# Grasshopper definition Gaussian_Elimination.gh (Grasshopper 0.9.76)

panel = Panel("2,-4,2;1,-3,-2;-3,8,9")
txt = Text("-3,8,9;2,-4,2;1,-3,-2")
split = TextSplit(Text=txt, Separators=";")
split_2 = TextSplit(Text=split, Separators=",")
item = ListItem(List=split_2, Index=0, Wrap=True)
lng = ListLength(List=flatten(item))
series = Series(Start=0, Step=1, Count=lng)
abs = Absolute(Value=item)
panel_3 = Panel(split_2)
int = Integer(series)
sort = SortList(Keys=flatten(abs), ValuesA=flatten(item))  # -> Keys, ValuesA
sort_2 = SortList(Keys=flatten(abs), ValuesA=int)  # -> Keys, ValuesA
path = ConstructPath(Indices=graft(sort_2.ValuesA))
viewer = ParamViewer(split_2)
replace = ReplacePaths(Data=split_2, Search=viewer, Replace=flatten(path))
item_2 = ListItem(List=replace, Index=0, Wrap=True)
series_2 = Series(Start=0, Step=1, Count="3")
shift = ShiftList(List=series_2, Shift=-1, Wrap=False)  # -> graft(List)
item_3 = ListItem(List=flatten(item_2), Index=-1, Wrap=True)
shift_2 = ShiftList(List=flatten(item_2), Shift=-1, Wrap=False)
path_2 = ConstructPath(Indices=shift)  # -> flatten(Branch)
panel_4 = Panel(shift_2)
panel_5 = Panel(item_3)
division = Division(A=item_3, B=shift_2)
split_3 = SplitTree(Data=replace, Masks=flatten(path_2))  # -> Positive, Negative
neg = Negative(Value=division)
multiplication = Multiplication(A=graft(neg), B=split_3.Positive)
panel_6 = Panel(neg)
addition = Addition(A=multiplication, B=split_3.Negative)
panel_7 = Panel(addition)
