# Grasshopper definition 160731_divCircle.gh (Grasshopper 0.9.76)
# plug-ins: Python Interpreter

nurbs = NurbsCurve(
    Vertices=[Point(-2.362783503, 5.729247896, 0), Point(-2.910558284, 2.591992332, 0), Point(-1.117840819, 0.5502863304, 0), Point(1.073258305, -0.3958701095, 0), Point(6.551006115, -0.6448586463, 0), Point(7.347769433, -6.969167481, 0), Point(2.367998697, -9.160266605, 0)],
    Degree=3,
    Periodic=False)  # -> Curve, Length, Domain
nurbs_2 = NurbsCurve(
    Vertices=[Point(-0.4704706229, -10.90318636, 0), Point(-3.557928479, -8.114514751, 0), Point(-4.255096382, -6.172404164, 0), Point(-1.964401844, -3.632721088, 0), Point(10.43522729, -0.5950609389, 0), Point(13.02470807, 4.534102919, 0), Point(8.592712117, 8.86650346, 0)],
    Degree=3,
    Periodic=False)  # -> Curve, Length, Domain
number_slider = Slider(3, range=0..100)
crv = Curve(reparameterize([nurbs.Curve, nurbs_2.Curve]))
crv_2 = Curve(reparameterize(nurbs.Curve))
pt = Point(Point(4, 3, 0))

number_slider_2 = Slider(1.682, range=0..10)  # disabled
python = PythonScript(x=crv_2, y=pt, count=number_slider, scale=number_slider_2)  # -> out, circles, radius, dist, pts, max; inputs x: Curve, y: Point3d, count: Int32; disabled
# ---------- python: Python ----------
import rhinoscriptsyntax as rs

pts =rs.DivideCurve(x,count)
t = x.ClosestPoint(y,-1)
new_pt = rs.EvaluateCurve(x,t[1])

dist = [rs.Distance(new_pt,i) for i in pts]
print (dist)


max = sorted(dist)[-1]
print (max)

"""
max = []
for i in range(len(dist)):
    temp = 0
    if dist[i]> temp:
        temp = dist[i]
max.append(temp)
"""
radius = [i/max*scale for i in dist]
circles = []
for i in xrange(len(pts)):
    circle = rs.AddCircle(pts[i],radius[i])
    circles.append(circle)
# ---------- end python ----------
crv_cp = CurveClosestPoint(Point=pt, Curve=crv_2)  # -> Point, Parameter, Distance; disabled
divide = DivideCurve(Curve=crv_2, Count=number_slider, Kinks=False)  # -> Points, Tangents, Parameters; disabled
dist = Distance(PointA=crv_cp.Point, PointB=divide.Points)  # disabled
bnd = Bounds(Numbers=dist)  # disabled
dedomain = DeconstructDomain(Domain=bnd)  # -> Start, End; disabled
remap = RemapNumbers(Value=dist, Source=dedomain.End, Target=Domain(0, 1))  # -> Mapped, Clipped; disabled
multiplication = Multiplication(A=remap.Mapped, B=number_slider_2)  # disabled
cir = Circle(Plane=divide.Points, Radius=multiplication)  # disabled

number_slider_3 = Slider(1.46, range=0..10)
divide_2 = DivideCurve(Curve=crv, Count=number_slider, Kinks=False)  # -> Points, Tangents, Parameters
crv_cp_2 = CurveClosestPoint(Point=pt, Curve=crv)  # -> Point, Parameter, Distance
panel = Panel(python.radius)  # disabled
dist_2 = Distance(PointA=crv_cp_2.Point, PointB=divide_2.Points)
bnd_2 = Bounds(Numbers=dist_2)
python_2 = PythonScript(x=crv, y=pt, count=number_slider, scale=number_slider_3)  # -> out, circles, radius, dist, pts; inputs x: list of Curve, y: Point3d, count: Int32; disabled
# ---------- python_2: Python ----------
import rhinoscriptsyntax as rs
from Grasshopper.Kernel.Data import GH_Path
from Grasshopper import DataTree
import Rhino

circles_list =[]
dist_list = []
for i in range(len(x)):
    pts =rs.DivideCurve(x[i],count)
    t = x[i].ClosestPoint(y,-1)
    new_pt = rs.EvaluateCurve(x[i],t[1])

    dist = [rs.Distance(new_pt,i) for i in pts]
    print (dist)
    dist_list.append(dist)


    max = sorted(dist)[-1]
    print (max)
    
    """
    max = []
    for i in range(len(dist)):
        temp = 0
        if dist[i]> temp:
            temp = dist[i]
    max.append(temp)
    """
    radius = [i/max*scale for i in dist]
    print (radius)
    circles = []
    
    for j in xrange(len(pts)):
        circle = rs.AddCircle(pts[j],radius[j])
        circles.append(circle)
    circles_list.append(circles)

"""
pts = []
t_list = []
for i in range(len(x)):
    pt = rs.DivideCurve(x[i],count)
    t = x[i].ClosestPoint(y,0.0)
    pts.append(pt)
    t_list.append(t)

new_pts = []
for i in range(len(x)):
    new_pt = rs.EvaluateCurve(x[i],t_list[i][1])
    new_pts.append(new_pt)
    
dists = [rs.Distance(new_pts[i],pts[i]) for i in range(len(pts))]

max = []
for i in range(len(x)):
    m = dists[i][-1]
    max.append(m)


radius = []
for i in range(len(x)):
    radiu = []
    for j in range(len(dists[i])):
        r = dists[i][j]/max[i] *scale
        radiu.append(r)
    radius.append(radiu)


circles = []
for i in range(len(x)):
    for j in range(len(dists[i])):
        circle = rs.AddCircle(pts[i][j],radius[i][j])
        print (pts[i][j])
        print (radius[i][j])
        print ("....")
    #circle = rs.AddCircle(pts[i],radius[i])
        circles.append(circle)
"""
# ---------- end python_2 ----------
python_3 = PythonScript(x=crv, y=pt, count=number_slider, scale=number_slider_3)  # -> out, circles, radius, dist, pts; inputs x: list of Curve, y: Point3d, count: Int32
# ---------- python_3: Python ----------
import rhinoscriptsyntax as rs
from Grasshopper.Kernel.Data import GH_Path
from Grasshopper import DataTree
import Rhino



pts = []
t_list = []
for i in range(len(x)):
    pt = rs.DivideCurve(x[i],count)
    t = x[i].ClosestPoint(y,0.0)
    pts.append(pt)
    t_list.append(t)

new_pts = []
for i in range(len(x)):
    new_pt = rs.EvaluateCurve(x[i],t_list[i][1])
    new_pts.append(new_pt)
    
dists = [rs.Distance(new_pts[i],pts[i]) for i in range(len(pts))]

max = []
for i in range(len(x)):
    m = dists[i][-1]
    max.append(m)


radius = []
for i in range(len(x)):
    radiu = []
    for j in range(len(dists[i])):
        r = dists[i][j]/max[i] *scale
        radiu.append(r)
    radius.append(radiu)


circles = []
for i in range(len(x)):
    for j in range(len(dists[i])):
        circle = rs.AddCircle(pts[i][j],radius[i][j])
        print (pts[i][j])
        print (radius[i][j])
        print ("....")
    #circle = rs.AddCircle(pts[i],radius[i])
        circles.append(circle)
# ---------- end python_3 ----------
dedomain_2 = DeconstructDomain(Domain=bnd_2)  # -> Start, End
panel_2 = Panel(python_2.dist)
remap_2 = RemapNumbers(Value=dist_2, Source=dedomain_2.End, Target=Domain(0, 1))  # -> Mapped, Clipped
crv_3 = Curve(python_3.circles)
multiplication_2 = Multiplication(A=remap_2.Mapped, B=number_slider_3)
cir_2 = Circle(Plane=divide_2.Points, Radius=multiplication_2)
panel_3 = Panel(remap_2.Mapped)
panel_5 = Panel(dist_2)
