# Grasshopper definition 160801_StringReverse.gh (Grasshopper 0.9.76)
# plug-ins: Python Interpreter

python = PythonScript()  # -> out, x, c
# ---------- python: Python ----------
#根据ascii码 大-->小
x = "LMNSWEFJIJMABC"
L = list(x)

c = ''
for i in range(len(L)):
    max = 'A'
    for j in range(len(L)):
        if L[j]>max:
            max = L[j]
    c = c+max
    L.remove(max)
    L.append('A')

print (c)
# ---------- end python ----------
python_2 = PythonScript()  # -> out, x, c
# ---------- python_2: Python ----------
x = "ABCDEFGHIJKLMN"
c = ''
for i in range(len(x)):
    c = c+x[-(i+1)]

print (c)
# ---------- end python_2 ----------
join = TextJoin(Text=python_2.c)
panel = Panel(python_2.c)
join_2 = TextJoin(Text=python.c)
panel_2 = Panel(join)
panel_3 = Panel(python.x)
panel_4 = Panel(join_2)
