# Grasshopper definition 160806_stairs_0020902.gh (Grasshopper 0.9.76)
# plug-ins: Python Interpreter

梯段厚 = Slider(275, range=150..400)
md_slider = MDSlider(
    slider_value=Point(0.6064434052, 0.3894286621, 0.5),
    SliderMode=0,
    x_domain=Domain(-1000, 1000),
    y_domain=Domain(-2000, 2000),
    z_domain=Domain(0, 1))
rotate = Slider(0, range=0..1)
box_height = Slider(2558, range=0..10000)
梯段宽 = Slider(2262.52, range=800..5000)
间距 = Slider(319, range=0..1000)
平台宽度 = Slider(2717, range=1000..5000)
平台厚度 = Slider(126.14, range=100..150)
梁的宽度 = Slider(238.21, range=100..350)
梁高 = Slider(385.25, range=300..550)

python = PythonScript(
    trans=md_slider,
    angle=rotate,
    box_length=Slider(4972, range=0..10000),
    box_width=Slider(4871, range=0..10000),
    box_height=box_height,
    stairsLength=梯段宽,
    stairsThickness=梯段厚,
    distance=间距,
    platformWidth=平台宽度,
    platformThickness=平台厚度,
    beamWidth=梁的宽度,
    beamHeight=梁高,
    tolerance=Slider(26, range=0..1000))  # -> out, stepCount, stepWidth, stepHeight, l, w, h, objs; inputs trans: Point3d, stairsLength: Int32, stairsThickness: Int32, distance: Int32, platformWidth: Int32, platformThickness: Int32, beamWidth: Int32, beamHeight: Int32
# ---------- python: Python ----------
import rhinoscriptsyntax as rs
import random as rand
import math

def getsize(domain_t,domain_r,domain_tadd2r,commendSlope,basicSlope,specialType=False):
    """get  step size from norm of stair,t represent tread,r represent step height
    Parameters:
        domain_t:tuple,(min_t,max_t)
        domain_r:tuple,(min_r,max_r)
        domain_r:tuple,(min_tadd2r,max_tadd2r)
        commendSlope:float,r/t
        basicSlope:r/t
    Returns:
        size
    """
    if specialType: #when norm is loose , take basic slope
        slope = basicSlope 
    else:
        slope = commendSlope
    sizeLst = []
    rangestep = 3
    epsilion = 0.01
    for t in xrange(domain_t[0],domain_t[1],rangestep):
        for r in xrange(domain_r[0],domain_r[1],rangestep):
            if (domain_tadd2r[0]<= t+2*r <= domain_tadd2r[1]) and ((r/t) <= slope):
                sizeLst.append((t,r))
    if sizeLst == []:
        return None
        print ('there is no appropriate size')
    else:
        size = sizeLst[0]
        return size

def settype(housingType=0):
    """select achitecture type:
    Parameters:
        housingType:int,0:tinyhouse
                        1:public housing internal
                        2:public housing external
    Returns:domain_t,tuple
            domain_r,tuple
            domain_tadd2r,tuple,
            commendSlope,float
            basicSlope,float
    """
    typeRange = [0,1,2]
    assert housingType in typeRange ,'Please set type between [0,2]'
    if housingType == 0:
        domain_t, domain_r, domain_tadd2r, commendSlope, basicSlope= (180,360),(120,210),(550,650),7/11,6/7
    elif housingType ==1:
        domain_t, domain_r, domain_tadd2r, commendSlope, basicSlope= (300,1000),(0,160),(550,650),7/11,7/11 #tread more than 300 is all right 
    else:
        domain_t, domain_r, domain_tadd2r, commendSlope, basicSlope= (300,1000),(0,160),(550,650),7/11,7/11
    return domain_t,domain_r,domain_tadd2r,commendSlope,basicSlope
try:
    print (settype())
    print (getsize(settype()[0],settype()[1],settype()[2],settype()[3],settype()[4]))
except IOError as e:
    raise ('error:%s'% e)
    
    
#/// 创建一个收集实体的list
objs = []
#///离散得到满足规范的楼梯踏步与踢面的尺寸
step_size = []
#///以下为住宅楼梯规范
for t in xrange(180,360,3):
    for r in xrange(120,210,3):
        if (550<=t+2*r<=650) and (r/t <=(7/11)):
            step_size.append((t,r))
            #print ("踏面:%s,阶高:%s"%(t,r))

#///给出一个box，box 有length,width,height三个属性，让楼梯限制在三个属性内，后面有反馈误差
#///在尺寸满足的前提下，根据给出的box_width和box_length得到楼梯的步数
countList = []
for count in xrange(0,20):
    for i in xrange(len(step_size)):
        #///用tolerance来控制精度
        if (abs((count-1)*step_size[i][0]+platformWidth-box_width)<=tolerance) and (abs((count*2*step_size[i][1])-box_height)<=tolerance ):
            countList.append((count,step_size[i][0],step_size[i][1]))
#seed = rand.randint(0,len(countList)) 怎么做到随机

#///记录下初始的box长宽高三属性,能够在后面反馈出误差
init_l = box_length
init_w = box_width
init_h = box_height


#///对stairsLength进行修正
#///在distance>0的情况下，boxWidth改变对间距和楼梯宽的权重
if (stairsLength*2+distance != box_length) and(distance>0):
    dist = stairsLength*2+distance-box_length
    #if distance>=0:
    distance -=dist*0.4
    stairsLength -=dist*0.3
#///如果间距不存在了，给他一个固定的间距。正确情况是，box_length如果太小了，保持梯段的宽度，缩小间距   
if (distance<=20):
    distance = 500
    stairsLength = (box_length-distance)/2
    #///正确情况是，box_length如果太小了，保持梯段的宽度，缩小间距 
    if stairsLength <=1000:
        stairsLength = 1000
        distance = (box_length-2*stairsLength)
        #///如果这个时候间距也小于20了,程序不能运行
        if distance<20:
            distance = 20
            print ("Error:%s"% "there is no distance betweeen stairs")

#///根据平台宽度需要大于等于楼梯宽度的规范，进行函数制约       ##########Error#########
def PlatformWidth():
    pass

#索引countList第一个值，得到踏步的尺寸和数量
stepCount = countList[0][0]
stepWidth = countList[0][1]
stepHeight = countList[0][2]

#///重新给box的三个属性赋值
box_width = (stepCount-1)*stepWidth + platformWidth
box_length = (stairsLength*2+distance) 
#distance = box_length-stairsLength*2
box_height = stepCount*2*stepHeight
#///插写梯段厚的函数
slope_cos = ((stepCount-1)*stepWidth)/math.sqrt((box_height*0.5)**2+((stepCount-1)*stepWidth)**2)#///坡度的余弦值
thick = stairsThickness/slope_cos
print (stepCount)


def AddStairsPts(x_direction=False):
    """
    Parameters:
        x_direction = False --> down True -->up
    return:
        stair_step pts
    """
    #first save coordinate
    pts_x = []
    pts_z = []
    platPt_xz = []

    #先对楼梯的走向进行一个判断，下面生成梯段的时候调用同一函数，但输入的参数不同
    if x_direction == True:
        dist = distance
        plat_xyz = ((stepCount - 1) * stepWidth,dist,(stepCount * stepHeight))
        k = -1
    else:
        plat_xyz = (0,0,0)
        k = 1
        dist = 0 #确保第一个梯段不会移动
    for j in xrange(stepCount):
        pt_x1 = pt_x2 = plat_xyz[0] + k * j * stepWidth
    
        pts_x.append(pt_x1)
        pts_x.append(pt_x2)
    
        if j == 0:
            pt_z1 = plat_xyz[2] - thick
        else:
            pt_z1 = plat_xyz[2] + j * stepHeight
        if j == stepCount - 1:
            pt_z2 = pt_z1 - thick ####R### 厚度需要根据坡度建立三角函数关系
        else:
            pt_z2 = plat_xyz[2] + j * stepHeight + stepHeight
        pts_z.append(pt_z1)
        pts_z.append(pt_z2)

    #add points ,still need to revise to doubles!
    pts = []
    for i in xrange(len(pts_z)):
        pt = rs.AddPoint(pts_x[i],dist,pts_z[i])
        #print (pts_x[i],0,pts_z[i])
        pts.append(pt)
    return pts

a = AddStairsPts(False)#第一个梯段
b = AddStairsPts(True)#第二个梯段

def StairsPolyLine(*ptLists):
    """
    Parameters:
        ptLists = stairsStep points
    Returns:
        list:polyline of all stairs step
    """
    pls = []
    for ptList in ptLists:
        ptList = list(ptList)
        
        #repeat the first point in one stair
        ptList.append(ptList[0])
        #create polyline with pts,must care about DataStructure
        pl = rs.AddPolyline(ptList)
        pls.append(rs.AddPolyline(ptList))
        
    return pls   

lines = StairsPolyLine(a,b)

"""
def boundaryExtrude(polyline,path): ###R###
    surf = rs.AddPlanarSrf(polyline)
    #path = rs.AddCurve([(0,stairsLength,0),(0,0,0)]) 
    #polyline_brep = rs.coercebrep(polyline,True)
    #polyline = rs.coercecurve(polyline,-1)
    subs = rs.ExtrudeCurve(polyline,path) #//////版本问题 why rs.ExtrudeSurface can't be used
    
    return subs
    
#bou = boundaryExtrude(line)
"""

def ExtrudeStairs(polyline,bool):
    #这个函数写成list的形式，有点面向过程，但先试试看,
    #不能同时带入两个可变参
    if bool == True:
        path_stairs = rs.AddCurve([(0,0,0),(0,stairsLength,0)])
    else:
        path_stairs = rs.AddCurve([(0,stairsLength,0),(0,0,0)])
    stairs = rs.ExtrudeCurve(polyline,path_stairs)
    return stairs

#stairsStep = ExtrudeStairs(lines,False,True)
stairs1_step = ExtrudeStairs(lines[0],False)
stairs2_step = ExtrudeStairs(lines[1],True)
objs.append(stairs1_step)
objs.append(stairs2_step)

def platform():
    #add platform points orderly
    
    pts_list = []
    plat_pt1 = ((stepCount-1)*stepWidth,-stairsLength,(stepCount*stepHeight))
    plat_pt2 = (plat_pt1[0]+platformWidth,-stairsLength,plat_pt1[2])
    plat_pt3 = (plat_pt2[0],-stairsLength,plat_pt2[2]-(beamHeight+platformThickness))
    plat_pt4 = (plat_pt3[0]-beamWidth,-stairsLength,plat_pt3[2])
    plat_pt5 = (plat_pt4[0],-stairsLength,plat_pt4[2]+beamHeight)
    plat_pt6 = (plat_pt5[0]-platformWidth+2*beamWidth,-stairsLength,plat_pt5[2])
    plat_pt7 = (plat_pt6[0],-stairsLength,plat_pt3[2])
    plat_pt8 = (plat_pt1[0],-stairsLength,plat_pt3[2])###R###maybe creat list by range

    pts_list.append(plat_pt1)
    pts_list.append(plat_pt2)
    pts_list.append(plat_pt3)
    pts_list.append(plat_pt4)
    pts_list.append(plat_pt5)
    pts_list.append(plat_pt6)
    pts_list.append(plat_pt7)
    pts_list.append(plat_pt8)
    pts_list.append(plat_pt1)
    
    plat_pts = []
    #print (pts_list)
    for i in pts_list:
        pt = rs.AddPoint(i)
        plat_pts.append(pt)
    
    #creat platform polyline
    platform_pl = rs.AddPolyline(plat_pts)
    path_plat = rs.AddLine((0,0,0),(0,2*stairsLength+distance,0)) ####2*stairsLength + distance = platformLength写之间的限制函数
    platform = rs.ExtrudeCurve(platform_pl,path_plat)
    return platform
    
plat = platform()
objs.append(plat)


def moveRotate():
    rs.MoveObject(objs,trans)
    rs.RotateObjects(objs,trans,angle*360,(0,0,1))
    return objs
    
moveRotate()

#///反馈
#width
width = (stepCount-1)*stepWidth+platformWidth
tol_w = init_w-width
w = (width,tol_w)

#box_length
length = stairsLength*2+distance #///这里stairsLength distance应该是被权重之后的值
tol_l = init_l-length
l = (length,tol_l)

#height
height = stepCount*2*stepHeight
tol_h = init_h-height
h = (height,tol_h)


"""
#///160813
写楼梯种类变化前的代码，先整理简化之前双跑楼梯的代码，考虑点的添加方式，优化数据结构和算法
    调换好length width的顺序
把自己理解的和规范都写进代码里
明确另外的几种情况:直行单跑楼梯，平行转梯，（旋转楼梯），折行双跑楼梯，折行旋转梯，折行三跑楼梯

"""
# ---------- end python ----------
panel = Panel(python.stepCount)
panel_2 = Panel(python.stepWidth)
panel_3 = Panel(python.stepHeight)
panel_4 = Panel(python.l)
panel_5 = Panel(python.w)
# 8.2.4 主要疏散楼梯应符合下列规定：
# 1 踏步宽度不应小于0.28m，踏步高度不应大于0.16m，连续踏步不超过18 级， 超过18 级时，应加设中间休息平台，楼梯平台宽度不应小于梯段宽度，并不得小于 1.10m；
# 2 不得采用螺旋楼梯，采用扇形梯段时，离踏步窄端扶手水平距离0.25m 处踏步宽度不应小于0.22m，宽端扶手处不应大于0.50m，休息平台窄端不小于1.20m；
panel_6 = Panel(python.h)
# 5.7.3 套内楼梯一边临空时，梯段净宽不应小于0.75m;当两侧有墙时,墙面净宽不应小于0.90，并应在其中一侧墙面设置扶手
# 
# 5.7.4 套内楼梯的踏步宽度不应小于0.22m;高度不应大于0.20m,扇形踏步转角距离扶手中心0.25m处，宽度不应小于0.22m
# 
# 6．1．4 公共出入口台阶踏步宽度不宜小于0．30m，踏步高度不宜大于0．15m，并不宜小于0．10m，踏步高度应均匀一致，并应采取防滑措施。台阶踏步数不应少于2级，当高差不足2级时，应按坡道设置；台阶宽度大于1．80m时，两侧宜设置栏杆扶手，高度应为0．90m。
panel_7 = Panel("""住宅楼梯(踏面=T,阶高=R)
550<=T+2R<=650
180<=T<=360,120<=R<=210
推荐倾斜度<=7/11
基本倾斜度<=6/7
不得已的情况下倾斜<=22/21,T>=195 T+2R=650

集合住宅、公用部分的公用楼梯
550<=T+2R<=650
推荐尺寸 T>=300,R<=160
基本倾斜度<=7/11,不得已的情况下T>=240

集合住宅、公用部分的室外楼梯
550<=T+2R<=650
推荐尺寸 T>=300,R<=160
不得已的情况下T>=240,550<=T+2R<=650""")
