# Grasshopper definition 160810_shortestList.gh (Grasshopper 0.9.76)
# plug-ins: Python Interpreter

series = Series(Start=0, Step=1, Count=Slider(7, range=0..10))
series_2 = Series(Start=0, Step=1, Count=Slider(3, range=0..10))
int = Integer(series_2)
panel = Panel(int)
int_2 = Integer(series)
panel_2 = Panel(int_2)
python = PythonScript(x=int, y=int_2)  # -> out, a; inputs x: list of Int32, y: list of Int32
# ---------- python: Python ----------
#LongList
if len(x)>len(y):
    n = len(x)
    last = y[-1]
    for i in range(len(x)-len(y)):
        y.append(last)
else:
    n = len(y)
    last = x[-1]
    for i in range(len(y)-len(x)):
        x.append(last)

a = []
for i in xrange(n):
    a.append(x[i]*y[i])
# ---------- end python ----------
python_2 = PythonScript(x=int, y=int_2)  # -> out, a; inputs x: list of Int32, y: list of Int32
# ---------- python_2: Python ----------
#ShortList
if len(x)<len(y):
    n = len(x)
else:
    n = len(y)

a = []
for i in xrange(n):
    a.append(x[i]*y[i])
# ---------- end python_2 ----------
python_3 = PythonScript(x=int, y=int_2)  # -> out, a; inputs x: list of Int32, y: list of Int32
# ---------- python_3: Python ----------
#CrossReference
a = []
for i in xrange(len(x)):
    for j in range(len(y)):
        a.append(x[i]*y[j])
# ---------- end python_3 ----------
short = ShortestList(ListA=int, ListB=int_2, TrimMode=2)  # -> ListA, ListB
long = LongestList(ListA=int, ListB=int_2, PaddingMode=2)  # -> ListA, ListB
crossref = CrossReference(ListA=int, ListB=int_2, CrossMode=1)  # -> ListA, ListB
multiplication = Multiplication(A=int, B=int_2)
panel_3 = Panel(python.a)
panel_4 = Panel(python_2.a)
panel_5 = Panel(python_3.a)
multiplication_2 = Multiplication(A=short.ListA, B=short.ListB)
multiplication_3 = Multiplication(A=crossref.ListA, B=crossref.ListB)
multiplication_4 = Multiplication(A=long.ListA, B=long.ListB)
panel_6 = Panel(multiplication)
python_4 = PythonScript(x=multiplication_3)  # -> out, a; inputs x: list of Int32
# ---------- python_4: Python ----------
a = sorted(x)
# ---------- end python_4 ----------
panel_7 = Panel(python_4.a)
concat = Concatenate(FragmentA=long.ListA, FragmentB=long.ListB)
concat_2 = Concatenate(FragmentA=short.ListA, FragmentB=short.ListB)
concat_3 = Concatenate(FragmentA=crossref.ListA, FragmentB=crossref.ListB)
python_5 = PythonScript(x=int, y=int_2)  # -> out, a; inputs x: list of Int32, y: list of Int32
# ---------- python_5: Python ----------
#LongList
if len(x)>len(y):
    n = len(x)
    last = y[-1]
    for i in range(len(x)-len(y)):
        y.append(last)
else:
    n = len(y)
    last = x[-1]
    for i in range(len(y)-len(x)):
        x.append(last)

a = []
for i in xrange(n):
    a.append(str(x[i])+str(y[i]))
# ---------- end python_5 ----------
series_3 = Series(Start=0, Step=1, Count=10)
item = ListItem(List=series_3, Index=Slider(5, range=0..10), Wrap=True)
index = ItemIndex(List=series_3, Item=item)
panel_8 = Panel(concat_3)
panel_9 = Panel(concat_2)
panel_10 = Panel(concat)
panel_11 = Panel(index)
number_slider = Slider(9.04, range=0..10)
number_slider_2 = Slider(8.4262, range=0..10)
pt = ConstructPoint(XCoordinate=0, YCoordinate=0, ZCoordinate=0)
number_slider_3 = Slider(6, range=0..10)
X = UnitX(Factor=number_slider)
pt_2 = Point(pt)
neg = Negative(Value=number_slider_2)
move = Move(Geometry=pt_2, Motion=X)  # -> Geometry, Transform
ln = Line(StartPoint=pt_2, EndPoint=move.Geometry)
offset = Offset(Curve=ln, Distance=neg, Plane=PlaneXY(0, 0, 0), Corners=1)
python_6 = PythonScript(pt=pt_2, mov=number_slider, offs=number_slider_2, div=number_slider_3, way=Slider(2, range=0..2))  # -> out, a, ptList, new_pts, off_line, lines; inputs div: Int32
# ---------- python_6: Python ----------
import rhinoscriptsyntax as rs

#移动点，画出直线
line = rs.AddLine((0,0,0),(mov,0,0))
#等分直线，返回等分点list
ptList = rs.DivideCurve(line,div)
#获得前面三个点
pts = ptList[:3]

#偏移曲线
off_line = rs.OffsetCurve(line,(0,1,0),offs)
#得到曲线最近点
new_pts = []
for i in xrange(len(pts)):
    t = rs.CurveClosestPoint(off_line,pts[i])
    new_pt = rs.EvaluateCurve(off_line,t)
    new_pts.append(new_pt)
#相互连接的方式探究
l1 = len(new_pts)
l2 = len(ptList)
if way ==0:
    #Longest
    if l1<l2:
        last = new_pts[-1]
        for i in xrange(l2-l1):
            new_pts.append(last)
    else:
        last = ptList[-1]
        for i in xrange(l1-l2):
            ptList.append(last)

    lines = []
    for j in xrange(len(new_pts)):
        line = rs.AddLine(ptList[j],new_pts[j])
        lines.append(line)

if way ==1:
    #Shortest
    lines = []
    if l1<l2:
        for i in xrange(l1):
            line = rs.AddLine(ptList[i],new_pts[i])
            lines.append(line)
    else:
        for i in xrange(l2):
            line = rs.AddLine(ptList[i],new_pts[i])
            lines.append(line)
            
if way == 2:
    #Cross Reference
    lines = []
    for i in xrange(l1):
        for j in xrange(l2):
            line = rs.AddLine(new_pts[i],ptList[j])
            lines.append(line)
# ---------- end python_6 ----------
panel_12 = Panel("""0
1
2""")
divide = DivideCurve(Curve=ln, Count=number_slider_3, Kinks=False)  # -> Points, Tangents, Parameters
item_2 = ListItem(List=divide.Points, Index=panel_12, Wrap=True)
crv_cp = CurveClosestPoint(Point=item_2, Curve=offset)  # -> Point, Parameter, Distance
crv = Curve(python_6.a)
crossref_2 = CrossReference(ListA=divide.Points, ListB=crv_cp.Point, CrossMode=1)  # -> ListA, ListB
ln_2 = Line(StartPoint=crossref_2.ListA, EndPoint=crossref_2.ListB)
