# Grasshopper definition 160811_carpenterworm_terrain.gh (Grasshopper 0.9.76)
# plug-ins: Python Interpreter

xy = XYPlane(Origin=Point(0, 0, 0))
rectangle = Rectangle(Plane=xy, XSize=Domain(-1, 1), YSize=Domain(-2, 2), Radius=0)  # -> Rectangle, Length
explode = Explode(Curve=rectangle.Rectangle, Recursive=True)  # -> Segments, Vertices
item = ListItem(List=explode.Segments, Index=0, Wrap=True)
nurbs = NurbsCurve(
    Vertices=[Point(32.34588297, -19.72844037, 0), Point(29.00849157, -11.86197139, 0), Point(15.69650923, -13.01753655, 0), Point(5.291738452, -37.92448137, 0), Point(9.037914677, -53.52815485, 0), Point(23.62189207, -63.28984211, 0), Point(36.16571, -64.40817294, 0), Point(41.7077964, -55.00034845, 0), Point(29.64734218, -44.01940302, 0), Point(27.26602613, -27.21383641, 0), Point(32.21607431, -19.69005976, 0)],
    Degree=3,
    Periodic=False)  # -> Curve, Length, Domain

dom = ConstructDomain(DomainStart="0", DomainEnd="1")
range = Range(Domain=dom, Steps="10")
sin = Sine(Value=range)
bnd = Bounds(Numbers=sin)
num = Number("10")
dom_2 = ConstructDomain(DomainStart="0", DomainEnd="0.5")
remap = RemapNumbers(Value=sin, Source=bnd, Target=dom_2)  # -> Mapped, Clipped
subtraction = Subtraction(A="1", B=remap.Mapped)
pt = Point([Point(42.46837865, -51.50928605, 0), Point(34.47753216, -44.36080289, 0), Point(30.16110363, -37.38473858, 0), Point(30.57866686, -27.37965963, 0), Point(36.2149887, -21.91782261, 0)])
nurbs_2 = NurbsCurve(Vertices=pt, Degree=3, Periodic=False)  # -> Curve, Length, Domain
merge = Merge(Data1=remap.Mapped, Data2=subtraction)
neg = Negative(Value="3")
sort = SortList(Keys=merge)  # -> Keys, ValuesA
dcon = DeleteConsecutive(Set=sort.Keys, Wrap=False)  # -> Set, Count
eval = EvaluateLength(Curve=nurbs_2.Curve, Length=dcon.Set, Normalized=True)  # -> Point, Tangent, Parameter
pframe = PerpFrame(Curve=nurbs_2.Curve, Parameter=eval.Parameter)
panel = Panel("""0
1""")
multiplication = Multiplication(A="3", B="2.5")
num_2 = Number(multiplication)
dom_3 = ConstructDomain(DomainStart="3", DomainEnd=neg)
dispatch = Dispatch(List=pframe, DispatchPattern=panel)  # -> ListA, ListB
vdis = VectorDisplay(Anchor=eval.Point, Vector=eval.Tangent)
neg_2 = Negative(Value=multiplication)
dedomain = DeconstructDomain(Domain=dom_3)  # -> Start, End
subtraction_2 = Subtraction(A=dedomain.Start, B=dedomain.End)
num_3 = Number(subtraction_2)
python = PythonScript(pts=pt, weight=num_3, height=num_2, n=num)  # -> out, curve, plane_even, recList_even; inputs pts: list, n: Int32
# ---------- python: Python ----------
import rhinoscriptsyntax  as rs 
import math

#创建曲线
curve = rs.AddCurve(pts,3)
#创建中间密，两边疏的数列，0<=t<=1
tList1 = [math.sin(i) for i in rs.frange(0,1,1/n)]
source = tList1[-1]
tList = []
for t in tList1:
    new_t1 = (t/source*0.5)
    new_t2 = 1-new_t1
    tList.append(new_t1)
    tList.append(new_t2)
tList = sorted(list(set(tList)))


#根据数列创建点
crvDomain = rs.CurveDomain(curve)
print (crvDomain)
crvLength = rs.CurveLength(curve)
print (crvLength)
ptList =[rs.EvaluateCurve(curve,t*crvDomain[1]) for t in tList] 


#偶数点位置建立矩形
pts_even = []
plane_even = []
recList_even = []
for i in xrange(len(tList)):
    #偶数情况下
    if i%2 ==0:
        plane = rs.CurvePerpFrame(curve,tList[i]*crvDomain[1])
        plane_even.append(plane)
        recList_even.append(rs.AddRectangle(plane,weight,height))
# ---------- end python ----------
rectangle_2 = Rectangle(Plane=dispatch.ListB, XSize=dom_3, YSize=neg_2, Radius=0)  # -> flatten(Rectangle), Length

fib = Fibonacci(SeedA=1, SeedB=1, Number=10)
dom_4 = ConstructDomain(DomainStart=["0", "1"], DomainEnd="0.5")
range_2 = Range(Domain=dom_4, Steps=10)
lng = ListLength(List=range_2)
smaller = SmallerThan(FirstNumber=fib, SecondNumber=lng)  # -> SmallerThan, OrEqualTo
sift = SiftPattern(List=fib, SiftPattern=smaller.OrEqualTo)  # -> Output0, Output1
bool = Boolean(sift.Output1)
cull = CullPattern(List=sift.Output1, CullPattern=bool)
neg_3 = Negative(Value=cull)
item_2 = ListItem(List=range_2, Index=neg_3, Wrap=True)

crv = Curve(<curve referenced from the Rhino model>)

panel_2 = Panel("0")  # disabled
panel_3 = Panel("1")  # disabled
python_2 = PythonScript()  # -> out, a
# ---------- python_2: Python ----------
tList = [0.0, 0.059320771868099302, 0.11804883019253268, 0.17559738362743749, 0.23139142604991469, 0.28487348183113731, 0.33550917594855656, 0.38279257328448624, 0.42625123376255897, 0.46545093281280098, 0.5, 0.53454906718719908, 0.57374876623744098, 0.61720742671551376, 0.66449082405144344, 0.71512651816886263, 0.76860857395008531, 0.82440261637256251, 0.88195116980746735, 0.94067922813190075, 1.0]

print ("tList = %s"%tList)
print ("len(tList) = %s" % len(tList))
# ---------- end python_2 ----------
dom_5 = ConstructDomain(DomainStart=panel_2, DomainEnd=panel_3)  # disabled
panel_4 = Panel("10")  # disabled
python_3 = PythonScript()  # -> out, a
# ---------- python_3: Python ----------
import rhinoscriptsyntax as rs

l = []
for i in rs.frange(0,1,0.1):
    l.append(i)

print (l)
print (len(l))
# ---------- end python_3 ----------
range_3 = Range(Domain=dom_5, Steps=panel_4)  # disabled
panel_5 = Panel("0.5")  # disabled
panel_6 = Panel("0")  # disabled
pt_2 = Point([Point(49.60187365, -49.73002758, 0), Point(42.00222227, -52.5705548, 0), Point(36.12039335, -50.05383128, 0), Point(33.83865545, -44.38731967, 0), Point(37.6563742, -30.54051299, 0), Point(43.01022298, -26.32882711, 0), Point(53.5753055, -27.27006779, 0), Point(56.28888937, -27.1641037, 0)])
sin_2 = Sine(Value=range_3)  # disabled
bnd_2 = Bounds(Numbers=sin_2)  # disabled
num_4 = Number(panel_4)  # disabled
dom_6 = ConstructDomain(DomainStart=panel_6, DomainEnd=panel_5)  # disabled
python_4 = PythonScript(pts=pt_2)  # -> out, curve, pt1, pt2, pt3; inputs pts: list
# ---------- python_4: Python ----------
import rhinoscriptsyntax as rs 

curve = rs.AddCurve(pts)

crvDomain = rs.CurveDomain(curve)
print (crvDomain[1])
crvLength = rs.CurveLength(curve)
print (crvLength)

#比较t=crvDomain[1]*0.5的时候是否为曲线的中点

pt1 = rs.EvaluateCurve(curve,crvDomain[1]*0.5)

pt2 = rs.EvaluateCurve(curve,crvLength*0.5*(crvDomain[1]/crvLength))

pt3 = rs.EvaluateCurve(curve,0.5) #不是单纯的1
print (pt1)
print (pt2)
print (pt3)
# ---------- end python_4 ----------
remap_2 = RemapNumbers(Value=sin_2, Source=bnd_2, Target=dom_6)  # -> Mapped, Clipped; disabled
panel_7 = Panel("1")  # disabled
subtraction_3 = Subtraction(A=panel_7, B=remap_2.Mapped)  # disabled
pt_3 = Point([Point(42.46837865, -51.50928605, 0), Point(34.47753216, -44.36080289, 0), Point(30.16110363, -37.38473858, 0), Point(30.57866686, -27.37965963, 0), Point(36.2149887, -21.91782261, 0)])  # disabled
nurbs_3 = NurbsCurve(Vertices=pt_3, Degree=3, Periodic=False)  # -> Curve, Length, Domain; disabled
merge_2 = Merge(Data1=remap_2.Mapped, Data2=subtraction_3)  # disabled
panel_8 = Panel("3")  # disabled
neg_4 = Negative(Value=panel_8)  # disabled
panel_9 = Panel("2.5")  # disabled
sort_2 = SortList(Keys=merge_2)  # -> Keys, ValuesA; disabled
dcon_2 = DeleteConsecutive(Set=sort_2.Keys, Wrap=False)  # -> Set, Count; disabled
eval_2 = EvaluateLength(Curve=nurbs_3.Curve, Length=dcon_2.Set, Normalized=True)  # -> Point, Tangent, Parameter; disabled
pframe_2 = PerpFrame(Curve=nurbs_3.Curve, Parameter=eval_2.Parameter)  # disabled
panel_10 = Panel("""0
1""")  # disabled
multiplication_2 = Multiplication(A=panel_8, B=panel_9)  # disabled
num_5 = Number(multiplication_2)  # disabled
dom_7 = ConstructDomain(DomainStart=panel_8, DomainEnd=neg_4)  # disabled
dispatch_2 = Dispatch(List=pframe_2, DispatchPattern=panel_10)  # -> ListA, ListB; disabled
vdis_2 = VectorDisplay(Anchor=eval_2.Point, Vector=eval_2.Tangent)  # disabled
neg_5 = Negative(Value=multiplication_2)  # disabled
dedomain_2 = DeconstructDomain(Domain=dom_7)  # -> Start, End; disabled
subtraction_4 = Subtraction(A=dedomain_2.Start, B=dedomain_2.End)  # disabled
num_6 = Number(subtraction_4)  # disabled
python_5 = PythonScript(pts=pt_3, weight=num_6, height=num_5, n=num_4)  # -> out, curve, plane_even, recList_even; inputs pts: list, n: Int32; disabled; same code as python
rectangle_3 = Rectangle(Plane=dispatch_2.ListA, XSize=dom_7, YSize=neg_5, Radius=0)  # -> flatten(Rectangle), Length; disabled
rectangle_4 = Rectangle(Plane=dispatch_2.ListB, XSize=dom_7, YSize=neg_5, Radius=0)  # -> flatten(Rectangle), Length; disabled
panel_11 = Panel(rectangle_4.Rectangle)  # disabled
debrep = DeconstructBrep(Brep=rectangle_4.Rectangle)  # -> Faces, Edges, Vertices; disabled
number_slider = Slider(0.5, range=0..1)  # disabled
number_slider_2 = Slider(0.65, range=0..1)  # disabled
crv_2 = Curve(debrep.Edges)  # disabled
panel_12 = Panel("0")  # disabled
panel_13 = Panel("1")  # disabled
panel_14 = Panel("3")  # disabled
item_3 = ListItem(List=crv_2, Index=panel_12, Wrap=False)  # disabled
item_4 = ListItem(List=debrep.Edges, Index=panel_13, Wrap=False)  # disabled
item_5 = ListItem(List=debrep.Edges, Index=panel_14, Wrap=False)  # disabled
panel_15 = Panel("1")  # disabled
subtraction_5 = Subtraction(A=panel_15, B=number_slider_2)  # disabled
eval_3 = EvaluateLength(Curve=reparameterize(item_3), Length=number_slider, Normalized=True)  # -> Point, Tangent, Parameter; disabled
eval_4 = EvaluateLength(Curve=reparameterize(item_4), Length=number_slider_2, Normalized=True)  # -> Point, Tangent, Parameter; disabled
eval_5 = EvaluateLength(Curve=reparameterize(item_4), Length=panel_12, Normalized=True)  # -> Point, Tangent, Parameter; disabled
eval_6 = EvaluateLength(Curve=reparameterize(item_5), Length=panel_13, Normalized=True)  # -> Point, Tangent, Parameter; disabled
eval_7 = EvaluateLength(Curve=reparameterize(item_5), Length=subtraction_5, Normalized=True)  # -> Point, Tangent, Parameter; disabled
debrep_2 = DeconstructBrep(Brep=rectangle_3.Rectangle)  # -> Faces, Edges, Vertices; disabled
number_slider_3 = Slider(0.5, range=0..1)  # disabled
number_slider_4 = Slider(0.546, range=0..1)  # disabled
crv_3 = Curve(debrep_2.Edges)  # disabled
panel_16 = Panel("3")  # disabled
panel_17 = Panel("0")  # disabled
panel_18 = Panel("1")  # disabled
merge_3 = Merge(Data1=eval_7.Point, Data2=eval_3.Point, Data3=eval_4.Point, Data4=eval_5.Point, Data5=eval_6.Point)  # disabled
item_6 = ListItem(List=crv_3, Index=panel_17, Wrap=False)  # disabled
item_7 = ListItem(List=debrep_2.Edges, Index=panel_18, Wrap=False)  # disabled
item_8 = ListItem(List=debrep_2.Edges, Index=panel_16, Wrap=False)  # disabled
panel_19 = Panel("1")  # disabled
subtraction_6 = Subtraction(A=panel_19, B=number_slider_4)  # disabled
pline = PolyLine(Vertices=merge_3, Closed=False)  # -> flatten(Polyline); disabled
eval_8 = EvaluateLength(Curve=reparameterize(item_6), Length=number_slider_3, Normalized=True)  # -> Point, Tangent, Parameter; disabled
eval_9 = EvaluateLength(Curve=reparameterize(item_7), Length=number_slider_4, Normalized=True)  # -> Point, Tangent, Parameter; disabled
eval_10 = EvaluateLength(Curve=reparameterize(item_7), Length=panel_17, Normalized=True)  # -> Point, Tangent, Parameter; disabled
eval_11 = EvaluateLength(Curve=reparameterize(item_8), Length=panel_18, Normalized=True)  # -> Point, Tangent, Parameter; disabled
eval_12 = EvaluateLength(Curve=reparameterize(item_8), Length=subtraction_6, Normalized=True)  # -> Point, Tangent, Parameter; disabled
merge_4 = Merge(
    Data1=eval_8.Point,
    Data2=eval_9.Point,
    Data3=eval_10.Point,
    Data4=eval_11.Point,
    Data5=eval_12.Point,
    Data6=eval_8.Point)  # disabled
merge_5 = Merge(Data1=eval_9.Point, Data2=eval_8.Point, Data3=eval_12.Point, Data4=eval_11.Point, Data5=eval_10.Point)  # disabled
pline_2 = PolyLine(Vertices=merge_5, Closed=False)  # -> flatten(Polyline); disabled
weave = Weave(Pattern=[0, 1], Stream0=pline, Stream1=pline_2, NullGaps=False)  # disabled
loft = Loft(Curves=weave, Options={Adjust=False, Closed=False, LoftEnds=0, LoftSimp=0, LoftType=0, Rebuild=10, Refit=0.01})  # disabled
panel_20 = Panel(loft)

reb = RebuildCurve(Curve=crv, Count=10, Tangents=False)
python_6 = PythonScript(curv=reb)  # -> out, surf
# ---------- python_6: Python ----------
import rhinoscriptsyntax as rs

surf = rs.AddPlanarSrf(curv)
# ---------- end python_6 ----------
boundary = BoundarySurfaces(Edges=reb)
sdivide = DivideSurface(Surface=boundary, UCount="80", VCount="80")  # -> flatten(Points), Normals, Parameters
null = NullItem(Item=sdivide.Points)  # -> NullFlags, InvalidFlags, Description
sift_2 = SiftPattern(List=sdivide.Points, SiftPattern=null.NullFlags)  # -> Output0, Output1
incurve = PointInCurve(Point=flatten(sift_2.Output1), Curve=reb)  # -> Relationship, Point
equals = Equality(FirstNumber=incurve.Relationship, SecondNumber="1")  # -> Equality, Inequality
cull_2 = CullPattern(List=incurve.Point, CullPattern=equals.Equality)
crv_cp = CurveClosestPoint(Point=cull_2, Curve=reb)  # -> Point, Parameter, Distance
dist = Distance(PointA=crv_cp.Point, PointB=cull_2)
bnd_3 = Bounds(Numbers=dist)
number_slider_5 = Slider(9.727, range=0..10)
dom_8 = ConstructDomain(DomainStart="0", DomainEnd="10")
neg_6 = Negative(Value="3.2")
multiplication_3 = Multiplication(A="3.2", B="2.5")
pt_4 = Point([Point(0, 12.96976163, 10.7283371), Point(0, -5.840278184, 5.268946622), Point(14.98105258, 2.931522335, 5.268946622), Point(33.4481862, 3.091950647, -0.4919541319), Point(33.4481862, 31.99634701, 13.39455105), Point(33.4481862, 3.770628079, -0.0634812846)])
remap_3 = RemapNumbers(Value=dist, Source=bnd_3, Target=dom_8)  # -> Mapped, Clipped
Z = UnitZ(Factor=remap_3.Mapped)
move = Move(Geometry=cull_2, Motion=Z)  # -> Geometry, Transform
merge_6 = Merge(Data1=crv_cp.Point, Data2=move.Geometry)
dom_9 = ConstructDomain(DomainStart=neg_6, DomainEnd="3.2")
neg_7 = Negative(Value=multiplication_3)

explode_2 = Explode(Curve=rectangle_2.Rectangle, Recursive=True)  # -> Segments, Vertices
item_9 = ListItem(List=explode_2.Segments, Index="1", Wrap=True)
item_10 = ListItem(List=explode_2.Segments, Index="3", Wrap=True)
item_11 = ListItem(List=explode_2.Segments, Index="0", Wrap=True)
flip = FlipCurve(Curve=item_10)  # -> Curve, Flag
curvepoint = PointOnCurve(item_11, parameter=0.504)
curvepoint_2 = PointOnCurve([item_9, flip.Curve], parameter=0.317)
panel_21 = Panel("""0
1""")
weave_2 = Weave(Pattern=panel_21, Stream0=curvepoint, Stream1=curvepoint_2, NullGaps=False)  # -> simplify(Weave)
item_12 = ListItem(List=explode_2.Vertices, Index=["2", "3"], Wrap=True)  # -> simplify(Item)
ins = InsertItems(List=weave_2, Item=item_12, Indices="2", Wrap=True)  # -> simplify(List)
merge_7 = Merge(Data1=ins, Data2=simplify(curvepoint))
pline_3 = PolyLine(Vertices=merge_7, Closed=False)  # -> flatten(Polyline)

xy_2 = XYPlane(Origin=Point(0, 0, 0))
neg_8 = Negative(Value=number_slider_5)
Z_2 = UnitZ(Factor=number_slider_5)
del = DelaunayMesh(Points=pt_4, Plane=PlaneXY(0, 0, 0))
rectangle_5 = Rectangle(Plane=dispatch.ListA, XSize=dom_9, YSize=neg_7, Radius=0)  # -> Rectangle, Length
msmooth = SmoothMesh(Mesh=del, Strength=Slider(0.37, range=0..1), SkipNaked=True, Iterations=1)
Z_3 = UnitZ(Factor=neg_8)
explode_3 = Explode(Curve=rectangle_5.Rectangle, Recursive=True)  # -> Segments, Vertices
item_13 = ListItem(List=explode_3.Segments, Index="1", Wrap=True)
item_14 = ListItem(List=explode_3.Segments, Index="3", Wrap=True)
move_2 = Move(Geometry=xy_2, Motion=Z_2)  # -> Geometry, Transform
msplit = MeshSplitPlane(Mesh=msmooth, Plane=move_2.Geometry)  # -> Above, Below
item_15 = ListItem(List=explode_3.Segments, Index="0", Wrap=True)
flip_2 = FlipCurve(Curve=item_14)  # -> Curve, Flag
mesh = Mesh(msplit.Above)
curvepoint_3 = PointOnCurve(item_15, parameter=0.504)
curvepoint_4 = PointOnCurve([item_13, flip_2.Curve], parameter=0.317)
move_3 = Move(Geometry=mesh, Motion=Z_3)  # -> Geometry, Transform
panel_22 = Panel("""0
1""")
panel_23 = Panel(null.NullFlags)
weave_3 = Weave(Pattern=panel_22, Stream0=curvepoint_3, Stream1=curvepoint_4, NullGaps=False)  # -> simplify(Weave)
item_16 = ListItem(List=explode_3.Vertices, Index=["2", "3"], Wrap=True)  # -> simplify(Item)
ins_2 = InsertItems(List=weave_3, Item=item_16, Indices="2", Wrap=True)  # -> simplify(List)
merge_8 = Merge(Data1=ins_2, Data2=simplify(curvepoint_3))
pline_4 = PolyLine(Vertices=merge_8, Closed=False)  # -> flatten(Polyline)
points = PointList(Points=merge_8, Size=Slider(2, range=0..10))
neg_9 = Negative(Value="0.8")
panel_24 = Panel("""0
1""")
offset = Offset(Curve=pline_4, Distance="0.35", Plane=dispatch.ListA, Corners=1)  # -> simplify(Curve)
weave_4 = Weave(Pattern=panel_24, Stream0=pline_4, Stream1=pline_3, NullGaps=False)
merge_9 = Merge(Data1=neg_9, Data2="0.8")  # -> graft(Result)
loft_opt = LoftOptions(Closed=False, Adjust=False, Rebuild=0, Refit=0, Type="3")

item_17 = ListItem(List=flatten(offset), Index=["0", "-1"], Wrap=True)  # -> simplify(graft(Item))

lng_2 = ListLength(List=flatten(offset))
loft_2 = Loft(Curves=weave_4, Options=loft_opt)
series = Series(Start="22", Step="4", Count="20")
debrep_3 = DeconstructBrep(Brep=loft_2)  # -> Faces, Edges, Vertices
subtraction_7 = Subtraction(A=lng_2, B="1")
neg_10 = Negative(Value="0.35")
crv_4 = Curve(item_17)
offset_2 = Offset(Curve=graft(crv_4), Distance=graft(merge_9), Plane=PlaneXY(0, 0, 0), Corners=1)  # -> simplify(Curve)
area = Area(Geometry=debrep_3.Faces)  # -> Area, Centroid
loft_opt_2 = LoftOptions(Closed=False, Adjust=False, Rebuild=0, Refit=0, Type="3")
item_18 = ListItem(List=debrep_3.Faces, Index=series, Wrap=True)
merge_10 = Merge(Data1=item_17, Data2=offset_2)
merge_11 = Merge(Data1="0", Data2=subtraction_7)
points_2 = PointList(Points=area.Centroid, Size=Slider(1.484, range=0..10))
join = BrepJoin(Breps=item_18)  # -> Breps, Closed
offset_3 = Offset(Surface=item_18, Distance=neg_10, Retrim=True)
loft_3 = Loft(Curves=merge_10, Options=loft_opt_2)
Z_4 = UnitZ(Factor="0.35")
join_2 = BrepJoin(Breps=offset_3)  # -> Breps, Closed
extr = Extrude(Base=join.Breps, Direction=Z_4)
