# Grasshopper definition 160811_skeleton.gh (Grasshopper 0.9.76)
# plug-ins: Python Interpreter, Weaverbird, Starling

number_slider = Slider(4, range=0..10)
number_slider_2 = Slider(4, range=0..10)
dom = ConstructDomain(DomainStart=0, DomainEnd="2")
random = Random(Range=dom, Number=1, Seed=Slider(56, range=0..100))
box = CenterBox(Base=PlaneXY(0, 0, 0), X=number_slider, Y=number_slider, Z=number_slider)
cyl = Cylinder(Base=PlaneXY(0, 0, 0), Radius=number_slider_2, Length=number_slider_2)
debrep = DeconstructBrep(Brep=box)  # -> Faces, Edges, Vertices
panel = Panel(random)
edges = BrepEdges(Brep=box)  # -> Naked, Interior, NonManifold
crv = Curve(debrep.Edges)
edges_2 = BrepEdges(Brep=cyl)  # -> Naked, Interior, NonManifold
edges_3 = BrepEdges(Brep=debrep.Edges)  # -> Naked, Interior, NonManifold
sph = Sphere(Base=PlaneXY(0, 0, 0), Radius=Slider(29.05, range=0..100))
popgeo = PopulateGeometry(Geometry=sph, Count=Slider(280, range=0..1000), Seed=1)
lng = ListLength(List=popgeo)
subtraction = Subtraction(A=lng, B="1")
dom_2 = ConstructDomain(DomainStart="0", DomainEnd=subtraction)
random_2 = Random(Range=dom_2, Number=Slider(50, range=0..100), Seed=Slider(27.08, range=0..100))
item = ListItem(List=popgeo, Index=random_2, Wrap=False)
number_slider_3 = Slider(71, range=0..100)
slhull3d = SlHull3D(Point3d=item)
volume = Volume(Geometry=slhull3d)  # -> Volume, Centroid
scale = Scale(Geometry=slhull3d, Center=volume.Centroid, Factor=Slider(0.936, range=0..1))  # -> Geometry, Transform
wbfacepolys = WeaverbirdsFacePolylines(Mesh=scale.Geometry)  # -> flatten(Polygons)
mesh_explode = PythonScript(mesh=slhull3d)  # -> out, a
# ---------- mesh_explode: Python ----------
import rhinoscriptsyntax as rs 

#Mesh Explode
a = rs.ExplodeMeshes(mesh)
# ---------- end mesh_explode ----------
graft = GraftTree(Tree=wbfacepolys, IncludeEmptyLists=True, IncludeNullItems=True)  # -> flatten(Tree)
item_2 = ListItem(List=graft, Index=number_slider_3, Wrap=False)
wbfacepolys_2 = WeaverbirdsFacePolylines(Mesh=mesh_explode.a)  # -> flatten(Polygons)
offset = Offset(Curve=wbfacepolys_2, Distance=Slider(0.8, range=-2..1), Plane=wbfacepolys_2, Corners=4)  # -> flatten(Curve)
item_3 = ListItem(List=offset, Index=number_slider_3, Wrap=False)

merge = Merge(Data1=graft(offset), Data2=graft(wbfacepolys))
loft = Loft(Curves=merge, Options={Adjust=False, Closed=False, LoftEnds=0, LoftSimp=0, LoftType=0, Rebuild=10, Refit=0.01})
debrep_2 = DeconstructBrep(Brep=loft)  # -> Faces, Edges, Vertices
edges_4 = BrepEdges(Brep=debrep_2.Faces)  # -> Naked, Interior, NonManifold

merge_2 = Merge(Data1=graft(wbfacepolys_2), Data2=graft(offset))
boundary = BoundarySurfaces(Edges=merge_2)  # -> simplify(Surfaces)
boundary_2 = BoundarySurfaces(Edges=edges_4.Naked)  # -> simplify(Surfaces)
path_mapper = PathMapper(boundary_2, source="{A;B}", target="{A}")
merge_3 = Merge(Data1=boundary, Data2=path_mapper)
join = BrepJoin(Breps=merge_3)  # -> Breps, Closed
mesh = MeshBrep(
    Brep=join.Breps,
    Settings={GridMaxCount=0, GridMinCount=16, JaggedSeams=False, MaxEdgeLength=0, MinEdgeLength=0.0001, MinTolerance=0, Refine=True, RefineAngle=0, RelativeTolerance=0.65, SimplePlanes=True, Tolerance=0})
wbcatmullclark = WeaverbirdsCatmullClarkSubdivision(MeshCurves=mesh, Level=Slider(2, range=0..10), SmoothNakedEdges=1)
mesh_2 = Mesh(wbcatmullclark)
wblaplace = WeaverbirdsLaplacianSmoothing(MeshCurves=slhull3d, Level=Slider(4, range=0..10), SmoothNakedEdges=1, Thin=1)
panel_2 = Panel(merge_3)
