# Grasshopper definition 160812_spiral_sweep1.gh (Grasshopper 0.9.76)
# plug-ins: Python Interpreter

# format
python = PythonScript()  # -> out, a
# ---------- python: Python ----------
print ("my name is {0}".format(75.9999,'.2f'))

print (format(65.442,'.2f'))
# ---------- end python ----------
dom = ConstructDomain(DomainStart="0", DomainEnd="20")
range = Range(Domain=dom, Steps="100")
multiplication = Multiplication(A=range, B="2")
cos = Cosine(Value=multiplication)
sin = Sine(Value=multiplication)
multiplication_2 = Multiplication(A=range, B=cos)
multiplication_3 = Multiplication(A=range, B=sin)
pt = ConstructPoint(XCoordinate=multiplication_3, YCoordinate=multiplication_2, ZCoordinate=range)
lng = ListLength(List=pt)
swatch = ColourSwatch(SwatchColor=RGB(255, 255, 255))
intcrv = Interpolate(Vertices=pt, Degree=3, Periodic=False, KnotStyle=1)  # -> Curve, Length, Domain
series = Series(Start="0", Step="10", Count=lng)
number_slider = Slider(2.146, range=0..10)
number_slider_2 = Slider(0.735, range=0..10)
item = ListItem(List=pt, Index=series, Wrap=False)
number_slider_3 = Slider(0.93, range=0..10)
number_slider_4 = Slider(0.182, range=0..10)
pframe = PerpFrame(Curve=intcrv.Curve, Parameter="0")
pline = PolyLine(Vertices=item, Closed=False)
pframe_2 = PerpFrame(Curve=pline, Parameter="0")
rectangle = Rectangle(Plane=pframe, XSize=number_slider, YSize=number_slider_2, Radius=0)  # -> Rectangle, Length
rectangle_2 = Rectangle(Plane=pframe_2, XSize=number_slider_3, YSize=number_slider_3, Radius=0)  # -> Rectangle, Length
swp1 = Sweep1(Rail=pline, Sections=rectangle_2.Rectangle, Miter=1)
swp1_2 = Sweep1(Rail=intcrv.Curve, Sections=rectangle.Rectangle, Miter=1)
python_2 = PythonScript(cir_x=number_slider, cir_y=number_slider_2, poly_x=number_slider_3, poly_y=number_slider_3)  # -> out, brep_int, brep_poly
# ---------- python_2: Python ----------
import rhinoscriptsyntax as rs
import math as ma
import Rhino.Geometry as rg

pts = []
for i in rs.frange(0,20,20/100):
    x = ma.sin(i*2)*i
    y = ma.cos(i*2)*i
    z = i
    pt = rs.AddPoint((x,y,z))
    pts.append(pt)

#interpCurve to sweep on rail
intCrv = rs.AddInterpCurve(pts)
print (type(intCrv))
plane_int = rs.CurvePerpFrame(intCrv,0)
rec_int = [rs.AddRectangle(plane_int,cir_x,cir_y)]
print (type(rec_int))
brep_int = rs.AddSweep1(intCrv,rec_int,closed = True)

#polyline to sweep on rail 
poly_pts = []
for i in xrange(0,len(pts),10):
    poly_pts.append(pts[i])
    
polyline = rs.AddPolyline(poly_pts)
plane_poly = rs.CurvePerpFrame(polyline,0)
rec_poly = [rs.AddRectangle(plane_poly,poly_x,poly_y)]
brep_poly =  rs.AddSweep1(polyline,rec_poly,closed = True)

#cap
cap_int = rs.CapPlanarHoles(brep_int)
cap_poly = rs.CapPlanarHoles(brep_poly)
# ---------- end python_2 ----------
cap = CapHoles(Brep=swp1)
cap_2 = CapHoles(Brep=swp1_2)
preview = CustomPreview(Geometry=cap_2, Shader=ColourSwatch(SwatchColor=RGB(255, 255, 255)))
preview_2 = CustomPreview(Geometry=cap, Shader=ColourSwatch(SwatchColor=RGB(0, 0, 0)))
