# Grasshopper definition 160815_foldingpaper_PythonFaltten.gh (Grasshopper 0.9.76)
# plug-ins: MeshEdit Components, Python Interpreter

pt = Point(<point referenced from the Rhino model>)
xz = XZPlane(Origin=pt)
number_slider = Slider(3.186, range=0..10)
recgrid = Rectangular(Plane=xz, SizeX="5", SizeY="15", ExtentX="5", ExtentY="1")  # -> Cells, Points
xy = XYPlane(Origin=Point(0, 0, 0))
cpoly = ControlPolygon(Curve=recgrid.Cells)  # -> Polygon, Points
boundary = BoundarySurfaces(Edges=recgrid.Cells)
neg = Negative(Value=number_slider)
rectangle = Rectangle(Plane=xy, XSize=Domain(-1, 1), YSize=Domain(-2, 2), Radius=0)  # -> Rectangle, Length
cpoly_2 = ControlPolygon(Curve=rectangle.Rectangle)  # -> Polygon, Points
area = Area(Geometry=boundary)  # -> Area, Centroid
explode = Explode(Curve=cpoly.Polygon, Recursive=True)  # -> Segments, Vertices
merge = Merge(Data1=number_slider, Data2=neg)
explode_2 = Explode(Curve=cpoly_2.Polygon, Recursive=True)  # -> Segments, Vertices
item = ListItem(List=explode.Segments, Index=["0", "2"], Wrap=True)
evalsrf = EvaluateSurface(Surface=boundary, Point=area.Centroid)  # -> Point, Normal, Frame
flatten = FlattenTree(Tree=recgrid.Cells, Path="{0}")
cpoly_3 = ControlPolygon(Curve=flatten)  # -> Polygon, Points
explode_3 = Explode(Curve=cpoly_3.Polygon, Recursive=True)  # -> Segments, Vertices
python = PythonScript(x=rectangle.Rectangle)  # -> out, a, b; inputs x: Curve
# ---------- python: Python ----------
import rhinoscriptsyntax as rs 

a = rs.CurveKnots(x)
b = rs.ExplodeCurves(x)
# ---------- end python ----------
panel = Panel(explode_2.Segments)
panel_2 = Panel(explode_2.Vertices)
eval = EvaluateLength(Curve=item, Length="0.5", Normalized=True)  # -> Point, Tangent, Parameter
unit = UnitVector(Vector=evalsrf.Normal)
amp = Amplitude(Vector=unit, Amplitude=merge)
python_2 = PythonScript(RecGrid=flatten)  # -> Out, A
panel_3 = Panel(explode_3.Segments)
vdis = VectorDisplay(Anchor=area.Centroid, Vector=amp)
move = Move(Geometry=eval.Point, Motion=amp)  # -> Geometry, Transform
panel_4 = Panel(python.b)
merge_2 = Merge(Data1=cpoly.Points, Data2=move.Geometry)
sort_pt = SortPoints(Points=merge_2)  # -> Points, Indices
dcon = DeleteConsecutive(Set=sort_pt.Points, Wrap=False)  # -> Set, Count
del = DelaunayMesh(Points=dcon.Set, Plane=boundary)
explode_4 = MeshExplode(Mesh=del, Interpolate=False)  # -> flatten(Faces)
number_slider_2 = Slider(2, range=0..10)
preview = CustomPreview(Geometry=del, Shader=ColourSwatch(SwatchColor=RGB(134, 156, 170)))
area_2 = Area(Geometry=explode_4)  # -> Area, Centroid
points = PointList(Points=area_2.Centroid, Size=number_slider_2)
python_3 = PythonScript(mesh=explode_4)  # -> out, xymeshes; inputs mesh: list of Mesh
# ---------- python_3: Python ----------
import rhinoscriptsyntax as rs 
mesh = mesh #导入外部程序的Mesh面

meshes = rs.ExplodeMeshes(mesh)#分解单一mesh面为多个
print (meshes[1])
print ("print meshes......")
xymeshes = []
for i in range(len(meshes)):
    if i == 0:#处理分解后第一个Mesh面的展平位置;
        mesh0point = rs.MeshVertices(meshes[i])
        print ("len = %d"%(len(mesh0point)))
        mesh0points = []
        for r in mesh0point:
            mesh0points.append([r[0],r[1],r[2]])
        print ("mesh0points = %s"%mesh0points)

        
        xymesh0 = rs.OrientObject(meshes[i],mesh0points,[[0,10,0],[10,0,0],[0,0,0]],1)
        xymeshes.append(xymesh0)
    
    else:#余下Mesh面的循环遍历
        vertices2 = rs.MeshVertices(meshes[i])
        vertices1 = rs.MeshVertices(meshes[i-1])
        
        vertices2lst = []
        vertices1lst = []
        for q in vertices2:
            vertices2lst.append([q[0],q[1],q[2]])
        for p in vertices1:
            vertices1lst.append([p[0],p[1],p[2]])
            
        ver =[m for m in vertices1lst for n in vertices2lst if m==n]
        print ("ver = %s"%ver)
        a = ver[0] #第一个共同点
        b = ver[1] #第二个共同点
        
        #找到相邻两个面共同顶点的索引；
        indexa = vertices1lst.index(a) 
        indexb = vertices1lst.index(b)
        #找到相邻两个面不共边的顶点
        cerf = [m for m in vertices1lst if m not in ver][0]
        cv = [m for m in vertices2lst if m not in ver][0]
        #定义面的延伸方向;
        refvertice = rs.MeshVertices(xymeshes[i-1])
        refvertices = []
        for x in refvertice:
            refvertices.append([x[0],x[1],x[2]])
        indexc = [c for c in range(0,3) if c != indexa and c!= indexb]
        print (indexc)
        refverticespoint = rs.MirrorObject(rs.AddPoint(refvertices[indexc[0]]),refvertices[indexa],refvertice[indexb])
        mirrorpoint = [rs.PointCoordinates(refverticespoint)]
        
        for z in mirrorpoint:
            mirrorpoint = [z[0],z[1],z[2]]
            
            #获得免得延展
            xymesh = rs.OrientObject(meshes[i],[a,b,cv],[refvertices[indexa],refvertices[indexb],mirrorpoint],1)
            xymeshes.append(xymesh)
            print (xymesh)
            
        vertice2lst = []
        vertice1lst = []
        ver = []
        print (xymeshes) #可以用print函数检查结果;
# ---------- end python_3 ----------
area_3 = Area(Geometry=python_3.xymeshes)  # -> Area, Centroid
preview_2 = CustomPreview(Geometry=python_3.xymeshes, Shader=ColourSwatch(SwatchColor=RGB(219, 225, 255)))
points_2 = PointList(Points=area_3.Centroid, Size=number_slider_2)
