# Grasshopper definition 160816_complex.gh (Grasshopper 0.9.76)
# plug-ins: Python Interpreter

pi = Pi(Factor=1)
eps = Epsilon(Factor=1)
E = NaturalLogarithm(Factor=1)
phi = GoldenRatio(Factor=1)
eps_2 = Epsilon(Factor="5")
E_2 = NaturalLogarithm(Factor="5")
phi_2 = GoldenRatio(Factor="5")
pi_2 = Pi(Factor="5")
panel = Panel(phi)
panel_2 = Panel(eps)
panel_3 = Panel(pi)
panel_4 = Panel(E)
panel_5 = Panel(eps_2)
panel_6 = Panel(E_2)
panel_7 = Panel(phi_2)

xy = XYPlane(Origin=Point(0, 0, 0))
cir = Circle(Plane=xy, Radius=Slider(33, range=0..100))
python = PythonScript(x=cir)  # -> out, a
# ---------- python: Python ----------
import rhinoscriptsyntax as rs

a = rs.DivideCurve(x,3)
# ---------- end python ----------
python_2 = PythonScript()  # -> out, pts
# ---------- python_2: Python ----------
import rhinoscriptsyntax as rs


complex0 = 1+2j
complex1 = 2+3j
complex2 = 3+4j
complexes = [complex0,complex1,complex2]
#通过复数创建点
pts = [rs.AddPoint(c.real,c.imag,0) for c in complexes]
# ---------- end python_2 ----------
pt = Point([Point(-25.43051709, -10.49826608, 0), Point(-20.52655741, -18.46781294, 0), Point(0.2043144784, -29.91034668, 0), Point(14.68255835, -19.65643544, 0), Point(27.07071078, -22.59853741, 0)])
pt_2 = Point(Point(16.16010563, 9.861479237, 0))
python_3 = PythonScript(x="5", y="3")  # -> out, a, b
# ---------- python_3: Python ----------
#a = x+(y)j

z = 3
b = 2+3j
print (b)

c = complex(2,3)
print (c)
# ---------- end python_3 ----------
preview = CustomPreview(Geometry=pt, Shader=ColourSwatch(SwatchColor=RGB(0, 0, 0)))
panel_8 = Panel(python_2.pts)
pdecon = Deconstruct(Point=pt)  # -> XComponent, YComponent, ZComponent
python_4 = PythonScript(x=pdecon.XComponent, y=pdecon.YComponent)  # -> out, ca, real, imag, conjs, modulus, argument; inputs x: list, y: list
# ---------- python_4: Python ----------
import math
import rhinoscriptsyntax as rs

#创建复数 create complex 
test = 5+2j
print (test)
#a = [complex(i,j) for i in x for j in y ] #///列表没有一一对应
#a = [complex(x[i],y[j]) for i in xrange(len(x)) for j in xrange(len(y)) if i==j] #///创建的有点复杂
#///较为简洁的创建解析列表
ca = [complex(x[i],y[i]) for i in xrange(len(x))]
print (ca)

#分解一个复数  complex components 
real = [n.real for n in ca]
imag = [n.imag for n in ca]

#得到共轭复数 complex conjugate
conjs = [c.conjugate() for c in ca] #///conjugata()是一个方法
print (conjs)

#复数的模 complex modulus 
modulus = [math.sqrt(((ca[i].real)**2+(ca[i].imag)**2)) for i in xrange(len(ca))]

#复数的辐角
vec = [rs.VectorCreate((0,0,0),(ca[m].real,ca[m].imag,0))for m in xrange(len(ca))]
argument = [rs.VectorAngle((1,0,0),vec[i])*(math.pi/180) for i in xrange(len(ca))]
print (argument)
# ---------- end python_4 ----------
panel_9 = Panel(python_4.ca)
panel_10 = Panel(python_4.real)
panel_11 = Panel(python_4.argument)
panel_12 = Panel(python_4.conjs)
panel_13 = Panel(python_4.imag)
panel_14 = Panel(python_4.modulus)
pdecon_2 = Deconstruct(Point=pt_2)  # -> XComponent, YComponent, ZComponent
pt_3 = ConstructPoint(XCoordinate=0, YCoordinate=0, ZCoordinate=0)
panel_15 = Panel(python_3.b)
complex = CreateComplex(Real=pdecon.XComponent, Imaginary=pdecon.YComponent)
panel_16 = Panel(complex)
complex_2 = CreateComplex(Real=pdecon_2.XComponent, Imaginary=pdecon_2.YComponent)

pdecon_3 = Deconstruct(Point=complex)  # -> XComponent, YComponent, ZComponent
complex_3 = ComplexComponents(Complex=complex)  # -> Real, Imaginary

vec2pt = Vector2Pt(PointA=pt_3, PointB=complex, Unitize=False)  # -> Vector, Length
panel_17 = Panel(pdecon_3.XComponent)
X = UnitX(Factor=1)
panel_18 = Panel(pdecon_3.YComponent)
vdis = VectorDisplay(Anchor=pt_3, Vector=vec2pt.Vector)
addition = Addition(A=complex, B=complex_2)
complex_conjugate = ComplexConjugate(Complex=complex)
pt_4 = Point(addition)

arg = ComplexArgument(Complex=complex)
angle = Angle(VectorA=X, VectorB=vec2pt.Vector)  # -> Angle, Reflex

sqr = Square(Value=complex_3.Real)
sqr_2 = Square(Value=complex_3.Imaginary)
panel_19 = Panel(complex_3.Imaginary)
panel_20 = Panel(complex_3.Real)
panel_21 = Panel(complex_conjugate)
points = PointList(Points=pt_4, Size=Slider(3.844, range=0..10))
panel_22 = Panel(arg)
panel_23 = Panel(angle.Angle)
addition_2 = Addition(A=sqr, B=sqr_2)

cmod = ComplexModulus(Complex=complex)
sqrt = SquareRoot(Value=addition_2)

panel_24 = Panel(cmod)
panel_25 = Panel(sqrt)
