# Grasshopper definition 160816_mathOperation.gh (Grasshopper 0.9.76)
# plug-ins: Python Interpreter

panel = Panel("""8
2
21
0.5""")
panel_2 = Panel("""5
6
2
8
4
9.2""")
panel_3 = Panel("""3.14
5.52
-3.8
-1.2""")
round = Round(Number=panel_3)  # -> Nearest, Floor, Ceiling
dom = ConstructDomain(DomainStart="0", DomainEnd="10")
max = Maximum(A=panel_2, B=panel)
min = Minimum(A=panel_2, B=panel)
panel_4 = Panel(round.Nearest)
panel_5 = Panel(round.Ceiling)
panel_6 = Panel(round.Floor)
random = Random(Range=dom, Number="10", Seed=2)
panel_7 = Panel("""8
2
1
1
3
9
6
2
0
6""")
panel_8 = Panel(max)
panel_9 = Panel(min)
division = Division(A="60", B="100")
ma = MassAddition(Input=random)  # -> Result, PartialResults
lng = ListLength(List=random)
multiplication = Multiplication(A=random, B=panel_7)
ma_2 = MassAddition(Input=panel_7)  # -> Result, PartialResults
extrz = Extremes(A=panel_2, B=panel)  # -> Mininum, Maximum
trunc = Truncate(Input=random, TruncationFactor=division)
trunc_2 = Truncate(Input=random, TruncationFactor="0")
lng_2 = ListLength(List=trunc_2)
multiplication_2 = Multiplication(A=lng_2, B="0.5")
python = PythonScript(x=panel_3)  # -> out, N, F, C, integer; inputs x: list
# ---------- python: Python ----------
import math

#实现Round运算器

#Nearest
N = [int(round(i)) for i in x]

#Floor
F = [int(math.floor(i)) for i in x]

#ceiling
C = [int(math.ceil(i)) for i in x]


#Integer
integer = [int(i) for i in x]
# ---------- end python ----------
panel_10 = Panel(random)
division_2 = Division(A=ma.Result, B=lng)
avr = Average(Input=random)
wav = WeightedAverage(Input=random, Weights=panel_7)
ma_3 = MassAddition(Input=multiplication)  # -> Result, PartialResults
panel_11 = Panel(extrz.Mininum)
panel_12 = Panel(extrz.Maximum)
split = SplitList(List=trunc_2, Index=multiplication_2)  # -> ListA, ListB
panel_13 = Panel(trunc)
panel_14 = Panel(trunc_2)
division_3 = Division(A=ma_3.Result, B=ma_2.Result)
panel_15 = Panel(python.N)
panel_16 = Panel(python.F)
panel_17 = Panel(python.C)
index = ItemIndex(List=split.ListA, Item=split.ListA)
addition = Addition(A=index, B="1")
division_4 = Division(A=addition, B="50")
panel_18 = Panel(division_2)
panel_19 = Panel(wav)
panel_20 = Panel(avr)
panel_21 = Panel(division_3)
panel_22 = Panel(division_4)
panel_23 = Panel(python.integer)
panel_24 = Panel("""1
1""")
panel_25 = Panel("""2
5
2
2
2
22
4
45
2
6""")
division_5 = Division(A="60", B="100")
num = Number(panel_25)
wav_2 = WeightedAverage(Input=num, Weights=panel_24)
trunc_3 = Truncate(Input=num, TruncationFactor=division_5)
panel_26 = Panel(trunc_3)
