# Grasshopper definition 160817_curveGeneration_hoopsnake.gh (Grasshopper 0.9.76)
# plug-ins: Python Interpreter, HoopSnake

# ----
# 曲率
# 垂直
# 水平平面
intcrv = Interpolate(
    Vertices=[Point(-4.404280238, 19.16058655, 0), Point(-11.2586286, 13.56186769, 0), Point(-11.2586286, 4.716857515, 0), Point(-7.032705268, -5.947827186, 0), Point(-2.313226025, -5.947827186, 0)],
    Degree=3,
    Periodic=False,
    KnotStyle=1)  # -> Curve, Length, Domain
reb = RebuildCurve(Curve=intcrv.Curve, Count=10, Tangents=False)
frame = CurveFrame(Curve=reb, Parameter="0")
pframe = PerpFrame(Curve=reb, Parameter="0")
hframe = HorizontalFrame(Curve=reb, Parameter="0")
rectangle = Rectangle(Plane=frame, XSize=Domain(-1, 1), YSize=Domain(-2, 2), Radius=0)  # -> Rectangle, Length
rectangle_2 = Rectangle(Plane=pframe, XSize=Domain(-1, 1), YSize=Domain(-2, 2), Radius=0)  # -> Rectangle, Length
rectangle_3 = Rectangle(Plane=hframe, XSize=Domain(-1, 1), YSize=Domain(-2, 2), Radius=0)  # -> Rectangle, Length

# ----
# 得到圆的圆心
number_slider = Slider(20.35, range=0..100)
md_slider = MDSlider(
    slider_value=Point(0.7999997139, 0.7550001144, 0.5),
    SliderMode=0,
    x_domain=Domain(0, 1),
    y_domain=Domain(0, 1),
    z_domain=Domain(0, 1))
multiplication = Multiplication(A=md_slider, B=number_slider)
cir = Circle(Plane=multiplication, Radius="10")
pt = Point(cir)

# ----
# 迭代的在曲线上取点的位置
panel = Panel("1")
md_slider_2 = MDSlider(
    slider_value=Point(0.3267993927, 0.4533002377, 0.5),
    SliderMode=0,
    x_domain=Domain(0, 1),
    y_domain=Domain(0, 1),
    z_domain=Domain(0, 1))
python = PythonScript(init_pt=md_slider_2)  # -> out, init_circle, pt0, circle0, pt1, circle1, pt2, d; inputs init_pt: Point3d
# ---------- python: Python ----------
import math
import rhinoscriptsyntax as rs

t0 = 0
sinList = []
#把三个圆t都存进同一张表中
while t0<=1:
    t0+=0.01
    t1 = t0*2
    t2 = t1*2
    sinList.append([abs(math.sin(t0)),abs(math.sin(t1)),abs(math.sin(t2))])

#print (sinList)

init_circle = rs.AddCircle((init_pt),20.350)
for i in xrange(len(sinList)-33):
    pt0 = rs.EvaluateCurve(init_circle,sinList[i][0])
    circle0 = rs.AddCircle(pt0,7)
    #旋转的轴
    vect = rs.VectorCreate(rs.CircleCenterPoint(init_circle),pt0)
    #绕轴旋转生成的第一个圆
    rs.RotateObject(circle0,rs.CircleCenterPoint(circle0),10,vect)
    
    #找出第二个圆心点,画出第二个圆
    pt1 = rs.EvaluateCurve(circle0,sinList[i][1])
    circle1 = rs.AddCircle(pt1,3.5)
    
    #找出第三个点
    pt2 = rs.EvaluateCurve(circle1,sinList[i][2])
# ---------- end python ----------
multiplication_2 = Multiplication(A=md_slider_2, B=Slider(20.35, range=0..100))
cir_2 = Circle(Plane=multiplication_2, Radius="10")
pt_2 = Point(cir_2)
division = Division(A="10", B="180/pi")
smaller = SmallerThan(FirstNumber=addition, SecondNumber=panel)  # -> SmallerThan, OrEqualTo
hs = HoopSnake(
    StartingData="0",
    Data=addition,
    TerminationCondition=smaller.OrEqualTo,
    Hoopsnake_Data_autoUpdate=False,
    Hoopsnake_Data_dataLimit=2147483647,
    Hoopsnake_Data_delay=0,
    Hoopsnake_Data_resetCounter=True,
    Hoopsnake_Data_updateView=True)  # -> Feedback, CumulativeFeedback, LoopsCounter, IterationsCounter
addition = Addition(A=hs.Feedback, B="0.01")
sin = Sine(Value=addition)
panel_2 = Panel(addition)
abs = Absolute(Value=sin)
eval = EvaluateLength(Curve=cir_2, Length=abs, Normalized=True)  # -> Point, Tangent, Parameter
vdis = VectorDisplay(Anchor=eval.Point, Vector=eval.Tangent)
ln = Line(StartPoint=pt_2, EndPoint=eval.Point)
cir_3 = Circle(Plane=eval.Point, Radius="7")
multiplication_3 = Multiplication(A=addition, B="2")
multiplication_4 = Multiplication(A=multiplication_3, B="2")
rotax = RotateAxis(Geometry=cir_3, Angle=division, Axis=ln)  # -> Geometry, Transform
sin_2 = Sine(Value=multiplication_3)
sin_3 = Sine(Value=multiplication_4)
seam = Seam(Curve=rotax.Geometry, Seam="10")
abs_2 = Absolute(Value=sin_2)
abs_3 = Absolute(Value=sin_3)
eval_2 = EvaluateLength(Curve=seam, Length=abs_2, Normalized=True)  # -> Point, Tangent, Parameter
cir_4 = Circle(Plane=eval_2.Point, Radius="3.5")
preview = CustomPreview(Geometry=[cir_2, cir_4], Shader=ColourSwatch(SwatchColor=RGB(202, 182, 169)))
seam_2 = Seam(Curve=cir_4, Seam="1")
eval_3 = EvaluateLength(Curve=seam_2, Length=abs_3, Normalized=True)  # -> Point, Tangent, Parameter

merge = Merge(Data1=multiplication_2, Data2=eval.Point, Data3=eval_2.Point, Data4=eval_3.Point)
pline = PolyLine(Vertices=merge, Closed=False)

rec = DataRecorder(eval_3.Point, DataLimit=10, RecordData=True)
intcrv_2 = Interpolate(Vertices=rec, Degree=3, Periodic=False, KnotStyle=0)  # -> Curve, Length, Domain
avr = Average(Input=rec)
rec_2 = DataRecorder(avr, DataLimit=50, RecordData=True)
reb_2 = RebuildCurve(Curve=intcrv_2.Curve, Count=10, Tangents=False)
pframe_2 = PerpFrame(Curve=reb_2, Parameter="0")
intcrv_3 = Interpolate(Vertices=rec_2, Degree=3, Periodic=False, KnotStyle=0)  # -> Curve, Length, Domain
rectangle_4 = Rectangle(Plane=pframe_2, XSize=Slider(1, range=0..1), YSize=Slider(0.09, range=0..0.1), Radius=0)  # -> Rectangle, Length
reb_3 = RebuildCurve(Curve=intcrv_3.Curve, Count=10, Tangents=False)
swp1 = Sweep1(Rail=reb_2, Sections=rectangle_4.Rectangle, Miter=1)
pipe = Pipe(Curve=reb_3, Radius=Slider(0.256, range=0..1), Caps="1")
cap = CapHoles(Brep=swp1)
