# Grasshopper definition 160817_suspendedCeiling.gh (Grasshopper 0.9.76)
# plug-ins: Kangaroo Components, Weaverbird

pt = Point([Point(22.30184113, -14.37095891, 0), Point(-4.976691097, -8.263220907, 0), Point(6.94827367, 17.13440844, 0), Point(26.1121822, 9.469559348, 0), Point(23.36853122, -5.31291269, 0)])
series = Series(Start=0, Step=1, Count=10)
pline = PolyLine(Vertices=pt, Closed=True)
points = PointList(Points=pt, Size=Slider(5, range=0..10))
digit_scroller = DigitScroller(Scroller_Digits=12, Scroller_Prefix="Domain end", Scroller_Radix=9, Scroller_Value=4.3)
digit_scroller_2 = DigitScroller(Scroller_Digits=12, Scroller_Prefix="Domain start", Scroller_Radix=9, Scroller_Value=1)
pline_2 = PolyLine(Vertices=pt, Closed=False)
pcen = PolygonCenter(Polyline=pline)  # -> CenterV, CenterE, CenterA
divdist = DivideDistance(Curve=pline_2, Distance=Slider(0.365, range=0..1))  # -> Points, Tangents, Parameters
vec2pt = Vector2Pt(PointA=divdist.Points, PointB=pcen.CenterE, Unitize=False)  # -> Vector, Length
dom = ConstructDomain(DomainStart=digit_scroller_2, DomainEnd=digit_scroller)
lng = ListLength(List=vec2pt.Vector)
random = Random(Range=dom, Number=lng, Seed=Slider(77, range=0..100))
digit_scroller_3 = DigitScroller(Scroller_Digits=12, Scroller_Prefix="Domain end", Scroller_Radix=9, Scroller_Value=7.2)
digit_scroller_4 = DigitScroller(Scroller_Digits=12, Scroller_Prefix="Domain start", Scroller_Radix=9, Scroller_Value=6)
amp = Amplitude(Vector=vec2pt.Vector, Amplitude=random)
move = Move(Geometry=divdist.Points, Motion=amp)  # -> Geometry, Transform
digit_scroller_5 = DigitScroller(Scroller_Digits=12, Scroller_Prefix="Domain end", Scroller_Radix=9, Scroller_Value=0.6)
digit_scroller_6 = DigitScroller(Scroller_Digits=12, Scroller_Prefix="Domain start", Scroller_Radix=9, Scroller_Value=0.5)
reduce = RandomReduce(List=move.Geometry, Reduction=Slider(71, range=0..100), Seed=Slider(44.2, range=0..100))
dom_2 = ConstructDomain(DomainStart=digit_scroller_4, DomainEnd=digit_scroller_3)
lng_2 = ListLength(List=reduce)
lng_3 = ListLength(List=reduce)
digit_scroller_7 = DigitScroller(Scroller_Digits=12, Scroller_Prefix="Domain end", Scroller_Radix=9, Scroller_Value=0.1)
digit_scroller_8 = DigitScroller(Scroller_Digits=12, Scroller_Prefix="Domain start", Scroller_Radix=9, Scroller_Value=0.5)
dom_3 = ConstructDomain(DomainStart=digit_scroller_6, DomainEnd=digit_scroller_5)
random_2 = Random(Range=dom_2, Number=lng_2, Seed=Slider(56.2, range=0..100))
Z = UnitZ(Factor=random_2)
lng_4 = ListLength(List=reduce)
random_3 = Random(Range=dom_3, Number=lng_3, Seed=Slider(56.2, range=0..100))
move_2 = Move(Geometry=reduce, Motion=Z)  # -> Geometry, Transform
ln = Line(StartPoint=reduce, EndPoint=move_2.Geometry)
digit_scroller_9 = DigitScroller(Scroller_Digits=12, Scroller_Prefix="Domain end", Scroller_Radix=9, Scroller_Value=0.1)
digit_scroller_10 = DigitScroller(Scroller_Digits=12, Scroller_Prefix="Domain start", Scroller_Radix=9, Scroller_Value=0)
dom_4 = ConstructDomain(DomainStart=digit_scroller_8, DomainEnd=digit_scroller_7)
eval = EvaluateLength(Curve=ln, Length=random_3, Normalized=True)  # -> Point, Tangent, Parameter
random_4 = Random(Range=dom_4, Number=lng_4, Seed=Slider(56.2, range=0..100))
lng_5 = ListLength(List=reduce)
circle = CircleCNR(Center=eval.Point, Normal=Vector(0, 0, 1), Radius=random_4)
dom_5 = ConstructDomain(DomainStart=digit_scroller_10, DomainEnd=digit_scroller_9)
random_5 = Random(Range=dom_5, Number=lng_5, Seed=Slider(61.969, range=0..100))
eval_2 = EvaluateLength(Curve=circle, Length=random_5, Normalized=True)  # -> Point, Tangent, Parameter
merge = Merge(Data1=simplify(graft(reduce)), Data2=simplify(graft(eval_2.Point)), Data3=simplify(graft(move_2.Geometry)))
intcrv = Interpolate(Vertices=merge, Degree=3, Periodic=False, KnotStyle=1)  # -> Curve, Length, Domain
number_slider = Slider(43, range=0..100)
branch = TreeBranch(Tree=intcrv.Curve, Path="0", MaintainPaths=True)
pipe = Pipe(Curve=intcrv.Curve, Radius=Slider(0.08, range=0..0.1), Caps=0)
divide = DivideCurve(Curve=branch, Count=number_slider, Kinks=False)  # -> Points, Tangents, Parameters
cap = CapHoles(Brep=pipe)
dom_6 = ConstructDomain(DomainStart="0", DomainEnd=number_slider)
xy = XYPlane(Origin=divide.Points)
subset = SubList(List=xy, Domain=dom_6, Wrap=True)  # -> List, Index
pcx = CurvePlane(Curve=intcrv.Curve, Plane=subset.List)  # -> simplify(Points), ParamsC, ParamsP
panel = Panel(intcrv.Curve)
series_2 = Series(Start="1", Step="1", Count=number_slider)
path_mapper = PathMapper(pcx.Points, source="{A;B}", target="{A}")
item = ListItem(List=path_mapper, Index=series_2, Wrap=False)
flip = FlipMatrix(Data=item)
con = DelaunayEdges(Points=flip, Plane=PlaneXY(0, 0, 0))  # -> Connectivity, Edges
len = Length(Curve=con.Edges)
subtraction = Subtraction(A=number_slider, B="5")
smaller = SmallerThan(FirstNumber=len, SecondNumber=Slider(3.021, range=0..10))  # -> SmallerThan, OrEqualTo
panel_2 = Panel("0")
cull = CullPattern(List=con.Edges, CullPattern=smaller.SmallerThan)
# 获得分支一层点
path = ConstructPath(Indices=subtraction)
viewer = ParamViewer(cull)
branch_2 = TreeBranch(Tree=simplify(flip), Path=path, MaintainPaths=True)
merge_2 = Merge(
    Data1=Slider(32, range=0..100),
    Data2=Slider(37, range=0..100),
    Data3=Slider(62, range=0..100),
    Data4=Slider(178, range=0..1000))
item_2 = ListItem(List=branch_2, Index=merge_2, Wrap=False)  # -> flatten(Item)
graft = GraftTree(Tree=item_2, IncludeEmptyLists=True, IncludeNullItems=True)
# 4点建构曲面
bang = ExplodeTree(Data=graft)  # -> Branch0, Branch1, Branch2, Branch3
# 模拟重力
Z_2 = UnitZ(Factor=Slider(-1, range=-1..1))
srf4pt = _4PointSurface(CornerA=bang.Branch0, CornerB=bang.Branch1, CornerC=bang.Branch2, CornerD=bang.Branch3)
number_slider_2 = Slider(0.01, range=0..0.01)
# srf 转换成 mesh
mesh_uv = MeshSurface(Surface=srf4pt, UCount=Slider(14, range=0..100), VCount=Slider(14, range=0..100), Overhang=True, Equalize=False)
demesh = DeconstructMesh(Mesh=mesh_uv)  # -> Vertices, Faces, Colours, Normals
uforce = UnaryForce(Point=demesh.Vertices, Force=Z_2)
timer = Timer(TimerInterval=1, Target=kangaroo)
wbedges = WeaverbirdsMeshEdges(MeshOrPolylines=mesh_uv)
panel_4 = Panel(mesh_uv)
Z_3 = UnitZ(Factor=number_slider_2)
# 动力学引擎，获得几何形态
springs = SpringsFromLine(
    Connection=wbedges,
    Stiffness=Slider(100.587, range=0..1000),
    Damping=10,
    RestLength=Slider(0.563, range=0..1),
    UpperCutoff=0,
    LowerCutoff=0,
    Plasticity=0)
kangaroo = KangarooPhysics(
    ForceObjects=[springs, uforce],
    AnchorPoints=flatten(graft),
    Settings=null,
    Geometry=mesh_uv,
    SimulationReset=Toggle(False))  # -> Out, Iterations, ParticlesOut, GeometryOut, KE
mesh = Mesh(kangaroo.KE)
wbfacepolys = WeaverbirdsFacePolylines(Mesh=mesh)
pipe_2 = Pipe(Curve=wbfacepolys, Radius=number_slider_2, Caps=0)
move_3 = Move(Geometry=mesh, Motion=Z_3)  # -> Geometry, Transform
panel_5 = Panel(kangaroo.Iterations)
