# Grasshopper definition 160818_hollowPillar.gh (Grasshopper 0.9.76)
# plug-ins: Python Interpreter

panel = Panel("""a
b
c
d
e""")
panel_2 = Panel("""0
1
2
3
4""")
panel_3 = Panel("""A
B
C
D
E""")

nurbs = NurbsCurve(
    Vertices=[Point(4.642522066, -23.04052931, 0), Point(14.19025586, -16.81906132, 0), Point(5.05830468, -12.35220256, 0), Point(-8.525609032, -13.11817523, 0), Point(-22.27037919, -10.790849, 0), Point(-20.09686158, -7.008310723, 0)],
    Degree=3,
    Periodic=False)  # -> Curve, Length, Domain; disabled
python = PythonScript()  # -> out, pts; disabled
# ---------- python: Python ----------
import rhinoscriptsyntax as rs
#gh不能显示python是嵌套的列表
pts = []
for i in xrange(5):
    pt = rs.AddPoint(i,0,0)
    pts.append(pt)
# ---------- end python ----------
python_2 = PythonScript(x=nurbs.Curve)  # -> out, a, pipe; disabled
# ---------- python_2: Python ----------
import rhinoscriptsyntax as rs

pipe = rs.AddPipe(x,0,1,True)
print (pipe)
print (type(pipe))
a = pipe[0]
print (len(pipe))
# ---------- end python_2 ----------
panel_4 = Panel(python.pts)  # disabled
brep = Brep(python_2.a)  # disabled

python_3 = PythonScript(x=panel_2, y=panel_3, z=panel)  # -> out, a; inputs x: list, y: list, z: list
# ---------- python_3: Python ----------
L = [[1,2,3],['a','b','c'],['A','B','C']]
a = zip(L[0],L[1],L[2])
print (a)
#[(1, 'a', 'A'), (2, 'b', 'B'), (3, 'c', 'C')]
b = zip(*L)
#[(1, 'a', 'A'), (2, 'b', 'B'), (3, 'c', 'C')]

print (b)
print (type(b))
print (type(b[1]))
for i in xrange(len(b[1])):
    print (type(b[1][i]))
"""
<type 'list'>
<type 'tuple'>
<type 'int'>
<type 'str'>
<type 'str'>
"""
# ---------- end python_3 ----------
pt = Point(Point(0, 0, 0))
Z = UnitZ(Factor=1)
line = LineSDL(Start=pt, Direction=Z, Length=Slider(19.8, range=0..100))
addition = Addition(A="4", B="1")
series = Series(Start="2", Step="2", Count=addition)
graph = GraphMapper(
    series,
    x0=0,
    x1=1,
    y0=0,
    y1=1,
    amplitude=0.345043242,
    container_name="Perlin",
    decay=0.436927259,
    frequency=0.2003479004,
    x_offset=0.4825507998,
    y_offset=0.481449306)
panel_5 = Panel(graph)
divide = DivideCurve(Curve=line, Count="4", Kinks=False)  # -> Points, Tangents, Parameters

python_4 = PythonScript()  # -> out, tree, tree_flip, cir_pipe, pipes
# ---------- python_4: Python ----------
import rhinoscriptsyntax  as rs 
import random
from Grasshopper.Kernel.Data import GH_Path
from Grasshopper import DataTree

#创建初始点
pt_start = rs.AddPoint((0,0,0))

#线段的向量vec,得到线的末端，连成直线
vec = rs.VectorCreate((0,0,0),(0,0,-21))
pt_end = rs.VectorAdd(pt_start,vec)
line = rs.AddLine(pt_start,pt_end)

#等分线段，等分点为圆心，相同半径为2创建圆
pt_div = rs.DivideCurve(line,4)#4段5点
cirs1 = []
ptsList = []
for i in xrange(len(pt_div)):
    cir0 = rs.AddCircle(pt_div[i],2)
    domain_max = rs.CurveDomain(cir0)[1]
    t_ran = random.random()*domain_max
    pt_cir1 = rs.EvaluateCurve(cir0,t_ran)
    cir1 = rs.AddCircle(pt_cir1,random.random()*1.5+1.5)
    cirs1.append(cir1)
    cir1_div = rs.DivideCurve(cir1,10)#///把圆分成10段，得到11个点
    ptsList.append(cir1_div)
    #///如果这个时候要显示ptsList的话会失败
    #///gh不能显示python中嵌套的列表

#///试试把他们放到树形数据中去
tree = DataTree[object]()
for i in xrange(len(ptsList)):
    tree.AddRange(ptsList[i],GH_Path(i))

#///手工Flip
tree_flip = DataTree[object]()
new_ptsList = []
for j in xrange(len(ptsList[0])):
    new_pts = []
    for i in xrange(len(ptsList)):
        new_pt = ptsList[i][j]
        new_pts.append(new_pt)
    new_ptsList.append(new_pts)

for i in xrange(len(new_ptsList)):
    tree_flip.AddRange(new_ptsList[i],GH_Path(i))

#///简单的实现Flip??


#连出polyline,pipe
polyList = []
pipes = []
for pts in new_ptsList:
    normalPoly = rs.AddPolyline(pts)
    pipe = rs.AddPipe(normalPoly,0,0.08,1,True)[0] #///parameter参数代表权重
    #print (type(pipe))  #///为什么AddPipe返回的是list
    polyList.append(normalPoly)
    pipes.append(pipe)
    
#print (pipes)

#///原来之前没有必要显示出Flip后的点来
#///但是发现后面的pipes如果要看到的话，要用放入树形数据
#///pipe 也不需要树形数据

#tree_pipe = DataTree[object]()
#for i in xrange(len(pipesList)):
#    tree_pipe.AddRange(pipesList[i],GH_Path(i))

cir_pipe = [rs.AddPipe(cir,0,0.08,1,True)[0] for cir in cirs1]
#///pipe出来怎么是list???因为之前出入了0.08有好几段
# ---------- end python_4 ----------
panel_6 = Panel(python_4.pipes)
panel_7 = Panel(python_4.tree)
panel_8 = Panel(python_4.cir_pipe)
panel_9 = Panel(python_4.tree_flip)

dom = ConstructDomain(DomainStart="0", DomainEnd="1")
cir = Circle(Plane=divide.Points, Radius=Slider(2, range=0..10))
lng = ListLength(List=cir)
multiplication = Multiplication(A=graph, B="4")
random = Random(Range=dom, Number=lng, Seed=Slider(34.962, range=0..100))
eval = EvaluateLength(Curve=cir, Length=random, Normalized=True)  # -> Point, Tangent, Parameter
number_slider = Slider(0.08, range=0..0.1)
lng_2 = ListLength(List=cir)
dom_2 = ConstructDomain(DomainStart="1.6", DomainEnd="2.5")
cir_2 = Circle(Plane=eval.Point, Radius=multiplication)
random_2 = Random(Range=dom_2, Number=lng_2, Seed=Slider(44.162, range=0..100))
divide_2 = DivideCurve(Curve=cir_2, Count=10, Kinks=False)  # -> Points, Tangents, Parameters
pipe = Pipe(Curve=cir_2, Radius=number_slider, Caps=0)
flip = FlipMatrix(Data=divide_2.Points)
pline = PolyLine(Vertices=flip, Closed=False)
pipe_2 = Pipe(Curve=pline, Radius=number_slider, Caps=0)
panel_10 = Panel(divide_2.Points)
