# Grasshopper definition 160818_voronoi3D_randomColor.gh (Grasshopper 0.9.76)

number_slider = Slider(174, range=0..1000)
dom = ConstructDomain(DomainStart="0", DomainEnd="10")
random = Random(Range=dom, Number=number_slider, Seed=Slider(45.662, range=0..100))
random_2 = Random(Range=dom, Number=number_slider, Seed=Slider(54.893, range=0..100))
random_3 = Random(Range=dom, Number=number_slider, Seed=Slider(65.662, range=0..100))
pt = ConstructPoint(XCoordinate=random, YCoordinate=random_2, ZCoordinate=random_3)
pt_2 = Point(pt)
voronoi³ = Voronoi3D(Points=pt_2)  # -> Cells, Boundary
edges = BrepEdges(Brep=voronoi³.Cells)  # -> Naked, Interior, NonManifold
pdecon = Deconstruct(Point=pt_2)  # -> flatten(XComponent), flatten(YComponent), flatten(ZComponent)
pipe = Pipe(Curve=edges.Interior, Radius=Slider(0.01, range=0..0.01), Caps=0)
dom_2 = ConstructDomain(DomainStart="0", DomainEnd="255")
path_mapper = PathMapper(pdecon.XComponent, source="{A}", target="{0}")
path_mapper_2 = PathMapper(pdecon.YComponent, source="{A}", target="{1}")
path_mapper_3 = PathMapper(pdecon.ZComponent, source="{A}", target="{2}")
panel = Panel(pdecon.XComponent)
scale = Scale(Geometry=voronoi³.Cells, Center=pt_2, Factor=Slider(0.594, range=0..1))  # -> Geometry, Transform
merge = Merge(Data1=path_mapper, Data2=path_mapper_3, Data3=path_mapper_2)
remap = RemapNumbers(Value=merge, Source=dom, Target=dom_2)  # -> Mapped, Clipped
bang = ExplodeTree(Data=remap.Mapped)  # -> Branch0, Branch1, Branch2
rgb = ColourRGB(Alpha=Slider(183.9, range=0..1000), Red=bang.Branch0, Green=bang.Branch1, Blue=bang.Branch2)
preview = CustomPreview(Geometry=scale.Geometry, Shader=rgb)
