# Grasshopper definition 20160619_brick.gh (Grasshopper 0.9.76)
# plug-ins: MosquitoAudio2, SEG

number_slider = Slider(50, range=0..1000)  # disabled
path = FilePath("D:\迅雷下载\grasshopper\插件\Mosquito-0.4c\Mosquito 0.4c\Examples\AudioWave Examples\heartbeat.mp3")  # disabled
toggle = BooleanToggle(False)  # disabled
toggle_2 = BooleanToggle(True)  # disabled
play = AudioPlay(AudioFile=path, Boolean=toggle)  # disabled
multiplication = Multiplication(A=play, B=number_slider)  # disabled
panel = Panel(multiplication)  # disabled
number_slider_2 = Slider(0.5, range=0..0.5)  # disabled
number_slider_3 = Slider(0, range=0..1000)  # disabled
number_slider_4 = Slider(0.3, range=0..0.5)  # disabled
number_slider_5 = Slider(0, range=0..1000)  # disabled
levels = Levels(
    Input=play,
    Trigger_hi=number_slider_2,
    Trigger_lo=number_slider_3,
    Settle=number_slider_4,
    Speed=number_slider_5,
    Active=toggle_2)  # disabled
number_slider_6 = Slider(10, range=0..10)  # disabled
num = Number(levels)  # disabled
division = Division(A=num, B=number_slider_6)  # disabled

num_2 = Number(levels)

num_3 = Number(Slider(3, range=0..10))
num_4 = Number(Slider(3, range=0..10))

md_slider = MDSlider(
    slider_value=Point(0.4806128903, 0.4916136148, 0.5),
    SliderMode=0,
    x_domain=Domain(-200, 200),
    y_domain=Domain(-200, 200),
    z_domain=Domain(0, 1))

num_5 = Number(1)
num_6 = Number(1)
num_7 = Number(num_4)
num_8 = Number(num_3)
md_slider_2 = MDSlider(
    slider_value=Point(0.4576095953, 0.4649754966, 0.5),
    SliderMode=0,
    x_domain=Domain(-10000, 10000),
    y_domain=Domain(-10000, 10000),
    z_domain=Domain(0, 1))

num_9 = Number(Slider(1, range=0..1))
num_10 = Number(Slider(0.553, range=0..1))
series = Series(Start=num_9, Step=expr("-x", Slider(0.18, range=0..1)), Count=10)
series_2 = Series(Start=num_10, Step=Slider(0.154, range=0..1), Count=10)

num_11 = Number(Slider(0.032, range=0..1))
num_12 = Number(Slider(0, range=0..1))

toggle_3 = BooleanToggle(False)

xy = XYPlane(Origin=Point(0, 0, 0))

conjugatedistance = Number(Slider(0.65, range=0..1))
conjugategradient = Number(Slider(0, range=0..0.1))
stretchernumber = Integer(Slider(10, range=1..50))
angleconstraint = Number("0.5*pi")
basicdirection = Number(Slider(0, range=0..1))
brikthickness = Integer("53")
stretchershift = Number(Slider(0.1, range=0..1))
brickrotation = Number(num_12)
layernumber = Integer(Slider(15, range=1..40))
shiftgradient = Number(Slider(0, range=0..0.1))
sidegradient = Number(Slider(0, range=0..1))
minisidelap = Number("60")
miniendlap = Number("15")
planeseam = Integer("0")
basicpoint = Point(xy)
briklength = Integer("240")
brikwidth = Integer("115")
sideseam = Number("10")
sideshift = Number(Slider(0.5, range=0..1))

series_3 = Series(Start=0, Step=1, Count=10)
num_13 = Number(Slider(0.8, range=0..1))

stretchershift_2 = Number(stretchershift)
shiftgradient_2 = Number(shiftgradient)

series_4 = Series(Start=0, Step=Slider(0.012782, range=-1e-06..0.1), Count=100)
subset = SubList(Wrap=True)  # -> List, Index

series_5 = Series(Start=1, Step=2, Count=Slider(6, range=0..10))
ma = MassAddition(Input=series_5)  # -> Result, PartialResults

fib = Fibonacci(SeedA=num_4, SeedB=num_3, Number=10)
series_6 = Series(Start=1, Step=2, Count=Slider(16, range=0..30))
ma_2 = MassAddition(Input=fib)  # -> Result, PartialResults

panel_2 = Panel(fib)

stretchernumber_2 = Integer(Slider(50, range=1..50))
layernumber_2 = Integer(Slider(13, range=1..40))

fib_2 = Fibonacci(SeedA=num_7, SeedB=num_8, Number=10)
ma_3 = MassAddition(Input=fib_2)  # -> Result, PartialResults

# ----
# distance小变大大变小
number_slider_7 = Slider(0.086, range=0..1)
number_slider_8 = Slider(0.5, range=0..1)
neg = Negative(Value=number_slider_7)
series_7 = Series(Start=Slider(1, range=0..1), Step=neg, Count=10)
series_8 = Series(Start=number_slider_8, Step=Slider(0.091, range=0..1), Count=10)
num_14 = Number(number_slider_8)
num_15 = Number(series_7)

dom = ConstructDomain(DomainStart=num_10, DomainEnd=num_9)

# ----
# 蛇形
number_slider_9 = Slider(4, range=0..10)

fib_3 = Fibonacci(SeedA=2, SeedB=1, Number=10)
ma_4 = MassAddition(Input=fib_3)  # -> Result, PartialResults

num_16 = Number(Slider(9, range=0..10))

pi = Pi(Factor=1)
multiplication_2 = Multiplication(A=pi, B=2)

num_17 = Number(conjugatedistance)
num_18 = Number(conjugategradient)
int = Integer(planeseam)
int_2 = Integer(brikthickness)
num_19 = Number(basicdirection)
int_3 = Integer(stretchernumber)
int_4 = Integer(stretchernumber)
num_20 = Number(sideseam)
int_5 = Integer(briklength)
num_21 = Number(brickrotation)
num_22 = Number(miniendlap)
int_6 = Integer(layernumber)
addition = Addition(A=num_20, B=num_22)
remap = RemapNumbers(Value=num_21, Source=Domain(0, 1), Target=angleconstraint)  # -> Mapped, Clipped
eval = Evaluate(F="(x-1)*2", x=int_4)
eval_2 = Evaluate(F="z-(2*y+x)", x=num_20, y=num_22, z=int_5)
series_9 = Series(Start=num_17, Step=num_18, Count=eval)
addition_2 = Addition(A=addition, B=eval_2)
remap_2 = RemapNumbers(Value=num_19, Source=Domain(0, 1), Target=Domain(0, 6.283185307))  # -> Mapped, Clipped
series_10 = Series(Start=remap_2.Mapped, Step=remap.Mapped, Count=expr("2*x-1", int_3))
prot = RotatePlane(Plane=basicpoint, Angle=remap_2.Mapped)
pshift = ShiftPaths(Data=series_9, Offset=1)
dom_2 = ConstructDomain(DomainStart=addition, DomainEnd=addition_2)
pshift_2 = ShiftPaths(Data=series_10, Offset=1)
stack = StackData(Data=dom_2, Stack=eval)
series_11 = Series(Start=0, Step=1, Count=int_6)
deplane = DeconstructPlane(Plane=prot)  # -> Origin, XAxis, YAxis, ZAxis
series_12 = Series(Start=0, Step=2, Count=int_4)
mod = Modulus(A=series_11, B=2)
pshift_3 = ShiftPaths(Data=series_12, Offset=1)
eval_3 = Evaluate(F="2*(y-x)-1", x=mod, y=int_4)
series_13 = Series(Start=mod, Step=1, Count=eval_3)
pshift_4 = ShiftPaths(Data=series_13, Offset=2)
addition_3 = Addition(A=int, B=int_2)
series_14 = Series(Start=0, Step=addition_3, Count=int_6)  # -> graft(Series)
pshift_5 = ShiftPaths(Data=series_14, Offset=2)
conjugatedomain = Number(eval_2)

eval_4 = Evaluate(F="2*x-1", x=int_3)
smaller = SmallerThan(FirstNumber=ma.PartialResults, SecondNumber=eval_4)  # -> SmallerThan, OrEqualTo
sift = SiftPattern(List=series_5, SiftPattern=smaller.SmallerThan)  # -> Output0, Output1
clean = CleanTree(RemoveNulls=True, RemoveInvalid=True, RemoveEmpty=False, Tree=sift.Output1)
ma_5 = MassAddition(Input=clean)  # -> Result, PartialResults
item = ListItem(List=clean, Index=-1, Wrap=True)
subtraction = Subtraction(A=eval_4, B=ma_5.Result)
addition_4 = Addition(A=subtraction, B=item)
replace = ReplaceItems(List=clean, Item=addition_4, Indices=-1, Wrap=True)
lng = ListLength(List=replace)
series_15 = Series(Start=Slider(0.031, range=0..1), Step=Slider(0.087, range=0..1), Count=lng)
sift_2 = SiftPattern(List=series_15, SiftPattern=[0, 1])  # -> Output0, Output1
neg_2 = Negative(Value=sift_2.Output1)
combine = CombineData(Input0=sift_2.Output0, Input1=neg_2)  # -> Result, Index
series_16 = Series(Start=0, Step=combine.Result, Count=replace)
flatten = FlattenTree(Tree=series_16, Path="{0}")

eval_5 = Evaluate(F="2*x-1", x=int_3)
smaller_2 = SmallerThan(FirstNumber=ma_2.PartialResults, SecondNumber=eval_5)  # -> SmallerThan, OrEqualTo
sift_3 = SiftPattern(List=fib, SiftPattern=smaller_2.SmallerThan)  # -> Output0, Output1
clean_2 = CleanTree(RemoveNulls=True, RemoveInvalid=True, RemoveEmpty=False, Tree=sift_3.Output1)
ma_6 = MassAddition(Input=clean_2)  # -> Result, PartialResults
item_2 = ListItem(List=clean_2, Index=-1, Wrap=True)
subtraction_2 = Subtraction(A=eval_5, B=ma_6.Result)
addition_5 = Addition(A=subtraction_2, B=item_2)
replace_2 = ReplaceItems(List=clean_2, Item=addition_5, Indices=-1, Wrap=True)

eval_6 = Evaluate(F="(x-1)*2", x=int_4)
smaller_3 = SmallerThan(FirstNumber=ma_3.PartialResults, SecondNumber=eval_6)  # -> SmallerThan, OrEqualTo
sift_4 = SiftPattern(List=fib_2, SiftPattern=smaller_3.SmallerThan)  # -> Output0, Output1
clean_3 = CleanTree(RemoveNulls=True, RemoveInvalid=True, RemoveEmpty=False, Tree=sift_4.Output1)
ma_7 = MassAddition(Input=clean_3)  # -> Result, PartialResults
item_3 = ListItem(List=clean_3, Index=-1, Wrap=True)
subtraction_3 = Subtraction(A=eval_6, B=ma_7.Result)
addition_6 = Addition(A=subtraction_3, B=item_3)
replace_3 = ReplaceItems(List=clean_3, Item=addition_6, Indices=-1, Wrap=True)

eval_7 = Evaluate(F="2*x-1", x=int_3)
smaller_4 = SmallerThan(FirstNumber=ma_4.PartialResults, SecondNumber=eval_7)  # -> SmallerThan, OrEqualTo
sift_5 = SiftPattern(List=fib_3, SiftPattern=smaller_4.SmallerThan)  # -> Output0, Output1
clean_4 = CleanTree(RemoveNulls=True, RemoveInvalid=True, RemoveEmpty=False, Tree=sift_5.Output1)
item_4 = ListItem(List=clean_4, Index=-1, Wrap=True)
ma_8 = MassAddition(Input=sift_5.Output1)  # -> Result, PartialResults
subtraction_4 = Subtraction(A=eval_7, B=ma_8.Result)
addition_7 = Addition(A=subtraction_4, B=item_4)
replace_4 = ReplaceItems(List=clean_4, Item=addition_7, Indices=-1, Wrap=True)
series_17 = Series(Start=0, Step=Slider(0.031, range=0..1), Count=replace_4)
pshift_6 = ShiftPaths(Data=series_17, Offset=3)
sift_6 = SiftPattern(List=flatten(pshift_6), SiftPattern=[0, 1])  # -> Output0, Output1
sift_7 = SiftPattern(List=flatten(pshift_6), SiftPattern=[0, 0, 0, 1, 1, 1])  # -> Output0, Output1
neg_3 = Negative(Value=sift_7.Output1)
neg_4 = Negative(Value=sift_6.Output1)
combine_2 = CombineData(Input0=sift_7.Output0, Input1=neg_3)  # -> Result, Index
combine_3 = CombineData(Input0=sift_6.Output0, Input1=neg_4)  # -> Result, Index

lng_2 = ListLength(List=replace_2)
series_18 = Series(Start=Slider(0.2, range=0..1), Step=Slider(0.129, range=0..1), Count=lng_2)
series_19 = Series(Start=0, Step=1, Count=lng_2)
pi_2 = Pi(Factor=series_18)
multiplication_3 = Multiplication(A=pi_2, B=2)
item_5 = ListItem(List=pi_2, Index=series_19, Wrap=True)
division_2 = Division(A=multiplication_3, B=replace_2)
sift_8 = SiftPattern(List=item_5, SiftPattern=[0, 1])  # -> Output0, Output1
sift_9 = SiftPattern(List=division_2, SiftPattern=[0, 1])  # -> Output0, Output1
neg_5 = Negative(Value=sift_8.Output1)
neg_6 = Negative(Value=sift_9.Output0)
combine_4 = CombineData(Input0=sift_8.Output0, Input1=neg_5)  # -> Result, Index
combine_5 = CombineData(Input0=sift_9.Output1, Input1=neg_6)  # -> Result, Index
series_20 = Series(Start=combine_4.Result, Step=combine_5.Result, Count=replace_2)
flatten_2 = FlattenTree(Tree=series_20, Path="{0}")

eval_8 = Evaluate(F="2*x-1", x=int_3)
division_3 = Division(A=eval_8, B=number_slider_9)
stack_2 = StackData(Data=number_slider_9, Stack=division_3)
series_21 = Series(Start=Slider(0.227, range=0..1), Step=Slider(0.088, range=0..1), Count=division_3)
ma_9 = MassAddition(Input=stack_2)  # -> Result, PartialResults
sift_10 = SiftPattern(List=series_21, SiftPattern=[0, 1])  # -> Output0, Output1
subtraction_5 = Subtraction(A=eval_8, B=ma_9.Result)
addition_8 = Addition(A=subtraction_5, B=number_slider_9)
neg_7 = Negative(Value=sift_10.Output1)
replace_5 = ReplaceItems(List=stack_2, Item=addition_8, Indices=-1, Wrap=True)
combine_6 = CombineData(Input0=sift_10.Output0, Input1=neg_7)  # -> Result, Index
series_22 = Series(Start=0, Step=combine_6.Result, Count=replace_5)
flatten_3 = FlattenTree(Tree=series_22, Path="{0}")

series_23 = Series(Start=remap_2.Mapped, Step=Slider(0.001, range=0..1), Count=expr("2*x-1", int_3))
sift_11 = SiftPattern(List=series_23, SiftPattern=[0, 1])  # -> Output0, Output1
series_24 = Series(Start=remap_2.Mapped, Step=Slider(0.112, range=0..1), Count=expr("2*x-1", int_3))
addition_9 = Addition(A=series_24, B=sift_11.Output0)
addition_10 = Addition(A=addition_9, B=sift_11.Output1)
addition_11 = Addition(A=addition_9, B=addition_10)
pshift_7 = ShiftPaths(Data=addition_11, Offset=1)

series_25 = Series(Start=remap_2.Mapped, Step=Slider(0, range=0..1), Count=expr("2*x-1", int_3))
split = SplitList(List=series_25, Index=num_16)  # -> ListA, ListB
lng_3 = ListLength(List=split.ListB)
series_26 = Series(Start=0, Step=Slider(0, range=0..1), Count=lng_3)
merge = Merge(Data1=flatten(split.ListA), Data2=flatten(series_26))

division_4 = Division(A=multiplication_2, B=replace_2)
neg_8 = Negative(Value=division_4)
series_27 = Series(Start=pi, Step=neg_8, Count=expr("x+1", replace_2))
flatten_4 = FlattenTree(Tree=series_27, Path="{0}")

lng_4 = ListLength(List=replace_2)
num_23 = Number(Slider(0.124, range=0..1))
neg_9 = Negative(Value=num_23)
repeat = RepeatData(Data=[num_23, neg_9], Length=lng_4)
series_28 = Series(Start=0, Step=repeat, Count=replace_2)
rev = ReverseList(List=series_28)
merge_2 = Merge(Data1=series_28, Data2=rev)
flatten_5 = FlattenTree(Tree=merge_2, Path="{0}")
sift_12 = SiftPattern(List=flatten_5, SiftPattern=[0, 1])  # -> Output0, Output1
clean_5 = CleanTree(RemoveNulls=True, RemoveInvalid=True, RemoveEmpty=False, Tree=sift_12.Output1)

int_7 = Integer(replace_3)

lng_5 = ListLength(List=int_7)
series_29 = Series(Start=0, Step=1, Count=lng_5)
item_6 = ListItem(List=num_15, Index=series_29, Wrap=True)
item_7 = ListItem(List=num_14, Index=series_29, Wrap=True)
subtraction_6 = Subtraction(A=item_6, B=item_7)
division_5 = Division(A=subtraction_6, B=int_7)
sift_13 = SiftPattern(List=item_6, SiftPattern=[0, 1])  # -> Output0, Output1
sift_14 = SiftPattern(List=item_7, SiftPattern=[0, 1])  # -> Output0, Output1
sift_15 = SiftPattern(List=division_5, SiftPattern=[0, 1])  # -> Output0, Output1
combine_7 = CombineData(Input0=sift_14.Output0, Input1=sift_13.Output1)  # -> Result, Index
neg_10 = Negative(Value=sift_15.Output1)
combine_8 = CombineData(Input0=sift_15.Output0, Input1=neg_10)  # -> Result, Index
series_30 = Series(Start=combine_7.Result, Step=combine_8.Result, Count=int_7)
flatten_6 = FlattenTree(Tree=series_30, Path="{0}")

lng_6 = ListLength(List=int_7)
conjugatedistance_2 = Number(conjugatedistance)
series_31 = Series(Start=Slider(0.01, range=0..0.1), Step=Slider(0.007534, range=0..0.1), Count=lng_6)
series_32 = Series(Start=conjugatedistance_2, Step=series_31, Count=int_7)
flatten_7 = FlattenTree(Tree=series_32, Path="{0}")

num_24 = Number(pshift_2)
num_25 = Number(num_24)

neg_11 = Negative(Value=division_2)
lng_7 = ListLength(List=neg_11)
series_33 = Series(Start=pi_2, Step=neg_11, Count=expr("x+1", replace_2))
flatten_8 = FlattenTree(Tree=series_33, Path="{0}")

num_26 = Number(pshift)
num_27 = Number(num_26)

series_34 = Series(Start=1, Step=2, Count=int_4)
panel_3 = Panel(num_26)
pshift_8 = ShiftPaths(Data=series_34, Offset=1)

larger = LargerThan(FirstNumber=num_27, SecondNumber=num_13)  # -> LargerThan, OrEqualTo
mindex = MemberIndex(Set=larger.LargerThan, Member=True)  # -> Index, Count
sift_16 = SiftPattern(List=num_27, SiftPattern=larger.LargerThan)  # -> Output0, Output1
replace_6 = ReplaceItems(List=sift_16.Output1, Item=num_13, Indices=mindex.Index, Wrap=False)
combine_9 = CombineData(Input0=sift_16.Output0, Input1=replace_6)  # -> Result, Index
pshift_9 = ShiftPaths(Data=combine_9.Result, Offset=2)

num_28 = Number(num_27)
multiplication_4 = Multiplication(A=addition_3, B=layernumber)
num_29 = Number(pshift_9)

remap_3 = RemapNumbers(Value=num_29, Source=Domain(0, 1), Target=stack)  # -> Mapped, Clipped
shift = ShiftList(List=num_25, Shift=-1, Wrap=False)
prot_2 = RotatePlane(Plane=prot, Angle=num_25)
merge_3 = Merge(Data1=0, Data2=remap_3.Mapped)
pshift_10 = ShiftPaths(Data=shift, Offset=-1)
merge_4 = Merge(Data1=0, Data2=remap_3.Mapped)
merge_5 = Merge(Data1=0, Data2=pshift_10)
shift_2 = ShiftList(List=merge_3, Shift=-1, Wrap=False)
pshift_11 = ShiftPaths(Data=shift_2, Offset=-1)
vrot = Rotate(Vector=deplane.XAxis, Axis=deplane.ZAxis, Angle=merge_5)
amp = Amplitude(Vector=vrot, Amplitude=pshift_11)
ma_10 = MassAddition(Input=amp)  # -> Result, PartialResults
addition_12 = Addition(A=deplane.Origin, B=ma_10.PartialResults)
pl_origin = PlaneOrigin(Base=prot_2, Origin=addition_12)
item_8 = ListItem(List=pl_origin, Index=pshift_4, Wrap=False)
item_9 = ListItem(List=pl_origin, Index=0, Wrap=True)
merge_6 = Merge(Data1=item_9, Data2=pl_origin)
item_10 = ListItem(List=item_8, Index=pshift_3, Wrap=False)
item_11 = ListItem(List=merge_4, Index=series_13, Wrap=False)
pshift_12 = ShiftPaths(Data=item_11, Offset=2)
clean_6 = CleanTree(RemoveNulls=True, RemoveInvalid=True, RemoveEmpty=False, Tree=item_10)
item_12 = ListItem(List=merge_6, Index=pshift_4, Wrap=False)
pt = PointOriented(BasePlane=item_12, UComponent=pshift_12, VComponent=0, WComponent=pshift_5)
item_13 = ListItem(List=pt, Index=pshift_3, Wrap=False)
clean_7 = CleanTree(RemoveNulls=True, RemoveInvalid=True, RemoveEmpty=False, Tree=item_13)
pl_origin_2 = PlaneOrigin(Base=clean_6, Origin=clean_7)
placementplane = Plane(pl_origin_2)

panel_4 = Panel(pshift_5)
tstat = TreeStatistics(Tree=pt)  # -> Paths, Length, Count
item_14 = ListItem(List=tstat.Paths, Index=0, Wrap=True)
branch = TreeBranch(Tree=pt, Path=item_14, MaintainPaths=True)
intcrv = Interpolate(Vertices=branch, Degree=3, Periodic=False, KnotStyle=1)  # -> Curve, Length, Domain

brikthickness_2 = Integer(brikthickness)
amp_2 = Amplitude(Vector=deplane.ZAxis, Amplitude=brikthickness_2)
thicknessvector = Vector(amp_2)

lng_8 = ListLength(List=int_7)
series_35 = Series(Start=0, Step=1, Count=lng_8)
addition_13 = Addition(A=int_7, B=-1)

random = Random(Range=dom, Number=lng_8, Seed=Slider(222, range=0..333))
random_2 = Random(Range=dom, Number=lng_8, Seed=Slider(10, range=0..10))

filter = StreamFilter(Gate=toggle_3, Stream0=series, Stream1=random_2)
filter_2 = StreamFilter(Gate=toggle_3, Stream0=series_2, Stream1=random)
item_15 = ListItem(List=filter, Index=series_35, Wrap=True)
item_16 = ListItem(List=filter_2, Index=series_35, Wrap=True)
subtraction_7 = Subtraction(A=item_15, B=item_16)
division_6 = Division(A=subtraction_7, B=int_7)
division_7 = Division(A=subtraction_7, B=addition_13)
sift_17 = SiftPattern(List=item_16, SiftPattern=[0, 1])  # -> Output0, Output1
sift_18 = SiftPattern(List=item_15, SiftPattern=[0, 1])  # -> Output0, Output1
sift_19 = SiftPattern(List=division_7, SiftPattern=[0, 1])  # -> Output0, Output1
combine_10 = CombineData(Input0=sift_17.Output0, Input1=sift_18.Output1)  # -> Result, Index
neg_12 = Negative(Value=sift_19.Output1)
combine_11 = CombineData(Input0=sift_19.Output0, Input1=neg_12)  # -> Result, Index
series_36 = Series(Start=combine_10.Result, Step=combine_11.Result, Count=int_7)
flatten_9 = FlattenTree(Tree=series_36, Path="{0}")

# ----
# 超出1的部分用1减
number_slider_10 = Slider(1, range=0..1)
num_30 = Number(number_slider_10)

larger_2 = LargerThan(FirstNumber=num_27, SecondNumber=num_30)  # -> LargerThan, OrEqualTo
mindex_2 = MemberIndex(Set=larger_2.LargerThan, Member=True)  # -> Index, Count
sift_20 = SiftPattern(List=num_27, SiftPattern=larger_2.LargerThan)  # -> Output0, Output1

subtraction_8 = Subtraction(A=sift_20.Output1, B=num_30)
subtraction_9 = Subtraction(A=num_30, B=subtraction_8)
clean_8 = CleanTree(RemoveNulls=True, RemoveInvalid=True, RemoveEmpty=False, Tree=subtraction_9)

replace_7 = ReplaceItems(List=sift_20.Output1, Item=clean_8, Indices=mindex_2.Index, Wrap=False)
combine_12 = CombineData(Input0=sift_20.Output0, Input1=replace_7)  # -> Result, Index
pshift_13 = ShiftPaths(Data=combine_12.Result, Offset=2)

num_31 = Number(Slider(2.447998, range=0..10))
num_32 = Number(Slider(3.023999, range=0..10))
int_8 = Integer(layernumber)
fib_4 = Fibonacci(SeedA=num_32, SeedB=num_31, Number=10)
ma_11 = MassAddition(Input=fib_4)  # -> Result, PartialResults
smaller_5 = SmallerThan(FirstNumber=ma_11.PartialResults, SecondNumber=int_8)  # -> SmallerThan, OrEqualTo
sift_21 = SiftPattern(List=fib_4, SiftPattern=smaller_5.SmallerThan)  # -> Output0, Output1
clean_9 = CleanTree(RemoveNulls=True, RemoveInvalid=True, RemoveEmpty=False, Tree=sift_21.Output1)
ma_12 = MassAddition(Input=clean_9)  # -> Result, PartialResults
item_17 = ListItem(List=clean_9, Index=-1, Wrap=True)
subtraction_10 = Subtraction(A=int_8, B=ma_12.Result)
addition_14 = Addition(A=subtraction_10, B=item_17)
replace_8 = ReplaceItems(List=clean_9, Item=addition_14, Indices=-1, Wrap=True)

pshift_14 = ShiftPaths(Data=replace_8, Offset=2)

int_9 = Integer(pshift_14)

panel_5 = Panel(int_9)

number_slider_11 = Slider(2, range=0..10)
series_37 = Series(Start=number_slider_11, Step=number_slider_11, Count=10)
ma_13 = MassAddition(Input=series_37)  # -> Result, PartialResults
int_10 = Integer(-1)

series_38 = Series(Start=0, Step=Slider(0.01, range=0..0.02), Count=100)

miniendlap_2 = Number(miniendlap)
stretchershift_3 = Number(stretchershift_2)
shiftgradient_3 = Number(shiftgradient_2)
placementplane_2 = Plane(placementplane)
conjugatedomain_2 = Number(conjugatedomain)
briklength_2 = Integer(briklength)
lng_9 = ListLength(List=placementplane_2)
series_39 = Series(Start=stretchershift_3, Step=shiftgradient_3, Count=lng_9)
pshift_15 = ShiftPaths(Data=series_39, Offset=-1)

lng_10 = ListLength(List=placementplane_2)
lng_11 = ListLength(List=flatten(lng_10))

lng_12 = ListLength(List=placementplane_2)
lng_13 = ListLength(List=flatten(lng_12))
series_40 = Series(Start=0, Step=1, Count=lng_13)
item_18 = ListItem(List=series_38, Index=series_40, Wrap=True)
sift_22 = SiftPattern(List=item_18, SiftPattern=[0, 1])  # -> Output0, Output1
division_8 = Division(A=lng_13, B=2)
split_2 = SplitList(List=item_18, Index=division_8)  # -> ListA, ListB
neg_13 = Negative(Value=sift_22.Output1)
rev_2 = ReverseList(List=split_2.ListB)
combine_13 = CombineData(Input0=sift_22.Output0, Input1=neg_13)  # -> Result, Index
merge_7 = Merge(Data1=split_2.ListA, Data2=rev_2)
series_41 = Series(Start=0, Step=graft(combine_13.Result), Count=lng_9)  # -> simplify(Series)

lng_14 = ListLength(List=placementplane_2)
lng_15 = ListLength(List=flatten(lng_14))
series_42 = Series(Start=0, Step=Slider(0.012076, range=-1e-06..0.1), Count=100)
series_43 = Series(Start=0, Step=1, Count=lng_15)
division_9 = Division(A=lng_15, B=Slider(1.99, range=0..3))
item_19 = ListItem(List=series_42, Index=series_43, Wrap=True)
split_3 = SplitList(List=item_19, Index=division_9)  # -> ListA, ListB
rev_3 = ReverseList(List=split_3.ListB)
shift_3 = ShiftList(List=item_19, Shift=division_9, Wrap=True)
merge_8 = Merge(Data1=split_3.ListA, Data2=rev_3)
series_44 = Series(Start=0, Step=graft(merge_8), Count=lng_9)  # -> simplify(Series)

series_45 = Series(Start=0, Step=1, Count=lng_11)

lng_16 = ListLength(List=int_9)
series_46 = Series(Start=0.1, Step=Slider(0, range=0..1), Count=lng_16)
neg_14 = Negative(Value=Slider(0, range=0..1))
sift_23 = SiftPattern(List=series_46, SiftPattern=[0, 1])  # -> Output0, Output1
series_47 = Series(Start=Slider(0.1, range=0..1), Step=neg_14, Count=lng_16)
neg_15 = Negative(Value=sift_23.Output1)
combine_14 = CombineData(Input0=sift_23.Output0, Input1=neg_15)  # -> Result, Index
series_48 = Series(Start=series_47, Step=series_46, Count=int_9)
flatten_10 = FlattenTree(Tree=series_48, Path="{0}")
number_slider_12 = Slider(17, range=0..100)
panel_6 = Panel("""0.1
0.3
0.4
0.6""")
lng_17 = ListLength(List=placementplane_2)
tstat_2 = TreeStatistics(Tree=lng_17)  # -> Paths, Length, Count
repeat_2 = RepeatData(Data=panel_6, Length=tstat_2.Count)
stack_3 = StackData(Data=graft(repeat_2), Stack=lng_17)
pshift_16 = ShiftPaths(Data=stack_3, Offset=2)

item_20 = ListItem(List=series_4, Index=series_45, Wrap=True)

smaller_6 = SmallerThan(FirstNumber=ma_13.PartialResults, SecondNumber=lng_11)  # -> SmallerThan, OrEqualTo
sift_24 = SiftPattern(List=series_37, SiftPattern=smaller_6.SmallerThan)  # -> Output0, Output1
clean_10 = CleanTree(RemoveNulls=True, RemoveInvalid=True, RemoveEmpty=False, Tree=sift_24.Output1)
item_21 = ListItem(List=clean_10, Index=int_10, Wrap=True)
ma_14 = MassAddition(Input=clean_10)  # -> Result, PartialResults
subtraction_11 = Subtraction(A=lng_11, B=ma_14.Result)
addition_15 = Addition(A=subtraction_11, B=item_21)
ins = InsertItems(List=clean_10, Item=addition_15, Indices=-1, Wrap=True)
pshift_17 = ShiftPaths(Data=ins, Offset=2)

partition = PartitionList(List=item_20, Size=2)
series_49 = Series(Start=0, Step=graft(partition), Count=lng_9)  # -> simplify(Series)
lng_18 = ListLength(List=pshift_17)
series_50 = Series(Start=0, Step=1, Count=lng_18)
stack_4 = StackData(Data=series_50, Stack=pshift_17)
panel_7 = Panel(pshift_17)
panel_8 = Panel(series_44)
panel_9 = Panel(item_20)

flatten_11 = FlattenTree(Tree=series_48, Path="{0}")
series_51 = Series(Start=graft(flatten_11), Step=Slider(0.08491, range=0..1), Count=lng_17)  # -> simplify(Series)

sift_25 = SiftPattern(List=item_20, SiftPattern=stack_4)  # -> Output0, Output1, Output2, Output3
panel_10 = Panel(series_49)
clean_11 = CleanTree(RemoveNulls=True, RemoveInvalid=True, RemoveEmpty=False, Tree=sift_25.Output1)
clean_12 = CleanTree(RemoveNulls=True, RemoveInvalid=True, RemoveEmpty=False, Tree=sift_25.Output0)
clean_13 = CleanTree(RemoveNulls=True, RemoveInvalid=True, RemoveEmpty=False, Tree=sift_25.Output2)
clean_14 = CleanTree(RemoveNulls=True, RemoveInvalid=True, RemoveEmpty=False, Tree=sift_25.Output3)
sift_26 = SiftPattern(List=item_20, SiftPattern=[0, 0, 1, 1])  # -> Output0, Output1, Output2
clean_15 = CleanTree(RemoveNulls=True, RemoveInvalid=True, RemoveEmpty=False, Tree=sift_26.Output0)
clean_16 = CleanTree(RemoveNulls=True, RemoveInvalid=True, RemoveEmpty=False, Tree=sift_26.Output1)
panel_11 = Panel(clean_12)
rev_4 = ReverseList(List=clean_12)
rev_5 = ReverseList(List=clean_13)
merge_9 = Merge(Data1=clean_15, Data2=clean_16)
merge_10 = Merge(Data1=rev_4, Data2=clean_11, Data3=rev_5, Data4=clean_14)
series_52 = Series(Start=0, Step=graft(merge_10), Count=lng_9)  # -> simplify(Series)

num_33 = Number(pshift_15)
num_34 = Number(series_52)

panel_12 = Panel(series_52)
num_35 = Number(num_34)

# ----
# 保持不脱离
number_slider_13 = Slider(0.97, range=0..1)
num_36 = Number(number_slider_13)
neg_16 = Negative(Value=num_36)
smaller_7 = SmallerThan(FirstNumber=num_35, SecondNumber=neg_16)  # -> SmallerThan, OrEqualTo
larger_3 = LargerThan(FirstNumber=num_35, SecondNumber=num_36)  # -> LargerThan, OrEqualTo
sift_27 = SiftPattern(List=num_35, SiftPattern=smaller_7.OrEqualTo)  # -> Output0, Output1
sift_28 = SiftPattern(List=num_35, SiftPattern=larger_3.OrEqualTo)  # -> Output0, Output1
clean_17 = CleanTree(RemoveNulls=True, RemoveInvalid=True, RemoveEmpty=False, Tree=sift_27.Output1)
clean_18 = CleanTree(RemoveNulls=True, RemoveInvalid=True, RemoveEmpty=False, Tree=sift_28.Output1)
mindex_3 = MemberIndex(Set=num_35, Member=clean_18)  # -> Index, Count
pshift_18 = ShiftPaths(Data=mindex_3.Index, Offset=-1)
replace_9 = ReplaceItems(List=num_35, Item=num_36, Indices=pshift_18, Wrap=True)
pshift_19 = ShiftPaths(Data=replace_9, Offset=-1)
mindex_4 = MemberIndex(Set=pshift_19, Member=clean_17)  # -> Index, Count
pshift_20 = ShiftPaths(Data=mindex_4.Index, Offset=-1)
replace_10 = ReplaceItems(List=pshift_19, Item=neg_16, Indices=pshift_20, Wrap=True)
pshift_21 = ShiftPaths(Data=replace_10, Offset=-1)

num_37 = Number(pshift_21)

remap_4 = RemapNumbers(Value=num_37, Source=Domain(0, 1), Target=conjugatedomain_2)  # -> Mapped, Clipped
eval_9 = Evaluate(F="-1*(x/2+y)", x=miniendlap_2, y=remap_4.Mapped)
addition_16 = Addition(A=eval_9, B=briklength_2)
dom_3 = ConstructDomain(DomainStart=eval_9, DomainEnd=addition_16)
stretcherdomain = Domain(dom_3)

minisidelap_2 = Number(minisidelap)
sideshift_2 = Number(sideshift)
sidegradient_2 = Number(sidegradient)
placementplane_3 = Plane(placementplane)
brikwidth_2 = Integer(brikwidth)
lng_19 = ListLength(List=placementplane_3)
series_53 = Series(Start=sideshift_2, Step=sidegradient_2, Count=lng_19)
subtraction_12 = Subtraction(A=brikwidth_2, B=minisidelap_2)
pshift_22 = ShiftPaths(Data=series_53, Offset=-1)

num_38 = Number(pshift_22)
num_39 = Number(num_38)

remap_5 = RemapNumbers(Value=num_39, Source=Domain(0, 1), Target=subtraction_12)  # -> Mapped, Clipped
eval_10 = Evaluate(F="-1*(x/2+y)", x=minisidelap_2, y=remap_5.Mapped)
addition_17 = Addition(A=eval_10, B=brikwidth_2)
dom_4 = ConstructDomain(DomainStart=eval_10, DomainEnd=addition_17)
sidedomain = Domain(dom_4)

placementplane_4 = Plane(placementplane)
stretcherdomain_2 = Domain(stretcherdomain)
thicknessvector_2 = Vector(thicknessvector)
sidedomain_2 = Domain(sidedomain)

rectangle = Rectangle(Plane=placementplane_4, XSize=stretcherdomain_2, YSize=sidedomain_2, Radius=0)  # -> Rectangle, Length
extr = Extrude(Base=rectangle.Rectangle, Direction=thicknessvector_2)
cap = CapHoles(Brep=extr)

lng_20 = ListLength(List=flatten(extr))

# ----
# 奇数层头点对奇数点
inputstartpoint = Number(eval_9)
inputdistance = Number(remap_3.Mapped)
layer = Number(layernumber)
column = Number(stretchernumber)
wallheight = Number(multiplication_4)
walllength = Number(intcrv.Length)
inputrotateangle = Number(num_25)
inputbricknumber = Number(lng_20)
item_22 = ListItem(List=inputdistance, Index=series_13, Wrap=False)
shift_4 = ShiftList(List=inputrotateangle, Shift=1, Wrap=False)
short = ShortestList(ListA=shift_4, ListB=inputrotateangle, TrimMode=2)  # -> ListA, ListB
shift_5 = ShiftList(List=inputrotateangle, Shift=2, Wrap=False)
short_2 = ShortestList(ListA=shift_5, ListB=inputrotateangle, TrimMode=2)  # -> ListA, ListB
clean_19 = CleanTree(RemoveNulls=True, RemoveInvalid=True, RemoveEmpty=False, Tree=item_22)
subtraction_13 = Subtraction(A=shift_4, B=short.ListB)
shift_6 = ShiftList(List=inputdistance, Shift=1, Wrap=False)
short_3 = ShortestList(ListA=shift_6, ListB=inputdistance, TrimMode=2)  # -> ListA, ListB
subtraction_14 = Subtraction(A=shift_5, B=short_2.ListB)
pshift_23 = ShiftPaths(Data=clean_19, Offset=2)
tstat_3 = TreeStatistics(Tree=pshift_23)  # -> Paths, Length, Count
ma_15 = MassAddition(Input=tstat_3.Length)  # -> Result, PartialResults
deg = Degrees(Radians=subtraction_14)
deg_2 = Degrees(Radians=subtraction_13)
addition_18 = Addition(A=shift_6, B=short_3.ListB)
shift_7 = ShiftList(List=ma_15.PartialResults, Shift=-1, Wrap=False)
sift_29 = SiftPattern(List=deg, SiftPattern=[0, 1])  # -> Output0, Output1
flatten_12 = FlattenTree(Tree=pshift_23, Path="{0}")
pshift_24 = ShiftPaths(Data=shift_7, Offset=1)
merge_11 = Merge(Data1=0, Data2=pshift_24)
sift_30 = SiftPattern(List=addition_18, SiftPattern=[0, 1])  # -> Output0, Output1
clean_20 = CleanTree(RemoveNulls=True, RemoveInvalid=True, RemoveEmpty=False, Tree=sift_29.Output0)
clean_21 = CleanTree(RemoveNulls=True, RemoveInvalid=True, RemoveEmpty=False, Tree=sift_29.Output1)
ins_2 = InsertItems(List=flatten_12, Item=tstat_3.Paths, Indices=merge_11, Wrap=True)
clean_22 = CleanTree(RemoveNulls=True, RemoveInvalid=True, RemoveEmpty=False, Tree=sift_30.Output0)
clean_23 = CleanTree(RemoveNulls=True, RemoveInvalid=True, RemoveEmpty=False, Tree=sift_30.Output1)
pshift_25 = ShiftPaths(Data=ins_2, Offset=1)
outputrotateanglebetweenlayer = Number(deg_2)
outputrotateangleevenlayer = Number(clean_21)
outputrotateangleoddlayer = Number(clean_20)
outputdistanceoddlayer = Number(clean_22)
outputdistanceevenlayer = Number(clean_23)
outputbricknumber = Integer(inputbricknumber)
outputdistance = Text(inputdistance)
walllength_2 = Number(walllength)
wallheight_2 = Number(wallheight)
column_2 = Integer(column)
layer_2 = Integer(layer)
panel_14 = Panel("""A
B
C
D
E
F
G
H
I
J
K
L""")
stack_5 = StackData(Data=Toggle(False), Stack=12)
concat = Concatenate(FragmentA=panel_14, FragmentB=graft("2"))
item_23 = ListItem(List=stack_5, Index=0, Wrap=True)  # -> Item, Item1, Item2, Item3, Item4, Item5, Item6, Item7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
item_24 = ListItem(List=concat, Index=0, Wrap=True)  # -> Item, Item1, Item2, Item3, Item4, Item5, Item6, Item7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

tstat_4 = TreeStatistics(Tree=inputstartpoint)  # -> Paths, Length, Count
ma_16 = MassAddition(Input=tstat_4.Length)  # -> Result, PartialResults
flatten_13 = FlattenTree(Tree=inputstartpoint, Path="{0}")
shift_8 = ShiftList(List=ma_16.PartialResults, Shift=-1, Wrap=False)
pshift_26 = ShiftPaths(Data=shift_8, Offset=1)
merge_12 = Merge(Data1=0, Data2=pshift_26)
ins_3 = InsertItems(List=flatten_13, Item=tstat_4.Paths, Indices=merge_12, Wrap=True)
pshift_27 = ShiftPaths(Data=ins_3, Offset=1)

outputstartpoint = Text(pshift_27)
entwine = Entwine(
    Branch00=walllength_2,
    Branch01=wallheight_2,
    Branch02=layer_2,
    Branch03=column_2,
    Branch04=outputdistanceoddlayer,
    Branch05=outputdistanceevenlayer,
    Branch06=outputdistance,
    Branch07=outputstartpoint,
    Branch08=outputrotateangleoddlayer,
    Branch09=outputrotateangleevenlayer,
    Branch010=outputrotateanglebetweenlayer,
    Branch011=outputbricknumber,
    FlattenInputs=True)
txt = Text(entwine)
bang = ExplodeTree(Data=txt)  # -> Branch0, Branch1, Branch2, Branch3, Branch4, Branch5, Branch6, Branch7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
toexcel = SEG_GHToExcel(Write=item_23.Item8, Path="E:\brick.xlsx", Cells=item_24.Item8, Data=bang.Branch8, Seg_GtoE=True)
toexcel_2 = SEG_GHToExcel(Write=item_23.Item, Path="E:\brick.xlsx", Cells=item_24.Item, Data=bang.Branch0, Seg_GtoE=True)
toexcel_3 = SEG_GHToExcel(Write=item_23.Item1, Path="E:\brick.xlsx", Cells=item_24.Item1, Data=bang.Branch1, Seg_GtoE=True)
toexcel_4 = SEG_GHToExcel(Write=item_23.Item3, Path="E:\brick.xlsx", Cells=item_24.Item3, Data=bang.Branch3, Seg_GtoE=True)
toexcel_5 = SEG_GHToExcel(Write=item_23.Item4, Path="E:\brick.xlsx", Cells=item_24.Item4, Data=bang.Branch4, Seg_GtoE=True)
toexcel_6 = SEG_GHToExcel(Write=item_23.Item5, Path="E:\brick.xlsx", Cells=item_24.Item5, Data=bang.Branch5, Seg_GtoE=True)
toexcel_7 = SEG_GHToExcel(Write=item_23.Item6, Path="E:\brick.xlsx", Cells=item_24.Item6, Data=bang.Branch6, Seg_GtoE=True)
toexcel_8 = SEG_GHToExcel(Write=item_23.Item9, Path="E:\brick.xlsx", Cells=item_24.Item9, Data=bang.Branch9, Seg_GtoE=True)
toexcel_9 = SEG_GHToExcel(Write=item_23.Item11, Path="E:\brick.xlsx", Cells=item_24.Item11, Data=bang.Branch11, Seg_GtoE=True)
toexcel_10 = SEG_GHToExcel(Write=item_23.Item7, Path="E:\brick.xlsx", Cells=item_24.Item7, Data=bang.Branch7, Seg_GtoE=True)
toexcel_11 = SEG_GHToExcel(Write=item_23.Item10, Path="E:\brick.xlsx", Cells=item_24.Item10, Data=bang.Branch10, Seg_GtoE=True)
toexcel_12 = SEG_GHToExcel(Write=item_23.Item2, Path="E:\brick.xlsx", Cells=item_24.Item2, Data=bang.Branch2, Seg_GtoE=True)
