# Grasshopper definition 160729_mesh.gh (Grasshopper 0.9.76)

quad = MeshQuad(CornerA=0, CornerB=1, CornerC=2, CornerD=3)
mesh = Mesh(<mesh referenced from the Rhino model>)
demesh = DeconstructMesh(Mesh=mesh)  # -> Vertices, Faces, Colours, Normals
panel = Panel(demesh.Vertices)
pt = Point(Point(-8.327484199, -51.10408807, 19.05390863))
deface = DeconstructFace(Face=demesh.Faces)  # -> CornerA, CornerB, CornerC, CornerD
dist = Distance(PointA=demesh.Vertices, PointB=pt)
pt_2 = Point(demesh.Vertices)
quad_2 = MeshQuad(CornerA=deface.CornerA, CornerB=deface.CornerB, CornerC=deface.CornerC, CornerD=deface.CornerD)

bnd = Bounds(Numbers=dist)
remap = RemapNumbers(Value=dist, Source=bnd, Target=Domain(0, 1))  # -> Mapped, Clipped

conmesh = ConstructMesh(Vertices=pt_2, Faces=quad_2, Colours=ColourSwatch(SwatchColor=RGB(250, 248, 255)))
conmesh_2 = ConstructMesh(Vertices=[Point(0, 0, 0), Point(10, 0, 0), Point(10, 10, 0), Point(0, 10, 0)], Faces={A=0, B=1, C=2, D=3})
gradient = Gradient(
    LowerLimit=0,
    UpperLimit=1,
    Parameter=remap.Mapped,
    stops=[0: RGB(20, 217, 133), 0: RGB(119, 53, 109), 0: RGB(255, 130, 160), 0.183: RGB(84, 227, 186), 0.294: RGB(122, 5, 23), 0.427: RGB(222, 143, 172), 0.555: RGB(168, 156, 87), 0.775: RGB(215, 80, 221), 0.899: RGB(220, 0, 40)])
mesh_2 = Mesh(conmesh)
triangle = MeshTriangle(CornerA=0, CornerB=1, CornerC=2)
mcol = MeshColours(Mesh=mesh_2, Colours=ColourSwatch(SwatchColor=RGB(126, 152, 255)))
mspray = MeshSpray(Mesh=mesh, Points=demesh.Vertices, Colours=gradient, SprayMode=11)
