# Grasshopper definition flod.gh (Grasshopper 0.9.76)
# plug-ins: Kangaroo Components

series = Series(Start=0, Step=Slider(1, range=0..10), Count=10)
panel = Panel("""0
1""")
cull_pattern = CullPattern(List=series, CullPattern=panel)
panel_2 = Panel(cull_pattern)
rectangle = Rectangle(Plane=PlaneXY(0, 0, 0), XSize=Slider(72.952, range=0..100), YSize=Slider(14.906, range=0..100), Radius=0)  # -> Rectangle, Length
mesh_plane = MeshPlane(Boundary=rectangle.Rectangle, WidthCount=Slider(15, range=0..100), HeightCount=Slider(1, range=0..1))  # -> Mesh, Area
mesh_edges = MeshEdges(Mesh=mesh_plane.Mesh)  # -> NakedEdges, InteriorEdges, NonManifoldEdges
merge = Merge(Data1=mesh_edges.NakedEdges, Data2=mesh_edges.InteriorEdges)  # -> flatten(Result)
panel_3 = Panel("""0
1""")
list_item = ListItem(List=mesh_edges.NakedEdges, Index="0", Wrap=True)
curve = Curve(mesh_edges.InteriorEdges)
reverse_list = ReverseList(List=mesh_edges.NakedEdges)
reverse_list_2 = ReverseList(List=panel_3)
list_item_2 = ListItem(List=reverse_list, Index="0", Wrap=True)
end_points = EndPoints(Curve=list_item)  # -> Start, End
end_points_2 = EndPoints(Curve=list_item_2)  # -> Start, End
springsfromline = SpringsFromLine(Connection=merge, Stiffness=1000, Damping=10, RestLength=merge, UpperCutoff=0, LowerCutoff=0, Plasticity=0)
cull_pattern_2 = CullPattern(List=curve, CullPattern=panel_3)
cull_pattern_3 = CullPattern(List=curve, CullPattern=reverse_list_2)
merge_2 = Merge(Data1=end_points_2.Start, Data2=end_points_2.End)
merge_3 = Merge(Data1=end_points.Start, Data2=end_points.End)
end_points_3 = EndPoints(Curve=cull_pattern_3)  # -> Start, End
end_points_4 = EndPoints(Curve=cull_pattern_2)  # -> Start, End
entwine = Entwine(Branch00=merge_3, Branch01=merge_2, FlattenInputs=True)  # -> flatten(Result)
boolean_toggle = BooleanToggle(True)
unit_z = UnitZ(Factor=Slider(8.575, range=0..10))
merge_4 = Merge(Data1=end_points_4.Start, Data2=end_points_4.End)
merge_5 = Merge(Data1=end_points_3.Start, Data2=end_points_3.End)
panel_4 = Panel("""0
1""")
# 对点进行约束
anchorxyz = AnchorXYZ(Point=merge_5, ConstrainX=Toggle(False), ConstrainY=boolean_toggle, ConstrainZ=boolean_toggle)
cull_pattern_4 = CullPattern(List=merge_4, CullPattern=panel_4)
unaryforce = UnaryForce(Point=cull_pattern_4, Force=unit_z)
panel_5 = Panel(anchorxyz)
# 解算的几何对象
entwine_2 = Entwine(
    Branch00=mesh_plane.Mesh,
    Branch01=merge,
    Branch02=cull_pattern_4,
    Branch03=merge_5,
    Branch04=entwine,
    FlattenInputs=True)
# 力对象
merge_6 = Merge(Data1=unaryforce, Data2=anchorxyz, Data3=springsfromline)  # -> flatten(Result)
panel_6 = Panel(cull_pattern_2)
number_slider = Slider(0.483, range=0..1)
timer = Timer(TimerInterval=20, Target=kangaroophysics)
kangaroophysics = KangarooPhysics(ForceObjects=merge_6, Settings=null, Geometry=entwine_2, SimulationReset=Toggle(True))  # -> Out, Iterations, ParticlesOut, simplify(GeometryOut), KE
negative = Negative(Value=number_slider)
tree_branch = TreeBranch(Tree=kangaroophysics.GeometryOut, Path="3", MaintainPaths=True)
construct_domain = ConstructDomain(DomainStart=number_slider, DomainEnd=negative)
tree_branch_2 = TreeBranch(Tree=kangaroophysics.GeometryOut, Path="2", MaintainPaths=True)
tree_branch_3 = TreeBranch(Tree=kangaroophysics.GeometryOut, Path="4", MaintainPaths=True)
panel_7 = Panel(kangaroophysics.Iterations)
circle = Circle(Plane=tree_branch_3, Radius=number_slider)
panel_8 = Panel(kangaroophysics.GeometryOut)
vector_display = VectorDisplay(Anchor=tree_branch_2, Vector=unit_z)
rectangle_2 = Rectangle(Plane=tree_branch, XSize=construct_domain, YSize=construct_domain, Radius=0)  # -> Rectangle, Length
point_list = PointList(Points=tree_branch, Size=Slider(1.164, range=0..10))
