# Grasshopper definition CreateDataTree.gh (Grasshopper 0.9.76)
# plug-ins: Python Interpreter

python = PythonScript()  # -> out, pts
# ---------- python: Python ----------
from Grasshopper.Kernel.Data import GH_Path
from Grasshopper import DataTree
from Rhino.Geometry import Point3d
pts = DataTree[Point3d]()
a = []; b = []
for i in range(10):
    if (i%2 == 0):
        a.append(Point3d(i,0,0))
    else:
        b.append(Point3d(0,i,0))
pts.AddRange(a,GH_Path(0))
pts.AddRange(b,GH_Path((0,1)))
pts.Add(Point3d(10,10,10),GH_Path(10))
# ---------- end python ----------
panel = Panel(python.pts)
