# Grasshopper definition DataTree_DeonstructPath.gh (Grasshopper 0.9.76)
# plug-ins: Python Interpreter

series = Series(Start=0, Step=1, Count=3)
series_2 = Series(Start=series, Step=1, Count=4)  # -> simplify(Series)
construct_path = ConstructPath(Indices=series_2)  # -> simplify(Branch)
panel = Panel(construct_path)
python_script = PythonScript(branches=panel)  # -> out, DPath; inputs branches: tree
# ---------- python_script: Python ----------
from Grasshopper.Kernel.Data import GH_Path
from Grasshopper import DataTree

#Deconstruct Path
DPath = DataTree[object]()
#先把字符串转换成列表
branch_count = branches.BranchCount
for i in xrange(branch_count):
    
    branch = branches.Branch(i)[0]
    #print (branch[0])
    data_list = []
    for j in branch:
        if not ((j in "{") or (j in "}") or (j in ";")):
            data_list.append(int(j))
            print ("add %s"% j)
    print (data_list)
    #再把列表放到树形结构中
    path = GH_Path(i,0)
    DPath.AddRange(data_list,path)
# ---------- end python_script ----------
deconstruct_path = DeconstructPath(Branch=panel)
panel_2 = Panel(python_script.DPath)
panel_3 = Panel(deconstruct_path)
