# Grasshopper definition DataTree_example.gh (Grasshopper 0.9.76)
# plug-ins: Python Interpreter

python = PythonScript()  # -> out, a
# ---------- python: Python ----------
import rhinoscriptsyntax as rs
import math as m
from Grasshopper.Kernel.Data import GH_Path
from Grasshopper import DataTree
from Rhino.Geometry import Point3d as Point3d 
pi = m.pi

angle = 0
pts = DataTree[Point3d]()#创建一个树形数据
c = 0
for i in rs.frange(0,20,0.5): #float要引用rs.frange()
    angle +=(pi/30)
    layer = []
    for j in rs.frange(0,2*pi,pi/15):
        x = 5*m.sin(j+angle)
        y = 5*m.cos(j+angle)
        layer.append(Point3d(x,y,i))
    pts.AddRange(layer,GH_Path(c))
    c +=1
    
a = pts
# ---------- end python ----------
flip = FlipMatrix(Data=python.a)
intcrv = Interpolate(Vertices=flip, Degree=3, Periodic=False, KnotStyle=1)  # -> Curve, Length, Domain
pipe = Pipe(Curve=intcrv.Curve, Radius=Slider(0.1, range=0..0.1), Caps=0)
panel = Panel(python.a)
