# Grasshopper definition DataTree_method.gh (Grasshopper 0.9.76)
# plug-ins: Python Interpreter

series = Series(Start=0, Step=1, Count=10)
python = PythonScript()  # -> out, a
# ---------- python: Python ----------
from Grasshopper.Kernel.Data import GH_Path
from Grasshopper import DataTree

tree = DataTree[object]()

print (tree)
# ---------- end python ----------
partition = PartitionList(List=series, Size=[3, 2])
pt = Point([Point(1.300776012, -1.869010416, 0), Point(4.032812551, -3.007358974, 0), Point(6.233619763, 0.0282371806, 0), Point(4.336372167, 1.849594873, 0), Point(0.8454365892, 1.925484777, 0), Point(0.01064764678, 0.7871362191, 0)])
line = Line([Line((-5.023516236, 9.287929654, 0), (-2.194064693, 10.15853013, 0)), Line((-2.847015049, 7.111428467, 0), (-5.241166354, 6.67612823, 0)), Line((-8.070617897, 9.070279535, 0), (-4.152915761, 12.55268143, 0)), Line((0.2000866116, 14.94683274, 0), (5.858989696, 9.723229891, 0)), Line((2.594237917, 7.546728704, 0), (-0.01756350702, 6.67612823, 0)), Line((0.4177367303, 11.24678072, 0), (3.464838391, 8.852629416, 0)), Line((7.817840764, 6.67612823, 0), (6.294289934, 4.281976925, 0)), Line((-3.064665168, 2.758426094, 0), (-9.15886849, 0.7995750266, 0))])
panel = Panel("""1
2
3
6""")
pt_2 = Point([Point(-13.07657063, 8.19967906, 0), Point(-14.38247134, 0.581924908, 0), Point(-8.723568253, -3.553427346, 0)])
line_2 = Line(Line((-15.68837205, -12.25943209, 0), (-5.676466592, 2.105475738, 0)))
box = Box({Plane=PlaneXY(6.823690327, -2.04149784, 0), X=Domain(0, 1.481744226), Y=Domain(0, 2.364043672), Z=Domain(0, 1.318850942)})
pt_3 = Point([Point(-7.200017422, -6.382878888, 0), Point(-5.241166354, 5.370227518, 0), Point(-8.723568253, 11.24678072, 0), Point(-10.4647692, 13.42328191, 0)])
python_2 = PythonScript(x=pt)  # -> out, a; inputs x: list of Point3d
# ---------- python_2: Python ----------
from Grasshopper.Kernel.Data import GH_Path
from Grasshopper import DataTree
#from Rhino.Geometry import Point3d

a = DataTree[object](x,GH_Path(1,1,1))
# ---------- end python_2 ----------
partition_2 = PartitionList(List=line, Size=[3, 2])
python_3 = PythonScript(x=partition)  # -> out, a; inputs x: tree
# ---------- python_3: Python ----------
from Grasshopper.Kernel.Data import GH_Path
from Grasshopper import DataTree

#浅复制一个树形结构
a = DataTree[object](x)

print (a)
# ---------- end python_3 ----------
panel_2 = Panel(partition_2)
panel_3 = Panel(python_2.a)
python_4 = PythonScript(x=panel, y=pt_2, z=line_2, u=box)  # -> out, a, tree; inputs x: list, y: list of Point3d, z: Curve, u: Brep
# ---------- python_4: Python ----------
from Grasshopper.Kernel.Data import GH_Path
from Grasshopper import DataTree

tree = DataTree[object]()
tree.AddRange(x,GH_Path(0,0,0))
tree.AddRange(y,GH_Path(1,0))
tree.Add(z,GH_Path(1))
tree.Add(u)
# ---------- end python_4 ----------
panel_4 = Panel(python_3.a)
python_5 = PythonScript(x=partition_2)  # -> out, a, tree; inputs x: tree of Curve
# ---------- python_5: Python ----------
from Grasshopper.Kernel.Data import GH_Path
from Grasshopper import DataTree

print (x)
input = ghenv.Component.Params.Input

def MyDuplicate(input):
    if (input == None):
        return None
    else:
        return input.DuplicateCurve()

#深复制一个已经存在的树形数据
tree = DataTree[object](x,MyDuplicate)
# ---------- end python_5 ----------
panel_5 = Panel(partition)
panel_6 = Panel(python_4.tree)
panel_7 = Panel(python_5.tree)
panel_8 = Panel(python_5.a)

series_2 = Series(Start=1, Step=1, Count=3)  # -> simplify(flatten(Series))
panel_9 = Panel("""a
b
c
d""")
panel_10 = Panel("""1
2
3
4
5
6""")
panel_11 = Panel("""1
2
3
4
5
6""")
panel_12 = Panel("""1
2
3
4
5
6""")
panel_13 = Panel("""1
2
3
4
5
6""")
panel_14 = Panel("""1
2
3
4
5
6""")
panel_15 = Panel("""1
2
3
4
5
6""")
panel_16 = Panel("""1
2
3
4
5
6""")
panel_17 = Panel("""1
2
3
4
5
6""")
panel_18 = Panel("""1
2
3
4
5
6""")
panel_19 = Panel("""1
2
3
4
5
6""")
panel_20 = Panel("""1
2
3
4
5
6""")
cir = Circle(Plane=PlaneXY(0, 0, 0), Radius=series_2)  # -> graft(Circle)
pt_4 = Point([Point(-13.9471711, -2.247526634, 0), Point(-11.98832003, 6.240827993, 0), Point(-6.329416948, 2.976076213, 0), Point(-5.458816473, -2.90047699, 0)])
line_3 = Line(Line((-12.85892051, -11.1711815, 0), (-10.68241932, 3.629026569, 0)))
box_2 = Box({Plane=PlaneXY(9.019358932, -5.32281796, 0), X=Domain(0, 0.4737634506), Y=Domain(0, 2.359045551), Z=Domain(0, 1.350268555)})
pt_5 = Point([Point(-13.9471711, -2.247526634, 0), Point(-11.98832003, 6.240827993, 0), Point(-6.329416948, 2.976076213, 0), Point(-5.458816473, -2.90047699, 0)])
line_4 = Line(Line((-12.85892051, -11.1711815, 0), (-10.68241932, 3.629026569, 0)))
box_3 = Box({Plane=PlaneXY(9.019358932, -5.32281796, 0), X=Domain(0, 0.4737634506), Y=Domain(0, 2.359045551), Z=Domain(0, 1.350268555)})
pt_6 = Point([Point(-13.9471711, -2.247526634, 0), Point(-11.98832003, 6.240827993, 0), Point(-6.329416948, 2.976076213, 0), Point(-5.458816473, -2.90047699, 0)])
line_5 = Line(Line((-12.85892051, -11.1711815, 0), (-10.68241932, 3.629026569, 0)))
box_4 = Box({Plane=PlaneXY(9.019358932, -5.32281796, 0), X=Domain(0, 0.4737634506), Y=Domain(0, 2.359045551), Z=Domain(0, 1.350268555)})
pt_7 = Point([Point(-13.9471711, -2.247526634, 0), Point(-11.98832003, 6.240827993, 0), Point(-6.329416948, 2.976076213, 0), Point(-5.458816473, -2.90047699, 0)])
line_6 = Line(Line((-12.85892051, -11.1711815, 0), (-10.68241932, 3.629026569, 0)))
box_5 = Box({Plane=PlaneXY(9.019358932, -5.32281796, 0), X=Domain(0, 0.4737634506), Y=Domain(0, 2.359045551), Z=Domain(0, 1.350268555)})
pt_8 = Point([Point(-13.9471711, -2.247526634, 0), Point(-11.98832003, 6.240827993, 0), Point(-6.329416948, 2.976076213, 0), Point(-5.458816473, -2.90047699, 0)])
line_7 = Line(Line((-12.85892051, -11.1711815, 0), (-10.68241932, 3.629026569, 0)))
box_6 = Box({Plane=PlaneXY(9.019358932, -5.32281796, 0), X=Domain(0, 0.4737634506), Y=Domain(0, 2.359045551), Z=Domain(0, 1.350268555)})
panel_21 = Panel("""1
2
3
4
5
6""")
sph = Sphere(Base=PlaneXY(0, 0, 0), Radius=1)
pt_9 = Point([Point(-13.9471711, -2.247526634, 0), Point(-11.98832003, 6.240827993, 0), Point(-6.329416948, 2.976076213, 0), Point(-5.458816473, -2.90047699, 0)])
line_8 = Line(Line((-12.85892051, -11.1711815, 0), (-10.68241932, 3.629026569, 0)))
pt_10 = Point([Point(-13.9471711, -2.247526634, 0), Point(-11.98832003, 6.240827993, 0), Point(-6.329416948, 2.976076213, 0), Point(-5.458816473, -2.90047699, 0)])
line_9 = Line(Line((-12.85892051, -11.1711815, 0), (-10.68241932, 3.629026569, 0)))
box_7 = Box({Plane=PlaneXY(9.019358932, -5.32281796, 0), X=Domain(0, 0.4737634506), Y=Domain(0, 2.359045551), Z=Domain(0, 1.350268555)})
pt_11 = Point([Point(-13.9471711, -2.247526634, 0), Point(-11.98832003, 6.240827993, 0), Point(-6.329416948, 2.976076213, 0), Point(-5.458816473, -2.90047699, 0)])
line_10 = Line(Line((-12.85892051, -11.1711815, 0), (-10.68241932, 3.629026569, 0)))
box_8 = Box({Plane=PlaneXY(9.019358932, -5.32281796, 0), X=Domain(0, 0.4737634506), Y=Domain(0, 2.359045551), Z=Domain(0, 1.350268555)})
box_9 = Box({Plane=PlaneXY(9.019358932, -5.32281796, 0), X=Domain(0, 0.4737634506), Y=Domain(0, 2.359045551), Z=Domain(0, 1.350268555)})
pt_12 = Point([Point(-13.9471711, -2.247526634, 0), Point(-11.98832003, 6.240827993, 0), Point(-6.329416948, 2.976076213, 0), Point(-5.458816473, -2.90047699, 0)])
line_11 = Line(Line((-12.85892051, -11.1711815, 0), (-10.68241932, 3.629026569, 0)))
box_10 = Box({Plane=PlaneXY(9.019358932, -5.32281796, 0), X=Domain(0, 0.4737634506), Y=Domain(0, 2.359045551), Z=Domain(0, 1.350268555)})
pt_13 = Point([Point(-13.9471711, -2.247526634, 0), Point(-11.98832003, 6.240827993, 0), Point(-6.329416948, 2.976076213, 0), Point(-5.458816473, -2.90047699, 0)])
line_12 = Line(Line((-12.85892051, -11.1711815, 0), (-10.68241932, 3.629026569, 0)))
box_11 = Box({Plane=PlaneXY(9.019358932, -5.32281796, 0), X=Domain(0, 0.4737634506), Y=Domain(0, 2.359045551), Z=Domain(0, 1.350268555)})
pt_14 = Point([Point(-13.9471711, -2.247526634, 0), Point(-11.98832003, 6.240827993, 0), Point(-6.329416948, 2.976076213, 0), Point(-5.458816473, -2.90047699, 0)])
line_13 = Line(Line((-12.85892051, -11.1711815, 0), (-10.68241932, 3.629026569, 0)))
box_12 = Box({Plane=PlaneXY(9.019358932, -5.32281796, 0), X=Domain(0, 0.4737634506), Y=Domain(0, 2.359045551), Z=Domain(0, 1.350268555)})
panel_22 = Panel("""1
2
3
4
5
6""")
pt_15 = Point([Point(-13.9471711, -2.247526634, 0), Point(-11.98832003, 6.240827993, 0), Point(-6.329416948, 2.976076213, 0), Point(-5.458816473, -2.90047699, 0)])
line_14 = Line(Line((-12.85892051, -11.1711815, 0), (-10.68241932, 3.629026569, 0)))
box_13 = Box({Plane=PlaneXY(9.019358932, -5.32281796, 0), X=Domain(0, 0.4737634506), Y=Domain(0, 2.359045551), Z=Domain(0, 1.350268555)})
panel_23 = Panel(cir)
pt_16 = Point([Point(-13.9471711, -2.247526634, 0), Point(-11.98832003, 6.240827993, 0), Point(-6.329416948, 2.976076213, 0), Point(-5.458816473, -2.90047699, 0)])
line_15 = Line(Line((-12.85892051, -11.1711815, 0), (-10.68241932, 3.629026569, 0)))
box_14 = Box({Plane=PlaneXY(9.019358932, -5.32281796, 0), X=Domain(0, 0.4737634506), Y=Domain(0, 2.359045551), Z=Domain(0, 1.350268555)})
python_6 = PythonScript(x=panel_10, y=pt_4, z=line_3, u=box_2)  # -> out, tree, p, b, c; inputs x: list, y: list of Point3d
# ---------- python_6: Python ----------
from Grasshopper.Kernel.Data import GH_Path
from Grasshopper import DataTree

tree = DataTree[object]()
tree.AddRange(x,GH_Path (0,0,0))
tree.AddRange(y,GH_Path(1,0))
tree.Add(z,GH_Path(1))
tree.Add(u)

p = tree.Path(2)
b = tree.Branch(GH_Path(1,0))
c = tree.Branch(p)
print (type(b))
# ---------- end python_6 ----------
python_7 = PythonScript(x=panel_14, y=pt_8, z=line_7, u=box_6)  # -> out, tree; inputs x: list, y: list of Point3d
# ---------- python_7: Python ----------
from Grasshopper.Kernel.Data import GH_Path
from Grasshopper import DataTree

tree = DataTree[object]()
tree.AddRange(x,GH_Path (0,0,0))
tree.AddRange(y,GH_Path(1,0))
tree.Add(z,GH_Path(1))
tree.Add(u)

print (tree.PathExists(GH_Path(1,0))) #PathExists判断指定路径是否真的存在
print (tree.PathExists(GH_Path(1,1))) #False
print (tree.PathExists(1,0)) #True
# ---------- end python_7 ----------
python_8 = PythonScript(x=panel_12, y=pt_6, z=line_5, u=box_4)  # -> out, tree; inputs x: list, y: list of Point3d
# ---------- python_8: Python ----------
from Grasshopper.Kernel.Data import GH_Path
from Grasshopper import DataTree

tree = DataTree[object]()
tree.AddRange(x,GH_Path (0,0,0))
tree.AddRange(y,GH_Path(1,0))
tree.Add(z,GH_Path(1))
tree.Add(u)

print ( tree.ItemExists(GH_Path(1),0)) #True

print (tree.ItemExists(GH_Path(1,0),2)) #True

print (tree.ItemExists(GH_Path(0,0,0),6)) #False
# ---------- end python_8 ----------
python_9 = PythonScript(x=panel_13, y=pt_7, z=line_6, u=box_5)  # -> out, tree, tree1, tree_m; inputs x: list, y: list of Point3d
# ---------- python_9: Python ----------
from Grasshopper.Kernel.Data import GH_Path
from Grasshopper import DataTree

tree = DataTree[object]()
tree.AddRange(x,GH_Path (0,0,0))
tree.AddRange(y,GH_Path(1,0))
tree.Add(z,GH_Path(1))
tree.Add(u)

tree1 = DataTree[object]()
tree1.AddRange([i for i in range(5)],GH_Path(0,0,0))
tree1.Add(5,GH_Path(2,0))

tree_m = DataTree[object](tree)
tree_m.MergeTree(tree1)
# ---------- end python_9 ----------
python_10 = PythonScript(x=panel_11, y=pt_5, z=line_4, u=box_3)  # -> out, a, tree, b; inputs x: list, y: list of Point3d
# ---------- python_10: Python ----------
from Grasshopper.Kernel.Data import GH_Path
from Grasshopper import DataTree

tree = DataTree[object]()
tree.AddRange(x,GH_Path (0,0,0))
tree.AddRange(y,GH_Path(1,0))
tree.Add(z,GH_Path(1))
tree.Add(u)

tree.EnsurePath(100,100,100)
tree.EnsurePath(99)
tree.EnsurePath(GH_Path(100,100,99))
tree.EnsurePath(GH_Path(100,100,100)) #重复的不会被创造了
# ---------- end python_10 ----------
python_11 = PythonScript(x=panel_17, y=pt_11, z=line_10, u=box_9)  # -> out, tree; inputs x: list, y: list of Point3d
# ---------- python_11: Python ----------
from Grasshopper.Kernel.Data import GH_Path
from Grasshopper import DataTree

tree = DataTree[object]()
tree.AddRange(x,GH_Path (0,0,0))
tree.AddRange(y,GH_Path(1,0))
tree.Add(z,GH_Path(1))
tree.Add(u)

tree.RemovePath(1,0)
# ---------- end python_11 ----------
python_12 = PythonScript(x=panel_16, y=pt_10, z=line_9, u=box_7, v=sph)  # -> out, tree; inputs x: list, y: list of Point3d, v: Surface
# ---------- python_12: Python ----------
from Grasshopper.Kernel.Data import GH_Path
from Grasshopper import DataTree

tree = DataTree[object]()
tree.AddRange(x,GH_Path (0,0,0))
tree.AddRange(y,GH_Path(1,0))
tree.Add(z,GH_Path(1))
tree.Add(u)

tree.Insert(v,GH_Path(0,0,0),1)
# ---------- end python_12 ----------
python_13 = PythonScript(x=panel_18, y=pt_12, z=line_11, u=box_10)  # -> out, tree, a; inputs x: list, y: list of Point3d
# ---------- python_13: Python ----------
from Grasshopper.Kernel.Data import GH_Path
from Grasshopper import DataTree

tree = DataTree[object]()
tree.AddRange(x,GH_Path (0,0,0))
tree.AddRange(y,GH_Path(1,0))
tree.Add(z,GH_Path(1))
tree.Add(u)

tree.RenumberPaths()#所有路径分支从0开始重新命名
tree.RenumberPaths("0;{i}") #对编号进行设计
tree.RenumberPaths("0;{i};{i}+1")
# ---------- end python_13 ----------
panel_24 = Panel(python_13.a)
python_14 = PythonScript(x=panel_15, y=pt_9, z=line_8, u=box_8)  # -> out, a, tree, b; inputs x: list, y: list of Point3d
# ---------- python_14: Python ----------
from Grasshopper.Kernel.Data import GH_Path
from Grasshopper import DataTree

tree = DataTree[object]()
tree.AddRange(x,GH_Path (0,0,0))
tree.AddRange(y,GH_Path(1,0))
tree.Add(z,GH_Path(1))
tree.Add(u)

tree.Flatten()
# ---------- end python_14 ----------
python_15 = PythonScript(x=panel_19, y=pt_13, z=line_12, u=box_11)  # -> out, a, tree, b; inputs x: list, y: list of Point3d
# ---------- python_15: Python ----------
from Grasshopper.Kernel.Data import GH_Path
from Grasshopper import DataTree

tree = DataTree[object]()
tree.AddRange(x,GH_Path (0,0,0))
tree.AddRange(y,GH_Path(1,0))
tree.Add(z,GH_Path(1))
tree.Add(u)

tree.Graft()
# ---------- end python_15 ----------
python_16 = PythonScript(x=panel_20, y=pt_14, z=line_13, u=box_12, v=cir)  # -> out, tree; inputs x: list, y: list of Point3d, v: tree
# ---------- python_16: Python ----------
from Grasshopper.Kernel.Data import GH_Path
from Grasshopper import DataTree

tree = DataTree[object]()
tree.AddRange(x,GH_Path (0,0,0))
tree.AddRange(y,GH_Path(1,0))
tree.Add(z,GH_Path(1))
tree.Add(u)

tree.MergeTree(v)
tree.SimplifyPaths()
print (tree.ToString()) #tree {1;6;1;1;1;5}
#tree.TrimExcess()
# ---------- end python_16 ----------
python_17 = PythonScript(x=panel_22, y=pt_16, z=line_15, u=box_14)  # -> out, a, tree, b, c, d; inputs x: list, y: list of Point3d
# ---------- python_17: Python ----------
from Grasshopper.Kernel.Data import GH_Path
from Grasshopper import DataTree

tree = DataTree[object]()
tree.AddRange(x,GH_Path (0,0,0))
tree.AddRange(y,GH_Path(1,0))
tree.Add(z,GH_Path(1))
tree.Add(u)

a = tree.AllData()  #类似于拍平数据

b = tree.Branch(0) #提取树形数据的某一支
c = tree.Branch(GH_Path(1,0))

tree.ClearData() #清空一个树形数据,不保留数据结构
print (tree) #tree {0;0;0} 保留下了结构
# ---------- end python_17 ----------
python_18 = PythonScript(x=panel_21, y=pt_15, z=line_14, u=box_13)  # -> out, a, tree, b; inputs x: list, y: list of Point3d
# ---------- python_18: Python ----------
from Grasshopper.Kernel.Data import GH_Path
from Grasshopper import DataTree

tree = DataTree[object]()
tree.AddRange(x,GH_Path (0,0,0))
tree.AddRange(y,GH_Path(1,0))
tree.Add(z,GH_Path(1))
tree.Add(u)

b = tree.AllData()
# ---------- end python_18 ----------
python_19 = PythonScript(x=panel_22, y=pt_16, z=line_15, u=box_14)  # -> out, a, tree, b, c, d; inputs x: list, y: list of Point3d
# ---------- python_19: Python ----------
from Grasshopper.Kernel.Data import GH_Path
from Grasshopper import DataTree

tree = DataTree[object]()
tree.AddRange(x,GH_Path (0,0,0))
tree.AddRange(y,GH_Path(1,0))
tree.Add(z,GH_Path(1))
tree.Add(u)

a = tree.AllData()  #类似于拍平数据

b = tree.Branch(0) #提取树形数据的某一支
c = tree.Branch(GH_Path(1,0))

tree.Clear() #清空一个树形数据,不保留数据结构
print (tree) #empty tree
# ---------- end python_19 ----------
panel_25 = Panel(python_6.c)
panel_26 = Panel(python_9.tree_m)
panel_27 = Panel(python_7.tree)
panel_28 = Panel(python_6.p)
panel_29 = Panel(python_17.tree)
panel_30 = Panel(python_11.tree)
panel_31 = Panel(python_10.tree)
panel_32 = Panel(python_18.b)
panel_33 = Panel(python_14.tree)
panel_34 = Panel(python_9.tree1)
panel_35 = Panel(python_8.tree)
panel_36 = Panel(python_12.tree)
panel_37 = Panel(python_19.b)
panel_38 = Panel(python_6.tree)
panel_39 = Panel(python_19.c)
panel_40 = Panel(python_13.tree)
panel_41 = Panel(python_16.tree)
panel_42 = Panel(python_15.tree)
panel_43 = Panel(python_19.a)
panel_44 = Panel(python_9.tree)
panel_45 = Panel(python_6.b)
panel_46 = Panel(python_19.tree)

panel_47 = Panel("""1
2
3
4
5
6""")
pt_17 = Point([Point(-13.9471711, -2.247526634, 0), Point(-11.98832003, 6.240827993, 0), Point(-6.329416948, 2.976076213, 0), Point(-5.458816473, -2.90047699, 0)])
line_16 = Line(Line((-12.85892051, -11.1711815, 0), (-10.68241932, 3.629026569, 0)))
box_15 = Box({Plane=PlaneXY(9.019358932, -5.32281796, 0), X=Domain(0, 0.4737634506), Y=Domain(0, 2.359045551), Z=Domain(0, 1.350268555)})
python_20 = PythonScript(x=panel_47, y=pt_17, z=line_16, u=box_15)  # -> out, tree; inputs x: list, y: list of Point3d
# ---------- python_20: Python ----------
from Grasshopper.Kernel.Data import GH_Path
from Grasshopper import DataTree

tree = DataTree[object]()
tree.AddRange(x,GH_Path (0,0,0))
tree.AddRange(y,GH_Path(1,0))
tree.Add(z,GH_Path(1))
tree.Add(u)
# ---------- end python_20 ----------
panel_48 = Panel("""1
2
3
4
5
6""")
panel_49 = Panel("""1
2
3
4
5
6""")
pt_18 = Point([Point(-13.9471711, -2.247526634, 0), Point(-11.98832003, 6.240827993, 0), Point(-6.329416948, 2.976076213, 0), Point(-5.458816473, -2.90047699, 0)])
line_17 = Line(Line((-12.85892051, -11.1711815, 0), (-10.68241932, 3.629026569, 0)))
box_16 = Box({Plane=PlaneXY(9.019358932, -5.32281796, 0), X=Domain(0, 0.4737634506), Y=Domain(0, 2.359045551), Z=Domain(0, 1.350268555)})
pt_19 = Point([Point(-13.9471711, -2.247526634, 0), Point(-11.98832003, 6.240827993, 0), Point(-6.329416948, 2.976076213, 0), Point(-5.458816473, -2.90047699, 0)])
line_18 = Line(Line((-12.85892051, -11.1711815, 0), (-10.68241932, 3.629026569, 0)))
box_17 = Box({Plane=PlaneXY(9.019358932, -5.32281796, 0), X=Domain(0, 0.4737634506), Y=Domain(0, 2.359045551), Z=Domain(0, 1.350268555)})
panel_50 = Panel("""1
2
3
4
5
6""")
panel_51 = Panel("""1
2
3
4
5
6""")
panel_52 = Panel("""1
2
3
4
5
6""")
panel_53 = Panel("""1
2
3
4
5
6""")
pt_20 = Point([Point(-13.9471711, -2.247526634, 0), Point(-11.98832003, 6.240827993, 0), Point(-6.329416948, 2.976076213, 0), Point(-5.458816473, -2.90047699, 0)])
line_19 = Line(Line((-12.85892051, -11.1711815, 0), (-10.68241932, 3.629026569, 0)))
box_18 = Box({Plane=PlaneXY(9.019358932, -5.32281796, 0), X=Domain(0, 0.4737634506), Y=Domain(0, 2.359045551), Z=Domain(0, 1.350268555)})
python_21 = PythonScript(x=panel_48, y=pt_18, z=line_17, u=box_16)  # -> out, tree, count; inputs x: list, y: list of Point3d
# ---------- python_21: Python ----------
from Grasshopper.Kernel.Data import GH_Path
from Grasshopper import DataTree

tree = DataTree[object]()
tree.AddRange(x,GH_Path (0,0,0))
tree.AddRange(y,GH_Path(1,0))
tree.Add(z,GH_Path(1))
tree.Add(u)

count = tree.BranchCount #统计分支的数量
# ---------- end python_21 ----------
pt_21 = Point([Point(-13.9471711, -2.247526634, 0), Point(-11.98832003, 6.240827993, 0), Point(-6.329416948, 2.976076213, 0), Point(-5.458816473, -2.90047699, 0)])
line_20 = Line(Line((-12.85892051, -11.1711815, 0), (-10.68241932, 3.629026569, 0)))
box_19 = Box({Plane=PlaneXY(9.019358932, -5.32281796, 0), X=Domain(0, 0.4737634506), Y=Domain(0, 2.359045551), Z=Domain(0, 1.350268555)})
pt_22 = Point([Point(-13.9471711, -2.247526634, 0), Point(-11.98832003, 6.240827993, 0), Point(-6.329416948, 2.976076213, 0), Point(-5.458816473, -2.90047699, 0)])
line_21 = Line(Line((-12.85892051, -11.1711815, 0), (-10.68241932, 3.629026569, 0)))
python_22 = PythonScript(x=panel_49, y=pt_19, z=line_18, u=box_17)  # -> out, tree, branches; inputs x: list, y: list of Point3d
# ---------- python_22: Python ----------
from Grasshopper.Kernel.Data import GH_Path
from Grasshopper import DataTree

tree = DataTree[object]()
tree.AddRange(x,GH_Path (0,0,0))
tree.AddRange(y,GH_Path(1,0))
tree.Add(z,GH_Path(1))
tree.Add(u)

#将所有路径分支下的项值放置于各自的子列表下后放置于父级列表下
branches = tree.Branches
# ---------- end python_22 ----------
box_20 = Box({Plane=PlaneXY(9.019358932, -5.32281796, 0), X=Domain(0, 0.4737634506), Y=Domain(0, 2.359045551), Z=Domain(0, 1.350268555)})
pt_23 = Point([Point(-13.9471711, -2.247526634, 0), Point(-11.98832003, 6.240827993, 0), Point(-6.329416948, 2.976076213, 0), Point(-5.458816473, -2.90047699, 0)])
line_22 = Line(Line((-12.85892051, -11.1711815, 0), (-10.68241932, 3.629026569, 0)))
box_21 = Box({Plane=PlaneXY(9.019358932, -5.32281796, 0), X=Domain(0, 0.4737634506), Y=Domain(0, 2.359045551), Z=Domain(0, 1.350268555)})
python_23 = PythonScript(x=panel_50, y=pt_20, z=line_19, u=box_18)  # -> out, tree, dataCount; inputs x: list, y: list of Point3d
# ---------- python_23: Python ----------
from Grasshopper.Kernel.Data import GH_Path
from Grasshopper import DataTree

tree = DataTree[object]()
tree.AddRange(x,GH_Path (0,0,0))
tree.AddRange(y,GH_Path(1,0))
tree.Add(z,GH_Path(1))
tree.Add(u)

dataCount = tree.DataCount

#提取每一个branch的数量
# ---------- end python_23 ----------
python_24 = PythonScript(x=panel_51, y=pt_21, z=line_20, u=box_19)  # -> out, tree, item, item1; inputs x: list, y: list of Point3d
# ---------- python_24: Python ----------
from Grasshopper.Kernel.Data import GH_Path
from Grasshopper import DataTree

tree = DataTree[object]()
tree.AddRange(x,GH_Path (0,0,0))
tree.AddRange(y,GH_Path(1,0))
tree.Add(z,GH_Path(1))
tree.Add(u)

#提取一个item tree[GH_Path(0,0,0),3]
item = tree[GH_Path(0,0,0),3]
item1 = tree[GH_Path(1,0),2]
# ---------- end python_24 ----------
python_25 = PythonScript(x=panel_52, y=pt_22, z=line_21, u=box_20)  # -> out, tree, path; inputs x: list, y: list of Point3d
# ---------- python_25: Python ----------
from Grasshopper.Kernel.Data import GH_Path
from Grasshopper import DataTree

tree = DataTree[object]()
tree.AddRange(x,GH_Path (0,0,0))
tree.AddRange(y,GH_Path(1,0))
tree.Add(z,GH_Path(1))
tree.Add(u)

path = tree.Paths #用于生成得到树形数据的路径分支
# ---------- end python_25 ----------
python_26 = PythonScript(x=panel_53, y=pt_23, z=line_22, u=box_21)  # -> out, tree, a; inputs x: list, y: list of Point3d
# ---------- python_26: Python ----------
from Grasshopper.Kernel.Data import GH_Path
from Grasshopper import DataTree

tree = DataTree[object]()
tree.AddRange(x,GH_Path (0,0,0))
tree.AddRange(y,GH_Path(1,0))
tree.Add(z,GH_Path(1))
tree.Add(u)

#得到树的拓扑结构表述，用于检测错误
a = tree.TopologyDescription
# ---------- end python_26 ----------
panel_54 = Panel(python_21.count)
panel_55 = Panel(python_22.branches)
panel_56 = Panel(python_24.item)
panel_57 = Panel(python_21.tree)
panel_58 = Panel(python_25.path)
panel_59 = Panel(python_24.item1)
panel_60 = Panel(python_25.tree)
panel_61 = Panel(python_26.a)
panel_62 = Panel(python_23.dataCount)
panel_63 = Panel(python_23.tree)
panel_64 = Panel(python_24.tree)
panel_65 = Panel("""1
2
3
4
5
6""")
pt_24 = Point([Point(-13.9471711, -2.247526634, 0), Point(-11.98832003, 6.240827993, 0), Point(-6.329416948, 2.976076213, 0), Point(-5.458816473, -2.90047699, 0)])
line_23 = Line(Line((-12.85892051, -11.1711815, 0), (-10.68241932, 3.629026569, 0)))
box_22 = Box({Plane=PlaneXY(9.019358932, -5.32281796, 0), X=Domain(0, 0.4737634506), Y=Domain(0, 2.359045551), Z=Domain(0, 1.350268555)})
python_27 = PythonScript(x=panel_65, y=pt_24, z=line_23, u=box_22)  # -> out, tree, dataCount, dataCounts; inputs x: list, y: list of Point3d
# ---------- python_27: Python ----------
from Grasshopper.Kernel.Data import GH_Path
from Grasshopper import DataTree

tree = DataTree[object]()
tree.AddRange(x,GH_Path (0,0,0))
tree.AddRange(y,GH_Path(1,0))
tree.Add(z,GH_Path(1))
tree.Add(u)

dataCount = tree.DataCount

#提取每一个branch的数量
tree.RenumberPaths()
len = tree.BranchCount
dataCounts = []
for i in range(len):
    tree1 = DataTree[object](tree.Branch(i))
    count = tree1.DataCount
    dataCounts.append(count)

sum = 0
for i in dataCounts:
    sum = sum +i

print (dataCount == sum) #True
# ---------- end python_27 ----------
panel_66 = Panel(python_27.dataCounts)
panel_67 = Panel(python_27.tree)
panel_68 = Panel("""1
2
3
4
5
6""")
pt_25 = Point([Point(-13.9471711, -2.247526634, 0), Point(-11.98832003, 6.240827993, 0), Point(-6.329416948, 2.976076213, 0), Point(-5.458816473, -2.90047699, 0)])
line_24 = Line(Line((-12.85892051, -11.1711815, 0), (-10.68241932, 3.629026569, 0)))
box_23 = Box({Plane=PlaneXY(9.019358932, -5.32281796, 0), X=Domain(0, 0.4737634506), Y=Domain(0, 2.359045551), Z=Domain(0, 1.350268555)})
python_28 = PythonScript(x=panel_68, y=pt_25, z=line_24, u=box_23)  # -> out, tree, dataCount, dataCounts; inputs x: list, y: list of Point3d
# ---------- python_28: Python ----------
from Grasshopper.Kernel.Data import GH_Path
from Grasshopper import DataTree

tree = DataTree[object]()
tree.AddRange(x,GH_Path (0,0,0))
tree.AddRange(y,GH_Path(1,0))
tree.Add(z,GH_Path(1))
tree.Add(u)

dataCount = tree.DataCount

dataCounts = []
#提取每一个branch的数量
for i in tree.Paths:
    tree1 = DataTree[object](tree.Branch(i))
    count = tree1.DataCount
    dataCounts.append(count)

sum = 0
for i in dataCounts:
    sum = sum +i

print (dataCount == sum) #True
# ---------- end python_28 ----------
panel_69 = Panel(python_28.dataCounts)
panel_70 = Panel(python_28.tree)
