# Grasshopper definition FilpMatrix.gh (Grasshopper 0.9.76)
# plug-ins: Python Interpreter

sdivide = DivideSurface(Surface=<geometry referenced from the Rhino model>, UCount=2, VCount=3)  # -> Points, Normals, Parameters
flip = FlipMatrix(Data=sdivide.Points)
python = PythonScript(x=sdivide.Points)  # -> out, Flip; inputs x: tree
# ---------- python: Python ----------
from Grasshopper.Kernel.Data import GH_Path
from Grasshopper import DataTree

#模拟Flip Matrix 对树形数据进行翻转

Flip = DataTree[object]()
#把树形数据转变成嵌套列表
data_list = []
branch_count = x.BranchCount
for i in xrange(branch_count):
    branch = x.Branch(i)
    data_list.append(branch)

#把嵌套列表进行变换后，再创建树形数据
for i in xrange(len(data_list[0])):
    list = []
    for j in xrange(len(data_list)):
        list.append(data_list[j][i])
    path = GH_Path(i)
    Flip.AddRange(list,path)
# ---------- end python ----------
python_2 = PythonScript(MultiMatrix=sdivide.Points)  # -> out, Flip, data_list; inputs MultiMatrix: tree of Point3d
# ---------- python_2: Python ----------
from Grasshopper.Kernel.Data import GH_Path
from Grasshopper import DataTree

Flip = DataTree[object]()
branch_count = MultiMatrix.BranchCount
data_list = []
print (branch_count)
for i in range(branch_count):
    branch = MultiMatrix.Branch(i)
    data_list.append(branch)
#print (data_list)


#把data_list添加到树形数据里面
tree = DataTree[object]()

for i in xrange(len(data_list[0])):
    list = []
    for j in xrange(len(data_list)):
        list.append(data_list[j][i])
    path = GH_Path(i)
    Flip.AddRange(list,path)
# ---------- end python_2 ----------
points = PointList(Points=python_2.Flip, Size=Slider(2, range=0..10))
panel = Panel(python_2.Flip)
