# Grasshopper definition LoftDivideCrvs.gh (Grasshopper 0.9.76)
# plug-ins: Python Interpreter

curve = Curve(<curve referenced from the Rhino model>)
curve_2 = Curve(<curve referenced from the Rhino model>)
python_script = PythonScript(crv1=curve, crv2=curve_2, count=Slider(13, range=0..110), scale=Slider(0.492, range=0..1))  # -> out, a; inputs crv1: Curve, crv2: Curve, count: Int32
# ---------- python_script: Python ----------
import rhinoscriptsyntax as rs

def LoftDivideCrvs(crv1,crv2,count,scale):
    listCrv1 = [];listCrv2 = [];srf = []
    
    pts1 = rs.DivideCurve(crv1,count)
    pts2 = rs.DivideCurve(crv2,count)
    
    for i in xrange(len(pts1)):
        curveList = []
        midPt = (pts1[i]+pts2[i])/2
        distance = rs.Distance(pts1[i],pts2[i])
        if (scale>1):
            new_midPt = rs.AddPoint(midPt.X,midPt.Y,distance/scale)
        else :
            new_midPt = rs.AddPoint(midPt.X,midPt.Y,distance*scale)
        curveList.extend((pts1[i],new_midPt,pts2[i]))
        #通过z值的变化生成曲线点
        curvs = rs.AddInterpCurve(curveList,3,3)
        listCrv1.append(curvs)
        line = rs.AddLine(pts1[i],pts2[i])
        listCrv2.append(line)
        
    for j in xrange(len(listCrv1)-1):
        LoftCrv = rs.AddLoftSrf([listCrv1[j],listCrv2[j+1]],None,None,3)[0]
        #print (type(LoftCrv))
        srf.append(LoftCrv)
    return srf
        

a = LoftDivideCrvs(crv1,crv2,count,scale)
# ---------- end python_script ----------
custom_preview = CustomPreview(Geometry=python_script.a, Shader=ColourSwatch(SwatchColor=RGB(78, 79, 127)))
