# Grasshopper definition Shatter_method.gh (Grasshopper 0.9.76)
# plug-ins: Python Interpreter

number_slider = Slider(0.2, range=0..1)
crv = Curve(reparameterize(<curve referenced from the Rhino model>))
crv_2 = Curve(reparameterize(<curve referenced from the Rhino model>))
pt = Point([Point(178, 25, 0), Point(197, 16, 0), Point(213, 9, 0)])
panel = Panel(crv_2)
python = PythonScript(curve=crv, y=number_slider)  # -> out, a; inputs curve: Curve
# ---------- python: Python ----------
import rhinoscriptsyntax as rs
a = curve.PointAt(y)
# ---------- end python ----------
eval = EvaluateCurve(Curve=crv, Parameter=number_slider)  # -> Point, Tangent, Angle
join = JoinCurves(Curves=crv_2, Preserve=False)
panel_2 = Panel(eval.Point)
panel_3 = Panel(python.a)
crv_cp = CurveClosestPoint(Point=pt, Curve=join)  # -> Point, Parameter, Distance
python_2 = PythonScript(pts=pt, curve=crv_2)  # -> out, new_curve, t, a, len; inputs pts: list of Point3d, curve: list of Curve
# ---------- python_2: Python ----------
import rhinoscriptsyntax as rs
new_curve = curve[0].JoinCurves(curve)
print (type(curve[0]))
v = curve[0].PointAt(0.4)
t = [new_curve[0].ClosestPoint(i,-1)[1] for i in pts]
a = new_curve[0].Split(t)
#len = rs.CurveLength(a) curveLenth和getLength什么区别
len = [j.GetLength() for j in a ]
#len = []
#len.append([j.GetLength() for j in a])
# ---------- end python_2 ----------
shatter = Shatter(Curve=join, Parameters=crv_cp.Parameter)
panel_4 = Panel(python_2.t)
panel_5 = Panel(python_2.len)
len = Length(Curve=shatter)
panel_6 = Panel(len)
