# Grasshopper definition SmartPlan.gh (Grasshopper 0.9.76)
# plug-ins: Python Interpreter

xy = XYPlane(Origin=Point(0, 0, 0))
python = PythonScript(
    width=Slider(9150, range=0..10000),
    depth=Slider(11696, range=0..100000),
    plane=xy,
    door_location=Slider(0.381, range=0..1),
    door_length=Slider(-0.434, range=-1..1))  # -> out, a, rec, lines, door_pt1, door_pt2
# ---------- python: Python ----------
import rhinoscriptsyntax as rs
from Rhino.Geometry import Point3d as Point3d

rec = rs.AddRectangle(plane,width,depth)
#lines = rs.ExplodeCurves(rec)

t = door_location
t_len = door_length
new_pt1 = rs.CurveDomain(rec)[1]*t
#创建门的第二点，point在curve的不同区间要有变化，point不能超出rec
if t_len<=0:
    new_pt2 = (new_pt1-int(new_pt1))*t_len
else :
    new_pt2 = (int(new_pt1)+1-new_pt1)*t_len
door_pt1 = rs.EvaluateCurve(rec,new_pt1)
door_pt2 = rs.EvaluateCurve(rec,new_pt1 + new_pt2)
#bug :Error door_length 不变，door_location变，会有bug 

#创建polyline，并offset
pts = []
#rec_pts = rs.ExplodeCurves(rec)
#print (rec_pts)
#print ('new_pt1:',new_pt1)
#记new_pt1为pl头点，其实也可以直接根据t值进行排序
rec_pts.append(new_pt1)
rec_pts.append(new_pt2)
print(rec_pts)
#door curve


#rs.EvaluateCurve
# ---------- end python ----------
md_slider = MDSlider(
    slider_value=Point(0.5, 0.5, 0.5),
    SliderMode=0,
    x_domain=Domain(-10000, 10000),
    y_domain=Domain(-10000, 10000),
    z_domain=Domain(0, 1))
remap = RemapNumbers(Value=Slider(0, range=0..1), Source=Domain(0, 1), Target=Domain(0, 6.283185307))  # -> Mapped, Clipped
pt = PointOriented(BasePlane=PlaneXY(0, 0, 0), UComponent=0, VComponent=0, WComponent=0)
num = Number(Slider(1730, range=0..10000))
num_2 = Number(Slider(5000, range=0..100000))
prot = RotatePlane(Plane=md_slider, Angle=remap.Mapped)
preview = CustomPreview(Geometry=python.door_pt2, Shader=ColourSwatch(SwatchColor=RGB(255, 255, 255)))
panel = Panel(python.out)
panel_2 = Panel(python.lines)
int = Integer("200")
rectangle = Rectangle(Plane=prot, XSize=num, YSize=num_2, Radius=0)  # -> Rectangle, Length
offset = Offset(Curve=rectangle.Rectangle, Distance=int, Plane=PlaneXY(0, 0, 0), Corners=1)
pline = PolyLine(Closed=False)
