# Grasshopper definition 01_list_04_truss.gh (Grasshopper 0.9.76)
# plug-ins: Python Interpreter

panel = Panel("7")  # disabled
pt = ConstructPoint(XCoordinate=panel, YCoordinate=0, ZCoordinate=0)  # disabled
number_slider = Slider(15.5, range=0..100)  # disabled
number_slider_2 = Slider(2.132, range=0..10)  # disabled
Y = UnitY(Factor=1)  # disabled
xy = XYPlane(Origin=Point(0, 0, 0))  # disabled
line = LineSDL(Start=pt, Direction=Y, Length=number_slider)  # disabled
neg = Negative(Value=number_slider_2)  # disabled
offset = Offset(Curve=line, Distance=[neg, number_slider_2], Plane=xy, Corners=1)  # -> flatten(Curve); disabled
panel_2 = Panel("1")  # disabled
offset_2 = Offset(Curve=line, Distance=[neg, number_slider_2], Plane=xy, Corners=1)  # -> simplify(Curve); disabled
ext = ExtendCurve(Curve=line, Type=0, Start=panel_2, End=panel_2)  # disabled
number_slider_3 = Slider(0.36743, range=0..100)  # disabled
panel_3 = Panel(offset_2)  # disabled
len = Length(Curve=ext)  # disabled
end = EndPoints(Curve=ext)  # -> Start, End; disabled
panel_4 = Panel("1")  # disabled
panel_5 = Panel("15")  # disabled
number_slider_4 = Slider(1.105, range=0..10)  # disabled
subtraction = Subtraction(A=panel_5, B=panel_4)  # disabled
pdecon = Deconstruct(Point=end.Start)  # -> XComponent, YComponent, ZComponent; disabled
pdecon_2 = Deconstruct(Point=end.End)  # -> XComponent, YComponent, ZComponent; disabled
addition = Addition(A=len, B=number_slider_3)  # disabled
Z = UnitZ(Factor=1)  # disabled
panel_6 = Panel("""True
False""")  # disabled
addition_2 = Addition(A=pdecon.ZComponent, B=number_slider_4)  # disabled
addition_3 = Addition(A=pdecon_2.ZComponent, B=number_slider_4)  # disabled
panel_7 = Panel("1")  # disabled
panel_8 = Panel("15")  # disabled
merge = Merge()  # disabled
pt_2 = ConstructPoint(XCoordinate=pdecon_2.XComponent, YCoordinate=pdecon_2.YComponent, ZCoordinate=addition_3)  # disabled
pt_3 = ConstructPoint(XCoordinate=pdecon.XComponent, YCoordinate=pdecon.YComponent, ZCoordinate=addition_2)  # disabled
cat = Catenary(PointA=pt_3, PointB=pt_2, Length=addition, Gravity=Z)  # disabled
dup = DuplicateData(Data=cat, Number=2, Order=True)  # -> simplify(graft(Data)); disabled
merge_2 = Merge(Data1=offset_2, Data2=dup)  # disabled
divide = DivideCurve(Curve=merge_2, Count=subtraction, Kinks=False)  # -> Points, Tangents, Parameters; disabled
cull = CullPattern(List=divide.Points, CullPattern=panel_6)  # disabled
path_mapper = PathMapper(cull, source="{A;B}(i)", target="{A;i}")  # disabled
path_mapper_2 = PathMapper(path_mapper, source="{A;B}", target="{A}")  # disabled
subtraction_2 = Subtraction(A=panel_8, B=panel_7)  # disabled
cat_2 = Catenary(PointA=pt_3, PointB=pt_2, Length=addition, Gravity=Z)  # disabled
panel_9 = Panel("2")  # disabled
neg_2 = Negative(Value=panel_9)  # disabled
pline = PolyLine(Vertices=path_mapper_2, Closed=False)  # disabled
divide_2 = DivideCurve(Curve=cat_2, Count=subtraction_2, Kinks=False)  # -> Points, Tangents, Parameters; disabled
divide_3 = DivideCurve(Curve=offset, Count=subtraction_2, Kinks=False)  # -> Points, Tangents, Parameters; disabled
shift = ShiftList(List=divide_3.Points, Shift=neg_2, Wrap=False)  # disabled
shift_2 = ShiftList(List=divide_2.Points, Shift=panel_9, Wrap=False)  # disabled
bang = ExplodeTree(Data=divide_3.Points)  # -> Branch0, Branch1; disabled
bang_2 = ExplodeTree(Data=shift)  # -> Branch0, Branch1; disabled
entwine = Entwine(Branch00=bang.Branch0, Branch01=divide_2.Points, Branch02=bang.Branch1, FlattenInputs=True)  # disabled
entwine_2 = Entwine(Branch00=bang_2.Branch0, Branch01=shift_2, Branch02=bang_2.Branch1, FlattenInputs=True)  # disabled
panel_10 = Panel("""True
False""")  # disabled
panel_11 = Panel("""True
False""")  # disabled
cull_2 = CullPattern(List=entwine, CullPattern=panel_10)  # disabled
cull_3 = CullPattern(List=entwine_2, CullPattern=panel_11)  # disabled
flip = FlipMatrix(Data=cull_2)  # disabled
flip_2 = FlipMatrix(Data=cull_3)  # disabled
pline_2 = PolyLine(Vertices=flip, Closed=False)  # disabled
pline_3 = PolyLine(Vertices=flip_2, Closed=False)  # disabled
panel_12 = Panel(flip)  # disabled
panel_13 = Panel(entwine_2)  # disabled

number_slider_5 = Slider(5.28, range=0..10)  # disabled
number_slider_6 = Slider(36.73, range=0..100)  # disabled
panel_14 = Panel("{1,0,0}")  # disabled
neg_3 = Negative(Value=number_slider_5)  # disabled
pt_4 = Point(Point(35.26170422, 12.20206493, 0))  # disabled
number_slider_7 = Slider(2.875, range=0..10)  # disabled
merge_3 = Merge(Data1=number_slider_5, Data2=neg_3)  # disabled
xy_2 = XYPlane(Origin=Point(0, 0, 0))  # disabled
line_2 = LineSDL(Start=pt_4, Direction=panel_14, Length=number_slider_6)  # disabled
offset_3 = Offset(Curve=line_2, Distance=merge_3, Plane=xy_2, Corners=1)  # -> simplify(Curve); disabled
number_slider_8 = Slider(42.517, range=0..100)  # disabled
ext_2 = ExtendCurve(Curve=line_2, Type=0, Start=number_slider_7, End=number_slider_7)  # disabled
number_slider_9 = Slider(4.141, range=0..10)  # disabled
Z_2 = UnitZ(Factor=1)  # disabled
end_2 = EndPoints(Curve=ext_2)  # -> Start, End; disabled
cat_3 = Catenary(PointA=end_2.Start, PointB=end_2.End, Length=number_slider_8, Gravity=Z_2)  # disabled
amp = Amplitude(Vector=Z_2, Amplitude=number_slider_9)  # disabled
move = Move(Geometry=cat_3, Motion=amp)  # -> Geometry, Transform; disabled
number_slider_10 = Slider(14, range=0..100)  # disabled
panel_15 = Panel("2")  # disabled
flip_3 = FlipCurve(Curve=move.Geometry)  # -> Curve, Flag; disabled
dup_2 = DuplicateData(Data=flip_3.Curve, Number=panel_15, Order=True)  # -> simplify(graft(Data)); disabled
merge_4 = Merge(Data1=dup_2, Data2=offset_3)  # disabled
panel_16 = Panel("""True
False""")  # disabled
divide_4 = DivideCurve(Curve=merge_4, Count=number_slider_10, Kinks=False)  # -> Points, Tangents, Parameters; disabled
cull_4 = CullPattern(List=divide_4.Points, CullPattern=panel_16)  # disabled
panel_17 = Panel(merge_4)  # disabled
path_mapper_3 = PathMapper(cull_4, source="{A;B}(i)", target="{A;i}")  # disabled
path_mapper_4 = PathMapper(path_mapper_3, source="{A;B}", target="{A}")  # disabled
pline_4 = PolyLine(Vertices=path_mapper_4, Closed=False)  # disabled

pt_5 = Point(Point(36.80135343, -44.63732657, 0))
python = PythonScript(
    BasicPoint=pt_5,
    Length=Slider(16.52, range=0..100),
    OffsetDistance=Slider(3.126, range=0..10),
    ExtendValue=Slider(2.875, range=0..10),
    HeightA=Slider(3.771, range=0..10),
    HeightB=Slider(7.064, range=0..10),
    DivideCount=Slider(14, range=0..100),
    PipeDiameter=Slider(0.266, range=0..1),
    LinkDiameter=Slider(0.042, range=0..1))  # -> out, pipes, linkPipes, APts, BPts, CPts; inputs BasicPoint: Point3d, DivideCount: Int32
# ---------- python: Python ----------
import rhinoscriptsyntax as rs

#--- start 建立基本结构线
basicPoint = BasicPoint
length = Length
ptxform = rs.XformTranslation((length,0,0))
mbasicPoint = rs.PointTransform(basicPoint,ptxform)
basicLine = rs.AddLine(basicPoint,mbasicPoint)
#偏移基本结构线
offsetDistance = OffsetDistance
offsetLineA = rs.OffsetCurve(basicLine,[0,0,0],offsetDistance,[0,0,1])
offsetLineB = rs.OffsetCurve(basicLine,[0,0,0],-offsetDistance,[0,0,1])
#延长结构线
extendValue = ExtendValue
extendLine = rs.ExtendCurveLength(basicLine,0,2,extendValue) #///side = 2向两侧延长
#得到首末端点和中间点
lineStartPoint = rs.CurveStartPoint(extendLine)
lineMidPoint = rs.CurveMidPoint(extendLine)
lineEndPoint = rs.CurveEndPoint(extendLine)
#向上一定距离移动点
heightA = HeightA
heightB = HeightB
xformStart = rs.XformTranslation((0,0,heightA))
xformEnd  = rs.XformTranslation((0,0,heightA))#首末两点移动heightA的距离
xformMid = rs.XformTranslation((0,0,heightB))
mLineStartPoint = rs.PointTransform(lineStartPoint,xformStart)
mLineEndPoint = rs.PointTransform(lineEndPoint,xformEnd)
mLineMidPoint = rs.PointTransform(lineMidPoint,xformMid)
curvepts = []
curvepts.extend([mLineStartPoint,mLineMidPoint,mLineEndPoint])
centerCurve = rs.AddCurve(curvepts,3)
rs.DeleteObjects([basicLine,extendLine])
#--- end 建立基本结构线

#--- start 等分点组织数据
divideCount = DivideCount 
offsetApts = rs.DivideCurve(offsetLineA,divideCount)
offsetBpts = rs.DivideCurve(offsetLineB,divideCount)
centerCrvpts = rs.DivideCurve(centerCurve,divideCount)
#两种选取等分点的模式
origin = list(range(len(offsetApts)))
patternA = origin[::2]
patternB = origin[1::2]
print (patternA)
print (patternB)
la = offsetApts[::2]
lb = offsetBpts[::2]
lc = centerCrvpts[::2]
lccopy = lc[:]
for i in range(len(patternB)):
    lc.insert(patternB[i],la[i])
    lccopy.insert(patternB[i],lb[i])
pla = rs.AddPolyline(lc)
plb = rs.AddPolyline(lccopy)
#--- end 等分点组织数据

#--- start 形态输出
pipeDiameter = PipeDiameter
linkDiameter = LinkDiameter
link = [pla,plb]
polys = [offsetLineA[0],offsetLineB[0],centerCurve]
linkPipes = [rs.AddPipe(pl,0,linkDiameter)[0] for pl in link]
pipes = [rs.AddPipe(pl,0,pipeDiameter)[0] for pl in polys] 

Pipes = pipes
APts = offsetApts
BPts = offsetBpts
CPts = centerCrvpts
#---end
# ---------- end python ----------
