# Grasshopper definition 03_dict_02_matrix.gh (Grasshopper 0.9.76)
# plug-ins: Python Interpreter

number_slider = Slider(4, range=0..10)
pt = Point(Point(14.83035555, 4.586093885, 0))
xy = XYPlane(Origin=pt)
sqgrid = Square(Plane=xy, Size=Slider(12, range=0..100), ExtentX=number_slider, ExtentY=number_slider)  # -> Cells, Points
python = PythonScript()  # -> out, a
# ---------- python: Python ----------
L = [(0,[1,2,3]),(1,[4,5,6]),(2,[7,8,9])]
d = dict(L)
print (d)
#{0: [1, 2, 3], 1: [4, 5, 6], 2: [7, 8, 9]}

#///字典的三种索引方式
print (d.get(0))
#[1, 2, 3]

print (d.setdefault(1))
#[4, 5, 6]

print (d[2])
#[7, 8, 9]
# ---------- end python ----------
area = Area(Geometry=sqgrid.Cells)  # -> Area, simplify(Centroid)
number_slider_2 = Slider(5, range=0..10)
flip = FlipMatrix(Data=area.Centroid)
points = PointList(Points=flip, Size=Slider(6, range=0..10))
branch = TreeBranch(Tree=flip, Path="1", MaintainPaths=True)
viewer = ParamViewer(branch)
viewer_2 = ParamViewer(flip)
rectangle = Rectangle(Plane=branch, XSize=number_slider_2, YSize=number_slider_2, Radius=0)  # -> Rectangle, Length
