# Grasshopper definition 03_dict_05_DataTree_instance.gh (Grasshopper 0.9.76)
# plug-ins: Python Interpreter

number_slider = Slider(8.25, range=0..10)
neg = Negative(Value=number_slider)
pt = Point(Point(162.7161824, 53.33507594, 0))
dom = ConstructDomain(DomainStart=neg, DomainEnd=number_slider)
rectangle = Rectangle(Plane=pt, XSize=dom, YSize=dom, Radius=0)  # -> Rectangle, Length

number_slider_2 = Slider(9, range=0..100)  # disabled
panel = Panel("2")  # disabled
addition = Addition(A=number_slider_2, B=panel)  # disabled
item = ListItem(Index=number_slider_2, Wrap=True)  # disabled
item_2 = ListItem(Index=addition, Wrap=True)  # disabled
loft = Loft(Curves=[item, item_2], Options={Adjust=False, Closed=False, LoftEnds=0, LoftSimp=0, LoftType=0, Rebuild=10, Refit=0.01})  # disabled

pop2d = Populate2D(Region=rectangle.Rectangle, Count="4", Seed=2)
dom_2 = ConstructDomain(DomainStart="0", DomainEnd="200")
alongcrv = SortAlongCurve(Points=pop2d, Curve=rectangle.Rectangle)  # -> Points, Indices
dom_3 = ConstructDomain(DomainStart="0", DomainEnd="1")
random = Random(Range=dom_2, Number="4", Seed=Slider(26.83, range=0..100))
pline = PolyLine(Vertices=alongcrv.Points, Closed=True)
explode = Explode(Curve=pline, Recursive=True)  # -> simplify(graft(Segments)), Vertices
number_slider_3 = Slider(1, range=0..1)
random_2 = Random(Range=dom_3, Number=Slider(20, range=0..100), Seed=random)  # -> simplify(Random)
sort = SortList(Keys=random_2)  # -> Keys, ValuesA
eval = EvaluateLength(Curve=explode.Segments, Length=sort.Keys, Normalized=True)  # -> Point, Tangent, Parameter
panel_2 = Panel(explode.Segments)
python = PythonScript(pts=eval.Point)  # -> out, tree, lst, lineTree; inputs pts: tree
# ---------- python: Python ----------
import rhinoscriptsyntax as rs
from Grasshopper.Kernel.Data import GH_Path
from Grasshopper import DataTree

print (pts)

tree = DataTree[object]()

#组织数据结构
lst = []
for i in range(pts.BranchCount):
    temp = []
    for pt in pts.Branch(GH_Path(i)):
        temp.append(pt)
    if i%2 == 0:
        temp.reverse()
    lst.append(temp)
    

#放入树形数据中
for k,v in enumerate(lst):
    tree.AddRange(v,GH_Path(k))
    
#分成两部分添加
line = []
line1 = [rs.AddLine(lst[0][p],lst[1][p]) for p in range(len(lst[0]))]
line2 = [rs.AddLine(lst[2][q],lst[3][q]) for q in range(len(lst[0]))]
line.extend(line1)
line.extend(line2)
#每相邻两条线为一个path
lineTree = DataTree[object]()
for l in range(len(line)):
    if l<len(line)-1:
        
        lineTree.Add(line[l],GH_Path(l))
        lineTree.Add(line[l+1],GH_Path(l))
# ---------- end python ----------
panel_3 = Panel(python.lineTree)
loft_2 = Loft(Curves=python.lineTree, Options={Adjust=False, Closed=False, LoftEnds=0, LoftSimp=0, LoftType=0, Rebuild=10, Refit=0.01})
srfsplit = SurfaceSplit(Surface=loft_2, Curves=python.lineTree)
area = Area(Geometry=srfsplit)  # -> Area, Centroid
panel_4 = Panel(area.Centroid)
panel_5 = Panel(eval.Point)
points = PointList(Points=python.tree, Size=Slider(0.146, range=0..1))
viewer = ParamViewer(python.lineTree)
pdecon = Deconstruct(Point=area.Centroid)  # -> XComponent, YComponent, ZComponent
bnd = Bounds(Numbers=pdecon.XComponent)
bnd_2 = Bounds(Numbers=pdecon.YComponent)
dom_4 = ConstructDomain(DomainStart="0", DomainEnd="255")
dom_5 = ConstructDomain(DomainStart="0", DomainEnd="255")
remap = RemapNumbers(Value=pdecon.YComponent, Source=bnd_2, Target=dom_4)  # -> Mapped, Clipped
remap_2 = RemapNumbers(Value=pdecon.XComponent, Source=bnd, Target=dom_5)  # -> Mapped, Clipped
rgb = ColourRGB(Alpha=255, Red=Slider(67.99, range=0..1000), Green=remap_2.Mapped, Blue=remap.Mapped)
preview = CustomPreview(Geometry=srfsplit, Shader=rgb)
panel_6 = Panel(remap.Mapped)
