# Grasshopper definition 04_string_01_ghMethod.gh (Grasshopper 0.9.76)
# plug-ins: Python Interpreter

panel = Panel("Hello ")  # disabled
panel_2 = Panel("10")  # disabled
stack = StackData(Data=panel, Stack=panel_2)  # disabled
series = Series(Start=0, Step=1, Count=10)
python = PythonScript()  # -> out, a
# ---------- python: Python ----------
lst = [ str(float(i)) for i in range(10)]
print (lst)
sep = "+"
lstjoin = sep.join(lst)
print (lstjoin)
# ---------- end python ----------
join = TextJoin(Text=series, Join="+")
panel_3 = Panel(join)

python_2 = PythonScript()  # -> out, a
# ---------- python_2: Python ----------
lst = list("Hello Python!")
print (lst)
#['H', 'e', 'l', 'l', 'o', ' ', 'P', 'y', 't', 'h', 'o', 'n', '!']
# ---------- end python_2 ----------
chars = Characters(Text="Hello Python!")  # -> Result, Unicode
panel_4 = Panel(chars.Unicode)
panel_5 = Panel(chars.Result)

series_2 = Series(Start=0, Step=1, Count=10)
join_2 = TextJoin(Text=series_2, Join="+")
python_3 = PythonScript()  # -> out, a
# ---------- python_3: Python ----------
lst_str = [str(float(i)) for i in range(10)]
sep = "+"
lstJoin = sep.join(lst_str) #///将sep嵌入
print (lstJoin)
#0.0+1.0+2.0+3.0+4.0+5.0+6.0+7.0+8.0+9.0


lstSplit = lstJoin.split("+")
print (lstSplit)
#['0.0', '1.0', '2.0', '3.0', '4.0', '5.0', '6.0', '7.0', '8.0', '9.0']

#///str.join() str.split() 是互逆方法
# ---------- end python_3 ----------
split = TextSplit(Text=join_2, Separators="+")
panel_6 = Panel(split)

chars_2 = Characters()  # -> Result, Unicode

python_4 = PythonScript()  # -> out, a
# ---------- python_4: Python ----------
stri = "Hello Python!"
print (stri)
length = len(stri)
print (length)
#13
# ---------- end python_4 ----------
len = TextLength(Text="Hello Python!")
panel_7 = Panel(len)

python_5 = PythonScript()  # -> out, a
# ---------- python_5: Python ----------
x = "Hello "
y = "Python!"
z = x + y #///字符串连接使用+号即可
print (z)
#Hello Python!
# ---------- end python_5 ----------
concat = Concatenate(FragmentA="Hello ", FragmentB="Python")
panel_8 = Panel(concat)

concat_2 = Concatenate()
join_3 = TextJoin()
len_2 = TextLength()
split_2 = TextSplit()

python_6 = PythonScript()  # -> out, a
# ---------- python_6: Python ----------
z = "                     Hello Python!"
stripStr = z.strip() #///strip()只移除两侧空格
print (stripStr)
#Hello Python!
# ---------- end python_6 ----------
trim = TextTrim(Text="                     Hello Python!", Start=True, End=True)
panel_9 = Panel(trim)

python_7 = PythonScript()  # -> out, a
# ---------- python_7: Python ----------
z = "Hello Python!"
print (z)

lowerStr = z.lower() #///返回小写字母版
print (lowerStr)
#hello python!

upperStr = z.upper() #///返回大写字母版
print (upperStr)
#HELLO PYTHON!

titleStr = z.title() #///首字母大写，其他字母小写
print (titleStr)
#Hello Python!
# ---------- end python_7 ----------
case = TextCase(Text="Hello Python!", Culture=127)  # -> UpperCase, LowerCase
panel_10 = Panel(case.UpperCase)
panel_11 = Panel(case.LowerCase)

format = Format(Culture=127)

fragment = TextFragment(Text="Hello Python!", Start="6")
python_8 = PythonScript()  # -> out, a
# ---------- python_8: Python ----------
z = "Hello Python!"

subStr = z[6:] #///切片的方法提取字符串
print (subStr)
# ---------- end python_8 ----------
panel_12 = Panel(fragment)

case_2 = TextCase(Culture=127)  # -> UpperCase, LowerCase
fragment_2 = TextFragment()
trim_2 = TextTrim(Start=True, End=True)

chars_3 = Characters(Text="Hello Python!")  # -> Result, Unicode
python_9 = PythonScript()  # -> out, a
# ---------- python_9: Python ----------
stri = "Hello Python!" #定义字符串变量
strLst = list(stri)
print (strLst)
#['H', 'e', 'l', 'l', 'o', ' ', 'P', 'y', 't', 'h', 'o', 'n', '!']

strLst.sort() #///用sort()排序字符串
print (strLst)

strilower = stri.lower() #将字符串转换为小写
print (strilower)
#hello python!
strlstlower = list(strilower)
strlstlower.sort()
print (strlstlower)
#[' ', '!', 'e', 'h', 'h', 'l', 'l', 'n', 'o', 'o', 'p', 't', 'y']
# ---------- end python_9 ----------
tsort = SortText(Keys=chars_3.Result, Culture=127)  # -> Keys, Values
panel_13 = Panel(tsort.Keys)

rep = ReplaceText(Text="Hello Python!", Find="Python", Replace="Grasshopper", RecursiveReplace=False)
python_10 = PythonScript()  # -> out, a
# ---------- python_10: Python ----------
strr = "Hello Python!"
#///replace替换字符串
replaceStr = strr.replace("Python","Grasshopper")
print (replaceStr)
#Hello Grasshopper!
# ---------- end python_10 ----------
panel_14 = Panel(rep)

tdist = TextDistance(TextA="Hello Python!", TextB="Python", Case=True)
python_11 = PythonScript()  # -> out, a
# ---------- python_11: Python ----------
stri = "Hello Python!"
d = "Python"
num =  stri.find(d) #///返回字符串所在位置最左端的索引值
print (num)
# ---------- end python_11 ----------
panel_15 = Panel(tdist)

tmatch = MatchText(Case=True)
rep_2 = ReplaceText(RecursiveReplace=False)
tsort_2 = SortText(Culture=127)  # -> Keys, Values
tdist_2 = TextDistance(Case=True)
