# Grasshopper definition 05_syntax_01_loop_raise_of_truss.gh (Grasshopper 0.9.76)
# plug-ins: Python Interpreter

python = PythonScript(X=Slider(1.619, range=0..10), start="0.5", step="0.2", radius=Slider(0.019, range=0..0.1), count="2")  # -> out, pts, pl
# ---------- python: Python ----------
import rhinoscriptsyntax as rs

#定义类型并赋值
x,start,step,radius,count = float(X),float(start),float(step),float(radius),int(count)
#创建点的序列
points = []
height = 0
i = 0
while i<=count:
    weight = (count-i) * x
    if i != count:
        points.extend([[weight,height,0],[-weight,height,0]])
    else:
        points.append([0,height+0.5,0])
    height += (start+i*step)*x
    i+=1
print (points)
#排序成为可以polyline的点的序列
new_points = sorted(points,key = lambda x:x[0]) 
print (new_points)
#连为多折线
pts = [rs.AddPoint(new_points[i]) for i in range(len(new_points))]
pl = rs.AddPolyline(pts)
# ---------- end python ----------
