# Grasshopper definition 05_syntax_02_if_ShorestWalk_breackLine.gh (Grasshopper 0.9.76)
# plug-ins: Python Interpreter, Shortest Walk in Gh

# ---- group: test
curve = Curve(<curve referenced from the Rhino model>)
curve_2 = Curve(<curve referenced from the Rhino model>)
curve_3 = Curve(<curve referenced from the Rhino model>)
curve_4 = Curve(<curve referenced from the Rhino model>)
python_script = PythonScript(x=curve_3, y=curve_2, z=curve_4)  # -> out, points, explodeCrv; disabled
# ---------- python_script: Python ----------
import rhinoscriptsyntax as rs

points = []
explodeCrv = []
curves = [x,y,z]
for i in range(len(curves)):
    ptsi = []
    ptiStart = rs.CurveStartPoint(curves[i])
    ptsi.append(ptiStart)
    for j in range(len(curves)):
        pt = rs.LineLineIntersection(curves[i],curves[j])[0]
        print ([i,j])
        ptsi.append(pt)
        points.append(pt)
    ptiStart = rs.CurveEndPoint(curves[i])
    ptsi.append(ptiStart)
    pl = rs.AddPolyline(ptsi)
    explodeCrv.append(pl)
# ---------- end python_script ----------
python_script_2 = PythonScript(x=curve_3, y=curve_2, z=curve_4, u=curve)  # -> out, a, explodeCrv
# ---------- python_script_2: Python ----------
import rhinoscriptsyntax as rs

#points = []
explodeCrv = []
curves = [x,y,z,u]
for i in range(len(curves)):
    ptsi = []
    ptiStart = rs.CurveStartPoint(curves[i])
    ptsi.append(ptiStart)
    for j in range(len(curves)):
        if i!=j:
            pt = rs.LineLineIntersection(curves[i],curves[j])[0]
            print ([i,j])
            if rs.IsPointOnCurve(curves[i],pt):
                ptsi.append(pt)
    ptiEnd = rs.CurveEndPoint(curves[i])
    ptsi.append(ptiEnd)
    #///需要排序点
    sortPts = rs.SortPointList(ptsi)
    pl = rs.AddPolyline(sortPts)
    explodeCrv.append(pl)
# ---------- end python_script_2 ----------
list_item = ListItem(List=python_script_2.explodeCrv, Index="3", Wrap=False)
explode = Explode(Curve=list_item, Recursive=True)  # -> graft(Segments), Vertices
explode_tree = ExplodeTree(Data=explode.Segments)  # -> _0000, _0001, _0002, Branch3
curve_5 = Curve(explode_tree._0001)
curve_6 = Curve(explode_tree._0002)
curve_7 = Curve(explode_tree.Branch3)
curve_8 = Curve(explode_tree._0000)
number_slider = Slider(10, range=0..10)
number_slider_2 = Slider(15, range=0..100)
curve_9 = Curve(<curve referenced from the Rhino model>)
curve_10 = Curve(<curve referenced from the Rhino model>)
curve_11 = Curve(<curve referenced from the Rhino model>)
curve_12 = Curve(<curve referenced from the Rhino model>)
explode_2 = Explode(Curve=python_script_2.explodeCrv, Recursive=True)  # -> flatten(Segments), Vertices
panel = Panel(explode_tree._0000)
explode_3 = Explode(Curve=curve_12, Recursive=True)  # -> Segments, Vertices
python_script_3 = PythonScript(x=curve_10, y=curve_9, z=curve_11)  # -> out, points, explodeCrv
# ---------- python_script_3: Python ----------
import rhinoscriptsyntax as rs

#a = rs.CurveCurveIntersection(x,y)[0][2]
#print (a)
#b = rs.CurveCurveIntersection(x,z)[0][2]
points = []
explodeCrv = []
curves = [x,y,z]
for i in range(len(curves)):
    ptsi = []
    ptiStart = rs.CurveStartPoint(curves[i])
    ptsi.append(ptiStart)
    for j in range(i+1,len(curves)):
        pt = rs.LineLineIntersection(curves[i],curves[j])[0]
        print ([i,j])
        ptsi.append(pt)
        points.append(pt)
    ptiStart = rs.CurveEndPoint(curves[i])
    ptsi.append(ptiStart)
    pl = rs.AddPolyline(ptsi)
    explodeCrv.append(pl)
# ---------- end python_script_3 ----------
list_item_2 = ListItem(List=explode_2.Segments, Index=Slider(11, range=0..15), Wrap=False)
python_script_4 = PythonScript()  # -> out, a, b
# ---------- python_script_4: Python ----------
n = 4
for i in range(n):
    for j in range(i+1,n):
        print ([i,j])
# ---------- end python_script_4 ----------
panel_2 = Panel(explode_3.Segments)
panel_3 = Panel(explode_2.Segments)
explode_4 = Explode(Curve=python_script_3.explodeCrv, Recursive=True)  # -> flatten(Segments), Vertices
list_item_3 = ListItem(List=python_script_3.points, Index="1", Wrap=True)
panel_4 = Panel("1")
list_item_4 = ListItem(List=explode_4.Segments, Index=Slider(0, range=0..10), Wrap=False)
panel_5 = Panel(explode_4.Segments)

# ---- group: 交错的道路
geometry_pipeline = GeometryPipeline(
    GroupByLayer=False,
    GroupByType=False,
    IncludeHidden=True,
    IncludeLocked=True,
    LayerFilter="road",
    NameFilter="*",
    TypeFilter=4)

# ---- group: 起始点和目标点
geometry_pipeline_2 = GeometryPipeline(
    GroupByLayer=False,
    GroupByType=False,
    IncludeHidden=True,
    IncludeLocked=True,
    LayerFilter="location",
    NameFilter="*",
    TypeFilter=1)

# ---- group: 打断线
python_script_5 = PythonScript(Lines=geometry_pipeline)  # -> out, IntersectionPoints, PLS; inputs Lines: list
# ---------- python_script_5: Python ----------
import rhinoscriptsyntax as rs

lines = Lines
IntersectionPoints = []
PLS = []
for i in range(len(lines)):
    #///以一条线为单位与其他线相交
    ptsi = []
    ptiStart = rs.CurveStartPoint(lines[i])
    ptsi.append(ptiStart)
    for j in range(len(lines)):
        if i!=j:
            pt = rs.LineLineIntersection(lines[i],lines[j])[0] #///两条线相交点
            print ([i,j])
            if rs.IsPointOnCurve(lines[i],pt):#///避免AddPolyline造成线的延长
                ptsi.append(pt)
                IntersectionPoints.append(pt)
    ptiEnd = rs.CurveEndPoint(lines[i])
    ptsi.append(ptiEnd)
    #///需要排序点SortPointList()
    sortPts = rs.SortPointList(ptsi)
    pl = rs.AddPolyline(sortPts)
    PLS.append(pl)
# ---------- end python_script_5 ----------

# ----
list_item_5 = ListItem(List=geometry_pipeline_2, Index="0", Wrap=True)
list_item_6 = ListItem(List=geometry_pipeline_2, Index="1", Wrap=True)
explode_5 = Explode(Curve=python_script_5.PLS, Recursive=True)  # -> flatten(Segments), Vertices
point = Point(python_script_5.IntersectionPoints)
line = Line(StartPoint=list_item_5, EndPoint=list_item_6)
shortest_walk = ShortestWalk(Curves=explode_5.Segments, WantedPath=line)  # -> ShortestWalk, Succession, Direction, Length
curve_13 = Curve(shortest_walk.ShortestWalk)
pipe = Pipe(Curve=curve_13, Radius=1, Caps=0)
