# Grasshopper definition 05_syntax_02_if_is.gh (Grasshopper 0.9.76)
# plug-ins: Python Interpreter

pt = Point([Point(-18.77207983, 4.701116839, 0), Point(-6.964211626, -15.38701861, 0), Point(16.28703946, -6.132096248, 0), Point(15.57027229, 8.569903436, 0)])
pdecon = Deconstruct(Point=pt)  # -> XComponent, YComponent, ZComponent
item = ListItem(List=pt, Index="3", Wrap=True)
pt_2 = ConstructPoint(XCoordinate=pdecon.XComponent, YCoordinate=pdecon.YComponent, ZCoordinate=pdecon.ZComponent)
python = PythonScript(x=pt, y=item, z=pt_2)  # -> out, a; inputs x: list
# ---------- python: Python ----------
ja = y in x
print (ja) #即使变量是原列表提取出来的，但GhPython是指向不同值
#False
jb = (z == x)
print (jb) #ghPython中指向不同的值
#False
m = n = x[3]
jc = m in x #///ghPython列表中切片的值，扔被包含的列表中
print (jc)
#True
jd = (m==y)
print (jd)
#False
print (jd,m,y)#m,y虽然表示同一点，但是引用对象不相等

je = (m==n)
print (je)
#True
print (je,m,n) #链式赋值中指向的对象相同
# ---------- end python ----------
panel = Panel(pt_2)
panel_2 = Panel(pt)
