# Grasshopper definition 05_syntax_02_if_meshFlatten.gh (Grasshopper 0.9.76)
# plug-ins: MeshEdit Components, Python Interpreter

pt = Point(Point(-6.617817227, -8.711088596, 0))
number_slider = Slider(7, range=0..10)

subtraction = Subtraction(A="20", B="14")
addition = Addition(A=subtraction, B="1")
series = Series(Start="14", Step="1", Count=addition)
panel = Panel(series)

python = PythonScript(start="14", end="20", step="1")  # -> out, series
# ---------- python: Python ----------
import rhinoscriptsyntax as rs

start,end,step = float(start),float(end),int(step)
series = rs.frange(start,end,step)
print (series)
# ---------- end python ----------
panel_2 = Panel(python.series)
msphere = MeshSphere(Base=pt, Radius=Slider(7.488, range=0..10), UCount=number_slider, VCount=number_slider)
medges = MeshEdges(Mesh=msphere)  # -> NakedEdges, InteriorEdges, NonManifoldEdges
explode = MeshExplode(Mesh=msphere, Interpolate=False)
item = ListItem(List=explode, Index=python.series, Wrap=True)
area = MeshArea(Mesh=item)  # -> Area, Centroid
X = UnitX(Factor=1)
demesh = DeconstructMesh(Mesh=item)  # -> simplify(Vertices), Faces, Colours, Normals
pt_2 = Point([Point(-11.94206561, -39.6494159, 0), Point(-11.97763966, -43.04224761, 0), Point(-6.944853077, -43.98043503, 0)])
python_2 = PythonScript(mesh=item, LocationPoints=pt_2)  # -> out, xymeshes; inputs LocationPoints: list
# ---------- python_2: Python ----------
import rhinoscriptsyntax as rs
mesh = mesh
meshes = rs.ExplodeMeshes(mesh)
lp = [] #建立空的列表，用于放置输入的定位点转化的点坐标列表
print (LocationPoints)
for i in LocationPoints:
    lp.append(rs.PointCoordinates(i))
print (lp)
xymeshes = [] #建立空的列表，用于放置次序展平后的Mesh单元面
for i in range(len(meshes)):
    if i == 0:
        mesh0point = rs.MeshVertices(meshes[i])
        xymesh0 = rs.OrientObject(meshes[i],mesh0point,lp,1)
        xymeshes.append(xymesh0)
    else:#从索引值1开始
        vertices2 = rs.MeshVertices(meshes[i])
        vertices1 = rs.MeshVertices(meshes[i-1])
        ver = [m for m in vertices1 for n in vertice2 if m==n] #提取重合点
        a = ver[0] #提取点a
        b = ver[1]
        indexa = vertices1.index(a) #点a在索引值为i-1时顶点中的索引值
        indexb = vertices1.index(b) #点b在索引值为i-1时顶点中的索引值
        d = [m for m in vertices2 if m not in ver][0]
        refvertice = rs.MeshVertices(xymeshes[i-1])#获取已经转化为二维单元面索引值为i-1时的单元顶点，如果i为1时候，第一个二维单元平面索引值为0是，if i==0 条件时候追加的单元面，如果i为2时，二维单元面索引值为1，即上次循环展平的单元面
        indexc = [c for c in range(0,3) if c != indexa and c!= indexb]
        refverticespoint = rs.MirrorObject(rs.AddPoint(refvertice[indexc[0]]),refvertice[indexa],refvertice[indexb]) #镜像c',参考点为a',b'，获取cm'点
        mirropoint = rs.PointCoordinates(refverticespoint) #获取cm'点的坐标列表
        xymesh = rs.OrientObject(mesher[i],[a,b,d],[refvertice[indexa],refvertice[indexb],mirropoint],1)
        xymeshes.append(xymesh)
        vertice2lst = []
        vertice1lst = []
        ver = []
# ---------- end python_2 ----------
branch = TreeBranch(Tree=demesh.Vertices, Path="0", MaintainPaths=True)
item_2 = ListItem(List=branch, Index="0", Wrap=True)  # -> Item, Item1, Item2, Item3
vec2pt = Vector2Pt(PointA=item_2.Item1, PointB=item_2.Item2, Unitize=False)  # -> Vector, Length
vec2pt_2 = Vector2Pt(PointA=item_2.Item, PointB=item_2.Item1, Unitize=False)  # -> Vector, Length
vlen = VectorLength(Vector=vec2pt_2.Vector)
amp = Amplitude(Vector=X, Amplitude=vlen)
vec2pt_3 = Vector2Pt(PointA=item_2.Item2, PointB=item_2.Item3, Unitize=False)  # -> Vector, Length
demesh_2 = DeconstructMesh()  # -> Vertices, Faces, Colours, Normals
points = PointList(Points=area.Centroid, Size=Slider(0.738, range=0..10))
medges_2 = MeshEdges(Mesh=python_2.xymeshes)  # -> NakedEdges, InteriorEdges, NonManifoldEdges
area_2 = MeshArea(Mesh=python_2.xymeshes)  # -> Area, Centroid
addition_2 = Addition(A=pt_2, B=vec2pt_2.Vector)
addition_3 = Addition(A=addition_2, B=vec2pt.Vector)
addition_4 = Addition(A=addition_3, B=vec2pt_3.Vector)
panel_3 = Panel(python_2.xymeshes)
vdis = VectorDisplay(Anchor=item_2.Item1, Vector=vec2pt.Vector)
tag = TextTag3D(Location=area_2.Centroid, Text=python.series, Size=Slider(0.877, range=0..1), Justification=7)
vdis_2 = VectorDisplay(Anchor=addition_2, Vector=vec2pt.Vector)
srf4pt = _4PointSurface(CornerA=pt_2, CornerB=addition_2, CornerC=addition_3, CornerD=addition_4)
panel_4 = Panel(branch)
python_3 = PythonScript(X=srf4pt)  # -> Out, A
