# Grasshopper definition 06_def_02_sectionPolypart.gh (Grasshopper 0.9.76)
# plug-ins: Python Interpreter

# basicpoint,lengunit,angle,offsetvalue,topbplineheight,multiple1,multiple2,multiple3
pt = Point(Point(0, 0, 0))
python = PythonScript(
    basicpoint=pt,
    lengthunit=Slider(5.37, range=0..10),
    angle=Slider(113.92, range=0..1000),
    offsetvalue=Slider(9.964, range=0..10),
    topbplineheight=Slider(4.756, range=0..10),
    multiple1=Slider(3, range=0..10),
    multiple2=Slider(3, range=0..10),
    multiple3=Slider(3, range=0..10),
    seed=Slider(2426.116, range=0..10000),
    floorheight=Slider(5, range=0..10))  # -> out, toppolylines, sectionpolylinepart0, sectionpolylinepart0_2; inputs basicpoint: Point3d
# ---------- python: Python ----------
import rhinoscriptsyntax as rs
import math
import random

lengthunit,angle,offsetvalue,topbplineheight,multiple1,multiple2,multiple3,seed,floorheight = float(lengthunit),float(angle),float(offsetvalue),float(topbplineheight),float(multiple1),float(multiple2),float(multiple3),float(seed),float(floorheight)
def basicline(basicpoint,lengunit,angle,offsetvalue,topbplineheight,multiple1,multiple2,multiple3):
    """
    Parameters:
        basicpoint:Point3d 起始定位点
        lengthunit:单位长度，通过乘以倍数获得各段长度
        angle:角度
        offsetvalue : 建筑进深
        topbplineheight : 建筑屋脊高度
        mutiple1, mutiple2, mutiple3 :倍数1， 倍数2， 倍数3
        
     Returns:
        bplines:第一组水平方向结构
        offsetbplines:第二组水平方向结构
        topbpline:屋脊水平方向结构
    """
    bpoint0 = (basicpoint[0],basicpoint[1],basicpoint[2]) 
    print (basicpoint,bpoint0)
    #(<Rhino.Geometry.Point3d object at 0x000000000000002B [0,0,0]>, (0.0, 0.0, 0.0))
    bpoints = [] #用于收集创建多折线的点
    bpoints.append(bpoint0)
    bpoint1 = (bpoint0[0]+lengunit*multiple1,bpoint0[1],bpoint0[2])
    hypotenuse = lengunit*multiple2
    bpoint2 = (bpoint1[0]+hypotenuse*math.cos(angle),bpoint1[1]-hypotenuse*math.sin(angle),bpoint1[2])
    bpoint3 = (bpoint2[0]+lengunit*multiple3,bpoint2[1],bpoint2[2])
    bpoints.extend([bpoint1,bpoint2,bpoint3]) #添加折线上的点到列表
    
    bpline0 = rs.AddPolyline(bpoints) #根据各个折线点的列表构建初始的水平方向结构线
    bplines = [] #用于收集创建得到的结构线
    for i in range(1,4):
        dividecurvelength = rs.CopyObject(bpline0,[0,0,5*i]) #根据新坐标，复制基础水平线
        bplines.append(dividecurvelength)
    offsetbplines = [(rs.OffsetCurve(j,[0,0,0],offsetvalue)) for j in bplines] #偏移复制得到的结构线
    topbplinecenter = rs.OffsetCurve(bplines[-1],[0,0,0],offsetvalue/2) #用于屋脊水平方向的折线
    topbpline = rs.CopyObject(topbplinecenter,[0,0,topbplineheight])
    rs.DeleteObject(topbplinecenter)
    return bplines,offsetbplines,topbpline

def basicpoints(bplines,lengthunit):
    """
    Parameters:
        bplines:
        lengthunit:
    Returns:
        sectionpolylineparts : 建筑截面折线
        pupoints4 : 最后一根水平方向结构线
    """
    basicplanepoints = [] #建立空的列表，用于放置等分点，嵌套列表
    for u in range(len(bplines)):
        basicplanepoint = rs.DivideCurveLength(bplines[u],lengthunit,True,True) #等分水平方向结构线
        basicplanepoints.append(basicplanepoint)
    planeunit = 1 #每组9个点之间的距离，可以将其放置于定义函数mainfunction中，用于交互
    randomselectionp =  [] #建立空列表，用于放置提取的随机点
    pupoints = [] #建立空列表，用于放置每次循环的9个点
    for o in range(len(basicplanepoints)-1):#遍历等分点列表，并排除最后一组等分点子列表
        for p in range(len(basicplanepoints[0])): #遍历等分点的子列表
            basicplanepointscor = [basicplanepoints[o][p][0],basicplanepoints[o][p][1],basicplanepoints[o][p][2]]
            pupoints.append(basicplanepointscor)
            
            pupoint1 = [basicplanepointscor[0]+lengthunit,basicplanepointscor[1],basicplanepointscor[2]]
            pupoints.append(pupoint1)
            rs.AddPoint(pupoint1)
            
            pupoint2 = [basicplanepointscor[0]+lengthunit,basicplanepointscor[1]+lengthunit,basicplanepointscor[2]]
            pupoints.append(pupoint2)
            rs.AddPoint(pupoint2)
            
            pupoint3 = [basicplanepointscor[0],basicplanepointscor[1]+lengthunit,basicplanepointscor[2]]
            pupoints.append(pupoint3)
            rs.AddPoint(pupoint3)
            
            pupoint4 = [basicplanepointscor[0]-lengthunit,basicplanepointscor[1]+lengthunit,basicplanepointscor[2]]
            pupoints.append(pupoint4)
            rs.AddPoint(pupoint4)
            
            pupoint5 = [basicplanepointscor[0]-lengthunit,basicplanepointscor[1],basicplanepointscor[2]]
            pupoints.append(pupoint5)
            rs.AddPoint(pupoint5)
            
            pupoint6 = [basicplanepointscor[0]-lengthunit,basicplanepointscor[1]-lengthunit,basicplanepointscor[2]]
            pupoints.append(pupoint6)
            rs.AddPoint(pupoint6)
            
            pupoint7 = [basicplanepointscor[0],basicplanepointscor[1]-lengthunit,basicplanepointscor[2]]
            pupoints.append(pupoint7)
            rs.AddPoint(pupoint7)
            
            pupoint8 = [basicplanepointscor[0]+lengthunit,basicplanepointscor[1]-lengthunit,basicplanepointscor[2]]
            pupoints.append(pupoint8)
            rs.AddPoint(pupoint8)
            
            randomselectionp.append(random.choice(pupoints)) #使用随机函数提取一个点
            print (randomselectionp)
            pupoints = [] #每次循环后清空
            pupoints0 = randomselectionp[:len(basicplanepoints[0])]
            pupoints1 = randomselectionp[len(basicplanepoints[0]):-len(basicplanepoints[0])]
            pupoints2 = randomselectionp[-len(basicplanepoints[0]):]
            pupoints4sub = basicplanepoints[-1] #提取最后一根水平方向结构线的折线点
            pupoints4 = [] 
            for e in range(len(pupoints4sub)):
                pupoints4.append([pupoints4sub[e][0],pupoints4sub[e][1],pupoints4sub[e][2]])
        
            sectionpolylineparts = []
            for q in range(len(pupoints0)):
                sectionpolylineparts.append(rs.AddPolyline((pupoints0[q],pupoints1[q],pupoints2[q],pupoints4[q])))
            
    
    
    
    return sectionpolylineparts,pupoints4
    
bl = basicline(basicpoint,lengthunit,angle,offsetvalue,topbplineheight,multiple1,multiple2,multiple3)
bps = basicpoints(bl[0],lengthunit)
sectionpolylinepart0 = bps[0][0]
sectionpolylinepart1 = bps[0][1]
# ---------- end python ----------
