# Grasshopper definition 06_def_03_randomCircle.gh (Grasshopper 0.9.76)
# plug-ins: Python Interpreter

pt = Point(Point(24.73577769, 3.531583597, 0))
python = PythonScript(basicpoint=pt, rwidth=Slider(141, range=0..1000), rheight=Slider(62, range=0..100), count=Slider(58, range=0..100))  # -> out, randomc
# ---------- python: Python ----------
import rhinoscriptsyntax as rs
import random

rwidth , rheight , count = int(rwidth),int(rheight),int(count)

basicpcor = rs.PointCoordinates(basicpoint)
rplane = rs.WorldXYPlane()
rplaneo = rs.MovePlane(rplane,basicpoint)
#///给出决定参数的范围
#rwidth = 115 
#rheight = 60
wrange = range(int(basicpcor[0]),int(basicpcor[0])+rwidth)
hrange = range(int(basicpcor[1]),int(basicpcor[1])+rheight)
wcount = hcount = 60
#///随机coordinates
randomx = random.sample(wrange,wcount)
randomy = random.sample(hrange,hcount)
#///随机point
randompts = []
for i in range(wcount):
    randompt = rs.AddPoint([randomx[i],randomy[i],0])
    randompts.append(randompt)
#///随机circle
randomc = []
for i in range(len(randompts)):
    distances = []
    for n in randompts:
        distance = rs.Distance(randompts[i],n)
        distances.append(distance)
    distances.sort()
    cir = rs.AddCircle(randompts[i],distances[1]/2) #///distance[0]是相同点，distance[1]是最近点
    randomc.append(cir)
# ---------- end python ----------
