# Grasshopper definition 06_def_08_time_abb.gh (Grasshopper 0.9.76)
# plug-ins: Python Interpreter

panel = Panel("""-180
180""")
panel_2 = Panel("""-95
155""")
panel_3 = Panel("""-180
75""")
panel_4 = Panel("""-400
400""")
panel_5 = Panel("""-120
120""")
python = PythonScript(
    MoveM="30",
    Axis1WorkingRange=panel,
    Axis1Counter="0.1",
    Axis2WorkingRange=panel_2,
    Axis2Counter="0.1",
    Axis3WorkingRange=panel_3,
    Axis3Counter="0.1",
    Axis4WorkingRange=panel_4,
    Axis4Counter="0.1",
    Axis5WorkingRange=panel_5,
    Axis5Counter="0.1",
    Action=Toggle(True))  # -> out, MoveD, Axis1, Axis2, Axis3, Axis4, Axis5; inputs Axis1WorkingRange: list, Axis2WorkingRange: list, Axis3WorkingRange: list, Axis4WorkingRange: list, Axis5WorkingRange: list, Action: Boolean
# ---------- python: Python ----------
import rhinoscriptsyntax as rs
import time
import math

#轴1运动条件 
axis1r = Axis1WorkingRange #运动工作范围
axis1c = float(Axis1Counter) #运动的次数频率
axis1ca = float(axis1r[0]) #初始值 
axis1cb = float(axis1r[1]) #结束值

#轴2运动条件 
axis2r = Axis2WorkingRange 
axis2c = float(Axis2Counter) 
axis2ca = float(axis2r[0]) 
axis2cb = float(axis2r[1]) #轴5运动条件 
#轴3运动条件 
axis3r = Axis3WorkingRange 
axis3c = float(Axis3Counter) 
axis3ca = float(axis3r[0]) 
axis3cb = float(axis3r[1]) 
#轴4运动条件 
axis4r = Axis4WorkingRange 
axis4c = float(Axis4Counter) 
axis4ca = float(axis4r[0]) 
axis4cb = float(axis4r[1])
#轴5运动条件
axis5r = Axis5WorkingRange 
axis5c = float(Axis5Counter) 
axis5ca = float(axis5r[0]) 
axis5cb = float(axis5r[1]) 

move = MoveM #整体移动单元距离
action = Action #控制定义函数运行与停止的布尔值

def GetTime(): #定义时间函数
    db10_time = time.time() #获取时间实数
    return (db10_time)
if action  == True: #判断bool值，如果为True则则执行
    db10_time_00 = GetTime()
time.sleep(0.001)
db10_time_current = GetTime()
db10_timer = round(db10_time_current - db10_time_00,1) #计算获取两次实数差

Axis1 = axis1ca+abs((math.sin(db10_timer*axis1c))*(axis1cb-axis1ca))
Axis2 = axis2ca+abs((math.sin(db10_timer*axis2c))*(axis2cb-axis2ca))
Axis3 = axis3ca+abs((math.sin(db10_timer*axis3c))*(axis3cb-axis3ca))
Axis4 = axis4ca+abs((math.sin(db10_timer*axis4c))*(axis4cb-axis4ca))
Axis5 = axis5ca+abs((math.sin(db10_timer*axis5c))*(axis5cb-axis5ca))
MoveD = db10_timer*(float(move))
# ---------- end python ----------
panel_6 = Panel(python.MoveD)
cluster = Cluster(角度=python.Axis5)  # -> 记录, 机械臂_2, 运动轴_2
cluster_2 = Cluster(角度=python.Axis1)  # -> 记录, 机械臂_2, 运动轴_2
cluster_3 = Cluster(角度=python.Axis2, 机械臂=cluster_2.记录, 运动轴=cluster_2.机械臂_2)  # -> 记录, 机械臂_2, 运动轴_2
cluster_4 = Cluster(角度=python.Axis3)  # -> 记录, 机械臂_2, 运动轴_2
cluster_5 = Cluster(角度=python.Axis4)  # -> 记录, 机械臂_2, 运动轴_2

# ==== cluster Cluster
机械臂 = ClusterInput()
角度 = ClusterInput()
运动轴 = ClusterInput()
rad = Radians(Degrees=角度)
cull_i = CullIndex(List=机械臂, Indices="0", Wrap=True)
item = ListItem(List=机械臂, Index="0", Wrap=True)
cull_i_2 = CullIndex(List=运动轴, Indices="0", Wrap=True)
item_2 = ListItem(List=运动轴, Index="0", Wrap=True)
记录 = ClusterOutput(item)
rotax = RotateAxis(Geometry=cull_i, Angle=rad, Axis=item_2)  # -> Geometry, Transform
rotax_2 = RotateAxis(Geometry=cull_i_2, Angle=rad, Axis=item_2)  # -> Geometry, Transform
运动轴_2 = ClusterOutput(rotax_2.Geometry)
机械臂_2 = ClusterOutput(rotax.Geometry)
