# Grasshopper definition 07_class_05_yield_point.gh (Grasshopper 0.9.76)
# plug-ins: Python Interpreter

panel = Panel("10")
pt = Point(Point(114.6368729, 24.66477487, 0))
python = PythonScript(BasicPoint=pt, Step=Slider(100, range=0..100))  # -> out, Next
# ---------- python: Python ----------
import rhinoscriptsyntax as rs
import math

basicPoint,step = BasicPoint,int(Step)
pointCor = rs.PointCoordinates(basicPoint)
def f(pointCor):
    ptx = pointCor[0]
    pty = pointCor[1]
    ptz = pointCor[2]
    while True: #///为什么这里需要while True 而不是 if True
        ptx += 10
        pty += 10
        ptz += 0
        addpt = rs.AddPoint([20*math.sin(ptx),100*math.cos(pty),ptz])
        yield addpt
        

p = f(pointCor)
Next = []
Next.append(next(p))
for i in range(step):
    Next.append(next(p))

print (Next)
# ---------- end python ----------
intcrv = Interpolate(Vertices=python.Next, Degree=3, Periodic=False, KnotStyle=1)  # -> Curve, Length, Domain
python_2 = PythonScript()  # -> Out, A
