# Grasshopper definition 160918_haystack_001.gh (Grasshopper 0.9.76)

number_slider = Slider(3, range=0..10)  # disabled
number_slider_2 = Slider(2, range=0..10)  # disabled
series = Series(Start=0, Step=1, Count=number_slider)  # disabled
number_slider_3 = Slider(1, range=0..1)  # disabled
xy = XYPlane(Origin=Point(0, 0, 0))  # disabled
pt = ConstructPoint(XCoordinate=series, YCoordinate=series, ZCoordinate=0)  # disabled
sqgrid = Square(Plane=xy, Size=1, ExtentX=5, ExtentY=5)  # -> Cells, Points; disabled
number_slider_4 = Slider(1, range=0..10)  # disabled
item = ListItem(List=pt, Index=0, Wrap=True)  # -> Item, Item1, Item2; disabled
pt_2 = Point(simplify(sqgrid.Points))  # disabled
tstat = TreeStatistics(Tree=pt_2)  # -> Paths, Length, Count; disabled
panel = Panel("1")  # disabled
equals = Equality(FirstNumber=number_slider_3, SecondNumber=number_slider_2)  # -> Equality, Inequality; disabled
addition = Addition(A=number_slider_4, B=panel)  # disabled
vec2pt = Vector2Pt(PointA=item.Item, PointB=item.Item1, Unitize=True)  # -> Vector, Length; disabled
vec2pt_2 = Vector2Pt(PointA=item.Item2, PointB=item.Item1, Unitize=True)  # -> Vector, Length; disabled
item_2 = ListItem(List=tstat.Paths, Index=number_slider_4, Wrap=True)  # disabled
pt_3 = Point(Point(18.39995365, 19.44577546, 0))
pt_4 = Point(Point(-8.643946034, 3.021630104, 0))
pt_5 = Point(Point(1.082617318, 12.68779055, 0))
item_3 = ListItem(List=tstat.Paths, Index=addition, Wrap=True)  # disabled
vec2pt_3 = Vector2Pt(Unitize=False)  # -> Vector, Length; disabled
panel_2 = Panel([vec2pt_2.Vector, vec2pt_2.Length])  # disabled
vec2pt_4 = Vector2Pt(PointA=pt_4, PointB=pt_5, Unitize=True)  # -> Vector, Length
panel_3 = Panel([vec2pt.Vector, vec2pt.Length])  # disabled
vec2pt_5 = Vector2Pt(PointA=pt_4, PointB=pt_3, Unitize=True)  # -> Vector, Length
item_4 = TreeItem(Tree=pt_2, Path=item_2, Index=0, Wrap=True)  # disabled
equals_2 = Equality(FirstNumber=vec2pt.Vector, SecondNumber=vec2pt_2.Vector)  # -> Equality, Inequality; disabled
item_5 = TreeItem(Tree=pt_2, Path=item_3, Index=panel, Wrap=True)  # disabled
amp = Amplitude(Amplitude=1)  # disabled
panel_4 = Panel(vec2pt_5.Vector)
panel_5 = Panel(vec2pt_4.Vector)
# 为什么这里会是True呢？
panel_6 = Panel(equals_2.Equality)  # disabled
panel_7 = Panel(pt_2)  # disabled
pt_6 = PointOriented(BasePlane=PlaneXY(0, 0, 0), UComponent=0, VComponent=0, WComponent=0)
panel_8 = Panel("5")
panel_9 = Panel("3")
panel_10 = Panel("20.0")
panel_11 = Panel("10.0")
dividecountlength = Integer(Slider(3, range=0..10))
dividecountheight = Integer(Slider(2, range=0..10))
reclength = Number(Slider(35, range=0..100))
recheight = Number(Slider(23, range=0..100))
pt_7 = Point(pt_6)
pdecon = Deconstruct(Point=pt_7)  # -> XComponent, YComponent, ZComponent
division = Division(A=[reclength, recheight], B=[dividecountlength, dividecountheight])
addition_2 = Addition(A=[dividecountlength, dividecountheight], B="1")
basicpt_x = Number(pdecon.XComponent)
basicpt_y = Number(pdecon.YComponent)
series_2 = Series(Start=[basicpt_x, basicpt_y], Step=division, Count=addition_2)  # -> simplify(Series)
panel_12 = Panel(series_2)
rev = ReverseList(List=series_2)
bang = ExplodeTree(Data=series_2)  # -> Branch0, Branch1
shift = ShiftList(List=flatten(bang.Branch1), Shift="1", Wrap=False)
shift_2 = ShiftList(List=flatten(shift), Shift="-1", Wrap=False)  # -> flatten(List)
item_6 = ListItem(List=bang.Branch1, Index="-1", Wrap=True)
item_7 = ListItem(List=bang.Branch0, Index="-1", Wrap=True)
sidept_y = Number(item_6)
merge = Merge(Data1=basicpt_y, Data2=flatten(sidept_y))
sidept_x = Number(item_7)
merge_2 = Merge(Data1=basicpt_x, Data2=flatten(sidept_x))
pt_8 = PointOriented(BasePlane=PlaneXY(0, 0, 0), UComponent=bang.Branch0, VComponent=graft(merge), WComponent=0)
pt_9 = PointOriented(BasePlane=PlaneXY(0, 0, 0), UComponent=merge_2, VComponent=graft(shift_2), WComponent=0)
flip = FlipMatrix(Data=pt_9)
# 应该还会有其他实现的方法
bang_2 = ExplodeTree(Data=pt_8)  # -> Branch0, Branch1
bang_3 = ExplodeTree(Data=flip)  # -> Branch0, Branch1
Y = UnitY(Factor=1)
X = UnitX(Factor=1)
entwine = Entwine(Branch00=bang_2.Branch0, Branch01=bang_3.Branch0, Branch02=bang_2.Branch1, Branch03=bang_3.Branch1, FlattenInputs=True)
panel_13 = Panel(entwine)

merge_3 = Merge(Data1="0", Data2=dividecountlength, Data3=dividecountheight, Data4=dividecountlength)
ma = MassAddition(Input=merge_3)  # -> Result, PartialResults

Y_2 = UnitY(Factor=1)
X_2 = UnitX(Factor=1)
flatten = FlattenTree(Tree=entwine, Path="{0}")
lng = ListLength(List=flatten)
subtraction = Subtraction(A=lng, B="1")
series_3 = Series(Start="1", Step=1, Count=subtraction)
pt_10 = Point(flatten)
shift_3 = ShiftList(List=flatten, Shift=series_3, Wrap=False)
shift_4 = ShiftList(List=flatten, Shift="-1", Wrap=False)  # -> graft(List)
vec2pt_6 = Vector2Pt(PointA=shift_4, PointB=shift_3, Unitize=Toggle(True))  # -> Vector, Length
panel_14 = Panel(vec2pt_6.Vector)
cset = CreateSet(List=vec2pt_6.Vector)  # -> Set, Map
panel_15 = Panel(cset.Set)
mindex = MemberIndex(Set=cset.Set, Member=Y)  # -> Index, Count
mindex_2 = MemberIndex(Set=cset.Set, Member=X)  # -> Index, Count
ln = Line(StartPoint=shift_4, EndPoint=shift_3)
merge_4 = Merge(Data1=mindex_2.Index, Data2=mindex.Index)
replace = ReplaceMembers(Set=cset.Set, Find=X, Replace=Toggle(False))
mindex_3 = MemberIndex(Set=vec2pt_6.Vector, Member=Y_2)  # -> Index, Count
mindex_4 = MemberIndex(Set=vec2pt_6.Vector, Member=X_2)  # -> Index, Count
lng_2 = ListLength(List=ln)  # -> flatten(Length)
item_8 = ListItem(List=pt_10, Index=ma.PartialResults, Wrap=False)
ma_2 = MassAddition(Input=lng_2)  # -> Result, PartialResults
panel_17 = Panel(ma.PartialResults)
panel_18 = Panel(replace)
lng_3 = ListLength(List=item_8)
exdiff = SetDifferenceS(SetA=pt_10, SetB=item_8)
panel_19 = Panel(merge_4)
line = LineSDL(Direction=Vector(0, 0, 1), Length=1)
series_4 = Series(Start=0, Step=1, Count=lng_3)
series_5 = Series(Start=["0", "1"], Step=graft("2"), Count=Slider(16, range=0..100))
item_9 = ListItem(List=series_4, Index=series_5, Wrap=False)
mindex_5 = MemberIndex(Set=series_4)  # -> Index, Count
series_6 = Series(Start=flatten(series_4), Step=1, Count=flatten(dividecountlength))
filter = StreamFilter(Gate=0)
panel_20 = Panel(mindex_4.Index)
combine = CombineData()  # -> Result, Index
panel_21 = Panel(item_8)
panel_22 = Panel(item_9)
panel_23 = Panel(series_6)
number_slider_5 = Slider(17.6, range=0..100)
division_2 = Division(A=number_slider_5, B=4)
division_3 = Division(A=number_slider_5, B="5")
md_slider = MDSlider(
    slider_value=Point(0.7987194526, 0.5163414188, 0.5),
    SliderMode=0,
    x_domain=Domain(-100, 100),
    y_domain=Domain(-100, 100),
    z_domain=Domain(0, 1))
int = Integer(division_3)
multiplication = Multiplication(A="4", B=division_2)
int_2 = Integer(division_2)
multiplication_2 = Multiplication(A="4", B=division_3)
division_4 = Division(A=number_slider_5, B=int_2)
division_5 = Division(A=number_slider_5, B=int)
panel_24 = Panel(multiplication)
panel_25 = Panel(multiplication_2)
number_slider_6 = Slider(17.6, range=0..100)
panel_26 = Panel(division_4)
panel_27 = Panel(division_5)
Y_3 = UnitY(Factor=1)
amp_2 = Amplitude(Vector=Y_3, Amplitude=number_slider_6)
line_2 = LineSDL(Start=md_slider, Direction=Y_3, Length=number_slider_6)
series_7 = Series(Start=0, Step=1, Count=10)
series_8 = Series(Start=0, Step=1, Count=10)
division_6 = Division(A=amp_2, B="4")
pt_11 = Point(division_6)
panel_28 = Panel(series_7)
panel_29 = Panel(series_8)
stack = StackData(Data=division_6, Stack="4")
ma_3 = MassAddition(Input=stack)  # -> Result, PartialResults
addition_3 = Addition(A=md_slider, B=ma_3.PartialResults)

panel_30 = Panel("""0
1
2
3""")
panel_31 = Panel("""10.3
15.4
10.3
15.4""")

num = Number("50")
int_3 = Integer("12")
dividecount = Integer("4")
item_10 = ListItem(List=panel_31, Index="0", Wrap=True)

division_7 = Division(A=num, B=int_3)
round = Round(Number=division_7)  # -> Nearest, Floor, Ceiling
division_8 = Division(A=num, B=[round.Floor, round.Ceiling])
multiplication_3 = Multiplication(A=division_7, B=division_8)
subtraction_2 = Subtraction(A=multiplication_3, B=num)
panel_32 = Panel(multiplication_3)
abs = Absolute(Value=subtraction_2)
item_11 = ListItem(List=abs, Index=0, Wrap=True)  # -> Item, Item1
min = Minimum(A=item_11.Item, B=item_11.Item1)
mindex_6 = MemberIndex(Set=abs, Member=min)  # -> Index, Count
item_12 = ListItem(List=multiplication_3, Index=mindex_6.Index, Wrap=True)

panel_33 = Panel(division_7)
merge_5 = Merge(Data1=round.Floor, Data2=round.Ceiling)
division_9 = Division(A=item_10, B=dividecount)

int_4 = Integer(division_9)
addition_4 = Addition(A=int_4, B="1")
multiplication_4 = Multiplication(A=addition_4, B=dividecount)
multiplication_5 = Multiplication(A=int_4, B=dividecount)
subtraction_3 = Subtraction(A=multiplication_5, B=item_10)
subtraction_4 = Subtraction(A=multiplication_4, B=item_10)
abs_2 = Absolute(Value=subtraction_3)
abs_3 = Absolute(Value=subtraction_4)
min_2 = Minimum(A=abs_2, B=abs_3)

addition_5 = Addition(A=division_9, B="1")
round_2 = Round(Number=division_9)  # -> Nearest, Floor, Ceiling
panel_34 = Panel(round_2.Ceiling)
multiplication_6 = Multiplication(A=int_3, B=merge_5)
merge_6 = Merge(Data1=round_2.Floor, Data2=round_2.Ceiling)
int_5 = Integer(addition_5)
panel_35 = Panel("""4
5""")
panel_36 = Panel("""0
1""")
multiplication_7 = Multiplication(A=dividecount, B=merge_6)
subtraction_5 = Subtraction(A=num, B=multiplication_6)
panel_37 = Panel(division_9)
dividecount_2 = Integer(panel_35)
item_13 = ListItem(List=panel_31, Index=panel_36, Wrap=True)
subtraction_6 = Subtraction(A=item_10, B=multiplication_7)
abs_4 = Absolute(Value=subtraction_5)
division_10 = Division(A=item_13, B=dividecount_2)
abs_5 = Absolute(Value=subtraction_6)
item_14 = ListItem(List=abs_4, Index="0", Wrap=True)  # -> Item, Item1
item_15 = ListItem(List=abs_5, Index="0", Wrap=True)  # -> Item, Item1
int_6 = Integer(division_10)
multiplication_8 = Multiplication(A=int_6, B=dividecount_2)
addition_6 = Addition(A=int_6, B="1")
smaller = SmallerThan(FirstNumber=item_14.Item, SecondNumber=item_14.Item1)  # -> SmallerThan, OrEqualTo
panel_38 = Panel(min_2)
smaller_2 = SmallerThan(FirstNumber=multiplication_8, SecondNumber=item_13)  # -> SmallerThan, OrEqualTo
smaller_3 = SmallerThan(FirstNumber=item_15.Item, SecondNumber=item_15.Item1)  # -> SmallerThan, OrEqualTo
panel_39 = Panel(multiplication_8)
panel_40 = Panel(division_10)
int_7 = Integer(smaller.SmallerThan)
item_16 = ListItem(List=merge_5, Index=int_7, Wrap=True)
item_17 = ListItem(List=smaller_2.SmallerThan, Index="0", Wrap=True)
panel_41 = Panel(int_6)
int_8 = Integer(smaller_3.SmallerThan)
item_18 = ListItem(List=merge_6, Index=int_8, Wrap=True)
filter_2 = StreamFilter(Gate=item_17)
multiplication_9 = Multiplication(A=dividecount, B=item_18)
multiplication_10 = Multiplication(A=int_3, B=item_16)
division_11 = Division(A=item_12, B=int_3)
panel_42 = Panel(item_12)
panel_43 = Panel(multiplication_10)
panel_44 = Panel(division_11)
md_slider_2 = MDSlider(
    slider_value=Point(0.6219512195, 0.7390244647, 0.5),
    SliderMode=0,
    x_domain=Domain(-100, 100),
    y_domain=Domain(-100, 100),
    z_domain=Domain(0, 1))
complex = ComplexComponents(Complex=md_slider_2)  # -> Real, Imaginary
panel_45 = Panel("""0
1
2
3""")
panel_46 = Panel("""10.3
15.4
10.3
15.4""")
complex_2 = CreateComplex(Real=complex.Real, Imaginary=complex.Imaginary)
item_19 = ListItem(
    List=[{imaginary=0, real=1}, {imaginary=1, real=0}, {imaginary=0, real=-1}, {imaginary=-1, real=0}],
    Index=panel_45,
    Wrap=False)
pt_12 = Point(complex_2)
amp_3 = Amplitude(Vector=item_19, Amplitude=panel_46)
ma_4 = MassAddition(Input=amp_3)  # -> Result, PartialResults
addition_7 = Addition(A=pt_12, B=ma_4.PartialResults)
panel_47 = Panel(complex_2)
md_slider_3 = MDSlider(
    slider_value=Point(0.6219512195, 0.7390244647, 0.5),
    SliderMode=0,
    x_domain=Domain(-100, 100),
    y_domain=Domain(-100, 100),
    z_domain=Domain(0, 1))
complex_3 = ComplexComponents(Complex=ma_4.PartialResults)  # -> Real, Imaginary
concat = Concatenate(FragmentA=complex_3.Real, FragmentB=complex_3.Imaginary, JoinSeparator=",")
pline = PolyLine(Vertices=addition_7, Closed=True)
concat_2 = Concatenate(FragmentA=concat, FragmentB=panel_45, JoinSeparator=";")
complex_4 = ComplexComponents(Complex=md_slider_3)  # -> Real, Imaginary
panel_48 = Panel("""0
1
2
3""")
panel_49 = Panel(concat_2)
complex_5 = CreateComplex(Real=complex_4.Real, Imaginary=complex_4.Imaginary)
panel_50 = Panel("""10.3
15.4
10.3
15.4""")
item_20 = ListItem(
    List=[{imaginary=0, real=1}, {imaginary=1, real=0}, {imaginary=0, real=-1}, {imaginary=-1, real=0}],
    Index=panel_48,
    Wrap=False)
pt_13 = Point(complex_5)
panel_51 = Panel(concat)
amp_4 = Amplitude(Vector=item_20, Amplitude=panel_50)
ma_5 = MassAddition(Input=amp_4)  # -> Result, PartialResults
addition_8 = Addition(A=pt_13, B=ma_5.PartialResults)
panel_52 = Panel(complex_5)
complex_6 = ComplexComponents(Complex=ma_5.PartialResults)  # -> Real, Imaginary
concat_3 = Concatenate(FragmentA=complex_6.Real, FragmentB=complex_6.Imaginary, JoinSeparator=",")
pline_2 = PolyLine(Vertices=addition_8, Closed=True)
concat_4 = Concatenate(FragmentA=concat_3, FragmentB=panel_48, JoinSeparator=";")
panel_53 = Panel(concat_4)
panel_54 = Panel(concat_3)

md_slider_4 = MDSlider(
    slider_value=Point(0.6219512195, 0.7390244647, 0.5),
    SliderMode=0,
    x_domain=Domain(-100, 100),
    y_domain=Domain(-100, 100),
    z_domain=Domain(0, 1))
complex_7 = ComplexComponents(Complex=md_slider_4)  # -> Real, Imaginary
complex_8 = CreateComplex(Real=complex_7.Real, Imaginary=complex_7.Imaginary)
item_21 = ListItem(
    List=[{imaginary=0, real=1}, {imaginary=1, real=0}, {imaginary=0, real=-1}, {imaginary=-1, real=0}],
    Index=panel_30,
    Wrap=False)
pt_14 = Point(complex_8)
amp_5 = Amplitude(Vector=item_21, Amplitude=panel_31)
ma_6 = MassAddition(Input=amp_5)  # -> Result, PartialResults
addition_9 = Addition(A=pt_14, B=ma_6.PartialResults)
panel_55 = Panel(complex_8)
complex_9 = ComplexComponents(Complex=ma_6.PartialResults)  # -> Real, Imaginary
concat_5 = Concatenate(FragmentA=complex_9.Real, FragmentB=complex_9.Imaginary, JoinSeparator=",")
panel_56 = Panel(concat_5)

pline_3 = PolyLine(Vertices=addition_9, Closed=True)
concat_6 = Concatenate(FragmentA=concat_5, FragmentB=panel_30, JoinSeparator=";")

panel_57 = Panel(concat_6)
