# Grasshopper definition 160918_stairs_001.gh (Grasshopper 0.9.76)

location = MDSlider(
    slider_value=Point(0.23624413, 0.8442312387, 0.5),
    SliderMode=0,
    x_domain=Domain(-10000, 10000),
    y_domain=Domain(-10000, 10000),
    z_domain=Domain(0, 1))
genes = GenePool(Decimals=2, Maximum=3900, Minimum=300, Value=[3046.31, 1917.18])
梁高 = Slider(447.87, range=300..550)
rotate = Slider(0, range=0..1)
梯段厚 = Slider(203, range=150..400)
梯段宽 = Slider(3376.53, range=800..5000)
间距 = Slider(732, range=0..1000)
平台宽度 = Slider(2892, range=1000..5000)
平台厚度 = Slider(144.76, range=100..150)
梁的宽度 = Slider(186.81, range=100..350)
踏步深 = Slider(271, range=200..350)

panel = Panel("""住宅楼梯(踏面=T,阶高=R)
550<=T+2R<=650
180<=T<=360,120<=R<=210
推荐倾斜度<=7/11
基本倾斜度<=6/7
不得已的情况下倾斜<=22/21,T>=195 T+2R=650

集合住宅、公用部分的公用楼梯
550<=T+2R<=650
推荐尺寸 T>=300,R<=160
基本倾斜度<=7/11,不得已的情况下T>=240

集合住宅、公用部分的室外楼梯
550<=T+2R<=650
推荐尺寸 T>=300,R<=160
不得已的情况下T>=240,550<=T+2R<=650""")
dom = ConstructDomain(DomainStart="220", DomainEnd="300")
dom_2 = ConstructDomain(DomainStart="130", DomainEnd="200")
remap = RemapNumbers(Value=rotate, Source=Domain(0, 1), Target=Domain(0, 6.283185307))  # -> Mapped, Clipped
dispatch = Dispatch(List=genes, DispatchPattern=[True, False])  # -> ListA, ListB
panel_2 = Panel("""0
-1""")

panel_3 = Panel("踏步深")
panel_4 = Panel("梯段宽")
panel_5 = Panel("平台长度")
panel_6 = Panel("平台厚度")
panel_7 = Panel("梁宽")
panel_8 = Panel("梁高")
panel_9 = Panel("踢面高")
panel_10 = Panel("平台宽度")
panel_11 = Panel("梯段高")
panel_12 = Panel("梯段厚")
panel_13 = Panel("间距")
panel_14 = Panel("梯段长")
num = Number(dispatch.ListA)
num_2 = Number(dispatch.ListB)
num_3 = Number(踏步深)
num_4 = Number(梯段厚)
num_5 = Number(间距)
num_6 = Number(梯段宽)
num_7 = Number(平台宽度)
num_8 = Number(平台厚度)
num_9 = Number(梁的宽度)
num_10 = Number(梁高)

inc = Includes(Value=num_3, Domain=dom)  # -> Includes, Deviation
gate = StreamGate(Stream=location, Gate=inc.Includes)  # -> Target0, Target1
division = Division(A=num, B=num_3)
stepcount = Integer(division)
division_2 = Division(A=num_2, B=stepcount)
series = Series(Start=0, Step=num_3, Count=division)
stepheight = Number(division_2)
series_2 = Series(Start=0, Step=division_2, Count=stepcount)
subtraction = Subtraction(A=num_7, B=num_9)
multiplication = Multiplication(A=num_6, B=2)
division_3 = Division(A=stepheight, B=num_3)
stack = StackData(Data=series, Stack="2")
item = ListItem(List=series_2, Index="-1", Wrap=True)
stack_2 = StackData(Data=series_2, Stack="2")
series_3 = Series(Start=0, Step=num_9, Count=2)
series_4 = Series(Start=subtraction, Step=num_9, Count=2)  # -> reverse(Series)
series_5 = Series(Start=0, Step=num_10, Count=2)
addition = Addition(A=num_5, B=multiplication)

num_11 = Number(division_2)
num_12 = Number(addition)

inc_2 = Includes(Value=num_11, Domain=dom_2)  # -> Includes, Deviation
gate_2 = StreamGate(Stream=remap.Mapped, Gate=inc_2.Includes)  # -> Target0, Target1
prot = RotatePlane(Plane=gate.Target1, Angle=gate_2.Target1)
basicplane = Plane(prot)
pln = Plane(basicplane)
atan = ArcTangent(Value=division_3)
ins = InsertItems(List=stack, Item="0", Indices="1", Wrap=True)
shift = ShiftList(List=stack_2, Shift=1, Wrap=False)
stack_3 = StackData(Data=num_8, Stack=2)
cos = Cosine(Value=atan)
item_2 = ListItem(List=series, Index=-1, Wrap=True)
pt = PointOriented(BasePlane=pln, UComponent=item_2, VComponent=expr("-x", num_6), WComponent=num_2)
pl_origin = PlaneOrigin(Base=pln, Origin=pt)
stack_4 = StackData(Data=series_5, Stack=4)
ins_2 = InsertItems(List=series_3, Item=series_4, Indices=1, Wrap=True)
division_4 = Division(A=num_4, B=cos)
subtraction_2 = Subtraction(A=item, B=division_4)
neg = Negative(Value=division_4)
merge = Merge(Data1=flatten(neg), Data2=flatten(subtraction_2))
ins_3 = InsertItems(List=shift, Item=subtraction_2, Indices=-1, Wrap=True)
shift_2 = ShiftList(List=ins, Shift="1", Wrap=False)
shift_3 = ShiftList(List=stack_4, Shift=2, Wrap=False)
stack_5 = StackData(Data=ins_2, Stack=2)
ins_4 = InsertItems(List=shift, Item=merge, Indices=panel_2, Wrap=True)
ins_5 = InsertItems(List=ins_3, Item=neg, Indices=0, Wrap=True)
ins_6 = InsertItems(List=shift_3, Item=stack_3, Indices=expr("4", 2), Wrap=True)
item_3 = ListItem(List=series_2, Index=-1, Wrap=True)
shift_4 = ShiftList(List=stack_5, Shift=1, Wrap=True)
rev = ReverseList(List=ins_4)
item_4 = ListItem(List=series, Index="-1", Wrap=True)
item_5 = ListItem(List=series_2, Index="-1", Wrap=True)
addition_2 = Addition(A=reverse(ins_5), B=item_3)
neg_2 = Negative(Value=ins_6)
addition_3 = Addition(A=rev, B=item_5)

pt_2 = PointOriented(BasePlane=basicplane, UComponent=ins, VComponent=0, WComponent=ins_5)
pt_3 = PointOriented(BasePlane=basicplane, UComponent=shift_2, VComponent=num_5, WComponent=addition_2)
pt_4 = PointOriented(BasePlane=pl_origin, UComponent=shift_4, VComponent=0, WComponent=neg_2)
pline = PolyLine(Vertices=pt_4, Closed=True)
pline_2 = PolyLine(Vertices=pt_2, Closed=True)
pline_3 = PolyLine(Vertices=pt_3, Closed=True)
deplane = DeconstructPlane(Plane=pln)  # -> Origin, XAxis, YAxis, ZAxis
neg_3 = Negative(Value=num_6)
deplane_2 = DeconstructPlane(Plane=prot)  # -> Origin, XAxis, YAxis, ZAxis
boundary = BoundarySurfaces(Edges=pline)
boundary_2 = BoundarySurfaces(Edges=[pline_2, pline_3])
amp = Amplitude(Vector=deplane_2.YAxis, Amplitude=[neg_3, num_6])
amp_2 = Amplitude(Vector=deplane.YAxis, Amplitude=addition)
extr = Extrude(Base=boundary_2, Direction=amp)
extr_2 = Extrude(Base=boundary, Direction=amp_2)
