# Grasshopper definition 160919_haystack_003.gh (Grasshopper 0.9.76)

md_slider = MDSlider(
    slider_value=Point(0.5914634146, 0.6780488549, 0.5),
    SliderMode=0,
    x_domain=Domain(-100, 100),
    y_domain=Domain(-100, 100),
    z_domain=Domain(0, 1))

panel = Panel("""15.4
10.3
15.4
10.3""")
panel_2 = Panel("""0
1
2
3""")

panel_3 = Panel("""5
3
5
3""")
ma = MassAddition(Input=panel_3)  # -> Result, PartialResults
panel_4 = Panel("""1
2
3""")
panel_5 = Panel("""2
3""")
complex = ComplexComponents(Complex=md_slider)  # -> Real, Imaginary
series = Series(Start="10", Step=1, Count=ma.Result)
int = Integer(panel_2)
num = Number(panel)
panel_6 = Panel("""5
3
5
3""")
entwine = Entwine(Branch00=panel_4, Branch01=panel_5, Branch02="3", FlattenInputs=True)  # -> simplify(Result)
complex_2 = CreateComplex(Real=complex.Real, Imaginary=complex.Imaginary)
partition = PartitionList(List=series, Size=panel_3)  # -> simplify(Chunks)
item = ListItem(
    List=[{imaginary=0, real=1}, {imaginary=1, real=0}, {imaginary=0, real=-1}, {imaginary=-1, real=0}],
    Index=int,
    Wrap=False)
panel_7 = Panel(item)
division = Division(A=num, B=panel_6)
panel_8 = Panel(entwine)
amp = Amplitude(Vector=item, Amplitude=num)
pt = Point(complex_2)
addition = Addition(A=partition, B=entwine)
amp_2 = Amplitude(Vector=item, Amplitude=division)
ma_2 = MassAddition(Input=amp)  # -> Result, PartialResults
addition_2 = Addition(A=pt, B=ma_2.PartialResults)
panel_9 = Panel(partition)
stack = StackData(Data=amp_2, Stack=panel_6)
complex_3 = ComplexComponents(Complex=ma_2.PartialResults)  # -> Real, Imaginary
ma_3 = MassAddition(Input=stack)  # -> Result, PartialResults
panel_10 = Panel(ma_2.PartialResults)
concat = Concatenate(FragmentA=complex_3.Real, FragmentB=complex_3.Imaginary, JoinSeparator=",")
partition_2 = PartitionList(List=ma_3.PartialResults, Size=panel_6)
addition_3 = Addition(A=pt, B=partition_2)
panel_11 = Panel(addition)

pline = PolyLine(Vertices=addition_2, Closed=True)
concat_2 = Concatenate(FragmentA=concat, FragmentB=int, JoinSeparator=";")

shift = ShiftList(List=partition_2, Shift="-1", Wrap=False)  # -> simplify(List)
addition_4 = Addition(A=pt, B=shift)
pt_2 = Point(shift)
tstat = TreeStatistics(Tree=pt_2)  # -> Paths, Length, Count
panel_12 = Panel(concat_2)
pt_3 = Point(shift)
shift_2 = ShiftList(List=tstat.Paths, Shift="1", Wrap=False)
number_slider = Slider(4, range=0..10)  # disabled
panel_13 = Panel(pt_3)
panel_14 = Panel("10")  # disabled
panel_15 = Panel(shift_2)
branch = TreeBranch(Tree=pt_2, Path=shift_2, MaintainPaths=True)
panel_16 = Panel("""1
2
3""")  # disabled
ma_4 = MassAddition(Input=panel_16)  # -> Result, PartialResults; disabled
panel_17 = Panel("""3
3
4""")  # disabled
panel_18 = Panel(pt_2)
series_2 = Series(Start=0, Step=1, Count=ma_4.Result)  # disabled
series_3 = Series(Start=number_slider, Step=1, Count=panel_14)  # disabled
partition_3 = PartitionList(List=series_3, Size=panel_17)  # -> simplify(Chunks); disabled
partition_4 = PartitionList(List=series_2, Size=panel_16)  # -> simplify(Chunks); disabled
panel_19 = Panel(branch)
bang = ExplodeTree(Data=partition_4)  # -> Branch0, Branch1, Branch2; disabled
bang_2 = ExplodeTree(Data=partition_3)  # -> Branch0, Branch1, Branch2; disabled
panel_20 = Panel(partition_4)  # disabled
vec2pt = Vector2Pt(PointA=shift, Unitize=False)  # -> Vector, Length
addition_5 = Addition(A=partition_4, B=partition_3)  # disabled
panel_21 = Panel("""1
2""")
series_4 = Series(Start=0, Step=1, Count="5")
panel_22 = Panel(partition_3)  # disabled
series_5 = Series(Start=series_4, Step=1, Count="3")  # -> simplify(Series)
addition_6 = Addition(A=series_5, B=graft(panel_21))
panel_23 = Panel(addition_5)  # disabled
panel_24 = Panel(series_5)
panel_25 = Panel(addition_6)

lng = ListLength(List=int)
tstat_2 = TreeStatistics(Tree=shift)  # -> Paths, Length, Count
subtraction = Subtraction(A=lng, B="1")
series_6 = Series(Start="1", Step=1, Count=subtraction)

item_2 = ListItem(List=series_6, Index=0, Wrap=True)  # -> Item, Item1, Item2
shift_3 = ShiftList(List=tstat_2.Paths, Shift=series_6, Wrap=False)  # -> simplify(List)

shift_4 = ShiftList(List=tstat_2.Paths, Shift=item_2.Item, Wrap=False)  # -> simplify(List)

shift_5 = ShiftList(List=tstat_2.Paths, Shift=item_2.Item1, Wrap=False)  # -> simplify(List)
shift_6 = ShiftList(List=tstat_2.Paths, Shift=item_2.Item2, Wrap=False)  # -> simplify(List)
branch_2 = TreeBranch(Tree=shift, Path=shift_6, MaintainPaths=True)
branch_3 = TreeBranch(Tree=shift, Path=shift_4, MaintainPaths=True)
branch_4 = TreeBranch(Tree=shift, Path=shift_5, MaintainPaths=True)
entwine_2 = Entwine(Branch00=branch_3, Branch01=branch_4, Branch02=branch_2, FlattenInputs=True)  # -> simplify(Result)
panel_26 = Panel(branch_4)
panel_27 = Panel(branch_2)
ln = Line(StartPoint=entwine_2, EndPoint=branch)
panel_28 = Panel(branch_3)
panel_29 = Panel(entwine_2)
panel_30 = Panel(ln)
