# Grasshopper definition 160919_haystack_004.gh (Grasshopper 0.9.76)

panel = Panel("""精确度问题
忽略了一个角""")
md_slider = MDSlider(
    slider_value=Point(0.5853658537, 0.6780488549, 0.5),
    SliderMode=0,
    x_domain=Domain(-100, 100),
    y_domain=Domain(-100, 100),
    z_domain=Domain(0, 1))
repeat = RepeatData(Data=[Slider(19.2, range=0..100), Slider(16, range=0..100)], Length="4")

panel_2 = Panel("""0
1
2
3""")
panel_3 = Panel(repeat)

panel_4 = Panel("""5
3
5
3""")
ma = MassAddition(Input=panel_4)  # -> Result, PartialResults
complex = ComplexComponents(Complex=md_slider)  # -> Real, Imaginary
panel_5 = Panel("""1
2
3""")
panel_6 = Panel("""2
3""")
pt = Point(Point(-95.50302731, 3.41775708, 0))
pt_2 = Point(Point(-61.12878793, 5.226927573, 0))
series = Series(Start="10", Step=1, Count=ma.Result)
int = Integer(panel_2)
num = Number(panel_3)
complex_2 = CreateComplex(Real=complex.Real, Imaginary=complex.Imaginary)
panel_7 = Panel("""5
3
5
3""")
entwine = Entwine(Branch00=panel_5, Branch01=panel_6, Branch02="3", FlattenInputs=True)  # -> simplify(Result)
partition = PartitionList(List=series, Size=panel_4)  # -> simplify(Chunks)
item = ListItem(
    List=[{imaginary=0, real=1}, {imaginary=1, real=0}, {imaginary=0, real=-1}, {imaginary=-1, real=0}],
    Index=int,
    Wrap=False)
ln = Line(StartPoint=pt, EndPoint=pt_2)
division = Division(A=num, B=panel_7)
amp = Amplitude(Vector=item, Amplitude=num)
panel_8 = Panel(entwine)
divide = DivideCurve(Curve=ln, Count=Slider(4, range=0..10), Kinks=False)  # -> simplify(flatten(Points)), Tangents, Parameters
lng = ListLength(List=divide.Points)
subtraction = Subtraction(A=lng, B="1")
pt_3 = Point(complex_2)
panel_9 = Panel(item)
addition = Addition(A=partition, B=entwine)
amp_2 = Amplitude(Vector=item, Amplitude=division)
series_2 = Series(Start="1", Step=1, Count=subtraction)
ma_2 = MassAddition(Input=amp)  # -> Result, PartialResults
addition_2 = Addition(A=pt_3, B=ma_2.PartialResults)
lng_2 = ListLength(List=int)
stack = StackData(Data=amp_2, Stack=panel_7)
panel_10 = Panel(partition)
shift = ShiftList(List=divide.Points, Shift="-1", Wrap=False)  # -> simplify(flatten(List))
panel_11 = Panel(shift)
shift_2 = ShiftList(List=divide.Points, Shift=series_2, Wrap=False)  # -> simplify(List)
subtraction_2 = Subtraction(A=lng_2, B="1")
complex_3 = ComplexComponents(Complex=ma_2.PartialResults)  # -> Real, Imaginary
panel_12 = Panel(ma_2.PartialResults)
ma_3 = MassAddition(Input=stack)  # -> Result, PartialResults
series_3 = Series(Start="1", Step=1, Count=subtraction_2)
item_2 = ListItem(List=series_3, Index=0, Wrap=True)  # -> Item, Item1, Item2
concat = Concatenate(FragmentA=complex_3.Real, FragmentB=complex_3.Imaginary, JoinSeparator=",")
ln_2 = Line(StartPoint=graft(shift), EndPoint=shift_2)
panel_13 = Panel(ln_2)
partition_2 = PartitionList(List=ma_3.PartialResults, Size=panel_7)
addition_3 = Addition(A=pt_3, B=partition_2)
panel_14 = Panel(addition)

pline = PolyLine(Vertices=addition_2, Closed=True)
concat_2 = Concatenate(FragmentA=concat, FragmentB=int, JoinSeparator=";")

shift_3 = ShiftList(List=partition_2, Shift="-1", Wrap=False)  # -> simplify(List)
tstat = TreeStatistics(Tree=shift_3)  # -> Paths, Length, Count
addition_4 = Addition(A=pt_3, B=shift_3)
shift_4 = ShiftList(List=tstat.Paths, Shift=item_2.Item, Wrap=False)  # -> simplify(List)
shift_5 = ShiftList(List=tstat.Paths, Shift=item_2.Item1, Wrap=False)  # -> simplify(List)
shift_6 = ShiftList(List=tstat.Paths, Shift=item_2.Item2, Wrap=False)  # -> simplify(List)
shift_7 = ShiftList(List=tstat.Paths, Shift="-1", Wrap=False)
panel_15 = Panel(concat_2)
branch = TreeBranch(Tree=shift_3, Path=shift_7, MaintainPaths=True)
branch_2 = TreeBranch(Tree=shift_3, Path=shift_4, MaintainPaths=True)
branch_3 = TreeBranch(Tree=shift_3, Path=shift_5, MaintainPaths=True)
branch_4 = TreeBranch(Tree=shift_3, Path=shift_6, MaintainPaths=True)
panel_16 = Panel(shift_3)
entwine_2 = Entwine(Branch00=flatten(branch_2), Branch01=flatten(branch_3), Branch02=flatten(branch_4), FlattenInputs=True)  # -> simplify(Result)
panel_17 = Panel(branch)
panel_18 = Panel(shift_2)

# ---- group: points
graft = GraftTree(Tree=branch, IncludeEmptyLists=True, IncludeNullItems=True)

# ----
panel_19 = Panel(graft)
complex_4 = ComplexComponents(Complex=graft)  # -> Real, Imaginary
lng_3 = ListLength(List=branch)
viewer = ParamViewer(graft)
lng_4 = ListLength(List=entwine_2)
multiplication = Multiplication(A=lng_3, B=lng_4)
complex_5 = CreateComplex(Real=complex_4.Real, Imaginary=complex_4.Imaginary)
item_3 = ListItem(List=int, Index=-1, Wrap=True)
concat_3 = Concatenate(FragmentA=complex_4.Real, FragmentB=complex_4.Imaginary, JoinSeparator=",")
repeat_2 = RepeatData(Data=entwine_2, Length=multiplication)
number_slider = Slider(4, range=0..100)
addition_5 = Addition(A=item_3, B="1")
partition_3 = PartitionList(List=repeat_2, Size=lng_4)

# ---- group: vectors
vec2pt = Vector2Pt(PointA=graft, PointB=partition_3, Unitize=False)  # -> simplify(Vector), Length

# ----
viewer_2 = ParamViewer(vec2pt.Vector)
flatten = FlattenTree(Tree=vec2pt.Vector, Path="{0}")
lng_5 = ListLength(List=flatten)
number_slider_2 = Slider(9, range=0..100)
lng_6 = ListLength(List=vec2pt.Vector)  # -> flatten(Length)
series_4 = Series(Start=0, Step=1, Count=number_slider)
amp_3 = Amplitude(Vector=vec2pt.Vector, Amplitude=vec2pt.Length)
series_5 = Series(Start=addition_5, Step=1, Count=lng_5)
int_2 = Integer(flatten(series_5))
flatten_2 = FlattenTree(Tree=vec2pt.Length, Path="{0}")
sort = SortList(Keys=flatten_2)  # -> Keys, ValuesA
item_4 = ListItem(List=sort.Keys, Index=series_4, Wrap=True)
partition_4 = PartitionList(List=int_2, Size=lng_6)  # -> simplify(Chunks)
concat_4 = Concatenate(FragmentA=concat_3, FragmentB=partition_4, JoinSeparator=";")
panel_20 = Panel(concat_4)
panel_21 = Panel(vec2pt.Vector)
cset = CreateSet(List=item_4)  # -> Set, Map
mindex = MemberIndex(Set=flatten_2, Member=cset.Set)  # -> Index, Count
pt_4 = Point(graft)
vec = Vector(vec2pt.Vector)

addition_6 = Addition(A=graft, B=amp_3)
line = LineSDL(Start=graft, Direction=vec2pt.Vector, Length=vec2pt.Length)
viewer_3 = ParamViewer(line)

jitter = Jitter(List=flatten(sort.Keys), Jitter=1, Seed=Slider(34.68, range=0..100))  # -> Values, Indices
addition_7 = Addition(A=vec, B=pt_4)
panel_22 = Panel(sort.Keys)
series_6 = Series(Start=0, Step=1, Count=number_slider)
addition_8 = Addition(A=addition_7, B=pt_4)
item_5 = ListItem(List=jitter.Values, Index=series_6, Wrap=False)
flatten_3 = FlattenTree(Tree=line, Path="{0}")
item_6 = ListItem(List=flatten(addition_8), Index=item_5, Wrap=True)
dom = ConstructDomain(DomainStart="0", DomainEnd="0.5")

item_7 = ListItem(List=division, Index=0, Wrap=True)
division_2 = Division(A=item_7, B="5")
division_3 = Division(A=item_7, B="2")
dom_2 = ConstructDomain(DomainStart=division_2, DomainEnd=division_3)
random = Random(Range=dom_2, Number=number_slider, Seed=Slider(32.45, range=0..100))

panel_23 = Panel("0.5")
item_8 = ListItem(List=flatten_3, Index=item_5, Wrap=True)
random_2 = Random(Range=dom, Number=number_slider, Seed=Slider(45.5, range=0..100))
multiplication_2 = Multiplication(A=item_6, B=random_2)
panel_24 = Panel(random_2)
pt_5 = Point(multiplication_2)
addition_9 = Addition(A=pt_3, B=pt_5)
pl = ConstructPlane(Origin=addition_9, XAxis=Vector(1, 0, 0), YAxis=Vector(0, 1, 0))
cir = Circle(Plane=pt_5, Radius=random)
panel_25 = Panel(multiplication_2)
