# Grasshopper definition 160919_haystack_005.gh (Grasshopper 0.9.76)

panel = Panel("""3
2
3""")
panel_2 = Panel("""5
2
2""")
ma = MassAddition(Input=panel)  # -> Result, PartialResults
ma_2 = MassAddition(Input=panel_2)  # -> Result, PartialResults
series = Series(Start=0, Step=1, Count=ma.Result)
series_2 = Series(Start=0, Step=1, Count=ma_2.Result)
partition = PartitionList(List=series, Size=panel)  # -> simplify(Chunks)
partition_2 = PartitionList(List=series_2, Size=panel_2)  # -> simplify(Chunks)
panel_3 = Panel(partition)
panel_4 = Panel(partition_2)
graft = GraftTree(Tree=partition, IncludeEmptyLists=True, IncludeNullItems=True)
lng = ListLength(List=partition)
lng_2 = ListLength(List=partition_2)
addition = Addition(A=partition, B=partition_2)
addition_2 = Addition(A=graft, B=partition_2)
viewer = ParamViewer(graft)
multiplication = Multiplication(A=lng, B=lng_2)
repeat = RepeatData(Data=partition_2, Length=multiplication)
partition_3 = PartitionList(List=repeat, Size=lng_2)  # -> simplify(Chunks)
viewer_2 = ParamViewer(partition_3)
addition_3 = Addition(A=graft, B=partition_3)

panel_5 = Panel("""5
3
5
3""")
ma_3 = MassAddition(Input=panel_5)  # -> Result, PartialResults
panel_6 = Panel("""1
2
3""")
panel_7 = Panel("""2
3""")
pt = Point(Point(-95.50302731, 3.41775708, 0))
pt_2 = Point(Point(-61.12878793, 5.226927573, 0))
series_3 = Series(Start="10", Step=1, Count=ma_3.Result)
entwine = Entwine(Branch00=panel_6, Branch01=panel_7, Branch02="3", FlattenInputs=True)  # -> simplify(Result)
partition_4 = PartitionList(List=series_3, Size=panel_5)  # -> simplify(Chunks)
ln = Line(StartPoint=pt, EndPoint=pt_2)
panel_8 = Panel(entwine)
divide = DivideCurve(Curve=ln, Count=Slider(4, range=0..10), Kinks=False)  # -> simplify(flatten(Points)), Tangents, Parameters
lng_3 = ListLength(List=divide.Points)
subtraction = Subtraction(A=lng_3, B="1")
addition_4 = Addition(A=partition_4, B=entwine)
series_4 = Series(Start="1", Step=1, Count=subtraction)
shift = ShiftList(List=divide.Points, Shift="-1", Wrap=False)  # -> simplify(flatten(List))
panel_9 = Panel(shift)
panel_10 = Panel(partition_4)
shift_2 = ShiftList(List=divide.Points, Shift=series_4, Wrap=False)  # -> simplify(List)

viewer_3 = ParamViewer()
bang = ExplodeTree()  # -> Branch0, Branch1, Branch2, Branch3
viewer_4 = ParamViewer(bang.Branch0)
dpath = DeconstructPath(Branch=viewer_4)
cull_i = CullIndex(Indices=dpath, Wrap=True)
branch = TreeBranch(Path=cull_i, MaintainPaths=True)

ln_2 = Line(StartPoint=graft(shift), EndPoint=shift_2)
panel_11 = Panel(ln_2)
panel_12 = Panel(addition_4)
panel_13 = Panel(shift_2)
panel_14 = Panel("""精确度问题,有限元问题
忽略了一个角""")
md_slider = MDSlider(
    slider_value=Point(0.5853658537, 0.6780488549, 0.5),
    SliderMode=0,
    x_domain=Domain(-100, 100),
    y_domain=Domain(-100, 100),
    z_domain=Domain(0, 1))
repeat_2 = RepeatData(Data=[Slider(19.2, range=0..100), Slider(16, range=0..100)], Length="4")

panel_15 = Panel("""0
1
2
3""")
panel_16 = Panel(repeat_2)

complex = ComplexComponents(Complex=md_slider)  # -> Real, Imaginary
int = Integer(panel_15)
num = Number(panel_16)
panel_17 = Panel("""5
3
5
3""")
complex_2 = CreateComplex(Real=complex.Real, Imaginary=complex.Imaginary)
division = Division(A=num, B=panel_17)
panel_18 = Panel("有限元插写")
item = ListItem(
    List=[{imaginary=0, real=1}, {imaginary=1, real=0}, {imaginary=0, real=-1}, {imaginary=-1, real=0}],
    Index=int,
    Wrap=False)
amp = Amplitude(Vector=item, Amplitude=division)
amp_2 = Amplitude(Vector=item, Amplitude=num)
pt_3 = Point(complex_2)
panel_19 = Panel(item)
stack = StackData(Data=amp, Stack=panel_17)
ma_4 = MassAddition(Input=amp_2)  # -> Result, PartialResults
addition_5 = Addition(A=pt_3, B=ma_4.PartialResults)
lng_4 = ListLength(List=int)
replace = ReplaceMembers()
ma_5 = MassAddition(Input=stack)  # -> Result, PartialResults
subtraction_2 = Subtraction(A=lng_4, B="1")
complex_3 = ComplexComponents(Complex=ma_4.PartialResults)  # -> Real, Imaginary
panel_20 = Panel(ma_4.PartialResults)
partition_5 = PartitionList(List=ma_5.PartialResults, Size=panel_17)  # -> simplify(Chunks)
addition_6 = Addition(A=pt_3, B=partition_5)
series_5 = Series(Start="1", Step=1, Count=subtraction_2)
item_2 = ListItem(List=series_5, Index=0, Wrap=True)  # -> Item, Item1, Item2
concat = Concatenate(FragmentA=complex_3.Real, FragmentB=complex_3.Imaginary, JoinSeparator=",")
complex_4 = ComplexComponents(Complex=partition_5)  # -> Real, Imaginary
complex_5 = CreateComplex(Real=complex_4.Real, Imaginary=complex_4.Imaginary)

pline = PolyLine(Vertices=addition_5, Closed=True)
concat_2 = Concatenate(FragmentA=concat, FragmentB=int, JoinSeparator=";")

panel_21 = Panel(concat_2)
series_6 = Series(Start=0, Step=1, Count="5")
item_3 = ListItem(List=int, Index=-1, Wrap=True)
number_slider = Slider(4, range=0..100)
addition_7 = Addition(A=item_3, B="1")
number_slider_2 = Slider(9, range=0..100)
series_7 = Series(Start=0, Step=1, Count=number_slider)
series_8 = Series(Start=0, Step=1, Count=number_slider)
dom = ConstructDomain(DomainStart="0", DomainEnd="0.5")

item_4 = ListItem(List=division, Index=0, Wrap=True)
division_2 = Division(A=item_4, B="5")
division_3 = Division(A=item_4, B="2")
dom_2 = ConstructDomain(DomainStart=division_2, DomainEnd=division_3)
random = Random(Range=dom_2, Number=number_slider, Seed=Slider(36.39, range=0..100))

panel_22 = Panel("0.5")
random_2 = Random(Range=dom, Number=number_slider, Seed=Slider(84.3, range=0..100))
panel_23 = Panel(random_2)

shift_3 = ShiftList(List=complex_5, Shift="-1", Wrap=False)  # -> simplify(List)

tstat = TreeStatistics(Tree=shift_3)  # -> Paths, Length, Count
lng_5 = ListLength(List=tstat.Paths)
subtraction_3 = Subtraction(A=lng_5, B="1")
series_9 = Series(Start="1", Step=1, Count=subtraction_3)
shift_4 = ShiftList(List=tstat.Paths, Shift=series_9, Wrap=False)  # -> simplify(List)
bang_2 = ExplodeTree(Data=shift_4)  # -> Branch0, Branch1, Branch2
branch_2 = TreeBranch(Tree=shift_3, Path=bang_2.Branch0, MaintainPaths=True)
branch_3 = TreeBranch(Tree=shift_3, Path=bang_2.Branch1, MaintainPaths=True)
branch_4 = TreeBranch(Tree=shift_3, Path=bang_2.Branch2, MaintainPaths=True)
entwine_2 = Entwine(Branch00=branch_2, Branch01=branch_3, Branch02=branch_4, FlattenInputs=True)  # -> simplify(Result)

# ----
# 重复排列点的做法
tstat_2 = TreeStatistics(Tree=shift_3)  # -> Paths, Length, Count
bang_3 = ExplodeTree(Data=shift_3)  # -> Branch0, Branch1, Branch2, Branch3
viewer_5 = ParamViewer(bang_3.Branch0)
panel_24 = Panel(tstat_2.Paths)
equals = Equality(FirstNumber=bang_3.Branch0)  # -> Equality, Inequality

shift_5 = ShiftList(List=tstat.Paths, Shift="-1", Wrap=False)  # -> simplify(List)
branch_5 = TreeBranch(Tree=shift_3, Path=shift_5, MaintainPaths=True)
graft_2 = GraftTree(Tree=branch_5, IncludeEmptyLists=True, IncludeNullItems=True)
lng_6 = ListLength(List=branch_5)
lng_7 = ListLength(List=entwine_2)
multiplication_2 = Multiplication(A=lng_6, B=lng_7)
repeat_3 = RepeatData(Data=entwine_2, Length=multiplication_2)
partition_6 = PartitionList(List=repeat_3, Size=lng_7)  # -> simplify(Chunks)

panel_25 = Panel(shift_3)
panel_26 = Panel(branch_5)
panel_27 = Panel(entwine_2)
vec2pt = Vector2Pt(PointA=graft_2, PointB=partition_6, Unitize=False)  # -> Vector, Length
threesidepoints = Point(graft_2)
vetor = Vector(vec2pt.Vector)

# ---- group: 运算数据结构
lng_8 = ListLength(List=vetor)
item_5 = ListItem(List=int, Index="-1", Wrap=True)
ma_6 = MassAddition(Input=flatten(lng_8))  # -> Result, PartialResults
addition_8 = Addition(A=item_5, B="1")
complex_6 = ComplexComponents(Complex=vetor)  # -> Real, Imaginary
series_10 = Series(Start=addition_8, Step=1, Count=ma_6.Result)
partition_7 = PartitionList(List=series_10, Size=flatten(lng_8))  # -> simplify(Chunks)
concat_3 = Concatenate(FragmentA=complex_6.Real, FragmentB=complex_6.Imaginary, JoinSeparator=",")
int_2 = Integer(partition_7)
concat_4 = Concatenate(FragmentA=concat_3, FragmentB=int_2, JoinSeparator=";")

# ----
vectorlength = Number(vec2pt.Length)
flatten = FlattenTree(Tree=vectorlength, Path="{0}")
line = LineSDL(Start=threesidepoints, Direction=vetor, Length=vectorlength)
sort = SortList(Keys=flatten)  # -> Keys, ValuesA
panel_28 = Panel(flatten)
cset = CreateSet(List=sort.Keys)  # -> Set, Map
item_6 = ListItem(List=cset.Set, Index=series_6, Wrap=False)
panel_29 = Panel(item_6)
mindex = MemberIndex(Set=flatten, Member=graft(item_6))  # -> simplify(Index), Count
split = TextSplit(Text=concat_4, Separators=";")
item_7 = ListItem(List=split, Index="1", Wrap=False)
flatten_2 = FlattenTree(Tree=item_7, Path="{0}")
multiplication_3 = Multiplication(A=vetor, B="0.5")
tstat_3 = TreeStatistics(Tree=split)  # -> Paths, Length, Count
addition_9 = Addition(A=addition_8, B=mindex.Index)
subtraction_4 = Subtraction(A=flatten_2, B=addition_8)
mindex_2 = MemberIndex(Set=subtraction_4, Member=mindex.Index)  # -> Index, Count
viewer_6 = ParamViewer(mindex_2.Index)
item_8 = ListItem(List=tstat_3.Paths, Index=mindex_2.Index, Wrap=True)
mindex_3 = MemberIndex(Set=flatten_2, Member=addition_9)  # -> Index, Count
branch_6 = TreeBranch(Tree=split, Path=item_8, MaintainPaths=True)
panel_30 = Panel(flatten_2)
panel_31 = Panel(addition_9)
panel_32 = Panel(mindex_3.Index)

shift_6 = ShiftList(List=partition_5, Shift="-1", Wrap=False)  # -> simplify(List)

tstat_4 = TreeStatistics(Tree=shift_6)  # -> Paths, Length, Count

shift_7 = ShiftList(List=tstat_4.Paths, Shift="1", Wrap=False)  # -> simplify(List)
branch_7 = TreeBranch(Tree=shift_6, Path=shift_7, MaintainPaths=True)
viewer_7 = ParamViewer(branch_7)
dpath_2 = DeconstructPath(Branch=viewer_7)
subtraction_5 = Subtraction(A=dpath_2, B="1")
path = ConstructPath(Indices=subtraction_5)  # -> flatten(Branch)
replace_2 = ReplacePaths(Data=branch_7, Search=viewer_7, Replace=path)

panel_33 = Panel(replace_2)

addition_10 = Addition(A=pt_3, B=shift_6)
shift_8 = ShiftList(List=tstat_4.Paths, Shift="-1", Wrap=False)
shift_9 = ShiftList(List=tstat_4.Paths, Shift=item_2.Item, Wrap=False)  # -> simplify(List)
shift_10 = ShiftList(List=tstat_4.Paths, Shift=item_2.Item1, Wrap=False)  # -> simplify(List)
shift_11 = ShiftList(List=tstat_4.Paths, Shift=item_2.Item2, Wrap=False)  # -> simplify(List)
shift_12 = ShiftList(List=tstat_4.Paths, Shift=series_5, Wrap=False)  # -> simplify(List)

branch_8 = TreeBranch(Tree=shift_6, Path=shift_8, MaintainPaths=True)

branch_9 = TreeBranch(Tree=shift_6, Path=shift_12, MaintainPaths=True)
branch_10 = TreeBranch(Tree=shift_6, Path=shift_9, MaintainPaths=True)
branch_11 = TreeBranch(Tree=shift_6, Path=shift_10, MaintainPaths=True)
branch_12 = TreeBranch(Tree=shift_6, Path=shift_11, MaintainPaths=True)
panel_34 = Panel(shift_6)
entwine_3 = Entwine(Branch00=flatten(branch_10), Branch01=flatten(branch_11), Branch02=flatten(branch_12), FlattenInputs=True)  # -> simplify(Result)

# ---- group: points
graft_3 = GraftTree(Tree=branch_8, IncludeEmptyLists=True, IncludeNullItems=True)

# ----
complex_7 = ComplexComponents(Complex=graft_3)  # -> Real, Imaginary
lng_9 = ListLength(List=branch_8)
lng_10 = ListLength(List=entwine_3)
panel_35 = Panel(entwine_3)
multiplication_4 = Multiplication(A=lng_9, B=lng_10)
complex_8 = CreateComplex(Real=complex_7.Real, Imaginary=complex_7.Imaginary)
concat_5 = Concatenate(FragmentA=complex_7.Real, FragmentB=complex_7.Imaginary, JoinSeparator=",")
repeat_4 = RepeatData(Data=entwine_3, Length=multiplication_4)
partition_8 = PartitionList(List=repeat_4, Size=lng_10)

# ---- group: vectors
vec2pt_2 = Vector2Pt(PointA=graft_3, PointB=partition_8, Unitize=False)  # -> simplify(Vector), Length

# ----
viewer_8 = ParamViewer(vec2pt_2.Vector)
flatten_3 = FlattenTree(Tree=vec2pt_2.Vector, Path="{0}")
panel_36 = Panel(shift_12)
lng_11 = ListLength(List=flatten_3)
lng_12 = ListLength(List=vec2pt_2.Vector)  # -> flatten(Length)
amp_3 = Amplitude(Vector=vec2pt_2.Vector, Amplitude=vec2pt_2.Length)
series_11 = Series(Start=addition_7, Step=1, Count=lng_11)
int_3 = Integer(flatten(series_11))
flatten_4 = FlattenTree(Tree=vec2pt_2.Length, Path="{0}")
sort_2 = SortList(Keys=flatten_4)  # -> Keys, ValuesA
panel_37 = Panel(sort_2.Keys)
item_9 = ListItem(List=sort_2.Keys, Index=series_7, Wrap=True)
partition_9 = PartitionList(List=int_3, Size=lng_12)  # -> simplify(Chunks)
concat_6 = Concatenate(FragmentA=concat_5, FragmentB=partition_9, JoinSeparator=";")
panel_38 = Panel(concat_6)
panel_39 = Panel(vec2pt_2.Vector)
cset_2 = CreateSet(List=item_9)  # -> Set, Map
mindex_4 = MemberIndex(Set=flatten_4, Member=cset_2.Set)  # -> Index, Count
pt_4 = Point(graft_3)
vec = Vector(vec2pt_2.Vector)

addition_11 = Addition(A=graft_3, B=amp_3)
line_2 = LineSDL(Start=graft_3, Direction=vec2pt_2.Vector, Length=vec2pt_2.Length)
viewer_9 = ParamViewer(line_2)

jitter = Jitter(List=flatten(sort_2.Keys), Jitter=1, Seed=Slider(34.68, range=0..100))  # -> Values, Indices
addition_12 = Addition(A=vec, B=pt_4)
addition_13 = Addition(A=addition_12, B=pt_4)
item_10 = ListItem(List=jitter.Values, Index=series_8, Wrap=False)
flatten_5 = FlattenTree(Tree=line_2, Path="{0}")
item_11 = ListItem(List=flatten(addition_13), Index=item_10, Wrap=True)
item_12 = ListItem(List=flatten_5, Index=item_10, Wrap=True)
multiplication_5 = Multiplication(A=item_11, B=random_2)
pt_5 = Point(multiplication_5)
addition_14 = Addition(A=pt_3, B=pt_5)
pl = ConstructPlane(Origin=addition_14, XAxis=Vector(1, 0, 0), YAxis=Vector(0, 1, 0))
cir = Circle(Plane=pl, Radius=random)
panel_42 = Panel(multiplication_5)
