# Grasshopper definition 160919_haystack_006.gh (Grasshopper 0.9.76)

panel = Panel("""3
2
3""")
panel_2 = Panel("""5
2
2""")
ma = MassAddition(Input=panel)  # -> Result, PartialResults
ma_2 = MassAddition(Input=panel_2)  # -> Result, PartialResults
series = Series(Start=0, Step=1, Count=ma.Result)
series_2 = Series(Start=0, Step=1, Count=ma_2.Result)
partition = PartitionList(List=series, Size=panel)  # -> simplify(Chunks)
partition_2 = PartitionList(List=series_2, Size=panel_2)  # -> simplify(Chunks)
panel_3 = Panel(partition)
panel_4 = Panel(partition_2)
graft = GraftTree(Tree=partition, IncludeEmptyLists=True, IncludeNullItems=True)
lng = ListLength(List=partition)
lng_2 = ListLength(List=partition_2)
addition = Addition(A=partition, B=partition_2)
addition_2 = Addition(A=graft, B=partition_2)
viewer = ParamViewer(graft)
multiplication = Multiplication(A=lng, B=lng_2)
repeat = RepeatData(Data=partition_2, Length=multiplication)
partition_3 = PartitionList(List=repeat, Size=lng_2)  # -> simplify(Chunks)
viewer_2 = ParamViewer(partition_3)
addition_3 = Addition(A=graft, B=partition_3)

panel_5 = Panel("""5
3
5
3""")
ma_3 = MassAddition(Input=panel_5)  # -> Result, PartialResults
panel_6 = Panel("""1
2
3""")
panel_7 = Panel("""2
3""")
pt = Point(Point(-95.50302731, 3.41775708, 0))
pt_2 = Point(Point(-61.12878793, 5.226927573, 0))
series_3 = Series(Start="10", Step=1, Count=ma_3.Result)
entwine = Entwine(Branch00=panel_6, Branch01=panel_7, Branch02="3", FlattenInputs=True)  # -> simplify(Result)
partition_4 = PartitionList(List=series_3, Size=panel_5)  # -> simplify(Chunks)
ln = Line(StartPoint=pt, EndPoint=pt_2)
panel_8 = Panel(entwine)
divide = DivideCurve(Curve=ln, Count=Slider(4, range=0..10), Kinks=False)  # -> simplify(flatten(Points)), Tangents, Parameters
lng_3 = ListLength(List=divide.Points)
subtraction = Subtraction(A=lng_3, B="1")
addition_4 = Addition(A=partition_4, B=entwine)
series_4 = Series(Start="1", Step=1, Count=subtraction)
shift = ShiftList(List=divide.Points, Shift="-1", Wrap=False)  # -> simplify(flatten(List))
panel_9 = Panel(shift)
panel_10 = Panel(partition_4)
shift_2 = ShiftList(List=divide.Points, Shift=series_4, Wrap=False)  # -> simplify(List)

viewer_3 = ParamViewer()
bang = ExplodeTree()  # -> Branch0, Branch1, Branch2, Branch3
viewer_4 = ParamViewer(bang.Branch0)
dpath = DeconstructPath(Branch=viewer_4)
cull_i = CullIndex(Indices=dpath, Wrap=True)
branch = TreeBranch(Path=cull_i, MaintainPaths=True)

ln_2 = Line(StartPoint=graft(shift), EndPoint=shift_2)
panel_11 = Panel(ln_2)
panel_12 = Panel(addition_4)
panel_13 = Panel(shift_2)
panel_14 = Panel("""精确度问题,有限元问题
忽略了一个角""")
md_slider = MDSlider(
    slider_value=Point(0.5853658537, 0.6780488549, 0.5),
    SliderMode=0,
    x_domain=Domain(-100, 100),
    y_domain=Domain(-100, 100),
    z_domain=Domain(0, 1))
repeat_2 = RepeatData(Data=[Slider(20, range=0..100), Slider(15, range=0..100)], Length="4")

panel_15 = Panel("""0
1
2
3""")
panel_16 = Panel(repeat_2)

complex = ComplexComponents(Complex=md_slider)  # -> Real, Imaginary
panel_17 = Panel("""5
3
5
3""")
int = Integer(panel_15)
num = Number(panel_16)
complex_2 = CreateComplex(Real=complex.Real, Imaginary=complex.Imaginary)
division = Division(A=num, B=panel_17)
panel_18 = Panel("有限元插写")
item = ListItem(
    List=[{imaginary=0, real=1}, {imaginary=1, real=0}, {imaginary=0, real=-1}, {imaginary=-1, real=0}],
    Index=int,
    Wrap=False)
amp = Amplitude(Vector=item, Amplitude=division)
basicpoint = Point(complex_2)
amp_2 = Amplitude(Vector=item, Amplitude=num)
panel_19 = Panel(item)
stack = StackData(Data=amp, Stack=panel_17)
ma_4 = MassAddition(Input=amp_2)  # -> Result, PartialResults
addition_5 = Addition(A=basicpoint, B=ma_4.PartialResults)
ma_5 = MassAddition(Input=stack)  # -> Result, PartialResults
complex_3 = ComplexComponents(Complex=ma_4.PartialResults)  # -> Real, Imaginary
panel_20 = Panel(ma_4.PartialResults)
partition_5 = PartitionList(List=ma_5.PartialResults, Size=panel_17)  # -> simplify(Chunks)
addition_6 = Addition(A=basicpoint, B=partition_5)
concat = Concatenate(FragmentA=complex_3.Real, FragmentB=complex_3.Imaginary, JoinSeparator=",")
complex_4 = ComplexComponents(Complex=partition_5)  # -> Real, Imaginary
complex_5 = CreateComplex(Real=complex_4.Real, Imaginary=complex_4.Imaginary)

pline = PolyLine(Vertices=addition_5, Closed=True)
concat_2 = Concatenate(FragmentA=concat, FragmentB=int, JoinSeparator=";")

panel_21 = Panel(concat_2)
miniestlinecount = Integer(Slider(5, range=0..10))
series_5 = Series(Start=0, Step=1, Count=miniestlinecount)
circlecountseed = Integer(Slider(54.95, range=0..100))
circlecount = Integer(Slider(5, range=0..10))
sidelocate_range = Number("0.5")
sidelocateseed = Number(Slider(40.18, range=0..100))
random = Random(Range=sidelocate_range, Number=circlecount, Seed=sidelocateseed)  # -> simplify(graft(Random))

shift_3 = ShiftList(List=complex_5, Shift="-1", Wrap=False)  # -> simplify(List)

tstat = TreeStatistics(Tree=shift_3)  # -> Paths, Length, Count
lng_4 = ListLength(List=tstat.Paths)
subtraction_2 = Subtraction(A=lng_4, B="1")
series_6 = Series(Start="1", Step=1, Count=subtraction_2)
shift_4 = ShiftList(List=tstat.Paths, Shift=series_6, Wrap=False)  # -> simplify(List)
bang_2 = ExplodeTree(Data=shift_4)  # -> Branch0, Branch1, Branch2
branch_2 = TreeBranch(Tree=shift_3, Path=bang_2.Branch0, MaintainPaths=True)
branch_3 = TreeBranch(Tree=shift_3, Path=bang_2.Branch1, MaintainPaths=True)
branch_4 = TreeBranch(Tree=shift_3, Path=bang_2.Branch2, MaintainPaths=True)
entwine_2 = Entwine(Branch00=branch_2, Branch01=branch_3, Branch02=branch_4, FlattenInputs=True)  # -> simplify(Result)

panel_22 = Panel(shift_3)

# ----
# 重复排列点的做法
tstat_2 = TreeStatistics(Tree=shift_3)  # -> Paths, Length, Count
bang_3 = ExplodeTree(Data=shift_3)  # -> Branch0, Branch1, Branch2, Branch3
viewer_5 = ParamViewer(bang_3.Branch0)
panel_23 = Panel(tstat_2.Paths)
equals = Equality(FirstNumber=bang_3.Branch0)  # -> Equality, Inequality

shift_5 = ShiftList(List=tstat.Paths, Shift="-1", Wrap=False)  # -> simplify(List)
branch_5 = TreeBranch(Tree=shift_3, Path=shift_5, MaintainPaths=True)
graft_2 = GraftTree(Tree=branch_5, IncludeEmptyLists=True, IncludeNullItems=True)
lng_5 = ListLength(List=branch_5)
lng_6 = ListLength(List=entwine_2)
multiplication_2 = Multiplication(A=lng_5, B=lng_6)
repeat_3 = RepeatData(Data=entwine_2, Length=multiplication_2)
partition_6 = PartitionList(List=repeat_3, Size=lng_6)  # -> simplify(Chunks)

panel_24 = Panel(branch_5)
vec2pt = Vector2Pt(PointA=graft_2, PointB=partition_6, Unitize=False)  # -> Vector, Length
threesidepoints = Point(graft_2)
vetor = Vector(vec2pt.Vector)

# ---- group: 运算数据结构
lng_7 = ListLength(List=vetor)
item_2 = ListItem(List=int, Index="-1", Wrap=True)
ma_6 = MassAddition(Input=flatten(lng_7))  # -> Result, PartialResults
addition_7 = Addition(A=item_2, B="1")
complex_6 = ComplexComponents(Complex=threesidepoints)  # -> Real, Imaginary
series_7 = Series(Start=addition_7, Step=1, Count=ma_6.Result)
partition_7 = PartitionList(List=series_7, Size=flatten(lng_7))  # -> simplify(Chunks)
concat_3 = Concatenate(FragmentA=complex_6.Real, FragmentB=complex_6.Imaginary, JoinSeparator=",")
int_2 = Integer(partition_7)
concat_4 = Concatenate(FragmentA=concat_3, FragmentB=int_2, JoinSeparator=";")

# ----
vectorlength = Number(vec2pt.Length)
flatten = FlattenTree(Tree=vectorlength, Path="{0}")
sort = SortList(Keys=flatten)  # -> Keys, ValuesA
line = LineSDL(Start=threesidepoints, Direction=vetor, Length=vectorlength)
cset = CreateSet(List=sort.Keys)  # -> Set, Map
item_3 = ListItem(List=cset.Set, Index=series_5, Wrap=False)
mindex = MemberIndex(Set=flatten, Member=graft(item_3))  # -> simplify(Index), Count
flatten_2 = FlattenTree(Tree=concat_4, Path="{0}")
panel_25 = Panel(mindex.Index)
item_4 = ListItem(List=flatten_2, Index=mindex.Index, Wrap=False)
panel_26 = Panel(flatten_2)
flatten_3 = FlattenTree(Tree=item_4, Path="{0}")
lng_8 = ListLength(List=flatten_3)
subtraction_3 = Subtraction(A=lng_8, B="1")
random_2 = Random(Range=subtraction_3, Number=circlecount, Seed=circlecountseed)
item_5 = ListItem(List=flatten_3, Index=random_2, Wrap=False)
panel_27 = Panel(item_5)
split = TextSplit(Text=item_5, Separators=";")
item_6 = ListItem(List=split, Index="0", Wrap=False)  # -> simplify(Item), simplify(Item1)
split_2 = TextSplit(Text=item_6.Item, Separators=",")
panel_28 = Panel(split)
item_7 = ListItem(List=split_2, Index="0", Wrap=False)  # -> simplify(Item), simplify(Item1)
tstat_3 = TreeStatistics(Tree=split)  # -> Paths, Length, Count
item_8 = ListItem(List=flatten(vetor), Index=item_6.Item1, Wrap=False)
complex_7 = CreateComplex(Real=item_7.Item, Imaginary=item_7.Item1)
panel_29 = Panel(split_2)
item_9 = ListItem(List=tstat_3.Paths, Index=0, Wrap=True)
complex_8 = ComplexComponents(Complex=item_8)  # -> Real, Imaginary
branch_6 = TreeBranch(Tree=split, Path=item_9, MaintainPaths=True)

# ---- group: startPoint
complex_9 = CreateComplex(Real=complex_8.Real, Imaginary=complex_8.Imaginary)

# ---- group: endPoint
addition_8 = Addition(A=complex_9, B=complex_7)

# ----
pt_3 = Point(complex_7)
addition_9 = Addition(A=complex_9, B=addition_8)
multiplication_3 = Multiplication(A=addition_9, B=random)
panel_30 = Panel(pt_3)
pt_4 = Point(multiplication_3)
panel_31 = Panel(multiplication_3)
addition_10 = Addition(A=basicpoint, B=pt_4)
panel_32 = Panel(addition_10)

lng_9 = ListLength(List=int)  # disabled
panel_33 = Panel("1")  # disabled
subtraction_4 = Subtraction(A=lng_9, B=panel_33)  # disabled
series_8 = Series(Start=panel_33, Step=1, Count=subtraction_4)  # disabled
item_10 = ListItem(List=series_8, Index=0, Wrap=True)  # -> Item, Item1, Item2; disabled
panel_34 = Panel("-1")  # disabled
panel_35 = Panel("-1")  # disabled
item_11 = ListItem(List=int, Index=-1, Wrap=True)  # disabled
panel_36 = Panel("1")  # disabled
number_slider = Slider(4, range=0..100)  # disabled
addition_11 = Addition(A=item_11, B=panel_36)  # disabled
number_slider_2 = Slider(9, range=0..100)
series_9 = Series(Start=0, Step=1, Count=number_slider)  # disabled
series_10 = Series(Start=0, Step=1, Count=number_slider)  # disabled
panel_37 = Panel("0.5")  # disabled
panel_38 = Panel("0")  # disabled
number_slider_3 = Slider(84.3, range=0..100)  # disabled
dom = ConstructDomain(DomainStart=panel_38, DomainEnd=panel_37)  # disabled
panel_39 = Panel("0.5")  # disabled
random_3 = Random(Range=dom, Number=number_slider, Seed=number_slider_3)  # disabled

shift_6 = ShiftList(List=partition_5, Shift=panel_34, Wrap=False)  # -> simplify(List)

item_12 = ListItem(List=division, Index=0, Wrap=True)  # disabled
panel_40 = Panel("2")  # disabled
panel_41 = Panel("5")  # disabled
division_2 = Division(A=item_12, B=panel_41)  # disabled
number_slider_4 = Slider(36.39, range=0..100)  # disabled
division_3 = Division(A=item_12, B=panel_40)  # disabled
dom_2 = ConstructDomain(DomainStart=division_2, DomainEnd=division_3)  # disabled
random_4 = Random(Range=dom_2, Number=number_slider, Seed=number_slider_4)  # disabled

shift_7 = ShiftList(List=partition_5, Shift=panel_34, Wrap=False)  # -> simplify(List); disabled

tstat_4 = TreeStatistics(Tree=shift_7)  # -> Paths, Length, Count

shift_8 = ShiftList(List=tstat_4.Paths, Shift="1", Wrap=False)  # -> simplify(List)
branch_7 = TreeBranch(Tree=shift_6, Path=shift_8, MaintainPaths=True)
viewer_6 = ParamViewer(branch_7)
dpath_2 = DeconstructPath(Branch=viewer_6)
subtraction_5 = Subtraction(A=dpath_2, B="1")
path = ConstructPath(Indices=subtraction_5)  # -> flatten(Branch)
replace = ReplacePaths(Data=branch_7, Search=viewer_6, Replace=path)

panel_42 = Panel(replace)

addition_12 = Addition(A=basicpoint, B=shift_7)

tstat_5 = TreeStatistics(Tree=shift_7)  # -> Paths, Length, Count; disabled
shift_9 = ShiftList(List=tstat_5.Paths, Shift=panel_35, Wrap=False)  # disabled
shift_10 = ShiftList(List=tstat_5.Paths, Shift=item_10.Item, Wrap=False)  # -> simplify(List); disabled
shift_11 = ShiftList(List=tstat_5.Paths, Shift=item_10.Item1, Wrap=False)  # -> simplify(List); disabled
shift_12 = ShiftList(List=tstat_5.Paths, Shift=item_10.Item2, Wrap=False)  # -> simplify(List); disabled
shift_13 = ShiftList(List=tstat_5.Paths, Shift=series_8, Wrap=False)  # -> simplify(List); disabled
branch_8 = TreeBranch(Tree=shift_7, Path=shift_13, MaintainPaths=True)  # disabled
branch_9 = TreeBranch(Tree=shift_7, Path=shift_10, MaintainPaths=True)  # disabled
branch_10 = TreeBranch(Tree=shift_7, Path=shift_11, MaintainPaths=True)  # disabled
branch_11 = TreeBranch(Tree=shift_7, Path=shift_12, MaintainPaths=True)  # disabled
entwine_3 = Entwine(Branch00=flatten(branch_9), Branch01=flatten(branch_10), Branch02=flatten(branch_11), FlattenInputs=True)  # -> simplify(Result); disabled
lng_10 = ListLength(List=entwine_3)  # disabled

branch_12 = TreeBranch(Tree=shift_7, Path=shift_9, MaintainPaths=True)  # disabled

# ---- group: points
graft_3 = GraftTree(Tree=branch_12, IncludeEmptyLists=True, IncludeNullItems=True)  # disabled

# ----
complex_10 = ComplexComponents(Complex=graft_3)  # -> Real, Imaginary; disabled
lng_11 = ListLength(List=branch_12)  # disabled
multiplication_4 = Multiplication(A=lng_11, B=lng_10)  # disabled
complex_11 = CreateComplex(Real=complex_10.Real, Imaginary=complex_10.Imaginary)  # disabled
concat_5 = Concatenate(FragmentA=complex_10.Real, FragmentB=complex_10.Imaginary, JoinSeparator=",")  # disabled
repeat_4 = RepeatData(Data=entwine_3, Length=multiplication_4)  # disabled
partition_8 = PartitionList(List=repeat_4, Size=lng_10)  # disabled
pt_5 = Point(graft_3)  # disabled

# ---- group: vectors
vec2pt_2 = Vector2Pt(PointA=graft_3, PointB=partition_8, Unitize=False)  # -> simplify(Vector), Length; disabled

# ----
viewer_7 = ParamViewer(vec2pt_2.Vector)  # disabled
flatten_4 = FlattenTree(Tree=vec2pt_2.Vector, Path="{0}")  # disabled
lng_12 = ListLength(List=flatten_4)  # disabled
lng_13 = ListLength(List=vec2pt_2.Vector)  # -> flatten(Length); disabled
amp_3 = Amplitude(Vector=vec2pt_2.Vector, Amplitude=vec2pt_2.Length)  # disabled
series_11 = Series(Start=addition_11, Step=1, Count=lng_12)  # disabled
flatten_5 = FlattenTree(Tree=vec2pt_2.Length, Path="{0}")  # disabled
int_3 = Integer(flatten(series_11))  # disabled
sort_2 = SortList(Keys=flatten_5)  # -> Keys, ValuesA; disabled
item_13 = ListItem(List=sort_2.Keys, Index=series_9, Wrap=True)  # disabled
partition_9 = PartitionList(List=int_3, Size=lng_13)  # -> simplify(Chunks); disabled
concat_6 = Concatenate(FragmentA=concat_5, FragmentB=partition_9, JoinSeparator=";")  # disabled
panel_43 = Panel(concat_6)  # disabled
cset_2 = CreateSet(List=item_13)  # -> Set, Map; disabled
mindex_2 = MemberIndex(Set=flatten_5, Member=cset_2.Set)  # -> Index, Count; disabled
vec = Vector(vec2pt_2.Vector)  # disabled
jitter = Jitter(List=flatten(sort_2.Keys), Jitter=1, Seed=Slider(34.68, range=0..100))  # -> Values, Indices; disabled
addition_13 = Addition(A=vec, B=pt_5)  # disabled
addition_14 = Addition(A=addition_13, B=pt_5)  # disabled
item_14 = ListItem(List=jitter.Values, Index=series_10, Wrap=False)  # disabled
item_15 = ListItem(List=flatten(addition_14), Index=item_14, Wrap=True)  # disabled
multiplication_5 = Multiplication(A=item_15, B=random_3)  # disabled
pt_6 = Point(multiplication_5)  # disabled
addition_15 = Addition(A=basicpoint, B=pt_6)  # disabled
pl = ConstructPlane(Origin=addition_15, XAxis=Vector(1, 0, 0), YAxis=Vector(0, 1, 0))  # disabled
cir = Circle(Plane=pl, Radius=random_4)  # disabled
panel_44 = Panel(multiplication_5)  # disabled

addition_16 = Addition(A=graft_3, B=amp_3)  # disabled
line_2 = LineSDL(Start=graft_3, Direction=vec2pt_2.Vector, Length=vec2pt_2.Length)  # disabled
viewer_8 = ParamViewer(line_2)  # disabled

flatten_6 = FlattenTree(Tree=line_2, Path="{0}")  # disabled
item_16 = ListItem(List=flatten_6, Index=item_14, Wrap=True)  # disabled
