# Grasshopper definition 160921_chase_stone.gh (Grasshopper 0.9.76)

md_slider = MDSlider(
    slider_value=Point(0.5775609831, 0.6897561608, 0.5),
    SliderMode=0,
    x_domain=Domain(-100, 100),
    y_domain=Domain(-100, 100),
    z_domain=Domain(0, 1))

genes = GenePool(Decimals=6, Maximum=50, Minimum=0, Value=[16.693933, 16.409426])

basicpoint = Point(md_slider)

finiteelement = Integer(Slider(3, range=0..10))
localsize = Number(genes)

complex = ComplexComponents(Complex=basicpoint)  # -> Real, Imaginary
localsize_2 = Number(localsize)
complex_2 = CreateComplex(Real=complex.Real, Imaginary=complex.Imaginary)
repeat = RepeatData(Data=localsize_2, Length="4")

panel = Panel(repeat)
panel_2 = Panel("""0
1
2
3""")

basicpoint_2 = Point(complex_2)
int = Integer(panel_2)
num = Number(panel)

item = ListItem(List=num, Index="0", Wrap=True)  # -> Item, Item1
finiteelement_2 = Integer(finiteelement)
division = Division(A=item.Item, B=finiteelement_2)
round = Round(Number=division)  # -> Nearest, Floor, Ceiling
merge = Merge(Data1=round.Floor, Data2=round.Ceiling)
subtraction = Subtraction(A=division, B=round.Floor)
subtraction_2 = Subtraction(A=division, B=merge)
multiplication = Multiplication(A=finiteelement_2, B=subtraction_2)
division_2 = Division(A=multiplication, B=merge)
addition = Addition(A=finiteelement_2, B=division_2)  # -> simplify(graft(Result))
larger = LargerThan(FirstNumber=subtraction, SecondNumber="0.5")  # -> LargerThan, OrEqualTo
bang = ExplodeTree(Data=addition)  # -> Branch0, Branch1
filter = StreamFilter(Gate=larger.OrEqualTo, Stream0=bang.Branch0, Stream1=bang.Branch1)  # -> flatten(Stream)
heightfiniteelement = Number(filter)
division_3 = Division(A=item.Item1, B=heightfiniteelement)
round_2 = Round(Number=division_3)  # -> Nearest, Floor, Ceiling
merge_2 = Merge(Data1=round_2.Floor, Data2=round_2.Ceiling)
subtraction_3 = Subtraction(A=division_3, B=merge_2)
subtraction_4 = Subtraction(A=division_3, B=round_2.Floor)
multiplication_2 = Multiplication(A=heightfiniteelement, B=subtraction_3)
division_4 = Division(A=multiplication_2, B=merge_2)
addition_2 = Addition(A=heightfiniteelement, B=division_4)  # -> simplify(graft(Result))
larger_2 = LargerThan(FirstNumber=subtraction_4, SecondNumber="0.5")  # -> LargerThan, OrEqualTo
bang_2 = ExplodeTree(Data=addition_2)  # -> Branch0, Branch1
filter_2 = StreamFilter(Gate=larger_2.OrEqualTo, Stream0=bang_2.Branch0, Stream1=bang_2.Branch1)  # -> flatten(Stream)
merge_3 = Merge(Data1=filter, Data2=filter_2, Data3=filter, Data4=filter_2)

finallyelement = Number(merge_3)
item_2 = ListItem(
    List=[{imaginary=0, real=1}, {imaginary=1, real=0}, {imaginary=0, real=-1}, {imaginary=-1, real=0}],
    Index=int,
    Wrap=False)
panel_3 = Panel(item_2)
division_5 = Division(A=num, B=finallyelement)
amp = Amplitude(Vector=item_2, Amplitude=finallyelement)
amp_2 = Amplitude(Vector=item_2, Amplitude=num)
stack = StackData(Data=amp, Stack=division_5)
ma = MassAddition(Input=amp_2)  # -> Result, PartialResults
addition_3 = Addition(A=basicpoint_2, B=ma.PartialResults)
pline = PolyLine(Vertices=addition_3, Closed=True)
panel_4 = Panel(division_5)
ma_2 = MassAddition(Input=stack)  # -> Result, PartialResults
complex_3 = ComplexComponents(Complex=ma.PartialResults)  # -> Real, Imaginary
partition = PartitionList(List=ma_2.PartialResults, Size=division_5)  # -> simplify(Chunks)
concat = Concatenate(FragmentA=complex_3.Real, FragmentB=complex_3.Imaginary, JoinSeparator=",")
complex_4 = ComplexComponents(Complex=partition)  # -> Real, Imaginary
concat_2 = Concatenate(FragmentA=concat, FragmentB=int, JoinSeparator=";")
complex_5 = CreateComplex(Real=complex_4.Real, Imaginary=complex_4.Imaginary)
totalpoints_original = Point(complex_5)
multiplication_3 = Multiplication(A=finiteelement_2, B="0.7")
multiplication_4 = Multiplication(A=finiteelement_2, B="0.1")

shift = ShiftList(List=totalpoints_original, Shift="-1", Wrap=False)  # -> simplify(List)
tstat = TreeStatistics(Tree=shift)  # -> Paths, Length, Count
lng = ListLength(List=tstat.Paths)
series = Series(Start="1", Step=1, Count=lng)
shift_2 = ShiftList(List=tstat.Paths, Shift=series, Wrap=True)  # -> simplify(List)
shift_3 = ShiftList(List=shift_2, Shift="-1", Wrap=False)  # -> simplify(List)
bang_3 = ExplodeTree(Data=shift_3)  # -> Branch0, Branch1, Branch2, Branch3
branch = TreeBranch(Tree=shift, Path=bang_3.Branch0, MaintainPaths=True)
branch_2 = TreeBranch(Tree=shift, Path=bang_3.Branch1, MaintainPaths=True)
branch_3 = TreeBranch(Tree=shift, Path=bang_3.Branch2, MaintainPaths=True)
branch_4 = TreeBranch(Tree=shift, Path=bang_3.Branch3, MaintainPaths=True)
entwine = Entwine(Branch00=branch, Branch01=branch_2, Branch02=branch_3, Branch03=branch_4, FlattenInputs=True)  # -> simplify(Result)
lng_2 = ListLength(List=shift)
lng_3 = ListLength(List=entwine)
multiplication_5 = Multiplication(A=lng_2, B=lng_3)
repeat_2 = RepeatData(Data=entwine, Length=multiplication_5)
graft = GraftTree(Tree=shift, IncludeEmptyLists=True, IncludeNullItems=True)
partition_2 = PartitionList(List=repeat_2, Size=lng_3)  # -> simplify(Chunks)
vec2pt = Vector2Pt(PointA=graft, PointB=partition_2, Unitize=False)  # -> Vector, Length
vdis = VectorDisplay(Anchor=graft, Vector=vec2pt.Vector)

division_6 = Division(A=multiplication_3, B=Slider(27.022, range=0..100))
neg = Negative(Value=division_6)
dom = ConstructDomain(DomainStart=multiplication_4, DomainEnd=multiplication_3)
panel_5 = Panel("""0.3
0.4
0
0.3""")
dom_2 = ConstructDomain(DomainStart="2", DomainEnd="12")
dom_3 = ConstructDomain(DomainStart=neg, DomainEnd=division_6)
panel_6 = Panel(merge_3)
treecountdomain = Domain(dom_2)
countweight = Number(panel_5)
circlesize_domain = Domain(dom)
circlesizeseed = Number(Slider(27.771, range=0..100))
stonesizerock_domain = Domain(dom_3)
stonesizerockseed = Number(Slider(15.773, range=0..100))
treecountseed = Number(Slider(38.29, range=0..100))

dedomain = DeconstructDomain(Domain=treecountdomain)  # -> Start, End
subtraction_5 = Subtraction(A=dedomain.End, B=dedomain.Start)
treecountseed_2 = Number(treecountseed)
range = Range(Domain=treecountdomain, Steps=subtraction_5)
jitter = Jitter(List=range, Jitter=1, Seed=treecountseed_2)  # -> Values, Indices
countweight_2 = Number(countweight)
item_3 = ListItem(List=jitter.Values, Index=0, Wrap=True)
stonestepcount = Integer(item_3)
multiplication_6 = Multiplication(A=stonestepcount, B=countweight_2)
int_2 = Integer(multiplication_6)
ma_3 = MassAddition(Input=int_2)  # -> Result, PartialResults
item_4 = ListItem(List=int_2, Index="-1", Wrap=True)
subtraction_6 = Subtraction(A=stonestepcount, B=ma_3.Result)
addition_4 = Addition(A=subtraction_6, B=item_4)
replace = ReplaceItems(List=int_2, Item=addition_4, Indices="-1", Wrap=True)
dividetreecount = Integer(simplify(graft(replace)))

remap = RemapNumbers(Value=[Slider(0.097, range=0..1), Slider(0.215, range=0..1)], Source=Domain(0, 1), Target=Domain(0, 6.283185307))  # -> graft(Mapped), Clipped
bang_4 = ExplodeTree(Data=simplify(remap.Mapped))  # -> Branch0, Branch1
dom_4 = ConstructDomain(DomainStart=bang_4.Branch0, DomainEnd=bang_4.Branch1)
vectorangledomain = Domain(dom_4)

panel_7 = Panel("""石块的半径在一个值域中
石块总体的趋势用权重控制，但变小的时候伴随晃动""")
sidefirstpoint = Point(graft)
vec = Vector(vec2pt.Vector)
vectorlength = Number(vec2pt.Length)
genes_2 = GenePool(Decimals=2, Maximum=16, Minimum=0, Value=[1.31, 8.75])
stonestepcount_2 = Integer(stonestepcount)

stonesize_domain = Domain(circlesize_domain)
circlesizeseed_2 = Number(circlesizeseed)
stonesizerock_domain_2 = Domain(stonesizerock_domain)
stonesizerockseed_2 = Number(stonesizerockseed)
chasestepcount = Integer(stonestepcount_2)
random = Random(Range=stonesize_domain, Number=chasestepcount, Seed=circlesizeseed_2)
sort = SortList(Keys=random)  # -> Keys, ValuesA
random_2 = Random(Range=stonesizerock_domain_2, Number=chasestepcount, Seed=stonesizerockseed_2)
rev = ReverseList(List=sort.Keys)
addition_5 = Addition(A=rev, B=random_2)
circlesize = Number(addition_5)

panel_8 = Panel(replace)
tstat_2 = TreeStatistics(Tree=sidefirstpoint)  # -> Paths, Length, Count
int_3 = Integer(genes_2)
item_5 = ListItem(List=tstat_2.Paths, Index=int_3, Wrap=True)
vectorjitter = Number(Slider(32.914, range=0..100))
vectorseed = Number(Slider(22.02, range=0..100))
branch_5 = TreeBranch(Tree=sidefirstpoint, Path=item_5, MaintainPaths=True)
bang_5 = ExplodeTree(Data=branch_5)  # -> Branch0, Branch1
series_2 = Series(Start=0, Step=1, Count=stonestepcount_2)
chaselengthseed = Number(Slider(7.716, range=0..100))
panel_9 = Panel(dom_4)
vec2pt_2 = Vector2Pt(PointA=bang_5.Branch0, PointB=bang_5.Branch1, Unitize=False)  # -> Vector, Length

finite_vector = Vector(vec2pt_2.Vector)
vectorangledomain_2 = Domain(vectorangledomain)
angle = Angle(VectorA=flatten(finite_vector), VectorB=vec)  # -> Angle, Reflex
inc = Includes(Value=angle.Angle, Domain=vectorangledomain_2)  # -> Includes, Deviation
sift = SiftPattern(List=vec, SiftPattern=inc.Includes)  # -> Output0, simplify(Output1)
clean = CleanTree(RemoveNulls=True, RemoveInvalid=True, RemoveEmpty=False, Tree=sift.Output1)
filteredvector = Vector(clean)

unit = UnitVector(Vector=filteredvector)
flatten = FlattenTree(Tree=unit, Path="{0}")
jitter_2 = Jitter(List=flatten, Jitter=vectorjitter, Seed=vectorseed)  # -> Values, Indices
item_6 = ListItem(List=jitter_2.Values, Index=series_2, Wrap=True)
vdis_2 = VectorDisplay(Anchor=bang_5.Branch0, Vector=vec2pt_2.Vector)
finite_vector_2 = Vector(vec2pt_2.Vector)

vlen = VectorLength(Vector=finite_vector_2)
division_7 = Division(A=vlen, B=stonestepcount_2)
stack_2 = StackData(Data=division_7, Stack=stonestepcount_2)

multiplication_7 = Multiplication(A=division_7, B="2")
dom_5 = ConstructDomain(DomainStart=division_7, DomainEnd=multiplication_7)
random_3 = Random(Range=dom_5, Number=stonestepcount_2, Seed=chaselengthseed)
firstpointvector = Point(bang_5.Branch0)
chasevectorunitize = Vector(item_6)
chaselength = Number(stack_2)
chaselength_2 = Number(random_3)

chasevectorunitize_2 = Vector(chasevectorunitize)
chaselength_3 = Number(chaselength_2)
amp_3 = Amplitude(Vector=chasevectorunitize_2, Amplitude=chaselength_3)
chasevector = Vector(amp_3)
ma_4 = MassAddition(Input=chasevector)  # -> Result, PartialResults
addition_6 = Addition(A=firstpointvector, B=ma_4.PartialResults)

anglerockdomain = Domain(vectorangledomain)
panel_10 = Panel(circlesize)
inc_2 = Includes(Value=ma_4.PartialResults, Domain=anglerockdomain)  # -> Includes, Deviation
finallypoints = Point(addition_6)

addition_7 = Addition(A=basicpoint_2, B=finallypoints)
pl = ConstructPlane(Origin=addition_7, XAxis=Vector(1, 0, 0), YAxis=Vector(0, 1, 0))
cir = Circle(Plane=pl, Radius=circlesize)
