# Grasshopper definition 160921_chase_stone_002.gh (Grasshopper 0.9.76)

md_slider = MDSlider(
    slider_value=Point(0.5775609831, 0.6897561608, 0.5),
    SliderMode=0,
    x_domain=Domain(-100, 100),
    y_domain=Domain(-100, 100),
    z_domain=Domain(0, 1))
panel = Panel("""追逃石的设计思路：
指定在场地上指定一条路径
将路径分成若干向量
向量方向发生小范围偏移摆放石头
两点之间插入的石头数目随机
石头的方向大小随机
大石头带领小石头""")

genes = GenePool(Decimals=6, Maximum=50, Minimum=0, Value=[31.123024, 16.409426])

basicpoint = Point(md_slider)

finiteelement = Integer(Slider(3, range=0..10))
localsize = Number(genes)

crv = Curve(<curve referenced from the Rhino model>)
explode = Explode(Curve=crv, Recursive=True)  # -> Segments, Vertices
complex = ComplexComponents(Complex=basicpoint)  # -> Real, Imaginary
localsize_2 = Number(localsize)
end = EndPoints(Curve=explode.Segments)  # -> Start, End
countseed = Number(Slider(30.592, range=0..100))
complex_2 = CreateComplex(Real=complex.Real, Imaginary=complex.Imaginary)
repeat = RepeatData(Data=localsize_2, Length="4")

panel_2 = Panel(repeat)
panel_3 = Panel("""0
1
2
3""")

vec2pt = Vector2Pt(PointA=end.Start, PointB=end.End, Unitize=False)  # -> Vector, Length
lng = ListLength(List=vec2pt.Vector)
dom = ConstructDomain(DomainStart="1", DomainEnd="2")
firstpoint = Point(end.Start)
random = Random(Range="100", Number=lng, Seed=countseed)
basicpoint_2 = Point(complex_2)
int = Integer(panel_3)
num = Number(panel_2)

item = ListItem(List=num, Index="0", Wrap=True)  # -> Item, Item1
finiteelement_2 = Integer(finiteelement)
division = Division(A=item.Item, B=finiteelement_2)
round = Round(Number=division)  # -> Nearest, Floor, Ceiling
merge = Merge(Data1=round.Floor, Data2=round.Ceiling)
subtraction = Subtraction(A=division, B=round.Floor)
subtraction_2 = Subtraction(A=division, B=merge)
multiplication = Multiplication(A=finiteelement_2, B=subtraction_2)
division_2 = Division(A=multiplication, B=merge)
addition = Addition(A=finiteelement_2, B=division_2)  # -> simplify(graft(Result))
larger = LargerThan(FirstNumber=subtraction, SecondNumber="0.5")  # -> LargerThan, OrEqualTo
bang = ExplodeTree(Data=addition)  # -> Branch0, Branch1
filter = StreamFilter(Gate=larger.OrEqualTo, Stream0=bang.Branch0, Stream1=bang.Branch1)  # -> flatten(Stream)
heightfiniteelement = Number(filter)
division_3 = Division(A=item.Item1, B=heightfiniteelement)
round_2 = Round(Number=division_3)  # -> Nearest, Floor, Ceiling
merge_2 = Merge(Data1=round_2.Floor, Data2=round_2.Ceiling)
subtraction_3 = Subtraction(A=division_3, B=merge_2)
subtraction_4 = Subtraction(A=division_3, B=round_2.Floor)
multiplication_2 = Multiplication(A=heightfiniteelement, B=subtraction_3)
division_4 = Division(A=multiplication_2, B=merge_2)
addition_2 = Addition(A=heightfiniteelement, B=division_4)  # -> simplify(graft(Result))
larger_2 = LargerThan(FirstNumber=subtraction_4, SecondNumber="0.5")  # -> LargerThan, OrEqualTo
bang_2 = ExplodeTree(Data=addition_2)  # -> Branch0, Branch1
filter_2 = StreamFilter(Gate=larger_2.OrEqualTo, Stream0=bang_2.Branch0, Stream1=bang_2.Branch1)  # -> flatten(Stream)
merge_3 = Merge(Data1=filter, Data2=filter_2, Data3=filter, Data4=filter_2)

finallyelement = Number(merge_3)
random_2 = Random(Range=dom, Number=1, Seed=random)  # -> simplify(Random)
item_2 = ListItem(
    List=[{imaginary=0, real=1}, {imaginary=1, real=0}, {imaginary=0, real=-1}, {imaginary=-1, real=0}],
    Index=int,
    Wrap=False)
panel_4 = Panel(item_2)
division_5 = Division(A=num, B=finallyelement)
amp = Amplitude(Vector=item_2, Amplitude=finallyelement)
stonecountbetweentwopoints = Integer(random_2)
panel_5 = Panel(stonecountbetweentwopoints)
amp_2 = Amplitude(Vector=item_2, Amplitude=num)
stack = StackData(Data=amp, Stack=division_5)
division_6 = Division(A=graft(vec2pt.Length), B=stonecountbetweentwopoints)  # -> simplify(Result)
ma = MassAddition(Input=amp_2)  # -> Result, PartialResults
addition_3 = Addition(A=basicpoint_2, B=ma.PartialResults)
pline = PolyLine(Vertices=addition_3, Closed=True)
panel_6 = Panel(division_5)
panel_7 = Panel(division_6)
ma_2 = MassAddition(Input=stack)  # -> Result, PartialResults
complex_3 = ComplexComponents(Complex=ma.PartialResults)  # -> Real, Imaginary
stack_2 = StackData(Data=division_6, Stack=stonecountbetweentwopoints)
partition = PartitionList(List=ma_2.PartialResults, Size=division_5)  # -> simplify(Chunks)
concat = Concatenate(FragmentA=complex_3.Real, FragmentB=complex_3.Imaginary, JoinSeparator=",")
ma_3 = MassAddition(Input=stack_2)  # -> Result, PartialResults
complex_4 = ComplexComponents(Complex=partition)  # -> Real, Imaginary
panel_8 = Panel(stack_2)
concat_2 = Concatenate(FragmentA=concat, FragmentB=int, JoinSeparator=";")
complex_5 = CreateComplex(Real=complex_4.Real, Imaginary=complex_4.Imaginary)
vectorseed = Number(Slider(13.674, range=0..100))
panel_9 = Panel(ma_3.PartialResults)
totalpoints_original = Point(complex_5)
multiplication_3 = Multiplication(A=finiteelement_2, B="0.7")
multiplication_4 = Multiplication(A=finiteelement_2, B="0.1")

shift = ShiftList(List=totalpoints_original, Shift="-1", Wrap=False)  # -> simplify(List)
tstat = TreeStatistics(Tree=shift)  # -> Paths, Length, Count
lng_2 = ListLength(List=tstat.Paths)
series = Series(Start="1", Step=1, Count=lng_2)
shift_2 = ShiftList(List=tstat.Paths, Shift=series, Wrap=True)  # -> simplify(List)
shift_3 = ShiftList(List=shift_2, Shift="-1", Wrap=False)  # -> simplify(List)
bang_3 = ExplodeTree(Data=shift_3)  # -> Branch0, Branch1, Branch2, Branch3
branch = TreeBranch(Tree=shift, Path=bang_3.Branch0, MaintainPaths=True)
branch_2 = TreeBranch(Tree=shift, Path=bang_3.Branch1, MaintainPaths=True)
branch_3 = TreeBranch(Tree=shift, Path=bang_3.Branch2, MaintainPaths=True)
branch_4 = TreeBranch(Tree=shift, Path=bang_3.Branch3, MaintainPaths=True)
entwine = Entwine(Branch00=branch, Branch01=branch_2, Branch02=branch_3, Branch03=branch_4, FlattenInputs=True)  # -> simplify(Result)
lng_3 = ListLength(List=shift)
lng_4 = ListLength(List=entwine)
multiplication_5 = Multiplication(A=lng_3, B=lng_4)
repeat_2 = RepeatData(Data=entwine, Length=multiplication_5)
graft = GraftTree(Tree=shift, IncludeEmptyLists=True, IncludeNullItems=True)
partition_2 = PartitionList(List=repeat_2, Size=lng_4)  # -> simplify(Chunks)
vec2pt_2 = Vector2Pt(PointA=graft, PointB=partition_2, Unitize=False)  # -> Vector, Length
vdis = VectorDisplay(Anchor=graft, Vector=vec2pt_2.Vector)

division_7 = Division(A=multiplication_3, B=Slider(21.271, range=0..100))
neg = Negative(Value=division_7)
dom_2 = ConstructDomain(DomainStart=multiplication_4, DomainEnd=multiplication_3)
panel_10 = Panel("""0.3
0.4
0
0.3""")
number_slider = Slider(4, range=0..10)  # disabled
dom_3 = ConstructDomain(DomainStart="2", DomainEnd="12")
dom_4 = ConstructDomain(DomainStart=neg, DomainEnd=division_7)
panel_11 = Panel(merge_3)
stonesizerock_domain = Domain(dom_4)
treecountdomain = Domain(dom_3)
treecountseed = Number(Slider(16.36, range=0..100))
vectorjitter = Number(Slider(17.182, range=0..100))
vectorseed_2 = Number(Slider(39.96, range=0..100))
countweight = Number(panel_10)
circlesize_domain = Domain(dom_2)
stonesizerockseed = Number(Slider(17.693, range=0..100))
circlesizeseed = Number(Slider(45.491, range=0..100))

dedomain = DeconstructDomain(Domain=treecountdomain)  # -> Start, End
subtraction_5 = Subtraction(A=dedomain.End, B=dedomain.Start)
treecountseed_2 = Number(treecountseed)
range = Range(Domain=treecountdomain, Steps=subtraction_5)
jitter = Jitter(List=range, Jitter=1, Seed=treecountseed_2)  # -> Values, Indices
countweight_2 = Number(countweight)
item_3 = ListItem(List=jitter.Values, Index=0, Wrap=True)
stonestepcount = Integer(item_3)
multiplication_6 = Multiplication(A=stonestepcount, B=countweight_2)
int_2 = Integer(multiplication_6)
ma_4 = MassAddition(Input=int_2)  # -> Result, PartialResults
item_4 = ListItem(List=int_2, Index="-1", Wrap=True)
subtraction_6 = Subtraction(A=stonestepcount, B=ma_4.Result)
addition_4 = Addition(A=subtraction_6, B=item_4)
replace = ReplaceItems(List=int_2, Item=addition_4, Indices="-1", Wrap=True)
dividetreecount = Integer(simplify(graft(replace)))

remap = RemapNumbers(Value=[Slider(0, range=0..1), Slider(0.078, range=0..1)], Source=Domain(0, 1), Target=Domain(0, 6.283185307))  # -> graft(Mapped), Clipped
bang_4 = ExplodeTree(Data=simplify(remap.Mapped))  # -> Branch0, Branch1
dom_5 = ConstructDomain(DomainStart=bang_4.Branch0, DomainEnd=bang_4.Branch1)
vectorangledomain = Domain(dom_5)

deg = Degrees(Radians=remap.Mapped)
panel_12 = Panel(deg)
panel_13 = Panel("""石块的半径在一个值域中
石块总体的趋势用权重控制，但变小的时候伴随晃动""")
sidefirstpoint = Point(graft)
vec = Vector(vec2pt_2.Vector)
flatten = FlattenTree(Tree=vec, Path="{0}")
angle = Angle(VectorA=graft(vec2pt.Vector), VectorB=flatten)  # -> simplify(Angle), Reflex
vectorlength = Number(vec2pt_2.Length)
genes_2 = GenePool(Decimals=2, Maximum=16, Minimum=0, Value=[2.35, 13.65])
stonestepcount_2 = Integer(stonestepcount)

stonesize_domain = Domain(circlesize_domain)
circlesizeseed_2 = Number(circlesizeseed)
stonesizerock_domain_2 = Domain(stonesizerock_domain)
stonesizerockseed_2 = Number(stonesizerockseed)
chasestepcount = Integer(stonestepcount_2)
random_3 = Random(Range=stonesize_domain, Number=chasestepcount, Seed=circlesizeseed_2)
sort = SortList(Keys=random_3)  # -> Keys, ValuesA
random_4 = Random(Range=stonesizerock_domain_2, Number=chasestepcount, Seed=stonesizerockseed_2)
rev = ReverseList(List=sort.Keys)
addition_5 = Addition(A=rev, B=random_4)
circlesize = Number(addition_5)

tstat_2 = TreeStatistics(Tree=sidefirstpoint)  # -> Paths, Length, Count
int_3 = Integer(genes_2)
item_5 = ListItem(List=tstat_2.Paths, Index=int_3, Wrap=True)
multiplication_7 = Multiplication(A=finiteelement_2, B="2")
multiplication_8 = Multiplication(A=finiteelement_2, B="0.1")
panel_14 = Panel(dom_5)
vectorjitter_2 = Number(vectorjitter)
vectorseed_3 = Number(vectorseed_2)
branch_5 = TreeBranch(Tree=sidefirstpoint, Path=item_5, MaintainPaths=True)
dom_6 = ConstructDomain(DomainStart=multiplication_8, DomainEnd=multiplication_7)
chaselengthseed = Number(Slider(15.524, range=0..100))
bang_5 = ExplodeTree(Data=branch_5)  # -> Branch0, Branch1
series_2 = Series(Start=0, Step=1, Count=stonestepcount_2)
random_5 = Random(Range=dom_6, Number=stonestepcount_2, Seed=chaselengthseed)
panel_15 = Panel(random_5)
vec2pt_3 = Vector2Pt(PointA=bang_5.Branch0, PointB=bang_5.Branch1, Unitize=False)  # -> Vector, Length

finite_vector = Vector(vec2pt_3.Vector)
vectorangledomain_2 = Domain(vectorangledomain)
angle_2 = Angle(VectorA=flatten(finite_vector), VectorB=vec)  # -> Angle, Reflex
inc = Includes(Value=angle_2.Angle, Domain=vectorangledomain_2)  # -> Includes, Deviation
sift = SiftPattern(List=vec, SiftPattern=inc.Includes)  # -> Output0, simplify(Output1)
clean = CleanTree(RemoveNulls=True, RemoveInvalid=True, RemoveEmpty=False, Tree=sift.Output1)
filteredvector = Vector(clean)

vectorangledomain_3 = Domain(vectorangledomain)
angle_3 = Angle(VectorA=flatten(finite_vector), VectorB=vec)  # -> Angle, Reflex
inc_2 = Includes(Value=angle.Angle, Domain=vectorangledomain_3)  # -> Includes, Deviation
sift_2 = SiftPattern(List=flatten, SiftPattern=inc_2.Includes)  # -> Output0, simplify(Output1)
clean_2 = CleanTree(RemoveNulls=True, RemoveInvalid=True, RemoveEmpty=False, Tree=sift_2.Output1)
filteredvector_2 = Vector(clean_2)

lng_5 = ListLength(List=filteredvector_2)
tstat_3 = TreeStatistics(Tree=lng_5)  # -> Paths, Length, Count
series_3 = Series(Start=0, Step=1, Count=lng_5)
random_6 = Random(Range="100", Number=tstat_3.Count, Seed=vectorseed)
jitter_2 = Jitter(List=series_3, Jitter=1, Seed=graft(random_6))  # -> simplify(Values), Indices
item_6 = ListItem(List=jitter_2.Values, Index=0, Wrap=True)
item_7 = ListItem(List=filteredvector_2, Index=item_6, Wrap=False)  # -> Item, Item1
amp_3 = Amplitude(Vector=item_7.Item, Amplitude=ma_3.PartialResults)
addition_6 = Addition(A=graft(firstpoint), B=amp_3)  # -> simplify(Result)
panel_16 = Panel(item_7.Item)
pl = ConstructPlane(Origin=addition_6, XAxis=Vector(1, 0, 0), YAxis=Vector(0, 1, 0))
align = AlignPlane(Plane=pl, Direction=item_7.Item1)  # -> Plane, Angle
rectangle = Rectangle(Plane=align.Plane, XSize=Domain(-1, 1), YSize=Domain(-2, 2), Radius=Slider(1.429, range=0..10))  # -> Rectangle, Length
unit = UnitVector(Vector=filteredvector)
flatten_2 = FlattenTree(Tree=unit, Path="{0}")
jitter_3 = Jitter(List=flatten_2, Jitter=vectorjitter_2, Seed=vectorseed_3)  # -> Values, Indices
item_8 = ListItem(List=jitter_3.Values, Index=series_2, Wrap=True)
vdis_2 = VectorDisplay(Anchor=bang_5.Branch0, Vector=vec2pt_3.Vector)
finite_vector_2 = Vector(vec2pt_3.Vector)

vlen = VectorLength(Vector=finite_vector_2)
division_8 = Division(A=vlen, B=stonestepcount_2)
stack_3 = StackData(Data=division_8, Stack=stonestepcount_2)

multiplication_9 = Multiplication(A=division_8, B="2")
dom_7 = ConstructDomain(DomainStart=division_8, DomainEnd=multiplication_9)
random_7 = Random(Range=dom_7, Number=stonestepcount_2, Seed=chaselengthseed)
panel_17 = Panel(random_7)
firstpointvector = Point(bang_5.Branch0)
chasevectorunitize = Vector(item_8)
chaselength = Number(stack_3)
chaselength_2 = Number(random_5)

chasevectorunitize_2 = Vector(chasevectorunitize)
chaselength_3 = Number(chaselength_2)
amp_4 = Amplitude(Vector=chasevectorunitize_2, Amplitude=chaselength_3)
chasevector = Vector(amp_4)
ma_5 = MassAddition(Input=chasevector)  # -> Result, PartialResults
addition_7 = Addition(A=firstpointvector, B=ma_5.PartialResults)

anglerockdomain = Domain(vectorangledomain)
panel_18 = Panel(circlesize)
inc_3 = Includes(Value=ma_5.PartialResults, Domain=anglerockdomain)  # -> Includes, Deviation
finallypoints = Point(addition_7)

addition_8 = Addition(A=basicpoint_2, B=finallypoints)
pl_2 = ConstructPlane(Origin=addition_8, XAxis=Vector(1, 0, 0), YAxis=Vector(0, 1, 0))
cir = Circle(Plane=pl_2, Radius=circlesize)

Y = UnitY(Factor=1)
align_2 = AlignPlane(Plane=pl_2, Direction=Y)  # -> Plane, Angle
rectangle_2 = Rectangle(Plane=align_2.Plane, XSize=Domain(-1, 1), YSize=Domain(-2, 2), Radius=Slider(1, range=0..10))  # -> Rectangle, Length
