# Grasshopper definition 160921_tim_haystack_commit.gh (Grasshopper 0.9.76)

md_slider = MDSlider(
    slider_value=Point(0.5775609831, 0.6897561608, 0.5),
    SliderMode=0,
    x_domain=Domain(-100, 100),
    y_domain=Domain(-100, 100),
    z_domain=Domain(0, 1))
basicpoint = Point(md_slider)

genes = GenePool(Decimals=6, Maximum=50, Minimum=0, Value=[15.690291, 16.87488])

complex = ComplexComponents(Complex=basicpoint)  # -> Real, Imaginary

finiteelement = Integer(Slider(3, range=0..10))
localsize = Number(genes)

complex_2 = CreateComplex(Real=complex.Real, Imaginary=complex.Imaginary)
basicpoint_2 = Point(complex_2)
localsize_2 = Number(localsize)
repeat = RepeatData(Data=localsize_2, Length="4")

panel = Panel(repeat)
panel_2 = Panel("""0
1
2
3""")

int = Integer(panel_2)
num = Number(panel)

item = ListItem(List=num, Index="0", Wrap=True)  # -> Item, Item1
finiteelement_2 = Integer(finiteelement)
division = Division(A=item.Item, B=finiteelement_2)
round = Round(Number=division)  # -> Nearest, Floor, Ceiling
merge = Merge(Data1=round.Floor, Data2=round.Ceiling)
subtraction = Subtraction(A=division, B=round.Floor)
subtraction_2 = Subtraction(A=division, B=merge)
multiplication = Multiplication(A=finiteelement_2, B=subtraction_2)
division_2 = Division(A=multiplication, B=merge)
addition = Addition(A=finiteelement_2, B=division_2)  # -> simplify(graft(Result))
larger = LargerThan(FirstNumber=subtraction, SecondNumber="0.5")  # -> LargerThan, OrEqualTo
bang = ExplodeTree(Data=addition)  # -> Branch0, Branch1
filter = StreamFilter(Gate=larger.OrEqualTo, Stream0=bang.Branch0, Stream1=bang.Branch1)  # -> flatten(Stream)
heightfiniteelement = Number(filter)
division_3 = Division(A=item.Item1, B=heightfiniteelement)
round_2 = Round(Number=division_3)  # -> Nearest, Floor, Ceiling
merge_2 = Merge(Data1=round_2.Floor, Data2=round_2.Ceiling)
subtraction_3 = Subtraction(A=division_3, B=merge_2)
subtraction_4 = Subtraction(A=division_3, B=round_2.Floor)
multiplication_2 = Multiplication(A=heightfiniteelement, B=subtraction_3)
division_4 = Division(A=multiplication_2, B=merge_2)
addition_2 = Addition(A=heightfiniteelement, B=division_4)  # -> simplify(graft(Result))
larger_2 = LargerThan(FirstNumber=subtraction_4, SecondNumber="0.5")  # -> LargerThan, OrEqualTo
bang_2 = ExplodeTree(Data=addition_2)  # -> Branch0, Branch1
filter_2 = StreamFilter(Gate=larger_2.OrEqualTo, Stream0=bang_2.Branch0, Stream1=bang_2.Branch1)  # -> flatten(Stream)
merge_3 = Merge(Data1=filter, Data2=filter_2, Data3=filter, Data4=filter_2)

finallyelement = Number(merge_3)
item_2 = ListItem(
    List=[{imaginary=0, real=1}, {imaginary=1, real=0}, {imaginary=0, real=-1}, {imaginary=-1, real=0}],
    Index=int,
    Wrap=False)
panel_3 = Panel(item_2)
division_5 = Division(A=num, B=finallyelement)
amp = Amplitude(Vector=item_2, Amplitude=finallyelement)
amp_2 = Amplitude(Vector=item_2, Amplitude=num)
stack = StackData(Data=amp, Stack=division_5)
ma = MassAddition(Input=amp_2)  # -> Result, PartialResults
addition_3 = Addition(A=basicpoint_2, B=ma.PartialResults)
pline = PolyLine(Vertices=addition_3, Closed=True)
panel_4 = Panel(division_5)
ma_2 = MassAddition(Input=stack)  # -> Result, PartialResults
complex_3 = ComplexComponents(Complex=ma.PartialResults)  # -> Real, Imaginary
partition = PartitionList(List=ma_2.PartialResults, Size=division_5)  # -> simplify(Chunks)
concat = Concatenate(FragmentA=complex_3.Real, FragmentB=complex_3.Imaginary, JoinSeparator=",")
complex_4 = ComplexComponents(Complex=partition)  # -> Real, Imaginary
concat_2 = Concatenate(FragmentA=concat, FragmentB=int, JoinSeparator=";")
complex_5 = CreateComplex(Real=complex_4.Real, Imaginary=complex_4.Imaginary)
panel_5 = Panel(concat_2)

totalpoints_original = Point(complex_5)
shift = ShiftList(List=totalpoints_original, Shift="-1", Wrap=False)  # -> simplify(List)
tstat = TreeStatistics(Tree=shift)  # -> Paths, Length, Count
shift_2 = ShiftList(List=tstat.Paths, Shift=1, Wrap=True)
item_3 = ListItem(List=shift_2, Index=0, Wrap=True)  # -> Item, Item1, Item2, Item3
branch = TreeBranch(Tree=shift, Path=item_3.Item, MaintainPaths=True)
branch_2 = TreeBranch(Tree=shift, Path=item_3.Item1, MaintainPaths=True)
branch_3 = TreeBranch(Tree=shift, Path=item_3.Item2, MaintainPaths=True)
branch_4 = TreeBranch(Tree=shift, Path=item_3.Item3, MaintainPaths=True)
entwine = Entwine(Branch00=branch, Branch01=branch_2, Branch02=branch_3, Branch03=branch_4, FlattenInputs=True)  # -> simplify(Result)
lng = ListLength(List=shift)
lng_2 = ListLength(List=entwine)
multiplication_3 = Multiplication(A=lng, B=lng_2)
repeat_2 = RepeatData(Data=entwine, Length=multiplication_3)
partition_2 = PartitionList(List=repeat_2, Size=lng_2)  # -> simplify(Chunks)
graft = GraftTree(Tree=shift, IncludeEmptyLists=True, IncludeNullItems=True)
pshift = ShiftPaths(Data=graft, Offset=-1)
vec2pt = Vector2Pt(PointA=graft, PointB=partition_2, Unitize=False)  # -> Vector, Length
stack_2 = StackData(Data=pshift, Stack=lng_2)
pshift_2 = ShiftPaths(Data=vec2pt.Vector, Offset=-1)
pshift_3 = ShiftPaths(Data=vec2pt.Length, Offset=-1)
sidefirstpoint = Point(stack_2)
vectorlength = Number(pshift_3)
vec = Vector(pshift_2)

multiplication_4 = Multiplication(A=finiteelement_2, B="0.7")
multiplication_5 = Multiplication(A=finiteelement_2, B="0.1")
panel_6 = Panel("""0.3
0.4
0
0.3""")
dom = ConstructDomain(DomainStart="0.3", DomainEnd="0.9")
dom_2 = ConstructDomain(DomainStart=multiplication_5, DomainEnd=multiplication_4)
dom_3 = ConstructDomain(DomainStart="2", DomainEnd="12")

panel_7 = Panel(merge_3)

treecountdomain = Domain(dom_3)
minilinecount = Integer(Slider(5, range=0..10))
reduceseed = Number(Slider(45.55, range=0..100))
ptonlineposition_domain = Domain(dom)
ptonlinepositionseed = Number(Slider(72.83, range=0..100))
circlesizeseed = Number(Slider(56.629, range=0..100))
circlesize_domain = Domain(dom_2)
treecountseed = Number(Slider(35.58, range=0..100))
countweight = Number(panel_6)

number_slider = Slider(1, range=0..3)
tstat_2 = TreeStatistics(Tree=pshift_3)  # -> Paths, Length, Count
item_4 = ListItem(List=tstat_2.Paths, Index=number_slider, Wrap=False)
branch_5 = TreeBranch(Tree=pshift_3, Path=item_4, MaintainPaths=True)
branch_6 = TreeBranch(Tree=pshift_3, Path=item_4, MaintainPaths=True)
gate = StreamGate(Stream=branch_5, Gate=number_slider)  # -> Target0, Target1, Target2, Target3
entwine_2 = Entwine(Branch00=gate.Target0, Branch01=gate.Target1, Branch02=gate.Target2, Branch03=gate.Target3, FlattenInputs=True)  # -> simplify(Result)

dedomain = DeconstructDomain(Domain=treecountdomain)  # -> Start, End
subtraction_5 = Subtraction(A=dedomain.End, B=dedomain.Start)
treecountseed_2 = Number(treecountseed)
range = Range(Domain=treecountdomain, Steps=subtraction_5)
jitter = Jitter(List=range, Jitter=1, Seed=treecountseed_2)  # -> Values, Indices
countweight_2 = Number(countweight)
item_5 = ListItem(List=jitter.Values, Index=0, Wrap=True)
treecount = Integer(item_5)
multiplication_6 = Multiplication(A=treecount, B=countweight_2)
int_2 = Integer(multiplication_6)
ma_3 = MassAddition(Input=int_2)  # -> Result, PartialResults
item_6 = ListItem(List=int_2, Index="-1", Wrap=True)
subtraction_6 = Subtraction(A=treecount, B=ma_3.Result)
addition_4 = Addition(A=subtraction_6, B=item_6)
replace = ReplaceItems(List=int_2, Item=addition_4, Indices="-1", Wrap=True)
dividetreecount = Integer(simplify(graft(replace)))

subtraction_7 = Subtraction(A=minilinecount, B=dividetreecount)
reduceseed_2 = Number(reduceseed)

minilinecount_2 = Integer(minilinecount)
sort = SortList(Keys=pshift_3)  # -> Keys, ValuesA
series = Series(Start=0, Step=1, Count=minilinecount_2)
item_7 = ListItem(List=sort.Keys, Index=series, Wrap=False)
pshift_4 = ShiftPaths(Data=item_7, Offset="1")  # -> simplify(Data)
mindex = MemberIndex(Set=vectorlength, Member=pshift_4)  # -> Index, Count
pshift_5 = ShiftPaths(Data=mindex.Index, Offset=-1)
reduce = RandomReduce(List=pshift_5, Reduction=subtraction_7, Seed=reduceseed_2)

finallyvectorindex = Integer(reduce)
item_8 = ListItem(List=sidefirstpoint, Index=finallyvectorindex, Wrap=False)
item_9 = ListItem(List=vec, Index=finallyvectorindex, Wrap=False)

lng_3 = ListLength(List=reduce)  # -> flatten(Length)
circlesize_domain_2 = Domain(circlesize_domain)
circlesizeseed_2 = Number(circlesizeseed)
ma_4 = MassAddition(Input=lng_3)  # -> Result, PartialResults
random = Random(Range=circlesize_domain_2, Number=ma_4.Result, Seed=circlesizeseed_2)
partition_3 = PartitionList(List=random, Size=lng_3)  # -> simplify(Chunks)

ptonlineposition_domain_2 = Domain(ptonlineposition_domain)
ptonlinepositionseed_2 = Number(ptonlinepositionseed)
random_2 = Random(Range=ptonlineposition_domain_2, Number=ma_4.Result, Seed=ptonlinepositionseed_2)
partition_4 = PartitionList(List=random_2, Size=lng_3)  # -> simplify(Chunks)
multiplication_7 = Multiplication(A=item_9, B=partition_4)
addition_5 = Addition(A=item_8, B=multiplication_7)
clean = CleanTree(RemoveNulls=True, RemoveInvalid=True, RemoveEmpty=False, Tree=addition_5)

addition_6 = Addition(A=basicpoint_2, B=clean)
pl = ConstructPlane(Origin=addition_6, XAxis=Vector(1, 0, 0), YAxis=Vector(0, 1, 0))
cir = Circle(Plane=pl, Radius=partition_3)
panel_8 = Panel(partition_4)
panel_9 = Panel(lng_3)
panel_10 = Panel(ma_4.Result)
panel_11 = Panel(partition_3)

shift_3 = ShiftList(List=complex_5, Shift="-1", Wrap=False)  # -> simplify(List)

tstat_3 = TreeStatistics(Tree=shift_3)  # -> Paths, Length, Count
lng_4 = ListLength(List=tstat_3.Paths)
subtraction_8 = Subtraction(A=lng_4, B="1")
series_2 = Series(Start="1", Step=1, Count=subtraction_8)
shift_4 = ShiftList(List=tstat_3.Paths, Shift=series_2, Wrap=False)  # -> simplify(List)
bang_3 = ExplodeTree(Data=shift_4)  # -> Branch0, Branch1, Branch2
branch_7 = TreeBranch(Tree=shift_3, Path=bang_3.Branch0, MaintainPaths=True)
branch_8 = TreeBranch(Tree=shift_3, Path=bang_3.Branch1, MaintainPaths=True)
branch_9 = TreeBranch(Tree=shift_3, Path=bang_3.Branch2, MaintainPaths=True)
entwine_3 = Entwine(Branch00=branch_7, Branch01=branch_8, Branch02=branch_9, FlattenInputs=True)  # -> simplify(Result)

shift_5 = ShiftList(List=tstat_3.Paths, Shift="-1", Wrap=False)  # -> simplify(List)
branch_10 = TreeBranch(Tree=shift_3, Path=shift_5, MaintainPaths=True)
graft_2 = GraftTree(Tree=branch_10, IncludeEmptyLists=True, IncludeNullItems=True)
lng_5 = ListLength(List=branch_10)
lng_6 = ListLength(List=entwine_3)
multiplication_8 = Multiplication(A=lng_5, B=lng_6)
repeat_3 = RepeatData(Data=entwine_3, Length=multiplication_8)
partition_5 = PartitionList(List=repeat_3, Size=lng_6)  # -> simplify(Chunks)

# ----
# 重复排列点的做法
tstat_4 = TreeStatistics(Tree=shift_3)  # -> Paths, Length, Count
bang_4 = ExplodeTree(Data=shift_3)  # -> Branch0, Branch1, Branch2, Branch3
viewer = ParamViewer(bang_4.Branch0)
panel_12 = Panel(tstat_4.Paths)
equals = Equality(FirstNumber=bang_4.Branch0)  # -> Equality, Inequality

vec2pt_2 = Vector2Pt(PointA=graft_2, PointB=partition_5, Unitize=False)  # -> Vector, Length

threesidepoints = Point(graft_2)
vetor = Vector(vec2pt_2.Vector)
vectorlength_2 = Number(vec2pt_2.Length)

# ----
# 先忽略了前面描述矩形的四个向量编号
lng_7 = ListLength(List=vetor)
ma_5 = MassAddition(Input=flatten(lng_7))  # -> Result, PartialResults
series_3 = Series(Start="0", Step=1, Count=ma_5.Result)
complex_6 = ComplexComponents(Complex=threesidepoints)  # -> Real, Imaginary
partition_6 = PartitionList(List=series_3, Size=flatten(lng_7))  # -> simplify(Chunks)
concat_3 = Concatenate(FragmentA=complex_6.Real, FragmentB=complex_6.Imaginary, JoinSeparator=",")
int_3 = Integer(partition_6)
concat_4 = Concatenate(FragmentA=concat_3, FragmentB=int_3, JoinSeparator=";")
