# Grasshopper definition 160921_tim_stairs_commit.gh (Grasshopper 0.9.76)

location = MDSlider(
    slider_value=Point(0.2972769939, 0.6519235464, 0.5),
    SliderMode=0,
    x_domain=Domain(-10000, 10000),
    y_domain=Domain(-10000, 10000),
    z_domain=Domain(0, 1))
建筑类型_规范 = Slider(0, range=0..2)
rotate = Slider(0.32, range=0..1)
genes = GenePool(Decimals=2, Maximum=3900, Minimum=300, Value=[2828.57, 1861.62])
踏步深 = Slider(245, range=200..350)
梯段厚 = Slider(227, range=150..400)
梯段宽 = Slider(3376.53, range=800..5000)
间距 = Slider(732, range=0..1000)
平台宽度 = Slider(2921, range=1000..5000)
平台厚度 = Slider(144.76, range=100..150)
梁的宽度 = Slider(186.81, range=100..350)
梁高 = Slider(447.87, range=300..550)

panel = Panel("""住宅楼梯(踏面=T,阶高=R)
550<=T+2R<=650
180<=T<=360,120<=R<=210
推荐倾斜度<=7/11
基本倾斜度<=6/7
不得已的情况下倾斜<=22/21,T>=195 T+2R=650

集合住宅、公用部分的公用楼梯
550<=T+2R<=650
推荐尺寸 T>=300,R<=160
基本倾斜度<=7/11,不得已的情况下T>=240

集合住宅、公用部分的室外楼梯
550<=T+2R<=650
推荐尺寸 T>=300,R<=160
不得已的情况下T>=240,550<=T+2R<=650""")

panel_2 = Panel("""160,360;120,210
300,600;0,160
300,600;0,160""")
split = TextSplit(Text=panel_2, Separators=";")
split_2 = TextSplit(Text=split, Separators=",")  # -> simplify(Result)
item = ListItem(List=split_2, Index=0, Wrap=True)  # -> Item, Item1
dom = ConstructDomain(DomainStart=item.Item, DomainEnd=item.Item1)
pshift = ShiftPaths(Data=dom, Offset=-1)
tstat = TreeStatistics(Tree=pshift)  # -> Paths, Length, Count
item_2 = ListItem(List=tstat.Paths, Index=建筑类型_规范, Wrap=False)
branch = TreeBranch(Tree=pshift, Path=item_2, MaintainPaths=True)
dispatch = Dispatch(List=branch, DispatchPattern=[True, False])  # -> ListA, ListB
width_domain = Domain(dispatch.ListA)
height_domain = Domain(dispatch.ListB)

remap = RemapNumbers(Value=rotate, Source=Domain(0, 1), Target=Domain(0, 6.283185307))  # -> Mapped, Clipped
prot = RotatePlane(Plane=location, Angle=remap.Mapped)
dispatch_2 = Dispatch(List=genes, DispatchPattern=[True, False])  # -> ListA, ListB

stairthickness = Number(梯段厚)
stairheight = Number(dispatch_2.ListB)
stairdistance = Number(间距)
stairlength = Number(梯段宽)
beamwidth = Number(梁的宽度)
platformwidth = Number(平台宽度)
beamheight = Number(梁高)
platformthickness = Number(平台厚度)
stairwidth = Number(dispatch_2.ListA)
stepwidth = Number(踏步深)

division = Division(A=stairwidth, B=stepwidth)
subtraction = Subtraction(A=platformwidth, B=beamwidth)
addition = Addition(A=platformthickness, B=beamheight)
addition_2 = Addition(A="0", B=platformthickness)
multiplication = Multiplication(A=stairlength, B="2")
neg = Negative(Value=addition)
neg_2 = Negative(Value=addition_2)
series = Series(Start=subtraction, Step=beamwidth, Count=2)
addition_3 = Addition(A=stairdistance, B=multiplication)
series_2 = Series(Start=0, Step=beamwidth, Count=2)
merge = Merge(Data1="0", Data2=neg, Data3=neg_2, Data4=neg)
rev = ReverseList(List=series)
stack = StackData(Data=merge, Stack="2")
ins = InsertItems(List=series_2, Item=rev, Indices="1", Wrap=True)
stack_2 = StackData(Data=ins, Stack="2")
shift = ShiftList(List=stack_2, Shift="1", Wrap=True)

stepcount = Integer(division)
platform_v = Number(stairlength)

division_2 = Division(A=stairheight, B=stepcount)
neg_3 = Negative(Value=platform_v)

stepwidth_2 = Number(stepwidth)
stepheight = Number(division_2)
inc = Includes(Value=stepwidth_2, Domain=width_domain)  # -> Includes, Deviation
inc_2 = Includes(Value=stepheight, Domain=height_domain)  # -> Includes, Deviation
and = GateAnd(A=inc.Includes, B=inc_2.Includes)

gate = StreamGate(Stream=prot, Gate=and)  # -> Target0, Target1

basicplane = Plane(gate.Target1)

stepheight_2 = Number(division_2)

series_3 = Series(Start=0, Step=stepwidth, Count=division)
series_4 = Series(Start=0, Step=division_2, Count=stepcount)
division_3 = Division(A=stepheight_2, B=stepwidth)
stack_3 = StackData(Data=series_3, Stack="2")
stack_4 = StackData(Data=series_4, Stack="2")
item_3 = ListItem(List=series_4, Index="-1", Wrap=True)
atan = ArcTangent(Value=division_3)
cos = Cosine(Value=atan)
ins_2 = InsertItems(List=stack_3, Item="0", Indices="1", Wrap=True)
shift_2 = ShiftList(List=stack_4, Shift="1", Wrap=False)
division_4 = Division(A=stairthickness, B=cos)
subtraction_2 = Subtraction(A=item_3, B=division_4)
neg_4 = Negative(Value=division_4)
merge_2 = Merge(Data1=flatten(neg_4), Data2=flatten(subtraction_2))
shift_3 = ShiftList(List=ins_2, Shift="1", Wrap=False)
panel_3 = Panel("""0
-1""")
item_4 = ListItem(List=series_4, Index="-1", Wrap=True)
ins_3 = InsertItems(List=shift_2, Item=merge_2, Indices=panel_3, Wrap=True)
item_5 = ListItem(List=series_3, Index="-1", Wrap=True)
addition_4 = Addition(A=item_4, B=stepheight_2)
rev_2 = ReverseList(List=ins_3)
addition_5 = Addition(A=rev_2, B=addition_4)

platform_u = Number(item_5)
platform_w = Number(addition_4)

addition_6 = Addition(A=platform_w, B=stack)
addition_7 = Addition(A=platform_u, B=shift)

pt = PointOriented(BasePlane=basicplane, UComponent=flatten(ins_2), VComponent=flatten(0), WComponent=flatten(ins_3))
pt_2 = PointOriented(BasePlane=basicplane, UComponent=addition_7, VComponent=neg_3, WComponent=addition_6)
pt_3 = PointOriented(BasePlane=basicplane, UComponent=flatten(shift_3), VComponent=flatten(stairdistance), WComponent=flatten(addition_5))
pline = PolyLine(Vertices=pt_2, Closed=True)
pline_2 = PolyLine(Vertices=pt_3, Closed=True)
pline_3 = PolyLine(Vertices=pt, Closed=True)
deplane = DeconstructPlane(Plane=basicplane)  # -> Origin, XAxis, YAxis, ZAxis
deplane_2 = DeconstructPlane(Plane=prot)  # -> Origin, XAxis, YAxis, ZAxis
neg_5 = Negative(Value=stairlength)
boundary = BoundarySurfaces(Edges=pline)
boundary_2 = BoundarySurfaces(Edges=[pline_3, pline_2])
amp = Amplitude(Vector=deplane.YAxis, Amplitude=addition_3)
amp_2 = Amplitude(Vector=deplane_2.YAxis, Amplitude=[neg_5, stairlength])
extr = Extrude(Base=boundary_2, Direction=amp_2)
extr_2 = Extrude(Base=boundary, Direction=amp)
