# Grasshopper definition 20161113_tim_graphics_fillArea_scanLine_003.gh (Grasshopper 0.9.76)

# log:区域填充算法
# 20161110:
# 向量几何公式的gh实现
# 向量乘积：点积，差积，行列式
# 向量需要用时候再学习
# 
# 扫描线填色算法gh实现:
# n,x_array,y_array的形式给出多边形
# 扫描线给定有限元finite_distance从上而下求交点
# 左右顶点处理（考虑是否有限元法不会有此问题）
# 左:y1<y2<y3 y2-y1>0,y2-y3<0
# 右:y1>y2>y3 y2-y1<0,y2-y3>0
# 20161113:
# 写活性表的伪代码，想清楚了连电池:
# 0;m0_y与相交值域的比较
# 1;值域和对应线段的映射关系
# 2;左右顶点处理坐标bug修正,书中给出的左右顶点有谬误
# 3;整理应映射标签运算程序段
# 求交点的问题:
# 1;计算数列起始坐标的标签运算:
# 1;0初始坐标调用现有的数据，用top_y以及对应的top_x
# 1;1减少数据结构间的无意义映射
# 2;每段line上scanLine的数量，不要重复计算，并行计算
# 3；对y进行top排序的时候，对应的x的值
# 4；修复因为修正顶点而产生的交点错误
# 5；整理交点部分程序
# 对偶数个数的点序进行连线:
# 1;组织对应的树形数据
# 扫描线有限元范围问题
panel = Panel("""{7.656903, 14.500688, 0.0}
{6.429437, -1.86552, 0.0}
{2.065114, -5.411532, 0.0}
{-5.367872, 0.521218, 0.0}
{1.724152, 5.294696, 0.0}
{-2.435593, 5.840236, 0.0}
{-1.753668, 10.136366, 0.0}""")
panel_2 = Panel("""{32.045762, 15.39429, 0.0}
{30.049266, -1.959868, 0.0}
{23.752625, -5.0314, 0.0}
{17.763138, -0.116948, 0.0}
{25.902698, 2.801007, 0.0}
{22.984742, 5.718963, 0.0}
{20.988246, 2.954584, 0.0}
{19.45248, 4.643927, 0.0}
{22.831166, 8.944072, 0.0}
{19.606057, 10.172685, 0.0}
{20.681093, 14.779983, 0.0}
{25.902698, 10.326261, 0.0}
{29.43496, 11.708451, 0.0}
{26.209851, 13.858523, 0.0}""")
panel_3 = Panel("""{7.637584, 15.346381, 0.0}
{9.723192, 10.523412, 0.0}
{7.767934, -3.684795, 0.0}
{-0.8352, 0.095371, 0.0}
{-3.963612, -6.291805, 0.0}
{-5.397468, 7.395, 0.0}
{-0.313798, 15.346381, 0.0}
{2.423563, 12.869721, 0.0}
{2.293213, 3.745185, 0.0}""")
txt = Text(panel_3)
complex = ComplexComponents(Complex=txt)  # -> Real, Imaginary
lng = ListLength(List=txt)
finite_distance = Number(Slider(1, range=0..1))
n = Integer(lng)
x_array = Number(complex.Real)
y_array = Number(complex.Imaginary)
sort = SortList(Keys=y_array)  # -> Keys, ValuesA
shift = ShiftList(List=y_array, Shift=[-1, 1], Wrap=True)
x2_original = Number(x_array)
y2_original = Number(y_array)
number = Number(shift)  # "y1,y3"
item = ListItem(List=sort.Keys, Index="-1", Wrap=True)  # -> Item, Item1
subtraction = Subtraction(A=y2_original, B=number)
subtraction_2 = Subtraction(A=item.Item, B=item.Item1)
division = Division(A=subtraction_2, B=finite_distance)
int = Integer(division)
larger = LargerThan(FirstNumber=subtraction, SecondNumber="0")  # -> LargerThan, OrEqualTo
neg = Negative(Value=finite_distance)
addition = Addition(A=int, B=2)
int_2 = Integer(larger.LargerThan)

# ----
# 左右顶点处理
# left:   y2-y1>0,y2-y3<0 -->10-->-1
# right: y2-y1<0,y2-y3>0 -->01-->1
# down y2-y1<0,y2-y3<0-->00--> 0
# up    y2-y1>0,y2-y3>0-->11--> 0
panel_4 = Panel("""-1
1
0
0""")

# ----
# 左右顶点处理
# left:   y2-y1>0,y2-y3<0 -->10-->1
# right: y2-y1<0,y2-y3>0 -->01-->-1
# down y2-y1<0,y2-y3<0-->00--> 0
# up    y2-y1>0,y2-y3>0-->11--> 0
panel_5 = Panel("""1
-1
0
0""")

series = Series(Start=item.Item, Step=neg, Count=addition)
flip = FlipMatrix(Data=int_2)
panel_6 = Panel("""10
01
00
11""")
ins = InsertItems(List=series, Item=y_array, Indices="0", Wrap=True)
y0 = Number(series)
join = TextJoin(Text=flip)
replace = ReplaceMembers(Set=join, Find=panel_6, Replace=panel_5)  # -> flatten(Result)
graft = GraftTree(Tree=y0, IncludeEmptyLists=True, IncludeNullItems=True)
addition_2 = Addition(A=y2_original, B=replace)
y2_after_revise = Number(addition_2)
panel_7 = Panel(x_array)

# ----
# 在端点上的扫描线的y值
# 扫描线的实例与类的映射关系
cset = CreateSet(List=y2_after_revise)  # -> Set, Map
sort_2 = SortList(Keys=cset.Set)  # -> reverse(Keys), ValuesA
shift_2 = ShiftList(List=sort_2.Keys, Shift=[-1, 1], Wrap=False)
y0_2 = Number(y0)
bang = ExplodeTree(Data=shift_2)  # -> Branch0, Branch1
lng_2 = ListLength(List=bang.Branch0)
scanline_class_count = Integer(lng_2)
graft_2 = GraftTree(Tree=y0_2, IncludeEmptyLists=True, IncludeNullItems=True)
smaller = SmallerThan(FirstNumber=graft_2, SecondNumber=bang.Branch0)  # -> SmallerThan, OrEqualTo
larger_2 = LargerThan(FirstNumber=graft_2, SecondNumber=bang.Branch1)  # -> LargerThan, OrEqualTo
and = GateAnd(A=smaller.OrEqualTo, B=larger_2.LargerThan)
mindex = MemberIndex(Set=and, Member=Toggle(True))  # -> simplify(Index), Count

panel_8 = Panel(graft)
scanline_class_count_2 = Integer(scanline_class_count)
series_2 = Series(Start=0, Step=1, Count=scanline_class_count_2)
int_3 = Integer(series_2)
panel_9 = Panel("组织树形结构时候，减少这种后馈，在前面就设计好算法")
panel_10 = Panel(mindex.Index)

number_slider = Slider(2, range=0..10)
pt = Point(txt)
pline = PolyLine(Vertices=pt, Closed=True)
points = PointList(Points=txt, Size=number_slider)

shift_3 = ShiftList(List=x_array, Shift=1, Wrap=True)
shift_4 = ShiftList(List=y_array, Shift=1, Wrap=True)
pshift = ShiftPaths(Data=shift_3, Offset=-1)
pshift_2 = ShiftPaths(Data=shift_4, Offset=-1)
subtraction_3 = Subtraction(A=y_array, B=pshift_2)
subtraction_4 = Subtraction(A=x_array, B=pshift)
division_2 = Division(A=subtraction_3, B=subtraction_4)
k = Number(division_2)

dom = ConstructDomain(DomainStart=y_array, DomainEnd=pshift_2)

inc = Includes(Value=graft, Domain=dom)  # -> Includes, Deviation
sift = SiftPattern(List=k, SiftPattern=inc.Includes)  # -> Output0, Output1
multiplication = Multiplication(A=x_array, B=sift.Output1)
subtraction_5 = Subtraction(A=y_array, B=multiplication)
subtraction_6 = Subtraction(A=graft, B=subtraction_5)
division_3 = Division(A=subtraction_6, B=sift.Output1)

k_2 = Number(k)

complex_2 = CreateComplex(Real=division_3, Imaginary=graft)
pt_2 = Point(complex_2)

division_4 = Division(A="1", B=k_2)
multiplication_2 = Multiplication(A=division_4, B=replace)
clean = CleanTree(RemoveNulls=True, RemoveInvalid=True, RemoveEmpty=False, Tree=pt_2)
addition_3 = Addition(A=x2_original, B=multiplication_2)
item_2 = ListItem(List=clean, Index=0, Wrap=True)  # -> Item, Item1
x2_after_revise = Number(addition_3)
ln = Line(StartPoint=item_2.Item, EndPoint=item_2.Item1)
shift_5 = ShiftList(List=x2_after_revise, Shift=1, Wrap=True)
panel_11 = Panel(x2_after_revise)
pt_3 = ConstructPoint(XCoordinate=x2_after_revise, YCoordinate=y2_after_revise, ZCoordinate=0)
graft_3 = GraftTree(Tree=x2_after_revise, IncludeEmptyLists=True, IncludeNullItems=True)
pshift_3 = ShiftPaths(Data=shift_5, Offset=-1)  # -> graft(Data)
points_2 = PointList(Points=flatten(pt_3), Size=number_slider)
merge = Merge(Data1=graft_3, Data2=pshift_3)  # -> simplify(Result)
number_2 = Number(division_4)

# ----
# sort首尾点的y值
shift_6 = ShiftList(List=y2_after_revise, Shift=1, Wrap=True)
pshift_4 = ShiftPaths(Data=shift_6, Offset=-1)  # -> graft(Data)
graft_4 = GraftTree(Tree=y2_after_revise, IncludeEmptyLists=True, IncludeNullItems=True)
merge_2 = Merge(Data1=graft_4, Data2=pshift_4)  # -> simplify(Result)

lng_3 = ListLength(List=merge_2)
series_3 = Series(Start=0, Step=1, Count=lng_3)
int_4 = Integer(series_3)

sort_3 = SortList(Keys=merge_2, ValuesA=int_4)  # -> Keys, ValuesA
num = Number(sort_3.Keys)

panel_12 = Panel(sort_3.ValuesA)
# process_x_intersections
item_3 = ListItem(List=num, Index=0, Wrap=True)  # -> Item, Item1
lng_4 = ListLength(List=flatten(item_3.Item1))
series_4 = Series(Start=0, Step=1, Count=lng_4)
sortmethod = Integer(series_4)

# ----
# sort较大的y,得到top_y
sort_4 = SortList(Keys=flatten(item_3.Item1), ValuesA=sortmethod)  # -> reverse(Keys), reverse(ValuesA)

# ----
# 重新寻找top_y对应的top_x
panel_13 = Panel("1")
int_5 = Integer(panel_13)
graft_5 = GraftTree(Tree=sort_4.ValuesA, IncludeEmptyLists=True, IncludeNullItems=True)
mindex_2 = MemberIndex(Set=sort_3.ValuesA, Member=int_5)  # -> Index, Count
path = ConstructPath(Indices=graft_5)
item_4 = ListItem(List=flatten(mindex_2.Index), Index=graft_5, Wrap=False)
item_5 = TreeItem(Tree=merge, Path=path, Index=item_4, Wrap=True)
flatten = FlattenTree(Tree=item_5, Path="{0}")

panel_14 = Panel(path)
panel_15 = Panel(item_4)
top_y_lineindex = Integer(sort_4.ValuesA)
item_6 = ListItem(List=x2_after_revise, Index=top_y_lineindex, Wrap=False)
item_7 = ListItem(List=number_2, Index=top_y_lineindex, Wrap=False)
match_top_1_k = Number(item_7)
top_y = Number(sort_4.Keys)
match_top_x = Number(flatten)

# ----
# Active_List_of_Side
graft_6 = GraftTree(Tree=reverse(num), IncludeEmptyLists=True, IncludeNullItems=True)
graft_7 = GraftTree(Tree=num, IncludeEmptyLists=True, IncludeNullItems=True)

# ----
# {n;m}
# 每条line端点处对应的scanLine的index
num_2 = Number(graft_6)
equals = Equality(FirstNumber=num_2, SecondNumber=sort_2.Keys)  # -> Equality, Inequality
mindex_3 = MemberIndex(Set=equals.Equality, Member=Toggle(True))  # -> simplify(Index), Count
pshift_5 = ShiftPaths(Data=mindex_3.Index, Offset=-1)
item_8 = ListItem(List=pshift_5, Index=0, Wrap=True)  # -> Item, Item1
subtraction_7 = Subtraction(A=item_8.Item1, B=item_8.Item)
series_5 = Series(Start=item_8.Item, Step=1, Count=subtraction_7)
int_6 = Integer(series_5)

neg_2 = Negative(Value=match_top_1_k)

# ----
# 恢复path
path_2 = ConstructPath(Indices=graft(top_y_lineindex))

graft_8 = GraftTree(Tree=int_6, IncludeEmptyLists=True, IncludeNullItems=True)
path_3 = ConstructPath(Indices=graft_8)  # -> simplify(Branch)
tstat = TreeStatistics(Tree=path_3)  # -> Paths, Length, Count
dpath = DeconstructPath(Branch=tstat.Paths)
mindex_4 = MemberIndex(Set=int_6, Member=int_3)  # -> simplify(Index), Count
tstat_2 = TreeStatistics(Tree=mindex_4.Index)  # -> Paths, Length, Count
equals_2 = Equality(FirstNumber=tstat_2.Length, SecondNumber="1")  # -> Equality, Inequality
sift_2 = SiftPattern(List=tstat_2.Paths, SiftPattern=equals_2.Equality)  # -> Output0, Output1
item_9 = ListItem(List=dpath, Index=0, Wrap=True)
partition = PartitionList(List=sift_2.Output1, Size=scanline_class_count_2)
viewer = ParamViewer(item_9)
panel_16 = Panel(int_6)

# ----
# scanLineCount_on_line for process_x_intersections
# 每个值域内的scanLineCount
cset_2 = CreateSet(List=flatten(mindex.Index))  # -> Set, Map
mindex_5 = MemberIndex(Set=cset_2.Map, Member=cset_2.Set)  # -> Index, Count
lng_5 = ListLength(List=mindex_5.Index)
flatten_2 = FlattenTree(Tree=lng_5, Path="{0}")
item_10 = ListItem(List=flatten_2, Index=int_6, Wrap=False)
ma = MassAddition(Input=item_10)  # -> Result, PartialResults
scanlinecount_on_line = Integer(ma.Result)

flatten_3 = FlattenTree(Tree=scanlinecount_on_line, Path="{0}")
item_11 = ListItem(List=flatten_3, Index=top_y_lineindex, Wrap=True)
series_6 = Series(Start=match_top_x, Step=neg_2, Count=item_11)
series_7 = Series(Start=top_y, Step="-1", Count=item_11)
viewer_2 = ParamViewer(series_6)
# {n;m}
# 每条line上对应与scanLine交点坐标
replace_2 = ReplacePaths(Data=series_7, Search=viewer_2, Replace=flatten(path_2))
panel_17 = Panel(replace_2)
replace_3 = ReplacePaths(Data=series_6, Search=viewer_2, Replace=flatten(path_2))
flip_2 = FlipMatrix(Data=replace_3)
flip_3 = FlipMatrix(Data=replace_2)
pt_4 = ConstructPoint(XCoordinate=replace_3, YCoordinate=replace_2, ZCoordinate=0)
panel_18 = Panel(replace_3)
panel_21 = Panel(scanlinecount_on_line)

# ----
# scanLine-->m , line --> n
# {m;n}
# 每条scanLine相交的line
flip_4 = FlipMatrix(Data=partition)
replace_4 = ReplacePaths(Data=item_9, Search=viewer, Replace=flatten(path_3))

flatten_4 = FlattenTree(Tree=replace_4, Path="{0}")
graft_9 = GraftTree(Tree=replace_4, IncludeEmptyLists=True, IncludeNullItems=True)
tstat_3 = TreeStatistics(Tree=graft_9)  # -> Paths, Length, Count
dpath_2 = DeconstructPath(Branch=tstat_3.Paths)
item_12 = ListItem(List=dpath_2, Index=0, Wrap=True)
flatten_5 = FlattenTree(Tree=item_12, Path="{0}")
weave = Weave(Pattern=[0, 1], Stream0=flatten_5, Stream1=flatten_4, NullGaps=False)
partition_2 = PartitionList(List=weave, Size="2")
path_4 = ConstructPath(Indices=partition_2)
viewer_3 = ParamViewer(graft_9)
flatten_6 = FlattenTree(Tree=path_4, Path="{0}")

replace_5 = ReplacePaths(Data=graft_9, Search=viewer_3, Replace=flatten_6)

panel_22 = Panel(flip_4)
panel_23 = Panel(replace_4)
