# Grasshopper definition 20161115_tim_graphics_fillArea_scanLine_005.gh (Grasshopper 0.9.76)

# log:区域填充算法
# 20161110:
# 向量几何公式的gh实现
# 向量乘积：点积，差积，行列式
# 向量需要用时候再学习
# 
# 扫描线填色算法gh实现:
# n,x_array,y_array的形式给出多边形
# 扫描线给定有限元finite_distance从上而下求交点
# 左右顶点处理（考虑是否有限元法不会有此问题）
# 左:y1<y2<y3 y2-y1>0,y2-y3<0
# 右:y1>y2>y3 y2-y1<0,y2-y3>0
# 20161113:
# 写活性表的伪代码，想清楚了连电池:
# 0;m0_y与相交值域的比较
# 1;值域和对应线段的映射关系
# 2;左右顶点处理坐标bug修正,书中给出的左右顶点有谬误
# 3;整理应映射标签运算程序段
# 求交点的问题:
# 1;计算数列起始坐标的标签运算:
# 1;0初始坐标调用现有的数据，用top_y以及对应的top_x
# 1;1减少数据结构间的无意义映射
# 2;每段line上scanLine的数量，不要重复计算，并行计算
# 3；对y进行top排序的时候，对应的x的值
# 4；修复因为修正顶点而产生的交点错误
# 5；整理交点部分程序
# 对偶数个数的点序进行连线:
# 1;组织对应的树形数据
# 扫描线有限元范围问题
# 20161114:
# 扫描线求交点问题：
# 1;抓住映射关系，多求一次最最大y0的交点
# 20161115:
# 整理求交点部分的程序:
# 0;精简连线前对x排序的算法
# 顶点修正以及去掉水平线
panel = Panel("""{7.656903, 14.500688, 0.0}
{6.429437, -1.86552, 0.0}
{2.065114, -5.411532, 0.0}
{-5.367872, 0.521218, 0.0}
{1.724152, 5.294696, 0.0}
{-2.435593, 5.840236, 0.0}
{-1.753668, 10.136366, 0.0}""")
panel_2 = Panel("""{32.045762, 15.39429, 0.0}
{30.049266, -1.959868, 0.0}
{23.752625, -5.0314, 0.0}
{17.763138, -0.116948, 0.0}
{25.902698, 2.801007, 0.0}
{22.984742, 5.718963, 0.0}
{20.988246, 2.954584, 0.0}
{19.45248, 4.643927, 0.0}
{22.831166, 8.944072, 0.0}
{19.606057, 10.172685, 0.0}
{20.681093, 14.779983, 0.0}
{25.902698, 10.326261, 0.0}
{29.43496, 11.708451, 0.0}
{26.209851, 13.858523, 0.0}""")
panel_3 = Panel("""{7.637584, 15.346381, 0.0}
{9.723192, 10.523412, 0.0}
{7.767934, -3.684795, 0.0}
{-0.8352, 0.095371, 0.0}
{-3.963612, -6.291805, 0.0}
{-5.397468, 7.395, 0.0}
{-0.313798, 15.346381, 0.0}
{2.423563, 12.869721, 0.0}
{2.293213, 3.745185, 0.0}""")
panel_4 = Panel("""{13.520889, -8.730148, 0.0}
{18.347637, 6.082975, 0.0}
{29.847165, 2.335938, 0.0}
{35.515554, 4.31966, 0.0}
{43.489775, -5.183901, 0.0}
{27.158453, -18.887142, 0.0}""")
txt = Text(panel)
num = Number("1")
complex = ComplexComponents(Complex=txt)  # -> Real, Imaginary
lng = ListLength(List=txt)
finite_distance = Number(num)

number_slider = Slider(2, range=0..10)
pt = Point(txt)
pline = PolyLine(Vertices=pt, Closed=True)
points = PointList(Points=txt, Size=number_slider)

n = Integer(lng)
x_array = Number(complex.Real)
y_array = Number(complex.Imaginary)
sort = SortList(Keys=y_array)  # -> Keys, ValuesA
shift = ShiftList(List=y_array, Shift=[-1, 1], Wrap=True)
x2_original = Number(x_array)
y2_original = Number(y_array)
number = Number(shift)  # "y1,y3"

shift_2 = ShiftList(List=x_array, Shift=1, Wrap=True)
shift_3 = ShiftList(List=y_array, Shift=1, Wrap=True)
pshift = ShiftPaths(Data=shift_2, Offset=-1)
pshift_2 = ShiftPaths(Data=shift_3, Offset=-1)
subtraction = Subtraction(A=x_array, B=pshift)
subtraction_2 = Subtraction(A=y_array, B=pshift_2)
division = Division(A=subtraction_2, B=subtraction)
k = Number(division)
multiplication = Multiplication(A=x_array, B=k)
subtraction_3 = Subtraction(A=y_array, B=multiplication)
b = Number(subtraction_3)

item = ListItem(List=sort.Keys, Index="-1", Wrap=True)  # -> Item, Item1
subtraction_4 = Subtraction(A=y2_original, B=number)
subtraction_5 = Subtraction(A=item.Item, B=item.Item1)
division_2 = Division(A=subtraction_5, B=finite_distance)
int = Integer(division_2)
larger = LargerThan(FirstNumber=subtraction_4, SecondNumber="0")  # -> LargerThan, OrEqualTo
neg = Negative(Value=finite_distance)
addition = Addition(A=int, B=2)
int_2 = Integer(larger.LargerThan)

# ----
# 左右顶点处理
# left:   y2-y1>0,y2-y3<0 -->10-->-1
# right: y2-y1<0,y2-y3>0 -->01-->1
# down y2-y1<0,y2-y3<0-->00--> 0
# up    y2-y1>0,y2-y3>0-->11--> 0
panel_5 = Panel("""-1
1
0
0""")

# ----
# 左右顶点处理
# left:   y2-y1>0,y2-y3<0 -->10-->1
# right: y2-y1<0,y2-y3>0 -->01-->-1
# down y2-y1<0,y2-y3<0-->00--> 0
# up    y2-y1>0,y2-y3>0-->11--> 0
panel_6 = Panel("""1
-1
0
0""")

series = Series(Start=item.Item, Step=neg, Count=addition)
flip = FlipMatrix(Data=int_2)
panel_7 = Panel("""10
01
00
11""")
y0 = Number(series)
join = TextJoin(Text=flip)
replace = ReplaceMembers(Set=join, Find=panel_7, Replace=panel_5)  # -> flatten(Result)
k_2 = Number(k)
division_3 = Division(A="1", B=k_2)
graft = GraftTree(Tree=y0, IncludeEmptyLists=True, IncludeNullItems=True)
multiplication_2 = Multiplication(A=division_3, B=replace)
addition_2 = Addition(A=y2_original, B=replace)
addition_3 = Addition(A=x2_original, B=multiplication_2)

x_array_2 = Number(x_array)
y_array_2 = Number(y_array)
y2_after_revise = Number(addition_2)

x2_after_revise = Number(addition_3)
pt_2 = ConstructPoint(XCoordinate=x2_after_revise, YCoordinate=y2_after_revise, ZCoordinate=0)
shift_4 = ShiftList(List=x2_after_revise, Shift=1, Wrap=True)
points_2 = PointList(Points=flatten(pt_2), Size=number_slider)
pshift_3 = ShiftPaths(Data=shift_4, Offset=-1)  # -> graft(Data)
graft_2 = GraftTree(Tree=x2_after_revise, IncludeEmptyLists=True, IncludeNullItems=True)
merge = Merge(Data1=graft_2, Data2=pshift_3)  # -> simplify(Result)

# ----
# sort首尾点的y值
shift_5 = ShiftList(List=y2_after_revise, Shift=1, Wrap=True)
pshift_4 = ShiftPaths(Data=shift_5, Offset=-1)  # -> graft(Data)
graft_3 = GraftTree(Tree=y2_after_revise, IncludeEmptyLists=True, IncludeNullItems=True)
merge_2 = Merge(Data1=graft_3, Data2=pshift_4)  # -> simplify(Result)
lng_2 = ListLength(List=merge_2)
series_2 = Series(Start=0, Step=1, Count=lng_2)
int_3 = Integer(series_2)
sort_2 = SortList(Keys=merge_2, ValuesA=int_3)  # -> Keys, ValuesA
num_2 = Number(sort_2.Keys)

# ----
# Active_List_of_Side
graft_4 = GraftTree(Tree=reverse(num_2), IncludeEmptyLists=True, IncludeNullItems=True)
graft_5 = GraftTree(Tree=num_2, IncludeEmptyLists=True, IncludeNullItems=True)

# ----
# 在端点上的扫描线的y值
# 扫描线的实例与类的映射关系
cset = CreateSet(List=y2_after_revise)  # -> Set, Map
sort_3 = SortList(Keys=cset.Set)  # -> reverse(Keys), ValuesA
shift_6 = ShiftList(List=sort_3.Keys, Shift=[-1, 1], Wrap=False)
y0_2 = Number(y0)
bang = ExplodeTree(Data=shift_6)  # -> Branch0, Branch1
lng_3 = ListLength(List=bang.Branch0)
scanline_class_count = Integer(lng_3)
graft_6 = GraftTree(Tree=y0_2, IncludeEmptyLists=True, IncludeNullItems=True)
smaller = SmallerThan(FirstNumber=graft_6, SecondNumber=bang.Branch0)  # -> SmallerThan, OrEqualTo
larger_2 = LargerThan(FirstNumber=graft_6, SecondNumber=bang.Branch1)  # -> LargerThan, OrEqualTo
and = GateAnd(A=smaller.OrEqualTo, B=larger_2.LargerThan)
mindex = MemberIndex(Set=and, Member=Toggle(True))  # -> simplify(Index), Count

# ----
# {n;m}
# 每条line端点处对应的scanLine的index
num_3 = Number(graft_4)
equals = Equality(FirstNumber=num_3, SecondNumber=sort_3.Keys)  # -> Equality, Inequality
mindex_2 = MemberIndex(Set=equals.Equality, Member=Toggle(True))  # -> simplify(Index), Count
pshift_5 = ShiftPaths(Data=mindex_2.Index, Offset=-1)
item_2 = ListItem(List=pshift_5, Index=0, Wrap=True)  # -> Item, Item1
subtraction_6 = Subtraction(A=item_2.Item1, B=item_2.Item)
series_3 = Series(Start=item_2.Item, Step=1, Count=subtraction_6)
int_4 = Integer(series_3)

# ----
# scanLine-->m , line --> n
# {m;n}
# 每条scanLine相交的line
graft_7 = GraftTree(Tree=int_4, IncludeEmptyLists=True, IncludeNullItems=True)
path = ConstructPath(Indices=graft_7)  # -> simplify(Branch)
tstat = TreeStatistics(Tree=path)  # -> Paths, Length, Count
dpath = DeconstructPath(Branch=tstat.Paths)
item_3 = ListItem(List=dpath, Index=0, Wrap=True)
viewer = ParamViewer(item_3)
replace_2 = ReplacePaths(Data=item_3, Search=viewer, Replace=flatten(path))

panel_8 = Panel(replace_2)

item_4 = ListItem(List=num_2, Index=0, Wrap=True)  # -> Item, Item1
lng_4 = ListLength(List=flatten(item_4.Item1))
series_4 = Series(Start=0, Step=1, Count=lng_4)
sortmethod = Integer(series_4)

# ----
# sort较大的y,得到top_y
sort_4 = SortList(Keys=flatten(item_4.Item1), ValuesA=sortmethod)  # -> reverse(Keys), reverse(ValuesA)

# ----
# 重新寻找top_y对应的top_x
panel_9 = Panel("1")
int_5 = Integer(panel_9)
graft_8 = GraftTree(Tree=sort_4.ValuesA, IncludeEmptyLists=True, IncludeNullItems=True)
mindex_3 = MemberIndex(Set=sort_2.ValuesA, Member=int_5)  # -> Index, Count
path_2 = ConstructPath(Indices=graft_8)
item_5 = ListItem(List=flatten(mindex_3.Index), Index=graft_8, Wrap=False)
item_6 = TreeItem(Tree=merge, Path=path_2, Index=item_5, Wrap=True)
flatten = FlattenTree(Tree=item_6, Path="{0}")

top_y_lineindex = Integer(sort_4.ValuesA)
top_y = Number(sort_4.Keys)

panel_10 = Panel(flatten)

# ----
# 扫描线的实例与类的映射关系
# 得到不同扫描线区间的最大实际y0
# 对y0进行分组
# 计算最大实际y0的交点
# x=(y-b)/k
# scanLine-->m , line --> n
# {m;n}
# 每条scanLine相交的line
int_6 = Integer(mindex.Index)
int_7 = Integer(replace_2)
tstat_2 = TreeStatistics(Tree=int_7)  # -> Paths, Length, Count
dpath_2 = DeconstructPath(Branch=tstat_2.Paths)
lng_5 = ListLength(List=int_7)
mindex_4 = MemberIndex(Set=flatten(int_6), Member=flatten(dpath_2))  # -> Index, Count
line_count_witheachscanline = Integer(lng_5)
b_2 = Number(b)
k_3 = Number(k)
item_7 = ListItem(List=b_2, Index=int_7, Wrap=True)
item_8 = ListItem(List=k_3, Index=int_7, Wrap=True)
division_4 = Division(A="1", B=item_8)
neg_2 = Negative(Value=division_4)

# ----
# member时count需要equal,所以都转成字符串
tstat_3 = TreeStatistics(Tree=int_7)  # -> Paths, Length, Count
dpath_3 = DeconstructPath(Branch=tstat_3.Paths)
join_2 = TextJoin(Text=int_7, Join="t")  # -> flatten(Result)
replace_3 = ReplaceMembers(Set=int_6, Find=flatten(dpath_3), Replace=join_2)
split = TextSplit(Text=replace_3, Separators="t")  # -> simplify(Result)

clean = CleanTree(RemoveNulls=True, RemoveInvalid=True, RemoveEmpty=True, Tree=mindex_4.Count)
clean_2 = CleanTree(RemoveNulls=True, RemoveInvalid=True, RemoveEmpty=True, Tree=mindex_4.Index)

int_8 = Integer(mindex_4.Count)
int_9 = Integer(int_8)

int_10 = Integer(mindex_4.Index)
int_11 = Integer(int_10)

instancescanliney0_count_afterpartition = Integer(graft(int_9))
item_9 = ListItem(List=y0_2, Index=int_11, Wrap=True)
item_10 = ListItem(List=item_9, Index=0, Wrap=True)
multiplication_3 = Multiplication(A=instancescanliney0_count_afterpartition, B=line_count_witheachscanline)
subtraction_7 = Subtraction(A=item_10, B=item_7)
series_5 = Series(Start=item_10, Step="-1", Count=instancescanliney0_count_afterpartition)  # -> simplify(Series)
division_5 = Division(A=subtraction_7, B=item_8)
repeat = RepeatData(Data=series_5, Length=multiplication_3)
series_6 = Series(Start=division_5, Step=neg_2, Count=instancescanliney0_count_afterpartition)  # -> simplify(Series)
partition = PartitionList(List=repeat, Size=instancescanliney0_count_afterpartition)  # -> simplify(Chunks)

panel_11 = Panel(clean)

clean_3 = CleanTree(RemoveNulls=True, RemoveInvalid=True, RemoveEmpty=True, Tree=series_6)
clean_4 = CleanTree(RemoveNulls=True, RemoveInvalid=True, RemoveEmpty=True, Tree=partition)

pt_3 = ConstructPoint(XCoordinate=series_6, YCoordinate=partition, ZCoordinate=0)
panel_12 = Panel(series_6)
panel_13 = Panel(int_7)

# ----
# 每一scanLine上的点根据x从左到右排序
num_4 = Number(series_6)
num_5 = Number(partition)
stack = StackData(Data=line_count_witheachscanline, Stack=instancescanliney0_count_afterpartition)  # -> simplify(graft(Data))
series_7 = Series(Start=0, Step=1, Count=stack)

# ----
# 手工pathMapper
graft_9 = GraftTree(Tree=num_5, IncludeEmptyLists=True, IncludeNullItems=True)
graft_10 = GraftTree(Tree=num_4, IncludeEmptyLists=True, IncludeNullItems=True)
tstat_4 = TreeStatistics(Tree=graft_10)  # -> Paths, Length, Count
dpath_4 = DeconstructPath(Branch=tstat_4.Paths)
item_11 = ListItem(List=dpath_4, Index=0, Wrap=True)  # -> Item, Item1, Item2
viewer_2 = ParamViewer(graft_10)
merge_3 = Merge(Data1=item_11.Item, Data2=item_11.Item2)
path_3 = ConstructPath(Indices=merge_3)
replace_4 = ReplacePaths(Data=graft_10, Search=viewer_2, Replace=flatten(path_3))
replace_5 = ReplacePaths(Data=graft_9, Search=viewer_2, Replace=flatten(path_3))

path_mapper = PathMapper(num_4, source="{A;B}(i)", target="{A;i}")
path_mapper_2 = PathMapper(num_5, source="{A;B}(i)", target="{A;i}")

lng_6 = ListLength(List=path_mapper)
sort_5 = SortList(Keys=path_mapper, ValuesA=simplify(series_7))  # -> Keys, ValuesA
item_12 = ListItem(List=path_mapper_2, Index=sort_5.ValuesA, Wrap=True)
partition_2 = PartitionList(List=sort_5.Keys, Size="2")
partition_3 = PartitionList(List=item_12, Size="2")
item_13 = ListItem(List=partition_2, Index=0, Wrap=True)  # -> Item, Item1
complex_2 = CreateComplex(Real=item_13.Item, Imaginary=partition_3)
complex_3 = CreateComplex(Real=item_13.Item1, Imaginary=partition_3)
ln = Line(StartPoint=complex_2, EndPoint=complex_3)

panel_14 = Panel(stack)
panel_15 = Panel(ln)
