# Grasshopper definition 20161205_graphics_clip_Sutherland_Cohen_001.gh (Grasshopper 0.9.76)

crv = Curve(<curve referenced from the Rhino model>)  # disabled
crv_2 = Curve(<curve referenced from the Rhino model>)  # disabled
end = EndPoints(Curve=crv_2)  # -> Start, End; disabled
explode = Explode(Curve=crv, Recursive=True)  # -> Segments, Vertices; disabled
merge = Merge(Data1=end.Start, Data2=end.End)  # disabled
shift = ShiftList(List=explode.Vertices, Shift=-1, Wrap=False)  # disabled
panel = Panel(shift)  # disabled
panel_2 = Panel(merge)  # disabled
panel_3 = Panel("""{-12.0, -7.0, 0.0}
{13.0, -7.0, 0.0}
{13.0, 7.0, 0.0}
{-12.0, 7.0, 0.0}""")
panel_4 = Panel("""{-0.865873, 9.024387, 0.0}
{13.0, -7.0, 0.0}""")
# Sutherland-cohen算法_logging
# 20161205
# 域的top,bottom,left,right
# 线的pt0的坐标与域比较得到code值
# 判断可见性的层级关系
# code值与所求交线的映射关系
# 求交点的算法以及精简处理好进fx的数据结构
# 替换掉combine这种搞不清的运算器
# 直线斜率的特殊情况 k=0和not exist
# 线和域的关系表示
panel_5 = Panel("""{-17.991846, 14.901049, 0.0}
{21.96326, -1.933968, 0.0}""")
panel_6 = Panel("""{-15.272727, 12.727273, 0.0}
{17.272727, -12.727273, 0.0}""")
panel_7 = Panel("""{-7.454545, 2.0, 0.0}
{8.181818, -3.636364, 0.0}""")
panel_8 = Panel("""{-8.0, 13.0, 0.0}
{18.0, -4.0, 0.0}""")
panel_9 = Panel("""{-9.818182, 14.909091, 0.0}
{9.636364, 9.454545, 0.0}""")
panel_10 = Panel("""{-10.955053, 11.205427, 0.0}
{-2.087898, -1.49975, 0.0}""")
panel_11 = Panel("""{8.102714, 13.322957, 0.0}
{8.102714, -11.822707, 0.0}""")
panel_12 = Panel("""{-14.220885, 3.185159, 0.0}
{21.287382, 3.185159, 0.0}""")
txt = Text(panel_7)
txt_2 = Text(panel_3)
pt = Point(txt_2)
pt_2 = Point(txt)
pline = PolyLine(Vertices=pt_2, Closed=True)
pline_2 = PolyLine(Vertices=pt, Closed=True)

# ----
# x0<xL  _ _ _ 1  -->left边交          --->3
# x0>xR _ _ 1 _   --->right边交      -->2
# y0<yB _ 1 _ _  --->bottom边交 -->1
# y0>yT 1_ _ _    ---> top边交  -->0
complex = ComplexComponents(Complex=txt)  # -> Real, Imaginary
complex_2 = ComplexComponents(Complex=txt_2)  # -> Real, Imaginary
entwine = Entwine(Branch00=complex_2.Real, Branch01=complex_2.Imaginary, FlattenInputs=True)
number = Number(complex.Imaginary)  # "ya,yb"
number_2 = Number(complex.Real)  # "xa,xb"
panel_13 = Panel("""0
2""")
entwine_2 = Entwine(Branch00=number_2, Branch01=number, FlattenInputs=True)
cset = CreateSet(List=entwine)  # -> Set, Map
pshift = ShiftPaths(Data=entwine_2, Offset=1)
sort = SortList(Keys=cset.Set)  # -> Keys, ValuesA
flatten = FlattenTree(Tree=sort.Keys, Path="{0}")
item = ListItem(List=flatten, Index=panel_13, Wrap=True)  # -> Item, Item1
larger = LargerThan(FirstNumber=pshift, SecondNumber=graft(item.Item1))  # -> LargerThan, OrEqualTo
smaller = SmallerThan(FirstNumber=pshift, SecondNumber=graft(item.Item))  # -> SmallerThan, OrEqualTo
int = Integer(smaller.SmallerThan)
int_2 = Integer(larger.LargerThan)
bang = ExplodeTree(Data=int_2)  # -> Branch0, Branch1
bang_2 = ExplodeTree(Data=int)  # -> Branch0, Branch1
concat = Concatenate(FragmentA=bang.Branch1, FragmentB=bang_2.Branch1, FragmentC=bang.Branch0, FragmentD=bang_2.Branch0)
txt_3 = Text(flatten(concat))

panel_14 = Panel("""1
-1""")
multiplication = Multiplication(A=pshift, B=panel_14)
ma = MassAddition(Input=multiplication)  # -> Result, PartialResults
item_2 = ListItem(List=pshift, Index=0, Wrap=True)
bang_3 = ExplodeTree(Data=ma.Result)  # -> Branch0, Branch1
bang_4 = ExplodeTree(Data=item_2)  # -> Branch0, Branch1
division = Division(A=bang_3.Branch1, B=bang_3.Branch0)
k = Number(division)
multiplication_2 = Multiplication(A=k, B=bang_4.Branch0)
subtraction = Subtraction(A=bang_4.Branch1, B=multiplication_2)
b = Number(subtraction)

# ----
# if c1 and c2 == 0000 --> 完全可见
# else c1 * c2 != 0000 --> 完全不可见
#     if  c1 * c2 == 0000 --> 不完全可见
#     then 开始裁剪
panel_15 = Panel("0000")
txt_4 = Text(panel_15)
equals = Equality(FirstNumber=txt_3, SecondNumber=txt_4)  # -> Equality, Inequality
item_3 = ListItem(List=equals.Equality, Index=0, Wrap=True)  # -> Item, Item1
and = GateAnd(A=item_3.Item, B=item_3.Item1)
gate = StreamGate(Stream=txt_3, Gate=and)  # -> Target0, Target1
chars = Characters(Text=gate.Target0)  # -> Result, Unicode
bang_5 = ExplodeTree(Data=chars.Result)  # -> Branch0, Branch1
panel_16 = Panel("""k*a+b
(a-b)/k""")
panel_17 = Panel("""1
1
0
0""")
panel_18 = Panel("""3
2
1
0""")
multiplication_3 = Multiplication(A=bang_5.Branch0, B=bang_5.Branch1)
txt_5 = Text(panel_16)
item_4 = ListItem(List=flatten, Index=panel_18, Wrap=True)
item_5 = ListItem(List=txt_5, Index=panel_17, Wrap=False)
join = TextJoin(Text=multiplication_3)
equals_2 = Equality(FirstNumber=join, SecondNumber=txt_4)  # -> Equality, Inequality
gate_2 = StreamGate(Stream=chars.Result, Gate=equals_2.Equality)  # -> Target0, Target1
mindex = MemberIndex(Set=gate_2.Target1, Member="1")  # -> simplify(Index), Count
item_6 = ListItem(List=item_5, Index=mindex.Index, Wrap=True)  # -> simplify(Item)
item_7 = ListItem(List=item_4, Index=mindex.Index, Wrap=True)  # -> simplify(Item)
item_8 = ListItem(List=panel_17, Index=mindex.Index, Wrap=True)
eval = Evaluate(F=item_6, a=item_7, k=k, b=b)  # -> simplify(r)
merge_2 = Merge(Data1=graft(eval), Data2=graft(item_7))
tstat = TreeStatistics(Tree=merge_2)  # -> Paths, Length, Count
dispatch = Dispatch(List=tstat.Paths, DispatchPattern=flatten(item_8))  # -> ListA, ListB
branch = TreeBranch(Tree=merge_2, Path=dispatch.ListA, MaintainPaths=True)
branch_2 = TreeBranch(Tree=merge_2, Path=dispatch.ListB, MaintainPaths=True)
rev = ReverseList(List=branch_2)
merge_3 = Merge(Data1=branch, Data2=rev)
item_9 = ListItem(List=merge_3, Index=0, Wrap=True)  # -> Item, Item1

# ----
# k not exist
null = NullItem(Item=k)  # -> NullFlags, InvalidFlags, Description
nullrep = ReplaceNulls(Items=item_9.Item, Replacements=number_2)  # -> Items, Count
filter = StreamFilter(Gate=null.NullFlags, Stream0=item_9.Item, Stream1=nullrep.Items)

# ----
# 得到交点code，取0000作为端点
# 若端点在域内，则merge初始点作为端点
entwine_3 = Entwine(Branch00=flatten(filter), Branch01=flatten(item_9.Item1), FlattenInputs=True)
panel_19 = Panel("""0
2""")
item_10 = ListItem(List=flatten, Index=panel_19, Wrap=True)  # -> Item, Item1
complex_3 = CreateComplex(Real=filter, Imaginary=item_9.Item1)
pshift_2 = ShiftPaths(Data=entwine_3, Offset=1)
larger_2 = LargerThan(FirstNumber=pshift_2, SecondNumber=graft(item_10.Item1))  # -> LargerThan, OrEqualTo
smaller_2 = SmallerThan(FirstNumber=pshift_2, SecondNumber=graft(item_10.Item))  # -> SmallerThan, OrEqualTo
int_3 = Integer(larger_2.LargerThan)
int_4 = Integer(smaller_2.SmallerThan)
bang_6 = ExplodeTree(Data=int_3)  # -> Branch0, Branch1
bang_7 = ExplodeTree(Data=int_4)  # -> Branch0, Branch1
concat_2 = Concatenate(FragmentA=bang_6.Branch1, FragmentB=bang_7.Branch1, FragmentC=bang_6.Branch0, FragmentD=bang_7.Branch0)
txt_6 = Text("0000")
txt_7 = Text(concat_2)
sift = SiftPattern(List=txt, SiftPattern=equals.Equality)  # -> Output0, Output1
equals_3 = Equality(FirstNumber=txt_7, SecondNumber=txt_6)  # -> Equality, Inequality
sift_2 = SiftPattern(List=flatten(complex_3), SiftPattern=equals_3.Equality)  # -> Output0, Output1
clean = CleanTree(RemoveNulls=True, RemoveInvalid=True, RemoveEmpty=False, Tree=sift_2.Output1)
clean_2 = CleanTree(RemoveNulls=True, RemoveInvalid=True, RemoveEmpty=False, Tree=sift.Output1)
merge_4 = Merge(Data1=flatten(clean), Data2=flatten(clean_2))
item_11 = ListItem(List=merge_4, Index=0, Wrap=False)  # -> Item, Item1

pt_3 = Point(complex_3)

int_5 = Integer(equals_2.Inequality)
int_6 = Integer(and)
concat_3 = Concatenate(FragmentA=int_6, FragmentB=int_5)
panel_20 = Panel("""1
01
00""")
replace = ReplaceMembers(Set=concat_3, Find=panel_20, Replace=["完全可见", "完全不可见", "不完全可见"])
panel_21 = Panel(replace)

panel_22 = Panel(pshift_2)
ln = Line(StartPoint=item_11.Item, EndPoint=item_11.Item1)
preview = CustomPreview(Geometry=ln, Shader=ColourSwatch(SwatchColor=RGBA(255, 255, 255, 0)))
