# Grasshopper definition 20161201_teaHouse.gh (Grasshopper 0.9.76)

crv = Curve(<curve referenced from the Rhino model>)
crv_2 = Curve(<curve referenced from the Rhino model>)
boundary = BoundarySurfaces(Edges=[crv, crv_2])
# AreaLimitation
# 0;营业厅:120 to 150
# 0;0服务台 4m
# 0;1茶座
# 1;茶水、厨房间 20
# 2;库房 20
# 3;厕所 5+5
# 4;小卖部 20
# 5;室外画廊展示面 15m
# 6;亲水平台 1m
panel = Panel("12.3")
area = Area(Geometry=boundary)  # -> Area, Centroid
crv_3 = Curve(<curve referenced from the Rhino model>)
md_slider = MDSlider(
    slider_value=Point(0.5, 0.5, 0.5),
    SliderMode=0,
    x_domain=Domain(-10000, 10000),
    y_domain=Domain(-10000, 10000),
    z_domain=Domain(0, 1))
grassground_hypotenuse = Number(Slider(24000, range=0..100000))
boundary_2 = BoundarySurfaces(Edges=crv_3)
grassground_angle = Number(Slider(5, range=0..100))
area_2 = Area(Geometry=boundary_2)  # -> Area, Centroid
division = Division(A=area_2.Area, B="1000000")
boardthickness = Number("120")
deplane = DeconstructPlane(Plane=md_slider)  # -> Origin, XAxis, YAxis, ZAxis
rad = Radians(Degrees=grassground_angle)
tan = Tangent(Value=rad)
multiplication = Multiplication(A=tan, B="28622.79")
pt = PointOriented(BasePlane=md_slider, UComponent=0, VComponent=0, WComponent=0)
panel_2 = Panel(division)
num = Number("2800")
sin = Sine(Value=rad)
cos = Cosine(Value=rad)
multiplication_2 = Multiplication(A=[sin, cos], B=grassground_hypotenuse)
item = ListItem(List=multiplication_2, Index=0, Wrap=True)  # -> Item, Item1
num_2 = Number("20")
grassground_height = Number(item.Item)
subtraction = Subtraction(A=grassground_height, B=boardthickness)
neg = Negative(Value=grassground_height)
smaller = SmallerThan(FirstNumber=subtraction, SecondNumber=num)  # -> SmallerThan, OrEqualTo
merge = Merge(Data1="0", Data2=neg, Data3=neg)
filter = StreamFilter(Gate=smaller.SmallerThan, Stream0=num, Stream1=subtraction)
grassground_length = Number(item.Item1)
merge_2 = Merge(Data1="0", Data2="0", Data3=grassground_length)
multiplication_3 = Multiplication(A=grassground_length, B=Slider(0.5, range=0..1))
multiplication_4 = Multiplication(A=grassground_length, B=Slider(0.375, range=0..1))
pt_2 = PointOriented(BasePlane=md_slider, UComponent=merge_2, VComponent="0", WComponent=merge)
multiplication_5 = Multiplication(A=num_2, B=Slider(1000000, range=0..1000000))
upground_length = Number(multiplication_3)
store_length = Number(multiplication_4)
store_height = Number(filter)
pline = PolyLine(Vertices=pt_2, Closed=True)
item_2 = ListItem(List=pt_2, Index=-1, Wrap=True)
division_2 = Division(A=multiplication_5, B=store_length)
series = Series(Start="0", Step=division_2, Count="2")
stack = StackData(Data=series, Stack="2")
panel_3 = Panel("""150
20
20
10
20""")
shift = ShiftList(List=stack, Shift=1, Wrap=True)
boundary_3 = BoundarySurfaces(Edges=pline)
ma = MassAddition(Input=panel_3)  # -> Result, PartialResults
amp = Amplitude(Vector=expr("-x", deplane.YAxis), Amplitude=Slider(10000, range=0..10000))
pt_3 = PointOriented(BasePlane=item_2, UComponent=0, VComponent=0, WComponent=0)
extr = Extrude(Base=boundary_3, Direction=amp)
division_3 = Division(A=ma.Result)
panel_4 = Panel(division_2)
panel_5 = Panel(grassground_length)
panel_6 = Panel(upground_length)
panel_7 = Panel(grassground_height)
panel_8 = Panel(shift)
panel_9 = Panel(extr)
nurbs = NurbsCurve(Degree=3, Periodic=False)  # -> Curve, Length, Domain
