# Grasshopper definition 20170306_pushBox01.gh (Grasshopper 0.9.76)

md_slider = MDSlider(slider_value=Point(0, 0, 0.5), SliderMode=0, x_domain=Domain(0, 1), y_domain=Domain(0, 1), z_domain=Domain(0, 1))
number_slider = Slider(0, range=0..10)
pln = Plane(md_slider)
intitial_box_pt_x = Number(Slider(7.83, range=0..10))
num = Number(number_slider)
num_2 = Number(Slider(7.25, range=0..10))
number_slider_2 = Slider(1.6, range=0..10)
pt = PointOriented(BasePlane=pln, UComponent=num_2, VComponent=Slider(0, range=0..10), WComponent=0)
pt_2 = PointOriented(BasePlane=pln, UComponent=intitial_box_pt_x, VComponent=num, WComponent=0)
pl = ConstructPlane(Origin=pt, XAxis=Vector(1, 0, 0), YAxis=Vector(0, 1, 0))
pl_2 = ConstructPlane(Origin=pt_2, XAxis=Vector(1, 0, 0), YAxis=Vector(0, 1, 0))
length = Number(number_slider_2)
height = Number(number_slider_2)
radius = Number(Slider(0.294, range=0..1))
cir = Circle(Plane=pl, Radius=radius)
rectangle = Rectangle(Plane=pl_2, XSize=length, YSize=height, Radius=0)  # -> Rectangle, Length
human_pt_x = Number(num_2)
box_pt_x = Number(intitial_box_pt_x)
crv = Curve(rectangle.Rectangle)
crv_2 = Curve(cir)
radius_2 = Number(radius)
explode = Explode(Curve=crv, Recursive=True)  # -> Segments, Vertices
# 小球运动的方向  True -->
rec = DataRecorder(human_pt_x, DataLimit=2, RecordData=True)
panel = Panel("""3
1""")
item = ListItem(List=explode.Segments, Index="1", Wrap=True)  # -> Item, Item1, Item2
item_2 = ListItem(List=rec, Index=0, Wrap=True)  # -> Item, Item1
item_3 = ListItem(List=explode.Segments, Index=panel, Wrap=True)
rightcurve = Curve(item.Item)
crv_3 = Curve(item_3)
leftcurve = Curve(item.Item2)
subtraction = Subtraction(A=item_2.Item1, B=item_2.Item)
ccx = CurveCurve(CurveA=crv_3, CurveB=crv_2)  # -> Points, ParamsA, ParamsB
smaller = SmallerThan(FirstNumber=subtraction, SecondNumber="0")  # -> SmallerThan, OrEqualTo
larger = LargerThan(FirstNumber=subtraction, SecondNumber="0")  # -> LargerThan, OrEqualTo
item_4 = ListItem(List=crv_3, Index=0, Wrap=True)  # -> Item, Item1

lng = ListLength(List=ccx.Points)
bool = Boolean(lng)
bang = ExplodeTree(Data=simplify(bool))  # -> Branch0, Branch1

addition = Addition(A=length, B=radius_2)
crv_4 = Curve(item_4.Item1)
addition_2 = Addition(A=human_pt_x, B=radius_2)
and = GateAnd(A=bang.Branch0, B=larger.LargerThan)
subtraction_2 = Subtraction(A=human_pt_x, B=addition)
and_2 = GateAnd(A=bang.Branch1, B=smaller.SmallerThan)
panel_2 = Panel(item_4.Item)
filter = StreamFilter(Gate=and, Stream0=box_pt_x, Stream1=addition_2)
filter_2 = StreamFilter(Gate=and_2, Stream0=box_pt_x, Stream1=subtraction_2)
panel_3 = Panel(filter)
panel_4 = Panel(filter_2)

num_3 = Number(number_slider)
num_4 = Number(filter)
number_slider_3 = Slider(1.6, range=0..10)
pt_3 = PointOriented(BasePlane=pln, UComponent=num_4, VComponent=num_3, WComponent=0)
pl_3 = ConstructPlane(Origin=pt_3, XAxis=Vector(1, 0, 0), YAxis=Vector(0, 1, 0))
length_2 = Number(number_slider_3)
height_2 = Number(number_slider_3)
rectangle_2 = Rectangle(Plane=pl_3, XSize=length_2, YSize=height_2, Radius=0)  # -> Rectangle, Length

num_5 = Number(number_slider)
num_6 = Number(filter_2)
number_slider_4 = Slider(1.6, range=0..10)
pt_4 = PointOriented(BasePlane=pln, UComponent=num_6, VComponent=num_5, WComponent=0)
pl_4 = ConstructPlane(Origin=pt_4, XAxis=Vector(1, 0, 0), YAxis=Vector(0, 1, 0))
length_3 = Number(number_slider_4)
height_3 = Number(number_slider_4)
rectangle_3 = Rectangle(Plane=pl_4, XSize=length_3, YSize=height_3, Radius=0)  # -> Rectangle, Length

# ----
# rectangle和curve数据类型的区别
rec_2 = Rectangle(rectangle.Rectangle)
crv_5 = Curve(rectangle.Rectangle)
equals = Equality(FirstNumber=rec_2, SecondNumber=crv_5)  # -> Equality, Inequality

# ----
# 无法轻易把empty替换
pt_5 = Point(ccx.Points)
bool_2 = Boolean(pt_5)
toggle = BooleanToggle(False)
bang_2 = ExplodeTree(Data=simplify(bool_2))  # -> Branch0, Branch1
int = Integer(pt_5)
nullrep = ReplaceNulls(Items=int, Replacements=toggle)  # -> Items, Count
replace = ReplaceMembers(Set=bool_2, Replace=toggle)

# ----
# polyline的组成和分解
# couterclockwise 逆时针
# clockwise 顺时针
pt_6 = Point(explode.Vertices)
rev = ReverseList(List=pt_6)
pline = PolyLine(Vertices=rev, Closed=False)
pline_2 = PolyLine(Vertices=pt_6, Closed=False)
explode_2 = Explode(Curve=pline, Recursive=True)  # -> Segments, Vertices
pt_7 = Point(pt_6)
reversepts = Point(explode_2.Vertices)
points = PointList(Points=pt_7, Size=Slider(0.72, range=0..10))
