# Grasshopper definition 20170306_pushBox02.gh (Grasshopper 0.9.76)

md_slider = MDSlider(slider_value=Point(0, 1, 0.5), SliderMode=0, x_domain=Domain(0, 10), y_domain=Domain(0, 10), z_domain=Domain(0, 1))
md_slider_2 = MDSlider(slider_value=Point(0, 0, 0.5), SliderMode=0, x_domain=Domain(0, 1), y_domain=Domain(0, 1), z_domain=Domain(0, 1))
number_slider = Slider(0, range=0..10)
pln = Plane(md_slider)
num = Number(Slider(16.44, range=0..100))
pln_2 = Plane(md_slider_2)
number_slider_2 = Slider(1.6, range=0..10)
series = Series(Start=0, Step=num, Count=2)
pt = Point(pln)
intitial_box_pt_x = Number(Slider(8.52, range=0..10))
intitial_box_pt_x_2 = Number(Slider(7.83, range=0..10))
pt_2 = PointOriented(BasePlane=pln, UComponent=series, VComponent=0, WComponent=0)
holelength = Number(Slider(2.8, range=0..30))
holelocation = Number(Slider(7.5, range=0..30))
holeheight = Number(Slider(0.6, range=0..30))
num_2 = Number(number_slider)
num_3 = Number(Slider(7.25, range=0..10))
number_slider_3 = Slider(1.6, range=0..10)
length = Number(number_slider_2)
height = Number(number_slider_2)

addition = Addition(A=holelocation, B=holelength)
smaller = SmallerThan(FirstNumber=intitial_box_pt_x, SecondNumber=addition)  # -> SmallerThan, OrEqualTo
larger = LargerThan(FirstNumber=intitial_box_pt_x, SecondNumber=holelocation)  # -> LargerThan, OrEqualTo
and = GateAnd(A=larger.LargerThan, B=smaller.SmallerThan)

pt_3 = PointOriented(BasePlane=pln_2, UComponent=num_3, VComponent=Slider(0, range=0..10), WComponent=0)
pline = PolyLine(Vertices=pt_2, Closed=False)
pt_4 = PointOriented(BasePlane=pln_2, UComponent=intitial_box_pt_x_2, VComponent=num_2, WComponent=0)
len = Length(Curve=pline)

# ----
# reparameterize后输入[0,1]区间
number_slider_4 = Slider(0.231, range=0..1)
holelocation_para = Number(Slider(0.499, range=0..1))
holelength_para = Number(number_slider_4)
addition_2 = Addition(A=holelocation_para, B=holelength_para)
dom = ConstructDomain(DomainStart=holelocation_para, DomainEnd=addition_2)
domain_para = Domain(dom)
remap = RemapNumbers(Value=addition_2, Source=Domain(0, 1), Target=len)  # -> Mapped, Clipped

pl = ConstructPlane(Origin=pt_3, XAxis=Vector(1, 0, 0), YAxis=Vector(0, 1, 0))
pl_2 = ConstructPlane(Origin=pt_4, XAxis=Vector(1, 0, 0), YAxis=Vector(0, 1, 0))
length_2 = Number(number_slider_3)
height_2 = Number(number_slider_3)
radius = Number(Slider(0.294, range=0..1))
addition_3 = Addition(A=intitial_box_pt_x, B=length)
cir = Circle(Plane=pl, Radius=radius)
rectangle = Rectangle(Plane=pl_2, XSize=length_2, YSize=height_2, Radius=0)  # -> Rectangle, Length

# ----
# 输入holeLength，转化成[0,1]区间
merge = Merge(Data1=holelocation, Data2=holelength)
division = Division(A=merge, B=len)
consec = ConsecutiveDomains(Numbers=division, Additive=True)
domain = Domain(consec)

consec_2 = ConsecutiveDomains(Numbers=merge, Additive=True)
inc = Includes(Value=intitial_box_pt_x, Domain=consec_2)  # -> Includes, Deviation

human_pt_x = Number(num_3)
inc_2 = Includes(Value=addition_3, Domain=consec_2)  # -> Includes, Deviation
box_pt_x = Number(intitial_box_pt_x_2)
crv = Curve(rectangle.Rectangle)
crv_2 = Curve(cir)
radius_2 = Number(radius)

# ----
# mapping的逆用
remap_2 = RemapNumbers(Value=holelocation, Source=len, Target=Domain(0, 1))  # -> Mapped, Clipped
remap_3 = RemapNumbers(Value=holelength, Source=len, Target=Domain(0, 1))  # -> Mapped, Clipped
merge_2 = Merge(Data1=remap_2.Mapped, Data2=remap_3.Mapped)
consec_3 = ConsecutiveDomains(Numbers=merge_2, Additive=True)
domain_2 = Domain(consec_3)

explode = Explode(Curve=crv, Recursive=True)  # -> Segments, Vertices
# 小球运动的方向  True -->
rec = DataRecorder(human_pt_x, DataLimit=2, RecordData=True)
and_2 = GateAnd(A=inc_2.Includes, B=inc.Includes)
addition_4 = Addition(A=holelocation, B=holelength)
panel = Panel("""3
1""")
item = ListItem(List=explode.Segments, Index="1", Wrap=True)  # -> Item, Item1, Item2
item_2 = ListItem(List=rec, Index=0, Wrap=True)  # -> Item, Item1
item_3 = ListItem(List=explode.Segments, Index=panel, Wrap=True)
subtraction = Subtraction(A=addition_4, B=length)
neg = Negative(Value=holeheight)
larger_2 = LargerThan(FirstNumber=intitial_box_pt_x, SecondNumber=subtraction)  # -> LargerThan, OrEqualTo
rightcurve = Curve(item.Item)
crv_3 = Curve(item_3)
leftcurve = Curve(item.Item2)
filter = StreamFilter(Gate=and_2, Stream0="0", Stream1=neg)
subtraction_2 = Subtraction(A=item_2.Item1, B=item_2.Item)
ccx = CurveCurve(CurveA=crv_3, CurveB=crv_2)  # -> Points, ParamsA, ParamsB
filter_2 = StreamFilter(Gate=larger_2.LargerThan, Stream0=intitial_box_pt_x, Stream1=subtraction)
finally_box_pt_x = Number(filter_2)
panel_2 = Panel(finally_box_pt_x)
finally_box_pt_y = Number(filter)
smaller_2 = SmallerThan(FirstNumber=subtraction_2, SecondNumber="0")  # -> SmallerThan, OrEqualTo
larger_3 = LargerThan(FirstNumber=subtraction_2, SecondNumber="0")  # -> LargerThan, OrEqualTo
item_4 = ListItem(List=crv_3, Index=0, Wrap=True)  # -> Item, Item1

lng = ListLength(List=ccx.Points)
bool = Boolean(lng)
bang = ExplodeTree(Data=simplify(bool))  # -> Branch0, Branch1

addition_5 = Addition(A=length_2, B=radius_2)
crv_4 = Curve(item_4.Item1)
addition_6 = Addition(A=human_pt_x, B=radius_2)
and_3 = GateAnd(A=bang.Branch0, B=larger_3.LargerThan)
subtraction_3 = Subtraction(A=human_pt_x, B=addition_5)
and_4 = GateAnd(A=bang.Branch1, B=smaller_2.SmallerThan)
panel_3 = Panel(item_4.Item)
filter_3 = StreamFilter(Gate=and_3, Stream0=box_pt_x, Stream1=addition_6)
filter_4 = StreamFilter(Gate=and_4, Stream0=box_pt_x, Stream1=subtraction_3)
panel_4 = Panel(filter_3)
panel_5 = Panel(filter_4)

num_4 = Number(number_slider)
num_5 = Number(filter_3)
number_slider_5 = Slider(1.6, range=0..10)
pt_5 = PointOriented(BasePlane=pln_2, UComponent=num_5, VComponent=num_4, WComponent=0)
pl_3 = ConstructPlane(Origin=pt_5, XAxis=Vector(1, 0, 0), YAxis=Vector(0, 1, 0))
length_3 = Number(number_slider_5)
height_3 = Number(number_slider_5)
rectangle_2 = Rectangle(Plane=pl_3, XSize=length_3, YSize=height_3, Radius=0)  # -> Rectangle, Length

num_6 = Number(number_slider)
num_7 = Number(filter_4)
number_slider_6 = Slider(1.6, range=0..10)
pt_6 = PointOriented(BasePlane=pln_2, UComponent=num_7, VComponent=num_6, WComponent=0)
pl_4 = ConstructPlane(Origin=pt_6, XAxis=Vector(1, 0, 0), YAxis=Vector(0, 1, 0))
length_4 = Number(number_slider_6)
height_4 = Number(number_slider_6)
rectangle_3 = Rectangle(Plane=pl_4, XSize=length_4, YSize=height_4, Radius=0)  # -> Rectangle, Length

item_5 = ListItem(List=pt_2, Index=0, Wrap=True)  # -> Item, Item1
subcrv = SubCurve(BaseCurve=reparameterize(pline), Domain=domain)
offset = Offset(Curve=subcrv, Distance=holeheight, Plane=pln, Corners=1)
end = EndPoints(Curve=offset)  # -> Start, End
end_2 = EndPoints(Curve=subcrv)  # -> Start, End
pt_7 = PointOriented(BasePlane=pln, UComponent=finally_box_pt_x, VComponent=finally_box_pt_y, WComponent=0)
merge_3 = Merge(Data1=end_2.Start, Data2=end_2.End)
merge_4 = Merge(Data1=end.Start, Data2=end.End)
pl_5 = ConstructPlane(Origin=pt_7, XAxis=Vector(1, 0, 0), YAxis=Vector(0, 1, 0))
ln = Line(StartPoint=item_5.Item, EndPoint=end_2.Start)
ln_2 = Line(StartPoint=end_2.End, EndPoint=item_5.Item1)
ln_3 = Line(StartPoint=merge_3, EndPoint=merge_4)
pln_3 = Plane(pl_5)
rectangle_4 = Rectangle(Plane=pln_3, XSize=length, YSize=height, Radius=0)  # -> Rectangle, Length

# ----
# rectangle和curve数据类型的区别
rec_2 = Rectangle(rectangle.Rectangle)
crv_5 = Curve(rectangle.Rectangle)
equals = Equality(FirstNumber=rec_2, SecondNumber=crv_5)  # -> Equality, Inequality

# ----
# 无法轻易把empty替换
pt_8 = Point(ccx.Points)
bool_2 = Boolean(pt_8)
toggle = BooleanToggle(False)
bang_2 = ExplodeTree(Data=simplify(bool_2))  # -> Branch0, Branch1
int = Integer(pt_8)
nullrep = ReplaceNulls(Items=int, Replacements=toggle)  # -> Items, Count
replace = ReplaceMembers(Set=bool_2, Replace=toggle)

# ----
# polyline的组成和分解
# couterclockwise 逆时针
# clockwise 顺时针
pt_9 = Point(explode.Vertices)
rev = ReverseList(List=pt_9)
pline_2 = PolyLine(Vertices=rev, Closed=False)
pline_3 = PolyLine(Vertices=pt_9, Closed=False)
explode_2 = Explode(Curve=pline_2, Recursive=True)  # -> Segments, Vertices
pt_10 = Point(pt_9)
reversepts = Point(explode_2.Vertices)
points = PointList(Points=pt_10, Size=Slider(0.72, range=0..10))
