# Grasshopper definition 20170306_pushBox03.gh (Grasshopper 0.9.76)

md_slider = MDSlider(slider_value=Point(0, 1, 0.5), SliderMode=0, x_domain=Domain(0, 10), y_domain=Domain(0, 20), z_domain=Domain(0, 1))
number_slider = Slider(5, range=0..10)
pln = Plane(md_slider)
subtraction = Subtraction(A=number_slider, B=1)
md_slider_2 = MDSlider(slider_value=Point(0, 1, 0.5), SliderMode=0, x_domain=Domain(0, 10), y_domain=Domain(0, 10), z_domain=Domain(0, 1))
pt = Point(pln)
md_slider_3 = MDSlider(slider_value=Point(0, 0, 0.5), SliderMode=0, x_domain=Domain(0, 1), y_domain=Domain(0, 1), z_domain=Domain(0, 1))
int = Integer(subtraction)
series = Series(Start=0, Step=Slider(12.9, range=0..100), Count=number_slider)
number_slider_2 = Slider(0, range=0..10)
pln_2 = Plane(md_slider_2)
num = Number(Slider(20.13, range=0..100))
number_slider_3 = Slider(1.6, range=0..10)
series_2 = Series(Start=0, Step=Slider(4.85, range=0..10), Count=int)
stack = StackData(Data=series, Stack=2)
pln_3 = Plane(md_slider_3)
shift = ShiftList(List=series, Shift=1, Wrap=False)
shift_2 = ShiftList(List=series, Shift=-1, Wrap=False)
series_3 = Series(Start=0, Step=num, Count=2)
pt_2 = Point(pln_2)

number_slider_4 = Slider(3.3, range=0..10)
length = Number(number_slider_4)
height = Number(number_slider_4)

shift_3 = ShiftList(List=stack, Shift=1, Wrap=False)
stack_2 = StackData(Data=series_2, Stack=2)
dom = ConstructDomain(DomainStart=shift_2, DomainEnd=shift)
intitial_box_pt_x = Number(Slider(7.83, range=0..10))
pt_3 = PointOriented(BasePlane=pln_2, UComponent=series_3, VComponent=0, WComponent=0)
shift_4 = ShiftList(List=shift_3, Shift=-1, Wrap=False)
neg = Negative(Value=stack_2)
pt_4 = PointOriented(BasePlane=pln, UComponent=shift_4, VComponent=neg, WComponent=0)
num_2 = Number(number_slider_2)
num_3 = Number(Slider(7.25, range=0..10))
number_slider_5 = Slider(1.6, range=0..10)
holelocation = Number(Slider(6.6, range=0..30))
holelength = Number(Slider(3.7, range=0..30))
holeheight = Number(Slider(4.9, range=0..30))
length_2 = Number(number_slider_3)
height_2 = Number(number_slider_3)
intitial_box_pt_x_2 = Number(Slider(7.53, range=0..15))
pt_5 = PointOriented(BasePlane=pln_3, UComponent=num_3, VComponent=Slider(0, range=0..10), WComponent=0)
pt_6 = PointOriented(BasePlane=pln_3, UComponent=intitial_box_pt_x, VComponent=num_2, WComponent=0)
pline = PolyLine(Vertices=pt_4, Closed=False)
intitial_box_pt_x_3 = Number(Slider(7.3, range=0..50))
pline_2 = PolyLine(Vertices=pt_3, Closed=False)
pl = ConstructPlane(Origin=pt_5, XAxis=Vector(1, 0, 0), YAxis=Vector(0, 1, 0))
pl_2 = ConstructPlane(Origin=pt_6, XAxis=Vector(1, 0, 0), YAxis=Vector(0, 1, 0))
length_3 = Number(number_slider_5)
height_3 = Number(number_slider_5)
radius = Number(Slider(0.294, range=0..1))
fdom = FindDomain(Domains=dom, Number=intitial_box_pt_x_3, Strict=False)  # -> Index, Neighbour
cir = Circle(Plane=pl, Radius=radius)
rectangle = Rectangle(Plane=pl_2, XSize=length_3, YSize=height_3, Radius=0)  # -> Rectangle, Length
item = ListItem(List=series_2, Index=fdom.Index, Wrap=True)

# ----
# 输入holeLength，转化成[0,1]区间
merge = Merge(Data1=holelocation, Data2=holelength)
len = Length(Curve=pline_2)
division = Division(A=merge, B=len)
consec = ConsecutiveDomains(Numbers=division, Additive=True)
domain = Domain(consec)

addition = Addition(A=holelocation, B=holelength)
subtraction_2 = Subtraction(A=addition, B=length_2)

# ----
# 判断是否会陷入洞中
larger = LargerThan(FirstNumber=intitial_box_pt_x_2, SecondNumber=holelocation)  # -> LargerThan, OrEqualTo
smaller = SmallerThan(FirstNumber=length_2, SecondNumber=holelength)  # -> SmallerThan, OrEqualTo
dom_2 = ConstructDomain(DomainStart=holelocation, DomainEnd=subtraction_2)
and = GateAnd(A=larger.LargerThan, B=smaller.SmallerThan)
domain_2 = Domain(dom_2)
larger_2 = LargerThan(FirstNumber=intitial_box_pt_x_2, SecondNumber=subtraction_2)  # -> LargerThan, OrEqualTo
inc = Includes(Value=intitial_box_pt_x_2, Domain=domain_2)  # -> Includes, Deviation
filter = StreamFilter(Gate=and, Stream1=and)
int_2 = Integer(inc.Includes)
int_3 = Integer(larger_2.LargerThan)
rec = DataRecorder(filter, DataLimit=1, RecordData=True)
panel = Panel("""10
11
00
01""")
panel_2 = Panel("""0
0
1
2""")
concat = Concatenate(FragmentA=int_2, FragmentB=int_3)
replace = ReplaceMembers(Set=concat, Find=panel, Replace=panel_2)
filter_2 = StreamFilter(Gate=replace, Stream0=intitial_box_pt_x_2, Stream1=holelocation, Stream2=subtraction_2)
filter_3 = StreamFilter(Gate=rec, Stream0=intitial_box_pt_x_2, Stream1=filter_2)

# ----
# reparameterize后输入[0,1]区间
number_slider_6 = Slider(0.231, range=0..1)
holelocation_para = Number(Slider(0.499, range=0..1))
holelength_para = Number(number_slider_6)
addition_2 = Addition(A=holelocation_para, B=holelength_para)
dom_3 = ConstructDomain(DomainStart=holelocation_para, DomainEnd=addition_2)
domain_para = Domain(dom_3)
remap = RemapNumbers(Value=addition_2, Source=Domain(0, 1), Target=len)  # -> Mapped, Clipped

human_pt_x = Number(num_3)
box_pt_x = Number(intitial_box_pt_x)
crv = Curve(rectangle.Rectangle)
crv_2 = Curve(cir)
radius_2 = Number(radius)
neg_2 = Negative(Value=item)
larger_3 = LargerThan(FirstNumber=intitial_box_pt_x_2, SecondNumber=subtraction_2)  # -> LargerThan, OrEqualTo
explode = Explode(Curve=crv, Recursive=True)  # -> Segments, Vertices
# 小球运动的方向  True -->
rec_2 = DataRecorder(human_pt_x, DataLimit=2, RecordData=True)
panel_3 = Panel("""3
1""")
filter_4 = StreamFilter(Gate=larger_3.LargerThan, Stream0=intitial_box_pt_x_2, Stream1=subtraction_2)
item_2 = ListItem(List=explode.Segments, Index="1", Wrap=True)  # -> Item, Item1, Item2
item_3 = ListItem(List=rec_2, Index=0, Wrap=True)  # -> Item, Item1
item_4 = ListItem(List=explode.Segments, Index=panel_3, Wrap=True)
pt_7 = PointOriented(BasePlane=pln, UComponent=intitial_box_pt_x_3, VComponent=neg_2, WComponent=0)
finally_box_pt_x = Number(filter_3)
rightcurve = Curve(item_2.Item)
crv_3 = Curve(item_4)
leftcurve = Curve(item_2.Item2)
subtraction_3 = Subtraction(A=item_3.Item1, B=item_3.Item)
pl_3 = ConstructPlane(Origin=pt_7, XAxis=Vector(1, 0, 0), YAxis=Vector(0, 1, 0))
ccx = CurveCurve(CurveA=crv_3, CurveB=crv_2)  # -> Points, ParamsA, ParamsB

consec_2 = ConsecutiveDomains(Numbers=merge, Additive=True)
inc_2 = Includes(Value=finally_box_pt_x, Domain=consec_2)  # -> Includes, Deviation

# ----
# level0:箱子进入洞中，前面绘制轨道可用几何
# level1:以上，轨道绘制不用offset
# level2:以上，箱子不再出来
# 
# level3:以上，同一平轨道中有多个洞
# level4:以上，可对洞进行开关
addition_3 = Addition(A=finally_box_pt_x, B=length_2)

addition_4 = Addition(A=holelocation, B=holelength)
smaller_2 = SmallerThan(FirstNumber=intitial_box_pt_x_2, SecondNumber=addition_4)  # -> SmallerThan, OrEqualTo
larger_4 = LargerThan(FirstNumber=intitial_box_pt_x_2, SecondNumber=holelocation)  # -> LargerThan, OrEqualTo
and_2 = GateAnd(A=larger_4.LargerThan, B=smaller_2.SmallerThan)

smaller_3 = SmallerThan(FirstNumber=subtraction_3, SecondNumber="0")  # -> SmallerThan, OrEqualTo
larger_5 = LargerThan(FirstNumber=subtraction_3, SecondNumber="0")  # -> LargerThan, OrEqualTo
item_5 = ListItem(List=crv_3, Index=0, Wrap=True)  # -> Item, Item1

lng = ListLength(List=ccx.Points)
bool = Boolean(lng)
bang = ExplodeTree(Data=simplify(bool))  # -> Branch0, Branch1

inc_3 = Includes(Value=addition_3, Domain=consec_2)  # -> Includes, Deviation
pln_4 = Plane(pl_3)
addition_5 = Addition(A=length_3, B=radius_2)
crv_4 = Curve(item_5.Item1)
rectangle_2 = Rectangle(Plane=pln_4, XSize=length, YSize=height, Radius=0)  # -> Rectangle, Length
and_3 = GateAnd(A=inc_3.Includes, B=inc_2.Includes)
addition_6 = Addition(A=human_pt_x, B=radius_2)
and_4 = GateAnd(A=bang.Branch0, B=larger_5.LargerThan)
subtraction_4 = Subtraction(A=human_pt_x, B=addition_5)
and_5 = GateAnd(A=bang.Branch1, B=smaller_3.SmallerThan)
panel_4 = Panel(item_5.Item)
neg_3 = Negative(Value=holeheight)
filter_5 = StreamFilter(Gate=and_4, Stream0=box_pt_x, Stream1=addition_6)
filter_6 = StreamFilter(Gate=and_5, Stream0=box_pt_x, Stream1=subtraction_4)
filter_7 = StreamFilter(Gate=and_3, Stream0="0", Stream1=neg_3)

# ----
# mapping的逆用
remap_2 = RemapNumbers(Value=holelocation, Source=len, Target=Domain(0, 1))  # -> Mapped, Clipped
remap_3 = RemapNumbers(Value=holelength, Source=len, Target=Domain(0, 1))  # -> Mapped, Clipped
merge_2 = Merge(Data1=remap_2.Mapped, Data2=remap_3.Mapped)
consec_3 = ConsecutiveDomains(Numbers=merge_2, Additive=True)
domain_3 = Domain(consec_3)

finally_box_pt_y = Number(filter_7)
panel_5 = Panel(filter_5)
panel_6 = Panel(filter_6)

num_4 = Number(number_slider_2)
num_5 = Number(filter_5)
number_slider_7 = Slider(1.6, range=0..10)
pt_8 = PointOriented(BasePlane=pln_3, UComponent=num_5, VComponent=num_4, WComponent=0)
pl_4 = ConstructPlane(Origin=pt_8, XAxis=Vector(1, 0, 0), YAxis=Vector(0, 1, 0))
length_4 = Number(number_slider_7)
height_4 = Number(number_slider_7)
rectangle_3 = Rectangle(Plane=pl_4, XSize=length_4, YSize=height_4, Radius=0)  # -> Rectangle, Length

num_6 = Number(number_slider_2)
num_7 = Number(filter_6)
number_slider_8 = Slider(1.6, range=0..10)
pt_9 = PointOriented(BasePlane=pln_3, UComponent=num_7, VComponent=num_6, WComponent=0)
pl_5 = ConstructPlane(Origin=pt_9, XAxis=Vector(1, 0, 0), YAxis=Vector(0, 1, 0))
length_5 = Number(number_slider_8)
height_5 = Number(number_slider_8)
rectangle_4 = Rectangle(Plane=pl_5, XSize=length_5, YSize=height_5, Radius=0)  # -> Rectangle, Length

item_6 = ListItem(List=pt_3, Index=0, Wrap=True)  # -> Item, Item1
subcrv = SubCurve(BaseCurve=reparameterize(pline_2), Domain=domain)
offset = Offset(Curve=subcrv, Distance=holeheight, Plane=pln_2, Corners=1)
pt_10 = PointOriented(BasePlane=pln_2, UComponent=finally_box_pt_x, VComponent=finally_box_pt_y, WComponent=0)
end = EndPoints(Curve=offset)  # -> Start, End
end_2 = EndPoints(Curve=subcrv)  # -> Start, End
pl_6 = ConstructPlane(Origin=pt_10, XAxis=Vector(1, 0, 0), YAxis=Vector(0, 1, 0))
merge_3 = Merge(Data1=end_2.Start, Data2=end_2.End)
merge_4 = Merge(Data1=end.Start, Data2=end.End)
pln_5 = Plane(pl_6)
rectangle_5 = Rectangle(Plane=pln_5, XSize=length_2, YSize=height_2, Radius=0)  # -> Rectangle, Length
ln = Line(StartPoint=item_6.Item, EndPoint=end_2.Start)
ln_2 = Line(StartPoint=end_2.End, EndPoint=item_6.Item1)
ln_3 = Line(StartPoint=merge_3, EndPoint=merge_4)
crv_5 = Curve(offset)

# ----
# rectangle和curve数据类型的区别
rec_3 = Rectangle(rectangle.Rectangle)
crv_6 = Curve(rectangle.Rectangle)
equals = Equality(FirstNumber=rec_3, SecondNumber=crv_6)  # -> Equality, Inequality

# ----
# 无法轻易把empty替换
pt_11 = Point(ccx.Points)
bool_2 = Boolean(pt_11)
toggle = BooleanToggle(False)
bang_2 = ExplodeTree(Data=simplify(bool_2))  # -> Branch0, Branch1
int_4 = Integer(pt_11)
nullrep = ReplaceNulls(Items=int_4, Replacements=toggle)  # -> Items, Count
replace_2 = ReplaceMembers(Set=bool_2, Replace=toggle)

# ----
# polyline的组成和分解
# couterclockwise 逆时针
# clockwise 顺时针
pt_12 = Point(explode.Vertices)
rev = ReverseList(List=pt_12)
pline_3 = PolyLine(Vertices=rev, Closed=False)
pline_4 = PolyLine(Vertices=pt_12, Closed=False)
explode_2 = Explode(Curve=pline_3, Recursive=True)  # -> Segments, Vertices
pt_13 = Point(pt_12)
reversepts = Point(explode_2.Vertices)
points = PointList(Points=pt_13, Size=Slider(0.72, range=0..10))
