# Grasshopper definition 20170314_taskbook_3DForm.gh (Grasshopper 0.9.76)

# ----
# 生成-->蓝色
# 解析-->黄色
# 数据-->白色
# 向量-->红色
# 预览-->紫色
panel = Panel("""数据组织
交错韵律
最小单元""")
sqgrid = Square(Plane=PlaneXY(0, 0, 0), Size=1, ExtentX=5, ExtentY=5)  # -> Cells, Points

path_mapper = PathMapper()
viewer = ParamViewer()

partition = PartitionList(Size=[3, 2])
tstat = TreeStatistics()  # -> Paths, Length, Count
shift = ShiftList(Shift=1, Wrap=True)
entwine = Entwine(FlattenInputs=True)
dup = DuplicateData(Number=2, Order=True)
item = ListItem(Index=0, Wrap=True)

area = Area()  # -> Area, Centroid
curvepoint = PointOnCurve(parameter=0.5)

points = PointList()
preview = CustomPreview(Shader={ambient=RGB(0, 0, 0), diffuse=RGB(255, 105, 180), emission=RGB(76, 32, 54), shine=0.5, specular=RGB(255, 255, 255), transparency=0})
vdis = VectorDisplay()

del = DelaunayMesh(Plane=PlaneXY(0, 0, 0))
pline = PolyLine(Closed=False)
ln = Line()

unit = UnitVector()
amp = Amplitude(Amplitude=1)

# ----
# 生成-->蓝色
# 解析-->黄色
# 数据-->白色
# 向量-->红色
# 变形-->绿色
# 预览-->紫色
panel_2 = Panel("""树形数据
平面渐变
空间渐变
单向渐变
对角渐变
等分旋转
色彩渐变""")
# 生成-->蓝色
# 解析-->黄色
# 数据-->白色
# 向量-->红色
# 变形-->绿色
# 预览-->紫色
panel_3 = Panel("""建模思路
函数找形
非样变形""")
panel_4 = Panel("""解域成点
节点插入
图形映射
色彩渐变""")

graph = GraphMapper(
    x0=0,
    x1=1,
    y0=0,
    y1=1,
    container_name="Sine Summation",
    Equation0_px=[0.2, 0.2004867792],
    Equation0_py=[0.2, 0.3020638824],
    Equation1_px=[0.6, 0.5952462554],
    Equation1_py=[0.3, 0.6849507093])
remap = RemapNumbers(Source=Domain(0, 1), Target=Domain(0, 1))  # -> Mapped, Clipped
item_2 = ListItem(Index=0, Wrap=True)
eval = Evaluate()
sort = SortList()  # -> Keys, ValuesA
range = Range(Domain=Domain(0, 1), Steps=10)

divide = DivideCurve(Count=10, Kinks=False)  # -> Points, Tangents, Parameters
edges = BrepEdges()  # -> Naked, Interior, NonManifold
devec = DeconstructVector()  # -> XComponent, YComponent, ZComponent

intcrv = Interpolate(Degree=3, Periodic=False, KnotStyle=1)  # -> Curve, Length, Domain
extr = Extrude()
join = BrepJoin()  # -> Breps, Closed
line = LineSDL(Direction=Vector(0, 0, 1), Length=1)
loft = Loft(Options={Adjust=False, Closed=False, LoftEnds=0, LoftSimp=0, LoftType=0, Rebuild=10, Refit=0.01})

scale_nu = ScaleNU(Plane=PlaneXY(0, 0, 0), ScaleX=1, ScaleY=1, ScaleZ=1)  # -> Geometry, Transform

ln_2 = Line()
rectangle = Rectangle(Plane=PlaneXY(0, 0, 0), XSize=Domain(-1, 1), YSize=Domain(-2, 2), Radius=0)  # -> Rectangle, Length
pline_2 = PolyLine(Closed=False)
boundary = BoundarySurfaces()

series = Series(Start=0, Step=1, Count=10)
range_2 = Range(Domain=Domain(0, 1), Steps=10)
merge = Merge()
item_3 = ListItem(Index=0, Wrap=True)
ins = InsertItems(Wrap=True)

X = UnitX(Factor=1)
amp_2 = Amplitude(Amplitude=1)

group = Group()
move = Move(Motion=Vector(0, 0, 10))  # -> Geometry, Transform
extr_2 = Extrude()

gradient = Gradient(LowerLimit=0, UpperLimit=1, stops=[0.15: RGB(255, 130, 160), 0.85: RGB(220, 0, 40)])
preview_2 = CustomPreview(Shader={ambient=RGB(0, 0, 0), diffuse=RGB(255, 105, 180), emission=RGB(76, 32, 54), shine=0.5, specular=RGB(255, 255, 255), transparency=0})

devec_2 = DeconstructVector()  # -> XComponent, YComponent, ZComponent
vec = VectorXYZ(XComponent=0, YComponent=0, ZComponent=0)  # -> Vector, Length
vec2pt = Vector2Pt(Unitize=False)  # -> Vector, Length

md_slider = MDSlider(slider_value=Point(0.5, 0.5, 0.5), SliderMode=0, x_domain=Domain(0, 1), y_domain=Domain(0, 1), z_domain=Domain(0, 1))
prot = RotatePlane()
remap_2 = RemapNumbers(Source=Domain(0, 1), Target=Domain(0, 1))  # -> Mapped, Clipped
graph_2 = GraphMapper(x0=0, x1=1, y0=0, y1=1, container_name="Sine", Equation_px=[0, 1], Equation_py=[0, 1])

eval_2 = EvaluateCurve()  # -> Point, Tangent, Angle
disc = Discontinuity(Level=1)  # -> Points, Parameters

intcrv_2 = Interpolate(Degree=3, Periodic=False, KnotStyle=1)  # -> Curve, Length, Domain
pline_3 = PolyLine(Closed=False)
sqgrid_2 = Square(Plane=PlaneXY(0, 0, 0), Size=1, ExtentX=5, ExtentY=5)  # -> Cells, Points

range_3 = Range(Domain=Domain(0, 1), Steps=10)
bnd = Bounds()
dedomain = DeconstructDomain()  # -> Start, End
path_mapper_2 = PathMapper()
dom = ConstructDomain(DomainStart=0, DomainEnd=1)
tstat_2 = TreeStatistics()  # -> Paths, Length, Count
remap_3 = RemapNumbers(Source=Domain(0, 1), Target=Domain(0, 1))  # -> Mapped, Clipped
shift_2 = ShiftList(Shift=1, Wrap=True)

Z = UnitZ(Factor=1)
X_2 = UnitX(Factor=1)
amp_3 = Amplitude(Amplitude=1)

explode = Explode(Recursive=True)  # -> Segments, Vertices

move_2 = Move(Motion=Vector(0, 0, 10))  # -> Geometry, Transform
rotate = Rotate(Angle=1.570796327, Plane=PlaneXY(0, 0, 0))  # -> Geometry, Transform
scale = Scale(Center=Point(0, 0, 0), Factor=0.5)  # -> Geometry, Transform

gradient_2 = Gradient(LowerLimit=0, UpperLimit=1, stops=[0.15: RGB(255, 130, 160), 0.85: RGB(220, 0, 40)])
preview_3 = CustomPreview(Shader={ambient=RGB(0, 0, 0), diffuse=RGB(255, 105, 180), emission=RGB(76, 32, 54), shine=0.5, specular=RGB(255, 255, 255), transparency=0})

deface = DeconstructFace()  # -> CornerA, CornerB, CornerC, CornerD
conmesh = ConstructMesh(Vertices=[Point(0, 0, 0), Point(10, 0, 0), Point(10, 10, 0), Point(0, 10, 0)], Faces={A=0, B=1, C=2, D=3})
hull = ConvexHull(Plane=PlaneXY(0, 0, 0))  # -> Hull, HullZ, Indices
mesh = MeshBrep(Settings={GridMaxCount=0, GridMinCount=16, JaggedSeams=False, MaxEdgeLength=0, MinEdgeLength=0.0001, MinTolerance=0, Refine=True, RefineAngle=0, RelativeTolerance=0.65, SimplePlanes=True, Tolerance=0})
panel_5 = Panel("mesh应用")
panel_6 = Panel("Transform(变形)体")
panel_7 = Panel("""几何求交
几何割补
碰撞检测""")
scale_2 = Scale(Center=Point(0, 0, 0), Factor=0.5)  # -> Geometry, Transform
arrcurve = CurveArray(Count=10)  # -> Geometry, Transform
mirror = Mirror(Plane=PlaneYZ(0, 0, 0))  # -> Geometry, Transform
blendbox = BlendBox()
comp = Compound()
group_2 = Group()
panel_8 = Panel("""曲面生成
曲面分析
几何生成
几何操作""")
slits = BoxSlits(Gap=0)  # -> Breps, Topology
rslits = RegionSlits(Gap=0)  # -> Regions, Topology
split = SplitBrep()
mcx = MeshCurve()  # -> Points, Faces

number_slider = Slider(100, range=0..100)
number_slider_2 = Slider(3.2, range=0..10)
pi = Pi(Factor=Slider(9, range=0..10))
range_4 = Range(Domain=pi, Steps=number_slider)
range_5 = Range(Domain=Domain(0, 1), Steps=number_slider)
range_6 = Range(Domain=Domain(0, 1), Steps=number_slider)
graph_3 = GraphMapper(
    range_5,
    x0=0,
    x1=1,
    y0=-1,
    y1=1,
    container_name="Bezier",
    cpx=[0, 0.6925650835, 0.395832777, 1],
    cpy=[0.8004057407, 0.5106195211, 0.5397279859, 1])
graph_4 = GraphMapper(
    range_6,
    x0=0,
    x1=1,
    y0=0,
    y1=1,
    container_name="Bezier",
    cpx=[0, 0.5397330523, 0.7577240467, 1],
    cpy=[0, 0.5831472278, 0.3482969403, 0])
eval_3 = Evaluate(F="a*sin(x)", a=number_slider_2, x=range_4)
eval_4 = Evaluate(F="a*cos(x)", a=number_slider_2, x=range_4)
dom_2 = ConstructDomain(DomainStart=Slider(0.05, range=0..0.1), DomainEnd=Slider(1.5, range=0..10))
remap_4 = RemapNumbers(Value=graph_4, Source="0 to 1", Target=Slider(21, range=0..100))  # -> Mapped, Clipped
remap_5 = RemapNumbers(Value=graph_3, Source="0 to 1", Target=dom_2)  # -> Mapped, Clipped
pt = ConstructPoint(XCoordinate=eval_3, YCoordinate=eval_4, ZCoordinate=remap_4.Mapped)
scale_nu_2 = ScaleNU(Geometry=pt, Plane=PlaneXY(0, 0, 0), ScaleX=remap_5.Mapped, ScaleY=remap_5.Mapped, ScaleZ=1)  # -> Geometry, Transform
intcrv_3 = Interpolate(Vertices=scale_nu_2.Geometry, Degree=3, Periodic=False, KnotStyle=1)  # -> reparameterize(Curve), Length, Domain
number_slider_3 = Slider(100, range=0..100)
divide_2 = DivideCurve(Curve=intcrv_3.Curve, Count=number_slider_3, Kinks=False)  # -> Points, Tangents, Parameters
pt_2 = Point(Point(0, 0, 0))
range_7 = Range(Domain=Domain(0, 1), Steps=number_slider_3)
vec2pt_2 = Vector2Pt(PointA=pt_2, PointB=divide_2.Points, Unitize=False)  # -> Vector, Length
graph_5 = GraphMapper(
    range_7,
    x0=0,
    x1=1,
    y0=0,
    y1=1,
    container_name="Bezier",
    cpx=[0, 0.2336956561, 0.3797094226, 1],
    cpy=[0, 0.5054347515, 0, 0])
devec_3 = DeconstructVector(Vector=vec2pt_2.Vector)  # -> XComponent, YComponent, ZComponent
vec_2 = VectorXYZ(XComponent=devec_3.XComponent, YComponent=devec_3.YComponent, ZComponent=0)  # -> Vector, Length
dom_3 = ConstructDomain(DomainStart=Slider(0.8, range=0..1), DomainEnd=Slider(1.7, range=0..10))
remap_6 = RemapNumbers(Value=graph_5, Source=Domain(0, 1), Target=dom_3)  # -> Mapped, Clipped
line_2 = LineSDL(Start=divide_2.Points, Direction=expr("-x", vec_2.Vector), Length=remap_6.Mapped)
Z_2 = UnitZ(Factor=Slider(0.077, range=0..1))
loft_2 = Loft(Curves=line_2, Options={Adjust=False, Closed=False, LoftEnds=0, LoftSimp=0, LoftType=0, Rebuild=10, Refit=0.01})
extr_3 = Extrude(Base=loft_2, Direction=Z_2)
edges_2 = BrepEdges(Brep=loft_2)  # -> Naked, Interior, NonManifold
sort_2 = SortList(Keys=edges_2.Naked, ValuesA=edges_2.Naked)  # -> Keys, ValuesA
panel_9 = Panel("""2
3""")
item_4 = ListItem(List=sort_2.ValuesA, Index=panel_9, Wrap=True)
Z_3 = UnitZ(Factor=Slider(1.9, range=0..10))
extr_4 = Extrude(Base=item_4, Direction=Z_3)
cluster = Cluster(srf=extr_4, num=Slider(0.05, range=0..0.1))

md_slider_2 = MDSlider(
    slider_value=Point(0, 0, 0.5),
    SliderMode=0,
    x_domain=Domain(-100, 100),
    y_domain=Domain(-100, 100),
    z_domain=Domain(0, 1))
remap_7 = RemapNumbers(Value=Slider(1, range=0..1), Source=Domain(0, 1), Target=Domain(0, 6.283185307))  # -> Mapped, Clipped
prot_2 = RotatePlane(Plane=md_slider_2, Angle=remap_7.Mapped)
yz = YZPlane(Origin=prot_2)
distance = Number(Slider(3.934, range=0..10))
rectangle_2 = Rectangle(Plane=yz, XSize=Slider(10, range=0..10), YSize=Slider(2.364, range=0..10), Radius=0)  # -> Rectangle, Length
cout = Integer(Slider(18, range=0..100))
series_2 = Series(Start=0, Step=distance, Count=cout)
X_3 = UnitX(Factor=1)
range_8 = Range(Domain=Domain(0, 1), Steps=expr("x-1", cout))
disc_2 = Discontinuity(Curve=rectangle_2.Rectangle, Level=1)  # -> Points, Parameters
amp_4 = Amplitude(Vector=X_3, Amplitude=series_2)
graph_6 = GraphMapper(range_8, x0=0, x1=1, y0=0, y1=1, container_name="Sine", Equation_px=[0, 0.3466898501], Equation_py=[0, 1])
move_3 = Move(Geometry=disc_2.Points, Motion=graft(amp_4))  # -> Geometry, Transform
item_5 = ListItem(List=move_3.Geometry, Index="2", Wrap=True)  # -> Item, Item1
num = Number(graph_6)
ln_3 = Line(StartPoint=item_5.Item, EndPoint=item_5.Item1)
Z_4 = UnitZ(Factor=1)
height = Number(Slider(2.633, range=0..10))
eval_5 = EvaluateCurve(Curve=ln_3, Parameter=graft(num))  # -> Point, Tangent, Angle
amp_5 = Amplitude(Vector=Z_4, Amplitude=height)
move_4 = Move(Geometry=eval_5.Point, Motion=amp_5)  # -> Geometry, Transform
multiplication = Multiplication(A=distance, B=Slider(0.8222, range=0..1))
ins_2 = InsertItems(List=move_3.Geometry, Item=move_4.Geometry, Indices=3, Wrap=True)
X_4 = UnitX(Factor=1)
thickness = Number(multiplication)
pline_4 = PolyLine(Vertices=ins_2, Closed=True)
amp_6 = Amplitude(Vector=X_4, Amplitude=thickness)
move_5 = Move(Geometry=pline_4, Motion=amp_6)  # -> Geometry, Transform
merge_2 = Merge(Data1=pline_4, Data2=move_5.Geometry)
gradient_3 = Gradient(LowerLimit=0, UpperLimit=1, Parameter=num, stops=[0: RGB(0, 128, 0), 0.5: RGB(255, 255, 0), 1: RGB(255, 0, 0)])
boundary_2 = BoundarySurfaces(Edges=merge_2)
extr_5 = Extrude(Base=pline_4, Direction=amp_6)
group_3 = Group(Objects=[boundary_2, extr_5])
preview_4 = CustomPreview(Geometry=flatten(group_3), Shader=gradient_3)

md_slider_3 = MDSlider(
    slider_value=Point(0.6763210297, 0, 0.5),
    SliderMode=0,
    x_domain=Domain(-100, 100),
    y_domain=Domain(-100, 100),
    z_domain=Domain(0, 1))
remap_8 = RemapNumbers(Value=Slider(1, range=0..1), Source=Domain(0, 1), Target=Domain(0, 6.283185307))  # -> Mapped, Clipped
prot_3 = RotatePlane(Plane=md_slider_3, Angle=remap_8.Mapped)
dom_4 = ConstructDomain(DomainStart=Slider(0.098, range=0..1), DomainEnd=Slider(0.6, range=0..1))
pln = Plane(prot_3)
domain_v = Domain(dom_4)
sqgrid_3 = Square(Plane=pln, Size=1, ExtentX=Slider(6, range=0..10), ExtentY=Slider(8, range=0..10))  # -> Cells, Points
step_u = Number(Slider(0.34, range=0..1))
area_2 = Area(Geometry=sqgrid_3.Cells)  # -> Area, Centroid
tstat_3 = TreeStatistics(Tree=area_2.Centroid)  # -> Paths, Length, Count
count_v = Integer(tstat_3.Count)
range_9 = Range(Domain=domain_v, Steps=expr("x-  1", count_v))
dom_5 = ConstructDomain(DomainStart=Slider(0.098, range=0..1), DomainEnd=Slider(0.61, range=0..1))
addition = Addition(A=range_9, B=step_u)
lng = ListLength(List=area_2.Centroid)
domain = Domain(dom_5)
dom_6 = ConstructDomain(DomainStart=range_9, DomainEnd=addition)
range_10 = Range(Domain=domain, Steps=expr("x-1", lng))
domain_2 = Domain(dom_6)
range_11 = Range(Domain=domain_2, Steps=expr("x-1", tstat_3.Length))
scale_3 = Scale(Geometry=sqgrid_3.Cells, Center=area_2.Centroid, Factor=range_11)  # -> Geometry, Transform
Z_5 = UnitZ(Factor=1)
graft = GraftTree(Tree=scale_3.Geometry, IncludeEmptyLists=True, IncludeNullItems=True)
dom_7 = ConstructDomain(DomainStart=Slider(0.098, range=0..1), DomainEnd=Slider(0.636, range=0..1))
domain_v_2 = Domain(dom_7)
range_12 = Range(Domain=domain_v_2, Steps=expr("x-  1", count_v))
step_u_2 = Number(Slider(0.55, range=0..1))
addition_2 = Addition(A=range_12, B=step_u_2)
dom_8 = ConstructDomain(DomainStart=range_12, DomainEnd=addition_2)
domain_3 = Domain(dom_8)
range_13 = Range(Domain=domain_3, Steps=expr("x-1", tstat_3.Length))
divide_count = Integer(Slider(4, range=0..10))
range_14 = Range(Domain=Slider(0.274, range=0..1), Steps=expr("x-1", divide_count))
remap_9 = RemapNumbers(Value=range_14, Source=Domain(0, 1), Target=Domain(0, 6.283185307))  # -> Mapped, Clipped
graft_2 = GraftTree(Tree=range_13, IncludeEmptyLists=True, IncludeNullItems=True)  # -> simplify(Tree)
range_15 = Range(Domain=graft_2, Steps=expr("x - 1", divide_count))
amp_7 = Amplitude(Vector=Z_5, Amplitude=range_15)
move_6 = Move(Geometry=graft, Motion=amp_7)  # -> simplify(Geometry), Transform
merge_3 = Merge(Data1=graft(scale_3.Geometry), Data2=graft(move_6.Geometry))  # -> simplify(Result)
rotate_2 = Rotate(Geometry=move_6.Geometry, Angle=remap_9.Mapped, Plane=graft(area_2.Centroid))  # -> Geometry, Transform
loft_3 = Loft(Curves=merge_3, Options={Adjust=False, Closed=False, LoftEnds=0, LoftSimp=0, LoftType=0, Rebuild=10, Refit=0.01})  # disabled
explode_2 = Explode(Curve=rotate_2.Geometry, Recursive=True)  # -> Segments, Vertices
remap_10 = RemapNumbers(Value=range_13, Source=Domain(0, 1), Target=Slider(1.34, range=0..10))  # -> Mapped, Clipped
shift_3 = ShiftList(List=explode_2.Vertices, Shift=-1, Wrap=False)  # -> simplify(List)
bnd_2 = Bounds(Numbers=flatten(range_15))
path_mapper_3 = PathMapper(shift_3, source="{A;B;C}(i)", target="{A;B;i}(C)")
dedomain_2 = DeconstructDomain(Domain=bnd_2)  # -> Start, End
gradient_4 = Gradient(
    LowerLimit=dedomain_2.Start,
    UpperLimit=dedomain_2.End,
    Parameter=flatten(range_15),
    stops=[0: RGB(0, 98, 0), 0.25: RGB(81, 175, 17), 0.5: RGB(159, 198, 146), 0.75: RGB(170, 235, 41), 1: RGB(221, 255, 53)])
pline_5 = PolyLine(Vertices=path_mapper_3, Closed=False)
intcrv_4 = Interpolate(Vertices=path_mapper_3, Degree=3, Periodic=False, KnotStyle=1)  # -> Curve, Length, Domain
preview_5 = CustomPreview(Geometry=flatten(intcrv_4.Curve), Shader=gradient_4)
viewer_2 = ParamViewer(path_mapper_3)

# ==== cluster Cluster
srf = ClusterInput()
num = ClusterInput()
srf_2 = Surface(srf)
num_2 = Number(num)
offset = Offset(Surface=srf_2, Distance=num_2, Retrim=True)
edges = BrepEdges(Brep=srf_2)  # -> Naked, Interior, NonManifold
edges_2 = BrepEdges(Brep=offset)  # -> Naked, Interior, NonManifold
graft = GraftTree(Tree=edges_2.Naked, IncludeEmptyLists=True, IncludeNullItems=True)
graft_2 = GraftTree(Tree=edges.Naked, IncludeEmptyLists=True, IncludeNullItems=True)
merge = Merge(Data1=graft_2, Data2=graft)
loft = Loft(Curves=merge, Options={Adjust=False, Closed=False, LoftEnds=0, LoftSimp=0, LoftType=0, Rebuild=10, Refit=0.01})
join = BrepJoin(Breps=flatten([srf_2, loft, offset]))  # -> Breps, Closed
B = ClusterOutput(join.Breps)
