# Grasshopper definition 20170314_taskbook_3d.gh (Grasshopper 0.9.76)

# ---- group: 模板
# 生成-->蓝色
# 解析-->黄色
# 数据-->白色
# 向量-->红色
# 预览-->紫色
panel = Panel("""数据组织
交错韵律
最小单元""")
sqgrid = Square(Plane=PlaneXY(0, 0, 0), Size=1, ExtentX=5, ExtentY=5)  # -> Cells, Points

path_mapper = PathMapper()
viewer = ParamViewer()

partition = PartitionList(Size=[3, 2])
tstat = TreeStatistics()  # -> Paths, Length, Count
shift = ShiftList(Shift=1, Wrap=True)
entwine = Entwine(FlattenInputs=True)
dup = DuplicateData(Number=2, Order=True)
item = ListItem(Index=0, Wrap=True)

area = Area()  # -> Area, Centroid
curvepoint = PointOnCurve(parameter=0.5)

points = PointList()
preview = CustomPreview(Shader={ambient=RGB(0, 0, 0), diffuse=RGB(255, 105, 180), emission=RGB(76, 32, 54), shine=0.5, specular=RGB(255, 255, 255), transparency=0})
vdis = VectorDisplay()

del = DelaunayMesh(Plane=PlaneXY(0, 0, 0))
pline = PolyLine(Closed=False)
ln = Line()

unit = UnitVector()
amp = Amplitude(Amplitude=1)

# ----
panel_2 = Panel("""曲面生成
曲面分析
几何生成
几何操作""")
deface = DeconstructFace()  # -> CornerA, CornerB, CornerC, CornerD
conmesh = ConstructMesh(Vertices=[Point(0, 0, 0), Point(10, 0, 0), Point(10, 10, 0), Point(0, 10, 0)], Faces={A=0, B=1, C=2, D=3})
hull = ConvexHull(Plane=PlaneXY(0, 0, 0))  # -> Hull, HullZ, Indices
mesh = MeshBrep(Settings={GridMaxCount=0, GridMinCount=16, JaggedSeams=False, MaxEdgeLength=0, MinEdgeLength=0.0001, MinTolerance=0, Refine=True, RefineAngle=0, RelativeTolerance=0.65, SimplePlanes=True, Tolerance=0})
scale = Scale(Center=Point(0, 0, 0), Factor=0.5)  # -> Geometry, Transform
arrcurve = CurveArray(Count=10)  # -> Geometry, Transform
mirror = Mirror(Plane=PlaneYZ(0, 0, 0))  # -> Geometry, Transform
blendbox = BlendBox()
comp = Compound()
group = Group()
slits = BoxSlits(Gap=0)  # -> Breps, Topology
rslits = RegionSlits(Gap=0)  # -> Regions, Topology
split = SplitBrep()
mcx = MeshCurve()  # -> Points, Faces
panel_3 = Panel("mesh应用")
panel_4 = Panel("Transform(变形)体")
panel_5 = Panel("""几何求交
几何割补
碰撞检测""")
panel_6 = Panel("""建模思路
函数找形
非样变形""")
panel_7 = Panel("""解域成点
节点插入
图形映射
色彩渐变""")
panel_8 = Panel("""树形数据
平面渐变
空间渐变
单向渐变
对角渐变
等分旋转
色彩渐变""")

# ----
# 生成-->蓝色
# 解析-->黄色
# 数据-->白色
# 向量-->红色
# 变形-->绿色
# 预览-->紫色
graph = GraphMapper(
    x0=0,
    x1=1,
    y0=0,
    y1=1,
    container_name="Sine Summation",
    Equation0_px=[0.2, 0.2004867792],
    Equation0_py=[0.2, 0.3020638824],
    Equation1_px=[0.6, 0.5952462554],
    Equation1_py=[0.3, 0.6849507093])
remap = RemapNumbers(Source=Domain(0, 1), Target=Domain(0, 1))  # -> Mapped, Clipped
item_2 = ListItem(Index=0, Wrap=True)
eval = Evaluate()
sort = SortList()  # -> Keys, ValuesA
range = Range(Domain=Domain(0, 1), Steps=10)

divide = DivideCurve(Count=10, Kinks=False)  # -> Points, Tangents, Parameters
edges = BrepEdges()  # -> Naked, Interior, NonManifold
devec = DeconstructVector()  # -> XComponent, YComponent, ZComponent

panel_9 = Panel("""树形数据
空间渐变
对角渐变
色彩渐变""")

intcrv = Interpolate(Degree=3, Periodic=False, KnotStyle=1)  # -> Curve, Length, Domain
extr = Extrude()
join = BrepJoin()  # -> Breps, Closed
line = LineSDL(Direction=Vector(0, 0, 1), Length=1)
loft = Loft(Options={Adjust=False, Closed=False, LoftEnds=0, LoftSimp=0, LoftType=0, Rebuild=10, Refit=0.01})

scale_nu = ScaleNU(Plane=PlaneXY(0, 0, 0), ScaleX=1, ScaleY=1, ScaleZ=1)  # -> Geometry, Transform

ln_2 = Line()
rectangle = Rectangle(Plane=PlaneXY(0, 0, 0), XSize=Domain(-1, 1), YSize=Domain(-2, 2), Radius=0)  # -> Rectangle, Length
pline_2 = PolyLine(Closed=False)
boundary = BoundarySurfaces()

series = Series(Start=0, Step=1, Count=10)
range_2 = Range(Domain=Domain(0, 1), Steps=10)
merge = Merge()
item_3 = ListItem(Index=0, Wrap=True)
ins = InsertItems(Wrap=True)

X = UnitX(Factor=1)
amp_2 = Amplitude(Amplitude=1)

group_2 = Group()
move = Move(Motion=Vector(0, 0, 10))  # -> Geometry, Transform
extr_2 = Extrude()

gradient = Gradient(LowerLimit=0, UpperLimit=1, stops=[0.15: RGB(255, 130, 160), 0.85: RGB(220, 0, 40)])
preview_2 = CustomPreview(Shader={ambient=RGB(0, 0, 0), diffuse=RGB(255, 105, 180), emission=RGB(76, 32, 54), shine=0.5, specular=RGB(255, 255, 255), transparency=0})

devec_2 = DeconstructVector()  # -> XComponent, YComponent, ZComponent
vec = VectorXYZ(XComponent=0, YComponent=0, ZComponent=0)  # -> Vector, Length
vec2pt = Vector2Pt(Unitize=False)  # -> Vector, Length

md_slider = MDSlider(slider_value=Point(0.5, 0.5, 0.5), SliderMode=0, x_domain=Domain(0, 1), y_domain=Domain(0, 1), z_domain=Domain(0, 1))
prot = RotatePlane()
remap_2 = RemapNumbers(Source=Domain(0, 1), Target=Domain(0, 1))  # -> Mapped, Clipped
graph_2 = GraphMapper(x0=0, x1=1, y0=0, y1=1, container_name="Sine", Equation_px=[0, 1], Equation_py=[0, 1])

eval_2 = EvaluateCurve()  # -> Point, Tangent, Angle
disc = Discontinuity(Level=1)  # -> Points, Parameters

intcrv_2 = Interpolate(Degree=3, Periodic=False, KnotStyle=1)  # -> Curve, Length, Domain
pline_3 = PolyLine(Closed=False)
sqgrid_2 = Square(Plane=PlaneXY(0, 0, 0), Size=1, ExtentX=5, ExtentY=5)  # -> Cells, Points

series_2 = Series(Start=0, Step=1, Count=10)
division = Division()
bnd = Bounds()
dedomain = DeconstructDomain()  # -> Start, End

gradient_2 = Gradient(LowerLimit=0, UpperLimit=1, stops=[0.15: RGB(255, 130, 160), 0.85: RGB(220, 0, 40)])
preview_3 = CustomPreview(Shader={ambient=RGB(0, 0, 0), diffuse=RGB(255, 105, 180), emission=RGB(76, 32, 54), shine=0.5, specular=RGB(255, 255, 255), transparency=0})

# ----
# 生成-->蓝色
# 解析-->黄色
# 数据-->白色
# 向量-->红色
# 变形-->绿色
# 预览-->紫色
range_3 = Range(Domain=Domain(0, 1), Steps=10)
bnd_2 = Bounds()
dedomain_2 = DeconstructDomain()  # -> Start, End
path_mapper_2 = PathMapper()
dom = ConstructDomain(DomainStart=0, DomainEnd=1)
tstat_2 = TreeStatistics()  # -> Paths, Length, Count
remap_3 = RemapNumbers(Source=Domain(0, 1), Target=Domain(0, 1))  # -> Mapped, Clipped
shift_2 = ShiftList(Shift=1, Wrap=True)

Z = UnitZ(Factor=1)
X_2 = UnitX(Factor=1)
amp_3 = Amplitude(Amplitude=1)

explode = Explode(Recursive=True)  # -> Segments, Vertices

move_2 = Move(Motion=Vector(0, 0, 10))  # -> Geometry, Transform
rotate = Rotate(Angle=1.570796327, Plane=PlaneXY(0, 0, 0))  # -> Geometry, Transform
scale_2 = Scale(Center=Point(0, 0, 0), Factor=0.5)  # -> Geometry, Transform

gradient_3 = Gradient(LowerLimit=0, UpperLimit=1, stops=[0.15: RGB(255, 130, 160), 0.85: RGB(220, 0, 40)])
preview_4 = CustomPreview(Shader={ambient=RGB(0, 0, 0), diffuse=RGB(255, 105, 180), emission=RGB(76, 32, 54), shine=0.5, specular=RGB(255, 255, 255), transparency=0})

recgrid = Rectangular(Plane=PlaneXY(0, 0, 0), SizeX=1, SizeY=2, ExtentX=10, ExtentY=5)  # -> Cells, Points
box = CenterBox(Base=PlaneXY(0, 0, 0), X=1, Y=1, Z=1)
pt = PointOriented(BasePlane=PlaneXY(0, 0, 0), UComponent=0, VComponent=0, WComponent=0)

dist = Distance()

scale_3 = Scale(Center=Point(0, 0, 0), Factor=0.5)  # -> Geometry, Transform
move_3 = Move(Motion=Vector(0, 0, 10))  # -> Geometry, Transform

number_slider = Slider(100, range=0..100)
number_slider_2 = Slider(3.2, range=0..10)
pi = Pi(Factor=Slider(9, range=0..10))
range_4 = Range(Domain=pi, Steps=number_slider)
range_5 = Range(Domain=Domain(0, 1), Steps=number_slider)
range_6 = Range(Domain=Domain(0, 1), Steps=number_slider)
graph_3 = GraphMapper(
    range_5,
    x0=0,
    x1=1,
    y0=-1,
    y1=1,
    container_name="Bezier",
    cpx=[0, 0.6925650835, 0.395832777, 1],
    cpy=[0.8004057407, 0.5106195211, 0.5397279859, 1])
graph_4 = GraphMapper(
    range_6,
    x0=0,
    x1=1,
    y0=0,
    y1=1,
    container_name="Bezier",
    cpx=[0, 0.5397330523, 0.7577240467, 1],
    cpy=[0, 0.5831472278, 0.3482969403, 0])
eval_3 = Evaluate(F="a*sin(x)", a=number_slider_2, x=range_4)
eval_4 = Evaluate(F="a*cos(x)", a=number_slider_2, x=range_4)
dom_2 = ConstructDomain(DomainStart=Slider(0.05, range=0..0.1), DomainEnd=Slider(1.5, range=0..10))
remap_4 = RemapNumbers(Value=graph_4, Source="0 to 1", Target=Slider(21, range=0..100))  # -> Mapped, Clipped
remap_5 = RemapNumbers(Value=graph_3, Source="0 to 1", Target=dom_2)  # -> Mapped, Clipped
pt_2 = ConstructPoint(XCoordinate=eval_3, YCoordinate=eval_4, ZCoordinate=remap_4.Mapped)
scale_nu_2 = ScaleNU(Geometry=pt_2, Plane=PlaneXY(0, 0, 0), ScaleX=remap_5.Mapped, ScaleY=remap_5.Mapped, ScaleZ=1)  # -> Geometry, Transform
intcrv_3 = Interpolate(Vertices=scale_nu_2.Geometry, Degree=3, Periodic=False, KnotStyle=1)  # -> reparameterize(Curve), Length, Domain
number_slider_3 = Slider(100, range=0..100)
divide_2 = DivideCurve(Curve=intcrv_3.Curve, Count=number_slider_3, Kinks=False)  # -> Points, Tangents, Parameters
pt_3 = Point(Point(0, 0, 0))
range_7 = Range(Domain=Domain(0, 1), Steps=number_slider_3)
vec2pt_2 = Vector2Pt(PointA=pt_3, PointB=divide_2.Points, Unitize=False)  # -> Vector, Length
graph_5 = GraphMapper(
    range_7,
    x0=0,
    x1=1,
    y0=0,
    y1=1,
    container_name="Bezier",
    cpx=[0, 0.2336956561, 0.3797094226, 1],
    cpy=[0, 0.5054347515, 0, 0])
devec_3 = DeconstructVector(Vector=vec2pt_2.Vector)  # -> XComponent, YComponent, ZComponent
vec_2 = VectorXYZ(XComponent=devec_3.XComponent, YComponent=devec_3.YComponent, ZComponent=0)  # -> Vector, Length
dom_3 = ConstructDomain(DomainStart=Slider(0.8, range=0..1), DomainEnd=Slider(1.7, range=0..10))
remap_6 = RemapNumbers(Value=graph_5, Source=Domain(0, 1), Target=dom_3)  # -> Mapped, Clipped
line_2 = LineSDL(Start=divide_2.Points, Direction=expr("-x", vec_2.Vector), Length=remap_6.Mapped)
Z_2 = UnitZ(Factor=Slider(0.077, range=0..1))
loft_2 = Loft(Curves=line_2, Options={Adjust=False, Closed=False, LoftEnds=0, LoftSimp=0, LoftType=0, Rebuild=10, Refit=0.01})
extr_3 = Extrude(Base=loft_2, Direction=Z_2)
edges_2 = BrepEdges(Brep=loft_2)  # -> Naked, Interior, NonManifold
sort_2 = SortList(Keys=edges_2.Naked, ValuesA=edges_2.Naked)  # -> Keys, ValuesA
panel_10 = Panel("""2
3""")
item_4 = ListItem(List=sort_2.ValuesA, Index=panel_10, Wrap=True)
Z_3 = UnitZ(Factor=Slider(1.9, range=0..10))
extr_4 = Extrude(Base=item_4, Direction=Z_3)
cluster = Cluster(srf=extr_4, num=Slider(0.05, range=0..0.1))

md_slider_2 = MDSlider(
    slider_value=Point(0.7435207367, 0, 0.5),
    SliderMode=0,
    x_domain=Domain(-100, 100),
    y_domain=Domain(-100, 100),
    z_domain=Domain(0, 1))
remap_7 = RemapNumbers(Value=Slider(1, range=0..1), Source=Domain(0, 1), Target=Domain(0, 6.283185307))  # -> Mapped, Clipped
number_slider_4 = Slider(5, range=0..10)
number_slider_5 = Slider(0.775, range=0..10)
prot_2 = RotatePlane(Plane=md_slider_2, Angle=remap_7.Mapped)
pln = Plane(prot_2)
series_3 = Series(Start=0, Step=number_slider_5, Count=expr("x+1", number_slider_4))
recgrid_2 = Rectangular(Plane=pln, SizeX=number_slider_5, SizeY=number_slider_5, ExtentX=number_slider_4, ExtentY=number_slider_4)  # -> Cells, Points
Z_4 = UnitZ(Factor=series_3)
pt_4 = PointOriented(BasePlane=pln, UComponent=-1, VComponent=0, WComponent=0)
move_4 = Move(Geometry=flatten(recgrid_2.Points), Motion=graft(Z_4))  # -> flatten(Geometry), Transform
pt_5 = Point(pt_4)
dist_2 = Distance(PointA=pt_5, PointB=move_4.Geometry)
box_2 = CenterBox(Base=move_4.Geometry, X=number_slider_5, Y=number_slider_5, Z=number_slider_5)
division_2 = Division(A=dist_2, B=Slider(16, range=0..100))
scale_4 = Scale(Geometry=box_2, Center=move_4.Geometry, Factor=division_2)  # -> Geometry, Transform
bnd_3 = Bounds(Numbers=division_2)
dedomain_3 = DeconstructDomain(Domain=bnd_3)  # -> Start, End
gradient_4 = Gradient(
    LowerLimit=dedomain_3.Start,
    UpperLimit=dedomain_3.End,
    Parameter=division_2,
    stops=[0: RGB(0, 98, 0), 0.25: RGB(81, 175, 17), 0.5: RGB(159, 198, 146), 0.75: RGB(170, 235, 41), 1: RGB(221, 255, 53)])
preview_5 = CustomPreview(Geometry=scale_4.Geometry, Shader=gradient_4)

md_slider_3 = MDSlider(
    slider_value=Point(0, 0, 0.5),
    SliderMode=0,
    x_domain=Domain(-100, 100),
    y_domain=Domain(-100, 100),
    z_domain=Domain(0, 1))
remap_8 = RemapNumbers(Value=Slider(1, range=0..1), Source=Domain(0, 1), Target=Domain(0, 6.283185307))  # -> Mapped, Clipped
prot_3 = RotatePlane(Plane=md_slider_3, Angle=remap_8.Mapped)
yz = YZPlane(Origin=prot_3)
distance = Number(Slider(3.934, range=0..10))
rectangle_2 = Rectangle(Plane=yz, XSize=Slider(10, range=0..10), YSize=Slider(2.364, range=0..10), Radius=0)  # -> Rectangle, Length
cout = Integer(Slider(18, range=0..100))
series_4 = Series(Start=0, Step=distance, Count=cout)
X_3 = UnitX(Factor=1)
range_8 = Range(Domain=Domain(0, 1), Steps=expr("x-1", cout))
disc_2 = Discontinuity(Curve=rectangle_2.Rectangle, Level=1)  # -> Points, Parameters
amp_4 = Amplitude(Vector=X_3, Amplitude=series_4)
graph_6 = GraphMapper(range_8, x0=0, x1=1, y0=0, y1=1, container_name="Sine", Equation_px=[0, 0.3466898501], Equation_py=[0, 1])
move_5 = Move(Geometry=disc_2.Points, Motion=graft(amp_4))  # -> Geometry, Transform
item_5 = ListItem(List=move_5.Geometry, Index="2", Wrap=True)  # -> Item, Item1
num = Number(graph_6)
ln_3 = Line(StartPoint=item_5.Item, EndPoint=item_5.Item1)
Z_5 = UnitZ(Factor=1)
height = Number(Slider(2.633, range=0..10))
eval_5 = EvaluateCurve(Curve=ln_3, Parameter=graft(num))  # -> Point, Tangent, Angle
amp_5 = Amplitude(Vector=Z_5, Amplitude=height)
move_6 = Move(Geometry=eval_5.Point, Motion=amp_5)  # -> Geometry, Transform
multiplication = Multiplication(A=distance, B=Slider(0.8222, range=0..1))
ins_2 = InsertItems(List=move_5.Geometry, Item=move_6.Geometry, Indices=3, Wrap=True)
X_4 = UnitX(Factor=1)
thickness = Number(multiplication)
pline_4 = PolyLine(Vertices=ins_2, Closed=True)
amp_6 = Amplitude(Vector=X_4, Amplitude=thickness)
move_7 = Move(Geometry=pline_4, Motion=amp_6)  # -> Geometry, Transform
merge_2 = Merge(Data1=pline_4, Data2=move_7.Geometry)
gradient_5 = Gradient(LowerLimit=0, UpperLimit=1, Parameter=num, stops=[0: RGB(0, 128, 0), 0.5: RGB(255, 255, 0), 1: RGB(255, 0, 0)])
boundary_2 = BoundarySurfaces(Edges=merge_2)
extr_5 = Extrude(Base=pline_4, Direction=amp_6)
group_3 = Group(Objects=[boundary_2, extr_5])
preview_6 = CustomPreview(Geometry=flatten(group_3), Shader=gradient_5)

md_slider_4 = MDSlider(
    slider_value=Point(0.6763210297, 0, 0.5),
    SliderMode=0,
    x_domain=Domain(-100, 100),
    y_domain=Domain(-100, 100),
    z_domain=Domain(0, 1))
remap_9 = RemapNumbers(Value=Slider(1, range=0..1), Source=Domain(0, 1), Target=Domain(0, 6.283185307))  # -> Mapped, Clipped
prot_4 = RotatePlane(Plane=md_slider_4, Angle=remap_9.Mapped)
dom_4 = ConstructDomain(DomainStart=Slider(0.098, range=0..1), DomainEnd=Slider(0.6, range=0..1))
pln_2 = Plane(prot_4)
domain_v = Domain(dom_4)
sqgrid_3 = Square(Plane=pln_2, Size=1, ExtentX=Slider(6, range=0..10), ExtentY=Slider(8, range=0..10))  # -> Cells, Points
step_u = Number(Slider(0.34, range=0..1))
area_2 = Area(Geometry=sqgrid_3.Cells)  # -> Area, Centroid
tstat_3 = TreeStatistics(Tree=area_2.Centroid)  # -> Paths, Length, Count
count_v = Integer(tstat_3.Count)
range_9 = Range(Domain=domain_v, Steps=expr("x-  1", count_v))
dom_5 = ConstructDomain(DomainStart=Slider(0.098, range=0..1), DomainEnd=Slider(0.61, range=0..1))
addition = Addition(A=range_9, B=step_u)
lng = ListLength(List=area_2.Centroid)
domain = Domain(dom_5)
dom_6 = ConstructDomain(DomainStart=range_9, DomainEnd=addition)
range_10 = Range(Domain=domain, Steps=expr("x-1", lng))
domain_2 = Domain(dom_6)
range_11 = Range(Domain=domain_2, Steps=expr("x-1", tstat_3.Length))
scale_5 = Scale(Geometry=sqgrid_3.Cells, Center=area_2.Centroid, Factor=range_11)  # -> Geometry, Transform
Z_6 = UnitZ(Factor=1)
graft = GraftTree(Tree=scale_5.Geometry, IncludeEmptyLists=True, IncludeNullItems=True)
dom_7 = ConstructDomain(DomainStart=Slider(0.098, range=0..1), DomainEnd=Slider(0.636, range=0..1))
domain_v_2 = Domain(dom_7)
range_12 = Range(Domain=domain_v_2, Steps=expr("x-  1", count_v))
step_u_2 = Number(Slider(0.55, range=0..1))
addition_2 = Addition(A=range_12, B=step_u_2)
dom_8 = ConstructDomain(DomainStart=range_12, DomainEnd=addition_2)
domain_3 = Domain(dom_8)
range_13 = Range(Domain=domain_3, Steps=expr("x-1", tstat_3.Length))
divide_count = Integer(Slider(4, range=0..10))
range_14 = Range(Domain=Slider(0.274, range=0..1), Steps=expr("x-1", divide_count))
remap_10 = RemapNumbers(Value=range_14, Source=Domain(0, 1), Target=Domain(0, 6.283185307))  # -> Mapped, Clipped
graft_2 = GraftTree(Tree=range_13, IncludeEmptyLists=True, IncludeNullItems=True)  # -> simplify(Tree)
range_15 = Range(Domain=graft_2, Steps=expr("x - 1", divide_count))
amp_7 = Amplitude(Vector=Z_6, Amplitude=range_15)
move_8 = Move(Geometry=graft, Motion=amp_7)  # -> simplify(Geometry), Transform
merge_3 = Merge(Data1=graft(scale_5.Geometry), Data2=graft(move_8.Geometry))  # -> simplify(Result)
rotate_2 = Rotate(Geometry=move_8.Geometry, Angle=remap_10.Mapped, Plane=graft(area_2.Centroid))  # -> Geometry, Transform
loft_3 = Loft(Curves=merge_3, Options={Adjust=False, Closed=False, LoftEnds=0, LoftSimp=0, LoftType=0, Rebuild=10, Refit=0.01})  # disabled
explode_2 = Explode(Curve=rotate_2.Geometry, Recursive=True)  # -> Segments, Vertices
remap_11 = RemapNumbers(Value=range_13, Source=Domain(0, 1), Target=Slider(1.34, range=0..10))  # -> Mapped, Clipped
shift_3 = ShiftList(List=explode_2.Vertices, Shift=-1, Wrap=False)  # -> simplify(List)
bnd_4 = Bounds(Numbers=flatten(range_15))
path_mapper_3 = PathMapper(shift_3, source="{A;B;C}(i)", target="{A;B;i}(C)")
dedomain_4 = DeconstructDomain(Domain=bnd_4)  # -> Start, End
gradient_6 = Gradient(
    LowerLimit=dedomain_4.Start,
    UpperLimit=dedomain_4.End,
    Parameter=flatten(range_15),
    stops=[0: RGB(0, 98, 0), 0.25: RGB(81, 175, 17), 0.5: RGB(159, 198, 146), 0.75: RGB(170, 235, 41), 1: RGB(221, 255, 53)])
intcrv_4 = Interpolate(Vertices=path_mapper_3, Degree=3, Periodic=False, KnotStyle=1)  # -> Curve, Length, Domain
pline_5 = PolyLine(Vertices=path_mapper_3, Closed=False)
preview_7 = CustomPreview(Geometry=flatten(intcrv_4.Curve), Shader=gradient_6)

md_slider_5 = MDSlider(
    slider_value=Point(0.2829589844, 0.14851439, 0.5),
    SliderMode=0,
    x_domain=Domain(-100, 100),
    y_domain=Domain(-100, 100),
    z_domain=Domain(0, 1))
remap_12 = RemapNumbers(Value=Slider(1, range=0..1), Source=Domain(0, 1), Target=Domain(0, 6.283185307))  # -> Mapped, Clipped
prot_5 = RotatePlane(Plane=md_slider_5, Angle=remap_12.Mapped)
sph = Sphere(Base=prot_5, Radius=1)

md_slider_6 = MDSlider(
    slider_value=Point(0.289680481, 0.1405187845, 0.5),
    SliderMode=0,
    x_domain=Domain(-100, 100),
    y_domain=Domain(-100, 100),
    z_domain=Domain(0, 1))
remap_13 = RemapNumbers(Value=Slider(1, range=0..1), Source=Domain(0, 1), Target=Domain(0, 6.283185307))  # -> Mapped, Clipped
number_slider_6 = Slider(0.93, range=0..10)
prot_6 = RotatePlane(Plane=md_slider_6, Angle=remap_13.Mapped)
box_3 = DomainBox(Base=prot_6, X=number_slider_6, Y=number_slider_6, Z=number_slider_6)
debrep = DeconstructBrep(Brep=box_3)  # -> Faces, Edges, Vertices
lng_2 = ListLength(List=debrep.Vertices)
random = Random(Range=lng_2, Number=Slider(4, range=0..10), Seed=Slider(66.52, range=0..100))
int = Integer(random)
item_6 = ListItem(List=debrep.Vertices, Index=int, Wrap=True)
item_7 = ListItem(List=item_6, Index=0, Wrap=True)  # -> Item, Item1, Item2, Item3
sph4pt = Sphere4Pt(Point1=item_7.Item, Point2=item_7.Item1, Point3=item_7.Item2, Point4=item_7.Item3)  # -> Center, Radius, Sphere

md_slider_7 = MDSlider(
    slider_value=Point(0.266960144, 0.14851439, 0.5),
    SliderMode=0,
    x_domain=Domain(-100, 100),
    y_domain=Domain(-100, 100),
    z_domain=Domain(0, 1))
remap_14 = RemapNumbers(Value=Slider(1, range=0..1), Source=Domain(0, 1), Target=Domain(0, 6.283185307))  # -> Mapped, Clipped
prot_7 = RotatePlane(Plane=md_slider_7, Angle=remap_14.Mapped)
cyl = Cylinder(Base=prot_7, Radius=Slider(0.7, range=0..10), Length=Slider(1.35, range=0..10))

md_slider_8 = MDSlider(
    slider_value=Point(0.25415802, 0.14851439, 0.5),
    SliderMode=0,
    x_domain=Domain(-100, 100),
    y_domain=Domain(-100, 100),
    z_domain=Domain(0, 1))
remap_15 = RemapNumbers(Value=Slider(1, range=0..1), Source=Domain(0, 1), Target=Domain(0, 6.283185307))  # -> Mapped, Clipped
prot_8 = RotatePlane(Plane=md_slider_8, Angle=remap_15.Mapped)
cone = Cone(Base=prot_8, Radius=Slider(0.7, range=0..10), Length=Slider(1.35, range=0..10))  # -> Cone, Tip

md_slider_9 = MDSlider(
    slider_value=Point(0.1619949341, 0.14851439, 0.5),
    SliderMode=0,
    x_domain=Domain(-100, 100),
    y_domain=Domain(-100, 100),
    z_domain=Domain(0, 1))
remap_16 = RemapNumbers(Value=Slider(1, range=0..1), Source=Domain(0, 1), Target=Domain(0, 6.283185307))  # -> Mapped, Clipped
number_slider_7 = Slider(2.33, range=0..10)
prot_9 = RotatePlane(Plane=md_slider_9, Angle=remap_16.Mapped)
rectangle_3 = Rectangle(Plane=prot_9, XSize=number_slider_7, YSize=number_slider_7, Radius=0)  # -> Rectangle, Length
boxrec = BoxRectangle(Rectangle=rectangle_3.Rectangle, Height=Slider(2.33, range=0..10))

md_slider_10 = MDSlider(
    slider_value=Point(0.1299972534, 0.1405149698, 0.5),
    SliderMode=0,
    x_domain=Domain(-100, 100),
    y_domain=Domain(-100, 100),
    z_domain=Domain(0, 1))
remap_17 = RemapNumbers(Value=Slider(1, range=0..1), Source=Domain(0, 1), Target=Domain(0, 6.283185307))  # -> Mapped, Clipped
number_slider_8 = Slider(2.18, range=0..10)
prot_10 = RotatePlane(Plane=md_slider_10, Angle=remap_17.Mapped)
pt_6 = Point(prot_10)
pt_7 = PointOriented(BasePlane=prot_10, UComponent=number_slider_8, VComponent=number_slider_8, WComponent=number_slider_8)
box_4 = Box2Pt(PointA=pt_6, PointB=pt_7, Plane=prot_10)

md_slider_11 = MDSlider(
    slider_value=Point(0.009994506836, 0.1597152948, 0.5),
    SliderMode=0,
    x_domain=Domain(-100, 100),
    y_domain=Domain(-100, 100),
    z_domain=Domain(0, 1))
number_slider_9 = Slider(5.44, range=0..10)
remap_18 = RemapNumbers(Value=Slider(1, range=0..1), Source=Domain(0, 1), Target=Domain(0, 6.283185307))  # -> Mapped, Clipped
prot_11 = RotatePlane(Plane=md_slider_11, Angle=remap_18.Mapped)
planesrf = PlaneSurface(Plane=prot_11, XSize=number_slider_9, YSize=number_slider_9)

md_slider_12 = MDSlider(
    slider_value=Point(0.09799957275, 0.1597152948, 0.5),
    SliderMode=0,
    x_domain=Domain(-100, 100),
    y_domain=Domain(-100, 100),
    z_domain=Domain(0, 1))
remap_19 = RemapNumbers(Value=Slider(1, range=0..1), Source=Domain(0, 1), Target=Domain(0, 6.283185307))  # -> Mapped, Clipped
prot_12 = RotatePlane(Plane=md_slider_12, Angle=remap_19.Mapped)
sph_2 = Sphere(Base=prot_12, Radius=Slider(1.79, range=0..10))
bbox = BoundingBox(Content=sph_2, Plane=PlaneXY(0, 0, 0))  # -> Box, Box_2

# ----
# 矩形凸包
number_slider_10 = Slider(1, range=0..1)
md_slider_13 = MDSlider(
    slider_value=Point(0.06631469727, 0.1597152948, 0.5),
    SliderMode=0,
    x_domain=Domain(-100, 100),
    y_domain=Domain(-100, 100),
    z_domain=Domain(0, 1))
remap_20 = RemapNumbers(Value=number_slider_10, Source=Domain(0, 1), Target=Domain(0, 6.283185307))  # -> Mapped, Clipped
prot_13 = RotatePlane(Plane=md_slider_13, Angle=remap_20.Mapped)
pt_8 = Point([Point(-87.27024197, -68.08731973, 0), Point(-87.14557953, -67.40078873, 0), Point(-86.41458888, -67.33414467, 0), Point(-85.48448708, -67.5506602, 0), Point(-85.97714316, -68.28168066, 0), Point(-86.77030171, -68.36925542, 0)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])
cir = Circle(Plane=prot_13, Radius=1)
pline_6 = PolyLine(Vertices=pt_8, Closed=False)
pxs = PlaneThroughShape(Plane=md_slider_13, Shape=cir, Inflate=Slider(0, range=0..10), SectionLogic=False)

md_slider_14 = MDSlider(
    slider_value=Point(0.2336807251, 0.14851439, 0.5),
    SliderMode=0,
    x_domain=Domain(-100, 100),
    y_domain=Domain(-100, 100),
    z_domain=Domain(0, 1))
remap_21 = RemapNumbers(Value=Slider(1, range=0..1), Source=Domain(0, 1), Target=Domain(0, 6.283185307))  # -> Mapped, Clipped
number_slider_11 = Slider(0.93, range=0..10)
prot_14 = RotatePlane(Plane=md_slider_14, Angle=remap_21.Mapped)
box_5 = DomainBox(Base=prot_14, X=number_slider_11, Y=number_slider_11, Z=number_slider_11)

md_slider_15 = MDSlider(
    slider_value=Point(0.2029571533, 0.14851439, 0.5),
    SliderMode=0,
    x_domain=Domain(-100, 100),
    y_domain=Domain(-100, 100),
    z_domain=Domain(0, 1))
remap_22 = RemapNumbers(Value=Slider(1, range=0..1), Source=Domain(0, 1), Target=Domain(0, 6.283185307))  # -> Mapped, Clipped
prot_15 = RotatePlane(Plane=md_slider_15, Angle=remap_22.Mapped)
division_3 = Division(A=Slider(2.33, range=0..10), B=2)
box_6 = CenterBox(Base=prot_15, X=division_3, Y=division_3, Z=division_3)

sfit = SphereFit(Points=debrep.Vertices)  # -> Center, Radius, Sphere

# ==== cluster Cluster
srf = ClusterInput()
num = ClusterInput()
srf_2 = Surface(srf)
num_2 = Number(num)
offset = Offset(Surface=srf_2, Distance=num_2, Retrim=True)
edges = BrepEdges(Brep=srf_2)  # -> Naked, Interior, NonManifold
edges_2 = BrepEdges(Brep=offset)  # -> Naked, Interior, NonManifold
graft = GraftTree(Tree=edges_2.Naked, IncludeEmptyLists=True, IncludeNullItems=True)
graft_2 = GraftTree(Tree=edges.Naked, IncludeEmptyLists=True, IncludeNullItems=True)
merge = Merge(Data1=graft_2, Data2=graft)
loft = Loft(Curves=merge, Options={Adjust=False, Closed=False, LoftEnds=0, LoftSimp=0, LoftType=0, Rebuild=10, Refit=0.01})
join = BrepJoin(Breps=flatten([srf_2, loft, offset]))  # -> Breps, Closed
B = ClusterOutput(join.Breps)
