# Grasshopper definition Surface_Freeforms.gh (Grasshopper 0.9.76)

pt = Point([Point(9.827565524, -3.10955794, 0), Point(1.3008132, 6.846955749, 0), Point(-6.782242871, -2.263836977, 0), Point(2.308475903, -8.132383039, 6.105145112)])
pt_2 = Point([Point(12.01150176, -1.181930227, 0), Point(10.47528685, 1.719474853, 1.22760975), Point(11.18960901, 4.348718982, 1.22760975), Point(4.849466013, 1.793857266, 3.334789095), Point(11.76386682, 2.564958832, 4.210888747), Point(16.48911077, 3.632256082, 5.969791209)])
item = ListItem(List=pt, Index=0, Wrap=True)  # -> Item, Item1, Item2, Item3
srf4pt = _4PointSurface(CornerA=item.Item, CornerB=item.Item1, CornerC=item.Item2, CornerD=item.Item3)
debrep = DeconstructBrep(Brep=srf4pt)  # -> Faces, Edges, Vertices
srfgrid = SurfaceFromPoints(Points=pt_2, UCount=Slider(2, range=0..10), Interpolate=Toggle(True))
panel = Panel(debrep.Vertices)
dom = ConstructDomain(DomainStart=Slider(0, range=-10..10), DomainEnd=Slider(2, range=0..10))
z_count = Integer(Slider(5, range=0..10))
series = Series(Start=0, Step=1, Count=10)
lng = ListLength(List=series)
pt_3 = Point([Point(1.395499371, -9.706647499, 0), Point(-6.35413878, -5.837988435, 0), Point(-4.817727947, 2.226811085, 0), Point(3.234819114, 1.797117732, 0)])
range = Range(Domain=dom, Steps=expr("x-1", lng))
series_2 = Series(Start=0, Step=1, Count=z_count)
pline = PolyLine(Vertices=pt_3, Closed=True)
boundary = BoundarySurfaces(Edges=pline)
Z = UnitZ(Factor=Slider(3.037, range=0..10))
jitter = Jitter(List=range, Jitter=1, Seed=series_2)  # -> Values, Indices

extr = Extrude(Base=pline, Direction=Z)
extr_2 = Extrude(Base=boundary, Direction=Z)

pt_4 = PointOriented(BasePlane=PlaneXY(0, 0, 0), UComponent=series, VComponent=jitter.Values, WComponent=graft(series_2))
panel_2 = Panel(extr)
panel_3 = Panel(extr_2)
nurbs = NurbsCurve(Vertices=pt_4, Degree=3, Periodic=False)  # -> Curve, Length, Domain
loft = Loft(
    Curves=flatten(nurbs.Curve),
    Options={Adjust=False, Closed=False, LoftEnds=0, LoftSimp=0, LoftType=0, Rebuild=10, Refit=0.01})
pt_5 = Point([Point(0.4874073099, -6.102958818, 0), Point(4.331781257, -7.310607173, 2.787256243), Point(5.014730354, -6.945758243, 0), Point(6.973322898, -4.708511002, 2.344193074), Point(8.062119767, -4.070675342, 0), Point(7.568277163, -0.9492125959, 2.842619391), Point(9.036733004, -0.8537654456, 0), Point(8.068032665, 3.747921377, 2.000674477), Point(5.487258978, 1.45314783, 0), Point(2.26593265, 2.650778329, 2.04070767), Point(0.3880113626, -0.11455024, 0), Point(-1.148909769, -2.887502406, 2.875184916)])
pline_2 = PolyLine(Vertices=pt_5, Closed=True)
fpatch = FragmentPatch(Boundary=pline_2)
patch = Patch(Spans=20, Flexibility=1, Trim=True)
debrep_2 = DeconstructBrep(Brep=fpatch)  # -> Faces, Edges, Vertices
pt_6 = Point(debrep_2.Vertices)
points = PointList(Points=pt_6, Size=Slider(2.72, range=0..10))
nurbs_2 = NurbsCurve(
    Vertices=[Point(0.2017722296, -0.3471885156, 0), Point(2.229798743, -0.9424968924, 0), Point(3.015161804, 1.675231231, 0), Point(5.818032971, 0.877075891, 0), Point(5.7618686, -1.562706504, 0), Point(7.540817412, -1.644413402, 0), Point(8.167507097, 0.4606787127, 0), Point(9.460320825, -0.05105841951, 0)],
    Degree=3,
    Periodic=False)  # -> Curve, Length, Domain
swp1 = Sweep1(Miter=1)
vpipe = PipeVariable(Caps=0)
pipe = Pipe(Curve=nurbs_2.Curve, Radius=Slider(0.16, range=0..1), Caps=0)
railrev = RailRevolution(Scale=False)
