# Grasshopper definition 20170327_随机游走.gh (Grasshopper 0.9.76)

# ---- group: 随机数判断前后
移动次数 = Integer(Slider(9000, range=0..10000))
num = Number(Slider(22.03, range=0..100))
random = Random(Range=Domain(0, 1), Number=移动次数, Seed=num)
panel = Panel("""1
-1""")
int = Integer(random)
item = ListItem(List=panel, Index=int, Wrap=True)
移动方向 = Integer(item)

# ----
panel_2 = Panel("""中点坐标计算
半径计算
缺省角度(0,pi)""")
md_slider = MDSlider(
    slider_value=Point(0.4500007629, 0.5678794167, 0.5),
    SliderMode=0,
    x_domain=Domain(-20, 20),
    y_domain=Domain(-20, 20),
    z_domain=Domain(0, 1))
remap = RemapNumbers(Value=Slider(0, range=0..1), Source=Domain(0, 1), Target=Domain(0, 6.283185307))  # -> Mapped, Clipped
series = Series(Start=0, Step=1, Count=Slider(7, range=0..10))
prot = RotatePlane(Plane=md_slider, Angle=remap.Mapped)
md_slider_2 = MDSlider(
    slider_value=Point(0.62890625, 0.70703125, 0.5),
    SliderMode=0,
    x_domain=Domain(-100, 100),
    y_domain=Domain(-100, 100),
    z_domain=Domain(0, 1))
jitter = Jitter(List=series, Jitter=1, Seed=2)  # -> Values, Indices
pln = Plane(prot)
panel_3 = Panel("""单向随机移动
平面随机移动
步距规律变化
轨迹长度计算
跳转弧线绘制""")
方位 = Plane(md_slider_2)

# ---- group: 跳转弧线绘制函数
移动后点x坐标序列 = Number(jitter.Values)
定位 = Plane(pln)
shift = ShiftList(List=移动后点x坐标序列, Shift=[1, -1], Wrap=False)  # -> simplify(List)
bang = ExplodeTree(Data=shift)  # -> Branch0, Branch1
addition = Addition(A=bang.Branch0, B=bang.Branch1)
subtraction = Subtraction(A=bang.Branch0, B=bang.Branch1)
division = Division(A=addition, B=2)
# 损耗后的步距最小不能低于最短步距
division_2 = Division(A=subtraction, B=2)
pt = PointOriented(BasePlane=定位, UComponent=division, VComponent=0, WComponent=0)
pl_origin = PlaneOrigin(Base=定位, Origin=pt)
arc = Arc(Plane=pl_origin, Radius=division_2, Angle=Domain(0, 3.141592654))  # -> Arc, Length

# ---- group: 跳转弧线绘制
pt_2 = Point(Point(32.67132851, -17.2431254, 0))
pt_3 = Point(Point(-6.61591646, -16.69677477, 0))
addition_2 = Addition(A=pt_3, B=pt_2)
dist = Distance(PointA=pt_3, PointB=pt_2)
division_3 = Division(A=addition_2, B=2)
division_4 = Division(A=dist, B=2)
arc_2 = Arc(Plane=division_3, Radius=division_4, Angle=Domain(0, 3.141592654))  # -> Arc, Length

# ----
pt_4 = PointOriented(BasePlane=方位, UComponent=0, VComponent=0, WComponent=0)
定位点 = Point(pt_4)

# ----
# 随机两次的值
# 00 --> 向上 --> 1   False
# 11 --> 向下 --> -1 False
# 01  --> 向右--> 1 True
# 10  --> 向左--> -1 True
# 两个数相同得到false，在前后方向上游走
# 第一个数为0得到1,否则为-1
number_slider = Slider(3, range=0..100)
number_slider_2 = Slider(9142, range=0..10000)
genes = GenePool(Decimals=2, Maximum=100, Minimum=0, Value=[52.45, 8.94])
移动次数_2 = Integer(number_slider)
num_2 = Number(genes)
random_2 = Random(Range=Domain(0, 1), Number=移动次数_2, Seed=graft(num_2))
pshift = ShiftPaths(Data=random_2, Offset=-1)
int_2 = Integer(pshift)
bang_2 = ExplodeTree(Data=simplify(int_2))  # -> Branch0, Branch1
panel_4 = Panel("""1
-1""")
subtraction_2 = Subtraction(A=bang_2.Branch0, B=bang_2.Branch1)
item_2 = ListItem(List=panel_4, Index=bang_2.Branch0, Wrap=True)
abs = Absolute(Value=subtraction_2)
正负系数 = Integer(item_2)
前后or左右_bool = Boolean(abs)
int_3 = Integer(int_2)

number_slider_3 = Slider(0.002, range=0..0.01)
单次损耗步距 = Number(Slider(0, range=0..10))
最长步距 = Number(Slider(9.18, range=0..10))
最短步距 = Number(Slider(1.66, range=0..10))
移动次数_3 = Integer(移动次数_2)
neg = Negative(Value=单次损耗步距)
series_2 = Series(Start=最长步距, Step=neg, Count=移动次数_3)
smaller = SmallerThan(FirstNumber=series_2, SecondNumber=最短步距)  # -> SmallerThan, OrEqualTo
dispatch = Dispatch(List=series_2, DispatchPattern=smaller.SmallerThan)  # -> ListA, ListB
lng = ListLength(List=dispatch.ListA)
stack = StackData(Data=最短步距, Stack=lng)
weave = Weave(Pattern=smaller.SmallerThan, Stream0=dispatch.ListB, Stream1=stack, NullGaps=False)
渐变后步距系数 = Number(weave)

# ----
# 平面随机移动
# 中国地图version 0.1
# 两个数相同得到false，在前后方向上游走
# 第一个数为0得到1,否则为-1
number_slider_4 = Slider(9.18, range=0..10)  # disabled
number_slider_5 = Slider(0.002, range=0..0.01)  # disabled
number_slider_6 = Slider(1.66, range=0..10)  # disabled
number_slider_7 = Slider(0, range=0..10)  # disabled
number_slider_8 = Slider(23, range=0..100)  # disabled
number_slider_9 = Slider(5743, range=0..10000)  # disabled
genes_2 = GenePool(Decimals=2, Maximum=100, Minimum=0, Value=[100, 0])  # disabled
md_slider_3 = MDSlider(
    slider_value=Point(0, 0.02703142166, 0.5),
    SliderMode=0,
    x_domain=Domain(-100, 100),
    y_domain=Domain(-100, 100),
    z_domain=Domain(0, 1))  # disabled
方位_2 = Plane(md_slider_3)  # disabled
单次损耗步距_2 = Number(number_slider_7)  # disabled
最长步距_2 = Number(number_slider_4)  # disabled
最短步距_2 = Number(number_slider_6)  # disabled
移动次数_4 = Integer(number_slider_9)  # disabled
移动次数_5 = Integer(移动次数_4)  # disabled
num_3 = Number(genes_2)  # disabled
pt_5 = PointOriented(BasePlane=方位_2, UComponent=0, VComponent=0, WComponent=0)  # disabled
neg_2 = Negative(Value=单次损耗步距_2)  # disabled
random_3 = Random(Range=Domain(0, 1), Number=移动次数_4, Seed=graft(num_3))  # disabled
series_3 = Series(Start=最长步距_2, Step=neg_2, Count=移动次数_5)  # disabled
int_4 = Integer(random_3)  # disabled
smaller_2 = SmallerThan(FirstNumber=series_3, SecondNumber=最短步距_2)  # -> SmallerThan, OrEqualTo; disabled
定位点_2 = Point(pt_5)  # disabled
bang_3 = ExplodeTree(Data=simplify(int_4))  # -> Branch0, Branch1; disabled
dispatch_2 = Dispatch(List=series_3, DispatchPattern=smaller_2.SmallerThan)  # -> ListA, ListB; disabled
panel_5 = Panel("""1
-1""")  # disabled
subtraction_3 = Subtraction(A=bang_3.Branch0, B=bang_3.Branch1)  # disabled
item_3 = ListItem(List=panel_5, Index=bang_3.Branch0, Wrap=True)  # disabled
lng_2 = ListLength(List=dispatch_2.ListA)  # disabled
abs_2 = Absolute(Value=subtraction_3)  # disabled
stack_2 = StackData(Data=最短步距_2, Stack=lng_2)  # disabled
正负系数_2 = Integer(item_3)  # disabled
前后or左右_bool_2 = Boolean(abs_2)  # disabled
weave_2 = Weave(Pattern=smaller_2.SmallerThan, Stream0=dispatch_2.ListB, Stream1=stack_2, NullGaps=False)  # disabled
panel_6 = Panel(前后or左右_bool_2)  # disabled
移动方向_2 = Integer(正负系数_2)  # disabled
渐变后步距系数_2 = Number(weave_2)  # disabled
步距系数 = Number(渐变后步距系数_2)  # disabled
multiplication = Multiplication(A=步距系数, B=移动方向_2)  # disabled
complex = ComplexComponents(Complex=定位点_2)  # -> Real, Imaginary; disabled
实际步距 = Number(multiplication)  # disabled
sift = SiftPattern(List=实际步距, SiftPattern=前后or左右_bool_2)  # -> Output0, Output1; disabled
dispatch_3 = Dispatch(List=实际步距, DispatchPattern=前后or左右_bool_2)  # -> ListA, ListB; disabled
panel_7 = Panel("0")  # disabled
nullrep = ReplaceNulls(Items=sift.Output0, Replacements=panel_7)  # -> Items, Count; disabled
nullrep_2 = ReplaceNulls(Items=sift.Output1, Replacements=panel_7)  # -> Items, Count; disabled
ma = MassAddition(Input=实际步距)  # -> Result, PartialResults; disabled
相对原点的改变 = Number(ma.PartialResults)  # disabled
addition_3 = Addition(A=complex.Real, B=相对原点的改变)  # disabled
complex_2 = CreateComplex(Real=nullrep.Items, Imaginary=nullrep_2.Items)  # disabled
轨迹总长 = Number(ma.Result)  # disabled
ma_2 = MassAddition(Input=complex_2)  # -> Result, PartialResults; disabled
移动后点x坐标序列_2 = Number(addition_3)  # disabled
vec = Vector(ma_2.PartialResults)  # disabled
addition_4 = Addition(A=定位点_2, B=vec)  # disabled
相对原点的改变_2 = Number(相对原点的改变)  # disabled
定位_2 = Plane(方位_2)  # disabled
定位_3 = Plane(方位_2)  # disabled
pt_6 = Point(addition_4)  # disabled
item_4 = ListItem(List=pt_6, Index=-1, Wrap=True)  # disabled
merge = Merge(Data1=flatten(0), Data2=flatten(相对原点的改变_2))  # disabled
merge_2 = Merge(Data1=flatten(定位_2), Data2=flatten(pt_6))  # disabled
最终点 = Point(item_4)  # disabled
shift_2 = ShiftList(List=merge, Shift=[1, -1], Wrap=False)  # -> simplify(List); disabled
pline = PolyLine(Vertices=merge_2, Closed=False)  # disabled
bang_4 = ExplodeTree(Data=shift_2)  # -> Branch0, Branch1; disabled
addition_5 = Addition(A=bang_4.Branch0, B=bang_4.Branch1)  # disabled
subtraction_4 = Subtraction(A=bang_4.Branch0, B=bang_4.Branch1)  # disabled
division_5 = Division(A=addition_5, B=2)  # disabled
division_6 = Division(A=subtraction_4, B=2)  # disabled
pt_7 = PointOriented(BasePlane=定位_3, UComponent=division_5, VComponent=0, WComponent=0)  # disabled
abs_3 = Absolute(Value=division_6)  # disabled
pl_origin_2 = PlaneOrigin(Base=定位_3, Origin=pt_7)  # disabled
arc_3 = Arc(Plane=pl_origin_2, Radius=division_6, Angle=Domain(0, 3.141592654))  # -> Arc, Length; disabled

# ----
# 平面随机移动
md_slider_4 = MDSlider(
    slider_value=Point(0, 0, 0.5),
    SliderMode=0,
    x_domain=Domain(-100, 100),
    y_domain=Domain(-100, 100),
    z_domain=Domain(0, 1))
方位_3 = Plane(md_slider_4)
pt_8 = PointOriented(BasePlane=方位_3, UComponent=0, VComponent=0, WComponent=0)
定位点_3 = Point(pt_8)

单次损耗步距_3 = Number(Slider(0.09, range=0..10))
最长步距_3 = Number(Slider(9.18, range=0..10))
最短步距_3 = Number(Slider(0, range=0..10))
移动次数_6 = Integer(移动次数)
neg_3 = Negative(Value=单次损耗步距_3)
series_4 = Series(Start=最长步距_3, Step=neg_3, Count=移动次数_6)

# ----
# 损耗后的步距最小不能低于最短步距
smaller_3 = SmallerThan(FirstNumber=series_4, SecondNumber=最短步距_3)  # -> SmallerThan, OrEqualTo
dispatch_4 = Dispatch(List=series_4, DispatchPattern=smaller_3.SmallerThan)  # -> ListA, ListB
lng_3 = ListLength(List=dispatch_4.ListA)
stack_3 = StackData(Data=最短步距_3, Stack=lng_3)
weave_3 = Weave(Pattern=smaller_3.SmallerThan, Stream0=dispatch_4.ListB, Stream1=stack_3, NullGaps=False)

渐变后步距系数_3 = Number(weave_3)

移动方向_3 = Integer(移动方向)
步距系数_2 = Number(渐变后步距系数_3)
multiplication_2 = Multiplication(A=步距系数_2, B=移动方向_3)
complex_3 = ComplexComponents(Complex=定位点)  # -> Real, Imaginary
实际步距_2 = Number(multiplication_2)
entwine = Entwine(Branch00=实际步距_2, Branch01=渐变后步距系数_3, FlattenInputs=True)
ma_3 = MassAddition(Input=entwine)  # -> Result, PartialResults
bang_5 = ExplodeTree(Data=ma_3.Result)  # -> Branch0, Branch1
bang_6 = ExplodeTree(Data=ma_3.PartialResults)  # -> Branch0, Branch1
相对原点的改变_3 = Number(bang_6.Branch0)
addition_6 = Addition(A=complex_3.Real, B=相对原点的改变_3)
移动后点x坐标序列_3 = Number(addition_6)
实际步距_3 = Number(实际步距_2)
轨迹总长_2 = Number(bang_5.Branch1)

# ---- group: 生成 / 移动后点的生成
complex_4 = CreateComplex(Real=移动后点x坐标序列_3, Imaginary=complex_3.Imaginary)
pt_9 = Point(complex_4)
item_5 = ListItem(List=pt_9, Index=-1, Wrap=True)
最终点_2 = Point(item_5)
pline_2 = PolyLine(Vertices=pt_9, Closed=False)

# ---- group: 轨迹长度计算(几何)
移动后生成点 = Point(pt_9)
定位点_4 = Point(定位点)
merge_3 = Merge(Data1=flatten(定位点_4), Data2=flatten(移动后生成点))
pline_3 = PolyLine(Vertices=merge_3, Closed=False)
len = Length(Curve=pline_3)

# ----
轨迹总长_3 = Number(轨迹总长_2)
轨迹总长_4 = Number(len)

实际步距_4 = Number(实际步距_3)

# ---- group: 生成 / 跳转弧线绘制
相对原点的改变_4 = Number(相对原点的改变_3)
merge_4 = Merge(Data1=flatten(0), Data2=flatten(相对原点的改变_4))
定位_4 = Plane(方位)
shift_3 = ShiftList(List=merge_4, Shift=[1, -1], Wrap=False)  # -> simplify(List)
bang_7 = ExplodeTree(Data=shift_3)  # -> Branch0, Branch1
addition_7 = Addition(A=bang_7.Branch0, B=bang_7.Branch1)
division_7 = Division(A=addition_7, B=2)
division_8 = Division(A=实际步距_4, B=2)
pt_10 = PointOriented(BasePlane=定位_4, UComponent=division_7, VComponent=0, WComponent=0)
abs_4 = Absolute(Value=division_8)  # disabled
pl_origin_3 = PlaneOrigin(Base=定位_4, Origin=pt_10)
arc_4 = Arc(Plane=pl_origin_3, Radius=division_8, Angle=Domain(0, 3.141592654))  # -> Arc, Length

# ----
移动方向_4 = Integer(正负系数)
步距系数_3 = Number(渐变后步距系数)
multiplication_3 = Multiplication(A=步距系数_3, B=移动方向_4)
实际步距_5 = Number(multiplication_3)
dispatch_5 = Dispatch(List=实际步距_5, DispatchPattern=前后or左右_bool)  # -> ListA, ListB; disabled
sift_2 = SiftPattern(List=实际步距_5, SiftPattern=前后or左右_bool)  # -> Output0, Output1
nullrep_3 = ReplaceNulls(Items=sift_2.Output1, Replacements="0")  # -> Items, Count
nullrep_4 = ReplaceNulls(Items=sift_2.Output0, Replacements="0")  # -> Items, Count
ma_4 = MassAddition(Input=步距系数_3)  # -> Result, PartialResults
轨迹总长_5 = Number(ma_4.Result)

# ----
# false上下移动det_y
# true   左右移动det_x
complex_5 = CreateComplex(Real=nullrep_3.Items, Imaginary=nullrep_4.Items)

ma_5 = MassAddition(Input=complex_5)  # -> Result, PartialResults
vec_2 = Vector(ma_5.PartialResults)

# ---- group: 移动后点的生成
定位点_5 = Point(定位点_3)
vec_3 = Vector(vec_2)
addition_8 = Addition(A=定位点_5, B=vec_3)
pt_11 = Point(addition_8)
merge_5 = Merge(Data1=flatten(定位点_5), Data2=flatten(pt_11))
item_6 = ListItem(List=pt_11, Index=-1, Wrap=True)
pline_4 = PolyLine(Vertices=merge_5, Closed=False)

# ---- group: 跳转弧线绘制
panel_8 = Panel("0,0,0")
定位_5 = Plane(方位_3)

# ----
int_5 = Integer(int_3)
vec_4 = Vector(vec_2)
pt_12 = Point(panel_8)
步距系数_4 = Number(渐变后步距系数)
flip = FlipMatrix(Data=int_5)
join = TextJoin(Text=flip)
最终点_3 = Point(item_6)
crv = Curve(pline_4)

# ---- group: 跳转弧线绘制 / 转换为圆弧弧度非plane位置
panel_9 = Panel("""0.5
1.5
0.0
1.0""")
addition_9 = Addition(A=panel_9, B=1)
merge_6 = Merge(Data1=graft(panel_9), Data2=graft(addition_9))
dom = ConstructDomain(DomainStart=panel_9, DomainEnd=addition_9)
multiplication_4 = Multiplication(A=merge_6, B=3.141592654)
item_7 = ListItem(List=multiplication_4, Index=0, Wrap=True)  # -> Item, Item1
dom_2 = ConstructDomain(DomainStart=item_7.Item, DomainEnd=item_7.Item1)
panel_10 = Panel("""00
11
01
10""")
pshift_2 = ShiftPaths(Data=dom_2, Offset=-1)
keysearch = KeyValueSearch(Keys=panel_10, Values=pshift_2, Search=join)
pshift_3 = ShiftPaths(Data=keysearch, Offset=-1)

# ---- group: 跳转弧线绘制 (continued)
merge_7 = Merge(Data1=flatten(pt_12), Data2=flatten(vec_4))
division_9 = Division(A=步距系数_4, B=2)
shift_4 = ShiftList(List=merge_7, Shift=[1, -1], Wrap=False)  # -> simplify(List)
flip_2 = FlipMatrix(Data=shift_4)
complex_6 = ComplexComponents(Complex=flip_2)  # -> Real, Imaginary
entwine_2 = Entwine(Branch00=complex_6.Real, Branch01=complex_6.Imaginary, FlattenInputs=True)
partition = PartitionList(List=entwine_2, Size=2)
pshift_4 = ShiftPaths(Data=partition, Offset=1)
ma_6 = MassAddition(Input=pshift_4)  # -> Result, PartialResults
division_10 = Division(A=ma_6.Result, B=2)
pshift_5 = ShiftPaths(Data=division_10, Offset=-1)
bang_8 = ExplodeTree(Data=pshift_5)  # -> Branch0, Branch1
pt_13 = PointOriented(BasePlane=定位_5, UComponent=bang_8.Branch0, VComponent=bang_8.Branch1, WComponent=0)
pl_origin_4 = PlaneOrigin(Base=定位_5, Origin=pt_13)
arc_5 = Arc(Plane=pl_origin_4, Radius=division_9, Angle=pshift_3)  # -> Arc, Length

# ----
flip_3 = FlipMatrix(Data=shift_4)  # disabled
complex_7 = ComplexComponents(Complex=flip_3)  # -> Real, Imaginary; disabled
entwine_3 = Entwine(Branch00=complex_7.Real, Branch01=complex_7.Imaginary, FlattenInputs=True)  # disabled
partition_2 = PartitionList(List=entwine_3, Size=2)  # disabled
pshift_6 = ShiftPaths(Data=partition_2, Offset=1)  # disabled
ma_7 = MassAddition(Input=pshift_6)  # -> Result, PartialResults; disabled
division_11 = Division(A=ma_7.Result, B=2)  # disabled
pshift_7 = ShiftPaths(Data=division_11, Offset=-1)  # disabled
bang_9 = ExplodeTree(Data=pshift_7)  # -> Branch0, Branch1; disabled

flip_4 = FlipMatrix(Data=shift_4)  # disabled
complex_8 = ComplexComponents(Complex=flip_4)  # -> Real, Imaginary; disabled
ma_8 = MassAddition(Input=complex_8.Real)  # -> Result, PartialResults; disabled
ma_9 = MassAddition(Input=complex_8.Imaginary)  # -> Result, PartialResults; disabled
division_12 = Division(A=ma_8.Result, B=2)  # -> flatten(Result); disabled
division_13 = Division(A=ma_9.Result, B=2)  # -> flatten(Result); disabled
complex_9 = CreateComplex(Real=division_12, Imaginary=division_13)  # disabled

bang_10 = ExplodeTree(Data=shift_4)  # -> Branch0, Branch1; disabled
panel_11 = Panel("""(x2+x1)/2
(y2+y1)/2""")  # disabled
complex_10 = ComplexComponents(Complex=bang_10.Branch0)  # -> Real, Imaginary; disabled
complex_11 = ComplexComponents(Complex=bang_10.Branch1)  # -> Real, Imaginary; disabled
eval = Evaluate(F=graft(panel_11), x1=complex_10.Real, y1=complex_10.Imaginary, x2=complex_11.Real, y2=complex_11.Imaginary)  # disabled
panel_12 = Panel("""x1,y1;
x2,y2;
((x2+x1)/2,)(y2+y1)/2)""")  # disabled
bang_11 = ExplodeTree(Data=eval)  # -> Branch0, Branch1; disabled
complex_12 = CreateComplex(Real=bang_11.Branch0, Imaginary=bang_11.Branch1)  # disabled

panel_13 = Panel(complex_9)  # disabled

# ---- group: 上下左右转换为弧度
panel_14 = Panel("""00
11
01
10""")  # disabled
panel_15 = Panel("""0.5*pi
1.5*pi
0.0*pi
1.0*pi""")  # disabled
keysearch_2 = KeyValueSearch(Keys=panel_14, Values=panel_15, Search=join)  # disabled
pshift_8 = ShiftPaths(Data=keysearch_2, Offset=-1)  # disabled

# ----
panel_16 = Panel(complex_12)

# ---- group: 上下左右转换为弧度 / 算两过大
prot_2 = RotatePlane(Plane=定位_5, Angle=pshift_8)  # disabled

# ----
crv_2 = Curve(arc_5.Arc)
