# Grasshopper definition 20170327_随机游走2.gh (Grasshopper 0.9.76)

# ---- group: 随机数判断前后
移动次数 = Integer(Slider(9000, range=0..10000))
num = Number(Slider(22.03, range=0..100))
random = Random(Range=Domain(0, 1), Number=移动次数, Seed=num)
panel = Panel("""1
-1""")
int = Integer(random)
item = ListItem(List=panel, Index=int, Wrap=True)
移动方向 = Integer(item)

# ----
panel_2 = Panel("""中点坐标计算
半径计算
缺省角度(0,pi)""")
md_slider = MDSlider(
    slider_value=Point(0.4500007629, 0.5678794167, 0.5),
    SliderMode=0,
    x_domain=Domain(-20, 20),
    y_domain=Domain(-20, 20),
    z_domain=Domain(0, 1))
remap = RemapNumbers(Value=Slider(0, range=0..1), Source=Domain(0, 1), Target=Domain(0, 6.283185307))  # -> Mapped, Clipped
series = Series(Start=0, Step=1, Count=Slider(7, range=0..10))
prot = RotatePlane(Plane=md_slider, Angle=remap.Mapped)
md_slider_2 = MDSlider(
    slider_value=Point(0.62890625, 0.70703125, 0.5),
    SliderMode=0,
    x_domain=Domain(-100, 100),
    y_domain=Domain(-100, 100),
    z_domain=Domain(0, 1))
item_2 = ListItem(List=["单向随机移动", "平面随机移动", "步距规律变化", "轨迹长度计算", "跳转弧线绘制", "移动趋势控制"], Index=Slider(0, range=0..5), Wrap=True)
jitter = Jitter(List=series, Jitter=1, Seed=2)  # -> Values, Indices
pln = Plane(prot)
方位 = Plane(md_slider_2)
panel_3 = Panel(item_2)

# ---- group: 跳转弧线绘制函数
移动后点x坐标序列 = Number(jitter.Values)
定位 = Plane(pln)
shift = ShiftList(List=移动后点x坐标序列, Shift=[1, -1], Wrap=False)  # -> simplify(List)
bang = ExplodeTree(Data=shift)  # -> Branch0, Branch1
addition = Addition(A=bang.Branch0, B=bang.Branch1)
subtraction = Subtraction(A=bang.Branch0, B=bang.Branch1)
division = Division(A=addition, B=2)
# 损耗后的步距最小不能低于最短步距
division_2 = Division(A=subtraction, B=2)
pt = PointOriented(BasePlane=定位, UComponent=division, VComponent=0, WComponent=0)
pl_origin = PlaneOrigin(Base=定位, Origin=pt)
arc = Arc(Plane=pl_origin, Radius=division_2, Angle=Domain(0, 3.141592654))  # -> Arc, Length

# ---- group: 跳转弧线绘制
pt_2 = Point(Point(32.67132851, -17.2431254, 0))
pt_3 = Point(Point(-6.61591646, -16.69677477, 0))
addition_2 = Addition(A=pt_3, B=pt_2)
dist = Distance(PointA=pt_3, PointB=pt_2)
division_3 = Division(A=addition_2, B=2)
division_4 = Division(A=dist, B=2)
arc_2 = Arc(Plane=division_3, Radius=division_4, Angle=Domain(0, 3.141592654))  # -> Arc, Length

# ----
pt_4 = PointOriented(BasePlane=方位, UComponent=0, VComponent=0, WComponent=0)
定位点 = Point(pt_4)
panel_4 = Panel("权重分配余数处理")
number_slider = Slider(9, range=0..100)  # disabled
number_slider_2 = Slider(8772, range=0..10000)  # disabled
genes = GenePool(Decimals=2, Maximum=100, Minimum=0, Value=[43.22, 52.02])  # disabled

md_slider_3 = MDSlider(
    slider_value=Point(0, 0, 0.5),
    SliderMode=0,
    x_domain=Domain(-100, 100),
    y_domain=Domain(-100, 100),
    z_domain=Domain(0, 1))
# 平面随机移动
方位_2 = Plane(md_slider_3)
pt_5 = PointOriented(BasePlane=方位_2, UComponent=0, VComponent=0, WComponent=0)
定位点_2 = Point(pt_5)
preview = CustomPreview(Geometry=定位点_2, Shader=ColourSwatch(SwatchColor=RGB(255, 255, 255)))

单次损耗步距 = Number(Slider(0, range=0..10))
最长步距 = Number(Slider(8.89, range=0..10))
最短步距 = Number(Slider(0, range=0..10))

number_slider_3 = Slider(0, range=0..10000)
number_slider_4 = Slider(2000, range=0..10000)
移动次数_2 = Integer(Slider(55, range=0..100))

number_slider_5 = Slider(10001, range=0..100000)
移动次数_3 = Integer(number_slider)  # disabled

# ----
# 权重分配开关
# True分配权重
number_slider_6 = Slider(0.823, range=0..1)
toggle_down = BooleanToggle(False)
toggle_right = BooleanToggle(True)
toggle_left = BooleanToggle(True)
toggle_up = BooleanToggle(True)
趋势权重总 = Number(number_slider_6)
seed = Number(Slider(19.81, range=0..100))

num_2 = Number(genes)  # disabled
random_2 = Random(Range=Domain(0, 1), Number=移动次数_3, Seed=graft(num_2))  # disabled
panel_5 = Panel("有序权值插入无序列表")
pshift = ShiftPaths(Data=random_2, Offset=-1)  # disabled
int_2 = Integer(pshift)  # disabled
flip = FlipMatrix(Data=int_2)  # disabled
join = TextJoin(Text=flip)  # -> flatten(Result); disabled
panel_7 = Panel("""00
11
01
10""")  # disabled
mindex = MemberIndex(Set=panel_7, Member=join)  # -> flatten(Index), Count; disabled
bar_graph = BarGraph(mindex.Index, BarColor=RGB(255, 0, 90))  # disabled
pie = PieChart(mindex.Index)  # disabled

# ---- group: 移动方向生成
panel_8 = Panel("""00
11
01
10""")  # disabled
mindex_2 = MemberIndex(Set=panel_8)  # -> flatten(Index), Count; disabled
bar_graph_2 = BarGraph(mindex_2.Index, BarColor=RGB(255, 0, 90))  # disabled

# ---- group: 步距衰减生成
单次损耗步距_2 = Number(单次损耗步距)
移动次数_4 = Integer(移动次数_2)
最长步距_2 = Number(最长步距)
最短步距_2 = Number(最短步距)
neg = Negative(Value=单次损耗步距_2)
series_2 = Series(Start=最长步距_2, Step=neg, Count=移动次数_4)
smaller = SmallerThan(FirstNumber=series_2, SecondNumber=最短步距_2)  # -> SmallerThan, OrEqualTo
dispatch = Dispatch(List=series_2, DispatchPattern=smaller.SmallerThan)  # -> ListA, ListB
lng = ListLength(List=dispatch.ListA)
stack = StackData(Data=最短步距_2, Stack=lng)
weave = Weave(Pattern=smaller.SmallerThan, Stream0=dispatch.ListB, Stream1=stack, NullGaps=False)
渐变后步距系数 = Number(weave)

# ----
单次损耗步距_3 = Number(Slider(0.09, range=0..10))
最长步距_3 = Number(Slider(9.18, range=0..10))
最短步距_3 = Number(Slider(0, range=0..10))
移动次数_5 = Integer(移动次数)
neg_2 = Negative(Value=单次损耗步距_3)
series_3 = Series(Start=最长步距_3, Step=neg_2, Count=移动次数_5)

# ----
# 损耗后的步距最小不能低于最短步距
smaller_2 = SmallerThan(FirstNumber=series_3, SecondNumber=最短步距_3)  # -> SmallerThan, OrEqualTo
dispatch_2 = Dispatch(List=series_3, DispatchPattern=smaller_2.SmallerThan)  # -> ListA, ListB
lng_2 = ListLength(List=dispatch_2.ListA)
stack_2 = StackData(Data=最短步距_3, Stack=lng_2)
weave_2 = Weave(Pattern=smaller_2.SmallerThan, Stream0=dispatch_2.ListB, Stream1=stack_2, NullGaps=False)

渐变后步距系数_2 = Number(weave_2)

移动方向_2 = Integer(移动方向)
步距系数 = Number(渐变后步距系数_2)
multiplication = Multiplication(A=步距系数, B=移动方向_2)
complex = ComplexComponents(Complex=定位点)  # -> Real, Imaginary
实际步距 = Number(multiplication)
entwine = Entwine(Branch00=实际步距, Branch01=渐变后步距系数_2, FlattenInputs=True)
ma = MassAddition(Input=entwine)  # -> Result, PartialResults
bang_2 = ExplodeTree(Data=ma.Result)  # -> Branch0, Branch1
bang_3 = ExplodeTree(Data=ma.PartialResults)  # -> Branch0, Branch1
相对原点的改变 = Number(bang_3.Branch0)
addition_3 = Addition(A=complex.Real, B=相对原点的改变)
移动后点x坐标序列_2 = Number(addition_3)
实际步距_2 = Number(实际步距)
轨迹总长 = Number(bang_2.Branch1)

# ---- group: 生成 / 移动后点的生成
complex_2 = CreateComplex(Real=移动后点x坐标序列_2, Imaginary=complex.Imaginary)
pt_6 = Point(complex_2)
item_3 = ListItem(List=pt_6, Index=-1, Wrap=True)
最终点 = Point(item_3)
pline = PolyLine(Vertices=pt_6, Closed=False)

# ---- group: 轨迹长度计算(几何)
移动后生成点 = Point(pt_6)
定位点_3 = Point(定位点)
merge = Merge(Data1=flatten(定位点_3), Data2=flatten(移动后生成点))
pline_2 = PolyLine(Vertices=merge, Closed=False)
len = Length(Curve=pline_2)

# ----
轨迹总长_2 = Number(轨迹总长)
轨迹总长_3 = Number(len)

实际步距_3 = Number(实际步距_2)

# ---- group: 生成 / 跳转弧线绘制
相对原点的改变_2 = Number(相对原点的改变)
merge_2 = Merge(Data1=flatten(0), Data2=flatten(相对原点的改变_2))
定位_2 = Plane(方位)
shift_2 = ShiftList(List=merge_2, Shift=[1, -1], Wrap=False)  # -> simplify(List)
bang_4 = ExplodeTree(Data=shift_2)  # -> Branch0, Branch1
addition_4 = Addition(A=bang_4.Branch0, B=bang_4.Branch1)
division_5 = Division(A=addition_4, B=2)
division_6 = Division(A=实际步距_3, B=2)
pt_7 = PointOriented(BasePlane=定位_2, UComponent=division_5, VComponent=0, WComponent=0)
abs = Absolute(Value=division_6)  # disabled
pl_origin_2 = PlaneOrigin(Base=定位_2, Origin=pt_7)
arc_3 = Arc(Plane=pl_origin_2, Radius=division_6, Angle=Domain(0, 3.141592654))  # -> Arc, Length

# ---- group: 移动方向生成
merge_3 = Merge(Data1=Toggle(False), Data2=Toggle(True), Data3=Toggle(False), Data4=Toggle(True))
趋势权重总_2 = Number(Slider(0.44, range=0..1))
移动次数_6 = Integer(Slider(3, range=0..100))
multiplication_2 = Multiplication(A=移动次数_6, B=趋势权重总_2)
mindex_3 = MemberIndex(Set=merge_3, Member=Toggle(True))  # -> Index, Count
int_3 = Integer(multiplication_2)
subtraction_2 = Subtraction(A=移动次数_6, B=int_3)
int_4 = Integer(mindex_3.Index)
subtraction_3 = Subtraction(A=mindex_3.Count, B=1)
权重剩余移动次数 = Integer(subtraction_2)
random_3 = Random(Range=subtraction_3, Number=int_3, Seed=2)
item_4 = ListItem(List=int_4, Index=random_3, Wrap=True)
random_4 = Random(Range=Domain(0, 3), Number=权重剩余移动次数, Seed=Slider(24.3, range=0..100))
加权后random返回值 = Integer(random_4)
加权值索引序列 = Integer(item_4)
panel_9 = Panel("""00
11
01
10""")

# 将加权后的random返回的值，随机替换成剩余的值
panel_10 = Panel("""0
1
2
3""")
int_5 = Integer(panel_10)
int_6 = Integer(int_4)
replace = ReplaceMembers(Set=int_5, Find=int_6)
int_7 = Integer(加权后random返回值)
pshift_2 = ShiftPaths(Data=replace, Offset=-1)
mindex_4 = MemberIndex(Set=int_7, Member=int_6)  # -> flatten(Index), Count
lng_3 = ListLength(List=pshift_2)
ma_2 = MassAddition(Input=mindex_4.Count)  # -> Result, PartialResults
subtraction_4 = Subtraction(A=lng_3, B=1)
random_5 = Random(Range=subtraction_4, Number=ma_2.Result, Seed=Slider(51.45, range=0..100))
int_8 = Integer(random_5)
item_5 = ListItem(List=pshift_2, Index=int_8, Wrap=True)
replace_2 = ReplaceItems(List=int_7, Item=item_5, Indices=mindex_4.Index, Wrap=False)

# ----
subtraction_5 = Subtraction(A=mindex_3.Count, B=1)  # disabled
panel_11 = Panel("多个权重分配问题")  # disabled
int_9 = Integer(int_3)  # disabled
random_6 = Random(Range=subtraction_5, Number=int_9, Seed=2)  # disabled
int_10 = Integer(int_4)  # disabled
item_6 = ListItem(List=int_10, Index=random_6, Wrap=True)  # disabled

# ---- group: 移动方向生成 (continued)
替换掉加权值后的索引序列 = Integer(replace_2)
merge_4 = Merge(Data1=flatten(加权值索引序列), Data2=flatten(替换掉加权值后的索引序列))
jitter_2 = Jitter(List=merge_4, Jitter=1, Seed=2)  # -> Values, Indices
item_7 = ListItem(List=panel_9, Index=jitter_2.Values, Wrap=True)
chars = Characters(Text=item_7)  # -> Result, Unicode
flip_2 = FlipMatrix(Data=chars.Result)
pshift_3 = ShiftPaths(Data=flip_2, Offset=1)
pshift_4 = ShiftPaths(Data=item_7, Offset=-1)
方向_拆解 = Integer(pshift_3)
方向_合并 = Text(pshift_4)

# ----
正确的加权值索引序列数量 = Integer(int_3)  # disabled
lng_4 = ListLength(List=替换掉加权值后的索引序列)  # disabled
addition_5 = Addition(A=正确的加权值索引序列数量, B=lng_4)  # disabled

seed_2 = Number(seed)
权重开关 = Boolean([toggle_up, toggle_down, toggle_right, toggle_left])
趋势权重总_3 = Number(趋势权重总)
mindex_5 = MemberIndex(Set=权重开关, Member=True)  # -> Index, Count
int_11 = Integer(mindex_5.Count)
int_12 = Integer(mindex_5.Index)
subtraction_6 = Subtraction(A=int_11, B=1)
seed_3 = Number(seed_2)
panel_12 = Panel("""00
11
01
10""")

equals = Equality(FirstNumber=int_11, SecondNumber=4)  # -> Equality, Inequality
gate = StreamGate(Stream=移动次数_2, Gate=equals.Equality)  # -> Target0, Target1
genes_2 = GenePool(Decimals=2, Maximum=100, Minimum=0, Value=[100, 86.66])
移动次数_7 = Integer(gate.Target1)
num_3 = Number(genes_2)
random_7 = Random(Range=Domain(0, 1), Number=移动次数_7, Seed=graft(num_3))
int_13 = Integer(random_7)
flip_3 = FlipMatrix(Data=int_13)
join_2 = TextJoin(Text=flip_3)
pshift_5 = ShiftPaths(Data=join_2, Offset=-2)
pshift_6 = ShiftPaths(Data=random_7, Offset=-1)
方向_拆解_2 = Integer(pshift_6)
方向_合并_2 = Text(pshift_5)
加权方式_bool = Boolean(equals.Equality)

移动次数_8 = Integer(gate.Target0)
multiplication_3 = Multiplication(A=移动次数_8, B=趋势权重总_3)
int_14 = Integer(multiplication_3)
subtraction_7 = Subtraction(A=移动次数_8, B=multiplication_3)
权重剩余移动次数_2 = Integer(subtraction_7)
random_8 = Random(Range=subtraction_6, Number=int_14, Seed=2)
random_9 = Random(Range=Domain(0, 3), Number=权重剩余移动次数_2, Seed=Slider(11.22, range=0..100))
item_8 = ListItem(List=int_12, Index=random_8, Wrap=True)
加权后random返回值_2 = Integer(random_9)
加权值索引序列_2 = Integer(item_8)

# ----
# 将加权后的random返回的值，随机替换成剩余的值
panel_13 = Panel("""0
1
2
3""")
int_15 = Integer(panel_13)
int_16 = Integer(int_12)
replace_3 = ReplaceMembers(Set=int_15, Find=int_16)
pshift_7 = ShiftPaths(Data=replace_3, Offset=-1)
int_17 = Integer(加权后random返回值_2)
mindex_6 = MemberIndex(Set=int_17, Member=int_16)  # -> flatten(Index), Count
lng_5 = ListLength(List=pshift_7)
ma_3 = MassAddition(Input=mindex_6.Count)  # -> Result, PartialResults
subtraction_8 = Subtraction(A=lng_5, B=1)
random_10 = Random(Range=subtraction_8, Number=ma_3.Result, Seed=Slider(51.45, range=0..100))
int_18 = Integer(random_10)
item_9 = ListItem(List=pshift_7, Index=int_18, Wrap=True)
replace_4 = ReplaceItems(List=int_17, Item=item_9, Indices=mindex_6.Index, Wrap=False)

替换掉加权值后的索引序列_2 = Integer(replace_4)
merge_5 = Merge(Data1=flatten(加权值索引序列_2), Data2=flatten(替换掉加权值后的索引序列_2))
jitter_3 = Jitter(List=merge_5, Jitter=1, Seed=seed_3)  # -> Values, Indices
item_10 = ListItem(List=panel_12, Index=jitter_3.Values, Wrap=True)
chars_2 = Characters(Text=item_10)  # -> Result, Unicode
flip_4 = FlipMatrix(Data=chars_2.Result)
pshift_8 = ShiftPaths(Data=flip_4, Offset=1)
pshift_9 = ShiftPaths(Data=item_10, Offset=-1)
方向_拆解_3 = Integer(pshift_8)
方向_合并_3 = Text(pshift_9)

filter = StreamFilter(Gate=加权方式_bool, Stream0=方向_合并_3, Stream1=方向_合并_2)
filter_2 = StreamFilter(Gate=加权方式_bool, Stream0=方向_拆解_3, Stream1=方向_拆解_2)

# ---- group: 方向解析
# 随机两次的值
# 00 --> 向上 --> 1   False
# 11 --> 向下 --> -1 False
# 01  --> 向右--> 1 True
# 10  --> 向左--> -1 True
# 第一个数为0得到1,否则为-1
# 两个数相同得到false，在前后方向上游走
方向_拆解_4 = Integer(filter_2)
bang_5 = ExplodeTree(Data=simplify(方向_拆解_4))  # -> Branch0, Branch1
subtraction_9 = Subtraction(A=bang_5.Branch0, B=bang_5.Branch1)
panel_14 = Panel("""1
-1""")
abs_2 = Absolute(Value=subtraction_9)
item_11 = ListItem(List=panel_14, Index=bang_5.Branch0, Wrap=True)
前后or左右_bool = Boolean(abs_2)
正负系数 = Integer(item_11)

# ---- group: 步距向量转换
步距系数_2 = Number(渐变后步距系数)
移动方向_3 = Integer(正负系数)
multiplication_4 = Multiplication(A=移动方向_3, B=步距系数_2)
实际步距_4 = Number(multiplication_4)
sift = SiftPattern(List=实际步距_4, SiftPattern=前后or左右_bool)  # -> Output0, Output1
ma_4 = MassAddition(Input=步距系数_2)  # -> Result, PartialResults
nullrep = ReplaceNulls(Items=sift.Output1, Replacements="0")  # -> Items, Count
nullrep_2 = ReplaceNulls(Items=sift.Output0, Replacements="0")  # -> Items, Count
轨迹总长_4 = Number(ma_4.Result)

# false上下移动det_y
# true   左右移动det_x
complex_3 = CreateComplex(Real=nullrep.Items, Imaginary=nullrep_2.Items)

ma_5 = MassAddition(Input=complex_3)  # -> Result, PartialResults
vec = Vector(ma_5.PartialResults)

# ---- group: 移动点绘制
定位点_4 = Point(定位点_2)
vec_2 = Vector(vec)
addition_6 = Addition(A=定位点_4, B=vec_2)
pt_8 = Point(addition_6)
merge_6 = Merge(Data1=flatten(定位点_4), Data2=flatten(pt_8))
item_12 = ListItem(List=pt_8, Index=-1, Wrap=True)
pline_3 = PolyLine(Vertices=merge_6, Closed=False)

# ----
步距系数_3 = Number(渐变后步距系数)
vec_3 = Vector(vec)

# ---- group: 跳转弧线绘制
方向_合并_4 = Text(graft(filter))
panel_15 = Panel("0,0,0")
定位_3 = Plane(方位_2)
division_7 = Division(A=步距系数_3, B=2)
pshift_10 = ShiftPaths(Data=方向_合并_4, Offset=1)

# ----
pt_9 = Point(panel_15)

# ---- group: 跳转弧线绘制 / 转换为圆弧弧度非plane位置
panel_16 = Panel("""0.5
1.5
0.0
1.0""")
addition_7 = Addition(A=panel_16, B=1)
merge_7 = Merge(Data1=graft(panel_16), Data2=graft(addition_7))
dom = ConstructDomain(DomainStart=panel_16, DomainEnd=addition_7)
multiplication_5 = Multiplication(A=merge_7, B=3.141592654)
item_13 = ListItem(List=multiplication_5, Index=0, Wrap=True)  # -> Item, Item1
dom_2 = ConstructDomain(DomainStart=item_13.Item, DomainEnd=item_13.Item1)
pshift_11 = ShiftPaths(Data=dom_2, Offset=-1)
panel_17 = Panel("""00
11
01
10""")
keysearch = KeyValueSearch(Keys=panel_17, Values=pshift_11, Search=pshift_10)

# ---- group: 跳转弧线绘制 (continued)
merge_8 = Merge(Data1=flatten(pt_9), Data2=flatten(vec_3))
shift_3 = ShiftList(List=merge_8, Shift=[1, -1], Wrap=False)  # -> simplify(List)
flip_5 = FlipMatrix(Data=shift_3)
complex_4 = ComplexComponents(Complex=flip_5)  # -> Real, Imaginary
entwine_2 = Entwine(Branch00=complex_4.Real, Branch01=complex_4.Imaginary, FlattenInputs=True)
partition = PartitionList(List=entwine_2, Size=2)
pshift_12 = ShiftPaths(Data=partition, Offset=1)
ma_6 = MassAddition(Input=pshift_12)  # -> Result, PartialResults
division_8 = Division(A=ma_6.Result, B=2)
pshift_13 = ShiftPaths(Data=division_8, Offset=-1)
bang_6 = ExplodeTree(Data=pshift_13)  # -> Branch0, Branch1
pt_10 = PointOriented(BasePlane=定位_3, UComponent=bang_6.Branch0, VComponent=bang_6.Branch1, WComponent=0)
pl_origin_3 = PlaneOrigin(Base=定位_3, Origin=pt_10)
arc_4 = Arc(Plane=pl_origin_3, Radius=division_7, Angle=flatten(keysearch))  # -> Arc, Length

# ----
crv = Curve(arc_4.Arc)
crv_2 = Curve(pline_3)
最终点_2 = Point(item_12)
