# Grasshopper definition 20170327_随机游走3.gh (Grasshopper 0.9.76)

panel = Panel("权重分配余数处理")

md_slider = MDSlider(
    slider_value=Point(0, 0, 0.5),
    SliderMode=0,
    x_domain=Domain(-100, 100),
    y_domain=Domain(-100, 100),
    z_domain=Domain(0, 1))
# 平面随机移动
方位 = Plane(md_slider)
pt = PointOriented(BasePlane=方位, UComponent=0, VComponent=0, WComponent=0)
定位点 = Point(pt)
preview = CustomPreview(Geometry=定位点, Shader=ColourSwatch(SwatchColor=RGB(255, 255, 255)))

number_slider = Slider(0, range=0..10000)
number_slider_2 = Slider(72, range=0..100)
number_slider_3 = Slider(2000, range=0..10000)
移动次数 = Integer(Slider(10001, range=0..100000))

单次损耗步距 = Number(Slider(0, range=0..10))
最长步距 = Number(Slider(8.89, range=0..10))
最短步距 = Number(Slider(0, range=0..10))

# ----
# 权重分配开关
# True分配权重
number_slider_4 = Slider(0.637, range=0..1)
toggle_down = BooleanToggle(False)
toggle_right = BooleanToggle(False)
toggle_left = BooleanToggle(False)
toggle_up = BooleanToggle(False)
趋势权重总 = Number(number_slider_4)
seed = Number(Slider(25.19, range=0..100))

panel_2 = Panel("有序权值插入无序列表")

# ---- group: 移动方向生成
panel_3 = Panel("""00
11
01
10""")  # disabled
mindex = MemberIndex(Set=panel_3)  # -> flatten(Index), Count; disabled
bar_graph = BarGraph(mindex.Index, BarColor=RGB(255, 0, 90))  # disabled

# ---- group: 步距衰减生成
单次损耗步距_2 = Number(单次损耗步距)
移动次数_2 = Integer(移动次数)
最长步距_2 = Number(最长步距)
最短步距_2 = Number(最短步距)
neg = Negative(Value=单次损耗步距_2)
series = Series(Start=最长步距_2, Step=neg, Count=移动次数_2)
smaller = SmallerThan(FirstNumber=series, SecondNumber=最短步距_2)  # -> SmallerThan, OrEqualTo
dispatch = Dispatch(List=series, DispatchPattern=smaller.SmallerThan)  # -> ListA, ListB
lng = ListLength(List=dispatch.ListA)
stack = StackData(Data=最短步距_2, Stack=lng)
weave = Weave(Pattern=smaller.SmallerThan, Stream0=dispatch.ListB, Stream1=stack, NullGaps=False)
渐变后步距系数 = Number(weave)

# ---- group: 移动方向生成
# 损耗后的步距最小不能低于最短步距
toggle = BooleanToggle(True)
merge = Merge(Data1=Toggle(True), Data2=Toggle(True), Data3=Toggle(False), Data4=toggle)
趋势权重总_2 = Number(Slider(0.44, range=0..1))
移动次数_3 = Integer(Slider(21, range=0..100))
multiplication = Multiplication(A=移动次数_3, B=趋势权重总_2)
mindex_2 = MemberIndex(Set=merge, Member=Toggle(True))  # -> Index, Count
int = Integer(multiplication)
subtraction = Subtraction(A=移动次数_3, B=int)
int_2 = Integer(mindex_2.Index)
subtraction_2 = Subtraction(A=mindex_2.Count, B=1)
权重剩余移动次数 = Integer(subtraction)
random = Random(Range=subtraction_2, Number=int, Seed=2)
item = ListItem(List=int_2, Index=random, Wrap=True)
random_2 = Random(Range=Domain(0, 3), Number=权重剩余移动次数, Seed=Slider(24.3, range=0..100))
加权后random返回值 = Integer(random_2)
加权值索引序列 = Integer(item)
panel_4 = Panel("""00
11
01
10""")

# 将加权后的random返回的值，随机替换成剩余的值
panel_5 = Panel("""0
1
2
3""")
int_3 = Integer(panel_5)
int_4 = Integer(int_2)
replace = ReplaceMembers(Set=int_3, Find=int_4)
pshift = ShiftPaths(Data=replace, Offset=-1)
int_5 = Integer(加权后random返回值)
mindex_3 = MemberIndex(Set=int_5, Member=int_4)  # -> flatten(Index), Count
lng_2 = ListLength(List=pshift)
ma = MassAddition(Input=mindex_3.Count)  # -> Result, PartialResults
subtraction_3 = Subtraction(A=lng_2, B=1)
random_3 = Random(Range=subtraction_3, Number=ma.Result, Seed=Slider(51.45, range=0..100))
int_6 = Integer(random_3)
item_2 = ListItem(List=pshift, Index=int_6, Wrap=True)
replace_2 = ReplaceItems(List=int_5, Item=item_2, Indices=mindex_3.Index, Wrap=False)

替换掉加权值后的索引序列 = Integer(replace_2)
merge_2 = Merge(Data1=flatten(加权值索引序列), Data2=flatten(替换掉加权值后的索引序列))
jitter = Jitter(List=merge_2, Jitter=1, Seed=2)  # -> Values, Indices
item_3 = ListItem(List=panel_4, Index=jitter.Values, Wrap=True)
chars = Characters(Text=item_3)  # -> Result, Unicode
flip = FlipMatrix(Data=chars.Result)
pshift_2 = ShiftPaths(Data=flip, Offset=1)
pshift_3 = ShiftPaths(Data=item_3, Offset=-1)
方向_拆解 = Integer(pshift_2)
方向_合并 = Text(pshift_3)

# ----
正确的加权值索引序列数量 = Integer(int)  # disabled
lng_3 = ListLength(List=替换掉加权值后的索引序列)  # disabled
addition = Addition(A=正确的加权值索引序列数量, B=lng_3)  # disabled

panel_6 = Panel("""0
4""")
genes = GenePool(Decimals=2, Maximum=100, Minimum=0, Value=[88.57, 100])
seed_2 = Number(genes)

seed_3 = Number(seed)
权重开关 = Boolean([toggle_up, toggle_down, toggle_right, toggle_left])
趋势权重总_3 = Number(趋势权重总)
mindex_4 = MemberIndex(Set=权重开关, Member=True)  # -> Index, Count
int_7 = Integer(mindex_4.Count)
int_8 = Integer(mindex_4.Index)
subtraction_4 = Subtraction(A=int_7, B=1)
seed_4 = Number(seed_3)
panel_7 = Panel("""00
11
01
10""")

equals = Equality(FirstNumber=int_7, SecondNumber=panel_6)  # -> Equality, Inequality
item_4 = ListItem(List=equals.Equality, Index=0, Wrap=True)  # -> Item, Item1
or = GateOr(A=item_4.Item, B=item_4.Item1)
加权方式_bool = Boolean(or)
gate = StreamGate(Stream=移动次数, Gate=加权方式_bool)  # -> Target0, Target1
移动次数_4 = Integer(gate.Target1)
random_4 = Random(Range=Domain(0, 1), Number=移动次数_4, Seed=graft(seed_2))
int_9 = Integer(random_4)
flip_2 = FlipMatrix(Data=int_9)
join = TextJoin(Text=flip_2)
pshift_4 = ShiftPaths(Data=random_4, Offset=-1)
pshift_5 = ShiftPaths(Data=join, Offset=-2)
方向_拆解_2 = Integer(pshift_4)
方向_合并_2 = Text(pshift_5)
加权方式_bool_2 = Boolean(加权方式_bool)

移动次数_5 = Integer(gate.Target0)
multiplication_2 = Multiplication(A=移动次数_5, B=趋势权重总_3)
int_10 = Integer(multiplication_2)
subtraction_5 = Subtraction(A=移动次数_5, B=multiplication_2)
权重剩余移动次数_2 = Integer(subtraction_5)
random_5 = Random(Range=subtraction_4, Number=int_10, Seed=2)
random_6 = Random(Range=Domain(0, 3), Number=权重剩余移动次数_2, Seed=Slider(11.22, range=0..100))
item_5 = ListItem(List=int_8, Index=random_5, Wrap=True)
加权后random返回值_2 = Integer(random_6)
加权值索引序列_2 = Integer(item_5)

# ----
# 将加权后的random返回的值，随机替换成剩余的值
panel_8 = Panel("""0
1
2
3""")
int_11 = Integer(panel_8)
int_12 = Integer(int_8)
replace_3 = ReplaceMembers(Set=int_11, Find=int_12)
pshift_6 = ShiftPaths(Data=replace_3, Offset=-1)
int_13 = Integer(加权后random返回值_2)
mindex_5 = MemberIndex(Set=int_13, Member=int_12)  # -> flatten(Index), Count
lng_4 = ListLength(List=pshift_6)
ma_2 = MassAddition(Input=mindex_5.Count)  # -> Result, PartialResults
subtraction_6 = Subtraction(A=lng_4, B=1)
random_7 = Random(Range=subtraction_6, Number=ma_2.Result, Seed=Slider(51.45, range=0..100))
int_14 = Integer(random_7)
item_6 = ListItem(List=pshift_6, Index=int_14, Wrap=True)
replace_4 = ReplaceItems(List=int_13, Item=item_6, Indices=mindex_5.Index, Wrap=False)

替换掉加权值后的索引序列_2 = Integer(replace_4)
merge_3 = Merge(Data1=flatten(加权值索引序列_2), Data2=flatten(替换掉加权值后的索引序列_2))
jitter_2 = Jitter(List=merge_3, Jitter=1, Seed=seed_4)  # -> Values, Indices
item_7 = ListItem(List=panel_7, Index=jitter_2.Values, Wrap=True)
chars_2 = Characters(Text=item_7)  # -> Result, Unicode
flip_3 = FlipMatrix(Data=chars_2.Result)
pshift_7 = ShiftPaths(Data=flip_3, Offset=1)
pshift_8 = ShiftPaths(Data=item_7, Offset=-1)
方向_拆解_3 = Integer(pshift_7)
方向_合并_3 = Text(pshift_8)

filter = StreamFilter(Gate=加权方式_bool_2, Stream0=方向_合并_3, Stream1=方向_合并_2)
filter_2 = StreamFilter(Gate=加权方式_bool_2, Stream0=方向_拆解_3, Stream1=方向_拆解_2)

# ---- group: 方向解析
# 随机两次的值
# 00 --> 向上 --> 1   False
# 11 --> 向下 --> -1 False
# 01  --> 向右--> 1 True
# 10  --> 向左--> -1 True
# 第一个数为0得到1,否则为-1
# 两个数相同得到false，在前后方向上游走
方向_拆解_4 = Integer(filter_2)
bang = ExplodeTree(Data=simplify(方向_拆解_4))  # -> Branch0, Branch1
subtraction_7 = Subtraction(A=bang.Branch0, B=bang.Branch1)
panel_9 = Panel("""1
-1""")
abs = Absolute(Value=subtraction_7)
item_8 = ListItem(List=panel_9, Index=bang.Branch0, Wrap=True)
前后or左右_bool = Boolean(abs)
正负系数 = Integer(item_8)

# ---- group: 步距向量转换
步距系数 = Number(渐变后步距系数)
移动方向 = Integer(正负系数)
multiplication_3 = Multiplication(A=移动方向, B=步距系数)
实际步距 = Number(multiplication_3)
sift = SiftPattern(List=实际步距, SiftPattern=前后or左右_bool)  # -> Output0, Output1
ma_3 = MassAddition(Input=步距系数)  # -> Result, PartialResults
nullrep = ReplaceNulls(Items=sift.Output1, Replacements="0")  # -> Items, Count
nullrep_2 = ReplaceNulls(Items=sift.Output0, Replacements="0")  # -> Items, Count
轨迹总长 = Number(ma_3.Result)

# false上下移动det_y
# true   左右移动det_x
complex = CreateComplex(Real=nullrep.Items, Imaginary=nullrep_2.Items)

ma_4 = MassAddition(Input=complex)  # -> Result, PartialResults
vec = Vector(ma_4.PartialResults)

# ---- group: 移动点绘制
定位点_2 = Point(定位点)
vec_2 = Vector(vec)
addition_2 = Addition(A=定位点_2, B=vec_2)
pt_2 = Point(addition_2)
merge_4 = Merge(Data1=flatten(定位点_2), Data2=flatten(pt_2))
item_9 = ListItem(List=pt_2, Index=-1, Wrap=True)
pline = PolyLine(Vertices=merge_4, Closed=False)

# ----
步距系数_2 = Number(渐变后步距系数)
vec_3 = Vector(vec)

# ---- group: 跳转弧线绘制
方向_合并_4 = Text(graft(filter))
panel_10 = Panel("0,0,0")
定位 = Plane(方位)
division = Division(A=步距系数_2, B=2)
pshift_9 = ShiftPaths(Data=方向_合并_4, Offset=1)

# ----
pt_3 = Point(panel_10)

# ---- group: 跳转弧线绘制 / 转换为圆弧弧度非plane位置
panel_11 = Panel("""0.5
1.5
0.0
1.0""")
addition_3 = Addition(A=panel_11, B=1)
merge_5 = Merge(Data1=graft(panel_11), Data2=graft(addition_3))
dom = ConstructDomain(DomainStart=panel_11, DomainEnd=addition_3)
multiplication_4 = Multiplication(A=merge_5, B=3.141592654)
item_10 = ListItem(List=multiplication_4, Index=0, Wrap=True)  # -> Item, Item1
dom_2 = ConstructDomain(DomainStart=item_10.Item, DomainEnd=item_10.Item1)
pshift_10 = ShiftPaths(Data=dom_2, Offset=-1)
panel_12 = Panel("""00
11
01
10""")
keysearch = KeyValueSearch(Keys=panel_12, Values=pshift_10, Search=pshift_9)

# ---- group: 跳转弧线绘制 (continued)
merge_6 = Merge(Data1=flatten(pt_3), Data2=flatten(vec_3))
shift = ShiftList(List=merge_6, Shift=[1, -1], Wrap=False)  # -> simplify(List)
flip_4 = FlipMatrix(Data=shift)
complex_2 = ComplexComponents(Complex=flip_4)  # -> Real, Imaginary
entwine = Entwine(Branch00=complex_2.Real, Branch01=complex_2.Imaginary, FlattenInputs=True)
partition = PartitionList(List=entwine, Size=2)
pshift_11 = ShiftPaths(Data=partition, Offset=1)
ma_5 = MassAddition(Input=pshift_11)  # -> Result, PartialResults
division_2 = Division(A=ma_5.Result, B=2)
pshift_12 = ShiftPaths(Data=division_2, Offset=-1)
bang_2 = ExplodeTree(Data=pshift_12)  # -> Branch0, Branch1
pt_4 = PointOriented(BasePlane=定位, UComponent=bang_2.Branch0, VComponent=bang_2.Branch1, WComponent=0)
pl_origin = PlaneOrigin(Base=定位, Origin=pt_4)
arc = Arc(Plane=pl_origin, Radius=division, Angle=flatten(keysearch))  # -> Arc, Length

# ----
crv = Curve(arc.Arc)
crv_2 = Curve(pline)
最终点 = Point(item_9)
