# Grasshopper definition 20170329_垂直构件限定空间.gh (Grasshopper 0.9.76)

panel = Panel("""开间
进深
墙厚
墙高
柱宽
柱高""")
# 上,下,左,右
# 上左,左下,下右,右上
# 上下,左右
# 上左右,左下上,下右下,左下右
panel_2 = Panel("""全围合
单面开敞
两面开敞（临边）
两面开敞（对边）
三面开敞
四面开敞""")
panel_3 = Panel("垂直构件限定空间")

# ---- group: 房间输入参数
md_slider = MDSlider(slider_value=Point(0.5, 0.5, 0.5), SliderMode=0, x_domain=Domain(0, 1), y_domain=Domain(0, 1), z_domain=Domain(0, 1))
房宽 = Slider(4000, range=0..5000)
角度 = Slider(0, range=0..360)
房深 = Slider(6000, range=0..6000)
墙厚 = Slider(200, range=0..5000)
complex = ComplexComponents(Complex=md_slider)  # -> Real, Imaginary

# ----
柱宽 = Slider(200, range=0..5000)
list = ValueList({"全围合": 0, "单面开敞": 1, "两面开敞（临边）": 2, "两面开敞（对边）": 3, "三面开敞": 4, "四面开敞": 5}, selected="四面开敞")
# 上右下左:0123
上右下左_0123 = Panel(""" 
0,1,2,3
03,32,21,10
02,13
013,023,123,012
 """)
int = Integer([list, Toggle(False), Toggle(False), Toggle(False), Toggle(False)])
num = Number([complex.Real, complex.Imaginary, 角度, 房宽, 房深, 墙厚, 柱宽])
item = ListItem(List=int, Index=0, Wrap=False)  # -> Item, Item1, Item2, Item3, Item4
item_2 = ListItem(List=num, Index=0, Wrap=False)  # -> Item, Item1, Item2, Item3, Item4, Item5, Item6
panel_4 = Panel("""s
h
t""")
complex_2 = CreateComplex(Real=item_2.Item, Imaginary=item_2.Item1)

panel_5 = Panel(";0,1,3")
split = TextSplit(Text=";0,2", Separators=";")
split_2 = TextSplit(Text=split, Separators=",")  # -> simplify(Result)

panel_6 = Panel("""0: s,-t;a,-a
1:-t,-h;-a,-a
2:-s, t;-a,a
3: t, h;a,a""")
柱宽_2 = Number(item_2.Item6)
房宽_2 = Number(item_2.Item3)
房深_2 = Number(item_2.Item4)
墙厚_2 = Number(item_2.Item5)
房位 = Complex(complex_2)
角度_2 = Number(item_2.Item2)
rad = Radians(Degrees=角度_2)
panel_7 = Panel("""0,2
2,1""")
prot = RotatePlane(Plane=房位, Angle=rad)
panel_8 = Panel("""1,-1
-1,-1
-1,1
1,1""")
房宽_s = Number(房宽_2)
房深_h = Number(房深_2)
墙厚_t = Number(墙厚_2)
方位编号 = Integer(split_2)
空间方位 = Complex(prot)
merge = Merge(Data1=房宽_s, Data2=房深_h, Data3=墙厚_t)

panel_9 = Panel("""0
1
3""")
txt = Text(panel_9)
txt_2 = Text("4")
panel_10 = Panel("""0
1""")
panel_11 = Panel("""0,2
2,1""")
mod = Modulus(A=txt, B=2)
mod_2 = Modulus(A=txt_2, B=2)
txt_3 = Text(mod)
panel_12 = Panel("""1,-1
-1,-1
-1,1
1,1""")
panel_13 = Panel("""0
1
2
3""")
txt_4 = Text(mod_2)
lng = ListLength(List=txt_4)
keysearch = KeyValueSearch(Keys=panel_10, Values=panel_11, Search=txt_3)
keysearch_2 = KeyValueSearch(Keys=panel_13, Values=panel_12, Search=txt)
柱宽_3 = Number(柱宽_2)
split_3 = TextSplit(Text=keysearch, Separators=",")
stack = StackData(Data="0", Stack=lng)
num_2 = Number(merge)
split_4 = TextSplit(Text=keysearch_2, Separators=",")
stack_2 = StackData(Data=graft(stack), Stack=2)
item_3 = ListItem(List=num_2, Index=split_3, Wrap=True)
item_4 = ListItem(List=柱宽_3, Index=stack_2, Wrap=True)
multiplication = Multiplication(A=item_3, B=split_4)
墙值域 = Number(multiplication)
柱值域 = Number(item_4)

bang = ExplodeTree(Data=方位编号)  # -> Branch0, Branch1

txt_5 = Text(bang.Branch1)
panel_14 = Panel("""0,2
2,1""")
panel_15 = Panel("""0
1""")
mod_3 = Modulus(A=txt_5, B=2)
txt_6 = Text(mod_3)
panel_16 = Panel("""1,-1
-1,-1
-1,1
1,1""")
panel_17 = Panel("""0
1
2
3""")
keysearch_3 = KeyValueSearch(Keys=panel_15, Values=panel_14, Search=txt_6)
keysearch_4 = KeyValueSearch(Keys=panel_17, Values=panel_16, Search=txt_5)
split_5 = TextSplit(Text=keysearch_3, Separators=",")
num_3 = Number(merge)
split_6 = TextSplit(Text=keysearch_4, Separators=",")
item_5 = ListItem(List=num_3, Index=split_5, Wrap=True)
multiplication_2 = Multiplication(A=item_5, B=split_6)
墙值域_2 = Number(multiplication_2)

房深_3 = Number(房深_2)
房宽_3 = Number(房宽_2)
stack_3 = StackData(Data=[房深_3, "0"], Stack=2)
stack_4 = StackData(Data=[房宽_3, "0"], Stack=2)
shift = ShiftList(List=stack_4, Shift=-1, Wrap=True)
pshift = ShiftPaths(Data=shift, Offset=-1)
pt = PointOriented(BasePlane=PlaneXY(0, 0, 0), UComponent=pshift, VComponent=stack_3, WComponent=0)
方位编号_2 = Integer(方位编号)
pt_2 = Point(pt)
item_6 = ListItem(List=pt_2, Index=方位编号_2, Wrap=True)
bang_2 = ExplodeTree(Data=item_6)  # -> Branch0, Branch1

txt_7 = Text(bang.Branch0)
panel_18 = Panel("""0
1
2
3""")
panel_19 = Panel("""1,-1
-1,-1
-1,1
1,1""")
lng_2 = ListLength(List=txt_7)
柱宽_4 = Number(柱宽_2)
keysearch_5 = KeyValueSearch(Keys=panel_18, Values=panel_19, Search=txt_7)
stack_5 = StackData(Data=柱宽_4, Stack=lng_2)
split_7 = TextSplit(Text=keysearch_5, Separators=",")
stack_6 = StackData(Data=graft(stack_5), Stack=2)
txt_8 = Text(split_7)
multiplication_3 = Multiplication(A=stack_6, B=txt_8)
柱值域_2 = Number(multiplication_3)

merge_2 = Merge(Data1=柱值域_2, Data2=墙值域_2)
pshift_2 = ShiftPaths(Data=merge_2, Offset=-1)
bang_3 = ExplodeTree(Data=pshift_2)  # -> Branch0, Branch1
partition = PartitionList(List=bang_3.Branch0, Size=2)
partition_2 = PartitionList(List=bang_3.Branch1, Size=2)
墙值域_3 = Number(partition_2)
柱值域_3 = Number(partition)
item_7 = ListItem(List=墙值域_3, Index=0, Wrap=True)  # -> Item, Item1
item_8 = ListItem(List=柱值域_3, Index=0, Wrap=True)  # -> Item, Item1
柱_x = Number(item_8.Item)
柱_y = Number(item_8.Item1)
墙_x = Number(item_7.Item)
墙_y = Number(item_7.Item1)

墙_y_2 = Number(墙_y)
墙方位 = Plane(bang_2.Branch1)
墙_x_2 = Number(墙_x)
柱_x_2 = Number(柱_x)
柱_y_2 = Number(柱_y)
柱方位 = Plane(bang_2.Branch0)
rectangle = Rectangle(Plane=graft(墙方位), XSize=墙_x_2, YSize=墙_y_2, Radius=0)  # -> Rectangle, Length
rectangle_2 = Rectangle(Plane=柱方位, XSize=柱_x_2, YSize=柱_y_2, Radius=0)  # -> Rectangle, Length
runion = RegionUnion(Curves=flatten(rectangle.Rectangle))
