# Grasshopper definition 20170329_垂直构件限定空间2.gh (Grasshopper 0.9.76)

panel = Panel("""012等价于023问题
bool值数量预处理""")
list = ValueList({"全围合": 0, "单面开敞": 1, "两面开敞（临边）": 2, "两面开敞（对边）": 3, "三面开敞": 4, "四面开敞": 5}, selected="两面开敞（临边）")
panel_2 = Panel("""1
1
1
1""")
int = Integer("1")
int_2 = Integer("4")
series = Series(Start=0, Step=1, Count=int_2)
stack = StackData(Data=int, Stack=int_2)
int_3 = Integer([list, Toggle(True), Toggle(True), Toggle(False), Toggle(False)])
sort = SortList(Keys=stack, ValuesA=series)  # -> Keys, ValuesA
partition = PartitionList(List=int_3, Size=[1, 4])  # -> simplify(Chunks)
merge = Merge(Data1=Toggle(False), Data2=Toggle(False), Data3=Toggle(True), Data4=Toggle(True))
bang = ExplodeTree(Data=partition)  # -> Branch0, Branch1
int_4 = Integer(Toggle(True))
mindex = MemberIndex(Set=merge, Member=Toggle(True))  # -> Index, Count
mindex_2 = MemberIndex(Set=bang.Branch1, Member=int_4)  # -> Index, Count

# ----
# 012等价于023问题
int_5 = Integer(mindex_2.Index)
lng = ListLength(List=int_5)
series_2 = Series(Start=0, Step=1, Count=lng)
shift = ShiftList(List=int_5, Shift=series_2, Wrap=True)
item = ListItem(List=shift, Index=0, Wrap=True)
subtraction = Subtraction(A=shift, B=item)
abs = Absolute(Value=subtraction)
sort_2 = SortList(Keys=abs)  # -> Keys, ValuesA
int_6 = Integer(sort_2.Keys)
join = TextJoin(Text=int_6, Join=",")

int_7 = Integer(bang.Branch0)
panel_3 = Panel("""开间
进深
墙厚
墙高
柱宽
柱高""")
# 上,下,左,右
# 上左,左下,下右,右上
# 上下,左右
# 上左右,左下上,下右下,左下右
panel_4 = Panel("""全围合
单面开敞
两面开敞（临边）
两面开敞（对边）
三面开敞
四面开敞""")
panel_5 = Panel("垂直构件限定空间")

# ----
# 判断bool值是否满足当前空间类型
panel_6 = Panel("0,1,2,3;0,1,2;0,1,3;0,2;0,2,3;0,1,2,3")
split = TextSplit(Text=panel_6, Separators=";")
mindex_3 = MemberIndex(Set=split, Member=join)  # -> Index, Count
equals = Equality(FirstNumber=int_7, SecondNumber=mindex_3.Index)  # -> Equality, Inequality
ma = MassAddition(Input=flatten(mindex_3.Count))  # -> Result, PartialResults
int_8 = Integer(equals.Equality)
bool = Boolean(ma.Result)
ma_2 = MassAddition(Input=flatten(int_8))  # -> Result, PartialResults
and = GateAnd(A=ma_2.Result, B=bool)

panel_7 = Panel(mindex_3.Index)
panel_8 = Panel(mindex.Index)
panel_9 = Panel(mindex_3.Count)

# ----
# 返回哪种partition类型索引
bool_2 = Boolean(mindex_3.Count)
dispatch = Dispatch(List=flatten(mindex_3.Count), DispatchPattern=flatten(bool_2))  # -> ListA, ListB
item_2 = ListItem(List=dispatch.ListA, Index=0, Wrap=True)
split_2 = TextSplit(Text="0,4;0,3;1,2;0,2;2,1;4,0", Separators=";")
index = Integer(item_2)

# ---- group: 房间输入参数
md_slider = MDSlider(slider_value=Point(0.5, 0.5, 0.5), SliderMode=0, x_domain=Domain(0, 1), y_domain=Domain(0, 1), z_domain=Domain(0, 1))
房宽 = Slider(4000, range=0..5000)
角度 = Slider(0, range=0..360)
房深 = Slider(6000, range=0..6000)
墙厚 = Slider(200, range=0..5000)
complex = ComplexComponents(Complex=md_slider)  # -> Real, Imaginary

# ----
柱宽 = Slider(200, range=0..5000)
list_2 = ValueList({"全围合": 0, "单面开敞": 1, "两面开敞（临边）": 2, "两面开敞（对边）": 3, "三面开敞": 4, "四面开敞": 5}, selected="四面开敞")
panel_10 = Panel(split)
# 上右下左:0123
上右下左_0123 = Panel(""" 
0,1,2,3
03,32,21,10
02,13
013,023,123,012
 """)
int_9 = Integer([list_2, Toggle(False), Toggle(False), Toggle(False), Toggle(False)])
num = Number([complex.Real, complex.Imaginary, 角度, 房宽, 房深, 墙厚, 柱宽])
panel_11 = Panel(index)
item_3 = ListItem(List=split_2, Index=int_7, Wrap=True)
item_4 = ListItem(List=int_9, Index=0, Wrap=False)  # -> Item, Item1, Item2, Item3, Item4
item_5 = ListItem(List=num, Index=0, Wrap=False)  # -> Item, Item1, Item2, Item3, Item4, Item5, Item6
split_3 = TextSplit(Text=item_3, Separators=",")
panel_12 = Panel("""s
h
t""")
complex_2 = CreateComplex(Real=item_5.Item, Imaginary=item_5.Item1)

panel_13 = Panel(";0,1,3")
split_4 = TextSplit(Text=";0,2", Separators=";")
split_5 = TextSplit(Text=split_4, Separators=",")  # -> simplify(Result)

panel_14 = Panel("""0: s,-t;a,-a
1:-t,-h;-a,-a
2:-s, t;-a,a
3: t, h;a,a""")
filter = StreamFilter(Gate=and, Stream1=split_3)
partition_2 = PartitionList(List=mindex_2.Index, Size=filter)
panel_15 = Panel(partition_2)
bang_2 = ExplodeTree(Data=partition_2)  # -> _0000, _0001
panel_16 = Panel(bang_2._0000)
panel_17 = Panel(bang_2._0001)
柱宽_2 = Number(item_5.Item6)
房宽_2 = Number(item_5.Item3)
房深_2 = Number(item_5.Item4)
墙厚_2 = Number(item_5.Item5)
房位 = Complex(complex_2)
角度_2 = Number(item_5.Item2)
rad = Radians(Degrees=角度_2)
panel_19 = Panel("""0,2
2,1""")
prot = RotatePlane(Plane=房位, Angle=rad)
panel_20 = Panel("""1,-1
-1,-1
-1,1
1,1""")
房宽_s = Number(房宽_2)
房深_h = Number(房深_2)
墙厚_t = Number(墙厚_2)
方位编号 = Integer(split_5)
空间方位 = Complex(prot)
merge_2 = Merge(Data1=房宽_s, Data2=房深_h, Data3=墙厚_t)

panel_23 = Panel("""0
1
3""")
txt = Text(panel_23)
txt_2 = Text("4")
panel_24 = Panel("""0
1""")
panel_25 = Panel("""0,2
2,1""")
mod = Modulus(A=txt, B=2)
mod_2 = Modulus(A=txt_2, B=2)
txt_3 = Text(mod)
panel_26 = Panel("""1,-1
-1,-1
-1,1
1,1""")
panel_27 = Panel("""0
1
2
3""")
txt_4 = Text(mod_2)
lng_2 = ListLength(List=txt_4)
keysearch = KeyValueSearch(Keys=panel_24, Values=panel_25, Search=txt_3)
keysearch_2 = KeyValueSearch(Keys=panel_27, Values=panel_26, Search=txt)
柱宽_3 = Number(柱宽_2)
split_6 = TextSplit(Text=keysearch, Separators=",")
stack_2 = StackData(Data="0", Stack=lng_2)
num_2 = Number(merge_2)
split_7 = TextSplit(Text=keysearch_2, Separators=",")
stack_3 = StackData(Data=graft(stack_2), Stack=2)
item_6 = ListItem(List=num_2, Index=split_6, Wrap=True)
item_7 = ListItem(List=柱宽_3, Index=stack_3, Wrap=True)
multiplication = Multiplication(A=item_6, B=split_7)
墙值域 = Number(multiplication)
柱值域 = Number(item_7)

bang_3 = ExplodeTree(Data=方位编号)  # -> Branch0, Branch1

txt_5 = Text(bang_3.Branch1)
panel_28 = Panel("""0,2
2,1""")
panel_29 = Panel("""0
1""")
mod_3 = Modulus(A=txt_5, B=2)
txt_6 = Text(mod_3)
panel_30 = Panel("""1,-1
-1,-1
-1,1
1,1""")
panel_31 = Panel("""0
1
2
3""")
keysearch_3 = KeyValueSearch(Keys=panel_29, Values=panel_28, Search=txt_6)
keysearch_4 = KeyValueSearch(Keys=panel_31, Values=panel_30, Search=txt_5)
split_8 = TextSplit(Text=keysearch_3, Separators=",")
num_3 = Number(merge_2)
split_9 = TextSplit(Text=keysearch_4, Separators=",")
item_8 = ListItem(List=num_3, Index=split_8, Wrap=True)
multiplication_2 = Multiplication(A=item_8, B=split_9)
墙值域_2 = Number(multiplication_2)

房深_3 = Number(房深_2)
房宽_3 = Number(房宽_2)
stack_4 = StackData(Data=[房深_3, "0"], Stack=2)
stack_5 = StackData(Data=[房宽_3, "0"], Stack=2)
shift_2 = ShiftList(List=stack_5, Shift=-1, Wrap=True)
pshift = ShiftPaths(Data=shift_2, Offset=-1)
pt = PointOriented(BasePlane=PlaneXY(0, 0, 0), UComponent=pshift, VComponent=stack_4, WComponent=0)
方位编号_2 = Integer(方位编号)
pt_2 = Point(pt)
item_9 = ListItem(List=pt_2, Index=方位编号_2, Wrap=True)
bang_4 = ExplodeTree(Data=item_9)  # -> Branch0, Branch1

txt_7 = Text(bang_3.Branch0)
panel_32 = Panel("""0
1
2
3""")
panel_33 = Panel("""1,-1
-1,-1
-1,1
1,1""")
lng_3 = ListLength(List=txt_7)
柱宽_4 = Number(柱宽_2)
keysearch_5 = KeyValueSearch(Keys=panel_32, Values=panel_33, Search=txt_7)
stack_6 = StackData(Data=柱宽_4, Stack=lng_3)
split_10 = TextSplit(Text=keysearch_5, Separators=",")
stack_7 = StackData(Data=graft(stack_6), Stack=2)
txt_8 = Text(split_10)
multiplication_3 = Multiplication(A=stack_7, B=txt_8)
柱值域_2 = Number(multiplication_3)

merge_3 = Merge(Data1=柱值域_2, Data2=墙值域_2)
pshift_2 = ShiftPaths(Data=merge_3, Offset=-1)
bang_5 = ExplodeTree(Data=pshift_2)  # -> Branch0, Branch1
partition_3 = PartitionList(List=bang_5.Branch0, Size=2)
partition_4 = PartitionList(List=bang_5.Branch1, Size=2)
墙值域_3 = Number(partition_4)
柱值域_3 = Number(partition_3)
item_10 = ListItem(List=墙值域_3, Index=0, Wrap=True)  # -> Item, Item1
item_11 = ListItem(List=柱值域_3, Index=0, Wrap=True)  # -> Item, Item1
柱_x = Number(item_11.Item)
柱_y = Number(item_11.Item1)
墙_x = Number(item_10.Item)
墙_y = Number(item_10.Item1)

墙_y_2 = Number(墙_y)
墙方位 = Plane(bang_4.Branch1)
墙_x_2 = Number(墙_x)
柱_x_2 = Number(柱_x)
柱_y_2 = Number(柱_y)
柱方位 = Plane(bang_4.Branch0)
rectangle = Rectangle(Plane=graft(墙方位), XSize=墙_x_2, YSize=墙_y_2, Radius=0)  # -> Rectangle, Length
rectangle_2 = Rectangle(Plane=柱方位, XSize=柱_x_2, YSize=柱_y_2, Radius=0)  # -> Rectangle, Length
runion = RegionUnion(Curves=flatten(rectangle.Rectangle))
