# Grasshopper definition 20170329_垂直构件限定空间3.gh (Grasshopper 0.9.76)

list = ValueList({"全围合": 0, "单面开敞": 1, "两面开敞（临边）": 2, "两面开敞（对边）": 3, "三面开敞": 4, "四面开敞": 5}, selected="两面开敞（临边）")
int = Integer([list, Toggle(True), Toggle(True), Toggle(False), Toggle(False)])
partition = PartitionList(List=int, Size=[1, 4])  # -> simplify(Chunks)
panel = Panel("""4
3
2
2
1
0""")
bang = ExplodeTree(Data=partition)  # -> Branch0, Branch1
int_2 = Integer(Toggle(True))
split = TextSplit(Text="0,4;0,3;1,2;0,2;2,1;4,0", Separators=";")
int_3 = Integer(bang.Branch0)
mindex = MemberIndex(Set=bang.Branch1, Member=int_2)  # -> Index, Count
item = ListItem(List=panel, Index=int_3, Wrap=False)
int_4 = Integer(item)
item_2 = ListItem(List=split, Index=int_3, Wrap=False)
int_5 = Integer(mindex.Index)
equals = Equality(FirstNumber=mindex.Count, SecondNumber=int_4)  # -> Equality, Inequality
split_2 = TextSplit(Text=item_2, Separators=",")

# ---- group: 数量匹配&&
filter = StreamFilter(Gate=equals.Equality, Stream1=int_5)

# ----
larger = LargerThan(FirstNumber=filter, SecondNumber=item)  # -> LargerThan, OrEqualTo
bool = Boolean(larger.OrEqualTo)

gate = StreamGate(Stream=filter, Gate=int_3)  # -> Target0, Target1, Target2, Target3, Target4, Target5
item_3 = ListItem(List=[gate.Target2, gate.Target3], Index=0, Wrap=True)  # -> Item, Item1
subtraction = Subtraction(A=item_3.Item1, B=item_3.Item)

# ---- group: 2,3转换成0,1
subtraction_2 = Subtraction(A=int_3, B=2)

# ----
gate_2 = StreamGate(Stream=subtraction, Gate=subtraction_2)  # -> Target0, Target1
panel_2 = Panel("""1
3""")
equals_2 = Equality(FirstNumber=gate_2.Target0, SecondNumber=panel_2)  # -> Equality, Inequality
equals_3 = Equality(FirstNumber=gate_2.Target1, SecondNumber="2")  # -> Equality, Inequality
ma = MassAddition(Input=equals_2.Equality)  # -> Result, PartialResults
int_6 = Integer(split_2)
bool_2 = Boolean(equals_3.Equality)
bool_3 = Boolean(ma.Result)
filter_2 = StreamFilter(Gate=subtraction_2, Stream0=bool_3, Stream1=bool_2)
filter_3 = StreamFilter(Gate=filter_2, Stream1=filter)
filter_4 = StreamFilter(
    Gate=int_3,
    Stream0=gate.Target0,
    Stream1=gate.Target1,
    Stream2=filter_3,
    Stream3=filter_3,
    Stream4=gate.Target4,
    Stream5=gate.Target5)
panel_3 = Panel("""0
1
2
3""")
partition_2 = PartitionList(List=filter_4, Size=int_6)
int_7 = Integer(panel_3)
int_8 = Integer(filter_4)
replace = ReplaceMembers(Set=int_7, Find=int_8)
txt = Text(partition_2)
panel_4 = Panel(partition_2)
panel_5 = Panel(replace)
panel_6 = Panel(filter_4)
panel_7 = Panel("""012等价于023问题
bool值数量预处理""")
list_2 = ValueList({"全围合": 0, "单面开敞": 1, "两面开敞（临边）": 2, "两面开敞（对边）": 3, "三面开敞": 4, "四面开敞": 5}, selected="全围合")

panel_8 = Panel("""1
1
1
1""")
int_9 = Integer("1")
int_10 = Integer("4")
series = Series(Start=0, Step=1, Count=int_10)
stack = StackData(Data=int_9, Stack=int_10)
sort = SortList(Keys=stack, ValuesA=series)  # -> Keys, ValuesA

int_11 = Integer([list_2, Toggle(True), Toggle(True), Toggle(True), Toggle(True)])
partition_3 = PartitionList(List=int_11, Size=[1, 4])  # -> simplify(Chunks)
bang_2 = ExplodeTree(Data=partition_3)  # -> Branch0, Branch1
int_12 = Integer(Toggle(True))
mindex_2 = MemberIndex(Set=bang_2.Branch1, Member=int_12)  # -> Index, Count

# ----
# 012等价于023问题
int_13 = Integer(mindex_2.Index)
lng = ListLength(List=int_13)
series_2 = Series(Start=0, Step=1, Count=lng)
shift = ShiftList(List=int_13, Shift=series_2, Wrap=True)
item_4 = ListItem(List=shift, Index=0, Wrap=True)
subtraction_3 = Subtraction(A=shift, B=item_4)
abs = Absolute(Value=subtraction_3)
sort_2 = SortList(Keys=abs)  # -> Keys, ValuesA
int_14 = Integer(sort_2.Keys)
join = TextJoin(Text=int_14, Join=",")

int_15 = Integer(mindex_2.Index)
lng_2 = ListLength(List=int_15)
series_3 = Series(Start=0, Step=1, Count=expr("x-1", lng_2))
shift_2 = ShiftList(List=int_15, Shift=series_3, Wrap=True)
int_16 = Integer(bang_2.Branch0)
panel_9 = Panel(join)
panel_10 = Panel("""开间
进深
墙厚
墙高
柱宽
柱高""")
# 上,下,左,右
# 上左,左下,下右,右上
# 上下,左右
# 上左右,左下上,下右下,左下右
panel_11 = Panel("""全围合
单面开敞
两面开敞（临边）
两面开敞（对边）
三面开敞
四面开敞""")
panel_12 = Panel("垂直构件限定空间")

# ----
# 判断bool值是否满足当前空间类型
panel_13 = Panel("0,1,2,3;0,1,2;0,1;0,2;0,2,3;0,1,2,3")
split_3 = TextSplit(Text="0,1,2,3;0,1,2;0,1;0,2;0,2,3;0,1,2,3", Separators=";")
mindex_3 = MemberIndex(Set=split_3, Member=join)  # -> Index, Count
equals_4 = Equality(FirstNumber=int_16, SecondNumber=mindex_3.Index)  # -> Equality, Inequality
ma_2 = MassAddition(Input=flatten(mindex_3.Count))  # -> Result, PartialResults
int_17 = Integer(equals_4.Equality)
bool_4 = Boolean(ma_2.Result)
ma_3 = MassAddition(Input=flatten(int_17))  # -> Result, PartialResults
and = GateAnd(A=ma_3.Result, B=bool_4)

split_4 = TextSplit(Text=split_3, Separators=",")
lng_3 = ListLength(List=split_4)  # -> flatten(Length)
item_5 = ListItem(List=lng_3, Index=int_16, Wrap=True)
series_4 = Series(Start=0, Step=1, Count=item_5)
rest_index = Integer(series_4)
item_6 = ListItem(List=shift_2, Index=rest_index, Wrap=True)

item_7 = ListItem(List=item_6, Index=0, Wrap=True)
subtraction_4 = Subtraction(A=item_6, B=item_7)
abs_2 = Absolute(Value=subtraction_4)

panel_14 = Panel(item_6)
join_2 = TextJoin(Text=abs_2, Join=",")

# ----
# 返回哪种partition类型索引
bool_5 = Boolean(mindex_3.Count)
dispatch = Dispatch(List=flatten(mindex_3.Count), DispatchPattern=flatten(bool_5))  # -> ListA, ListB
item_8 = ListItem(List=dispatch.ListA, Index=0, Wrap=True)
split_5 = TextSplit(Text="0,4;0,3;1,2;0,2;2,1;4,0", Separators=";")
index = Integer(item_8)

panel_16 = Panel("0,1,2,3;0,1,2;0,1;0,2;0;0,1,2,3")

# ---- group: 房间输入参数
md_slider = MDSlider(slider_value=Point(0.5, 0.5, 0.5), SliderMode=0, x_domain=Domain(0, 1), y_domain=Domain(0, 1), z_domain=Domain(0, 1))
房宽 = Slider(4000, range=0..5000)
角度 = Slider(0, range=0..360)
房深 = Slider(6000, range=0..6000)
墙厚 = Slider(200, range=0..5000)
complex = ComplexComponents(Complex=md_slider)  # -> Real, Imaginary

# ----
柱宽 = Slider(200, range=0..5000)
list_3 = ValueList({"全围合": 0, "单面开敞": 1, "两面开敞（临边）": 2, "两面开敞（对边）": 3, "三面开敞": 4, "四面开敞": 5}, selected="四面开敞")
# 上右下左:0123
上右下左_0123 = Panel(""" 
0,1,2,3
03,32,21,10
02,13
013,023,123,012
 """)
item_9 = ListItem(List=split_5, Index=int_16, Wrap=True)
int_18 = Integer([list_3, Toggle(False), Toggle(False), Toggle(False), Toggle(False)])
num = Number([complex.Real, complex.Imaginary, 角度, 房宽, 房深, 墙厚, 柱宽])
split_6 = TextSplit(Text=item_9, Separators=",")
item_10 = ListItem(List=int_18, Index=0, Wrap=False)  # -> Item, Item1, Item2, Item3, Item4
item_11 = ListItem(List=num, Index=0, Wrap=False)  # -> Item, Item1, Item2, Item3, Item4, Item5, Item6
filter_5 = StreamFilter(Gate=and, Stream1=split_6)
partition_4 = PartitionList(List=mindex_2.Index, Size=filter_5)
bang_3 = ExplodeTree(Data=partition_4)  # -> _0000, _0001
panel_17 = Panel(bang_3._0000)
panel_18 = Panel(bang_3._0001)
panel_19 = Panel("""s
h
t""")
complex_2 = CreateComplex(Real=item_11.Item, Imaginary=item_11.Item1)

panel_20 = Panel(";0,1,3")
split_7 = TextSplit(Text=";0,2", Separators=";")
split_8 = TextSplit(Text=split_7, Separators=",")  # -> simplify(Result)

panel_21 = Panel("""0: s,-t;a,-a
1:-t,-h;-a,-a
2:-s, t;-a,a
3: t, h;a,a""")
txt_2 = Text(bang_3._0000)
txt_3 = Text(bang_3._0001)
柱宽_2 = Number(item_11.Item6)
房宽_2 = Number(item_11.Item3)
房深_2 = Number(item_11.Item4)
墙厚_2 = Number(item_11.Item5)
房位 = Complex(complex_2)
角度_2 = Number(item_11.Item2)
panel_22 = Panel(partition_4)
entwine = Entwine(Branch00=txt_2, Branch01=txt_3, FlattenInputs=True)
rad = Radians(Degrees=角度_2)
txt_4 = Text(txt)
panel_23 = Panel("""0,2
2,1""")
txt_5 = Text(entwine)
prot = RotatePlane(Plane=房位, Angle=rad)
panel_25 = Panel("""1,-1
-1,-1
-1,1
1,1""")
房宽_s = Number(房宽_2)
房深_h = Number(房深_2)
墙厚_t = Number(墙厚_2)
panel_26 = Panel(entwine)
方位编号 = Integer(txt_4)
空间方位 = Complex(prot)
merge = Merge(Data1=房宽_s, Data2=房深_h, Data3=墙厚_t)
bang_4 = ExplodeTree(Data=方位编号)  # -> _0000, _0001
txt_6 = Text(方位编号)
txt_7 = Text(bang_4._0000)
txt_8 = Text(bang_4._0001)

txt_9 = Text(txt_8)
panel_28 = Panel("""0,2
2,1""")
panel_29 = Panel("""0
1""")
mod = Modulus(A=txt_9, B=2)
txt_10 = Text(mod)
panel_30 = Panel("""1,-1
-1,-1
-1,1
1,1""")
panel_31 = Panel("""0
1
2
3""")
keysearch = KeyValueSearch(Keys=panel_29, Values=panel_28, Search=txt_10)
keysearch_2 = KeyValueSearch(Keys=panel_31, Values=panel_30, Search=txt_9)
split_9 = TextSplit(Text=keysearch, Separators=",")
num_2 = Number(merge)
split_10 = TextSplit(Text=keysearch_2, Separators=",")
item_12 = ListItem(List=num_2, Index=split_9, Wrap=True)
multiplication = Multiplication(A=item_12, B=split_10)
墙值域 = Number(multiplication)

房深_3 = Number(房深_2)
房宽_3 = Number(房宽_2)
stack_2 = StackData(Data=[房深_3, "0"], Stack=2)
stack_3 = StackData(Data=[房宽_3, "0"], Stack=2)
shift_3 = ShiftList(List=stack_3, Shift=-1, Wrap=True)
pshift = ShiftPaths(Data=shift_3, Offset=-1)
pt = PointOriented(BasePlane=PlaneXY(0, 0, 0), UComponent=pshift, VComponent=stack_2, WComponent=0)
方位编号_2 = Integer(方位编号)
pt_2 = Point(pt)
item_13 = ListItem(List=pt_2, Index=方位编号_2, Wrap=True)
bang_5 = ExplodeTree(Data=item_13)  # -> _0000, _0001

txt_11 = Text(txt_7)
panel_32 = Panel("""0
1
2
3""")
panel_33 = Panel("""1,-1
-1,-1
-1,1
1,1""")
lng_4 = ListLength(List=txt_11)
柱宽_3 = Number(柱宽_2)
keysearch_3 = KeyValueSearch(Keys=panel_32, Values=panel_33, Search=txt_11)
stack_4 = StackData(Data=柱宽_3, Stack=lng_4)
split_11 = TextSplit(Text=keysearch_3, Separators=",")
stack_5 = StackData(Data=graft(stack_4), Stack=2)
txt_12 = Text(split_11)
multiplication_2 = Multiplication(A=stack_5, B=txt_12)
柱值域 = Number(multiplication_2)

panel_34 = Panel("""0
1
3""")
txt_13 = Text(panel_34)
txt_14 = Text("4")
panel_35 = Panel("""0
1""")
panel_36 = Panel("""0,2
2,1""")
mod_2 = Modulus(A=txt_13, B=2)
mod_3 = Modulus(A=txt_14, B=2)
txt_15 = Text(mod_2)
panel_37 = Panel("""1,-1
-1,-1
-1,1
1,1""")
panel_38 = Panel("""0
1
2
3""")
txt_16 = Text(mod_3)
lng_5 = ListLength(List=txt_16)
keysearch_4 = KeyValueSearch(Keys=panel_35, Values=panel_36, Search=txt_15)
keysearch_5 = KeyValueSearch(Keys=panel_38, Values=panel_37, Search=txt_13)
柱宽_4 = Number(柱宽_2)
split_12 = TextSplit(Text=keysearch_4, Separators=",")
stack_6 = StackData(Data="0", Stack=lng_5)
num_3 = Number(merge)
split_13 = TextSplit(Text=keysearch_5, Separators=",")
stack_7 = StackData(Data=graft(stack_6), Stack=2)
item_14 = ListItem(List=num_3, Index=split_12, Wrap=True)
item_15 = ListItem(List=柱宽_4, Index=stack_7, Wrap=True)
multiplication_3 = Multiplication(A=item_14, B=split_13)
墙值域_2 = Number(multiplication_3)
柱值域_2 = Number(item_15)

merge_2 = Merge(Data1=柱值域, Data2=墙值域)
pshift_2 = ShiftPaths(Data=merge_2, Offset=-1)
bang_6 = ExplodeTree(Data=pshift_2)  # -> _0000, _0001
partition_5 = PartitionList(List=bang_6._0000, Size=2)
partition_6 = PartitionList(List=bang_6._0001, Size=2)
墙值域_3 = Number(partition_6)
柱值域_3 = Number(partition_5)
item_16 = ListItem(List=墙值域_3, Index=0, Wrap=True)  # -> Item, Item1
item_17 = ListItem(List=柱值域_3, Index=0, Wrap=True)  # -> Item, Item1
柱_x = Number(item_17.Item)
柱_y = Number(item_17.Item1)
墙_x = Number(item_16.Item)
墙_y = Number(item_16.Item1)

墙_y_2 = Number(墙_y)
墙方位 = Plane(bang_5._0001)
墙_x_2 = Number(墙_x)
柱_x_2 = Number(柱_x)
柱_y_2 = Number(柱_y)
柱方位 = Plane(bang_5._0000)
rectangle = Rectangle(Plane=graft(柱方位), XSize=柱_x_2, YSize=柱_y_2, Radius=0)  # -> Rectangle, Length
rectangle_2 = Rectangle(Plane=graft(墙方位), XSize=墙_x_2, YSize=墙_y_2, Radius=0)  # -> Rectangle, Length
runion = RegionUnion(Curves=flatten(rectangle_2.Rectangle))
