# Grasshopper definition 20170329_垂直构件限定空间4.gh (Grasshopper 0.9.76)

list = ValueList({"全围合": 0, "单面开敞": 1, "两面开敞（临边）": 2, "两面开敞（对边）": 3, "三面开敞": 4, "四面开敞": 5}, selected="三面开敞")
int = Integer([list, Toggle(False), Toggle(False), Toggle(True), Toggle(False)])
partition = PartitionList(List=int, Size=[1, 4])  # -> simplify(Chunks)
panel = Panel("""4
3
2
2
1
0""")
bang = ExplodeTree(Data=partition)  # -> Branch0, Branch1
int_2 = Integer(Toggle(True))
int_3 = Integer(bang.Branch0)
item = ListItem(List=panel, Index=int_3, Wrap=False)
mindex = MemberIndex(Set=bang.Branch1, Member=int_2)  # -> Index, Count
int_4 = Integer(item)
equals = Equality(FirstNumber=mindex.Count, SecondNumber=int_4)  # -> Equality, Inequality
int_5 = Integer(mindex.Index)
filter = StreamFilter(Gate=equals.Equality, Stream1=int_3)
filter_2 = StreamFilter(Gate=equals.Equality, Stream1=int_5)
int_6 = Integer(filter)
gate = StreamGate(Stream=filter_2, Gate=int_6)  # -> Target0, Target1, Target2, Target3, Target4, Target5
equals_2 = Equality(FirstNumber=int_6, SecondNumber=4)  # -> Equality, Inequality
split = TextSplit(Text="0,4;0,3;1,2;0,2;2,1;4,0", Separators=";")
item_2 = ListItem(List=[gate.Target2, gate.Target3], Index=0, Wrap=True)  # -> Item, Item1
subtraction = Subtraction(A=item_2.Item1, B=item_2.Item)
equals_3 = Equality(FirstNumber=int_6, SecondNumber=2)  # -> Equality, Inequality
equals_4 = Equality(FirstNumber=subtraction, SecondNumber=3)  # -> Equality, Inequality
gate_2 = StreamGate(Stream=gate.Target4, Gate=equals_2.Equality)  # -> Target0, Target1
item_3 = ListItem(List=split, Index=int_6, Wrap=False)
subtraction_2 = Subtraction(A=item_2.Item1, B=item_2.Item)
filter_3 = StreamFilter(Gate=equals_4.Equality, Stream0=item_2.Item, Stream1=item_2.Item1)
gate_3 = StreamGate(Stream=filter_3, Gate=equals_3.Equality)  # -> Target0, Target1
addition = Addition(A=gate_2.Target1, B=[2, 3])
subtraction_3 = Subtraction(A=int_6, B=2)
split_2 = TextSplit(Text=item_3, Separators=",")
addition_2 = Addition(A=gate_3.Target1, B=3)
gate_4 = StreamGate(Stream=subtraction_2, Gate=subtraction_3)  # -> Target0, Target1
panel_2 = Panel("""1
3""")
larger = LargerThan(FirstNumber=addition, SecondNumber=3)  # -> LargerThan, OrEqualTo
larger_2 = LargerThan(FirstNumber=addition_2, SecondNumber=3)  # -> LargerThan, OrEqualTo
equals_5 = Equality(FirstNumber=gate_4.Target0, SecondNumber=panel_2)  # -> Equality, Inequality
equals_6 = Equality(FirstNumber=gate_4.Target1, SecondNumber="2")  # -> Equality, Inequality
gate_5 = StreamGate(Stream=addition, Gate=larger.LargerThan)  # -> Target0, Target1
gate_6 = StreamGate(Stream=addition_2, Gate=larger_2.LargerThan)  # -> Target0, Target1
ma = MassAddition(Input=equals_5.Equality)  # -> Result, PartialResults
subtraction_4 = Subtraction(A=gate_5.Target1, B=4)
bool = Boolean(equals_6.Equality)
subtraction_5 = Subtraction(A=gate_6.Target1, B=4)
int_7 = Integer(split_2)
bool_2 = Boolean(ma.Result)
filter_4 = StreamFilter(Gate=larger.LargerThan, Stream0=gate_5.Target0, Stream1=subtraction_4)
filter_5 = StreamFilter(Gate=larger_2.LargerThan, Stream0=gate_6.Target0, Stream1=subtraction_5)
filter_6 = StreamFilter(Gate=subtraction_3, Stream0=bool_2, Stream1=bool)
filter_7 = StreamFilter(Gate=equals_2.Equality, Stream1=filter_4)
filter_8 = StreamFilter(Gate=equals_3.Equality, Stream1=filter_5)
filter_9 = StreamFilter(Gate=filter_6, Stream1=[gate.Target2, gate.Target3])
merge = Merge(Data1=filter_7, Data2=gate.Target4)
merge_2 = Merge(Data1=filter_8, Data2=filter_9)
filter_10 = StreamFilter(
    Gate=int_6,
    Stream0=gate.Target0,
    Stream1=gate.Target1,
    Stream2=merge_2,
    Stream3=merge_2,
    Stream4=merge,
    Stream5=[0, 1, 2, 3])
int_8 = Integer(filter_10)
partition_2 = PartitionList(List=int_8, Size=int_7)
txt = Text(partition_2)

list_2 = ValueList({"全围合": 0, "单面开敞": 1, "两面开敞（临边）": 2, "两面开敞（对边）": 3, "三面开敞": 4, "四面开敞": 5}, selected="三面开敞")

panel_3 = Panel("""1
1
1
1""")
int_9 = Integer("1")
int_10 = Integer("4")
series = Series(Start=0, Step=1, Count=int_10)
stack = StackData(Data=int_9, Stack=int_10)
sort = SortList(Keys=stack, ValuesA=series)  # -> Keys, ValuesA

int_11 = Integer([list_2, Toggle(False), Toggle(False), Toggle(True), Toggle(False)])
partition_3 = PartitionList(List=int_11, Size=[1, 4])  # -> simplify(Chunks)
panel_4 = Panel("""4
3
2
2
1
0""")
bang_2 = ExplodeTree(Data=partition_3)  # -> Branch0, Branch1
int_12 = Integer(Toggle(True))
int_13 = Integer(bang_2.Branch0)
item_4 = ListItem(List=panel_4, Index=int_13, Wrap=False)
mindex_2 = MemberIndex(Set=bang_2.Branch1, Member=int_12)  # -> Index, Count
int_14 = Integer(item_4)
equals_7 = Equality(FirstNumber=mindex_2.Count, SecondNumber=int_14)  # -> Equality, Inequality

list_3 = ValueList({"全围合": 0, "单面开敞": 1, "两面开敞（临边）": 2, "两面开敞（对边）": 3, "三面开敞": 4, "四面开敞": 5}, selected="全围合")
int_15 = Integer([list_3, Toggle(True), Toggle(True), Toggle(True), Toggle(True)])
partition_4 = PartitionList(List=int_15, Size=[1, 4])  # -> simplify(Chunks)
panel_5 = Panel("""4
3
2
2
1
0""")
bang_3 = ExplodeTree(Data=partition_4)  # -> Branch0, Branch1
int_16 = Integer(Toggle(True))
split_3 = TextSplit(Text="0,4;0,3;1,2;0,2;2,1;4,0", Separators=";")
int_17 = Integer(bang_3.Branch0)
mindex_3 = MemberIndex(Set=bang_3.Branch1, Member=int_16)  # -> Index, Count
item_5 = ListItem(List=panel_5, Index=int_17, Wrap=False)
int_18 = Integer(item_5)
int_19 = Integer(mindex_3.Index)
equals_8 = Equality(FirstNumber=mindex_3.Count, SecondNumber=int_18)  # -> Equality, Inequality
filter_11 = StreamFilter(Gate=equals_8.Equality, Stream1=int_17)
filter_12 = StreamFilter(Gate=equals_8.Equality, Stream1=int_19)
larger_3 = LargerThan(FirstNumber=filter_12, SecondNumber=item_5)  # -> LargerThan, OrEqualTo
int_20 = Integer(filter_11)
item_6 = ListItem(List=split_3, Index=int_20, Wrap=False)
split_4 = TextSplit(Text=item_6, Separators=",")
gate_7 = StreamGate(Stream=filter_12, Gate=int_20)  # -> Target0, Target1, Target2, Target3, Target4, Target5
bool_3 = Boolean(larger_3.OrEqualTo)
equals_9 = Equality(FirstNumber=int_20, SecondNumber=2)  # -> Equality, Inequality
item_7 = ListItem(List=[gate_7.Target2, gate_7.Target3], Index=0, Wrap=True)  # -> Item, Item1
equals_10 = Equality(FirstNumber=int_20, SecondNumber=4)  # -> Equality, Inequality
gate_8 = StreamGate(Stream=item_7.Item, Gate=equals_9.Equality)  # -> Target0, Target1
subtraction_6 = Subtraction(A=item_7.Item1, B=item_7.Item)
gate_9 = StreamGate(Stream=gate_7.Target4, Gate=equals_10.Equality)  # -> Target0, Target1
subtraction_7 = Subtraction(A=int_20, B=2)
addition_3 = Addition(A=gate_9.Target1, B=[2, 3])
addition_4 = Addition(A=gate_8.Target1, B=3)
gate_10 = StreamGate(Stream=subtraction_6, Gate=subtraction_7)  # -> Target0, Target1
panel_6 = Panel("""1
3""")
larger_4 = LargerThan(FirstNumber=addition_4, SecondNumber=3)  # -> LargerThan, OrEqualTo
larger_5 = LargerThan(FirstNumber=addition_3, SecondNumber=3)  # -> LargerThan, OrEqualTo
equals_11 = Equality(FirstNumber=gate_10.Target0, SecondNumber=panel_6)  # -> Equality, Inequality
equals_12 = Equality(FirstNumber=gate_10.Target1, SecondNumber="2")  # -> Equality, Inequality
gate_11 = StreamGate(Stream=addition_4, Gate=larger_4.LargerThan)  # -> Target0, Target1
sift = SiftPattern(List=addition_3, SiftPattern=larger_5.LargerThan)  # -> Output0, Output1
gate_12 = StreamGate(Stream=addition_3, Gate=larger_5.LargerThan)  # -> Target0, Target1
ma_2 = MassAddition(Input=equals_11.Equality)  # -> Result, PartialResults
int_21 = Integer(split_4)
subtraction_8 = Subtraction(A=gate_11.Target1, B=4)
subtraction_9 = Subtraction(A=gate_12.Target1, B=4)
subtraction_10 = Subtraction(A=sift.Output1, B=4)
bool_4 = Boolean(equals_12.Equality)
bool_5 = Boolean(ma_2.Result)
filter_13 = StreamFilter(Gate=larger_4.LargerThan, Stream0=gate_11.Target0, Stream1=subtraction_8)
filter_14 = StreamFilter(Gate=larger_5.LargerThan, Stream0=gate_12.Target0, Stream1=subtraction_9)
filter_15 = StreamFilter(Gate=subtraction_7, Stream0=bool_5, Stream1=bool_4)
combine = CombineData(Input0=sift.Output0, Input1=subtraction_10)  # -> Result, Index
filter_16 = StreamFilter(Gate=equals_9.Equality, Stream1=filter_13)
filter_17 = StreamFilter(Gate=equals_10.Equality, Stream1=filter_14)
filter_18 = StreamFilter(Gate=filter_15, Stream1=filter_12)
filter_19 = StreamFilter(Gate=int_20, Stream2=filter_16, Stream4=filter_17)
filter_20 = StreamFilter(
    Gate=int_20,
    Stream0=gate_7.Target0,
    Stream1=gate_7.Target1,
    Stream2=filter_18,
    Stream3=filter_18,
    Stream4=gate_7.Target4,
    Stream5=gate_7.Target5)
int_22 = Integer(filter_20)
panel_7 = Panel(filter_14)
merge_3 = Merge(Data1=filter_19, Data2=int_22)
partition_5 = PartitionList(List=merge_3, Size=int_21)
txt_2 = Text(partition_5)
panel_8 = Panel(partition_5)
panel_9 = Panel(filter_20)

int_23 = Integer(mindex_2.Index)
panel_10 = Panel("""开间
进深
墙厚
墙高
柱宽
柱高""")
# 上,下,左,右
# 上左,左下,下右,右上
# 上下,左右
# 上左右,左下上,下右下,左下右
panel_11 = Panel("""全围合
单面开敞
两面开敞（临边）
两面开敞（对边）
三面开敞
四面开敞""")
panel_12 = Panel("垂直构件限定空间")

filter_21 = StreamFilter(Gate=equals_7.Equality, Stream1=int_13)

# ---- group: 数量匹配&&
filter_22 = StreamFilter(Gate=equals_7.Equality, Stream1=int_23)

# ----
int_24 = Integer(filter_21)
panel_13 = Panel("""012等价于023问题
bool值数量预处理""")
gate_13 = StreamGate(Stream=filter_22, Gate=int_24)  # -> Target0, Target1, Target2, Target3, Target4, Target5
list_4 = ValueList({"全围合": 0, "单面开敞": 1, "两面开敞（临边）": 2, "两面开敞（对边）": 3, "三面开敞": 4, "四面开敞": 5}, selected="全围合")

# ---- group: 房间输入参数
md_slider = MDSlider(slider_value=Point(0.5, 0.5, 0.5), SliderMode=0, x_domain=Domain(0, 1), y_domain=Domain(0, 1), z_domain=Domain(0, 1))
房宽 = Slider(4000, range=0..5000)
角度 = Slider(0, range=0..360)
房深 = Slider(6000, range=0..6000)
墙厚 = Slider(200, range=0..5000)
complex = ComplexComponents(Complex=md_slider)  # -> Real, Imaginary

# ----
柱宽 = Slider(200, range=0..5000)
list_5 = ValueList({"全围合": 0, "单面开敞": 1, "两面开敞（临边）": 2, "两面开敞（对边）": 3, "三面开敞": 4, "四面开敞": 5}, selected="四面开敞")

equals_13 = Equality(FirstNumber=int_24, SecondNumber=4)  # -> Equality, Inequality
gate_14 = StreamGate(Stream=gate_13.Target4, Gate=equals_13.Equality)  # -> Target0, Target1
addition_5 = Addition(A=gate_14.Target1, B=[2, 3])
larger_6 = LargerThan(FirstNumber=addition_5, SecondNumber=3)  # -> LargerThan, OrEqualTo
gate_15 = StreamGate(Stream=addition_5, Gate=larger_6.LargerThan)  # -> Target0, Target1
subtraction_11 = Subtraction(A=gate_15.Target1, B=4)
filter_23 = StreamFilter(Gate=larger_6.LargerThan, Stream0=gate_15.Target0, Stream1=subtraction_11)
filter_24 = StreamFilter(Gate=equals_13.Equality, Stream1=filter_23)
merge_4 = Merge(Data1=filter_24, Data2=gate_13.Target4)

split_5 = TextSplit(Text="0,4;0,3;1,2;0,2;2,1;4,0", Separators=";")
int_25 = Integer([list_4, Toggle(True), Toggle(True), Toggle(True), Toggle(True)])
# 上右下左:0123
上右下左_0123 = Panel(""" 
0,1,2,3
03,32,21,10
02,13
013,023,123,012
 """)
item_8 = ListItem(List=split_5, Index=int_24, Wrap=False)
int_26 = Integer([list_5, Toggle(False), Toggle(False), Toggle(False), Toggle(False)])
num = Number([complex.Real, complex.Imaginary, 角度, 房宽, 房深, 墙厚, 柱宽])
partition_6 = PartitionList(List=int_25, Size=[1, 4])  # -> simplify(Chunks)

# ---- group: 2,3转换成0,1
subtraction_12 = Subtraction(A=int_24, B=2)

# ----
item_9 = ListItem(List=[gate_13.Target2, gate_13.Target3], Index=0, Wrap=True)  # -> Item, Item1
subtraction_13 = Subtraction(A=item_9.Item1, B=item_9.Item)
gate_16 = StreamGate(Stream=subtraction_13, Gate=subtraction_12)  # -> Target0, Target1
panel_14 = Panel("""1
3""")
equals_14 = Equality(FirstNumber=gate_16.Target0, SecondNumber=panel_14)  # -> Equality, Inequality
equals_15 = Equality(FirstNumber=gate_16.Target1, SecondNumber="2")  # -> Equality, Inequality
ma_3 = MassAddition(Input=equals_14.Equality)  # -> Result, PartialResults
bool_6 = Boolean(equals_15.Equality)
bool_7 = Boolean(ma_3.Result)
filter_25 = StreamFilter(Gate=subtraction_12, Stream0=bool_7, Stream1=bool_6)
filter_26 = StreamFilter(Gate=filter_25, Stream1=[gate_13.Target2, gate_13.Target3])

# ---- group: 0,3退化情况处理
subtraction_14 = Subtraction(A=item_9.Item1, B=item_9.Item)
equals_16 = Equality(FirstNumber=subtraction_14, SecondNumber=3)  # -> Equality, Inequality
filter_27 = StreamFilter(Gate=equals_16.Equality, Stream0=item_9.Item, Stream1=item_9.Item1)

# ---- group: 双敞(邻边)溢出转换,计算柱编号
equals_17 = Equality(FirstNumber=int_24, SecondNumber=2)  # -> Equality, Inequality
gate_17 = StreamGate(Stream=filter_27, Gate=equals_17.Equality)  # -> Target0, Target1
addition_6 = Addition(A=gate_17.Target1, B=3)
larger_7 = LargerThan(FirstNumber=addition_6, SecondNumber=3)  # -> LargerThan, OrEqualTo
gate_18 = StreamGate(Stream=addition_6, Gate=larger_7.LargerThan)  # -> Target0, Target1
subtraction_15 = Subtraction(A=gate_18.Target1, B=4)
filter_28 = StreamFilter(Gate=larger_7.LargerThan, Stream0=gate_18.Target0, Stream1=subtraction_15)
filter_29 = StreamFilter(Gate=equals_17.Equality, Stream1=filter_28)

# ----
split_6 = TextSplit(Text=item_8, Separators=",")
item_10 = ListItem(List=int_26, Index=0, Wrap=False)  # -> Item, Item1, Item2, Item3, Item4
item_11 = ListItem(List=num, Index=0, Wrap=False)  # -> Item, Item1, Item2, Item3, Item4, Item5, Item6
bang_4 = ExplodeTree(Data=partition_6)  # -> Branch0, Branch1
int_27 = Integer(Toggle(True))
panel_15 = Panel("""s
h
t""")
complex_2 = CreateComplex(Real=item_11.Item, Imaginary=item_11.Item1)
mindex_4 = MemberIndex(Set=bang_4.Branch1, Member=int_27)  # -> Index, Count

# ----
# 012等价于023问题
int_28 = Integer(mindex_4.Index)
lng = ListLength(List=int_28)
series_2 = Series(Start=0, Step=1, Count=lng)
shift = ShiftList(List=int_28, Shift=series_2, Wrap=True)
item_12 = ListItem(List=shift, Index=0, Wrap=True)
subtraction_16 = Subtraction(A=shift, B=item_12)
abs = Absolute(Value=subtraction_16)
sort_2 = SortList(Keys=abs)  # -> Keys, ValuesA
int_29 = Integer(sort_2.Keys)
join = TextJoin(Text=int_29, Join=",")

int_30 = Integer(mindex_4.Index)
lng_2 = ListLength(List=int_30)
series_3 = Series(Start=0, Step=1, Count=expr("x-1", lng_2))
shift_2 = ShiftList(List=int_30, Shift=series_3, Wrap=True)
panel_16 = Panel("""0: s,-t;a,-a
1:-t,-h;-a,-a
2:-s, t;-a,a
3: t, h;a,a""")
int_31 = Integer(bang_4.Branch0)
柱宽_2 = Number(item_11.Item6)
房宽_2 = Number(item_11.Item3)
房深_2 = Number(item_11.Item4)
墙厚_2 = Number(item_11.Item5)
房位 = Complex(complex_2)
角度_2 = Number(item_11.Item2)
panel_17 = Panel(join)
rad = Radians(Degrees=角度_2)
int_32 = Integer(split_6)

# ----
# 判断bool值是否满足当前空间类型
panel_18 = Panel("0,1,2,3;0,1,2;0,1;0,2;0,2,3;0,1,2,3")
split_7 = TextSplit(Text="0,1,2,3;0,1,2;0,1;0,2;0,2,3;0,1,2,3", Separators=";")
mindex_5 = MemberIndex(Set=split_7, Member=join)  # -> Index, Count
equals_18 = Equality(FirstNumber=int_31, SecondNumber=mindex_5.Index)  # -> Equality, Inequality
ma_4 = MassAddition(Input=flatten(mindex_5.Count))  # -> Result, PartialResults
int_33 = Integer(equals_18.Equality)
bool_8 = Boolean(ma_4.Result)
ma_5 = MassAddition(Input=flatten(int_33))  # -> Result, PartialResults
and = GateAnd(A=ma_5.Result, B=bool_8)

split_8 = TextSplit(Text=split_7, Separators=",")
lng_3 = ListLength(List=split_8)  # -> flatten(Length)
item_13 = ListItem(List=lng_3, Index=int_31, Wrap=True)
series_4 = Series(Start=0, Step=1, Count=item_13)
rest_index = Integer(series_4)
item_14 = ListItem(List=shift_2, Index=rest_index, Wrap=True)

item_15 = ListItem(List=item_14, Index=0, Wrap=True)
subtraction_17 = Subtraction(A=item_14, B=item_15)
abs_2 = Absolute(Value=subtraction_17)

panel_19 = Panel(item_14)
join_2 = TextJoin(Text=abs_2, Join=",")
panel_20 = Panel("""0,2
2,1""")
prot = RotatePlane(Plane=房位, Angle=rad)
panel_21 = Panel("""1,-1
-1,-1
-1,1
1,1""")

# ----
# 返回哪种partition类型索引
bool_9 = Boolean(mindex_5.Count)
dispatch = Dispatch(List=flatten(mindex_5.Count), DispatchPattern=flatten(bool_9))  # -> ListA, ListB
item_16 = ListItem(List=dispatch.ListA, Index=0, Wrap=True)
split_9 = TextSplit(Text="0,4;0,3;1,2;0,2;2,1;4,0", Separators=";")
index = Integer(item_16)

空间方位 = Complex(prot)
panel_23 = Panel("0,1,2,3;0,1,2;0,1;0,2;0;0,1,2,3")
merge_5 = Merge(Data1=filter_29, Data2=filter_26)
item_17 = ListItem(List=split_9, Index=int_31, Wrap=True)
filter_30 = StreamFilter(
    Gate=int_24,
    Stream0=gate_13.Target0,
    Stream1=gate_13.Target1,
    Stream2=merge_5,
    Stream3=merge_5,
    Stream4=merge_4,
    Stream5=[0, 1, 2, 3])
split_10 = TextSplit(Text=item_17, Separators=",")
filter_31 = StreamFilter(Gate=and, Stream1=split_10)
partition_7 = PartitionList(List=mindex_4.Index, Size=filter_31)
bang_5 = ExplodeTree(Data=partition_7)  # -> _0000, _0001
panel_24 = Panel(bang_5._0000)
panel_25 = Panel(bang_5._0001)
int_34 = Integer(filter_30)
partition_8 = PartitionList(List=int_34, Size=int_32)
txt_3 = Text(partition_8)
txt_4 = Text(txt_3)
房宽_s = Number(房宽_2)
房深_h = Number(房深_2)
墙厚_t = Number(墙厚_2)
txt_5 = Text(bang_5._0000)
txt_6 = Text(bang_5._0001)
方位编号 = Integer(txt_4)
merge_6 = Merge(Data1=房宽_s, Data2=房深_h, Data3=墙厚_t)
panel_26 = Panel(partition_7)
entwine = Entwine(Branch00=txt_5, Branch01=txt_6, FlattenInputs=True)
bang_6 = ExplodeTree(Data=方位编号)  # -> _0000, _0001
txt_7 = Text(entwine)

txt_8 = Text(bang_6._0001)
panel_28 = Panel("""0,2
2,1""")
panel_29 = Panel("""0
1""")
mod = Modulus(A=txt_8, B=2)
txt_9 = Text(mod)
panel_30 = Panel("""1,-1
-1,-1
-1,1
1,1""")
panel_31 = Panel("""0
1
2
3""")
keysearch = KeyValueSearch(Keys=panel_29, Values=panel_28, Search=txt_9)
keysearch_2 = KeyValueSearch(Keys=panel_31, Values=panel_30, Search=txt_8)
split_11 = TextSplit(Text=keysearch, Separators=",")
num_2 = Number(merge_6)
split_12 = TextSplit(Text=keysearch_2, Separators=",")
item_18 = ListItem(List=num_2, Index=split_11, Wrap=True)
multiplication = Multiplication(A=item_18, B=split_12)
墙值域 = Number(multiplication)

panel_32 = Panel(entwine)

房深_3 = Number(房深_2)
房宽_3 = Number(房宽_2)
stack_2 = StackData(Data=[房深_3, "0"], Stack=2)
stack_3 = StackData(Data=[房宽_3, "0"], Stack=2)
shift_3 = ShiftList(List=stack_3, Shift=-1, Wrap=True)
pshift = ShiftPaths(Data=shift_3, Offset=-1)
pt = PointOriented(BasePlane=PlaneXY(0, 0, 0), UComponent=pshift, VComponent=stack_2, WComponent=0)
方位编号_2 = Integer(方位编号)
pt_2 = Point(pt)
item_19 = ListItem(List=pt_2, Index=方位编号_2, Wrap=True)
bang_7 = ExplodeTree(Data=item_19)  # -> _0000, _0001

txt_10 = Text(bang_6._0000)
panel_33 = Panel("""0
1
2
3""")
panel_34 = Panel("""1,-1
-1,-1
-1,1
1,1""")
lng_4 = ListLength(List=txt_10)
柱宽_3 = Number(柱宽_2)
keysearch_3 = KeyValueSearch(Keys=panel_33, Values=panel_34, Search=txt_10)
stack_4 = StackData(Data=柱宽_3, Stack=lng_4)
split_13 = TextSplit(Text=keysearch_3, Separators=",")
stack_5 = StackData(Data=graft(stack_4), Stack=2)
txt_11 = Text(split_13)
multiplication_2 = Multiplication(A=stack_5, B=txt_11)
柱值域 = Number(multiplication_2)

panel_36 = Panel("""0
1
3""")
txt_12 = Text(panel_36)
txt_13 = Text("4")
panel_37 = Panel("""0
1""")
panel_38 = Panel("""0,2
2,1""")
mod_2 = Modulus(A=txt_12, B=2)
mod_3 = Modulus(A=txt_13, B=2)
txt_14 = Text(mod_2)
panel_39 = Panel("""1,-1
-1,-1
-1,1
1,1""")
panel_40 = Panel("""0
1
2
3""")
txt_15 = Text(mod_3)
lng_5 = ListLength(List=txt_15)
keysearch_4 = KeyValueSearch(Keys=panel_37, Values=panel_38, Search=txt_14)
keysearch_5 = KeyValueSearch(Keys=panel_40, Values=panel_39, Search=txt_12)
柱宽_4 = Number(柱宽_2)
split_14 = TextSplit(Text=keysearch_4, Separators=",")
stack_6 = StackData(Data="0", Stack=lng_5)
num_3 = Number(merge_6)
split_15 = TextSplit(Text=keysearch_5, Separators=",")
stack_7 = StackData(Data=graft(stack_6), Stack=2)
item_20 = ListItem(List=num_3, Index=split_14, Wrap=True)
item_21 = ListItem(List=柱宽_4, Index=stack_7, Wrap=True)
multiplication_3 = Multiplication(A=item_20, B=split_15)
墙值域_2 = Number(multiplication_3)
柱值域_2 = Number(item_21)

merge_7 = Merge(Data1=柱值域, Data2=墙值域)
pshift_2 = ShiftPaths(Data=merge_7, Offset=-1)
bang_8 = ExplodeTree(Data=pshift_2)  # -> _0000, _0001
partition_9 = PartitionList(List=bang_8._0000, Size=2)
partition_10 = PartitionList(List=bang_8._0001, Size=2)
墙值域_3 = Number(partition_10)
柱值域_3 = Number(partition_9)
item_22 = ListItem(List=墙值域_3, Index=0, Wrap=True)  # -> Item, Item1
item_23 = ListItem(List=柱值域_3, Index=0, Wrap=True)  # -> Item, Item1
柱_x = Number(item_23.Item)
柱_y = Number(item_23.Item1)
墙_x = Number(item_22.Item)
墙_y = Number(item_22.Item1)

墙_y_2 = Number(墙_y)
墙方位 = Plane(bang_7._0001)
墙_x_2 = Number(墙_x)
柱_x_2 = Number(柱_x)
柱_y_2 = Number(柱_y)
柱方位 = Plane(bang_7._0000)
rectangle = Rectangle(Plane=graft(柱方位), XSize=柱_x_2, YSize=柱_y_2, Radius=0)  # -> Rectangle, Length
rectangle_2 = Rectangle(Plane=graft(墙方位), XSize=墙_x_2, YSize=墙_y_2, Radius=0)  # -> Rectangle, Length
runion = RegionUnion(Curves=flatten(rectangle_2.Rectangle))

int_35 = Integer(int_24)
equals_19 = Equality(FirstNumber=int_35, SecondNumber=4)  # -> Equality, Inequality
gate_19 = StreamGate(Stream=rectangle_2.Rectangle, Gate=equals_19.Equality)  # -> Target0, Target1
rec = Rectangle(gate_19.Target1)
