# Grasshopper definition 20170329_垂直构件限定空间6.gh (Grasshopper 0.9.76)

# ---- group: 房间输入参数
md_slider = MDSlider(
    slider_value=Point(0.6180000305, 0.4639997482, 0.5),
    SliderMode=0,
    x_domain=Domain(-10000, 10000),
    y_domain=Domain(-10000, 10000),
    z_domain=Domain(0, 1))
角度 = Slider(0, range=0..360)
房宽 = Slider(4000, range=0..5000)
房深 = Slider(6000, range=0..6000)
墙厚 = Slider(200, range=0..5000)
complex = ComplexComponents(Complex=md_slider)  # -> Real, Imaginary

# ----
柱宽 = Slider(200, range=0..5000)

# ---- group: 空间类型参数输入
list = ValueList({"全围合": 0, "单面开敞": 1, "两面开敞（临边）": 2, "两面开敞（对边）": 3, "三面开敞": 4, "四面开敞": 5}, selected="两面开敞（对边）")
toggle = BooleanToggle(True)
toggle_2 = BooleanToggle(False)
toggle_3 = BooleanToggle(True)
toggle_4 = BooleanToggle(False)

# ----
int = Integer([list, toggle, toggle_2, toggle_3, toggle_4])
partition = PartitionList(List=int, Size=[1, 4])  # -> simplify(Chunks)
bang = ExplodeTree(Data=partition)  # -> Branch0, Branch1

# ----
# 上,下,左,右
# 上左,左下,下右,右上
# 上下,左右
# 上左右,左下上,下右下,左下右
panel = Panel("""全围合
单面开敞
两面开敞（临边）
两面开敞（对边）
三面开敞
四面开敞""")
panel_2 = Panel("垂直构件限定空间")

num = Number([complex.Real, complex.Imaginary, 角度, 房宽, 房深, 墙厚, 柱宽])
item = ListItem(List=num, Index=0, Wrap=False)  # -> Item, Item1, Item2, Item3, Item4, Item5, Item6
complex_2 = CreateComplex(Real=item.Item, Imaginary=item.Item1)
房宽_2 = Number(item.Item3)
房深_2 = Number(item.Item4)
房位 = Complex(complex_2)
柱宽_2 = Number(item.Item6)
角度_2 = Number(item.Item2)
墙厚_2 = Number(item.Item5)
rad = Radians(Degrees=角度_2)
prot = RotatePlane(Plane=房位, Angle=rad)
空间方位 = Complex(prot)

list_2 = ValueList({"全围合": 0, "单面开敞": 1, "两面开敞（临边）": 2, "两面开敞（对边）": 3, "三面开敞": 4, "四面开敞": 5}, selected="三面开敞")
int_2 = Integer([list_2, Toggle(False), Toggle(False), Toggle(True), Toggle(False)])
partition_2 = PartitionList(List=int_2, Size=[1, 4])  # -> simplify(Chunks)
panel_3 = Panel("""4
3
2
2
1
0""")
bang_2 = ExplodeTree(Data=partition_2)  # -> Branch0, Branch1
int_3 = Integer(Toggle(True))
int_4 = Integer(bang_2.Branch0)
item_2 = ListItem(List=panel_3, Index=int_4, Wrap=False)
mindex = MemberIndex(Set=bang_2.Branch1, Member=int_3)  # -> Index, Count
int_5 = Integer(item_2)
equals = Equality(FirstNumber=mindex.Count, SecondNumber=int_5)  # -> Equality, Inequality
int_6 = Integer(mindex.Index)
filter = StreamFilter(Gate=equals.Equality, Stream1=int_4)
filter_2 = StreamFilter(Gate=equals.Equality, Stream1=int_6)
int_7 = Integer(filter)
gate = StreamGate(Stream=filter_2, Gate=int_7)  # -> Target0, Target1, Target2, Target3, Target4, Target5
equals_2 = Equality(FirstNumber=int_7, SecondNumber=4)  # -> Equality, Inequality
split = TextSplit(Text="0,4;0,3;1,2;0,2;2,1;4,0", Separators=";")
item_3 = ListItem(List=[gate.Target2, gate.Target3], Index=0, Wrap=True)  # -> Item, Item1
subtraction = Subtraction(A=item_3.Item1, B=item_3.Item)
equals_3 = Equality(FirstNumber=int_7, SecondNumber=2)  # -> Equality, Inequality
equals_4 = Equality(FirstNumber=subtraction, SecondNumber=3)  # -> Equality, Inequality
gate_2 = StreamGate(Stream=gate.Target4, Gate=equals_2.Equality)  # -> Target0, Target1
item_4 = ListItem(List=split, Index=int_7, Wrap=False)
subtraction_2 = Subtraction(A=item_3.Item1, B=item_3.Item)
filter_3 = StreamFilter(Gate=equals_4.Equality, Stream0=item_3.Item, Stream1=item_3.Item1)
gate_3 = StreamGate(Stream=filter_3, Gate=equals_3.Equality)  # -> Target0, Target1
addition = Addition(A=gate_2.Target1, B=[2, 3])
subtraction_3 = Subtraction(A=int_7, B=2)
split_2 = TextSplit(Text=item_4, Separators=",")
addition_2 = Addition(A=gate_3.Target1, B=3)
gate_4 = StreamGate(Stream=subtraction_2, Gate=subtraction_3)  # -> Target0, Target1
panel_4 = Panel("""1
3""")
larger = LargerThan(FirstNumber=addition, SecondNumber=3)  # -> LargerThan, OrEqualTo
larger_2 = LargerThan(FirstNumber=addition_2, SecondNumber=3)  # -> LargerThan, OrEqualTo
equals_5 = Equality(FirstNumber=gate_4.Target0, SecondNumber=panel_4)  # -> Equality, Inequality
equals_6 = Equality(FirstNumber=gate_4.Target1, SecondNumber="2")  # -> Equality, Inequality
gate_5 = StreamGate(Stream=addition, Gate=larger.LargerThan)  # -> Target0, Target1
gate_6 = StreamGate(Stream=addition_2, Gate=larger_2.LargerThan)  # -> Target0, Target1
ma = MassAddition(Input=equals_5.Equality)  # -> Result, PartialResults
subtraction_4 = Subtraction(A=gate_5.Target1, B=4)
bool = Boolean(equals_6.Equality)
subtraction_5 = Subtraction(A=gate_6.Target1, B=4)
int_8 = Integer(split_2)
bool_2 = Boolean(ma.Result)
filter_4 = StreamFilter(Gate=larger.LargerThan, Stream0=gate_5.Target0, Stream1=subtraction_4)
filter_5 = StreamFilter(Gate=larger_2.LargerThan, Stream0=gate_6.Target0, Stream1=subtraction_5)
filter_6 = StreamFilter(Gate=subtraction_3, Stream0=bool_2, Stream1=bool)
filter_7 = StreamFilter(Gate=equals_2.Equality, Stream1=filter_4)
filter_8 = StreamFilter(Gate=equals_3.Equality, Stream1=filter_5)
filter_9 = StreamFilter(Gate=filter_6, Stream1=[gate.Target2, gate.Target3])
merge = Merge(Data1=filter_7, Data2=gate.Target4)
merge_2 = Merge(Data1=filter_8, Data2=filter_9)
filter_10 = StreamFilter(
    Gate=int_7,
    Stream0=gate.Target0,
    Stream1=gate.Target1,
    Stream2=merge_2,
    Stream3=merge_2,
    Stream4=merge,
    Stream5=[0, 1, 2, 3])
int_9 = Integer(filter_10)
partition_3 = PartitionList(List=int_9, Size=int_8)
txt = Text(partition_3)

# ----
# 上右下左:0123
上右下左_0123 = Panel(""" 
0,1,2,3
03,32,21,10
02,13
013,023,123,012
 """)
panel_5 = Panel("""s
h
t""")
panel_6 = Panel("""0: s,-t;a,-a
1:-t,-h;-a,-a
2:-s, t;-a,a
3: t, h;a,a""")
panel_7 = Panel("""0,2
2,1""")
panel_8 = Panel("""1,-1
-1,-1
-1,1
1,1""")

panel_9 = Panel("""1
1
1
1""")
int_10 = Integer("1")
int_11 = Integer("4")
series = Series(Start=0, Step=1, Count=int_11)
stack = StackData(Data=int_10, Stack=int_11)
sort = SortList(Keys=stack, ValuesA=series)  # -> Keys, ValuesA

空间类型 = Integer(bang.Branch0)
墙方位 = Integer(bang.Branch1)
panel_10 = Panel("""4
3
2
2
1
0""")
item_5 = ListItem(List=panel_10, Index=空间类型, Wrap=False)
mindex_2 = MemberIndex(Set=墙方位, Member=1)  # -> Index, Count
equals_7 = Equality(FirstNumber=mindex_2.Count, SecondNumber=item_5)  # -> Equality, Inequality
split_3 = TextSplit(Text="0,4;0,3;1,2;0,2;2,1;4,0", Separators=";")

# ---- group: 数量匹配&&
filter_11 = StreamFilter(Gate=equals_7.Equality, Stream1=mindex_2.Index)
filter_12 = StreamFilter(Gate=equals_7.Equality, Stream1=空间类型)

# ----
int_12 = Integer(filter_12)
gate_7 = StreamGate(Stream=filter_11, Gate=int_12)  # -> Target0, Target1, Target2, Target3, Target4, Target5
item_6 = ListItem(List=split_3, Index=int_12, Wrap=False)
split_4 = TextSplit(Text=item_6, Separators=",")

equals_8 = Equality(FirstNumber=int_12, SecondNumber=4)  # -> Equality, Inequality
gate_8 = StreamGate(Stream=gate_7.Target4, Gate=equals_8.Equality)  # -> Target0, Target1
addition_3 = Addition(A=gate_8.Target1, B=[2, 3])
larger_3 = LargerThan(FirstNumber=addition_3, SecondNumber=3)  # -> LargerThan, OrEqualTo
gate_9 = StreamGate(Stream=addition_3, Gate=larger_3.LargerThan)  # -> Target0, Target1
subtraction_6 = Subtraction(A=gate_9.Target1, B=4)
filter_13 = StreamFilter(Gate=larger_3.LargerThan, Stream0=gate_9.Target0, Stream1=subtraction_6)
filter_14 = StreamFilter(Gate=equals_8.Equality, Stream1=filter_13)
merge_3 = Merge(Data1=filter_14, Data2=gate_7.Target4)

# ---- group: 2,3转换成0,1
subtraction_7 = Subtraction(A=int_12, B=2)

# ----
item_7 = ListItem(List=[gate_7.Target2, gate_7.Target3], Index=0, Wrap=True)  # -> Item, Item1
subtraction_8 = Subtraction(A=item_7.Item1, B=item_7.Item)
gate_10 = StreamGate(Stream=subtraction_8, Gate=subtraction_7)  # -> Target0, Target1
panel_11 = Panel("""1
3""")
equals_9 = Equality(FirstNumber=gate_10.Target0, SecondNumber=panel_11)  # -> Equality, Inequality
equals_10 = Equality(FirstNumber=gate_10.Target1, SecondNumber="2")  # -> Equality, Inequality
ma_2 = MassAddition(Input=equals_9.Equality)  # -> Result, PartialResults
bool_3 = Boolean(equals_10.Equality)
bool_4 = Boolean(ma_2.Result)
filter_15 = StreamFilter(Gate=subtraction_7, Stream0=bool_4, Stream1=bool_3)
filter_16 = StreamFilter(Gate=filter_15, Stream1=[gate_7.Target2, gate_7.Target3])

# ---- group: 双敞(邻边)溢出转换,计算柱编号 / 0,3退化情况处理
subtraction_9 = Subtraction(A=item_7.Item1, B=item_7.Item)
equals_11 = Equality(FirstNumber=subtraction_9, SecondNumber=3)  # -> Equality, Inequality
filter_17 = StreamFilter(Gate=equals_11.Equality, Stream0=item_7.Item, Stream1=item_7.Item1)

# ---- group: 双敞(邻边)溢出转换,计算柱编号
equals_12 = Equality(FirstNumber=int_12, SecondNumber=2)  # -> Equality, Inequality
gate_11 = StreamGate(Stream=filter_17, Gate=equals_12.Equality)  # -> Target0, Target1
addition_4 = Addition(A=gate_11.Target1, B=3)
larger_4 = LargerThan(FirstNumber=addition_4, SecondNumber=3)  # -> LargerThan, OrEqualTo
gate_12 = StreamGate(Stream=addition_4, Gate=larger_4.LargerThan)  # -> Target0, Target1
subtraction_10 = Subtraction(A=gate_12.Target1, B=4)
filter_18 = StreamFilter(Gate=larger_4.LargerThan, Stream0=gate_12.Target0, Stream1=subtraction_10)
filter_19 = StreamFilter(Gate=equals_12.Equality, Stream1=filter_18)

# ----
merge_4 = Merge(Data1=filter_19, Data2=filter_16)

filter_20 = StreamFilter(
    Gate=int_12,
    Stream0=gate_7.Target0,
    Stream1=gate_7.Target1,
    Stream2=merge_4,
    Stream3=merge_4,
    Stream4=merge_3,
    Stream5=[0, 1, 2, 3])
partition_4 = PartitionList(List=filter_20, Size=split_4)
方位编号 = Text(partition_4)

# ---- group: 墙住方位值域运算
方位编号_2 = Integer(方位编号)
bang_3 = ExplodeTree(Data=方位编号_2)  # -> _0000, _0001

# ----
panel_12 = Panel(bang_3._0000)

# ---- group: 墙住方位运算
房深_3 = Number(房深_2)
房宽_3 = Number(房宽_2)
空间方位_2 = Plane(prot)
stack_2 = StackData(Data=[房深_3, "0"], Stack=2)
stack_3 = StackData(Data=[房宽_3, "0"], Stack=2)
shift = ShiftList(List=stack_3, Shift=-1, Wrap=True)
pshift = ShiftPaths(Data=shift, Offset=-1)
pt = PointOriented(BasePlane=空间方位_2, UComponent=pshift, VComponent=stack_2, WComponent=0)
pl_origin = PlaneOrigin(Base=空间方位_2, Origin=pt)
方位编号_3 = Integer(方位编号_2)
item_8 = ListItem(List=pl_origin, Index=方位编号_3, Wrap=True)
bang_4 = ExplodeTree(Data=item_8)  # -> _0000, _0001
柱方位 = Plane(bang_4._0000)
墙方位_2 = Plane(bang_4._0001)

# ---- group: 墙住方位值域运算
柱宽_3 = Number(柱宽_2)
柱方位_2 = Text(bang_3._0000)
panel_13 = Panel("""1,-1
-1,-1
-1,1
1,1""")
panel_14 = Panel("""0
1
2
3""")
lng = ListLength(List=柱方位_2)
keysearch = KeyValueSearch(Keys=panel_14, Values=panel_13, Search=柱方位_2)
stack_4 = StackData(Data=柱宽_3, Stack=lng)
split_5 = TextSplit(Text=keysearch, Separators=",")
stack_5 = StackData(Data=graft(stack_4), Stack=2)
txt_2 = Text(split_5)
multiplication = Multiplication(A=stack_5, B=txt_2)
柱值域 = Number(multiplication)

房宽_s = Number(房宽_2)
房深_h = Number(房深_2)
墙厚_t = Number(墙厚_2)
墙方位_3 = Text(bang_3._0001)
panel_15 = Panel("""0,2
2,1""")
panel_16 = Panel("""0
1""")
mod = Modulus(A=墙方位_3, B=2)
num_2 = Number([房宽_s, 房深_h, 墙厚_t])
txt_3 = Text(mod)
panel_17 = Panel("""0
1
2
3""")
panel_18 = Panel("""1,-1
-1,-1
-1,1
1,1""")
keysearch_2 = KeyValueSearch(Keys=panel_16, Values=panel_15, Search=txt_3)
keysearch_3 = KeyValueSearch(Keys=panel_17, Values=panel_18, Search=墙方位_3)
split_6 = TextSplit(Text=keysearch_2, Separators=",")
split_7 = TextSplit(Text=keysearch_3, Separators=",")
item_9 = ListItem(List=num_2, Index=split_6, Wrap=True)
multiplication_2 = Multiplication(A=item_9, B=split_7)
墙值域 = Number(multiplication_2)

merge_5 = Merge(Data1=柱值域, Data2=墙值域)
pshift_2 = ShiftPaths(Data=merge_5, Offset=-1)  # -> simplify(Data)
bang_5 = ExplodeTree(Data=pshift_2)  # -> Branch0, Branch1
partition_5 = PartitionList(List=bang_5.Branch0, Size=2)
partition_6 = PartitionList(List=bang_5.Branch1, Size=2)
墙值域_2 = Number(partition_6)
柱值域_2 = Number(partition_5)
item_10 = ListItem(List=墙值域_2, Index=0, Wrap=True)  # -> Item, Item1
item_11 = ListItem(List=柱值域_2, Index=0, Wrap=True)  # -> Item, Item1
柱_x = Number(item_11.Item)
柱_y = Number(item_11.Item1)
墙_x = Number(item_10.Item)
墙_y = Number(item_10.Item1)

# ----
墙方位_4 = Plane(墙方位_2)
墙_x_2 = Number(墙_x)
墙_y_2 = Number(墙_y)
int_13 = Integer(int_12)
柱方位_3 = Plane(柱方位)
柱_x_2 = Number(柱_x)
柱_y_2 = Number(柱_y)
equals_13 = Equality(FirstNumber=int_13, SecondNumber=4)  # -> Equality, Inequality
rectangle = Rectangle(Plane=graft(墙方位_4), XSize=墙_x_2, YSize=墙_y_2, Radius=0)  # -> Rectangle, Length
rectangle_2 = Rectangle(Plane=graft(柱方位_3), XSize=柱_x_2, YSize=柱_y_2, Radius=0)  # -> Rectangle, Length
gate_13 = StreamGate(Stream=rectangle.Rectangle, Gate=equals_13.Equality)  # -> Target0, Target1
runion = RegionUnion(Curves=flatten(rectangle.Rectangle))

rec = Rectangle(rectangle_2.Rectangle)
crv = Curve(runion)
rec_2 = Rectangle(gate_13.Target1)
