# Grasshopper definition 160925_PE_points.gh (Grasshopper 0.9.76)

line = Line([Line((-28.43570879, -32.87535514, 0), (26.13975502, -11.96140003, 0)), Line((18.7700756, 6.164027732, 0), (13.19302091, -43.43192296, 0)), Line((-30.62669456, -19.7294405, 0), (35.30205917, -38.25322931, 0)), Line((2.835633616, -1.404832213, 0), (-1.54633793, -45.62290873, 0))])  # disabled
panel = Panel("1")  # disabled
linelist = Curve(line)  # disabled
lng = ListLength(List=linelist)  # disabled
subtraction = Subtraction(A=lng, B=panel)  # disabled
series = Series(Start=0, Step=1, Count=subtraction)  # disabled
addition = Addition(A=series, B=panel)  # disabled
item = ListItem(List=linelist, Index=series, Wrap=False)  # -> simplify(graft(Item)); disabled
shift = ShiftList(List=linelist, Shift=addition, Wrap=False)  # -> simplify(List); disabled
end = EndPoints(Curve=item)  # -> Start, End; disabled
end_2 = EndPoints(Curve=shift)  # -> Start, End; disabled

line_length = Panel("""3.2
5.1
6.3
4.2""")
panel_2 = Panel("""0
1
2
3""")
# Point:indicate a position in space
# Line:length,direction,position
# Point
# two ends of the line
# the intersection of two lines
# the meeting of lines at the corner of a space or volumn
# the center of field
md_slider = MDSlider(
    slider_value=Point(0.5132578379, 0.5396976122, 0.5),
    SliderMode=0,
    x_domain=Domain(-100, 100),
    y_domain=Domain(-100, 100),
    z_domain=Domain(0, 1))  # disabled
startpoint = Point(md_slider)  # disabled
line_length_2 = Number(line_length)
int = Integer(panel_2)
number_slider = Slider(0.52, range=0..100)  # disabled
number_slider_2 = Slider(2.4, range=0..100)  # disabled
number_slider_3 = Slider(7.61, range=0..100)  # disabled
number_slider_4 = Slider(6.19, range=0..100)  # disabled
item_2 = ListItem(List=["1,0", "0,1", "-1,0", "0,-1"], Index=int, Wrap=True)
item_3 = ListItem(List=line_length_2, Index=0, Wrap=True)
X = UnitX(Factor=1)
basicvector = Vector(item_2)
merge = Merge(Data1=number_slider, Data2=number_slider_2)  # disabled
merge_2 = Merge(Data1=number_slider_3, Data2=number_slider_4)  # disabled
amp = Amplitude(Vector=X, Amplitude=item_3)  # disabled
line_2 = LineSDL(Start=startpoint, Direction=X, Length=item_3)  # disabled
complex = ComplexComponents(Complex=startpoint)  # -> Real, Imaginary; disabled
pt = PointOriented(BasePlane=startpoint, UComponent=merge, VComponent=merge_2, WComponent=0)  # disabled
complex_2 = ComplexComponents(Complex=amp)  # -> Real, Imaginary; disabled
complex_3 = CreateComplex(Real=complex.Real, Imaginary=complex.Imaginary)  # disabled
complex_4 = CreateComplex(Real=complex_2.Real, Imaginary=complex_2.Imaginary)  # disabled
item_4 = ListItem(List=pt, Index=0, Wrap=True)  # -> Item, Item1; disabled
X_2 = UnitX(Factor=1)  # disabled
Y = UnitY(Factor=1)  # disabled
addition_2 = Addition(A=complex_3, B=complex_4)  # disabled
line_3 = LineSDL(Start=item_4.Item1, Direction=Y, Length=item_3)  # disabled
line_4 = LineSDL(Start=item_4.Item, Direction=X_2, Length=item_3)  # disabled
panel_3 = Panel(addition_2)  # disabled
panel_4 = Panel("""1,2
2,1""")  # disabled
panel_5 = Panel("""2.0,2.0,0.0
-0.5,4.0,0.0""")  # disabled
panel_6 = Panel(complex_3)  # disabled
startpoint_2 = Point(panel_4)  # disabled
vec = Vector(panel_5)  # disabled
addition_3 = Addition(A=startpoint_2, B=vec)  # disabled
vec2pt = Vector2Pt(PointA=startpoint_2, PointB=addition_3, Unitize=False)  # -> Vector, Length; disabled
ln = Line(StartPoint=startpoint_2, EndPoint=addition_3)  # disabled
endpoint = Point(addition_3)  # disabled

line_length_3 = Panel("""3.2
5.1
3.2
5.1
6.4
10.2""")
panel_7 = Panel("""0
1
0
1
2
3""")
line_5 = Line([Line((-10.29725997, 2.159053388, 0), (-11.99011357, -47.17553699, 0)), Line((-27.95130457, -8.723576843, 0), (26.94551904, -6.547050797, 0)), Line((21.62512204, 3.368234525, 0), (19.44859599, -45.72451963, 0)), Line((-26.50028721, -30.24700108, 0), (26.46184658, -43.06432113, 0))])
# explore a point position in space
linelist_2 = Curve(line_5)
lng_2 = ListLength(List=linelist_2)
subtraction_2 = Subtraction(A=lng_2, B="1")
panel_8 = Panel("""0
1
2
3""")
line_length_4 = Panel("""3.2
5.1
3.2
5.1""")
series_2 = Series(Start=0, Step=1, Count=subtraction_2)
addition_4 = Addition(A=series_2, B="1")
item_5 = ListItem(List=linelist_2, Index=series_2, Wrap=False)  # -> simplify(graft(Item))
end_3 = EndPoints(Curve=linelist)  # -> Start, End; disabled
Y_2 = UnitY(Factor=1)
shift_2 = ShiftList(List=linelist_2, Shift=addition_4, Wrap=False)  # -> simplify(List)
X_3 = UnitX(Factor=1)
md_slider_2 = MDSlider(
    slider_value=Point(0.4899997711, 0.4549980164, 0.5),
    SliderMode=0,
    x_domain=Domain(0, 1),
    y_domain=Domain(0, 1),
    z_domain=Domain(0, 1))
rev = Reverse(Vector=Y_2)
subtraction_3 = Subtraction(A=end_3.End, B=end_3.Start)  # disabled
line_length_5 = Number(line_length_3)
panel_9 = Panel("""1,0
0,1
-1,0
0,-1""")
startpoint_3 = Point(end_3.Start)  # disabled
end_4 = EndPoints(Curve=item_5)  # -> Start, End
end_5 = EndPoints(Curve=shift_2)  # -> Start, End
vec_2 = Vector(subtraction_3)  # disabled
vlen = VectorLength(Vector=rev)
vlen_2 = VectorLength(Vector=X_3)
vec_3 = Vector(panel_9)
int_2 = Integer(panel_7)
lng_3 = ListLength(List=int_2)
addition_5 = Addition(A=startpoint_3, B=vec_2)  # disabled
endpoint_2 = Point(addition_5)  # disabled
multiplication = Multiplication(A=X_3, B=rev)
multiplication_2 = Multiplication(A=vlen_2, B=vlen)
lng_4 = ListLength(List=addition_5)  # disabled
end_6 = EndPoints(Curve=linelist_2)  # -> Start, End
lng_5 = ListLength(List=startpoint_3)  # disabled
series_3 = Series(Start=0, Step=1, Count=lng_3)
panel_10 = Panel("1")  # disabled
panel_11 = Panel(startpoint_3)  # disabled
panel_12 = Panel("1")  # disabled
item_6 = ListItem(List=vec_3, Index=int_2, Wrap=True)
division = Division(A=multiplication, B=multiplication_2)
subtraction_4 = Subtraction(A=lng_4, B=panel_10)  # disabled
subtraction_5 = Subtraction(A=lng_5, B=panel_12)  # disabled
subtraction_6 = Subtraction(A=end_6.End, B=end_6.Start)
item_7 = ListItem(List=line_length_5, Index=series_3, Wrap=True)
panel_13 = Panel(item_7)
startpoint_4 = Point(end_6.Start)
vec_4 = Vector(subtraction_6)
basicvectorunit = Vector(item_6)
series_4 = Series(Start=0, Step=1, Count=subtraction_5)  # disabled
series_5 = Series(Start=0, Step=1, Count=subtraction_4)  # disabled
acos = ArcCosine(Value=division)
amp_2 = Amplitude(Vector=basicvectorunit, Amplitude=item_7)
addition_6 = Addition(A=series_5, B=panel_10)  # disabled
addition_7 = Addition(A=startpoint_4, B=vec_4)
endpoint_3 = Point(addition_7)
addition_8 = Addition(A=series_4, B=panel_12)  # disabled
lng_6 = ListLength(List=addition_7)
lng_7 = ListLength(List=startpoint_4)
panel_14 = Panel(startpoint_4)
number_slider_5 = Slider(6, range=0..100)  # disabled
item_8 = ListItem(List=startpoint_3, Index=series_4, Wrap=False)  # -> simplify(graft(Item)); disabled
item_9 = ListItem(List=addition_5, Index=series_5, Wrap=False)  # -> simplify(graft(Item)); disabled
shift_3 = ShiftList(List=addition_5, Shift=addition_6, Wrap=False)  # -> simplify(List); disabled
shift_4 = ShiftList(List=startpoint_3, Shift=addition_8, Wrap=False)  # -> simplify(List); disabled
subtraction_7 = Subtraction(A=lng_6, B="1")
subtraction_8 = Subtraction(A=lng_7, B="1")
ma = MassAddition(Input=amp_2)  # -> Result, PartialResults
addition_9 = Addition(A=md_slider_2, B=ma.PartialResults)
panel_15 = Panel(ma.PartialResults)
pt_2 = Point(ma.PartialResults)
panel_16 = Panel(item_6)
series_6 = Series(Start=0, Step=1, Count=subtraction_8)
series_7 = Series(Start=0, Step=1, Count=subtraction_7)
shift_5 = ShiftList(List=ma.PartialResults, Shift=-1, Wrap=True)
complex_5 = ComplexComponents(Complex=shift_5)  # -> Real, Imaginary
firstpt0 = Point(item_8)  # disabled
firstpt1 = Point(shift_4)  # disabled
endpt0 = Point(item_9)  # disabled
endpt1 = Point(shift_3)  # disabled
addition_10 = Addition(A=series_7, B="1")
addition_11 = Addition(A=series_6, B="1")
points = PointList(Points=flatten(firstpt0), Size=number_slider_5)  # disabled
item_10 = ListItem(List=startpoint_4, Index=series_6, Wrap=False)  # -> simplify(graft(Item))
# describe space by (point;index) of vector
concat = Concatenate(FragmentA=complex_5.Real, FragmentB=complex_5.Imaginary, JoinSeparator=",")
item_11 = ListItem(List=amp_2, Index=graft(series_3), Wrap=True)
item_12 = ListItem(List=addition_7, Index=series_7, Wrap=False)  # -> simplify(graft(Item))
shift_6 = ShiftList(List=addition_7, Shift=addition_10, Wrap=False)  # -> simplify(List)
shift_7 = ShiftList(List=startpoint_4, Shift=addition_11, Wrap=False)  # -> simplify(List)
complex_6 = ComplexComponents(Complex=endpt1)  # -> Real, Imaginary; disabled
complex_7 = ComplexComponents(Complex=firstpt1)  # -> Real, Imaginary; disabled
complex_8 = ComplexComponents(Complex=firstpt0)  # -> Real, Imaginary; disabled
complex_9 = ComplexComponents(Complex=endpt0)  # -> Real, Imaginary; disabled
pline = PolyLine(Vertices=pt_2, Closed=True)
concat_2 = Concatenate(FragmentA=concat, FragmentB=int_2, JoinSeparator=";")
item_13 = ListItem(List=concat_2, Index=series_3, Wrap=True)
split = TextSplit(Text=item_13, Separators=";")  # -> simplify(Result)
panel_17 = Panel(split)
item_14 = ListItem(List=split, Index=0, Wrap=True)  # -> Item, Item1
pt_3 = Point(item_14.Item)
panel_18 = Panel(pt_3)
panel_19 = Panel(item_11)
subtraction_9 = Subtraction(A=complex_8.Real, B=complex_9.Real)  # disabled
subtraction_10 = Subtraction(A=complex_8.Imaginary, B=complex_9.Imaginary)  # disabled
subtraction_11 = Subtraction(A=complex_7.Real, B=complex_6.Real)  # disabled
firstpt0_2 = Point(item_10)
firstpt1_2 = Point(shift_7)
endpt0_2 = Point(item_12)
endpt1_2 = Point(shift_6)
subtraction_12 = Subtraction(A=complex_7.Imaginary, B=complex_6.Imaginary)  # disabled
points_2 = PointList(Points=flatten(firstpt0_2), Size=Slider(6, range=0..100))
addition_12 = Addition(A=pt_3, B=item_11)
division_2 = Division(A=subtraction_10, B=subtraction_9)  # disabled
division_3 = Division(A=subtraction_12, B=subtraction_11)  # disabled
firstpt0_3 = Point(item_14.Item)
endpt0_3 = Point(addition_12)
complex_10 = ComplexComponents(Complex=endpt1_2)  # -> Real, Imaginary
complex_11 = ComplexComponents(Complex=firstpt1_2)  # -> Real, Imaginary
complex_12 = ComplexComponents(Complex=firstpt0_2)  # -> Real, Imaginary
complex_13 = ComplexComponents(Complex=endpt0_2)  # -> Real, Imaginary
panel_20 = Panel(concat_2)
k2 = Number(division_3)  # disabled
multiplication_3 = Multiplication(A=k2, B=complex_6.Real)  # disabled
k1 = Number(division_2)  # disabled
multiplication_4 = Multiplication(A=k1, B=complex_9.Real)  # disabled
panel_21 = Panel(firstpt0_2)
complex_14 = ComplexComponents(Complex=endpt0_3)  # -> Real, Imaginary
complex_15 = ComplexComponents(Complex=firstpt0_3)  # -> Real, Imaginary
subtraction_13 = Subtraction(A=complex_12.Real, B=complex_13.Real)
subtraction_14 = Subtraction(A=complex_12.Imaginary, B=complex_13.Imaginary)
subtraction_15 = Subtraction(A=complex_11.Real, B=complex_10.Real)
subtraction_16 = Subtraction(A=complex_11.Imaginary, B=complex_10.Imaginary)
subtraction_17 = Subtraction(A=complex_9.Imaginary, B=multiplication_4)  # disabled
subtraction_18 = Subtraction(A=complex_6.Imaginary, B=multiplication_3)  # disabled
division_4 = Division(A=subtraction_14, B=subtraction_13)
division_5 = Division(A=subtraction_16, B=subtraction_15)
subtraction_19 = Subtraction(A=k1, B=k2)  # disabled
b1 = Number(subtraction_17)  # disabled
subtraction_20 = Subtraction(A=complex_15.Imaginary, B=complex_14.Imaginary)
b2 = Number(subtraction_18)  # disabled
subtraction_21 = Subtraction(A=complex_15.Real, B=complex_14.Real)
pt_4 = Point(Point(4.088879338, 7.756294624, 0))
panel_22 = Panel(item_14.Item1)
subtraction_22 = Subtraction(A=b2, B=b1)  # disabled
k2_2 = Number(division_5)
multiplication_5 = Multiplication(A=k2_2, B=complex_10.Real)
k1_2 = Number(division_4)
multiplication_6 = Multiplication(A=k1_2, B=complex_13.Real)
division_6 = Division(A=subtraction_22, B=subtraction_19)  # disabled

# ----
# 0 --> extend one line to intersect two lines
# 1 --> extend two lines
# 2 --> extend three lines
dom = ConstructDomain(DomainStart=complex_7.Real, DomainEnd=complex_6.Real)  # disabled
dom_2 = ConstructDomain(DomainStart=complex_8.Real, DomainEnd=complex_9.Real)  # disabled
inc = Includes(Value=division_6, Domain=dom_2)  # -> Includes, Deviation; disabled
inc_2 = Includes(Value=division_6, Domain=dom)  # -> Includes, Deviation; disabled
int_3 = Integer(inc.Includes)  # disabled
int_4 = Integer(inc_2.Includes)  # disabled
addition_13 = Addition(A=int_3, B=int_4)  # disabled
panel_23 = Panel("2")  # disabled
subtraction_23 = Subtraction(A=panel_23, B=addition_13)  # disabled
extendlinecount = Integer(subtraction_23)  # disabled

division_7 = Division(A=subtraction_20, B=subtraction_21)
complex_16 = ComplexComponents(Complex=pt_4)  # -> Real, Imaginary
subtraction_24 = Subtraction(A=complex_13.Imaginary, B=multiplication_6)
subtraction_25 = Subtraction(A=complex_10.Imaginary, B=multiplication_5)
multiplication_7 = Multiplication(A=division_6, B=k2)  # disabled
k1_3 = Number(division_7)
multiplication_8 = Multiplication(A=k1_3, B=complex_14.Real)
subtraction_26 = Subtraction(A=k1_2, B=k2_2)
b1_2 = Number(subtraction_24)
addition_14 = Addition(A=multiplication_7, B=b2)  # disabled
b2_2 = Number(subtraction_25)
dom_3 = ConstructDomain(DomainStart=complex_11.Real, DomainEnd=complex_10.Real)
dom_4 = ConstructDomain(DomainStart=complex_12.Real, DomainEnd=complex_13.Real)
subtraction_27 = Subtraction(A=complex_14.Imaginary, B=multiplication_8)
subtraction_28 = Subtraction(A=b2_2, B=b1_2)
division_8 = Division(A=subtraction_28, B=subtraction_26)
sift = SiftPattern(List=addition_14, SiftPattern=extendlinecount)  # -> Output0, Output1, Output2; disabled
sift_2 = SiftPattern(List=division_6, SiftPattern=extendlinecount)  # -> Output0, Output1, Output2; disabled
xy = XYPlane(Origin=Point(0, 0, 0))  # disabled
inc_3 = Includes(Value=division_8, Domain=dom_4)  # -> Includes, Deviation
inc_4 = Includes(Value=division_8, Domain=dom_3)  # -> Includes, Deviation
b1_3 = Number(subtraction_27)

# ----
# distances between points and space boundary
null = NullItem(Item=k1_3)  # -> NullFlags, InvalidFlags, Description
sift_3 = SiftPattern(List=pt_3, SiftPattern=null.NullFlags)  # -> Output0, Output1
complex_17 = ComplexComponents(Complex=sift_3.Output1)  # -> Real, Imaginary
eval = Evaluate(F="abs(k*x0-y0+b)/sqrt(k*k+1)", k=k1_3, b=b1_3, x0=complex_16.Real, y0=complex_16.Imaginary)
subtraction_29 = Subtraction(A=complex_16.Real, B=complex_17.Real)  # -> simplify(Result)
distance = Number(eval)
abs = Absolute(Value=subtraction_29)  # -> simplify(Result)
combine = CombineData(Input0=distance, Input1=abs)  # -> Result, Index

panel_24 = Panel(combine.Result)

# ----
# vectors between points and space boundary
panel_25 = Panel("0.5")
item_15 = ListItem(List=vec_3, Index=item_14.Item1, Wrap=True)
pi = Pi(Factor=panel_25)
neg = Negative(Value=pi)
Z = UnitZ(Factor=1)
vrot = Rotate(Vector=item_15, Axis=Z, Angle=neg)
amp_3 = Amplitude(Vector=vrot, Amplitude=combine.Result)

panel_26 = Panel(amp_3)
panel_27 = Panel(item_15)
multiplication_9 = Multiplication(A=division_8, B=k2_2)
int_5 = Integer(inc_3.Includes)
addition_15 = Addition(A=multiplication_9, B=b2_2)
int_6 = Integer(inc_4.Includes)
pt_5 = PointOriented(BasePlane=xy, UComponent=sift_2.Output0, VComponent=sift.Output0, WComponent=0)  # disabled
panel_28 = Panel("abs(k*x0-y0+b)/sqrt(k*k+1)")
panel_29 = Panel("(k*x0-y0+b)/sqrt(k*k+1)")
panel_30 = Panel("-(k*x0-y0+b)/sqrt(k*k+1)")
flatten = FlattenTree(Tree=pt_5, Path="{0}")  # disabled
addition_16 = Addition(A=int_5, B=int_6)
xy_2 = XYPlane(Origin=Point(0, 0, 0))
panel_31 = Panel(vrot)
clean = CleanTree(RemoveNulls=True, RemoveInvalid=True, RemoveEmpty=False, Tree=flatten)  # disabled
# 0 --> extend one line to intersect two lines
# 1 --> extend two lines
# 2 --> extend three lines
subtraction_30 = Subtraction(A="2", B=addition_16)
extendlinecount_2 = Integer(subtraction_30)
sift_4 = SiftPattern(List=addition_15, SiftPattern=extendlinecount_2)  # -> Output0, Output1, Output2
sift_5 = SiftPattern(List=division_8, SiftPattern=extendlinecount_2)  # -> Output0, Output1, Output2
intersection_x = Number(division_6)  # disabled
intersection_y = Number(addition_14)  # disabled
pt_6 = PointOriented(BasePlane=xy_2, UComponent=sift_5.Output0, VComponent=sift_4.Output0, WComponent=0)
xy_3 = XYPlane(Origin=Point(0, 0, 0))  # disabled
flatten_2 = FlattenTree(Tree=pt_6, Path="{0}")
pt_7 = PointOriented(BasePlane=xy_3, UComponent=intersection_x, VComponent=intersection_y, WComponent=0)  # disabled
vdis = VectorDisplay(Anchor=pt_4, Vector=amp_3)
panel_32 = Panel(extendlinecount)  # disabled
clean_2 = CleanTree(RemoveNulls=True, RemoveInvalid=True, RemoveEmpty=False, Tree=flatten_2)
pt_8 = Point(Point(-2.015690168, -16.36521091, 0))
panel_34 = Panel(eval)
intersection_x_2 = Number(division_8)
intersection_y_2 = Number(addition_15)
sift_6 = SiftPattern(List=pt_7, SiftPattern=extendlinecount)  # -> Output0, Output1, Output2; disabled
xy_4 = XYPlane(Origin=Point(0, 0, 0))
partition = PartitionList(List=clean_2, Size="2")
bang = ExplodeTree(Data=partition)  # -> Branch0, Branch1
rev_2 = ReverseList(List=bang.Branch1)
intersectionontwolines = Point(sift_6.Output0)  # disabled
intersectionononeline = Point(sift_6.Output1)  # disabled
intersectiononextend = Point(sift_6.Output2)  # disabled
pt_9 = PointOriented(BasePlane=xy_4, UComponent=intersection_x_2, VComponent=intersection_y_2, WComponent=0)
panel_36 = Panel(extendlinecount_2)
merge_3 = Merge(Data1=bang.Branch0, Data2=rev_2)  # -> flatten(Result)
sift_7 = SiftPattern(List=pt_9, SiftPattern=extendlinecount_2)  # -> Output0, Output1, Output2
pline_2 = PolyLine(Vertices=merge_3, Closed=True)
intersectionontwolines_2 = Point(sift_7.Output0)
intersectionononeline_2 = Point(sift_7.Output1)
intersectiononextend_2 = Point(sift_7.Output2)
panel_37 = Panel(merge_3)

line_6 = Line(Line((0.5128004552, -4.732454223, 0), (1.991620914, 0.1073218237, 0)))  # disabled
line_7 = Line(Line((-2.265589497, -0.1167418821, 0), (5.711078431, -2.357378941, 0)))  # disabled
end_7 = EndPoints(Curve=line_7)  # -> Start, End; disabled
complex_18 = ComplexComponents(Complex=end_7.End)  # -> Real, Imaginary; disabled
complex_19 = ComplexComponents(Complex=end_7.Start)  # -> Real, Imaginary; disabled
end_8 = EndPoints(Curve=line_6)  # -> Start, End; disabled
complex_20 = ComplexComponents(Complex=end_8.End)  # -> Real, Imaginary; disabled
complex_21 = ComplexComponents(Complex=end_8.Start)  # -> Real, Imaginary; disabled
panel_38 = Panel("1")  # disabled
panel_39 = Panel("2")  # disabled
panel_40 = Panel("0")  # disabled
x1 = Number(complex_19.Real)  # disabled
y1 = Number(complex_19.Imaginary)  # disabled
x2 = Number(complex_18.Real)  # disabled
y2 = Number(complex_18.Imaginary)  # disabled
panel_42 = Panel("0")  # disabled
panel_43 = Panel("2")  # disabled
panel_44 = Panel("0")  # disabled
panel_45 = Panel("2")  # disabled
panel_46 = Panel("-c/(x1*(y1-y2)/(x1-x2)+y1)")  # disabled
panel_47 = Panel("-c/(x1*(y1-y2)/(x1-x2)+y1)")  # disabled
x1_2 = Number(panel_44)  # disabled
y1_2 = Number(panel_42)  # disabled
x2_2 = Number(panel_45)  # disabled
y2_2 = Number(panel_43)  # disabled
panel_48 = Panel("1")  # disabled
subtraction_31 = Subtraction(A=x1, B=x2)  # disabled
neg_2 = Negative(Value=x1)  # disabled
panel_49 = Panel("1")  # disabled
panel_50 = Panel("0")  # disabled
panel_51 = Panel("0")  # disabled
panel_52 = Panel("-b*(y1-y2)/(x1-x2)")  # disabled
panel_53 = Panel("-b*(y1-y2)/(x1-x2)")  # disabled
c = Number(panel_48)  # disabled
panel_54 = Panel("1")  # disabled
equals = Equality(FirstNumber=subtraction_31, SecondNumber=panel_50)  # -> Equality, Inequality; disabled
a = Number(panel_49)  # disabled
b = Number(panel_51)  # disabled
c_2 = Number(neg_2)  # disabled
neg_3 = Negative(Value=x1_2)  # disabled
subtraction_32 = Subtraction(A=x1_2, B=x2_2)  # disabled
eval_2 = Evaluate(F=panel_46, c=c, x1=x1, x2=x2, y1=y1, y2=y2)  # disabled
panel_55 = Panel("1")  # disabled
panel_56 = Panel("0")  # disabled
panel_57 = Panel("0")  # disabled
c_3 = Number(panel_54)  # disabled
b_2 = Number(eval_2)  # disabled
equals_2 = Equality(FirstNumber=subtraction_32, SecondNumber=panel_56)  # -> Equality, Inequality; disabled
a_2 = Number(panel_55)  # disabled
b_3 = Number(panel_57)  # disabled
c_4 = Number(neg_3)  # disabled
eval_3 = Evaluate(F=panel_47, c=c_3, x1=x1_2, x2=x2_2, y1=y1_2, y2=y2_2)  # disabled
merge_4 = Merge(Data1=a, Data2=b, Data3=c_2)  # disabled
eval_4 = Evaluate(F=panel_52, b=b_2, x1=x1, x2=x2, y1=y1, y2=y2)  # disabled
b_4 = Number(eval_3)  # disabled
merge_5 = Merge(Data1=a_2, Data2=b_3, Data3=c_4)  # disabled
a_3 = Number(eval_4)  # disabled
eval_5 = Evaluate(F=panel_53, b=b_4, x1=x1_2, x2=x2_2, y1=y1_2, y2=y2_2)  # disabled
merge_6 = Merge(Data1=a_3, Data2=b_2, Data3=c)  # disabled
a_4 = Number(eval_5)  # disabled
panel_58 = Panel("1")  # disabled
panel_59 = Panel("0")  # disabled
panel_60 = Panel("-1")  # disabled
panel_61 = Panel("1")  # disabled
panel_62 = Panel("-2")  # disabled
panel_63 = Panel("2")  # disabled
merge_7 = Merge(Data1=a_4, Data2=b_4, Data3=c_3)  # disabled
filter = StreamFilter(Gate=equals.Equality, Stream0=merge_6, Stream1=merge_4)  # disabled
filter_2 = StreamFilter(Gate=equals_2.Equality, Stream0=merge_7, Stream1=merge_5)  # disabled
item_16 = ListItem(List=filter, Index=0, Wrap=True)  # -> Item, Item1, Item2; disabled
item_17 = ListItem(List=filter_2, Index=0, Wrap=True)  # -> Item, Item1, Item2; disabled
panel_64 = Panel(filter)  # disabled
panel_65 = Panel(filter_2)  # disabled
a1 = Number(panel_58)  # disabled
b1_4 = Number(panel_60)  # disabled
c1 = Number(panel_59)  # disabled
a2 = Number(panel_61)  # disabled
b2_3 = Number(panel_62)  # disabled
c2 = Number(panel_63)  # disabled

panel_66 = Panel("""(b1*c2-b2*c1)/(a1*b2-a2*b1)
(a2*c1-a1*c2)/(a1*b2-a2*b1)""")  # disabled
eval_6 = Evaluate(F=panel_66, a1=a1, b1=b1_4, c1=c1, a2=a2, b2=b2_3, c2=c2)  # disabled

item_18 = ListItem(List=eval_6, Index=0, Wrap=True)  # -> Item, Item1; disabled
panel_67 = Panel(eval_6)  # disabled
complex_22 = CreateComplex(Real=item_18.Item, Imaginary=item_18.Item1)  # disabled
pt_10 = Point(complex_22)  # disabled
