# Grasshopper definition 160929_PE_points_intersection_002.gh (Grasshopper 0.9.76)

panel = Panel("""1
3
4
2
6
7""")
panel_2 = Panel("3")
partition = PartitionList(List=panel, Size="3")  # -> simplify(Chunks)
series = Series(Start=0, Step=1, Count=10)
num = Number(partition)
panel_3 = Panel(num)
panel_4 = Panel("""001
002""")
series_2 = Series(Start="2", Step=1, Count="5")
num_2 = Number(["2", "4"])
panel_5 = Panel(series)
replace = ReplaceMembers(Set=graft(series), Find=num, Replace=graft(panel_4))
mindex = MemberIndex(Set=series_2, Member=num_2)  # -> simplify(Index), Count
panel_6 = Panel(replace)
panel_7 = Panel(series_2)
panel_8 = Panel(mindex.Index)

line = Line([Line((-28.43570879, -32.87535514, 0), (26.13975502, -11.96140003, 0)), Line((18.7700756, 6.164027732, 0), (13.19302091, -43.43192296, 0)), Line((-30.62669456, -19.7294405, 0), (35.30205917, -38.25322931, 0)), Line((2.835633616, -1.404832213, 0), (-1.54633793, -45.62290873, 0))])  # disabled
panel_9 = Panel("1")  # disabled
linelist = Curve(line)  # disabled
lng = ListLength(List=linelist)  # disabled
subtraction = Subtraction(A=lng, B=panel_9)  # disabled
series_3 = Series(Start=0, Step=1, Count=subtraction)  # disabled
addition = Addition(A=series_3, B=panel_9)  # disabled
item = ListItem(List=linelist, Index=series_3, Wrap=False)  # -> simplify(graft(Item)); disabled
shift = ShiftList(List=linelist, Shift=addition, Wrap=False)  # -> simplify(List); disabled
end = EndPoints(Curve=item)  # -> Start, End; disabled
end_2 = EndPoints(Curve=shift)  # -> Start, End; disabled

line_length = Panel("""3.2
5.1
6.3
4.2""")
panel_10 = Panel("""0
1
2
3""")
# Point:indicate a position in space
# Line:length,direction,position
# Point
# two ends of the line
# the intersection of two lines
# the meeting of lines at the corner of a space or volumn
# the center of field
md_slider = MDSlider(
    slider_value=Point(0.5132578379, 0.5396976122, 0.5),
    SliderMode=0,
    x_domain=Domain(-100, 100),
    y_domain=Domain(-100, 100),
    z_domain=Domain(0, 1))  # disabled
startpoint = Point(md_slider)  # disabled
line_length_2 = Number(line_length)
int = Integer(panel_10)
number_slider = Slider(0.52, range=0..100)  # disabled
number_slider_2 = Slider(2.4, range=0..100)  # disabled
number_slider_3 = Slider(7.61, range=0..100)  # disabled
number_slider_4 = Slider(6.19, range=0..100)  # disabled
item_2 = ListItem(List=["1,0", "0,1", "-1,0", "0,-1"], Index=int, Wrap=True)
item_3 = ListItem(List=line_length_2, Index=0, Wrap=True)
X = UnitX(Factor=1)
basicvector = Vector(item_2)
merge = Merge(Data1=number_slider, Data2=number_slider_2)  # disabled
merge_2 = Merge(Data1=number_slider_3, Data2=number_slider_4)  # disabled
amp = Amplitude(Vector=X, Amplitude=item_3)  # disabled
line_2 = LineSDL(Start=startpoint, Direction=X, Length=item_3)  # disabled
complex = ComplexComponents(Complex=startpoint)  # -> Real, Imaginary; disabled
pt = PointOriented(BasePlane=startpoint, UComponent=merge, VComponent=merge_2, WComponent=0)  # disabled
complex_2 = ComplexComponents(Complex=amp)  # -> Real, Imaginary; disabled
complex_3 = CreateComplex(Real=complex.Real, Imaginary=complex.Imaginary)  # disabled
complex_4 = CreateComplex(Real=complex_2.Real, Imaginary=complex_2.Imaginary)  # disabled
item_4 = ListItem(List=pt, Index=0, Wrap=True)  # -> Item, Item1; disabled
X_2 = UnitX(Factor=1)  # disabled
Y = UnitY(Factor=1)  # disabled
addition_2 = Addition(A=complex_3, B=complex_4)  # disabled
line_3 = LineSDL(Start=item_4.Item1, Direction=Y, Length=item_3)  # disabled
line_4 = LineSDL(Start=item_4.Item, Direction=X_2, Length=item_3)  # disabled
panel_11 = Panel(addition_2)  # disabled
panel_12 = Panel("""1,2
2,1""")  # disabled
panel_13 = Panel("""2.0,2.0,0.0
-0.5,4.0,0.0""")  # disabled
panel_14 = Panel(complex_3)  # disabled
startpoint_2 = Point(panel_12)  # disabled
vec = Vector(panel_13)  # disabled
addition_3 = Addition(A=startpoint_2, B=vec)  # disabled
vec2pt = Vector2Pt(PointA=startpoint_2, PointB=addition_3, Unitize=False)  # -> Vector, Length; disabled
ln = Line(StartPoint=startpoint_2, EndPoint=addition_3)  # disabled
endpoint = Point(addition_3)  # disabled

line_length_3 = Panel("""3.2
5.1
3.2
5.1
6.4
10.2""")
panel_15 = Panel("""0
1
0
1
2
3""")
line_5 = Line([Line((-10.29725997, 2.159053388, 0), (-11.99011357, -47.17553699, 0)), Line((-27.95130457, -8.723576843, 0), (26.94551904, -6.547050797, 0)), Line((21.62512204, 3.368234525, 0), (19.44859599, -45.72451963, 0)), Line((-26.50028721, -30.24700108, 0), (26.46184658, -43.06432113, 0))])

Y_2 = UnitY(Factor=1)
X_3 = UnitX(Factor=1)
rev = Reverse(Vector=Y_2)
vlen = VectorLength(Vector=rev)
vlen_2 = VectorLength(Vector=X_3)
multiplication = Multiplication(A=X_3, B=rev)
multiplication_2 = Multiplication(A=vlen_2, B=vlen)
division = Division(A=multiplication, B=multiplication_2)
acos = ArcCosine(Value=division)

# ----
# explore a point position in space
linelist_2 = Curve(line_5)
lng_2 = ListLength(List=linelist_2)
subtraction_2 = Subtraction(A=lng_2, B="1")
panel_16 = Panel("""0
1
2
3""")
line_length_4 = Panel("""3.2
5.1
3.2
5.1""")
series_4 = Series(Start=0, Step=1, Count=subtraction_2)
addition_4 = Addition(A=series_4, B="1")
item_5 = ListItem(List=linelist_2, Index=series_4, Wrap=False)  # -> simplify(graft(Item))
end_3 = EndPoints(Curve=linelist)  # -> Start, End; disabled
shift_2 = ShiftList(List=linelist_2, Shift=addition_4, Wrap=False)  # -> simplify(List)
panel_17 = Panel("""用字符串的方法表示还差最后一步，那么先拆开来用判断的方法做
拆开的方法很繁琐，索性还是用字符串替换的方法
检查目前的替换方法是否可以简化
并且找出到各个边的距离最近点""")
md_slider_2 = MDSlider(
    slider_value=Point(0.4899997711, 0.4549980164, 0.5),
    SliderMode=0,
    x_domain=Domain(0, 1),
    y_domain=Domain(0, 1),
    z_domain=Domain(0, 1))
subtraction_3 = Subtraction(A=end_3.End, B=end_3.Start)  # disabled
line_length_5 = Number(line_length_3)
panel_18 = Panel("""1,0
0,1
-1,0
0,-1""")
startpoint_3 = Point(end_3.Start)  # disabled
end_4 = EndPoints(Curve=item_5)  # -> Start, End
end_5 = EndPoints(Curve=shift_2)  # -> Start, End
vec_2 = Vector(subtraction_3)  # disabled
vec_3 = Vector(panel_18)
int_2 = Integer(panel_15)
lng_3 = ListLength(List=int_2)
addition_5 = Addition(A=startpoint_3, B=vec_2)  # disabled
endpoint_2 = Point(addition_5)  # disabled
lng_4 = ListLength(List=addition_5)  # disabled
end_6 = EndPoints(Curve=linelist_2)  # -> Start, End
lng_5 = ListLength(List=startpoint_3)  # disabled
series_5 = Series(Start=0, Step=1, Count=lng_3)
panel_19 = Panel("1")  # disabled
panel_20 = Panel(startpoint_3)  # disabled
panel_21 = Panel("1")  # disabled
item_6 = ListItem(List=vec_3, Index=int_2, Wrap=True)
subtraction_4 = Subtraction(A=lng_4, B=panel_19)  # disabled
subtraction_5 = Subtraction(A=lng_5, B=panel_21)  # disabled
subtraction_6 = Subtraction(A=end_6.End, B=end_6.Start)
item_7 = ListItem(List=line_length_5, Index=series_5, Wrap=True)
startpoint_4 = Point(end_6.Start)
vec_4 = Vector(subtraction_6)
basicvectorunit = Vector(item_6)
series_6 = Series(Start=0, Step=1, Count=subtraction_5)  # disabled
series_7 = Series(Start=0, Step=1, Count=subtraction_4)  # disabled
amp_2 = Amplitude(Vector=basicvectorunit, Amplitude=item_7)
addition_6 = Addition(A=series_7, B=panel_19)  # disabled
addition_7 = Addition(A=startpoint_4, B=vec_4)
endpoint_3 = Point(addition_7)
addition_8 = Addition(A=series_6, B=panel_21)  # disabled
lng_6 = ListLength(List=addition_7)
lng_7 = ListLength(List=startpoint_4)
panel_22 = Panel(startpoint_4)
number_slider_5 = Slider(6, range=0..100)  # disabled
item_8 = ListItem(List=startpoint_3, Index=series_6, Wrap=False)  # -> simplify(graft(Item)); disabled
item_9 = ListItem(List=addition_5, Index=series_7, Wrap=False)  # -> simplify(graft(Item)); disabled
shift_3 = ShiftList(List=addition_5, Shift=addition_6, Wrap=False)  # -> simplify(List); disabled
shift_4 = ShiftList(List=startpoint_3, Shift=addition_8, Wrap=False)  # -> simplify(List); disabled
subtraction_7 = Subtraction(A=lng_6, B="1")
subtraction_8 = Subtraction(A=lng_7, B="1")
ma = MassAddition(Input=amp_2)  # -> Result, PartialResults
addition_9 = Addition(A=md_slider_2, B=ma.PartialResults)
pt_2 = Point(ma.PartialResults)
panel_23 = Panel(item_6)
series_8 = Series(Start=0, Step=1, Count=subtraction_8)
series_9 = Series(Start=0, Step=1, Count=subtraction_7)
shift_5 = ShiftList(List=ma.PartialResults, Shift=-1, Wrap=True)
complex_5 = ComplexComponents(Complex=shift_5)  # -> Real, Imaginary
firstpt0 = Point(item_8)  # disabled
firstpt1 = Point(shift_4)  # disabled
endpt0 = Point(item_9)  # disabled
endpt1 = Point(shift_3)  # disabled
addition_10 = Addition(A=series_9, B="1")
addition_11 = Addition(A=series_8, B="1")
points = PointList(Points=flatten(firstpt0), Size=number_slider_5)  # disabled
item_10 = ListItem(List=startpoint_4, Index=series_8, Wrap=False)  # -> simplify(graft(Item))
# describe space by (point;index) of vector
concat = Concatenate(FragmentA=complex_5.Real, FragmentB=complex_5.Imaginary, JoinSeparator=",")
item_11 = ListItem(List=amp_2, Index=graft(series_5), Wrap=True)
item_12 = ListItem(List=addition_7, Index=series_9, Wrap=False)  # -> simplify(graft(Item))
shift_6 = ShiftList(List=addition_7, Shift=addition_10, Wrap=False)  # -> simplify(List)
shift_7 = ShiftList(List=startpoint_4, Shift=addition_11, Wrap=False)  # -> simplify(List)
complex_6 = ComplexComponents(Complex=endpt1)  # -> Real, Imaginary; disabled
complex_7 = ComplexComponents(Complex=firstpt1)  # -> Real, Imaginary; disabled
complex_8 = ComplexComponents(Complex=firstpt0)  # -> Real, Imaginary; disabled
complex_9 = ComplexComponents(Complex=endpt0)  # -> Real, Imaginary; disabled
pline = PolyLine(Vertices=pt_2, Closed=True)
concat_2 = Concatenate(FragmentA=concat, FragmentB=int_2, JoinSeparator=";")
item_13 = ListItem(List=concat_2, Index=series_5, Wrap=True)
split = TextSplit(Text=item_13, Separators=";")  # -> simplify(Result)
item_14 = ListItem(List=split, Index=0, Wrap=True)  # -> Item, Item1
pt_3 = Point(item_14.Item)
subtraction_9 = Subtraction(A=complex_8.Real, B=complex_9.Real)  # disabled
subtraction_10 = Subtraction(A=complex_8.Imaginary, B=complex_9.Imaginary)  # disabled
subtraction_11 = Subtraction(A=complex_7.Real, B=complex_6.Real)  # disabled
firstpt0_2 = Point(item_10)
firstpt1_2 = Point(shift_7)
endpt0_2 = Point(item_12)
endpt1_2 = Point(shift_6)
subtraction_12 = Subtraction(A=complex_7.Imaginary, B=complex_6.Imaginary)  # disabled
points_2 = PointList(Points=flatten(firstpt0_2), Size=Slider(6, range=0..100))
addition_12 = Addition(A=pt_3, B=item_11)
division_2 = Division(A=subtraction_10, B=subtraction_9)  # disabled
division_3 = Division(A=subtraction_12, B=subtraction_11)  # disabled
firstpt0_3 = Point(item_14.Item)
endpt0_3 = Point(addition_12)
complex_10 = ComplexComponents(Complex=endpt1_2)  # -> Real, Imaginary
complex_11 = ComplexComponents(Complex=firstpt1_2)  # -> Real, Imaginary
complex_12 = ComplexComponents(Complex=firstpt0_2)  # -> Real, Imaginary
complex_13 = ComplexComponents(Complex=endpt0_2)  # -> Real, Imaginary
panel_24 = Panel(concat_2)
k2 = Number(division_3)  # disabled
multiplication_3 = Multiplication(A=k2, B=complex_6.Real)  # disabled
k1 = Number(division_2)  # disabled
multiplication_4 = Multiplication(A=k1, B=complex_9.Real)  # disabled
panel_25 = Panel(firstpt0_2)
complex_14 = ComplexComponents(Complex=endpt0_3)  # -> Real, Imaginary
complex_15 = ComplexComponents(Complex=firstpt0_3)  # -> Real, Imaginary
subtraction_13 = Subtraction(A=complex_12.Real, B=complex_13.Real)
subtraction_14 = Subtraction(A=complex_12.Imaginary, B=complex_13.Imaginary)
subtraction_15 = Subtraction(A=complex_11.Real, B=complex_10.Real)
subtraction_16 = Subtraction(A=complex_11.Imaginary, B=complex_10.Imaginary)
subtraction_17 = Subtraction(A=complex_9.Imaginary, B=multiplication_4)  # disabled
subtraction_18 = Subtraction(A=complex_6.Imaginary, B=multiplication_3)  # disabled
pt_4 = Point(Point(1.488717773, 12.13872048, 0))
division_4 = Division(A=subtraction_14, B=subtraction_13)
division_5 = Division(A=subtraction_16, B=subtraction_15)
subtraction_19 = Subtraction(A=k1, B=k2)  # disabled
b1 = Number(subtraction_17)  # disabled
subtraction_20 = Subtraction(A=complex_15.Imaginary, B=complex_14.Imaginary)
subtraction_21 = Subtraction(A=complex_15.Real, B=complex_14.Real)
b2 = Number(subtraction_18)  # disabled
complex_16 = ComplexComponents(Complex=pt_4)  # -> Real, Imaginary

y = Number(complex_16.Imaginary)
x = Number(complex_16.Real)
larger = LargerThan(FirstNumber=complex_15.Real, SecondNumber=x)  # -> LargerThan, OrEqualTo
larger_2 = LargerThan(FirstNumber=complex_15.Imaginary, SecondNumber=y)  # -> LargerThan, OrEqualTo
int_3 = Integer(larger.LargerThan)
int_4 = Integer(larger_2.LargerThan)
concat_3 = Concatenate(FragmentA=int_3, FragmentB=int_4)

# ---- group: vector match concept Error
panel_26 = Panel("""010
012
110
112""")
panel_27 = Panel("""101
103
111
113""")
panel_28 = Panel("""001
003
011
013""")
panel_29 = Panel("""000
002
100
102""")
merge_3 = Merge(Data1=panel_27, Data2=panel_26, Data3=panel_28, Data4=panel_29)
entwine = Entwine(Branch00=panel_27, Branch01=panel_26, Branch02=panel_28, Branch03=panel_29, FlattenInputs=True)  # -> simplify(Result)
concat_4 = Concatenate(FragmentA=concat_3, FragmentB=item_14.Item1)
flatten = FlattenTree(Tree=concat_4, Path="{0}")
mindex_2 = MemberIndex(Set=merge_3, Member=flatten)  # -> Index, Count
division_6 = Division(A=mindex_2.Index, B="4")
int_5 = Integer(division_6)
item_15 = ListItem(List=vec_3, Index=int_5, Wrap=True)

mindex_3 = MemberIndex(Set=entwine, Member=flatten)  # -> Index, Count
clean = CleanTree(RemoveNulls=True, RemoveInvalid=True, RemoveEmpty=True, Tree=mindex_3.Index)
tstat = TreeStatistics(Tree=clean)  # -> Paths, Length, Count
split_2 = TextSplit(Text=tstat.Paths, Separators=";")
item_16 = ListItem(List=split_2, Index="0", Wrap=True)
split_3 = TextSplit(Text=item_16, Separators="{")
item_17 = ListItem(List=split_3, Index="1", Wrap=True)  # -> simplify(Item)

equals = Equality(FirstNumber=graft(flatten), SecondNumber=merge_3)  # -> Equality, Inequality
mindex_4 = MemberIndex(Set=equals.Equality, Member=Toggle(True))  # -> Index, Count

# ----
subtraction_22 = Subtraction(A=b2, B=b1)  # disabled
k2_2 = Number(division_5)
multiplication_5 = Multiplication(A=k2_2, B=complex_10.Real)
k1_2 = Number(division_4)
multiplication_6 = Multiplication(A=k1_2, B=complex_13.Real)
division_7 = Division(A=subtraction_22, B=subtraction_19)  # disabled

# ----
# 0 --> extend one line to intersect two lines
# 1 --> extend two lines
# 2 --> extend three lines
dom = ConstructDomain(DomainStart=complex_7.Real, DomainEnd=complex_6.Real)  # disabled
dom_2 = ConstructDomain(DomainStart=complex_8.Real, DomainEnd=complex_9.Real)  # disabled
inc = Includes(Value=division_7, Domain=dom_2)  # -> Includes, Deviation; disabled
inc_2 = Includes(Value=division_7, Domain=dom)  # -> Includes, Deviation; disabled
int_6 = Integer(inc.Includes)  # disabled
int_7 = Integer(inc_2.Includes)  # disabled
addition_13 = Addition(A=int_6, B=int_7)  # disabled
panel_30 = Panel("2")  # disabled
subtraction_23 = Subtraction(A=panel_30, B=addition_13)  # disabled
extendlinecount = Integer(subtraction_23)  # disabled

division_8 = Division(A=subtraction_20, B=subtraction_21)
subtraction_24 = Subtraction(A=complex_13.Imaginary, B=multiplication_6)
subtraction_25 = Subtraction(A=complex_10.Imaginary, B=multiplication_5)
multiplication_7 = Multiplication(A=division_7, B=k2)  # disabled
k1_3 = Number(division_8)
multiplication_8 = Multiplication(A=k1_3, B=complex_14.Real)
subtraction_26 = Subtraction(A=k1_2, B=k2_2)
b1_2 = Number(subtraction_24)
addition_14 = Addition(A=multiplication_7, B=b2)  # disabled
b2_2 = Number(subtraction_25)
dom_3 = ConstructDomain(DomainStart=complex_11.Real, DomainEnd=complex_10.Real)
dom_4 = ConstructDomain(DomainStart=complex_12.Real, DomainEnd=complex_13.Real)
subtraction_27 = Subtraction(A=complex_14.Imaginary, B=multiplication_8)
subtraction_28 = Subtraction(A=b2_2, B=b1_2)
division_9 = Division(A=subtraction_28, B=subtraction_26)
sift = SiftPattern(List=addition_14, SiftPattern=extendlinecount)  # -> Output0, Output1, Output2; disabled
sift_2 = SiftPattern(List=division_7, SiftPattern=extendlinecount)  # -> Output0, Output1, Output2; disabled
xy = XYPlane(Origin=Point(0, 0, 0))  # disabled
inc_3 = Includes(Value=division_9, Domain=dom_4)  # -> Includes, Deviation
inc_4 = Includes(Value=division_9, Domain=dom_3)  # -> Includes, Deviation
b1_3 = Number(subtraction_27)

# ----
# distances between points and space boundary
null = NullItem(Item=k1_3)  # -> NullFlags, InvalidFlags, Description
sift_3 = SiftPattern(List=pt_3, SiftPattern=null.NullFlags)  # -> Output0, Output1
complex_17 = ComplexComponents(Complex=sift_3.Output1)  # -> Real, Imaginary
eval = Evaluate(F="abs(k*x0-y0+b)/sqrt(k*k+1)", k=k1_3, b=b1_3, x0=complex_16.Real, y0=complex_16.Imaginary)
subtraction_29 = Subtraction(A=complex_16.Real, B=complex_17.Real)  # -> simplify(Result)
distance = Number(eval)
abs = Absolute(Value=subtraction_29)  # -> simplify(Result)
combine = CombineData(Input0=distance, Input1=abs)  # -> Result, Index

# ---- group: vector match method 1
concat_5 = Concatenate(FragmentA=concat_3, FragmentB=item_14.Item1)
flatten_2 = FlattenTree(Tree=concat_5, Path="{0}")
panel_31 = Panel("""000
002
100
102""")
panel_32 = Panel("""010
012
110
112""")
panel_33 = Panel("""101
103
111
113""")
panel_34 = Panel("""001
003
011
013""")
mindex_5 = MemberIndex(Set=panel_34, Member=flatten_2)  # -> Index, Count
mindex_6 = MemberIndex(Set=panel_31, Member=flatten_2)  # -> Index, Count
mindex_7 = MemberIndex(Set=panel_33, Member=flatten_2)  # -> Index, Count
mindex_8 = MemberIndex(Set=panel_32, Member=flatten_2)  # -> Index, Count
clean_2 = CleanTree(RemoveNulls=True, RemoveInvalid=True, RemoveEmpty=True, Tree=mindex_8.Index)
clean_3 = CleanTree(RemoveNulls=True, RemoveInvalid=True, RemoveEmpty=True, Tree=mindex_6.Index)
clean_4 = CleanTree(RemoveNulls=True, RemoveInvalid=True, RemoveEmpty=True, Tree=mindex_7.Index)
clean_5 = CleanTree(RemoveNulls=True, RemoveInvalid=True, RemoveEmpty=True, Tree=mindex_5.Index)
replace_2 = ReplaceItems(List=clean_4, Item="0", Indices="0", Wrap=False)
replace_3 = ReplaceItems(List=clean_2, Item="1", Indices="0", Wrap=False)
replace_4 = ReplaceItems(List=clean_5, Item="2", Indices="0", Wrap=False)
replace_5 = ReplaceItems(List=clean_3, Item="3", Indices="0", Wrap=False)
merge_4 = Merge(Data1=replace_2, Data2=replace_3, Data3=replace_4, Data4=replace_5)
item_18 = ListItem(List=vec_3, Index=merge_4, Wrap=True)
amp_3 = Amplitude(Vector=item_18, Amplitude=combine.Result)
vdis = VectorDisplay(Anchor=pt_4, Vector=amp_3)

# ---- group: vector match method 0 Error
# left-down;x-axis
# left-up;y-axis
a = Number(complex_15.Real)
b = Number(complex_15.Imaginary)
y_2 = Number(complex_16.Imaginary)
x_2 = Number(complex_16.Real)
item_19 = ListItem(List=vec_3, Index=item_14.Item1, Wrap=True)
smaller = SmallerThan(FirstNumber=b, SecondNumber=y_2)  # -> SmallerThan, OrEqualTo
not = GateNot(A=smaller.SmallerThan)
smaller_2 = SmallerThan(FirstNumber=a, SecondNumber=x_2)  # -> SmallerThan, OrEqualTo
and = GateAnd(A=smaller_2.SmallerThan, B=not)
equals_2 = Equality(FirstNumber="0", SecondNumber=graft(int_2))  # -> Equality, Inequality
equals_3 = Equality(FirstNumber="2", SecondNumber=graft(int_2))  # -> Equality, Inequality
and_2 = GateAnd(A=smaller_2.SmallerThan, B=smaller.SmallerThan)
equals_4 = Equality(FirstNumber="1", SecondNumber=graft(int_2))  # -> Equality, Inequality
equals_5 = Equality(FirstNumber="3", SecondNumber=graft(int_2))  # -> Equality, Inequality
or = GateOr(A=equals_2.Equality, B=equals_3.Equality)
or_2 = GateOr(A=equals_4.Equality, B=equals_5.Equality)
and_3 = GateAnd(A=or_2, B=and_2)
and_4 = GateAnd(A=or, B=and)
or_3 = GateOr(A=and_3, B=and_4)
sift_4 = SiftPattern(List=item_19, SiftPattern=or_3)  # -> Output0, Output1
pi = Pi(Factor="0.5")
Z = UnitZ(Factor=1)
neg = Negative(Value=pi)
vrot = Rotate(Vector=sift_4.Output0, Axis=Z, Angle=neg)
vrot_2 = Rotate(Vector=sift_4.Output1, Axis=Z, Angle=pi)
combine_2 = CombineData(Input0=vrot, Input1=vrot_2)  # -> Result, Index
amp_4 = Amplitude(Vector=combine_2.Result, Amplitude=combine.Result)
vdis_2 = VectorDisplay(Anchor=pt_4, Vector=amp_4)

# ----
# vectors between points and space boundary
panel_35 = Panel("0.5")  # disabled
item_20 = ListItem(List=vec_3, Index=item_14.Item1, Wrap=True)  # disabled
pi_2 = Pi(Factor=panel_35)  # disabled
neg_2 = Negative(Value=pi_2)  # disabled
Z_2 = UnitZ(Factor=1)  # disabled
vrot_3 = Rotate(Vector=item_20, Axis=Z_2, Angle=neg_2)  # disabled
amp_5 = Amplitude(Vector=vrot_3, Amplitude=combine.Result)  # disabled

multiplication_9 = Multiplication(A=division_9, B=k2_2)
int_8 = Integer(inc_3.Includes)
addition_15 = Addition(A=multiplication_9, B=b2_2)
int_9 = Integer(inc_4.Includes)
pt_5 = PointOriented(BasePlane=xy, UComponent=sift_2.Output0, VComponent=sift.Output0, WComponent=0)  # disabled
panel_36 = Panel("abs(k*x0-y0+b)/sqrt(k*k+1)")
panel_37 = Panel("(k*x0-y0+b)/sqrt(k*k+1)")
panel_38 = Panel("-(k*x0-y0+b)/sqrt(k*k+1)")
flatten_3 = FlattenTree(Tree=pt_5, Path="{0}")  # disabled
addition_16 = Addition(A=int_8, B=int_9)
xy_2 = XYPlane(Origin=Point(0, 0, 0))
clean_6 = CleanTree(RemoveNulls=True, RemoveInvalid=True, RemoveEmpty=False, Tree=flatten_3)  # disabled
# 0 --> extend one line to intersect two lines
# 1 --> extend two lines
# 2 --> extend three lines
subtraction_30 = Subtraction(A="2", B=addition_16)
extendlinecount_2 = Integer(subtraction_30)
sift_5 = SiftPattern(List=addition_15, SiftPattern=extendlinecount_2)  # -> Output0, Output1, Output2
sift_6 = SiftPattern(List=division_9, SiftPattern=extendlinecount_2)  # -> Output0, Output1, Output2
intersection_x = Number(division_7)  # disabled
intersection_y = Number(addition_14)  # disabled
pt_6 = PointOriented(BasePlane=xy_2, UComponent=sift_6.Output0, VComponent=sift_5.Output0, WComponent=0)
xy_3 = XYPlane(Origin=Point(0, 0, 0))  # disabled
flatten_4 = FlattenTree(Tree=pt_6, Path="{0}")
pt_7 = PointOriented(BasePlane=xy_3, UComponent=intersection_x, VComponent=intersection_y, WComponent=0)  # disabled
panel_39 = Panel(extendlinecount)  # disabled
clean_7 = CleanTree(RemoveNulls=True, RemoveInvalid=True, RemoveEmpty=False, Tree=flatten_4)
pt_8 = Point(Point(-2.015690168, -16.36521091, 0))
panel_40 = Panel(eval)
intersection_x_2 = Number(division_9)
intersection_y_2 = Number(addition_15)
sift_7 = SiftPattern(List=pt_7, SiftPattern=extendlinecount)  # -> Output0, Output1, Output2; disabled
xy_4 = XYPlane(Origin=Point(0, 0, 0))
partition_2 = PartitionList(List=clean_7, Size="2")
bang = ExplodeTree(Data=partition_2)  # -> Branch0, Branch1
rev_2 = ReverseList(List=bang.Branch1)
intersectionontwolines = Point(sift_7.Output0)  # disabled
intersectionononeline = Point(sift_7.Output1)  # disabled
intersectiononextend = Point(sift_7.Output2)  # disabled
pt_9 = PointOriented(BasePlane=xy_4, UComponent=intersection_x_2, VComponent=intersection_y_2, WComponent=0)
panel_41 = Panel(combine.Result)
panel_42 = Panel(extendlinecount_2)
merge_5 = Merge(Data1=bang.Branch0, Data2=rev_2)  # -> flatten(Result)
sift_8 = SiftPattern(List=pt_9, SiftPattern=extendlinecount_2)  # -> Output0, Output1, Output2
pline_2 = PolyLine(Vertices=merge_5, Closed=True)
intersectionontwolines_2 = Point(sift_8.Output0)
intersectionononeline_2 = Point(sift_8.Output1)
intersectiononextend_2 = Point(sift_8.Output2)
panel_43 = Panel(merge_5)

line_6 = Line(Line((0.5128004552, -4.732454223, 0), (1.991620914, 0.1073218237, 0)))  # disabled
line_7 = Line(Line((-2.265589497, -0.1167418821, 0), (5.711078431, -2.357378941, 0)))  # disabled
end_7 = EndPoints(Curve=line_7)  # -> Start, End; disabled
complex_18 = ComplexComponents(Complex=end_7.End)  # -> Real, Imaginary; disabled
complex_19 = ComplexComponents(Complex=end_7.Start)  # -> Real, Imaginary; disabled
end_8 = EndPoints(Curve=line_6)  # -> Start, End; disabled
complex_20 = ComplexComponents(Complex=end_8.End)  # -> Real, Imaginary; disabled
complex_21 = ComplexComponents(Complex=end_8.Start)  # -> Real, Imaginary; disabled
panel_44 = Panel("1")  # disabled
panel_45 = Panel("0")  # disabled
panel_46 = Panel("2")  # disabled
x1 = Number(complex_19.Real)  # disabled
y1 = Number(complex_19.Imaginary)  # disabled
x2 = Number(complex_18.Real)  # disabled
y2 = Number(complex_18.Imaginary)  # disabled
panel_48 = Panel("0")  # disabled
panel_49 = Panel("0")  # disabled
panel_50 = Panel("2")  # disabled
panel_51 = Panel("2")  # disabled
panel_52 = Panel("-c/(x1*(y1-y2)/(x1-x2)+y1)")  # disabled
panel_53 = Panel("-c/(x1*(y1-y2)/(x1-x2)+y1)")  # disabled
x1_2 = Number(panel_49)  # disabled
y1_2 = Number(panel_48)  # disabled
x2_2 = Number(panel_51)  # disabled
y2_2 = Number(panel_50)  # disabled
panel_54 = Panel("1")  # disabled
subtraction_31 = Subtraction(A=x1, B=x2)  # disabled
neg_3 = Negative(Value=x1)  # disabled
panel_55 = Panel("1")  # disabled
panel_56 = Panel("0")  # disabled
panel_57 = Panel("0")  # disabled
panel_58 = Panel("-b*(y1-y2)/(x1-x2)")  # disabled
c = Number(panel_54)  # disabled
panel_59 = Panel("-b*(y1-y2)/(x1-x2)")  # disabled
panel_60 = Panel("1")  # disabled
equals_6 = Equality(FirstNumber=subtraction_31, SecondNumber=panel_56)  # -> Equality, Inequality; disabled
a_2 = Number(panel_55)  # disabled
b_2 = Number(panel_57)  # disabled
c_2 = Number(neg_3)  # disabled
neg_4 = Negative(Value=x1_2)  # disabled
subtraction_32 = Subtraction(A=x1_2, B=x2_2)  # disabled
eval_2 = Evaluate(F=panel_52, c=c, x1=x1, x2=x2, y1=y1, y2=y2)  # disabled
panel_61 = Panel("1")  # disabled
panel_62 = Panel("0")  # disabled
panel_63 = Panel("0")  # disabled
c_3 = Number(panel_60)  # disabled
b_3 = Number(eval_2)  # disabled
equals_7 = Equality(FirstNumber=subtraction_32, SecondNumber=panel_62)  # -> Equality, Inequality; disabled
a_3 = Number(panel_61)  # disabled
b_4 = Number(panel_63)  # disabled
c_4 = Number(neg_4)  # disabled
eval_3 = Evaluate(F=panel_53, c=c_3, x1=x1_2, x2=x2_2, y1=y1_2, y2=y2_2)  # disabled
merge_6 = Merge(Data1=a_2, Data2=b_2, Data3=c_2)  # disabled
eval_4 = Evaluate(F=panel_58, b=b_3, x1=x1, x2=x2, y1=y1, y2=y2)  # disabled
b_5 = Number(eval_3)  # disabled
merge_7 = Merge(Data1=a_3, Data2=b_4, Data3=c_4)  # disabled
a_4 = Number(eval_4)  # disabled
eval_5 = Evaluate(F=panel_59, b=b_5, x1=x1_2, x2=x2_2, y1=y1_2, y2=y2_2)  # disabled
merge_8 = Merge(Data1=a_4, Data2=b_3, Data3=c)  # disabled
a_5 = Number(eval_5)  # disabled
panel_64 = Panel("1")  # disabled
panel_65 = Panel("0")  # disabled
panel_66 = Panel("-1")  # disabled
panel_67 = Panel("1")  # disabled
panel_68 = Panel("-2")  # disabled
panel_69 = Panel("2")  # disabled
merge_9 = Merge(Data1=a_5, Data2=b_5, Data3=c_3)  # disabled
filter = StreamFilter(Gate=equals_6.Equality, Stream0=merge_8, Stream1=merge_6)  # disabled
filter_2 = StreamFilter(Gate=equals_7.Equality, Stream0=merge_9, Stream1=merge_7)  # disabled
item_21 = ListItem(List=filter, Index=0, Wrap=True)  # -> Item, Item1, Item2; disabled
item_22 = ListItem(List=filter_2, Index=0, Wrap=True)  # -> Item, Item1, Item2; disabled
panel_70 = Panel(filter)  # disabled
panel_71 = Panel(filter_2)  # disabled
a1 = Number(panel_64)  # disabled
b1_4 = Number(panel_66)  # disabled
c1 = Number(panel_65)  # disabled
a2 = Number(panel_67)  # disabled
b2_3 = Number(panel_68)  # disabled
c2 = Number(panel_69)  # disabled

panel_72 = Panel("""(b1*c2-b2*c1)/(a1*b2-a2*b1)
(a2*c1-a1*c2)/(a1*b2-a2*b1)""")  # disabled
eval_6 = Evaluate(F=panel_72, a1=a1, b1=b1_4, c1=c1, a2=a2, b2=b2_3, c2=c2)  # disabled

item_23 = ListItem(List=eval_6, Index=0, Wrap=True)  # -> Item, Item1; disabled
panel_73 = Panel(eval_6)  # disabled
complex_22 = CreateComplex(Real=item_23.Item, Imaginary=item_23.Item1)  # disabled
pt_10 = Point(complex_22)  # disabled

# ---- group: vector match method 1 simplify
# 问题在于，当某一path缺少时，替换的内容仍然会配对，造成数据多余错误
# 要探测出缺少的路径
# statistics-->DePath
# 最后拍平后替换路径
entwine_2 = Entwine(Branch00=panel_27, Branch01=panel_26, Branch02=panel_28, Branch03=panel_29, FlattenInputs=True)  # -> simplify(Result)
flatten_5 = FlattenTree(Tree=concat_5, Path="{0}")
mindex_9 = MemberIndex(Set=entwine_2, Member=flatten_5)  # -> Index, Count
clean_8 = CleanTree(RemoveNulls=True, RemoveInvalid=True, RemoveEmpty=True, Tree=mindex_9.Index)
pshift = ShiftPaths(Data=clean_8, Offset=-1)
viewer = ParamViewer(clean_8)

tstat_2 = TreeStatistics(Tree=pshift)  # -> Paths, Length, Count
dpath = DeconstructPath(Branch=tstat_2.Paths)  # -> simplify(Indices)

graft = GraftTree(Tree=tstat_2.Length, IncludeEmptyLists=True, IncludeNullItems=True)
series_10 = Series(Start=0, Step=1, Count=graft)
int_10 = Integer(simplify(series_10))
replace_6 = ReplaceItems(List=pshift, Item=dpath, Indices=int_10, Wrap=False)
graft_2 = GraftTree(Tree=flatten(replace_6), IncludeEmptyLists=True, IncludeNullItems=True)
viewer_2 = ParamViewer(graft_2)
replace_7 = ReplacePaths(Data=graft_2, Search=viewer_2, Replace=viewer)
pshift_2 = ShiftPaths(Data=replace_7, Offset="1")
item_24 = ListItem(List=vec_3, Index=pshift_2, Wrap=True)
amp_6 = Amplitude(Vector=item_24, Amplitude=combine.Result)
vdis_3 = VectorDisplay(Anchor=pt_4, Vector=amp_6)
