# Grasshopper definition 160929_PE_points_intersection_004_polyline.gh (Grasshopper 0.9.76)

panel = Panel("""1
3
4
2
6
7""")
panel_2 = Panel("3")
partition = PartitionList(List=panel, Size="3")  # -> simplify(Chunks)
series = Series(Start=0, Step=1, Count=10)
num = Number(partition)
panel_3 = Panel(num)
panel_4 = Panel("""001
002""")
series_2 = Series(Start="2", Step=1, Count="5")
num_2 = Number(["2", "4"])
panel_5 = Panel(series)
replace = ReplaceMembers(Set=graft(series), Find=num, Replace=graft(panel_4))
mindex = MemberIndex(Set=series_2, Member=num_2)  # -> simplify(Index), Count
panel_6 = Panel(replace)
panel_7 = Panel(series_2)
panel_8 = Panel(mindex.Index)

line = Line([Line((-28.43570879, -32.87535514, 0), (26.13975502, -11.96140003, 0)), Line((18.7700756, 6.164027732, 0), (13.19302091, -43.43192296, 0)), Line((-30.62669456, -19.7294405, 0), (35.30205917, -38.25322931, 0)), Line((2.835633616, -1.404832213, 0), (-1.54633793, -45.62290873, 0))])  # disabled
panel_9 = Panel("1")  # disabled
linelist = Curve(line)  # disabled
lng = ListLength(List=linelist)  # disabled
subtraction = Subtraction(A=lng, B=panel_9)  # disabled
series_3 = Series(Start=0, Step=1, Count=subtraction)  # disabled
addition = Addition(A=series_3, B=panel_9)  # disabled
item = ListItem(List=linelist, Index=series_3, Wrap=False)  # -> simplify(graft(Item)); disabled
shift = ShiftList(List=linelist, Shift=addition, Wrap=False)  # -> simplify(List); disabled
end = EndPoints(Curve=item)  # -> Start, End; disabled
end_2 = EndPoints(Curve=shift)  # -> Start, End; disabled

panel_10 = Panel("""0
1
0
1
2
3""")

line_length = Panel("""3.2
5.1
6.3
4.2""")
panel_11 = Panel("""0
1
2
3""")
# Point:indicate a position in space
# Line:length,direction,position
# Point
# two ends of the line
# the intersection of two lines
# the meeting of lines at the corner of a space or volumn
# the center of field
md_slider = MDSlider(
    slider_value=Point(0.5132578379, 0.5396976122, 0.5),
    SliderMode=0,
    x_domain=Domain(-100, 100),
    y_domain=Domain(-100, 100),
    z_domain=Domain(0, 1))  # disabled
startpoint = Point(md_slider)  # disabled
line_length_2 = Number(line_length)
int = Integer(panel_11)
number_slider = Slider(0.52, range=0..100)  # disabled
number_slider_2 = Slider(2.4, range=0..100)  # disabled
number_slider_3 = Slider(7.61, range=0..100)  # disabled
number_slider_4 = Slider(6.19, range=0..100)  # disabled
item_2 = ListItem(List=["1,0", "0,1", "-1,0", "0,-1"], Index=int, Wrap=True)
item_3 = ListItem(List=line_length_2, Index=0, Wrap=True)
X = UnitX(Factor=1)
basicvector = Vector(item_2)
merge = Merge(Data1=number_slider, Data2=number_slider_2)  # disabled
merge_2 = Merge(Data1=number_slider_3, Data2=number_slider_4)  # disabled
amp = Amplitude(Vector=X, Amplitude=item_3)  # disabled
line_2 = LineSDL(Start=startpoint, Direction=X, Length=item_3)  # disabled
complex = ComplexComponents(Complex=startpoint)  # -> Real, Imaginary; disabled
pt = PointOriented(BasePlane=startpoint, UComponent=merge, VComponent=merge_2, WComponent=0)  # disabled
complex_2 = ComplexComponents(Complex=amp)  # -> Real, Imaginary; disabled
complex_3 = CreateComplex(Real=complex.Real, Imaginary=complex.Imaginary)  # disabled
complex_4 = CreateComplex(Real=complex_2.Real, Imaginary=complex_2.Imaginary)  # disabled
item_4 = ListItem(List=pt, Index=0, Wrap=True)  # -> Item, Item1; disabled
X_2 = UnitX(Factor=1)  # disabled
Y = UnitY(Factor=1)  # disabled
addition_2 = Addition(A=complex_3, B=complex_4)  # disabled
line_3 = LineSDL(Start=item_4.Item1, Direction=Y, Length=item_3)  # disabled
line_4 = LineSDL(Start=item_4.Item, Direction=X_2, Length=item_3)  # disabled
panel_12 = Panel(addition_2)  # disabled
panel_13 = Panel("""1,2
2,1""")  # disabled
panel_14 = Panel("""2.0,2.0,0.0
-0.5,4.0,0.0""")  # disabled
panel_15 = Panel(complex_3)  # disabled
startpoint_2 = Point(panel_13)  # disabled
vec = Vector(panel_14)  # disabled
addition_3 = Addition(A=startpoint_2, B=vec)  # disabled
vec2pt = Vector2Pt(PointA=startpoint_2, PointB=addition_3, Unitize=False)  # -> Vector, Length; disabled
ln = Line(StartPoint=startpoint_2, EndPoint=addition_3)  # disabled
endpoint = Point(addition_3)  # disabled

line_length_3 = Panel("""3.2
5.1
3.2
5.1
6.4
10.2""")

Y_2 = UnitY(Factor=1)
X_3 = UnitX(Factor=1)
rev = Reverse(Vector=Y_2)
vlen = VectorLength(Vector=rev)
vlen_2 = VectorLength(Vector=X_3)
multiplication = Multiplication(A=X_3, B=rev)
multiplication_2 = Multiplication(A=vlen_2, B=vlen)
division = Division(A=multiplication, B=multiplication_2)
acos = ArcCosine(Value=division)

panel_16 = Panel("""0
1
2
3""")
line_length_4 = Panel("""3.2
5.1
3.2
5.1""")
md_slider_2 = MDSlider(
    slider_value=Point(0.4899997711, 0.4549980164, 0.5),
    SliderMode=0,
    x_domain=Domain(0, 1),
    y_domain=Domain(0, 1),
    z_domain=Domain(0, 1))
end_3 = EndPoints(Curve=linelist)  # -> Start, End; disabled
panel_17 = Panel("""用字符串的方法表示还差最后一步，那么先拆开来用判断的方法做
拆开的方法很繁琐，索性还是用字符串替换的方法
检查目前的替换方法是否可以简化
并且找出到各个边的距离最近点""")
subtraction_2 = Subtraction(A=end_3.End, B=end_3.Start)  # disabled
line_length_5 = Number(line_length_3)
panel_18 = Panel("""1,0
0,1
-1,0
0,-1""")
startpoint_3 = Point(end_3.Start)  # disabled
vec_2 = Vector(subtraction_2)  # disabled
vec_3 = Vector(panel_18)
int_2 = Integer(panel_10)
lng_2 = ListLength(List=int_2)
addition_4 = Addition(A=startpoint_3, B=vec_2)  # disabled
endpoint_2 = Point(addition_4)  # disabled
lng_3 = ListLength(List=addition_4)  # disabled
lng_4 = ListLength(List=startpoint_3)  # disabled
series_4 = Series(Start=0, Step=1, Count=lng_2)
panel_19 = Panel("1")  # disabled
panel_20 = Panel(startpoint_3)  # disabled
panel_21 = Panel("1")  # disabled
item_5 = ListItem(List=vec_3, Index=int_2, Wrap=True)
panel_22 = Panel(item_5)
subtraction_3 = Subtraction(A=lng_3, B=panel_19)  # disabled
subtraction_4 = Subtraction(A=lng_4, B=panel_21)  # disabled
item_6 = ListItem(List=line_length_5, Index=series_4, Wrap=True)
basicvectorunit = Vector(item_5)
series_5 = Series(Start=0, Step=1, Count=subtraction_4)  # disabled
series_6 = Series(Start=0, Step=1, Count=subtraction_3)  # disabled
amp_2 = Amplitude(Vector=basicvectorunit, Amplitude=item_6)
addition_5 = Addition(A=series_6, B=panel_19)  # disabled
addition_6 = Addition(A=series_5, B=panel_21)  # disabled
number_slider_5 = Slider(6, range=0..100)  # disabled
item_7 = ListItem(List=startpoint_3, Index=series_5, Wrap=False)  # -> simplify(graft(Item)); disabled
item_8 = ListItem(List=addition_4, Index=series_6, Wrap=False)  # -> simplify(graft(Item)); disabled
shift_2 = ShiftList(List=addition_4, Shift=addition_5, Wrap=False)  # -> simplify(List); disabled
shift_3 = ShiftList(List=startpoint_3, Shift=addition_6, Wrap=False)  # -> simplify(List); disabled
ma = MassAddition(Input=amp_2)  # -> Result, PartialResults
addition_7 = Addition(A=md_slider_2, B=ma.PartialResults)
pt_2 = Point(ma.PartialResults)
shift_4 = ShiftList(List=ma.PartialResults, Shift=-1, Wrap=True)
complex_5 = ComplexComponents(Complex=shift_4)  # -> Real, Imaginary
firstpt0 = Point(item_7)  # disabled
firstpt1 = Point(shift_3)  # disabled
endpt0 = Point(item_8)  # disabled
endpt1 = Point(shift_2)  # disabled
points = PointList(Points=flatten(firstpt0), Size=number_slider_5)  # disabled
# describe space by (point;index) of vector
concat = Concatenate(FragmentA=complex_5.Real, FragmentB=complex_5.Imaginary, JoinSeparator=",")
item_9 = ListItem(List=amp_2, Index=graft(series_4), Wrap=True)
complex_6 = ComplexComponents(Complex=endpt1)  # -> Real, Imaginary; disabled
complex_7 = ComplexComponents(Complex=firstpt1)  # -> Real, Imaginary; disabled
complex_8 = ComplexComponents(Complex=firstpt0)  # -> Real, Imaginary; disabled
complex_9 = ComplexComponents(Complex=endpt0)  # -> Real, Imaginary; disabled
pline = PolyLine(Vertices=pt_2, Closed=True)
concat_2 = Concatenate(FragmentA=concat, FragmentB=int_2, JoinSeparator=";")
item_10 = ListItem(List=concat_2, Index=series_4, Wrap=True)
split = TextSplit(Text=item_10, Separators=";")  # -> simplify(Result)
item_11 = ListItem(List=split, Index=0, Wrap=True)  # -> Item, Item1
pt_3 = Point(item_11.Item)
subtraction_5 = Subtraction(A=complex_8.Real, B=complex_9.Real)  # disabled
subtraction_6 = Subtraction(A=complex_8.Imaginary, B=complex_9.Imaginary)  # disabled
subtraction_7 = Subtraction(A=complex_7.Real, B=complex_6.Real)  # disabled
subtraction_8 = Subtraction(A=complex_7.Imaginary, B=complex_6.Imaginary)  # disabled
addition_8 = Addition(A=pt_3, B=item_9)
division_2 = Division(A=subtraction_6, B=subtraction_5)  # disabled
division_3 = Division(A=subtraction_8, B=subtraction_7)  # disabled
firstpt0_2 = Point(item_11.Item)
endpt0_2 = Point(addition_8)
panel_23 = Panel(concat_2)
k2 = Number(division_3)  # disabled
multiplication_3 = Multiplication(A=k2, B=complex_6.Real)  # disabled
k1 = Number(division_2)  # disabled
multiplication_4 = Multiplication(A=k1, B=complex_9.Real)  # disabled
complex_10 = ComplexComponents(Complex=endpt0_2)  # -> Real, Imaginary
complex_11 = ComplexComponents(Complex=firstpt0_2)  # -> Real, Imaginary
subtraction_9 = Subtraction(A=complex_9.Imaginary, B=multiplication_4)  # disabled
subtraction_10 = Subtraction(A=complex_6.Imaginary, B=multiplication_3)  # disabled
pt_4 = Point(Point(1.488717773, 12.13872048, 0))
subtraction_11 = Subtraction(A=k1, B=k2)  # disabled
b1 = Number(subtraction_9)  # disabled
subtraction_12 = Subtraction(A=complex_11.Imaginary, B=complex_10.Imaginary)
subtraction_13 = Subtraction(A=complex_11.Real, B=complex_10.Real)
b2 = Number(subtraction_10)  # disabled
complex_12 = ComplexComponents(Complex=pt_4)  # -> Real, Imaginary

y = Number(complex_12.Imaginary)
x = Number(complex_12.Real)
larger = LargerThan(FirstNumber=complex_11.Real, SecondNumber=x)  # -> LargerThan, OrEqualTo
larger_2 = LargerThan(FirstNumber=complex_11.Imaginary, SecondNumber=y)  # -> LargerThan, OrEqualTo
int_3 = Integer(larger.LargerThan)
int_4 = Integer(larger_2.LargerThan)
concat_3 = Concatenate(FragmentA=int_3, FragmentB=int_4)

# ---- group: vector match concept Error
panel_24 = Panel("""010
012
110
112""")
panel_25 = Panel("""101
103
111
113""")
panel_26 = Panel("""001
003
011
013""")
panel_27 = Panel("""000
002
100
102""")
merge_3 = Merge(Data1=panel_25, Data2=panel_24, Data3=panel_26, Data4=panel_27)
entwine = Entwine(Branch00=panel_25, Branch01=panel_24, Branch02=panel_26, Branch03=panel_27, FlattenInputs=True)  # -> simplify(Result)
concat_4 = Concatenate(FragmentA=concat_3, FragmentB=item_11.Item1)
flatten = FlattenTree(Tree=concat_4, Path="{0}")
mindex_2 = MemberIndex(Set=merge_3, Member=flatten)  # -> Index, Count
division_4 = Division(A=mindex_2.Index, B="4")
int_5 = Integer(division_4)
item_12 = ListItem(List=vec_3, Index=int_5, Wrap=True)

mindex_3 = MemberIndex(Set=entwine, Member=flatten)  # -> Index, Count
clean = CleanTree(RemoveNulls=True, RemoveInvalid=True, RemoveEmpty=True, Tree=mindex_3.Index)
tstat = TreeStatistics(Tree=clean)  # -> Paths, Length, Count
split_2 = TextSplit(Text=tstat.Paths, Separators=";")
item_13 = ListItem(List=split_2, Index="0", Wrap=True)
split_3 = TextSplit(Text=item_13, Separators="{")
item_14 = ListItem(List=split_3, Index="1", Wrap=True)  # -> simplify(Item)

equals = Equality(FirstNumber=graft(flatten), SecondNumber=merge_3)  # -> Equality, Inequality
mindex_4 = MemberIndex(Set=equals.Equality, Member=Toggle(True))  # -> Index, Count

# ----
subtraction_14 = Subtraction(A=b2, B=b1)  # disabled
division_5 = Division(A=subtraction_14, B=subtraction_11)  # disabled

# ----
# 0 --> extend one line to intersect two lines
# 1 --> extend two lines
# 2 --> extend three lines
dom = ConstructDomain(DomainStart=complex_7.Real, DomainEnd=complex_6.Real)  # disabled
dom_2 = ConstructDomain(DomainStart=complex_8.Real, DomainEnd=complex_9.Real)  # disabled
inc = Includes(Value=division_5, Domain=dom_2)  # -> Includes, Deviation; disabled
inc_2 = Includes(Value=division_5, Domain=dom)  # -> Includes, Deviation; disabled
int_6 = Integer(inc.Includes)  # disabled
int_7 = Integer(inc_2.Includes)  # disabled
addition_9 = Addition(A=int_6, B=int_7)  # disabled
panel_28 = Panel("2")  # disabled
subtraction_15 = Subtraction(A=panel_28, B=addition_9)  # disabled
extendlinecount = Integer(subtraction_15)  # disabled

division_6 = Division(A=subtraction_12, B=subtraction_13)
multiplication_5 = Multiplication(A=division_5, B=k2)  # disabled
k1_2 = Number(division_6)
multiplication_6 = Multiplication(A=k1_2, B=complex_10.Real)
addition_10 = Addition(A=multiplication_5, B=b2)  # disabled
subtraction_16 = Subtraction(A=complex_10.Imaginary, B=multiplication_6)
sift = SiftPattern(List=addition_10, SiftPattern=extendlinecount)  # -> Output0, Output1, Output2; disabled
sift_2 = SiftPattern(List=division_5, SiftPattern=extendlinecount)  # -> Output0, Output1, Output2; disabled
xy = XYPlane(Origin=Point(0, 0, 0))  # disabled
b1_2 = Number(subtraction_16)

# ----
# distances between points and space boundary
null = NullItem(Item=k1_2)  # -> NullFlags, InvalidFlags, Description
sift_3 = SiftPattern(List=pt_3, SiftPattern=null.NullFlags)  # -> Output0, Output1
complex_13 = ComplexComponents(Complex=sift_3.Output1)  # -> Real, Imaginary
eval = Evaluate(F="abs(k*x0-y0+b)/sqrt(k*k+1)", k=k1_2, b=b1_2, x0=complex_12.Real, y0=complex_12.Imaginary)
subtraction_17 = Subtraction(A=complex_12.Real, B=complex_13.Real)  # -> simplify(Result)
distance = Number(eval)
abs = Absolute(Value=subtraction_17)  # -> simplify(Result)
combine = CombineData(Input0=distance, Input1=abs)  # -> Result, Index

# ---- group: vector match method 1
concat_5 = Concatenate(FragmentA=concat_3, FragmentB=item_11.Item1)
flatten_2 = FlattenTree(Tree=concat_5, Path="{0}")
panel_29 = Panel("""000
002
100
102""")
panel_30 = Panel("""010
012
110
112""")
panel_31 = Panel("""101
103
111
113""")
panel_32 = Panel("""001
003
011
013""")
mindex_5 = MemberIndex(Set=panel_32, Member=flatten_2)  # -> Index, Count
mindex_6 = MemberIndex(Set=panel_29, Member=flatten_2)  # -> Index, Count
mindex_7 = MemberIndex(Set=panel_31, Member=flatten_2)  # -> Index, Count
mindex_8 = MemberIndex(Set=panel_30, Member=flatten_2)  # -> Index, Count
clean_2 = CleanTree(RemoveNulls=True, RemoveInvalid=True, RemoveEmpty=True, Tree=mindex_8.Index)
clean_3 = CleanTree(RemoveNulls=True, RemoveInvalid=True, RemoveEmpty=True, Tree=mindex_6.Index)
clean_4 = CleanTree(RemoveNulls=True, RemoveInvalid=True, RemoveEmpty=True, Tree=mindex_7.Index)
clean_5 = CleanTree(RemoveNulls=True, RemoveInvalid=True, RemoveEmpty=True, Tree=mindex_5.Index)
replace_2 = ReplaceItems(List=clean_4, Item="0", Indices="0", Wrap=False)
replace_3 = ReplaceItems(List=clean_2, Item="1", Indices="0", Wrap=False)
replace_4 = ReplaceItems(List=clean_5, Item="2", Indices="0", Wrap=False)
replace_5 = ReplaceItems(List=clean_3, Item="3", Indices="0", Wrap=False)
merge_4 = Merge(Data1=replace_2, Data2=replace_3, Data3=replace_4, Data4=replace_5)
item_15 = ListItem(List=vec_3, Index=merge_4, Wrap=True)
amp_3 = Amplitude(Vector=item_15, Amplitude=combine.Result)
vdis = VectorDisplay(Anchor=pt_4, Vector=amp_3)

# ---- group: vector match method 0 Error
# left-down;x-axis
# left-up;y-axis
a = Number(complex_11.Real)
b = Number(complex_11.Imaginary)
y_2 = Number(complex_12.Imaginary)
x_2 = Number(complex_12.Real)
item_16 = ListItem(List=vec_3, Index=item_11.Item1, Wrap=True)
smaller = SmallerThan(FirstNumber=b, SecondNumber=y_2)  # -> SmallerThan, OrEqualTo
not = GateNot(A=smaller.SmallerThan)
smaller_2 = SmallerThan(FirstNumber=a, SecondNumber=x_2)  # -> SmallerThan, OrEqualTo
and = GateAnd(A=smaller_2.SmallerThan, B=not)
equals_2 = Equality(FirstNumber="0", SecondNumber=graft(int_2))  # -> Equality, Inequality
equals_3 = Equality(FirstNumber="2", SecondNumber=graft(int_2))  # -> Equality, Inequality
and_2 = GateAnd(A=smaller_2.SmallerThan, B=smaller.SmallerThan)
equals_4 = Equality(FirstNumber="1", SecondNumber=graft(int_2))  # -> Equality, Inequality
equals_5 = Equality(FirstNumber="3", SecondNumber=graft(int_2))  # -> Equality, Inequality
or = GateOr(A=equals_2.Equality, B=equals_3.Equality)
or_2 = GateOr(A=equals_4.Equality, B=equals_5.Equality)
and_3 = GateAnd(A=or_2, B=and_2)
and_4 = GateAnd(A=or, B=and)
or_3 = GateOr(A=and_3, B=and_4)
sift_4 = SiftPattern(List=item_16, SiftPattern=or_3)  # -> Output0, Output1
pi = Pi(Factor="0.5")
Z = UnitZ(Factor=1)
neg = Negative(Value=pi)
vrot = Rotate(Vector=sift_4.Output0, Axis=Z, Angle=neg)
vrot_2 = Rotate(Vector=sift_4.Output1, Axis=Z, Angle=pi)
combine_2 = CombineData(Input0=vrot, Input1=vrot_2)  # -> Result, Index
amp_4 = Amplitude(Vector=combine_2.Result, Amplitude=combine.Result)
vdis_2 = VectorDisplay(Anchor=pt_4, Vector=amp_4)

# ----
# vectors between points and space boundary
panel_33 = Panel("0.5")  # disabled
item_17 = ListItem(List=vec_3, Index=item_11.Item1, Wrap=True)  # disabled
pi_2 = Pi(Factor=panel_33)  # disabled
neg_2 = Negative(Value=pi_2)  # disabled
Z_2 = UnitZ(Factor=1)  # disabled
vrot_3 = Rotate(Vector=item_17, Axis=Z_2, Angle=neg_2)  # disabled
amp_5 = Amplitude(Vector=vrot_3, Amplitude=combine.Result)  # disabled

pt_5 = PointOriented(BasePlane=xy, UComponent=sift_2.Output0, VComponent=sift.Output0, WComponent=0)  # disabled
panel_34 = Panel("abs(k*x0-y0+b)/sqrt(k*k+1)")
panel_35 = Panel("(k*x0-y0+b)/sqrt(k*k+1)")
panel_36 = Panel("-(k*x0-y0+b)/sqrt(k*k+1)")
flatten_3 = FlattenTree(Tree=pt_5, Path="{0}")  # disabled
clean_6 = CleanTree(RemoveNulls=True, RemoveInvalid=True, RemoveEmpty=False, Tree=flatten_3)  # disabled
intersection_x = Number(division_5)  # disabled
intersection_y = Number(addition_10)  # disabled
xy_2 = XYPlane(Origin=Point(0, 0, 0))  # disabled
pt_6 = PointOriented(BasePlane=xy_2, UComponent=intersection_x, VComponent=intersection_y, WComponent=0)  # disabled
panel_37 = Panel(extendlinecount)  # disabled
panel_38 = Panel(eval)
sift_5 = SiftPattern(List=pt_6, SiftPattern=extendlinecount)  # -> Output0, Output1, Output2; disabled
intersectionontwolines = Point(sift_5.Output0)  # disabled
intersectionononeline = Point(sift_5.Output1)  # disabled
intersectiononextend = Point(sift_5.Output2)  # disabled
panel_39 = Panel(combine.Result)
line_5 = Line([Line((11.10063287, -43.65250149, 0), (11.36790676, -34.83246292, 0)), Line((11.90245455, -29.21971111, 0), (27.00342968, -28.01697858, 0)), Line((23.39523208, -31.22426533, 0), (26.60251884, -43.91977539, 0)), Line((5.354244101, -41.11339948, 0), (34.35346182, -36.97065409, 0)), Line((25.80069715, -23.87423319, 0), (25.80069715, -45.25614487, 0))])
# explore a point position in space
linelist_2 = Curve(line_5)
lng_5 = ListLength(List=linelist_2)
subtraction_18 = Subtraction(A=lng_5, B="1")
series_7 = Series(Start=0, Step=1, Count=subtraction_18)
addition_11 = Addition(A=series_7, B="1")
item_18 = ListItem(List=linelist_2, Index=series_7, Wrap=False)  # -> simplify(graft(Item))
shift_5 = ShiftList(List=linelist_2, Shift=addition_11, Wrap=False)  # -> simplify(List)
end_4 = EndPoints(Curve=item_18)  # -> Start, End
end_5 = EndPoints(Curve=shift_5)  # -> Start, End
end_6 = EndPoints(Curve=linelist_2)  # -> Start, End
subtraction_19 = Subtraction(A=end_6.End, B=end_6.Start)

startpoint_4 = Point(end_6.Start)
vec_4 = Vector(subtraction_19)

addition_12 = Addition(A=startpoint_4, B=vec_4)
endpoint_3 = Point(addition_12)
lng_6 = ListLength(List=addition_12)
lng_7 = ListLength(List=startpoint_4)
line_length_6 = Panel("""3.2
5.1
3.2
5.1
6.4
10.2""")
panel_40 = Panel(startpoint_4)
panel_41 = Panel("""0
1
0
1
2
3""")
subtraction_20 = Subtraction(A=lng_6, B="1")
subtraction_21 = Subtraction(A=lng_7, B="1")
series_8 = Series(Start=0, Step=1, Count=subtraction_21)
series_9 = Series(Start=0, Step=1, Count=subtraction_20)
addition_13 = Addition(A=series_9, B="1")
addition_14 = Addition(A=series_8, B="1")
item_19 = ListItem(List=startpoint_4, Index=series_8, Wrap=False)  # -> simplify(graft(Item))
item_20 = ListItem(List=addition_12, Index=series_9, Wrap=False)  # -> simplify(graft(Item))
shift_6 = ShiftList(List=addition_12, Shift=addition_13, Wrap=False)  # -> simplify(List)
shift_7 = ShiftList(List=startpoint_4, Shift=addition_14, Wrap=False)  # -> simplify(List)

firstpt0_3 = Point(item_19)
firstpt1_2 = Point(shift_7)
endpt0_3 = Point(item_20)
endpt1_2 = Point(shift_6)

points_2 = PointList(Points=flatten(firstpt0_3), Size=Slider(6, range=0..100))
panel_42 = Panel("描述方法只是数据结构的不同，先用几何代表抽象的数据结构")
md_slider_3 = MDSlider(
    slider_value=Point(0.5591201782, 0.4691162109, 0.5),
    SliderMode=0,
    x_domain=Domain(-1000, 1000),
    y_domain=Domain(-1000, 1000),
    z_domain=Domain(0, 1))
line_length_7 = Panel("""3.2
5.1
3.2
5.1""")
panel_43 = Panel("""0
1
2
3""")
line_6 = Line(Line((116.8207412, -60.08346993, 0), (123.0442973, -60.08346993, 0)))
crv = Curve()
panel_44 = Panel("""x0,y0;0,1,2,3
x1,y0;0,3,2""")
end_7 = EndPoints(Curve=line_6)  # -> Start, End
panel_45 = Panel("""处理k不存在的情况
写成函数""")
line_length_8 = Number(line_length_7)
panel_46 = Panel("""1,0
0,1
-1,0
0,-1""")
int_8 = Integer(panel_43)
lng_8 = ListLength(List=int_8)
vec_5 = Vector(panel_46)
series_10 = Series(Start=0, Step=1, Count=lng_8)
item_21 = ListItem(List=vec_5, Index=int_8, Wrap=True)
panel_47 = Panel(item_21)
pt_7 = Point()
vec_6 = Vector()
item_22 = ListItem(List=line_length_8, Index=series_10, Wrap=True)
basicvectorunit_2 = Vector(item_21)
amp_6 = Amplitude(Vector=basicvectorunit_2, Amplitude=item_22)
panel_48 = Panel(amp_6)
ma_2 = MassAddition(Input=amp_6)  # -> Result, PartialResults
addition_15 = Addition(A=md_slider_3, B=ma_2.PartialResults)
pt_8 = Point(addition_15)
shift_8 = ShiftList(List=ma_2.PartialResults, Shift=-1, Wrap=True)
complex_14 = ComplexComponents(Complex=shift_8)  # -> Real, Imaginary
pt_9 = Point()
# describe space by (point;index) of vector
concat_6 = Concatenate(FragmentA=complex_14.Real, FragmentB=complex_14.Imaginary, JoinSeparator=",")
xy_3 = XYPlane(Origin=Point(0, 0, 0))
pline_2 = PolyLine(Vertices=pt_8, Closed=True)
concat_7 = Concatenate(FragmentA=concat_6, FragmentB=int_8, JoinSeparator=";")
panel_49 = Panel(concat_7)

# ----
# explore a point position in space
# 0 --> extend one line to intersect two lines
# 1 --> extend two lines
# 2 --> extend three lines
line_7 = Line([Line((-24.40860271, -49.55265212, 0), (8.180806958, -33.66531491, 0)), Line((-1.799699753, -27.75848441, 0), (-1.799699753, -50.36738737, 0))])  # disabled
panel_50 = Panel("1")  # disabled
linelist_3 = Curve(line_7)  # disabled
lng_9 = ListLength(List=linelist_3)  # disabled
subtraction_22 = Subtraction(A=lng_9, B=panel_50)  # disabled
series_11 = Series(Start=0, Step=1, Count=subtraction_22)  # disabled
addition_16 = Addition(A=series_11, B=panel_50)  # disabled
item_23 = ListItem(List=linelist_3, Index=series_11, Wrap=False)  # -> simplify(graft(Item)); disabled
shift_9 = ShiftList(List=linelist_3, Shift=addition_16, Wrap=False)  # -> simplify(List); disabled
end_8 = EndPoints(Curve=item_23)  # -> Start, End; disabled
end_9 = EndPoints(Curve=shift_9)  # -> Start, End; disabled
end_10 = EndPoints(Curve=linelist_3)  # -> Start, End; disabled
panel_51 = Panel("1")  # disabled
panel_52 = Panel("1")  # disabled
number_slider_6 = Slider(6, range=0..100)  # disabled
panel_53 = Panel("0")  # disabled
panel_54 = Panel("0")  # disabled
panel_55 = Panel("处理k不存在的情况")  # disabled
equals_6 = Equality()  # -> Equality, Inequality; disabled
panel_56 = Panel("2")  # disabled
xy_4 = XYPlane(Origin=Point(0, 0, 0))  # disabled

subtraction_23 = Subtraction(A=end_10.End, B=end_10.Start)  # disabled
startpoint_5 = Point(end_10.Start)  # disabled

vec_7 = Vector(subtraction_23)  # disabled
addition_17 = Addition(A=startpoint_5, B=vec_7)  # disabled
endpoint_4 = Point(addition_17)  # disabled
lng_10 = ListLength(List=addition_17)  # disabled
lng_11 = ListLength(List=startpoint_5)  # disabled
panel_57 = Panel(startpoint_5)  # disabled
subtraction_24 = Subtraction(A=lng_10, B=panel_51)  # disabled
subtraction_25 = Subtraction(A=lng_11, B=panel_52)  # disabled
series_12 = Series(Start=0, Step=1, Count=subtraction_25)  # disabled
series_13 = Series(Start=0, Step=1, Count=subtraction_24)  # disabled
addition_18 = Addition(A=series_13, B=panel_51)  # disabled
addition_19 = Addition(A=series_12, B=panel_52)  # disabled
item_24 = ListItem(List=startpoint_5, Index=series_12, Wrap=False)  # -> simplify(graft(Item)); disabled
item_25 = ListItem(List=addition_17, Index=series_13, Wrap=False)  # -> simplify(graft(Item)); disabled
shift_10 = ShiftList(List=addition_17, Shift=addition_18, Wrap=False)  # -> simplify(List); disabled
shift_11 = ShiftList(List=startpoint_5, Shift=addition_19, Wrap=False)  # -> simplify(List); disabled
firstpt1_3 = Point(shift_11)  # disabled
firstpt0_4 = Point(item_24)  # disabled
endpt0_4 = Point(item_25)  # disabled
endpt1_3 = Point(shift_10)  # disabled
points_3 = PointList(Points=flatten(firstpt0_4), Size=number_slider_6)  # disabled
panel_58 = Panel(firstpt0_4)  # disabled
complex_15 = ComplexComponents(Complex=firstpt1_3)  # -> Real, Imaginary; disabled
complex_16 = ComplexComponents(Complex=endpt1_3)  # -> Real, Imaginary; disabled
complex_17 = ComplexComponents(Complex=firstpt0_4)  # -> Real, Imaginary; disabled
complex_18 = ComplexComponents(Complex=endpt0_4)  # -> Real, Imaginary; disabled
subtraction_26 = Subtraction(A=complex_15.Imaginary, B=complex_16.Imaginary)  # disabled
subtraction_27 = Subtraction(A=complex_17.Real, B=complex_18.Real)  # disabled
equals_7 = Equality(FirstNumber=subtraction_27, SecondNumber=panel_54)  # -> Equality, Inequality; disabled
sift_6 = SiftPattern(List=complex_17.Real, SiftPattern=equals_7.Equality)  # -> Output0, Output1; disabled
subtraction_28 = Subtraction(A=complex_15.Real, B=complex_16.Real)  # disabled
equals_8 = Equality(FirstNumber=subtraction_28, SecondNumber=panel_53)  # -> Equality, Inequality; disabled
sift_7 = SiftPattern(List=complex_16.Real, SiftPattern=equals_8.Equality)  # -> Output0, Output1; disabled
subtraction_29 = Subtraction(A=complex_17.Imaginary, B=complex_18.Imaginary)  # disabled
combine_3 = CombineData(Input0=sift_6.Output1, Input1=sift_7.Output1)  # -> Result, Index; disabled
panel_59 = Panel(complex_17.Real)  # disabled
division_7 = Division(A=subtraction_26, B=subtraction_28)  # disabled
division_8 = Division(A=subtraction_29, B=subtraction_27)  # disabled
panel_60 = Panel(subtraction_28)  # disabled
panel_61 = Panel(equals_8.Equality)  # disabled
k1_3 = Number(division_8)  # disabled
multiplication_7 = Multiplication(A=k1_3, B=complex_18.Real)  # disabled
k2_2 = Number(division_7)  # disabled
multiplication_8 = Multiplication(A=k2_2, B=complex_16.Real)  # disabled
subtraction_30 = Subtraction(A=complex_18.Imaginary, B=multiplication_7)  # disabled
panel_62 = Panel(k1_3)  # disabled
subtraction_31 = Subtraction(A=complex_16.Imaginary, B=multiplication_8)  # disabled
subtraction_32 = Subtraction(A=k1_3, B=k2_2)  # disabled
b1_3 = Number(subtraction_30)  # disabled
dom_3 = ConstructDomain(DomainStart=complex_17.Real, DomainEnd=complex_18.Real)  # disabled
b2_2 = Number(subtraction_31)  # disabled
dom_4 = ConstructDomain(DomainStart=complex_15.Real, DomainEnd=complex_16.Real)  # disabled
subtraction_33 = Subtraction(A=b2_2, B=b1_3)  # disabled
nullrep = ReplaceNulls(Items=k1_3, Replacements=complex_17.Real)  # -> Items, Count; disabled
division_9 = Division(A=subtraction_33, B=subtraction_32)  # disabled
panel_63 = Panel(division_9)  # disabled
inc_3 = Includes(Value=division_9, Domain=dom_3)  # -> Includes, Deviation; disabled
inc_4 = Includes(Value=division_9, Domain=dom_4)  # -> Includes, Deviation; disabled
multiplication_9 = Multiplication(A=division_9, B=k2_2)  # disabled
panel_64 = Panel(nullrep.Items)  # disabled
nullrep_2 = ReplaceNulls(Items=division_9, Replacements=combine_3.Result)  # -> Items, Count; disabled
int_9 = Integer(inc_3.Includes)  # disabled
int_10 = Integer(inc_4.Includes)  # disabled
addition_20 = Addition(A=multiplication_9, B=b2_2)  # disabled
addition_21 = Addition(A=int_9, B=int_10)  # disabled
subtraction_34 = Subtraction(A=panel_56, B=addition_21)  # disabled
extendlinecount_2 = Integer(subtraction_34)  # disabled
intersection_x_2 = Number(division_9)  # disabled
intersection_y_2 = Number(addition_20)  # disabled
pt_10 = PointOriented(BasePlane=xy_4, UComponent=intersection_x_2, VComponent=intersection_y_2, WComponent=0)  # disabled
panel_65 = Panel(extendlinecount_2)  # disabled
sift_8 = SiftPattern(List=pt_10, SiftPattern=extendlinecount_2)  # -> Output0, Output1, Output2; disabled
intersectionontwolines_2 = Point(sift_8.Output0)  # disabled
intersectionononeline_2 = Point(sift_8.Output1)  # disabled
intersectiononextend_2 = Point(sift_8.Output2)  # disabled

xy_5 = XYPlane(Origin=Point(0, 0, 0))  # disabled
sift_9 = SiftPattern(List=division_9, SiftPattern=extendlinecount_2)  # -> Output0, Output1, Output2; disabled
sift_10 = SiftPattern(List=addition_20, SiftPattern=extendlinecount_2)  # -> Output0, Output1, Output2; disabled
pt_11 = PointOriented(BasePlane=xy_5, UComponent=sift_9.Output0, VComponent=sift_10.Output0, WComponent=0)  # disabled
flatten_4 = FlattenTree(Tree=pt_11, Path="{0}")  # disabled
clean_7 = CleanTree(RemoveNulls=True, RemoveInvalid=True, RemoveEmpty=False, Tree=flatten_4)  # disabled
pt_12 = Point(Point(-2.015690168, -16.36521091, 0))  # disabled
panel_66 = Panel("2")  # disabled
partition_2 = PartitionList(List=clean_7, Size=panel_66)  # disabled
bang = ExplodeTree(Data=partition_2)  # -> Branch0, Branch1; disabled
rev_2 = ReverseList(List=bang.Branch1)  # disabled
merge_5 = Merge(Data1=bang.Branch0, Data2=rev_2)  # -> flatten(Result); disabled
pline_3 = PolyLine(Vertices=merge_5, Closed=True)  # disabled

# ---- group: vector match method 1 simplify
# 问题在于，当某一path缺少时，替换的内容仍然会配对，造成数据多余错误
# 要探测出缺少的路径
# statistics-->DePath
# 最后拍平后替换路径
entwine_2 = Entwine(Branch00=panel_25, Branch01=panel_24, Branch02=panel_26, Branch03=panel_27, FlattenInputs=True)  # -> simplify(Result)
flatten_5 = FlattenTree(Tree=concat_5, Path="{0}")
mindex_9 = MemberIndex(Set=entwine_2, Member=flatten_5)  # -> Index, Count
clean_8 = CleanTree(RemoveNulls=True, RemoveInvalid=True, RemoveEmpty=True, Tree=mindex_9.Index)
pshift = ShiftPaths(Data=clean_8, Offset=-1)
viewer = ParamViewer(clean_8)

tstat_2 = TreeStatistics(Tree=pshift)  # -> Paths, Length, Count
dpath = DeconstructPath(Branch=tstat_2.Paths)  # -> simplify(Indices)

graft = GraftTree(Tree=tstat_2.Length, IncludeEmptyLists=True, IncludeNullItems=True)
series_14 = Series(Start=0, Step=1, Count=graft)
int_11 = Integer(simplify(series_14))
replace_6 = ReplaceItems(List=pshift, Item=dpath, Indices=int_11, Wrap=False)
graft_2 = GraftTree(Tree=flatten(replace_6), IncludeEmptyLists=True, IncludeNullItems=True)
viewer_2 = ParamViewer(graft_2)
replace_7 = ReplacePaths(Data=graft_2, Search=viewer_2, Replace=viewer)
pshift_2 = ShiftPaths(Data=replace_7, Offset="1")
item_26 = ListItem(List=vec_3, Index=pshift_2, Wrap=True)
amp_7 = Amplitude(Vector=item_26, Amplitude=combine.Result)
vdis_3 = VectorDisplay(Anchor=pt_4, Vector=amp_7)

# ----
complex_19 = ComplexComponents(Complex=firstpt1_2)  # -> Real, Imaginary
complex_20 = ComplexComponents(Complex=endpt1_2)  # -> Real, Imaginary
complex_21 = ComplexComponents(Complex=endpt0_3)  # -> Real, Imaginary
complex_22 = ComplexComponents(Complex=firstpt0_3)  # -> Real, Imaginary
subtraction_35 = Subtraction(A=complex_19.Imaginary, B=complex_20.Imaginary)
subtraction_36 = Subtraction(A=complex_19.Real, B=complex_20.Real)
subtraction_37 = Subtraction(A=complex_22.Real, B=complex_21.Real)
subtraction_38 = Subtraction(A=complex_22.Imaginary, B=complex_21.Imaginary)
division_10 = Division(A=subtraction_35, B=subtraction_36)
division_11 = Division(A=subtraction_38, B=subtraction_37)
k1_4 = Number(division_11)
k2_3 = Number(division_10)
multiplication_10 = Multiplication(A=k2_3, B=complex_19.Real)
subtraction_39 = Subtraction(A=complex_19.Imaginary, B=multiplication_10)
b2_3 = Number(subtraction_39)
subtraction_40 = Subtraction(A=k1_4, B=k2_3)

multiplication_11 = Multiplication(A=k1_4, B=complex_22.Real)
subtraction_41 = Subtraction(A=complex_22.Imaginary, B=multiplication_11)

equals_9 = Equality(FirstNumber=subtraction_36, SecondNumber="0")  # -> Equality, Inequality
equals_10 = Equality(FirstNumber=subtraction_37, SecondNumber="0")  # -> Equality, Inequality
sift_11 = SiftPattern(List=complex_20.Real, SiftPattern=equals_9.Equality)  # -> Output0, Output1
sift_12 = SiftPattern(List=complex_22.Real, SiftPattern=equals_10.Equality)  # -> Output0, Output1
or_4 = GateOr(A=equals_10.Equality, B=equals_9.Equality)
combine_4 = CombineData(Input0=sift_12.Output1, Input1=sift_11.Output1)  # -> Result, Index
sift_13 = SiftPattern(List=k2_3, SiftPattern=equals_9.Equality)  # -> Output0, Output1
sift_14 = SiftPattern(List=b2_3, SiftPattern=equals_9.Equality)  # -> Output0, Output1
sift_15 = SiftPattern(List=k1_4, SiftPattern=equals_10.Equality)  # -> Output0, Output1
combine_5 = CombineData(Input0=sift_15.Output0, Input1=sift_13.Output0)  # -> Result, Index
a_2 = Number(combine_4.Result)
k = Number(combine_5.Result)
multiplication_12 = Multiplication(A=a_2, B=k)
intersection_x_3 = Number(a_2)

b1_4 = Number(subtraction_41)
subtraction_42 = Subtraction(A=b2_3, B=b1_4)
division_12 = Division(A=subtraction_42, B=subtraction_40)
multiplication_13 = Multiplication(A=division_12, B=k2_3)
addition_22 = Addition(A=multiplication_13, B=b2_3)
sift_16 = SiftPattern(List=addition_22, SiftPattern=or_4)  # -> Output0, Output1

sift_17 = SiftPattern(List=b1_4, SiftPattern=equals_10.Equality)  # -> Output0, Output1
combine_6 = CombineData(Input0=sift_17.Output0, Input1=sift_14.Output0)  # -> Result, Index
b_2 = Number(combine_6.Result)
sift_18 = SiftPattern(List=b_2, SiftPattern=or_4)  # -> Output0, Output1
addition_23 = Addition(A=multiplication_12, B=sift_18.Output1)
intersection_y_3 = Number(addition_23)

combine_7 = CombineData(Input0=sift_16.Output0, Input1=intersection_y_3)  # -> Result, Index
combine_8 = CombineData(Input0=division_12, Input1=intersection_x_3)  # -> Result, Index

# ----
# 0 --> extend one line to intersect two lines
# 1 --> extend two lines
# 2 --> extend three lines
dom_5 = ConstructDomain(DomainStart=complex_19.Real, DomainEnd=complex_20.Real)
dom_6 = ConstructDomain(DomainStart=complex_22.Real, DomainEnd=complex_21.Real)
inc_5 = Includes(Value=combine_8.Result, Domain=dom_6)  # -> Includes, Deviation
inc_6 = Includes(Value=combine_8.Result, Domain=dom_5)  # -> Includes, Deviation
int_12 = Integer(inc_5.Includes)
int_13 = Integer(inc_6.Includes)
addition_24 = Addition(A=int_12, B=int_13)
subtraction_43 = Subtraction(A="2", B=addition_24)
extendlinecount_3 = Integer(subtraction_43)

intersection_x_4 = Number(combine_8.Result)
intersection_y_4 = Number(combine_7.Result)
pt_13 = PointOriented(BasePlane=xy_3, UComponent=intersection_x_4, VComponent=intersection_y_4, WComponent=0)
panel_67 = Panel(pt_13)
sift_19 = SiftPattern(List=pt_13, SiftPattern=extendlinecount_3)  # -> Output0, Output1, Output2
intersectionontwolines_3 = Point(sift_19.Output0)
intersectionononeline_3 = Point(sift_19.Output1)
intersectiononextend_3 = Point(sift_19.Output2)
panel_68 = Panel(extendlinecount_3)
panel_69 = Panel(intersectionontwolines_3)
