# Grasshopper definition 160929_PE_points_intersection_006_polyline_treeData.gh (Grasshopper 0.9.76)

panel = Panel("""1
3
4
2
6
7""")
panel_2 = Panel("3")
partition = PartitionList(List=panel, Size="3")  # -> simplify(Chunks)
series = Series(Start=0, Step=1, Count=10)
num = Number(partition)
panel_3 = Panel(num)
panel_4 = Panel("""001
002""")
series_2 = Series(Start="2", Step=1, Count="5")
num_2 = Number(["2", "4"])
panel_5 = Panel(series)
replace = ReplaceMembers(Set=graft(series), Find=num, Replace=graft(panel_4))
mindex = MemberIndex(Set=series_2, Member=num_2)  # -> simplify(Index), Count
panel_6 = Panel(replace)
panel_7 = Panel(series_2)
panel_8 = Panel(mindex.Index)

line = Line([Line((-28.43570879, -32.87535514, 0), (26.13975502, -11.96140003, 0)), Line((18.7700756, 6.164027732, 0), (13.19302091, -43.43192296, 0)), Line((-30.62669456, -19.7294405, 0), (35.30205917, -38.25322931, 0)), Line((2.835633616, -1.404832213, 0), (-1.54633793, -45.62290873, 0))])  # disabled
panel_9 = Panel("1")  # disabled
linelist = Curve(line)  # disabled
lng = ListLength(List=linelist)  # disabled
subtraction = Subtraction(A=lng, B=panel_9)  # disabled
series_3 = Series(Start=0, Step=1, Count=subtraction)  # disabled
addition = Addition(A=series_3, B=panel_9)  # disabled
item = ListItem(List=linelist, Index=series_3, Wrap=False)  # -> simplify(graft(Item)); disabled
shift = ShiftList(List=linelist, Shift=addition, Wrap=False)  # -> simplify(List); disabled
end = EndPoints(Curve=item)  # -> Start, End; disabled
end_2 = EndPoints(Curve=shift)  # -> Start, End; disabled

panel_10 = Panel("""0
1
0
1
2
3""")

line_length = Panel("""3.2
5.1
6.3
4.2""")
panel_11 = Panel("""0
1
2
3""")
# Point:indicate a position in space
# Line:length,direction,position
# Point
# two ends of the line
# the intersection of two lines
# the meeting of lines at the corner of a space or volumn
# the center of field
md_slider = MDSlider(
    slider_value=Point(0.5132578379, 0.5396976122, 0.5),
    SliderMode=0,
    x_domain=Domain(-100, 100),
    y_domain=Domain(-100, 100),
    z_domain=Domain(0, 1))  # disabled
startpoint = Point(md_slider)  # disabled
line_length_2 = Number(line_length)
int = Integer(panel_11)
number_slider = Slider(0.52, range=0..100)  # disabled
number_slider_2 = Slider(2.4, range=0..100)  # disabled
number_slider_3 = Slider(7.61, range=0..100)  # disabled
number_slider_4 = Slider(6.19, range=0..100)  # disabled
item_2 = ListItem(List=["1,0", "0,1", "-1,0", "0,-1"], Index=int, Wrap=True)
item_3 = ListItem(List=line_length_2, Index=0, Wrap=True)
X = UnitX(Factor=1)
basicvector = Vector(item_2)
merge = Merge(Data1=number_slider, Data2=number_slider_2)  # disabled
merge_2 = Merge(Data1=number_slider_3, Data2=number_slider_4)  # disabled
amp = Amplitude(Vector=X, Amplitude=item_3)  # disabled
line_2 = LineSDL(Start=startpoint, Direction=X, Length=item_3)  # disabled
complex = ComplexComponents(Complex=startpoint)  # -> Real, Imaginary; disabled
pt = PointOriented(BasePlane=startpoint, UComponent=merge, VComponent=merge_2, WComponent=0)  # disabled
complex_2 = ComplexComponents(Complex=amp)  # -> Real, Imaginary; disabled
complex_3 = CreateComplex(Real=complex.Real, Imaginary=complex.Imaginary)  # disabled
complex_4 = CreateComplex(Real=complex_2.Real, Imaginary=complex_2.Imaginary)  # disabled
item_4 = ListItem(List=pt, Index=0, Wrap=True)  # -> Item, Item1; disabled
X_2 = UnitX(Factor=1)  # disabled
Y = UnitY(Factor=1)  # disabled
addition_2 = Addition(A=complex_3, B=complex_4)  # disabled
line_3 = LineSDL(Start=item_4.Item1, Direction=Y, Length=item_3)  # disabled
line_4 = LineSDL(Start=item_4.Item, Direction=X_2, Length=item_3)  # disabled
panel_12 = Panel(addition_2)  # disabled
panel_13 = Panel("""1,2
2,1""")  # disabled
panel_14 = Panel("""2.0,2.0,0.0
-0.5,4.0,0.0""")  # disabled
panel_15 = Panel(complex_3)  # disabled
startpoint_2 = Point(panel_13)  # disabled
vec = Vector(panel_14)  # disabled
addition_3 = Addition(A=startpoint_2, B=vec)  # disabled
vec2pt = Vector2Pt(PointA=startpoint_2, PointB=addition_3, Unitize=False)  # -> Vector, Length; disabled
ln = Line(StartPoint=startpoint_2, EndPoint=addition_3)  # disabled
endpoint = Point(addition_3)  # disabled

line_length_3 = Panel("""3.2
5.1
3.2
5.1
6.4
10.2""")

Y_2 = UnitY(Factor=1)
X_3 = UnitX(Factor=1)
rev = Reverse(Vector=Y_2)
vlen = VectorLength(Vector=rev)
vlen_2 = VectorLength(Vector=X_3)
multiplication = Multiplication(A=X_3, B=rev)
multiplication_2 = Multiplication(A=vlen_2, B=vlen)
division = Division(A=multiplication, B=multiplication_2)
acos = ArcCosine(Value=division)

md_slider_2 = MDSlider(
    slider_value=Point(0.4899997711, 0.4549980164, 0.5),
    SliderMode=0,
    x_domain=Domain(0, 1),
    y_domain=Domain(0, 1),
    z_domain=Domain(0, 1))
panel_16 = Panel("""0
1
2
3""")
line_length_4 = Panel("""3.2
5.1
3.2
5.1""")
end_3 = EndPoints(Curve=linelist)  # -> Start, End; disabled
panel_17 = Panel("""用字符串的方法表示还差最后一步，那么先拆开来用判断的方法做
拆开的方法很繁琐，索性还是用字符串替换的方法
检查目前的替换方法是否可以简化
并且找出到各个边的距离最近点""")
subtraction_2 = Subtraction(A=end_3.End, B=end_3.Start)  # disabled
line_length_5 = Number(line_length_4)
panel_18 = Panel("""1,0
0,1
-1,0
0,-1""")
startpoint_3 = Point(end_3.Start)  # disabled
vec_2 = Vector(subtraction_2)  # disabled
vec_3 = Vector(panel_18)
int_2 = Integer(panel_16)
lng_2 = ListLength(List=int_2)
addition_4 = Addition(A=startpoint_3, B=vec_2)  # disabled
endpoint_2 = Point(addition_4)  # disabled
lng_3 = ListLength(List=addition_4)  # disabled
lng_4 = ListLength(List=startpoint_3)  # disabled
series_4 = Series(Start=0, Step=1, Count=lng_2)
panel_19 = Panel("1")  # disabled
panel_20 = Panel(startpoint_3)  # disabled
panel_21 = Panel("1")  # disabled
item_5 = ListItem(List=vec_3, Index=int_2, Wrap=True)
panel_22 = Panel(item_5)
subtraction_3 = Subtraction(A=lng_3, B=panel_19)  # disabled
subtraction_4 = Subtraction(A=lng_4, B=panel_21)  # disabled
item_6 = ListItem(List=line_length_5, Index=series_4, Wrap=True)
basicvectorunit = Vector(item_5)
series_5 = Series(Start=0, Step=1, Count=subtraction_4)  # disabled
series_6 = Series(Start=0, Step=1, Count=subtraction_3)  # disabled
addition_5 = Addition(A=series_6, B=panel_19)  # disabled
amp_2 = Amplitude(Vector=basicvectorunit, Amplitude=item_6)
addition_6 = Addition(A=series_5, B=panel_21)  # disabled
number_slider_5 = Slider(6, range=0..100)  # disabled
item_7 = ListItem(List=startpoint_3, Index=series_5, Wrap=False)  # -> simplify(graft(Item)); disabled
item_8 = ListItem(List=addition_4, Index=series_6, Wrap=False)  # -> simplify(graft(Item)); disabled
shift_2 = ShiftList(List=addition_4, Shift=addition_5, Wrap=False)  # -> simplify(List); disabled
shift_3 = ShiftList(List=startpoint_3, Shift=addition_6, Wrap=False)  # -> simplify(List); disabled
ma = MassAddition(Input=amp_2)  # -> Result, PartialResults
addition_7 = Addition(A=md_slider_2, B=ma.PartialResults)

pt_2 = Point(ma.PartialResults)
pline = PolyLine(Vertices=pt_2, Closed=True)

shift_4 = ShiftList(List=ma.PartialResults, Shift=-1, Wrap=True)
complex_5 = ComplexComponents(Complex=shift_4)  # -> Real, Imaginary
firstpt0 = Point(item_7)  # disabled
firstpt1 = Point(shift_3)  # disabled
endpt0 = Point(item_8)  # disabled
endpt1 = Point(shift_2)  # disabled
points = PointList(Points=flatten(firstpt0), Size=number_slider_5)  # disabled
# describe space by (point;index) of vector
concat = Concatenate(FragmentA=complex_5.Real, FragmentB=complex_5.Imaginary, JoinSeparator=",")
item_9 = ListItem(List=amp_2, Index=graft(series_4), Wrap=True)
complex_6 = ComplexComponents(Complex=endpt1)  # -> Real, Imaginary; disabled
complex_7 = ComplexComponents(Complex=firstpt1)  # -> Real, Imaginary; disabled
complex_8 = ComplexComponents(Complex=firstpt0)  # -> Real, Imaginary; disabled
complex_9 = ComplexComponents(Complex=endpt0)  # -> Real, Imaginary; disabled
panel_23 = Panel(ma.PartialResults)
concat_2 = Concatenate(FragmentA=concat, FragmentB=int_2, JoinSeparator=";")
item_10 = ListItem(List=concat_2, Index=series_4, Wrap=True)
split = TextSplit(Text=item_10, Separators=";")  # -> simplify(Result)
item_11 = ListItem(List=split, Index=0, Wrap=True)  # -> Item, Item1
pt_3 = Point(item_11.Item)
subtraction_5 = Subtraction(A=complex_8.Real, B=complex_9.Real)  # disabled
subtraction_6 = Subtraction(A=complex_8.Imaginary, B=complex_9.Imaginary)  # disabled
subtraction_7 = Subtraction(A=complex_7.Real, B=complex_6.Real)  # disabled
subtraction_8 = Subtraction(A=complex_7.Imaginary, B=complex_6.Imaginary)  # disabled
addition_8 = Addition(A=pt_3, B=item_9)
division_2 = Division(A=subtraction_6, B=subtraction_5)  # disabled
division_3 = Division(A=subtraction_8, B=subtraction_7)  # disabled
firstpt0_2 = Point(item_11.Item)
endpt0_2 = Point(addition_8)
panel_24 = Panel(concat_2)
k2 = Number(division_3)  # disabled
multiplication_3 = Multiplication(A=k2, B=complex_6.Real)  # disabled
k1 = Number(division_2)  # disabled
multiplication_4 = Multiplication(A=k1, B=complex_9.Real)  # disabled
complex_10 = ComplexComponents(Complex=endpt0_2)  # -> Real, Imaginary
complex_11 = ComplexComponents(Complex=firstpt0_2)  # -> Real, Imaginary
subtraction_9 = Subtraction(A=complex_9.Imaginary, B=multiplication_4)  # disabled
subtraction_10 = Subtraction(A=complex_6.Imaginary, B=multiplication_3)  # disabled
pt_4 = Point(Point(1.488717773, 12.13872048, 0))
subtraction_11 = Subtraction(A=k1, B=k2)  # disabled
b1 = Number(subtraction_9)  # disabled
subtraction_12 = Subtraction(A=complex_11.Imaginary, B=complex_10.Imaginary)
subtraction_13 = Subtraction(A=complex_11.Real, B=complex_10.Real)
b2 = Number(subtraction_10)  # disabled
complex_12 = ComplexComponents(Complex=pt_4)  # -> Real, Imaginary

y = Number(complex_12.Imaginary)
x = Number(complex_12.Real)
larger = LargerThan(FirstNumber=complex_11.Real, SecondNumber=x)  # -> LargerThan, OrEqualTo
larger_2 = LargerThan(FirstNumber=complex_11.Imaginary, SecondNumber=y)  # -> LargerThan, OrEqualTo
int_3 = Integer(larger.LargerThan)
int_4 = Integer(larger_2.LargerThan)
concat_3 = Concatenate(FragmentA=int_3, FragmentB=int_4)

# ---- group: vector match concept Error
panel_25 = Panel("""010
012
110
112""")
panel_26 = Panel("""101
103
111
113""")
panel_27 = Panel("""001
003
011
013""")
panel_28 = Panel("""000
002
100
102""")
merge_3 = Merge(Data1=panel_26, Data2=panel_25, Data3=panel_27, Data4=panel_28)
entwine = Entwine(Branch00=panel_26, Branch01=panel_25, Branch02=panel_27, Branch03=panel_28, FlattenInputs=True)  # -> simplify(Result)
concat_4 = Concatenate(FragmentA=concat_3, FragmentB=item_11.Item1)
flatten = FlattenTree(Tree=concat_4, Path="{0}")
mindex_2 = MemberIndex(Set=merge_3, Member=flatten)  # -> Index, Count
division_4 = Division(A=mindex_2.Index, B="4")
int_5 = Integer(division_4)
item_12 = ListItem(List=vec_3, Index=int_5, Wrap=True)

mindex_3 = MemberIndex(Set=entwine, Member=flatten)  # -> Index, Count
clean = CleanTree(RemoveNulls=True, RemoveInvalid=True, RemoveEmpty=True, Tree=mindex_3.Index)
tstat = TreeStatistics(Tree=clean)  # -> Paths, Length, Count
split_2 = TextSplit(Text=tstat.Paths, Separators=";")
item_13 = ListItem(List=split_2, Index="0", Wrap=True)
split_3 = TextSplit(Text=item_13, Separators="{")
item_14 = ListItem(List=split_3, Index="1", Wrap=True)  # -> simplify(Item)

equals = Equality(FirstNumber=graft(flatten), SecondNumber=merge_3)  # -> Equality, Inequality
mindex_4 = MemberIndex(Set=equals.Equality, Member=Toggle(True))  # -> Index, Count

# ----
subtraction_14 = Subtraction(A=b2, B=b1)  # disabled
division_5 = Division(A=subtraction_14, B=subtraction_11)  # disabled

# ----
# 0 --> extend one line to intersect two lines
# 1 --> extend two lines
# 2 --> extend three lines
dom = ConstructDomain(DomainStart=complex_7.Real, DomainEnd=complex_6.Real)  # disabled
dom_2 = ConstructDomain(DomainStart=complex_8.Real, DomainEnd=complex_9.Real)  # disabled
inc = Includes(Value=division_5, Domain=dom_2)  # -> Includes, Deviation; disabled
inc_2 = Includes(Value=division_5, Domain=dom)  # -> Includes, Deviation; disabled
int_6 = Integer(inc.Includes)  # disabled
int_7 = Integer(inc_2.Includes)  # disabled
addition_9 = Addition(A=int_6, B=int_7)  # disabled
panel_29 = Panel("2")  # disabled
subtraction_15 = Subtraction(A=panel_29, B=addition_9)  # disabled
extendlinecount = Integer(subtraction_15)  # disabled

division_6 = Division(A=subtraction_12, B=subtraction_13)
multiplication_5 = Multiplication(A=division_5, B=k2)  # disabled
k1_2 = Number(division_6)
multiplication_6 = Multiplication(A=k1_2, B=complex_10.Real)
addition_10 = Addition(A=multiplication_5, B=b2)  # disabled
subtraction_16 = Subtraction(A=complex_10.Imaginary, B=multiplication_6)
sift = SiftPattern(List=addition_10, SiftPattern=extendlinecount)  # -> Output0, Output1, Output2; disabled
sift_2 = SiftPattern(List=division_5, SiftPattern=extendlinecount)  # -> Output0, Output1, Output2; disabled
xy = XYPlane(Origin=Point(0, 0, 0))  # disabled
b1_2 = Number(subtraction_16)

# ----
# distances between points and space boundary
null = NullItem(Item=k1_2)  # -> NullFlags, InvalidFlags, Description
sift_3 = SiftPattern(List=pt_3, SiftPattern=null.NullFlags)  # -> Output0, Output1
complex_13 = ComplexComponents(Complex=sift_3.Output1)  # -> Real, Imaginary
eval = Evaluate(F="abs(k*x0-y0+b)/sqrt(k*k+1)", k=k1_2, b=b1_2, x0=complex_12.Real, y0=complex_12.Imaginary)
subtraction_17 = Subtraction(A=complex_12.Real, B=complex_13.Real)  # -> simplify(Result)
distance = Number(eval)
abs = Absolute(Value=subtraction_17)  # -> simplify(Result)
combine = CombineData(Input0=distance, Input1=abs)  # -> Result, Index

# ---- group: vector match method 1
concat_5 = Concatenate(FragmentA=concat_3, FragmentB=item_11.Item1)
flatten_2 = FlattenTree(Tree=concat_5, Path="{0}")
panel_30 = Panel("""000
002
100
102""")
panel_31 = Panel("""010
012
110
112""")
panel_32 = Panel("""101
103
111
113""")
panel_33 = Panel("""001
003
011
013""")
mindex_5 = MemberIndex(Set=panel_33, Member=flatten_2)  # -> Index, Count
mindex_6 = MemberIndex(Set=panel_30, Member=flatten_2)  # -> Index, Count
mindex_7 = MemberIndex(Set=panel_32, Member=flatten_2)  # -> Index, Count
mindex_8 = MemberIndex(Set=panel_31, Member=flatten_2)  # -> Index, Count
clean_2 = CleanTree(RemoveNulls=True, RemoveInvalid=True, RemoveEmpty=True, Tree=mindex_8.Index)
clean_3 = CleanTree(RemoveNulls=True, RemoveInvalid=True, RemoveEmpty=True, Tree=mindex_6.Index)
clean_4 = CleanTree(RemoveNulls=True, RemoveInvalid=True, RemoveEmpty=True, Tree=mindex_7.Index)
clean_5 = CleanTree(RemoveNulls=True, RemoveInvalid=True, RemoveEmpty=True, Tree=mindex_5.Index)
replace_2 = ReplaceItems(List=clean_4, Item="0", Indices="0", Wrap=False)
replace_3 = ReplaceItems(List=clean_2, Item="1", Indices="0", Wrap=False)
replace_4 = ReplaceItems(List=clean_5, Item="2", Indices="0", Wrap=False)
replace_5 = ReplaceItems(List=clean_3, Item="3", Indices="0", Wrap=False)
merge_4 = Merge(Data1=replace_2, Data2=replace_3, Data3=replace_4, Data4=replace_5)
item_15 = ListItem(List=vec_3, Index=merge_4, Wrap=True)
amp_3 = Amplitude(Vector=item_15, Amplitude=combine.Result)
vdis = VectorDisplay(Anchor=pt_4, Vector=amp_3)

# ---- group: vector match method 0 Error
# left-down;x-axis
# left-up;y-axis
a = Number(complex_11.Real)
b = Number(complex_11.Imaginary)
y_2 = Number(complex_12.Imaginary)
x_2 = Number(complex_12.Real)
item_16 = ListItem(List=vec_3, Index=item_11.Item1, Wrap=True)
smaller = SmallerThan(FirstNumber=b, SecondNumber=y_2)  # -> SmallerThan, OrEqualTo
not = GateNot(A=smaller.SmallerThan)
smaller_2 = SmallerThan(FirstNumber=a, SecondNumber=x_2)  # -> SmallerThan, OrEqualTo
and = GateAnd(A=smaller_2.SmallerThan, B=not)
equals_2 = Equality(FirstNumber="0", SecondNumber=graft(int_2))  # -> Equality, Inequality
equals_3 = Equality(FirstNumber="2", SecondNumber=graft(int_2))  # -> Equality, Inequality
and_2 = GateAnd(A=smaller_2.SmallerThan, B=smaller.SmallerThan)
equals_4 = Equality(FirstNumber="1", SecondNumber=graft(int_2))  # -> Equality, Inequality
equals_5 = Equality(FirstNumber="3", SecondNumber=graft(int_2))  # -> Equality, Inequality
or = GateOr(A=equals_2.Equality, B=equals_3.Equality)
or_2 = GateOr(A=equals_4.Equality, B=equals_5.Equality)
and_3 = GateAnd(A=or_2, B=and_2)
and_4 = GateAnd(A=or, B=and)
or_3 = GateOr(A=and_3, B=and_4)
sift_4 = SiftPattern(List=item_16, SiftPattern=or_3)  # -> Output0, Output1
pi = Pi(Factor="0.5")
Z = UnitZ(Factor=1)
neg = Negative(Value=pi)
vrot = Rotate(Vector=sift_4.Output0, Axis=Z, Angle=neg)
vrot_2 = Rotate(Vector=sift_4.Output1, Axis=Z, Angle=pi)
combine_2 = CombineData(Input0=vrot, Input1=vrot_2)  # -> Result, Index
amp_4 = Amplitude(Vector=combine_2.Result, Amplitude=combine.Result)
vdis_2 = VectorDisplay(Anchor=pt_4, Vector=amp_4)

# ----
# vectors between points and space boundary
panel_34 = Panel("0.5")  # disabled
item_17 = ListItem(List=vec_3, Index=item_11.Item1, Wrap=True)  # disabled
pi_2 = Pi(Factor=panel_34)  # disabled
neg_2 = Negative(Value=pi_2)  # disabled
Z_2 = UnitZ(Factor=1)  # disabled
vrot_3 = Rotate(Vector=item_17, Axis=Z_2, Angle=neg_2)  # disabled
amp_5 = Amplitude(Vector=vrot_3, Amplitude=combine.Result)  # disabled

pt_5 = PointOriented(BasePlane=xy, UComponent=sift_2.Output0, VComponent=sift.Output0, WComponent=0)  # disabled
panel_35 = Panel("abs(k*x0-y0+b)/sqrt(k*k+1)")
panel_36 = Panel("(k*x0-y0+b)/sqrt(k*k+1)")
panel_37 = Panel("-(k*x0-y0+b)/sqrt(k*k+1)")
flatten_3 = FlattenTree(Tree=pt_5, Path="{0}")  # disabled
clean_6 = CleanTree(RemoveNulls=True, RemoveInvalid=True, RemoveEmpty=False, Tree=flatten_3)  # disabled
intersection_x = Number(division_5)  # disabled
intersection_y = Number(addition_10)  # disabled
xy_2 = XYPlane(Origin=Point(0, 0, 0))  # disabled
pt_6 = PointOriented(BasePlane=xy_2, UComponent=intersection_x, VComponent=intersection_y, WComponent=0)  # disabled
panel_38 = Panel(extendlinecount)  # disabled
panel_39 = Panel(eval)
sift_5 = SiftPattern(List=pt_6, SiftPattern=extendlinecount)  # -> Output0, Output1, Output2; disabled
intersectionontwolines = Point(sift_5.Output0)  # disabled
intersectionononeline = Point(sift_5.Output1)  # disabled
intersectiononextend = Point(sift_5.Output2)  # disabled
panel_40 = Panel(combine.Result)
num_3 = Number(Toggle(False))
line_5 = Line(Line((119.3393443, -60.78584412, 0), (119.6525493, -60.78584412, 0)))
line_6 = Line(Line((119.8096632, -60.78584412, 0), (119.4931182, -60.78584412, 0)))
panel_41 = Panel("运算器存在bug")
ccx = CurveCurve(CurveA=line_5, CurveB=line_6)  # -> Points, ParamsA, ParamsB
line_bug_commonline = Line([Line((119.3540923, -60.56923774, 0), (119.5008735, -60.56923774, 0)), Line((119.5919791, -60.56923774, 0), (119.7404475, -60.56923774, 0))])
# debug:之前判断是实交和虚交的方法是判断交点point的x坐标是否在两线段的值域范围内，但是当上述情况的时候，直线会虚交被误判成实际交点
line_bug_insectiononextend = Line([Line((119.0174668, -60.28107794, 0), (119.4638718, -60.28107794, 0)), Line((119.2255633, -60.35451331, 0), (119.2255633, -61.15203638, 0))])
line_7 = Line([Line((119.5723897, -60.99532941, 0), (119.5723897, -61.13933165, 0)), Line((119.5723897, -60.99532941, 0), (119.7626783, -60.99532941, 0))])
panel_42 = Panel("把正交和斜交的情况分离开来，同时组织数据结构")
panel_43 = Panel("描述方法只是数据结构的不同，先用几何代表抽象的数据结构")
panel_44 = Panel("""x0,y0;0,1,2,3
x1,y0;0,3,2""")
panel_45 = Panel("""多条线且含有多折线连线组织数据结构问题
得到交点
交点的path替换""")
crv = Curve([<curve referenced from the Rhino model> x3])
crv_2 = Curve([<curve referenced from the Rhino model> x4])
explode = Explode(Curve=crv_2, Recursive=True)  # -> Segments, Vertices
end_4 = EndPoints(Curve=crv_2)  # -> Start, End
neg_3 = Negative(Value="1")
shift_5 = ShiftList(List=explode.Vertices, Shift="1", Wrap=False)
shift_6 = ShiftList(List=explode.Vertices, Shift=neg_3, Wrap=False)

panel_46 = Panel("""1,0
0,1
-1,0
0,-1""")
vec_4 = Vector(panel_46)

# ----
# describe space by (point;index) of vector
md_slider_3 = MDSlider(
    slider_value=Point(0.5591201782, 0.4691162109, 0.5),
    SliderMode=0,
    x_domain=Domain(-1000, 1000),
    y_domain=Domain(-1000, 1000),
    z_domain=Domain(0, 1))
panel_47 = Panel("""0
1
2
3""")
line_length_6 = Panel("""3.2
5.1
3.2
5.1""")
line_length_7 = Number(line_length_6)
int_8 = Integer(panel_47)
lng_5 = ListLength(List=int_8)
series_7 = Series(Start=0, Step=1, Count=lng_5)
item_18 = ListItem(List=vec_4, Index=int_8, Wrap=True)
item_19 = ListItem(List=line_length_7, Index=series_7, Wrap=True)
basicvectorunit_2 = Vector(item_18)
amp_6 = Amplitude(Vector=basicvectorunit_2, Amplitude=item_19)
ma_2 = MassAddition(Input=amp_6)  # -> Result, PartialResults
addition_11 = Addition(A=md_slider_3, B=ma_2.PartialResults)
pt_7 = Point(addition_11)
shift_7 = ShiftList(List=ma_2.PartialResults, Shift=-1, Wrap=True)
complex_14 = ComplexComponents(Complex=shift_7)  # -> Real, Imaginary
concat_6 = Concatenate(FragmentA=complex_14.Real, FragmentB=complex_14.Imaginary, JoinSeparator=",")
pline_2 = PolyLine(Vertices=pt_7, Closed=True)
concat_7 = Concatenate(FragmentA=concat_6, FragmentB=int_8, JoinSeparator=";")

subtraction_18 = Subtraction(A=shift_5, B=shift_6)

# ----
# 首点坐标相对于第一点
graft = GraftTree(Tree=end_4.Start, IncludeEmptyLists=True, IncludeNullItems=True)  # -> simplify(Tree)
subtraction_19 = Subtraction(A=graft, B="{0,0,0}")  # -> flatten(Result)
item_20 = ListItem(List=subtraction_19, Index="0", Wrap=True)
subtraction_20 = Subtraction(A=graft, B=item_20)

# ----
# curve convert to direction and length
unit = UnitVector(Vector=subtraction_18)
vec_5 = Vector(subtraction_18)
len = Length(Curve=explode.Segments)  # -> simplify(Length)
pshift = ShiftPaths(Data=unit, Offset=-1)
mindex_9 = MemberIndex(Set=vec_4, Member=pshift)  # -> Index, Count
vdis_3 = VectorDisplay(Anchor=shift_6, Vector=vec_5)
pshift_2 = ShiftPaths(Data=mindex_9.Index, Offset=-1)  # -> simplify(Data)

vecdirection = Integer(pshift_2)
veclength = Number(len)
pt_8 = Point(graft)

panel_48 = Panel(vec_4)
item_21 = ListItem(List=vec_4, Index=vecdirection, Wrap=True)
amp_7 = Amplitude(Vector=item_21, Amplitude=veclength)
ma_3 = MassAddition(Input=amp_7)  # -> Result, PartialResults
addition_12 = Addition(A=pt_8, B=ma_3.PartialResults)
pt_9 = Point(addition_12)
ins = InsertItems(List=addition_12, Item=pt_8, Indices="0", Wrap=True)
neg_4 = Negative(Value="1")
panel_49 = Panel(pt_8)
panel_50 = Panel(concat_7)
panel_51 = Panel(amp_6)
panel_52 = Panel(ins)
# each line first point
shift_8 = ShiftList(List=ins, Shift=neg_4, Wrap=False)  # -> simplify(List)

# ----
# tree data trial
# first point 和 end point 的数据结构组织的方式是同一种的
# 
# 先手工傻做，再寻找规律
# 
# 先不管结构如何，把他们放在一起，结构在外部运算，在替换成对的树形数据
# 上升数据结构后手工或者数列
# 上升后全部拍平处理
# 用stack+listItem对拍平的数据处理
# 
# 留下来的问题是数据结构的替换
# 手工
pt_10 = Point(shift_8)
graft_2 = GraftTree(Tree=pt_10, IncludeEmptyLists=True, IncludeNullItems=True)

panel_53 = Panel(pt_10)

flatten_4 = FlattenTree(Tree=graft_2, Path="{0}")
tstat_2 = TreeStatistics(Tree=pt_10)  # -> Paths, Length, Count
tstat_3 = TreeStatistics(Tree=graft_2)  # -> Paths, Length, Count
ma_4 = MassAddition(Input=tstat_2.Length)  # -> Result, PartialResults
series_8 = Series(Start=0, Step=1, Count=tstat_3.Count)
stack = StackData(Data=ma_4.PartialResults, Stack=tstat_2.Length)
shift_9 = ShiftList(List=series_8, Shift=stack, Wrap=False)
item_22 = ListItem(List=flatten_4, Index=shift_9, Wrap=True)  # -> simplify(Item)

panel_54 = Panel(tstat_2.Length)
lng_6 = ListLength(List=item_22)
panel_55 = Panel(graft_2)
stack_2 = StackData(Data=graft_2, Stack=lng_6)

bang = ExplodeTree(Data=graft_2)  # -> Branch0, Branch1, Branch2, Branch3, Branch4, Branch5
merge_5 = Merge(Data1=bang.Branch1, Data2=bang.Branch2, Data3=bang.Branch3, Data4=bang.Branch4, Data5=bang.Branch5)
entwine_2 = Entwine(
    Branch00=merge_5,
    Branch01=bang.Branch5,
    Branch02=bang.Branch5,
    Branch03=bang.Branch5,
    Branch04=bang.Branch5,
    FlattenInputs=True)

# ----
# each line end point
shift_10 = ShiftList(List=ins, Shift="1", Wrap=False)  # -> simplify(List)
graft_3 = GraftTree(Tree=stack_2, IncludeEmptyLists=True, IncludeNullItems=True)
graft_4 = GraftTree(Tree=shift_8, IncludeEmptyLists=True, IncludeNullItems=True)

flatten_5 = FlattenTree(Tree=graft_4, Path="{0}")
tstat_4 = TreeStatistics(Tree=shift_8)  # -> Paths, Length, Count
tstat_5 = TreeStatistics(Tree=graft_4)  # -> Paths, Length, Count
ma_5 = MassAddition(Input=tstat_4.Length)  # -> Result, PartialResults
series_9 = Series(Start=0, Step=1, Count=tstat_5.Count)
stack_3 = StackData(Data=ma_5.PartialResults, Stack=tstat_4.Length)
shift_11 = ShiftList(List=series_9, Shift=stack_3, Wrap=False)
viewer = ParamViewer()
item_23 = ListItem(List=flatten_5, Index=shift_11, Wrap=True)  # -> simplify(Item)
replace_6 = ReplacePaths(Data=item_23, Search=viewer)

graft_5 = GraftTree(Tree=shift_10, IncludeEmptyLists=True, IncludeNullItems=True)

# ----
# kernel tree data
flatten_6 = FlattenTree(Tree=graft_5, Path="{0}")
tstat_6 = TreeStatistics(Tree=shift_10)  # -> Paths, Length, Count
tstat_7 = TreeStatistics(Tree=graft_5)  # -> Paths, Length, Count
ma_6 = MassAddition(Input=tstat_6.Length)  # -> Result, PartialResults
series_10 = Series(Start=0, Step=1, Count=tstat_7.Count)
stack_4 = StackData(Data=ma_6.PartialResults, Stack=tstat_6.Length)
shift_12 = ShiftList(List=series_10, Shift=stack_4, Wrap=False)
item_24 = ListItem(List=flatten_6, Index=shift_12, Wrap=True)  # -> simplify(Item)
viewer_2 = ParamViewer()
replace_7 = ReplacePaths(Data=item_24, Search=viewer_2)

panel_56 = Panel(item_22)
addition_13 = Addition(A=pt_8)

viewer_3 = ParamViewer()
replace_8 = ReplacePaths(Data=item_22, Search=viewer_3)

firstpt_line0 = Point(graft_4)
firstpt_line1 = Point(item_23)
endpt_line0 = Point(graft_5)
endpt_line1 = Point(item_24)

panel_57 = Panel(item_23)
graft_6 = GraftTree(Tree=item_22, IncludeEmptyLists=True, IncludeNullItems=True)
panel_59 = Panel(graft_6)
pi_3 = Pi(Factor="2")
random = Random(Range=pi_3, Number="20", Seed=Slider(33.222, range=0..100))
panel_61 = Panel(pi_3)
sort = SortList(Keys=random)  # -> Keys, ValuesA
panel_62 = Panel(sort.Keys)

# ----
# explore a point position in space
# 0 --> extend one line to intersect two lines
# 1 --> extend two lines
# 2 --> extend three lines
line_8 = Line([Line((-24.40860271, -49.55265212, 0), (8.180806958, -33.66531491, 0)), Line((-1.799699753, -27.75848441, 0), (-1.799699753, -50.36738737, 0))])  # disabled
panel_63 = Panel("1")  # disabled
linelist_2 = Curve(line_8)  # disabled
lng_7 = ListLength(List=linelist_2)  # disabled
subtraction_21 = Subtraction(A=lng_7, B=panel_63)  # disabled
series_11 = Series(Start=0, Step=1, Count=subtraction_21)  # disabled
addition_14 = Addition(A=series_11, B=panel_63)  # disabled
item_25 = ListItem(List=linelist_2, Index=series_11, Wrap=False)  # -> simplify(graft(Item)); disabled
shift_13 = ShiftList(List=linelist_2, Shift=addition_14, Wrap=False)  # -> simplify(List); disabled
end_5 = EndPoints(Curve=item_25)  # -> Start, End; disabled
end_6 = EndPoints(Curve=shift_13)  # -> Start, End; disabled
end_7 = EndPoints(Curve=linelist_2)  # -> Start, End; disabled
panel_64 = Panel("1")  # disabled
panel_65 = Panel("1")  # disabled
number_slider_6 = Slider(6, range=0..100)  # disabled
panel_66 = Panel("0")  # disabled
panel_67 = Panel("0")  # disabled
panel_68 = Panel("处理k不存在的情况")  # disabled
equals_6 = Equality()  # -> Equality, Inequality; disabled
panel_69 = Panel("2")  # disabled
xy_3 = XYPlane(Origin=Point(0, 0, 0))  # disabled

subtraction_22 = Subtraction(A=end_7.End, B=end_7.Start)  # disabled
startpoint_4 = Point(end_7.Start)  # disabled

vec_6 = Vector(subtraction_22)  # disabled
addition_15 = Addition(A=startpoint_4, B=vec_6)  # disabled
endpoint_3 = Point(addition_15)  # disabled
lng_8 = ListLength(List=addition_15)  # disabled
lng_9 = ListLength(List=startpoint_4)  # disabled
panel_70 = Panel(startpoint_4)  # disabled
subtraction_23 = Subtraction(A=lng_8, B=panel_64)  # disabled
subtraction_24 = Subtraction(A=lng_9, B=panel_65)  # disabled
series_12 = Series(Start=0, Step=1, Count=subtraction_24)  # disabled
series_13 = Series(Start=0, Step=1, Count=subtraction_23)  # disabled
addition_16 = Addition(A=series_13, B=panel_64)  # disabled
addition_17 = Addition(A=series_12, B=panel_65)  # disabled
item_26 = ListItem(List=startpoint_4, Index=series_12, Wrap=False)  # -> simplify(graft(Item)); disabled
item_27 = ListItem(List=addition_15, Index=series_13, Wrap=False)  # -> simplify(graft(Item)); disabled
shift_14 = ShiftList(List=addition_15, Shift=addition_16, Wrap=False)  # -> simplify(List); disabled
shift_15 = ShiftList(List=startpoint_4, Shift=addition_17, Wrap=False)  # -> simplify(List); disabled
firstpt1_2 = Point(shift_15)  # disabled
firstpt0_3 = Point(item_26)  # disabled
endpt0_3 = Point(item_27)  # disabled
endpt1_2 = Point(shift_14)  # disabled
points_2 = PointList(Points=flatten(firstpt0_3), Size=number_slider_6)  # disabled
panel_71 = Panel(firstpt0_3)  # disabled
complex_15 = ComplexComponents(Complex=firstpt1_2)  # -> Real, Imaginary; disabled
complex_16 = ComplexComponents(Complex=endpt1_2)  # -> Real, Imaginary; disabled
complex_17 = ComplexComponents(Complex=firstpt0_3)  # -> Real, Imaginary; disabled
complex_18 = ComplexComponents(Complex=endpt0_3)  # -> Real, Imaginary; disabled
subtraction_25 = Subtraction(A=complex_15.Imaginary, B=complex_16.Imaginary)  # disabled
subtraction_26 = Subtraction(A=complex_17.Real, B=complex_18.Real)  # disabled
equals_7 = Equality(FirstNumber=subtraction_26, SecondNumber=panel_67)  # -> Equality, Inequality; disabled
sift_6 = SiftPattern(List=complex_17.Real, SiftPattern=equals_7.Equality)  # -> Output0, Output1; disabled
subtraction_27 = Subtraction(A=complex_15.Real, B=complex_16.Real)  # disabled
equals_8 = Equality(FirstNumber=subtraction_27, SecondNumber=panel_66)  # -> Equality, Inequality; disabled
sift_7 = SiftPattern(List=complex_16.Real, SiftPattern=equals_8.Equality)  # -> Output0, Output1; disabled
subtraction_28 = Subtraction(A=complex_17.Imaginary, B=complex_18.Imaginary)  # disabled
combine_3 = CombineData(Input0=sift_6.Output1, Input1=sift_7.Output1)  # -> Result, Index; disabled
panel_72 = Panel(complex_17.Real)  # disabled
division_7 = Division(A=subtraction_25, B=subtraction_27)  # disabled
division_8 = Division(A=subtraction_28, B=subtraction_26)  # disabled
panel_73 = Panel(subtraction_27)  # disabled
panel_74 = Panel(equals_8.Equality)  # disabled
k1_3 = Number(division_8)  # disabled
multiplication_7 = Multiplication(A=k1_3, B=complex_18.Real)  # disabled
k2_2 = Number(division_7)  # disabled
multiplication_8 = Multiplication(A=k2_2, B=complex_16.Real)  # disabled
subtraction_29 = Subtraction(A=complex_18.Imaginary, B=multiplication_7)  # disabled
panel_75 = Panel(k1_3)  # disabled
subtraction_30 = Subtraction(A=complex_16.Imaginary, B=multiplication_8)  # disabled
subtraction_31 = Subtraction(A=k1_3, B=k2_2)  # disabled
b1_3 = Number(subtraction_29)  # disabled
dom_3 = ConstructDomain(DomainStart=complex_17.Real, DomainEnd=complex_18.Real)  # disabled
b2_2 = Number(subtraction_30)  # disabled
dom_4 = ConstructDomain(DomainStart=complex_15.Real, DomainEnd=complex_16.Real)  # disabled
subtraction_32 = Subtraction(A=b2_2, B=b1_3)  # disabled
nullrep = ReplaceNulls(Items=k1_3, Replacements=complex_17.Real)  # -> Items, Count; disabled
division_9 = Division(A=subtraction_32, B=subtraction_31)  # disabled
panel_76 = Panel(division_9)  # disabled
inc_3 = Includes(Value=division_9, Domain=dom_3)  # -> Includes, Deviation; disabled
inc_4 = Includes(Value=division_9, Domain=dom_4)  # -> Includes, Deviation; disabled
multiplication_9 = Multiplication(A=division_9, B=k2_2)  # disabled
panel_77 = Panel(nullrep.Items)  # disabled
nullrep_2 = ReplaceNulls(Items=division_9, Replacements=combine_3.Result)  # -> Items, Count; disabled
int_9 = Integer(inc_3.Includes)  # disabled
int_10 = Integer(inc_4.Includes)  # disabled
addition_18 = Addition(A=multiplication_9, B=b2_2)  # disabled
addition_19 = Addition(A=int_9, B=int_10)  # disabled
subtraction_33 = Subtraction(A=panel_69, B=addition_19)  # disabled
extendlinecount_2 = Integer(subtraction_33)  # disabled
intersection_x_2 = Number(division_9)  # disabled
intersection_y_2 = Number(addition_18)  # disabled
pt_11 = PointOriented(BasePlane=xy_3, UComponent=intersection_x_2, VComponent=intersection_y_2, WComponent=0)  # disabled
panel_78 = Panel(extendlinecount_2)  # disabled
sift_8 = SiftPattern(List=pt_11, SiftPattern=extendlinecount_2)  # -> Output0, Output1, Output2; disabled
intersectionontwolines_2 = Point(sift_8.Output0)  # disabled
intersectionononeline_2 = Point(sift_8.Output1)  # disabled
intersectiononextend_2 = Point(sift_8.Output2)  # disabled

xy_4 = XYPlane(Origin=Point(0, 0, 0))  # disabled
sift_9 = SiftPattern(List=division_9, SiftPattern=extendlinecount_2)  # -> Output0, Output1, Output2; disabled
sift_10 = SiftPattern(List=addition_18, SiftPattern=extendlinecount_2)  # -> Output0, Output1, Output2; disabled
pt_12 = PointOriented(BasePlane=xy_4, UComponent=sift_9.Output0, VComponent=sift_10.Output0, WComponent=0)  # disabled
flatten_7 = FlattenTree(Tree=pt_12, Path="{0}")  # disabled
clean_7 = CleanTree(RemoveNulls=True, RemoveInvalid=True, RemoveEmpty=False, Tree=flatten_7)  # disabled
pt_13 = Point(Point(-2.015690168, -16.36521091, 0))  # disabled
panel_79 = Panel("2")  # disabled
partition_2 = PartitionList(List=clean_7, Size=panel_79)  # disabled
bang_2 = ExplodeTree(Data=partition_2)  # -> Branch0, Branch1; disabled
rev_2 = ReverseList(List=bang_2.Branch1)  # disabled
merge_6 = Merge(Data1=bang_2.Branch0, Data2=rev_2)  # -> flatten(Result); disabled
pline_3 = PolyLine(Vertices=merge_6, Closed=True)  # disabled

# ---- group: vector match method 1 simplify
# 问题在于，当某一path缺少时，替换的内容仍然会配对，造成数据多余错误
# 要探测出缺少的路径
# statistics-->DePath
# 最后拍平后替换路径
entwine_3 = Entwine(Branch00=panel_26, Branch01=panel_25, Branch02=panel_27, Branch03=panel_28, FlattenInputs=True)  # -> simplify(Result)
flatten_8 = FlattenTree(Tree=concat_5, Path="{0}")
mindex_10 = MemberIndex(Set=entwine_3, Member=flatten_8)  # -> Index, Count
clean_8 = CleanTree(RemoveNulls=True, RemoveInvalid=True, RemoveEmpty=True, Tree=mindex_10.Index)
pshift_3 = ShiftPaths(Data=clean_8, Offset=-1)
viewer_4 = ParamViewer(clean_8)

tstat_8 = TreeStatistics(Tree=pshift_3)  # -> Paths, Length, Count
dpath = DeconstructPath(Branch=tstat_8.Paths)  # -> simplify(Indices)

graft_7 = GraftTree(Tree=tstat_8.Length, IncludeEmptyLists=True, IncludeNullItems=True)
series_14 = Series(Start=0, Step=1, Count=graft_7)
int_11 = Integer(simplify(series_14))
replace_9 = ReplaceItems(List=pshift_3, Item=dpath, Indices=int_11, Wrap=False)
graft_8 = GraftTree(Tree=flatten(replace_9), IncludeEmptyLists=True, IncludeNullItems=True)
viewer_5 = ParamViewer(graft_8)
replace_10 = ReplacePaths(Data=graft_8, Search=viewer_5, Replace=viewer_4)
pshift_4 = ShiftPaths(Data=replace_10, Offset="1")
item_28 = ListItem(List=vec_3, Index=pshift_4, Wrap=True)
amp_8 = Amplitude(Vector=item_28, Amplitude=combine.Result)
vdis_4 = VectorDisplay(Anchor=pt_4, Vector=amp_8)

# ----
# explore a point position in space
line_9 = Line([Line((120.3761888, -60.82999189, 0), (120.4261985, -60.77899512, 0)), Line((120.4071159, -60.77735006, 0), (120.4317917, -60.84644247, 0)), Line((120.3676345, -60.80070987, 0), (120.440017, -60.81387033, 0))])
# debug:可以做，但是要改动很多，先放放，出现问题了再来
linelist_3 = Curve(line_9)
end_8 = EndPoints(Curve=linelist_3)  # -> Start, End
subtraction_34 = Subtraction(A=end_8.End, B=end_8.Start)
panel_80 = Panel("""处理k不存在的情况

写成函数
把坐标在相减后就分开来算

对实交和虚交的算法 不够缜密""")
xy_5 = XYPlane(Origin=Point(0, 0, 0))

panel_81 = Panel(subtraction_34)

startpoint_5 = Point(end_8.Start)
vec_7 = Vector(subtraction_34)

panel_82 = Panel(startpoint_5)
panel_84 = Panel(vec_7)

addition_20 = Addition(A=startpoint_5, B=vec_7)
endpoint_4 = Point(addition_20)
lng_10 = ListLength(List=addition_20)
lng_11 = ListLength(List=startpoint_5)
subtraction_35 = Subtraction(A=lng_10, B="1")
subtraction_36 = Subtraction(A=lng_11, B="1")
series_15 = Series(Start=0, Step=1, Count=subtraction_36)
series_16 = Series(Start=0, Step=1, Count=subtraction_35)
addition_21 = Addition(A=series_15, B="1")
addition_22 = Addition(A=series_16, B="1")
item_29 = ListItem(List=startpoint_5, Index=series_15, Wrap=False)  # -> simplify(graft(Item))
item_30 = ListItem(List=addition_20, Index=series_16, Wrap=False)  # -> simplify(graft(Item))
shift_16 = ShiftList(List=addition_20, Shift=addition_22, Wrap=False)  # -> simplify(List)
shift_17 = ShiftList(List=startpoint_5, Shift=addition_21, Wrap=False)  # -> simplify(List)

panel_86 = Panel(shift_16)

firstpt_line0_2 = Point(item_29)
firstpt_line1_2 = Point(shift_17)
endpt1_line1 = Point(shift_16)
endpt_line0_2 = Point(item_30)

panel_87 = Panel(item_29)

points_3 = PointList(Points=flatten(firstpt_line0_2), Size=Slider(6, range=0..100))

complex_19 = ComplexComponents(Complex=firstpt_line1_2)  # -> Real, Imaginary
complex_20 = ComplexComponents(Complex=endpt1_line1)  # -> Real, Imaginary
complex_21 = ComplexComponents(Complex=endpt_line0_2)  # -> Real, Imaginary
complex_22 = ComplexComponents(Complex=firstpt_line0_2)  # -> Real, Imaginary
subtraction_37 = Subtraction(A=complex_19.Imaginary, B=complex_20.Imaginary)
subtraction_38 = Subtraction(A=complex_19.Real, B=complex_20.Real)
subtraction_39 = Subtraction(A=complex_22.Real, B=complex_21.Real)
subtraction_40 = Subtraction(A=complex_22.Imaginary, B=complex_21.Imaginary)
division_10 = Division(A=subtraction_37, B=subtraction_38)
division_11 = Division(A=subtraction_40, B=subtraction_39)
k1_4 = Number(division_11)
k2_3 = Number(division_10)
multiplication_10 = Multiplication(A=k2_3, B=complex_19.Real)
subtraction_41 = Subtraction(A=complex_19.Imaginary, B=multiplication_10)
b2_3 = Number(subtraction_41)
subtraction_42 = Subtraction(A=k1_4, B=k2_3)

dom_5 = ConstructDomain(DomainStart=complex_22.Real, DomainEnd=complex_21.Real)
dom_6 = ConstructDomain(DomainStart=complex_22.Imaginary, DomainEnd=complex_21.Imaginary)
dom_7 = ConstructDomain(DomainStart=complex_19.Real, DomainEnd=complex_20.Real)
dom_8 = ConstructDomain(DomainStart=complex_19.Imaginary, DomainEnd=complex_20.Imaginary)

multiplication_11 = Multiplication(A=k1_4, B=complex_22.Real)
subtraction_43 = Subtraction(A=complex_22.Imaginary, B=multiplication_11)

equals_9 = Equality(FirstNumber=subtraction_38, SecondNumber="0")  # -> Equality, Inequality
equals_10 = Equality(FirstNumber=subtraction_39, SecondNumber="0")  # -> Equality, Inequality
sift_11 = SiftPattern(List=complex_20.Real, SiftPattern=equals_9.Equality)  # -> Output0, Output1
sift_12 = SiftPattern(List=complex_22.Real, SiftPattern=equals_10.Equality)  # -> Output0, Output1
or_4 = GateOr(A=equals_10.Equality, B=equals_9.Equality)
combine_4 = CombineData(Input0=sift_12.Output1, Input1=sift_11.Output1)  # -> Result, Index
sift_13 = SiftPattern(List=k2_3, SiftPattern=equals_9.Equality)  # -> Output0, Output1
sift_14 = SiftPattern(List=b2_3, SiftPattern=equals_9.Equality)  # -> Output0, Output1
sift_15 = SiftPattern(List=k1_4, SiftPattern=equals_10.Equality)  # -> Output0, Output1
combine_5 = CombineData(Input0=sift_15.Output0, Input1=sift_13.Output0)  # -> Result, Index
a_2 = Number(combine_4.Result)
k = Number(combine_5.Result)
multiplication_12 = Multiplication(A=a_2, B=k)
intersection_x_3 = Number(a_2)

b1_4 = Number(subtraction_43)
subtraction_44 = Subtraction(A=b2_3, B=b1_4)
division_12 = Division(A=subtraction_44, B=subtraction_42)
multiplication_13 = Multiplication(A=division_12, B=k2_3)
addition_23 = Addition(A=multiplication_13, B=b2_3)
sift_16 = SiftPattern(List=addition_23, SiftPattern=or_4)  # -> Output0, Output1

sift_17 = SiftPattern(List=b1_4, SiftPattern=equals_10.Equality)  # -> Output0, Output1
combine_6 = CombineData(Input0=sift_17.Output0, Input1=sift_14.Output0)  # -> Result, Index
b_2 = Number(combine_6.Result)
sift_18 = SiftPattern(List=b_2, SiftPattern=or_4)  # -> Output0, Output1
addition_24 = Addition(A=multiplication_12, B=sift_18.Output1)
intersection_y_3 = Number(addition_24)

combine_7 = CombineData(Input0=sift_16.Output0, Input1=intersection_y_3)  # -> Result, Index
combine_8 = CombineData(Input0=division_12, Input1=intersection_x_3)  # -> Result, Index

panel_88 = Panel(equals_10.Equality)
intersection_x_4 = Number(combine_8.Result)
intersection_y_4 = Number(combine_7.Result)
pt_14 = PointOriented(BasePlane=xy_5, UComponent=intersection_x_4, VComponent=intersection_y_4, WComponent=0)

# ----
# true --> real insection
# false --> extend
# 10,11 --> real insection
# 01       --> extend one line
# 00       --> extend two lines
# true   -- > extend one line
# false -->  extend two lines
dom_9 = ConstructDomain(DomainStart=complex_22.Imaginary, DomainEnd=complex_21.Imaginary)
dom_10 = ConstructDomain(DomainStart=complex_22.Real, DomainEnd=complex_21.Real)
dom_11 = ConstructDomain(DomainStart=complex_19.Real, DomainEnd=complex_20.Real)
dom_12 = ConstructDomain(DomainStart=complex_19.Imaginary, DomainEnd=complex_20.Imaginary)
firstpty_domain = Domain(dom_9)
firstptx_domain = Domain(dom_10)
endpty_domain = Domain(dom_12)
endptx_domain = Domain(dom_11)
inc_5 = Includes(Value=intersection_y_4, Domain=firstpty_domain)  # -> Includes, Deviation
inc_6 = Includes(Value=intersection_x_4, Domain=endptx_domain)  # -> Includes, Deviation
inc_7 = Includes(Value=intersection_y_4, Domain=endpty_domain)  # -> Includes, Deviation
inc_8 = Includes(Value=intersection_x_4, Domain=firstptx_domain)  # -> Includes, Deviation
or_5 = GateOr(A=inc_8.Includes, B=inc_5.Includes, C=inc_6.Includes, D=inc_7.Includes)
and_5 = GateAnd(A=inc_8.Includes, B=inc_5.Includes, C=inc_6.Includes, D=inc_7.Includes)
int_12 = Integer(or_5)
int_13 = Integer(and_5)
concat_8 = Concatenate(FragmentA=int_13, FragmentB=int_12)
panel_89 = Panel("""10
11
01
00""")
panel_90 = Panel("""0
0
1
2""")
keysearch = KeyValueSearch(Keys=panel_89, Values=panel_90, Search=concat_8)
extendlinecount_3 = Integer(keysearch)

# ----
# k1=k2,b1=b2 --> common line -->point or line
equals_11 = Equality(FirstNumber=k1_4, SecondNumber=k2_3)  # -> Equality, Inequality; disabled
equals_12 = Equality(FirstNumber=b1_4, SecondNumber=b2_3)  # -> Equality, Inequality; disabled
and_6 = GateAnd(A=equals_11.Equality, B=equals_12.Equality)  # disabled
dedomain = DeconstructDomain(Domain=firstptx_domain)  # -> Start, End; disabled
dedomain_2 = DeconstructDomain(Domain=firstpty_domain)  # -> Start, End; disabled
dedomain_3 = DeconstructDomain(Domain=endptx_domain)  # -> Start, End; disabled
dedomain_4 = DeconstructDomain(Domain=endpty_domain)  # -> Start, End; disabled
merge_7 = Merge(Data1=dedomain.Start, Data2=dedomain.End, Data3=dedomain_3.Start, Data4=dedomain_3.End)  # disabled
merge_8 = Merge(Data1=dedomain_2.Start, Data2=dedomain_2.End, Data3=dedomain_4.Start, Data4=dedomain_4.End)  # disabled
sort_2 = SortList(Keys=merge_7)  # -> Keys, ValuesA; disabled
sort_3 = SortList(Keys=merge_8)  # -> Keys, ValuesA; disabled
panel_91 = Panel("1")  # disabled
panel_92 = Panel("1")  # disabled
item_31 = ListItem(List=sort_2.Keys, Index=panel_91, Wrap=False)  # -> Item, Item1; disabled
item_32 = ListItem(List=sort_3.Keys, Index=panel_92, Wrap=False)  # -> Item, Item1; disabled
panel_93 = Panel("2")  # disabled
panel_94 = Panel("2")  # disabled
addition_25 = Addition(A=item_32.Item, B=item_32.Item1)  # disabled
addition_26 = Addition(A=item_31.Item, B=item_31.Item1)  # disabled
division_13 = Division(A=addition_25, B=panel_94)  # disabled
division_14 = Division(A=addition_26, B=panel_93)  # disabled

sift_19 = SiftPattern(List=pt_14, SiftPattern=extendlinecount_3)  # -> Output0, Output1, Output2
intersectionontwolines_3 = Point(sift_19.Output0)
intersectionononeline_3 = Point(sift_19.Output1)
intersectiononextend_3 = Point(sift_19.Output2)
panel_95 = Panel(intersectionontwolines_3)

firstpt0_4 = Point(firstpt_line0)
firstpt1_3 = Point(firstpt_line1)
endpt0_4 = Point(endpt_line0)
endpt1_3 = Point(endpt_line1)
points_4 = PointList(Points=flatten(firstpt0_4), Size=Slider(0.109, range=0..3))
complex_23 = ComplexComponents(Complex=firstpt0_4)  # -> Real, Imaginary
complex_24 = ComplexComponents(Complex=firstpt1_3)  # -> Real, Imaginary
complex_25 = ComplexComponents(Complex=endpt1_3)  # -> Real, Imaginary
complex_26 = ComplexComponents(Complex=endpt0_4)  # -> Real, Imaginary
subtraction_45 = Subtraction(A=complex_24.Imaginary, B=complex_25.Imaginary)
subtraction_46 = Subtraction(A=complex_24.Real, B=complex_25.Real)
equals_13 = Equality(FirstNumber=subtraction_46, SecondNumber="0")  # -> Equality, Inequality
sift_20 = SiftPattern(List=complex_25.Real, SiftPattern=equals_13.Equality)  # -> Output0, Output1
subtraction_47 = Subtraction(A=complex_23.Imaginary, B=complex_26.Imaginary)
subtraction_48 = Subtraction(A=complex_23.Real, B=complex_26.Real)
equals_14 = Equality(FirstNumber=subtraction_48, SecondNumber="0")  # -> Equality, Inequality
sift_21 = SiftPattern(List=complex_23.Real, SiftPattern=equals_14.Equality)  # -> Output0, Output1
or_6 = GateOr(A=equals_14.Equality, B=equals_13.Equality)
combine_9 = CombineData(Input0=sift_21.Output1, Input1=sift_20.Output1)  # -> Result, Index
division_15 = Division(A=subtraction_45, B=subtraction_46)
division_16 = Division(A=subtraction_47, B=subtraction_48)
panel_96 = Panel("""处理k不存在的情况

写成函数
把坐标在相减后就分开来算""")
k1_5 = Number(division_16)
multiplication_14 = Multiplication(A=k1_5, B=complex_23.Real)
sift_22 = SiftPattern(List=k1_5, SiftPattern=equals_14.Equality)  # -> Output0, Output1
subtraction_49 = Subtraction(A=complex_23.Imaginary, B=multiplication_14)
b1_5 = Number(subtraction_49)
sift_23 = SiftPattern(List=b1_5, SiftPattern=equals_14.Equality)  # -> Output0, Output1
k2_4 = Number(division_15)
multiplication_15 = Multiplication(A=k2_4, B=complex_24.Real)
sift_24 = SiftPattern(List=k2_4, SiftPattern=equals_13.Equality)  # -> Output0, Output1
subtraction_50 = Subtraction(A=complex_24.Imaginary, B=multiplication_15)
combine_10 = CombineData(Input0=sift_22.Output0, Input1=sift_24.Output0)  # -> Result, Index
b2_4 = Number(subtraction_50)
sift_25 = SiftPattern(List=b2_4, SiftPattern=equals_13.Equality)  # -> Output0, Output1
combine_11 = CombineData(Input0=sift_23.Output0, Input1=sift_25.Output0)  # -> Result, Index
subtraction_51 = Subtraction(A=b2_4, B=b1_5)
b_3 = Number(combine_11.Result)
a_3 = Number(combine_9.Result)
k_2 = Number(combine_10.Result)
subtraction_52 = Subtraction(A=k1_5, B=k2_4)
sift_26 = SiftPattern(List=b_3, SiftPattern=or_6)  # -> Output0, Output1
multiplication_16 = Multiplication(A=a_3, B=k_2)
division_17 = Division(A=subtraction_51, B=subtraction_52)
multiplication_17 = Multiplication(A=division_17, B=k2_4)
addition_27 = Addition(A=multiplication_17, B=b2_4)
sift_27 = SiftPattern(List=addition_27, SiftPattern=or_6)  # -> Output0, Output1
addition_28 = Addition(A=multiplication_16, B=sift_26.Output1)
intersection_x_5 = Number(a_3)
intersection_y_5 = Number(addition_28)
combine_12 = CombineData(Input0=sift_27.Output0, Input1=intersection_y_5)  # -> Result, Index
combine_13 = CombineData(Input0=division_17, Input1=intersection_x_5)  # -> Result, Index
intersection_x_6 = Number(combine_13.Result)
intersection_y_6 = Number(combine_12.Result)
xy_6 = XYPlane(Origin=Point(0, 0, 0))
pt_15 = PointOriented(BasePlane=xy_6, UComponent=intersection_x_6, VComponent=intersection_y_6, WComponent=0)

# ----
# true --> real insection
# false --> extend
# 10,11 --> real insection
# 01       --> extend one line
# 00       --> extend two lines
# true   -- > extend one line
# false -->  extend two lines
dom_13 = ConstructDomain(DomainStart=complex_23.Imaginary, DomainEnd=complex_26.Imaginary)
dom_14 = ConstructDomain(DomainStart=complex_23.Real, DomainEnd=complex_26.Real)
dom_15 = ConstructDomain(DomainStart=complex_24.Real, DomainEnd=complex_25.Real)
dom_16 = ConstructDomain(DomainStart=complex_24.Imaginary, DomainEnd=complex_25.Imaginary)
firstpty_domain_2 = Domain(dom_13)
firstptx_domain_2 = Domain(dom_14)
endpty_domain_2 = Domain(dom_16)
endptx_domain_2 = Domain(dom_15)
inc_9 = Includes(Value=intersection_y_6, Domain=firstpty_domain_2)  # -> Includes, Deviation
inc_10 = Includes(Value=intersection_x_6, Domain=endptx_domain_2)  # -> Includes, Deviation
inc_11 = Includes(Value=intersection_y_6, Domain=endpty_domain_2)  # -> Includes, Deviation
inc_12 = Includes(Value=intersection_x_6, Domain=firstptx_domain_2)  # -> Includes, Deviation
or_7 = GateOr(A=inc_12.Includes, B=inc_9.Includes, C=inc_10.Includes, D=inc_11.Includes)
and_7 = GateAnd(A=inc_12.Includes, B=inc_9.Includes, C=inc_10.Includes, D=inc_11.Includes)
int_14 = Integer(or_7)
int_15 = Integer(and_7)
concat_9 = Concatenate(FragmentA=int_15, FragmentB=int_14)
panel_97 = Panel("""10
11
01
00""")
panel_98 = Panel("""0
0
1
2""")
keysearch_2 = KeyValueSearch(Keys=panel_97, Values=panel_98, Search=concat_9)
extendlinecount_4 = Integer(keysearch_2)

panel_99 = Panel(pt_15)

sift_28 = SiftPattern(List=pt_15, SiftPattern=extendlinecount_4)  # -> Output0, Output1, Output2
intersectionontwolines_4 = Point(sift_28.Output0)
intersectionononeline_4 = Point(sift_28.Output1)
intersectiononextend_4 = Point(sift_28.Output2)
panel_100 = Panel(intersectionontwolines_4)
