# Grasshopper definition 20161011_PE_points_intersection_009_vectorElection_debugPrecision.gh (Grasshopper 0.9.76)

panel = Panel("""0
0.4
1
1.5
1.5
1.92

2.05
2.1
2.4
2.3
2.3
2.1
3
3.12
3.11
3.12""")
panel_2 = Panel("""0
1
2
3
2
2
3
1
2
1
0
0
2
0
1
3""")
# kernel intersection algorithm 002_siftPoint
panel_3 = Panel("""0
2
1
3""")

# ----
# log:
# 20161010
# 设计向量方向与数据结构之间的映射关系
# 数据结构用集合运算然后替换
# 替换树形结构的时候需要拍平
# 无论什么情况都留出0123正交的位置为Null
# 如果0123存在，没关系，不存在，插入一个空值
# 20161011
# 角度和path之间的映射关系，以及角度的识别
# 线交的算法与path之间多对多的关系
pi = Pi(Factor="2")
# log:
# 20161010
# 如果0123存在，没关系，不存在，插入一个空值
# 光是插入一个空值也是不行，修改标签运算的算法使其更合理:原因是set的时候把null去掉了
# 应该是插入不是替换
# 不是插入一个Null就能解决问题的，问题处在了member的寻找上，寻找时候把null数据给删除了，结果找不到对应的path
random = Random(Range=pi, Number="20", Seed=Slider(33.222, range=0..100))

pi_2 = Pi(Factor=1)
ins = InsertItems(List=random, Item=pi_2, Indices="0", Wrap=True)

# ----
# Point:indicate a position in space
# Line:length,direction,position
# Point
# two ends of the line
# the intersection of two lines
# the meeting of lines at the corner of a space or volumn
# the center of field
panel_4 = Panel("""0
0.4
1
1.5
1.5
1.92

2.05
2.1
2.4
2.3
2.3
2.1
3
3.12
3.11
3.12""")
panel_5 = Panel("""0
1
2
3
2
2
3
1
2
1
0
0
2
0
1
3""")

# ----
# mapping between angle and path
# {0;0} --> 0
# {1;0} --> 1/2*pi
# {2;0} --> pi
# {3;0} --> 3/2*pi
# 当向量中不存在某正交方向时候为Null
# vectorPath00_can't identify reverse vectors
panel_6 = Panel("2")
pi_3 = Pi(Factor=panel_6)
num = Number(panel)
remap = RemapNumbers(Value=num, Source="4", Target=pi_3)  # -> Mapped, Clipped
pi_4 = Pi(Factor=1)
sort = SortList(Keys=remap.Mapped)  # -> Keys, ValuesA
division = Division(A=pi_4, B="2")
series = Series(Start=0, Step=division, Count="5")
consec = ConsecutiveDomains(Numbers=series, Additive=False)  # -> simplify(Domains)
domain = Domain(graft(consec))
# log:
# 20161010
# 不是插入一个Null就能解决问题的，问题处在了member的寻找上，寻找时候把null数据给删除了，结果找不到对应的path:
# 找到替换的member的运算器
# 发现前馈需要一大堆的运算器，先做成后馈
angle = Number(sort.Keys)
dedomain = DeconstructDomain(Domain=domain)  # -> Start, End
larger = LargerThan(FirstNumber=angle, SecondNumber=dedomain.Start)  # -> LargerThan, OrEqualTo
smaller = SmallerThan(FirstNumber=angle, SecondNumber=dedomain.End)  # -> SmallerThan, OrEqualTo
and = GateAnd(A=larger.OrEqualTo, B=smaller.SmallerThan)
sift = SiftPattern(List=angle, SiftPattern=and)  # -> Output0, Output1
# log:
# 20161010
# 设计向量方向与数据结构之间的映射关系
# 数据结构用集合运算然后替换
# 替换树形结构的时候需要拍平
# 无论什么情况都留出0123正交的位置为Null
# 如果0123存在，没关系，不存在，插入一个空值
# 20161011
# 角度和path之间的映射关系，以及角度的识别:
# 先正交的位置关系，后自由的位置关系
# 如何识别path知道非正交的相反的向量
# 增强path的排序的算法前馈，可通过path运算直接得到向量关系
clean = CleanTree(RemoveNulls=True, RemoveInvalid=True, RemoveEmpty=False, Tree=sift.Output1)  # -> simplify(Tree)
item = ListItem(List=clean, Index="0", Wrap=True)
equals = Equality(FirstNumber=item, SecondNumber=simplify(dedomain.Start))  # -> Equality, Inequality
int = Integer(equals.Inequality)
ins_2 = InsertItems(List=clean, Indices="0", Wrap=True)
neg = Negative(Value=int)
cull_i = CullIndex(List=ins_2, Indices=neg, Wrap=False)  # -> simplify(List)
num_2 = Number(cull_i)
cset = CreateSet(List=num_2)  # -> Set, Map
addition = Addition(A=cset.Map, B=int)
tstat = TreeStatistics(Tree=addition)  # -> Paths, Length, Count
dpath = DeconstructPath(Branch=tstat.Paths)
graft = GraftTree(Tree=addition, IncludeEmptyLists=True, IncludeNullItems=True)
stack = StackData(Data=dpath, Stack=graft(tstat.Length))
graft_2 = GraftTree(Tree=cull_i, IncludeEmptyLists=True, IncludeNullItems=True)
graft_3 = GraftTree(Tree=stack, IncludeEmptyLists=True, IncludeNullItems=True)  # -> simplify(Tree)
ins_3 = InsertItems(List=graft_3, Item=graft, Indices="-1", Wrap=True)
path = ConstructPath(Indices=ins_3)  # -> simplify(Branch)
viewer = ParamViewer(graft_2)
flatten = FlattenTree(Tree=path, Path="{0}")
flatten_2 = FlattenTree(Tree=cull_i, Path="{0}")
replace = ReplacePaths(Data=graft_2, Search=viewer, Replace=flatten)
graft_4 = GraftTree(Tree=sort.Keys, IncludeEmptyLists=True, IncludeNullItems=True)  # -> simplify(Tree)
keysearch = KeyValueSearch(Keys=flatten_2, Values=flatten, Search=graft_4)

jitter = Jitter(List=panel_5, Jitter=1, Seed=2)  # -> Values, Indices
panel_7 = Panel("""2.5838678
Pi
1.6421
3.212896
1.5*Pi""")

# ----
# ErrorSample0
toggle = BooleanToggle(True)
panel_8 = Panel("""tim
my""")
panel_9 = Panel([toggle, Toggle(False)])
series_2 = Series(Start=0, Step=1, Count=10)
panel_10 = Panel("""5
7""")
bool = Boolean(panel_9)
sift_2 = SiftPattern(List=panel_8, SiftPattern=bool)  # -> Output0, Output1
ins_4 = InsertItems(List=series_2, Item=sift_2.Output1, Indices=panel_10, Wrap=True)  # -> simplify(List)
clean_2 = CleanTree(RemoveNulls=True, RemoveInvalid=True, RemoveEmpty=False, Tree=ins_4)

# ----
# ErrorSample1-DataTree
toggle_2 = BooleanToggle(True)
panel_11 = Panel([Toggle(True), Toggle(False), toggle_2])
panel_12 = Panel("""tim
my
name""")
bool_2 = Boolean(panel_11)
series_3 = Series(Start=0, Step=1, Count=3)  # -> simplify(graft(Series))
graft_5 = GraftTree(Tree="0", IncludeEmptyLists=True, IncludeNullItems=True)  # -> graft(Tree)
sift_3 = SiftPattern(List=graft(panel_12), SiftPattern=graft(bool_2))  # -> Output0, Output1
ins_5 = InsertItems(List=series_3, Item=sift_3.Output1, Indices=graft_5, Wrap=True)  # -> simplify(List)
clean_3 = CleanTree(RemoveNulls=True, RemoveInvalid=True, RemoveEmpty=False, Tree=ins_5)
panel_13 = Panel(clean_3)

# ----
# Sample2-cleanTree
toggle_3 = BooleanToggle(False)
panel_14 = Panel([Toggle(False), Toggle(True), toggle_3])
panel_15 = Panel("""tim
my
name""")
bool_3 = Boolean(panel_14)
series_4 = Series(Start=0, Step=1, Count=3)  # -> simplify(graft(Series))
graft_6 = GraftTree(Tree="0", IncludeEmptyLists=True, IncludeNullItems=True)  # -> graft(Tree)
sift_4 = SiftPattern(SiftPattern=graft(bool_3))  # -> Output0, Output1
ins_6 = InsertItems(List=series_4, Item=sift_4.Output1, Indices=graft_6, Wrap=True)  # -> simplify(List)
clean_4 = CleanTree(RemoveNulls=True, RemoveInvalid=True, RemoveEmpty=False, Tree=ins_6)
panel_16 = Panel(clean_4)

# ----
# log:
# 20161010
# 应该是插入不是替换：
# 连一个新电池，是True就插入，False就不插入
# 简短的并不需要连接电池
# 插入的应该是一个Null值，而不是正交角度
# instance
panel_17 = Panel("0")
item_2 = ListItem(List=clean, Index=panel_17, Wrap=True)
equals_2 = Equality(FirstNumber=item_2, SecondNumber=simplify(dedomain.Start))  # -> Equality, Inequality
num_3 = Number(clean)
neg_2 = Negative(Value=equals_2.Inequality)
ins_7 = InsertItems(List=num_3, Indices=graft("0"), Wrap=True)
cull_i_2 = CullIndex(List=ins_7, Indices=neg_2, Wrap=False)  # -> simplify(List)

# ----
# log:
# 20161010
# 插入的应该是一个Null值，而不是正交角度:
# 先保留空值，后根据boolean删除Null
# 插入一个空值的方法：
# 运用cull index运算器本身的性质，对布尔值进行negetive后删除不需要的空值
toggle_4 = BooleanToggle(False)
series_5 = Series(Start=0, Step=1, Count=3)  # -> simplify(graft(Series))
graft_7 = GraftTree(Tree="0", IncludeEmptyLists=True, IncludeNullItems=True)  # -> graft(Tree)
panel_18 = Panel([Toggle(False), Toggle(True), toggle_4])
bool_4 = Boolean(panel_18)
ins_8 = InsertItems(List=series_5, Indices=graft_7, Wrap=True)  # -> simplify(List)
int_2 = Integer(bool_4)
neg_3 = Negative(Value=int_2)
cull_i_3 = CullIndex(List=ins_8, Indices=graft(neg_3), Wrap=False)
panel_19 = Panel(cull_i_3)

panel_20 = Panel(ins_5)
panel_21 = Panel(clean_2)

# ----
# sample_treeStatistics
cset_2 = CreateSet(List=num_2)  # -> Set, Map
tstat_2 = TreeStatistics(Tree=cset_2.Map)  # -> Paths, Length, Count
dpath_2 = DeconstructPath(Branch=tstat_2.Paths)
stack_2 = StackData(Data=dpath_2, Stack=graft(tstat_2.Length))
graft_8 = GraftTree(Tree=cset_2.Map, IncludeEmptyLists=True, IncludeNullItems=True)
graft_9 = GraftTree(Tree=stack_2, IncludeEmptyLists=True, IncludeNullItems=True)  # -> simplify(Tree)
ins_9 = InsertItems(List=graft_9, Item=graft_8, Indices="-1", Wrap=True)
path_2 = ConstructPath(Indices=ins_9)  # -> simplify(Branch)
flatten_3 = FlattenTree(Tree=path_2, Path="{0}")

# ----
# 记得替换数据结构的时候拍平
num_4 = Number(clean)
cset_3 = CreateSet(List=num_4)  # -> Set, Map
graft_10 = GraftTree(Tree=num_4, IncludeEmptyLists=True, IncludeNullItems=True)
flatten_4 = FlattenTree(Tree=cset_3.Set, Path="{0}")
graft_11 = GraftTree(Tree=cset_3.Set, IncludeEmptyLists=True, IncludeNullItems=True)
viewer_2 = ParamViewer(graft_10)
mindex = MemberIndex(Set=flatten_4, Member=num_4)  # -> Index, Count
tstat_3 = TreeStatistics(Tree=graft_11)  # -> Paths, Length, Count
item_3 = ListItem(List=tstat_3.Paths, Index=mindex.Index, Wrap=True)  # -> flatten(Item)
replace_2 = ReplacePaths(Data=graft_10, Search=viewer_2, Replace=item_3)

panel_22 = Panel(graft_4)

pshift = ShiftPaths(Data=replace_2, Offset=-1)
item_4 = ListItem(List=pshift, Index="0", Wrap=True)
equals_3 = Equality(FirstNumber=item_4, SecondNumber=simplify(dedomain.Start))  # -> Equality, Inequality
int_3 = Integer(equals_3.Inequality)
ins_10 = InsertItems(List=pshift, Indices="0", Wrap=True)
neg_4 = Negative(Value=int_3)
cull_i_4 = CullIndex(List=ins_10, Indices=neg_4, Wrap=False)  # -> simplify(List)

flatten_5 = FlattenTree(Tree=cull_i_4, Path="{0}")
null = NullItem(Item=flatten_5)  # -> NullFlags, InvalidFlags, Description
tstat_4 = TreeStatistics(Tree=replace_2)  # -> Paths, Length, Count
mindex_2 = MemberIndex(Set=null.NullFlags, Member=Toggle(True))  # -> Index, Count
int_4 = Integer(tstat_4.Length)
ins_11 = InsertItems(List=int_4, Item="1", Indices=mindex_2.Index, Wrap=True)
partition = PartitionList(List=flatten_5, Size=ins_11)  # -> simplify(Chunks)
viewer_3 = ParamViewer(partition)
viewer_4 = ParamViewer(replace_2)
replace_3 = ReplacePaths(Data=partition, Search=viewer_3, Replace=viewer_4)

panel_23 = Panel(keysearch)
panel_24 = Panel("""0
0.4
1
1.5
1.5
1.92
2
2.05
2.1
2.4
2.3
2.3
2.1
3
3.12
3.11
3.12""")
panel_26 = Panel("""0
1
0
1.3
3
1
2.3
2""")
line = Line(Line((119.3393443, -60.78584412, 0), (119.6525493, -60.78584412, 0)))
line_2 = Line(Line((119.8096632, -60.78584412, 0), (119.4931182, -60.78584412, 0)))
panel_27 = Panel("运算器存在bug")
jitter_2 = Jitter(List=panel_26, Jitter=1, Seed=2)  # -> Values, Indices
ccx = CurveCurve(CurveA=line, CurveB=line_2)  # -> Points, ParamsA, ParamsB
pi_5 = Pi(Factor=1)

# ----
# log:
# 20161012
# debug时候replacePath爆红:
# 删除空的树形数据结构，merge的时候数据结构对应
# 精度问题导致set不能去掉原本偏差相同的角度：
# 用round函数取到小数点后几位，关键是排序，这样做就不会对原来的数据产生什么影响，是标签改对了
panel_28 = Panel("9.223234")
num_5 = Number(panel_28)
eval = Evaluate(F="round(x,4)", x=num_5)
panel_29 = Panel(eval)

pi_6 = Pi(Factor="0.5")
# log:
# 20161011
# 增强path的排序的算法前馈，可通过path运算直接得到向量关系:
# 排序前后问题：
# 先精确控制还是先离散问题
num_6 = Number("1.6421")
line_bug_commonline = Line([Line((119.3540923, -60.56923774, 0), (119.5008735, -60.56923774, 0)), Line((119.5919791, -60.56923774, 0), (119.7404475, -60.56923774, 0))])
# debug:之前判断是实交和虚交的方法是判断交点point的x坐标是否在两线段的值域范围内，但是当上述情况的时候，直线会虚交被误判成实际交点
line_bug_insectiononextend = Line([Line((119.0174668, -60.28107794, 0), (119.4638718, -60.28107794, 0)), Line((119.2255633, -60.35451331, 0), (119.2255633, -61.15203638, 0))])
# log:
# 20161010
# 设计向量方向与数据结构之间的映射关系
# 分离对应的算法，让算法之间有通过也有分离
# 线线重合的问题解决后先放在一旁
# 数据结构的替换，在最后做
line_3 = Line([Line((119.5723897, -60.99532941, 0), (119.5723897, -61.13933165, 0)), Line((119.5723897, -60.99532941, 0), (119.7626783, -60.99532941, 0))])
addition_2 = Addition(A=num_6, B=pi_6)
panel_30 = Panel("把正交和斜交的情况分离开来，同时组织数据结构")
panel_31 = Panel(addition_2)
panel_32 = Panel("""2.5838678
Pi
1.6421
3.212896
1.5*Pi""")

# ----
# vectorPath01
# mapping between angle and path
# {0;0} --> 0
# {1;0} --> 1/2*pi
# {2;0} --> pi
# {3;0} --> 3/2*pi
# 无所谓正交向量存不存在
pi_7 = Pi(Factor=1)
division_2 = Division(A=pi_7, B="2")
series_6 = Series(Start=0, Step=division_2, Count="5")
consec_2 = ConsecutiveDomains(Numbers=series_6, Additive=False)  # -> simplify(Domains)
domain_2 = Domain(graft(consec_2))
pi_8 = Pi(Factor="2")
num_7 = Number(jitter_2.Values)
dedomain_2 = DeconstructDomain(Domain=domain_2)  # -> simplify(Start), simplify(End)
remap_2 = RemapNumbers(Value=num_7, Source="4", Target=pi_8)  # -> Mapped, Clipped
num_8 = Number(dedomain_2.Start)
angle_2 = Number(panel_32)
larger_2 = LargerThan(FirstNumber=angle_2, SecondNumber=dedomain_2.Start)  # -> LargerThan, OrEqualTo
smaller_2 = SmallerThan(FirstNumber=angle_2, SecondNumber=dedomain_2.End)  # -> SmallerThan, OrEqualTo
and_2 = GateAnd(A=larger_2.OrEqualTo, B=smaller_2.SmallerThan)
sift_5 = SiftPattern(List=angle_2, SiftPattern=and_2)  # -> Output0, Output1
clean_5 = CleanTree(RemoveNulls=True, RemoveInvalid=True, RemoveEmpty=False, Tree=sift_5.Output1)  # -> simplify(Tree)
tstat_5 = TreeStatistics(Tree=clean_5)  # -> Paths, Length, Count
bool_5 = Boolean(tstat_5.Length)
sift_6 = SiftPattern(List=num_8, SiftPattern=graft(bool_5))  # -> Output0, Output1
clean_6 = CleanTree(RemoveNulls=True, RemoveInvalid=False, RemoveEmpty=True, Tree=sift_6.Output1)  # -> simplify(Tree)
clean_7 = CleanTree(RemoveNulls=True, RemoveInvalid=False, RemoveEmpty=True, Tree=sift_5.Output1)  # -> simplify(Tree)
graft_12 = GraftTree(Tree=angle_2, IncludeEmptyLists=True, IncludeNullItems=True)
subtraction = Subtraction(A=clean_7, B=clean_6)
num_9 = Number(subtraction)
num_10 = Number(clean_7)
eval_2 = Evaluate(F="round(x,4)", x=num_9)
flatten_6 = FlattenTree(Tree=eval_2, Path="{0}")
cset_4 = CreateSet(List=flatten_6)  # -> Set, Map
sort_2 = SortList(Keys=cset_4.Set)  # -> Keys, ValuesA
mindex_3 = MemberIndex(Set=sort_2.Keys, Member=eval_2)  # -> Index, Count
pshift_2 = ShiftPaths(Data=mindex_3.Index, Offset=-1)
flatten_7 = FlattenTree(Tree=mindex_3.Index, Path="{0}")
tstat_6 = TreeStatistics(Tree=pshift_2)  # -> Paths, Length, Count
dpath_3 = DeconstructPath(Branch=tstat_6.Paths)
graft_13 = GraftTree(Tree=flatten_7, IncludeEmptyLists=True, IncludeNullItems=True)  # -> simplify(Tree)
stack_3 = StackData(Data=dpath_3, Stack=graft(tstat_6.Length))
flatten_8 = FlattenTree(Tree=stack_3, Path="{0}")
graft_14 = GraftTree(Tree=flatten_8, IncludeEmptyLists=True, IncludeNullItems=True)  # -> simplify(Tree)
merge = Merge(Data1=graft_14, Data2=graft_13)
path_3 = ConstructPath(Indices=merge)
flatten_9 = FlattenTree(Tree=path_3, Path="{0}")
graft_15 = GraftTree(Tree=num_10, IncludeEmptyLists=True, IncludeNullItems=True)
flatten_10 = FlattenTree(Tree=graft_15, Path="{0}")
viewer_5 = ParamViewer(graft_15)
keysearch_2 = KeyValueSearch(Keys=flatten_10, Values=flatten_9, Search=graft_12)  # -> simplify(Result)
replace_4 = ReplacePaths(Data=graft_15, Search=viewer_5, Replace=flatten_9)

# ----
# revise precision 01
lng = ListLength(List=subtraction)  # -> flatten(Length)
flatten_11 = FlattenTree(Tree=subtraction, Path="{0}")
partition_2 = PartitionList(List=num_9, Size=lng)  # -> simplify(Chunks)
num_11 = Number(flatten_11)
lng_2 = ListLength(List=num_11)
neg_5 = Negative(Value="1")
subtraction_2 = Subtraction(A=lng_2, B="1")
series_7 = Series(Start="1", Step=1, Count=subtraction_2)
shift = ShiftList(List=num_11, Shift=neg_5, Wrap=False)  # -> simplify(List)
shift_2 = ShiftList(List=num_11, Shift=series_7, Wrap=False)  # -> simplify(List)
graft_16 = GraftTree(Tree=shift, IncludeEmptyLists=True, IncludeNullItems=True)  # -> simplify(Tree)
subtraction_3 = Subtraction(A=graft_16, B=shift_2)
percision = Number("0.00001")
abs = Absolute(Value=subtraction_3)
larger_3 = LargerThan(FirstNumber=abs, SecondNumber="0")  # -> LargerThan, OrEqualTo
smaller_3 = SmallerThan(FirstNumber=abs, SecondNumber=percision)  # -> SmallerThan, OrEqualTo
num_12 = Number(shift_2)
and_3 = GateAnd(A=smaller_3.SmallerThan, B=larger_3.LargerThan)
sift_7 = SiftPattern(List=num_12, SiftPattern=and_3)  # -> Output0, Output1
clean_8 = CleanTree(RemoveNulls=True, RemoveInvalid=True, RemoveEmpty=False, Tree=sift_7.Output1)
tstat_7 = TreeStatistics(Tree=clean_8)  # -> Paths, Length, Count
int_5 = Integer("1")
flatten_12 = FlattenTree(Tree=clean_8, Path="{0}")
mindex_4 = MemberIndex(Set=tstat_7.Length, Member=int_5)  # -> Index, Count
replace_5 = ReplaceItems(List=num_11, Item=flatten_12, Indices=mindex_4.Index, Wrap=False)  # -> simplify(flatten(List))
num_13 = Number(replace_5)

panel_33 = Panel(flatten_11)

# ----
# mapping between angle and path
# {0;0} --> 0
# {1;0} --> 1/2*pi
# {2;0} --> pi
# {3;0} --> 3/2*pi
# 当向量中不存在某正交方向时候为Null
panel_34 = Panel("2")
pi_9 = Pi(Factor=panel_34)
num_14 = Number(jitter_2.Values)
pi_10 = Pi(Factor=1)
remap_3 = RemapNumbers(Value=num_14, Source="4", Target=pi_9)  # -> Mapped, Clipped
division_3 = Division(A=pi_10, B="2")
sort_3 = SortList(Keys=remap_3.Mapped)  # -> Keys, ValuesA
series_8 = Series(Start=0, Step=division_3, Count="5")
consec_3 = ConsecutiveDomains(Numbers=series_8, Additive=False)  # -> simplify(Domains)
domain_3 = Domain(graft(consec_3))
angle_3 = Number(sort_3.Keys)
dedomain_3 = DeconstructDomain(Domain=domain_3)  # -> Start, End
smaller_4 = SmallerThan(FirstNumber=angle_3, SecondNumber=dedomain_3.End)  # -> SmallerThan, OrEqualTo
larger_4 = LargerThan(FirstNumber=angle_3, SecondNumber=dedomain_3.Start)  # -> LargerThan, OrEqualTo
and_4 = GateAnd(A=larger_4.OrEqualTo, B=smaller_4.SmallerThan)
sift_8 = SiftPattern(List=angle_3, SiftPattern=and_4)  # -> Output0, Output1
clean_9 = CleanTree(RemoveNulls=True, RemoveInvalid=True, RemoveEmpty=False, Tree=sift_8.Output1)  # -> simplify(Tree)
item_5 = ListItem(List=clean_9, Index="0", Wrap=True)
equals_4 = Equality(FirstNumber=item_5, SecondNumber=simplify(dedomain_3.Start))  # -> Equality, Inequality
int_6 = Integer(equals_4.Inequality)
ins_12 = InsertItems(List=clean_9, Indices="0", Wrap=True)
neg_6 = Negative(Value=int_6)
cull_i_5 = CullIndex(List=ins_12, Indices=neg_6, Wrap=False)  # -> simplify(List)
num_15 = Number(cull_i_5)
cset_5 = CreateSet(List=num_15)  # -> Set, Map
addition_3 = Addition(A=cset_5.Map, B=int_6)
tstat_8 = TreeStatistics(Tree=addition_3)  # -> Paths, Length, Count
dpath_4 = DeconstructPath(Branch=tstat_8.Paths)
graft_17 = GraftTree(Tree=addition_3, IncludeEmptyLists=True, IncludeNullItems=True)
stack_4 = StackData(Data=dpath_4, Stack=graft(tstat_8.Length))
graft_18 = GraftTree(Tree=cull_i_5, IncludeEmptyLists=True, IncludeNullItems=True)
graft_19 = GraftTree(Tree=stack_4, IncludeEmptyLists=True, IncludeNullItems=True)  # -> simplify(Tree)
ins_13 = InsertItems(List=graft_19, Item=graft_17, Indices="-1", Wrap=True)
path_4 = ConstructPath(Indices=ins_13)  # -> simplify(Branch)
viewer_6 = ParamViewer(graft_18)
flatten_13 = FlattenTree(Tree=path_4, Path="{0}")
flatten_14 = FlattenTree(Tree=cull_i_5, Path="{0}")
replace_6 = ReplacePaths(Data=graft_18, Search=viewer_6, Replace=flatten_13)
graft_20 = GraftTree(Tree=remap_3.Mapped, IncludeEmptyLists=True, IncludeNullItems=True)  # -> simplify(Tree)
keysearch_3 = KeyValueSearch(Keys=flatten_14, Values=flatten_13, Search=graft_20)

# ----
# kernel intersection algorithm 001_trial
line_length = Panel("""3.2
5.1
6.3
4.2""")
panel_35 = Panel("""0
1
2
3""")
md_slider = MDSlider(
    slider_value=Point(0.5132578379, 0.5396976122, 0.5),
    SliderMode=0,
    x_domain=Domain(-100, 100),
    y_domain=Domain(-100, 100),
    z_domain=Domain(0, 1))  # disabled
line_length_2 = Number(line_length)
startpoint = Point(md_slider)  # disabled
int_7 = Integer(panel_35)
number_slider = Slider(0.52, range=0..100)  # disabled
number_slider_2 = Slider(2.4, range=0..100)  # disabled
number_slider_3 = Slider(7.61, range=0..100)  # disabled
number_slider_4 = Slider(6.19, range=0..100)  # disabled
item_6 = ListItem(List=["1,0", "0,1", "-1,0", "0,-1"], Index=int_7, Wrap=True)
item_7 = ListItem(List=line_length_2, Index=0, Wrap=True)
X = UnitX(Factor=1)
basicvector = Vector(item_6)
merge_2 = Merge(Data1=number_slider, Data2=number_slider_2)  # disabled
merge_3 = Merge(Data1=number_slider_3, Data2=number_slider_4)  # disabled
amp = Amplitude(Vector=X, Amplitude=item_7)  # disabled
line_4 = LineSDL(Start=startpoint, Direction=X, Length=item_7)  # disabled
complex = ComplexComponents(Complex=startpoint)  # -> Real, Imaginary; disabled
pt = PointOriented(BasePlane=startpoint, UComponent=merge_2, VComponent=merge_3, WComponent=0)  # disabled
complex_2 = ComplexComponents(Complex=amp)  # -> Real, Imaginary; disabled
complex_3 = CreateComplex(Real=complex.Real, Imaginary=complex.Imaginary)  # disabled
complex_4 = CreateComplex(Real=complex_2.Real, Imaginary=complex_2.Imaginary)  # disabled
item_8 = ListItem(List=pt, Index=0, Wrap=True)  # -> Item, Item1; disabled
X_2 = UnitX(Factor=1)  # disabled
Y = UnitY(Factor=1)  # disabled
addition_4 = Addition(A=complex_3, B=complex_4)  # disabled
line_5 = LineSDL(Start=item_8.Item1, Direction=Y, Length=item_7)  # disabled
line_6 = LineSDL(Start=item_8.Item, Direction=X_2, Length=item_7)  # disabled
panel_36 = Panel(addition_4)  # disabled
panel_37 = Panel("""1,2
2,1""")  # disabled
panel_38 = Panel("""2.0,2.0,0.0
-0.5,4.0,0.0""")  # disabled
panel_39 = Panel(complex_3)  # disabled
startpoint_2 = Point(panel_37)  # disabled
vec = Vector(panel_38)  # disabled
addition_5 = Addition(A=startpoint_2, B=vec)  # disabled
vec2pt = Vector2Pt(PointA=startpoint_2, PointB=addition_5, Unitize=False)  # -> Vector, Length; disabled
ln = Line(StartPoint=startpoint_2, EndPoint=addition_5)  # disabled
endpoint = Point(addition_5)  # disabled

# ----
# 首点坐标相对于第一点
line_7 = Line([Line((-28.43570879, -32.87535514, 0), (26.13975502, -11.96140003, 0)), Line((18.7700756, 6.164027732, 0), (13.19302091, -43.43192296, 0)), Line((-30.62669456, -19.7294405, 0), (35.30205917, -38.25322931, 0)), Line((2.835633616, -1.404832213, 0), (-1.54633793, -45.62290873, 0))])  # disabled
panel_40 = Panel("1")  # disabled
linelist = Curve(line_7)  # disabled
lng_3 = ListLength(List=linelist)  # disabled
subtraction_4 = Subtraction(A=lng_3, B=panel_40)  # disabled
series_9 = Series(Start=0, Step=1, Count=subtraction_4)  # disabled
addition_6 = Addition(A=series_9, B=panel_40)  # disabled
item_9 = ListItem(List=linelist, Index=series_9, Wrap=False)  # -> simplify(graft(Item)); disabled
shift_3 = ShiftList(List=linelist, Shift=addition_6, Wrap=False)  # -> simplify(List); disabled
end = EndPoints(Curve=item_9)  # -> Start, End; disabled
end_2 = EndPoints(Curve=shift_3)  # -> Start, End; disabled

panel_41 = Panel("""2.5838678
1.5*Pi
1.86685674
0.235794
Pi
4.2223
1.6421
0.235794
3.212896
4.2223
4.3333
0.5*Pi""")
clean_10 = CleanTree(RemoveNulls=True, RemoveInvalid=False, RemoveEmpty=True, Tree=sift_5.Output1)  # -> simplify(Tree)
clean_11 = CleanTree(RemoveNulls=True, RemoveInvalid=False, RemoveEmpty=True, Tree=sift_6.Output1)  # -> simplify(Tree)
panel_42 = Panel(num_13)
subtraction_5 = Subtraction(A=clean_10, B=clean_11)
flatten_15 = FlattenTree(Tree=subtraction_5, Path="{0}")
num_16 = Number(replace_5)
round = Round()  # -> Nearest, Floor, Ceiling
cset_6 = CreateSet(List=flatten_15)  # -> Set, Map
num_17 = Number("5.4422323")
panel_43 = Panel(flatten_15)
panel_44 = Panel(clean_11)
panel_45 = Panel(clean_10)
eval_3 = Evaluate(F="round(x,2)", x=num_17)

# ----
# 处理用于set的数据的精度问题
lng_4 = ListLength()
series_10 = Series(Start="1", Step=1, Count=lng_4)
graft_21 = GraftTree(IncludeEmptyLists=True, IncludeNullItems=True)
shift_4 = ShiftList(Shift=series_10, Wrap=False)
subtraction_6 = Subtraction(A=graft_21, B=shift_4)
abs_2 = Absolute(Value=subtraction_6)
smaller_5 = SmallerThan(FirstNumber=abs_2, SecondNumber="0.000001")  # -> SmallerThan, OrEqualTo
sift_9 = SiftPattern(SiftPattern=smaller_5.SmallerThan)  # -> Output0, Output1
flatten_16 = FlattenTree(Tree=sift_9.Output0, Path="{0}")

# ----
# 问题
panel_46 = Panel(eval_3)
panel_47 = Panel(cset_6.Set)
panel_48 = Panel(subtraction_5)

panel_49 = Panel(num_16)
# 目标
cset_7 = CreateSet(List=panel_49)  # -> Set, Map
panel_50 = Panel(cset_7.Set)

panel_51 = Panel("""1
1
2
3
1
66
5
5.4
5.4
5.3
5.99997
5.99996""")
cset_8 = CreateSet(List=panel_51)  # -> Set, Map
panel_52 = Panel(cset_8.Set)

path_5 = DataPath(keysearch_2)
panel_53 = Panel(replace_4)
path_6 = DataPath(path_5)

flatten_17 = FlattenTree(Tree=path_6, Path="{0}")
tstat_9 = TreeStatistics(Tree=path_6)  # -> Paths, Length, Count
tstat_10 = TreeStatistics(Tree=path_6)  # -> Paths, Length, Count
ma = MassAddition(Input=tstat_9.Length)  # -> Result, PartialResults
series_11 = Series(Start=0, Step=1, Count=tstat_10.Count)
stack_5 = StackData(Data=ma.PartialResults, Stack=tstat_9.Length)
shift_5 = ShiftList(List=series_11, Shift=stack_5, Wrap=False)
# log:
# 20161011
# 如何识别path知道非正交的相反的向量
# 增强path的排序的算法前馈，可通过path运算直接得到向量关系
# 运用path提取相应的两条交线；
# 索引交线，并保留原有树形结构
item_10 = ListItem(List=flatten_17, Index=shift_5, Wrap=True)  # -> simplify(Item)

# ----
# log:
# 20161010
# 设计向量方向与数据结构之间的映射关系
# 数据结构用集合运算然后替换
# 替换树形结构的时候需要拍平
# 无论什么情况都留出0123正交的位置为Null
# 如果0123存在，没关系，不存在，插入一个空值
# 20161011
# 角度和path之间的映射关系，以及角度的识别:
# 分解basic line的path得到位置位置关系
# 先正交的位置关系，后自由的位置关系
# 考虑先组合line还是先分解path在配对
# 如何识别path知道非正交的相反的向量
# 增强path的排序的算法前馈，可通过path运算直接得到向量关系
# 运用path提取相应的两条交线
# 20161012
# debug时候replacePath爆红
# 精度问题导致set不能去掉原本偏差相同的角度
panel_54 = Panel(path_5)

# ----
# 00 common parallel
# 10 vectical
# 20 reverse parallel
lng_5 = ListLength(List=item_10)
stack_6 = StackData(Data=path_6, Stack=lng_5)
secondpath = DataPath(item_10)
firstpath = DataPath(stack_6)
dpath_5 = DeconstructPath(Branch=secondpath)
dpath_6 = DeconstructPath(Branch=firstpath)
subtraction_7 = Subtraction(A=dpath_6, B=dpath_5)
abs_3 = Absolute(Value=subtraction_7)
item_11 = ListItem(List=abs_3, Index=0, Wrap=True)  # -> Item, Item1
panel_55 = Panel("""00
10
20""")
concat = Concatenate(FragmentA=item_11.Item, FragmentB=item_11.Item1)
mindex_5 = MemberIndex(Set=panel_55, Member=concat)  # -> simplify(Index), Count
graft_22 = GraftTree(Tree=secondpath, IncludeEmptyLists=True, IncludeNullItems=True)
graft_23 = GraftTree(Tree=firstpath, IncludeEmptyLists=True, IncludeNullItems=True)
sift_10 = SiftPattern(List=graft_22, SiftPattern=mindex_5.Index)  # -> Output0, Output1, Output2
sift_11 = SiftPattern(List=graft_23, SiftPattern=mindex_5.Index)  # -> Output0, Output1, Output2
clean_12 = CleanTree(RemoveNulls=True, RemoveInvalid=True, RemoveEmpty=True, Tree=sift_10.Output2)
clean_13 = CleanTree(RemoveNulls=True, RemoveInvalid=True, RemoveEmpty=True, Tree=sift_11.Output0)
clean_14 = CleanTree(RemoveNulls=True, RemoveInvalid=True, RemoveEmpty=True, Tree=sift_11.Output1)
clean_15 = CleanTree(RemoveNulls=True, RemoveInvalid=True, RemoveEmpty=True, Tree=sift_11.Output2)
clean_16 = CleanTree(RemoveNulls=True, RemoveInvalid=True, RemoveEmpty=True, Tree=sift_10.Output0)
clean_17 = CleanTree(RemoveNulls=True, RemoveInvalid=True, RemoveEmpty=True, Tree=sift_10.Output1)

int_8 = Integer(mindex_5.Count)
int_9 = Integer("0")
replace_7 = ReplaceMembers(Set=int_8, Find=int_9, Replace="3")
int_10 = Integer(mindex_5.Index)
equals_5 = Equality(FirstNumber=replace_7, SecondNumber="1")  # -> Equality, Inequality
sift_12 = SiftPattern(List=replace_7, SiftPattern=equals_5.Equality)  # -> Output0, Output1
combine = CombineData(Input0=int_10, Input1=sift_12.Output0)  # -> Result, Index

path_7 = DataPath(keysearch_3)

# ----
# deconstruct first line path
# True-->正交线
# 两条正交线的角度关系
# 0 --> same direction parallel
# 1 --> vertical
# 2 --> reverse parallel
# 3 --> vertical
# deconstruct second line path
# True-->正交线
lng_6 = ListLength(List=item_10)
stack_7 = StackData(Data=path_6, Stack=lng_6)
secondpath_2 = DataPath(item_10)
firstpath_2 = DataPath(stack_7)
dpath_7 = DeconstructPath(Branch=firstpath_2)
dpath_8 = DeconstructPath(Branch=secondpath_2)
item_12 = ListItem(List=dpath_8, Index=0, Wrap=True)  # -> Item, Item1
item_13 = ListItem(List=dpath_7, Index=0, Wrap=True)  # -> Item, Item1
equals_6 = Equality(FirstNumber=item_12.Item1, SecondNumber="0")  # -> Equality, Inequality
equals_7 = Equality(FirstNumber=item_13.Item1, SecondNumber="0")  # -> Equality, Inequality
sift_13 = SiftPattern(List=item_12.Item, SiftPattern=equals_6.Equality)  # -> Output0, Output1
sift_14 = SiftPattern(List=item_13.Item, SiftPattern=equals_7.Equality)  # -> Output0, Output1
subtraction_8 = Subtraction(A=sift_14.Output1, B=sift_13.Output1)
abs_4 = Absolute(Value=subtraction_8)

# ----
# log:
# 20161011
# 角度和path之间的映射关系，以及角度的识别:
# 分解basic line的path得到位置位置关系
# 先正交的位置关系，后自由的位置关系:
# 考虑先组合line还是先分解path在配对:
# 先分解path
# {0;x} --> 0-1
# {1;x} --> 1-2
# {2;x} --> 2-3
# {3;x} --> 3-
# {x;0}正交
path_8 = DataPath(path_7)
dpath_9 = DeconstructPath(Branch=path_8)
item_14 = ListItem(List=dpath_9, Index=0, Wrap=True)  # -> Item, Item1
equals_8 = Equality(FirstNumber=item_14.Item1, SecondNumber="0")  # -> Equality, Inequality
sift_15 = SiftPattern(List=dpath_9, SiftPattern=equals_8.Equality)  # -> Output0, Output1
clean_18 = CleanTree(RemoveNulls=True, RemoveInvalid=True, RemoveEmpty=False, Tree=sift_15.Output0)
item_15 = ListItem(List=clean_18, Index=0, Wrap=True)
sift_16 = SiftPattern(List=sift_15.Output0, SiftPattern=item_15)  # -> Output0, Output1, Output2, Output3
clean_19 = CleanTree(RemoveNulls=True, RemoveInvalid=True, RemoveEmpty=False, Tree=sift_15.Output1)
clean_20 = CleanTree(RemoveNulls=True, RemoveInvalid=True, RemoveEmpty=False, Tree=sift_16.Output0)
clean_21 = CleanTree(RemoveNulls=True, RemoveInvalid=True, RemoveEmpty=False, Tree=sift_16.Output1)
clean_22 = CleanTree(RemoveNulls=True, RemoveInvalid=True, RemoveEmpty=False, Tree=sift_16.Output2)
clean_23 = CleanTree(RemoveNulls=True, RemoveInvalid=True, RemoveEmpty=False, Tree=sift_16.Output3)
path_9 = ConstructPath(Indices=clean_19)
path_10 = ConstructPath(Indices=clean_20)
path_11 = ConstructPath(Indices=clean_21)
path_12 = ConstructPath(Indices=clean_22)
path_13 = ConstructPath(Indices=clean_23)
clean_24 = CleanTree(RemoveNulls=True, RemoveInvalid=True, RemoveEmpty=False, Tree=path_10)
clean_25 = CleanTree(RemoveNulls=True, RemoveInvalid=True, RemoveEmpty=False, Tree=path_11)
clean_26 = CleanTree(RemoveNulls=True, RemoveInvalid=True, RemoveEmpty=False, Tree=path_12)
clean_27 = CleanTree(RemoveNulls=True, RemoveInvalid=True, RemoveEmpty=False, Tree=path_13)
clean_28 = CleanTree(RemoveNulls=True, RemoveInvalid=True, RemoveEmpty=False, Tree=path_9)
quadraturepath = FilePath(clean_28)
_0to1path = FilePath(clean_24)
_1to2path = FilePath(clean_25)
_2to3path = FilePath(clean_26)
_3to4path = FilePath(clean_27)

tstat_11 = TreeStatistics(Tree=mindex_5.Index)  # -> Paths, Length, Count
ultimateangle_afterelection = Number(replace_4)

# ----
# {x;y}第x个方向和第y个方向的关系
graft_24 = GraftTree(Tree=tstat_11.Paths, IncludeEmptyLists=True, IncludeNullItems=True)
sift_17 = SiftPattern(List=graft_24, SiftPattern=combine.Result)  # -> Output0, Output1, Output2, Output3
clean_29 = CleanTree(RemoveNulls=True, RemoveInvalid=True, RemoveEmpty=True, Tree=sift_17.Output0)  # -> simplify(Tree)
clean_30 = CleanTree(RemoveNulls=True, RemoveInvalid=True, RemoveEmpty=True, Tree=sift_17.Output1)  # -> simplify(Tree)
clean_31 = CleanTree(RemoveNulls=True, RemoveInvalid=True, RemoveEmpty=True, Tree=sift_17.Output2)  # -> simplify(Tree)
clean_32 = CleanTree(RemoveNulls=True, RemoveInvalid=True, RemoveEmpty=True, Tree=sift_17.Output3)  # -> simplify(Tree)
dpath_10 = DeconstructPath(Branch=clean_29)
item_16 = ListItem(List=dpath_10, Index=0, Wrap=True)  # -> Item, Item1
graft_25 = GraftTree(Tree=ultimateangle_afterelection, IncludeEmptyLists=True, IncludeNullItems=True)  # -> simplify(Tree)
flatten_18 = FlattenTree(Tree=graft_25, Path="{0}")
item_17 = ListItem(List=flatten_18, Index=item_16.Item1, Wrap=False)
item_18 = ListItem(List=flatten_18, Index=item_16.Item, Wrap=False)
viewer_7 = ParamViewer(item_18)

panel_56 = Panel(ultimateangle_afterelection)

item_19 = TreeItem(Tree=ultimateangle_afterelection, Path=clean_15, Index="0", Wrap=True)
item_20 = TreeItem(Tree=ultimateangle_afterelection, Path=clean_13, Index="0", Wrap=True)
item_21 = TreeItem(Tree=ultimateangle_afterelection, Path=clean_16, Index="0", Wrap=True)
item_22 = TreeItem(Tree=ultimateangle_afterelection, Path=clean_14, Index="0", Wrap=True)
item_23 = TreeItem(Tree=ultimateangle_afterelection, Path=clean_12, Index="0", Wrap=True)
item_24 = TreeItem(Tree=ultimateangle_afterelection, Path=clean_17, Index="0", Wrap=True)

panel_57 = Panel(clean_16)
panel_58 = Panel(clean_13)
panel_59 = Panel(clean_17)
panel_60 = Panel(clean_14)
panel_61 = Panel(clean_15)
panel_62 = Panel(clean_12)

panel_63 = Panel(abs_4)
panel_64 = Panel(item_19)
panel_65 = Panel(item_22)
panel_66 = Panel(item_20)
panel_67 = Panel(item_21)
panel_68 = Panel(item_24)
panel_69 = Panel(item_23)
panel_70 = Panel(quadraturepath)
panel_71 = Panel("描述方法只是数据结构的不同，先用几何代表抽象的数据结构")
panel_72 = Panel("""多条线且含有多折线连线组织数据结构问题
得到交点
交点的path替换""")
panel_73 = Panel("""x0,y0;0,1,2,3
x1,y0;0,3,2""")
crv = Curve([<curve referenced from the Rhino model> x3])
crv_2 = Curve([<curve referenced from the Rhino model> x3])
explode = Explode(Curve=crv_2, Recursive=True)  # -> Segments, Vertices
end_3 = EndPoints(Curve=crv_2)  # -> Start, End
neg_7 = Negative(Value="1")
shift_6 = ShiftList(List=explode.Vertices, Shift="1", Wrap=False)
shift_7 = ShiftList(List=explode.Vertices, Shift=neg_7, Wrap=False)

panel_74 = Panel("""1,0
0,1
-1,0
0,-1""")
vec_2 = Vector(panel_74)

# ----
# describe space by (point;index) of vector
md_slider_2 = MDSlider(
    slider_value=Point(0.5591201782, 0.4691162109, 0.5),
    SliderMode=0,
    x_domain=Domain(-1000, 1000),
    y_domain=Domain(-1000, 1000),
    z_domain=Domain(0, 1))
panel_75 = Panel("""0
1
2
3""")
line_length_3 = Panel("""3.2
5.1
3.2
5.1""")
line_length_4 = Number(line_length_3)
int_11 = Integer(panel_75)
lng_7 = ListLength(List=int_11)
series_12 = Series(Start=0, Step=1, Count=lng_7)
item_25 = ListItem(List=vec_2, Index=int_11, Wrap=True)
item_26 = ListItem(List=line_length_4, Index=series_12, Wrap=True)
basicvectorunit = Vector(item_25)
amp_2 = Amplitude(Vector=basicvectorunit, Amplitude=item_26)
ma_2 = MassAddition(Input=amp_2)  # -> Result, PartialResults
addition_7 = Addition(A=md_slider_2, B=ma_2.PartialResults)
pt_2 = Point(addition_7)
shift_8 = ShiftList(List=ma_2.PartialResults, Shift=-1, Wrap=True)
complex_5 = ComplexComponents(Complex=shift_8)  # -> Real, Imaginary
concat_2 = Concatenate(FragmentA=complex_5.Real, FragmentB=complex_5.Imaginary, JoinSeparator=",")
pline = PolyLine(Vertices=pt_2, Closed=True)
concat_3 = Concatenate(FragmentA=concat_2, FragmentB=int_11, JoinSeparator=";")

subtraction_9 = Subtraction(A=shift_6, B=shift_7)

graft_26 = GraftTree(Tree=end_3.Start, IncludeEmptyLists=True, IncludeNullItems=True)  # -> simplify(Tree)
subtraction_10 = Subtraction(A=graft_26, B="{0,0,0}")  # -> flatten(Result)
item_27 = ListItem(List=subtraction_10, Index="0", Wrap=True)
subtraction_11 = Subtraction(A=graft_26, B=item_27)

unit = UnitVector(Vector=subtraction_9)
vec_3 = Vector(subtraction_9)
len = Length(Curve=explode.Segments)  # -> simplify(Length)
pshift_3 = ShiftPaths(Data=unit, Offset=-1)
mindex_6 = MemberIndex(Set=vec_2, Member=pshift_3)  # -> Index, Count
vdis = VectorDisplay(Anchor=shift_7, Vector=vec_3)
pshift_4 = ShiftPaths(Data=mindex_6.Index, Offset=-1)  # -> simplify(Data)

vecdirection = Integer(pshift_4)
veclength = Number(len)
pt_3 = Point(graft_26)

panel_76 = Panel(vec_2)
item_28 = ListItem(List=vec_2, Index=vecdirection, Wrap=True)
amp_3 = Amplitude(Vector=item_28, Amplitude=veclength)
ma_3 = MassAddition(Input=amp_3)  # -> Result, PartialResults
addition_8 = Addition(A=pt_3, B=ma_3.PartialResults)
pt_4 = Point(addition_8)
ins_14 = InsertItems(List=addition_8, Item=pt_3, Indices="0", Wrap=True)
neg_8 = Negative(Value="1")
panel_77 = Panel(pt_3)
panel_78 = Panel(concat_3)
panel_79 = Panel(amp_2)
shift_9 = ShiftList(List=ins_14, Shift=neg_8, Wrap=False)  # -> simplify(List)

# ----
# tree data trial
# first point 和 end point 的数据结构组织的方式是同一种的
# 
# 先手工傻做，再寻找规律
# 
# 先不管结构如何，把他们放在一起，结构在外部运算，在替换成对的树形数据
# 上升数据结构后手工或者数列
# 上升后全部拍平处理
# 用stack+listItem对拍平的数据处理
# 
# 留下来的问题是数据结构的替换
# 手工
pt_5 = Point(shift_9)
graft_27 = GraftTree(Tree=pt_5, IncludeEmptyLists=True, IncludeNullItems=True)

flatten_19 = FlattenTree(Tree=graft_27, Path="{0}")
tstat_12 = TreeStatistics(Tree=pt_5)  # -> Paths, Length, Count
tstat_13 = TreeStatistics(Tree=graft_27)  # -> Paths, Length, Count
ma_4 = MassAddition(Input=tstat_12.Length)  # -> Result, PartialResults
series_13 = Series(Start=0, Step=1, Count=tstat_13.Count)
stack_8 = StackData(Data=ma_4.PartialResults, Stack=tstat_12.Length)
shift_10 = ShiftList(List=series_13, Shift=stack_8, Wrap=False)
item_29 = ListItem(List=flatten_19, Index=shift_10, Wrap=True)  # -> simplify(Item)

lng_8 = ListLength(List=item_29)

bang = ExplodeTree(Data=graft_27)  # -> Branch0, Branch1, Branch2, Branch3, Branch4, Branch5
merge_4 = Merge(Data1=bang.Branch1, Data2=bang.Branch2, Data3=bang.Branch3, Data4=bang.Branch4, Data5=bang.Branch5)
entwine = Entwine(
    Branch00=merge_4,
    Branch01=bang.Branch5,
    Branch02=bang.Branch5,
    Branch03=bang.Branch5,
    Branch04=bang.Branch5,
    FlattenInputs=True)

stack_9 = StackData(Data=graft_27, Stack=lng_8)
shift_11 = ShiftList(List=ins_14, Shift="1", Wrap=False)  # -> simplify(List)
graft_28 = GraftTree(Tree=stack_9, IncludeEmptyLists=True, IncludeNullItems=True)
graft_29 = GraftTree(Tree=shift_9, IncludeEmptyLists=True, IncludeNullItems=True)

flatten_20 = FlattenTree(Tree=graft_29, Path="{0}")
tstat_14 = TreeStatistics(Tree=shift_9)  # -> Paths, Length, Count
tstat_15 = TreeStatistics(Tree=graft_29)  # -> Paths, Length, Count
ma_5 = MassAddition(Input=tstat_14.Length)  # -> Result, PartialResults
series_14 = Series(Start=0, Step=1, Count=tstat_15.Count)
stack_10 = StackData(Data=ma_5.PartialResults, Stack=tstat_14.Length)
shift_12 = ShiftList(List=series_14, Shift=stack_10, Wrap=False)
viewer_8 = ParamViewer()
item_30 = ListItem(List=flatten_20, Index=shift_12, Wrap=True)  # -> simplify(Item)
replace_8 = ReplacePaths(Data=item_30, Search=viewer_8)

graft_30 = GraftTree(Tree=shift_11, IncludeEmptyLists=True, IncludeNullItems=True)

# ----
# kernel tree data
flatten_21 = FlattenTree(Tree=graft_30, Path="{0}")
tstat_16 = TreeStatistics(Tree=shift_11)  # -> Paths, Length, Count
tstat_17 = TreeStatistics(Tree=graft_30)  # -> Paths, Length, Count
ma_6 = MassAddition(Input=tstat_16.Length)  # -> Result, PartialResults
series_15 = Series(Start=0, Step=1, Count=tstat_17.Count)
stack_11 = StackData(Data=ma_6.PartialResults, Stack=tstat_16.Length)
shift_13 = ShiftList(List=series_15, Shift=stack_11, Wrap=False)
item_31 = ListItem(List=flatten_21, Index=shift_13, Wrap=True)  # -> simplify(Item)
viewer_9 = ParamViewer()
replace_9 = ReplacePaths(Data=item_31, Search=viewer_9)

addition_9 = Addition(A=pt_3)

viewer_10 = ParamViewer()
replace_10 = ReplacePaths(Data=item_29, Search=viewer_10)

firstpt_line0 = Point(graft_29)
firstpt_line1 = Point(item_30)
endpt_line0 = Point(graft_30)
endpt_line1 = Point(item_31)

graft_31 = GraftTree(Tree=item_29, IncludeEmptyLists=True, IncludeNullItems=True)

# ----
# log:
# 20161011
# 增强path的排序的算法前馈，可通过path运算直接得到向量关系:
# 排序前后问题：
# 先精确控制还是先离散问题
# 应该是把排序前的原始数据进行path替换，而不是排序之后的数据：结果竟然是一样的。。。！
# mapping between angle and path
# {0;0} --> 0
# {1;0} --> 1/2*pi
# {2;0} --> pi
# {3;0} --> 3/2*pi
# 无所谓正交向量存不存在
# vectorPath01
pi_11 = Pi(Factor=1)
# {0,0}-->0/2*pi
# 0/2*pi <= a< 1/2*pi
# {1,0}-->1/2*pi
# 1/2*pi <= a < 2/2*pi
# {2,0}-->2/2*pi
# 2/2*pi <= a < 3/2*pi
# {3,0}-->3/2*pi
# 3/2*pi <= a < 4/2*pi
panel_80 = Panel("2")
division_4 = Division(A=pi_11, B=panel_80)
series_16 = Series(Start=0, Step=division_4, Count="5")
consec_4 = ConsecutiveDomains(Numbers=series_16, Additive=False)  # -> simplify(Domains)
domain_4 = Domain(graft(consec_4))
pi_12 = Pi(Factor="2")
num_18 = Number(jitter.Values)
dedomain_4 = DeconstructDomain(Domain=domain_4)  # -> simplify(Start), simplify(End)
remap_4 = RemapNumbers(Value=num_18, Source="4", Target=pi_12)  # -> Mapped, Clipped
angle_4 = Number(panel_7)
larger_5 = LargerThan(FirstNumber=angle_4, SecondNumber=dedomain_4.Start)  # -> LargerThan, OrEqualTo
smaller_6 = SmallerThan(FirstNumber=angle_4, SecondNumber=dedomain_4.End)  # -> SmallerThan, OrEqualTo
and_5 = GateAnd(A=larger_5.OrEqualTo, B=smaller_6.SmallerThan)
sift_18 = SiftPattern(List=angle_4, SiftPattern=and_5)  # -> Output0, Output1
graft_32 = GraftTree(Tree=angle_4, IncludeEmptyLists=True, IncludeNullItems=True)
clean_33 = CleanTree(RemoveNulls=True, RemoveInvalid=True, RemoveEmpty=False, Tree=sift_18.Output1)  # -> simplify(Tree)
subtraction_12 = Subtraction(A=clean_33, B=dedomain_4.Start)
graft_33 = GraftTree(Tree=clean_33, IncludeEmptyLists=True, IncludeNullItems=True)
flatten_22 = FlattenTree(Tree=graft_33, Path="{0}")
viewer_11 = ParamViewer(graft_33)

panel_81 = Panel(subtraction_12)
# log:
# 20161010
# 发现前馈需要一大堆的运算器，先做成后馈
# 如果需要前反馈，可能需要修改标签运算的算法，所以先后馈，至少能做下去
# 重新Partition
# 还是回到前馈
# log:
# 20161010
# 还是回到前馈：
# 用set运算器自带的index记录，与boolean值进行相加，对path运算得到新的path
num_19 = Number(subtraction_12)
clean_34 = CleanTree(RemoveNulls=True, RemoveInvalid=True, RemoveEmpty=True, Tree=num_19)
eval_4 = Evaluate(F="round(x,4)", x=clean_34)
num_20 = Number(eval_4)
num_21 = Number(num_20)

flatten_23 = FlattenTree(Tree=num_21, Path="{0}")
cset_9 = CreateSet(List=flatten_23)  # -> Set, Map
sort_4 = SortList(Keys=cset_9.Set)  # -> Keys, ValuesA
mindex_7 = MemberIndex(Set=sort_4.Keys, Member=num_21)  # -> Index, Count
pshift_5 = ShiftPaths(Data=mindex_7.Index, Offset=-1)
tstat_18 = TreeStatistics(Tree=pshift_5)  # -> Paths, Length, Count
dpath_11 = DeconstructPath(Branch=tstat_18.Paths)
stack_12 = StackData(Data=dpath_11, Stack=graft(tstat_18.Length))
graft_34 = GraftTree(Tree=stack_12, IncludeEmptyLists=True, IncludeNullItems=True)  # -> simplify(Tree)
merge_5 = Merge(Data1=graft_34, Data2=mindex_7.Index)
path_14 = ConstructPath(Indices=merge_5)
flatten_24 = FlattenTree(Tree=path_14, Path="{0}")
keysearch_4 = KeyValueSearch(Keys=flatten_22, Values=flatten_24, Search=graft_32)  # -> simplify(Result)
replace_11 = ReplacePaths(Data=graft_33, Search=viewer_11, Replace=flatten_24)

panel_82 = Panel(clean_34)
panel_83 = Panel(eval_4)
panel_84 = Panel(replace_11)

viewer_12 = ParamViewer(graft_32)
flatten_25 = FlattenTree(Tree=keysearch_4, Path="{0}")
replace_12 = ReplacePaths(Data=graft_32, Search=viewer_12, Replace=flatten_25)

# ----
# explore a point position in space
line_8 = Line([Line((120.4046894, -60.83579072, 0), (120.4046894, -60.79145643, 0)), Line((120.3917346, -60.82485109, 0), (120.420811, -60.82485109, 0))])
panel_85 = Panel("""处理k不存在的情况

写成函数
把坐标在相减后就分开来算

对实交和虚交的算法 不够缜密""")
# debug:可以做，但是要改动很多，先放放，出现问题了再来
linelist_2 = Curve(line_8)
end_4 = EndPoints(Curve=linelist_2)  # -> Start, End
subtraction_13 = Subtraction(A=end_4.End, B=end_4.Start)
xy = XYPlane(Origin=Point(0, 0, 0))

startpoint_3 = Point(end_4.Start)
vec_4 = Vector(subtraction_13)

# ----
# 计算点到边界的垂直向量
# describe space by (point;index) of vector
# 问题在于，当某一path缺少时，替换的内容仍然会配对，造成数据多余错误
# 要探测出缺少的路径
# statistics-->DePath
# 最后拍平后替换路径
line_length_5 = Panel("""3.2
5.1
3.2
5.1
6.4
10.2""")
panel_86 = Panel("""0
1
0
1
2
3""")
md_slider_3 = MDSlider(
    slider_value=Point(0.4899997711, 0.4549980164, 0.5),
    SliderMode=0,
    x_domain=Domain(0, 1),
    y_domain=Domain(0, 1),
    z_domain=Domain(0, 1))
panel_87 = Panel("""0
1
2
3""")
line_length_6 = Panel("""3.2
5.1
3.2
5.1""")
panel_88 = Panel("""用字符串的方法表示还差最后一步，那么先拆开来用判断的方法做
拆开的方法很繁琐，索性还是用字符串替换的方法
检查目前的替换方法是否可以简化
并且找出到各个边的距离最近点""")
line_length_7 = Number(line_length_6)
panel_89 = Panel("""1,0
0,1
-1,0
0,-1""")
vec_5 = Vector(panel_89)
int_12 = Integer(panel_87)
lng_9 = ListLength(List=int_12)
series_17 = Series(Start=0, Step=1, Count=lng_9)
item_32 = ListItem(List=vec_5, Index=int_12, Wrap=True)
panel_90 = Panel(item_32)
item_33 = ListItem(List=line_length_7, Index=series_17, Wrap=True)
basicvectorunit_2 = Vector(item_32)
amp_4 = Amplitude(Vector=basicvectorunit_2, Amplitude=item_33)
ma_7 = MassAddition(Input=amp_4)  # -> Result, PartialResults
addition_10 = Addition(A=md_slider_3, B=ma_7.PartialResults)
shift_14 = ShiftList(List=ma_7.PartialResults, Shift=-1, Wrap=True)
complex_6 = ComplexComponents(Complex=shift_14)  # -> Real, Imaginary
concat_4 = Concatenate(FragmentA=complex_6.Real, FragmentB=complex_6.Imaginary, JoinSeparator=",")
item_34 = ListItem(List=amp_4, Index=graft(series_17), Wrap=True)
panel_91 = Panel(ma_7.PartialResults)
concat_5 = Concatenate(FragmentA=concat_4, FragmentB=int_12, JoinSeparator=";")
item_35 = ListItem(List=concat_5, Index=series_17, Wrap=True)
split = TextSplit(Text=item_35, Separators=";")  # -> simplify(Result)
item_36 = ListItem(List=split, Index=0, Wrap=True)  # -> Item, Item1
pt_6 = Point(item_36.Item)
addition_11 = Addition(A=pt_6, B=item_34)
firstpt0 = Point(item_36.Item)
endpt0 = Point(addition_11)
panel_92 = Panel(concat_5)
complex_7 = ComplexComponents(Complex=endpt0)  # -> Real, Imaginary
complex_8 = ComplexComponents(Complex=firstpt0)  # -> Real, Imaginary
pt_7 = Point(Point(1.488717773, 12.13872048, 0))
subtraction_14 = Subtraction(A=complex_8.Imaginary, B=complex_7.Imaginary)
subtraction_15 = Subtraction(A=complex_8.Real, B=complex_7.Real)
complex_9 = ComplexComponents(Complex=pt_7)  # -> Real, Imaginary
division_5 = Division(A=subtraction_14, B=subtraction_15)
k1 = Number(division_5)
multiplication = Multiplication(A=k1, B=complex_7.Real)
subtraction_16 = Subtraction(A=complex_7.Imaginary, B=multiplication)
b1 = Number(subtraction_16)
panel_93 = Panel("abs(k*x0-y0+b)/sqrt(k*k+1)")
panel_94 = Panel("(k*x0-y0+b)/sqrt(k*k+1)")
panel_95 = Panel("-(k*x0-y0+b)/sqrt(k*k+1)")

x = Number(complex_9.Real)
y = Number(complex_9.Imaginary)
larger_6 = LargerThan(FirstNumber=complex_8.Real, SecondNumber=x)  # -> LargerThan, OrEqualTo
larger_7 = LargerThan(FirstNumber=complex_8.Imaginary, SecondNumber=y)  # -> LargerThan, OrEqualTo
int_13 = Integer(larger_6.LargerThan)
int_14 = Integer(larger_7.LargerThan)
concat_6 = Concatenate(FragmentA=int_13, FragmentB=int_14)

# ---- group: vector match concept Error
panel_96 = Panel("""101
103
111
113""")
panel_97 = Panel("""010
012
110
112""")
panel_98 = Panel("""001
003
011
013""")
panel_99 = Panel("""000
002
100
102""")
merge_6 = Merge(Data1=panel_96, Data2=panel_97, Data3=panel_98, Data4=panel_99)
entwine_2 = Entwine(Branch00=panel_96, Branch01=panel_97, Branch02=panel_98, Branch03=panel_99, FlattenInputs=True)  # -> simplify(Result)
concat_7 = Concatenate(FragmentA=concat_6, FragmentB=item_36.Item1)
flatten_26 = FlattenTree(Tree=concat_7, Path="{0}")
mindex_8 = MemberIndex(Set=merge_6, Member=flatten_26)  # -> Index, Count
division_6 = Division(A=mindex_8.Index, B="4")
int_15 = Integer(division_6)
item_37 = ListItem(List=vec_5, Index=int_15, Wrap=True)

# ----
pt_8 = Point(ma_7.PartialResults)
pline_2 = PolyLine(Vertices=pt_8, Closed=True)

# ---- group: vector match concept Error
mindex_9 = MemberIndex(Set=entwine_2, Member=flatten_26)  # -> Index, Count
clean_35 = CleanTree(RemoveNulls=True, RemoveInvalid=True, RemoveEmpty=True, Tree=mindex_9.Index)
tstat_19 = TreeStatistics(Tree=clean_35)  # -> Paths, Length, Count
split_2 = TextSplit(Text=tstat_19.Paths, Separators=";")
item_38 = ListItem(List=split_2, Index="0", Wrap=True)
split_3 = TextSplit(Text=item_38, Separators="{")
item_39 = ListItem(List=split_3, Index="1", Wrap=True)  # -> simplify(Item)

equals_9 = Equality(FirstNumber=graft(flatten_26), SecondNumber=merge_6)  # -> Equality, Inequality
mindex_10 = MemberIndex(Set=equals_9.Equality, Member=Toggle(True))  # -> Index, Count

# ----
# distances between points and space boundary
null_2 = NullItem(Item=k1)  # -> NullFlags, InvalidFlags, Description
sift_19 = SiftPattern(List=pt_6, SiftPattern=null_2.NullFlags)  # -> Output0, Output1
complex_10 = ComplexComponents(Complex=sift_19.Output1)  # -> Real, Imaginary
eval_5 = Evaluate(F="abs(k*x0-y0+b)/sqrt(k*k+1)", k=k1, b=b1, x0=complex_9.Real, y0=complex_9.Imaginary)
subtraction_17 = Subtraction(A=complex_9.Real, B=complex_10.Real)  # -> simplify(Result)
distance = Number(eval_5)
abs_5 = Absolute(Value=subtraction_17)  # -> simplify(Result)
combine_2 = CombineData(Input0=distance, Input1=abs_5)  # -> Result, Index

# ---- group: vector match method 1
concat_8 = Concatenate(FragmentA=concat_6, FragmentB=item_36.Item1)
flatten_27 = FlattenTree(Tree=concat_8, Path="{0}")
panel_100 = Panel("""000
002
100
102""")
panel_101 = Panel("""101
103
111
113""")
panel_102 = Panel("""010
012
110
112""")
panel_103 = Panel("""001
003
011
013""")
mindex_11 = MemberIndex(Set=panel_103, Member=flatten_27)  # -> Index, Count
mindex_12 = MemberIndex(Set=panel_100, Member=flatten_27)  # -> Index, Count
mindex_13 = MemberIndex(Set=panel_101, Member=flatten_27)  # -> Index, Count
mindex_14 = MemberIndex(Set=panel_102, Member=flatten_27)  # -> Index, Count
clean_36 = CleanTree(RemoveNulls=True, RemoveInvalid=True, RemoveEmpty=True, Tree=mindex_14.Index)
clean_37 = CleanTree(RemoveNulls=True, RemoveInvalid=True, RemoveEmpty=True, Tree=mindex_12.Index)
clean_38 = CleanTree(RemoveNulls=True, RemoveInvalid=True, RemoveEmpty=True, Tree=mindex_13.Index)
clean_39 = CleanTree(RemoveNulls=True, RemoveInvalid=True, RemoveEmpty=True, Tree=mindex_11.Index)
replace_13 = ReplaceItems(List=clean_38, Item="0", Indices="0", Wrap=False)
replace_14 = ReplaceItems(List=clean_36, Item="1", Indices="0", Wrap=False)
replace_15 = ReplaceItems(List=clean_39, Item="2", Indices="0", Wrap=False)
replace_16 = ReplaceItems(List=clean_37, Item="3", Indices="0", Wrap=False)
merge_7 = Merge(Data1=replace_13, Data2=replace_14, Data3=replace_15, Data4=replace_16)
item_40 = ListItem(List=vec_5, Index=merge_7, Wrap=True)
amp_5 = Amplitude(Vector=item_40, Amplitude=combine_2.Result)
vdis_2 = VectorDisplay(Anchor=pt_7, Vector=amp_5)

# ---- group: vector match method 0 Error
# left-down;x-axis
# left-up;y-axis
y_2 = Number(complex_9.Imaginary)
a = Number(complex_8.Real)
b = Number(complex_8.Imaginary)
x_2 = Number(complex_9.Real)
item_41 = ListItem(List=vec_5, Index=item_36.Item1, Wrap=True)
smaller_7 = SmallerThan(FirstNumber=b, SecondNumber=y_2)  # -> SmallerThan, OrEqualTo
not = GateNot(A=smaller_7.SmallerThan)
smaller_8 = SmallerThan(FirstNumber=a, SecondNumber=x_2)  # -> SmallerThan, OrEqualTo
and_6 = GateAnd(A=smaller_8.SmallerThan, B=not)
equals_10 = Equality(FirstNumber="0", SecondNumber=graft(int_12))  # -> Equality, Inequality
equals_11 = Equality(FirstNumber="2", SecondNumber=graft(int_12))  # -> Equality, Inequality
and_7 = GateAnd(A=smaller_8.SmallerThan, B=smaller_7.SmallerThan)
equals_12 = Equality(FirstNumber="1", SecondNumber=graft(int_12))  # -> Equality, Inequality
equals_13 = Equality(FirstNumber="3", SecondNumber=graft(int_12))  # -> Equality, Inequality
or = GateOr(A=equals_10.Equality, B=equals_11.Equality)
or_2 = GateOr(A=equals_12.Equality, B=equals_13.Equality)
and_8 = GateAnd(A=or_2, B=and_7)
and_9 = GateAnd(A=or, B=and_6)
or_3 = GateOr(A=and_8, B=and_9)
sift_20 = SiftPattern(List=item_41, SiftPattern=or_3)  # -> Output0, Output1
pi_13 = Pi(Factor="0.5")
Z = UnitZ(Factor=1)
neg_9 = Negative(Value=pi_13)
vrot = Rotate(Vector=sift_20.Output0, Axis=Z, Angle=neg_9)
vrot_2 = Rotate(Vector=sift_20.Output1, Axis=Z, Angle=pi_13)
combine_3 = CombineData(Input0=vrot, Input1=vrot_2)  # -> Result, Index
amp_6 = Amplitude(Vector=combine_3.Result, Amplitude=combine_2.Result)
vdis_3 = VectorDisplay(Anchor=pt_7, Vector=amp_6)

# ----
# vectors between points and space boundary
panel_104 = Panel("0.5")  # disabled
item_42 = ListItem(List=vec_5, Index=item_36.Item1, Wrap=True)  # disabled
pi_14 = Pi(Factor=panel_104)  # disabled
neg_10 = Negative(Value=pi_14)  # disabled
Z_2 = UnitZ(Factor=1)  # disabled
vrot_3 = Rotate(Vector=item_42, Axis=Z_2, Angle=neg_10)  # disabled
amp_7 = Amplitude(Vector=vrot_3, Amplitude=combine_2.Result)  # disabled

panel_105 = Panel(eval_5)
panel_106 = Panel(combine_2.Result)

# ----
# kernel intersection algorithm 002_trial
# explore a point position in space
# curve convert to direction and length
# 0 --> extend one line to intersect two lines
# 1 --> extend two lines
# 2 --> extend three lines
line_9 = Line([Line((-24.40860271, -49.55265212, 0), (8.180806958, -33.66531491, 0)), Line((-1.799699753, -27.75848441, 0), (-1.799699753, -50.36738737, 0))])  # disabled
panel_107 = Panel("1")  # disabled
linelist_3 = Curve(line_9)  # disabled
lng_10 = ListLength(List=linelist_3)  # disabled
subtraction_18 = Subtraction(A=lng_10, B=panel_107)  # disabled
series_18 = Series(Start=0, Step=1, Count=subtraction_18)  # disabled
addition_12 = Addition(A=series_18, B=panel_107)  # disabled
item_43 = ListItem(List=linelist_3, Index=series_18, Wrap=False)  # -> simplify(graft(Item)); disabled
shift_15 = ShiftList(List=linelist_3, Shift=addition_12, Wrap=False)  # -> simplify(List); disabled
end_5 = EndPoints(Curve=item_43)  # -> Start, End; disabled
end_6 = EndPoints(Curve=shift_15)  # -> Start, End; disabled
end_7 = EndPoints(Curve=linelist_3)  # -> Start, End; disabled
panel_108 = Panel("1")  # disabled
panel_109 = Panel("1")  # disabled
number_slider_5 = Slider(6, range=0..100)  # disabled
panel_110 = Panel("0")  # disabled
panel_111 = Panel("0")  # disabled
panel_112 = Panel("处理k不存在的情况")  # disabled
equals_14 = Equality()  # -> Equality, Inequality; disabled
panel_113 = Panel("2")  # disabled
xy_2 = XYPlane(Origin=Point(0, 0, 0))  # disabled

subtraction_19 = Subtraction(A=end_7.End, B=end_7.Start)  # disabled
startpoint_4 = Point(end_7.Start)  # disabled

vec_6 = Vector(subtraction_19)  # disabled
addition_13 = Addition(A=startpoint_4, B=vec_6)  # disabled
endpoint_2 = Point(addition_13)  # disabled
lng_11 = ListLength(List=addition_13)  # disabled
lng_12 = ListLength(List=startpoint_4)  # disabled
panel_114 = Panel(startpoint_4)  # disabled
subtraction_20 = Subtraction(A=lng_11, B=panel_108)  # disabled
subtraction_21 = Subtraction(A=lng_12, B=panel_109)  # disabled
series_19 = Series(Start=0, Step=1, Count=subtraction_21)  # disabled
series_20 = Series(Start=0, Step=1, Count=subtraction_20)  # disabled
addition_14 = Addition(A=series_20, B=panel_108)  # disabled
addition_15 = Addition(A=series_19, B=panel_109)  # disabled
item_44 = ListItem(List=startpoint_4, Index=series_19, Wrap=False)  # -> simplify(graft(Item)); disabled
item_45 = ListItem(List=addition_13, Index=series_20, Wrap=False)  # -> simplify(graft(Item)); disabled
shift_16 = ShiftList(List=addition_13, Shift=addition_14, Wrap=False)  # -> simplify(List); disabled
shift_17 = ShiftList(List=startpoint_4, Shift=addition_15, Wrap=False)  # -> simplify(List); disabled
firstpt1 = Point(shift_17)  # disabled
firstpt0_2 = Point(item_44)  # disabled
endpt0_2 = Point(item_45)  # disabled
endpt1 = Point(shift_16)  # disabled
points = PointList(Points=flatten(firstpt0_2), Size=number_slider_5)  # disabled
panel_115 = Panel(firstpt0_2)  # disabled
complex_11 = ComplexComponents(Complex=firstpt1)  # -> Real, Imaginary; disabled
complex_12 = ComplexComponents(Complex=endpt1)  # -> Real, Imaginary; disabled
complex_13 = ComplexComponents(Complex=firstpt0_2)  # -> Real, Imaginary; disabled
complex_14 = ComplexComponents(Complex=endpt0_2)  # -> Real, Imaginary; disabled
subtraction_22 = Subtraction(A=complex_11.Imaginary, B=complex_12.Imaginary)  # disabled
subtraction_23 = Subtraction(A=complex_13.Real, B=complex_14.Real)  # disabled
equals_15 = Equality(FirstNumber=subtraction_23, SecondNumber=panel_111)  # -> Equality, Inequality; disabled
sift_21 = SiftPattern(List=complex_13.Real, SiftPattern=equals_15.Equality)  # -> Output0, Output1; disabled
subtraction_24 = Subtraction(A=complex_11.Real, B=complex_12.Real)  # disabled
equals_16 = Equality(FirstNumber=subtraction_24, SecondNumber=panel_110)  # -> Equality, Inequality; disabled
sift_22 = SiftPattern(List=complex_12.Real, SiftPattern=equals_16.Equality)  # -> Output0, Output1; disabled
subtraction_25 = Subtraction(A=complex_13.Imaginary, B=complex_14.Imaginary)  # disabled
combine_4 = CombineData(Input0=sift_21.Output1, Input1=sift_22.Output1)  # -> Result, Index; disabled
panel_116 = Panel(complex_13.Real)  # disabled
division_7 = Division(A=subtraction_22, B=subtraction_24)  # disabled
division_8 = Division(A=subtraction_25, B=subtraction_23)  # disabled
panel_117 = Panel(subtraction_24)  # disabled
panel_118 = Panel(equals_16.Equality)  # disabled
k1_2 = Number(division_8)  # disabled
multiplication_2 = Multiplication(A=k1_2, B=complex_14.Real)  # disabled
k2 = Number(division_7)  # disabled
multiplication_3 = Multiplication(A=k2, B=complex_12.Real)  # disabled
subtraction_26 = Subtraction(A=complex_14.Imaginary, B=multiplication_2)  # disabled
panel_119 = Panel(k1_2)  # disabled
subtraction_27 = Subtraction(A=complex_12.Imaginary, B=multiplication_3)  # disabled
subtraction_28 = Subtraction(A=k1_2, B=k2)  # disabled
b1_2 = Number(subtraction_26)  # disabled
dom = ConstructDomain(DomainStart=complex_13.Real, DomainEnd=complex_14.Real)  # disabled
b2 = Number(subtraction_27)  # disabled
dom_2 = ConstructDomain(DomainStart=complex_11.Real, DomainEnd=complex_12.Real)  # disabled
subtraction_29 = Subtraction(A=b2, B=b1_2)  # disabled
nullrep = ReplaceNulls(Items=k1_2, Replacements=complex_13.Real)  # -> Items, Count; disabled
division_9 = Division(A=subtraction_29, B=subtraction_28)  # disabled
panel_120 = Panel(division_9)  # disabled
inc = Includes(Value=division_9, Domain=dom)  # -> Includes, Deviation; disabled
inc_2 = Includes(Value=division_9, Domain=dom_2)  # -> Includes, Deviation; disabled
multiplication_4 = Multiplication(A=division_9, B=k2)  # disabled
panel_121 = Panel(nullrep.Items)  # disabled
nullrep_2 = ReplaceNulls(Items=division_9, Replacements=combine_4.Result)  # -> Items, Count; disabled
int_16 = Integer(inc.Includes)  # disabled
addition_16 = Addition(A=multiplication_4, B=b2)  # disabled
int_17 = Integer(inc_2.Includes)  # disabled
addition_17 = Addition(A=int_16, B=int_17)  # disabled
subtraction_30 = Subtraction(A=panel_113, B=addition_17)  # disabled
extendlinecount = Integer(subtraction_30)  # disabled
intersection_x = Number(division_9)  # disabled
intersection_y = Number(addition_16)  # disabled
pt_9 = PointOriented(BasePlane=xy_2, UComponent=intersection_x, VComponent=intersection_y, WComponent=0)  # disabled
panel_122 = Panel(extendlinecount)  # disabled
sift_23 = SiftPattern(List=pt_9, SiftPattern=extendlinecount)  # -> Output0, Output1, Output2; disabled
intersectionontwolines = Point(sift_23.Output0)  # disabled
intersectionononeline = Point(sift_23.Output1)  # disabled
intersectiononextend = Point(sift_23.Output2)  # disabled

xy_3 = XYPlane(Origin=Point(0, 0, 0))  # disabled
sift_24 = SiftPattern(List=division_9, SiftPattern=extendlinecount)  # -> Output0, Output1, Output2; disabled
sift_25 = SiftPattern(List=addition_16, SiftPattern=extendlinecount)  # -> Output0, Output1, Output2; disabled
pt_10 = PointOriented(BasePlane=xy_3, UComponent=sift_24.Output0, VComponent=sift_25.Output0, WComponent=0)  # disabled
flatten_28 = FlattenTree(Tree=pt_10, Path="{0}")  # disabled
clean_40 = CleanTree(RemoveNulls=True, RemoveInvalid=True, RemoveEmpty=False, Tree=flatten_28)  # disabled
pt_11 = Point(Point(-2.015690168, -16.36521091, 0))  # disabled
panel_123 = Panel("2")  # disabled
partition_3 = PartitionList(List=clean_40, Size=panel_123)  # disabled
bang_2 = ExplodeTree(Data=partition_3)  # -> Branch0, Branch1; disabled
rev = ReverseList(List=bang_2.Branch1)  # disabled
merge_8 = Merge(Data1=bang_2.Branch0, Data2=rev)  # -> flatten(Result); disabled
pline_3 = PolyLine(Vertices=merge_8, Closed=True)  # disabled

addition_18 = Addition(A=startpoint_3, B=vec_4)
endpoint_3 = Point(addition_18)
lng_13 = ListLength(List=addition_18)
lng_14 = ListLength(List=startpoint_3)
subtraction_31 = Subtraction(A=lng_13, B="1")
subtraction_32 = Subtraction(A=lng_14, B="1")
series_21 = Series(Start=0, Step=1, Count=subtraction_32)
series_22 = Series(Start=0, Step=1, Count=subtraction_31)
addition_19 = Addition(A=series_21, B="1")
addition_20 = Addition(A=series_22, B="1")
item_46 = ListItem(List=startpoint_3, Index=series_21, Wrap=False)  # -> simplify(graft(Item))
item_47 = ListItem(List=addition_18, Index=series_22, Wrap=False)  # -> simplify(graft(Item))
shift_18 = ShiftList(List=addition_18, Shift=addition_20, Wrap=False)  # -> simplify(List)
shift_19 = ShiftList(List=startpoint_3, Shift=addition_19, Wrap=False)  # -> simplify(List)

firstpt_line0_2 = Point(item_46)
firstpt_line1_2 = Point(shift_19)
endpt1_line1 = Point(shift_18)
endpt_line0_2 = Point(item_47)

end_8 = EndPoints(Curve=linelist)  # -> Start, End; disabled
subtraction_33 = Subtraction(A=end_8.End, B=end_8.Start)  # disabled
startpoint_5 = Point(end_8.Start)  # disabled
vec_7 = Vector(subtraction_33)  # disabled
addition_21 = Addition(A=startpoint_5, B=vec_7)  # disabled
endpoint_4 = Point(addition_21)  # disabled
lng_15 = ListLength(List=addition_21)  # disabled
lng_16 = ListLength(List=startpoint_5)  # disabled
panel_124 = Panel("1")  # disabled
panel_125 = Panel(startpoint_5)  # disabled
panel_126 = Panel("1")  # disabled
subtraction_34 = Subtraction(A=lng_15, B=panel_124)  # disabled
subtraction_35 = Subtraction(A=lng_16, B=panel_126)  # disabled
series_23 = Series(Start=0, Step=1, Count=subtraction_35)  # disabled
series_24 = Series(Start=0, Step=1, Count=subtraction_34)  # disabled
addition_22 = Addition(A=series_24, B=panel_124)  # disabled
addition_23 = Addition(A=series_23, B=panel_126)  # disabled
number_slider_6 = Slider(6, range=0..100)  # disabled
item_48 = ListItem(List=startpoint_5, Index=series_23, Wrap=False)  # -> simplify(graft(Item)); disabled
item_49 = ListItem(List=addition_21, Index=series_24, Wrap=False)  # -> simplify(graft(Item)); disabled
shift_20 = ShiftList(List=addition_21, Shift=addition_22, Wrap=False)  # -> simplify(List); disabled
shift_21 = ShiftList(List=startpoint_5, Shift=addition_23, Wrap=False)  # -> simplify(List); disabled
firstpt0_3 = Point(item_48)  # disabled
firstpt1_2 = Point(shift_21)  # disabled
endpt0_3 = Point(item_49)  # disabled
endpt1_2 = Point(shift_20)  # disabled
points_2 = PointList(Points=flatten(firstpt0_3), Size=number_slider_6)  # disabled
complex_15 = ComplexComponents(Complex=endpt1_2)  # -> Real, Imaginary; disabled
complex_16 = ComplexComponents(Complex=endpt0_3)  # -> Real, Imaginary; disabled
complex_17 = ComplexComponents(Complex=firstpt1_2)  # -> Real, Imaginary; disabled
complex_18 = ComplexComponents(Complex=firstpt0_3)  # -> Real, Imaginary; disabled
subtraction_36 = Subtraction(A=complex_18.Real, B=complex_16.Real)  # disabled
subtraction_37 = Subtraction(A=complex_18.Imaginary, B=complex_16.Imaginary)  # disabled
subtraction_38 = Subtraction(A=complex_17.Real, B=complex_15.Real)  # disabled
subtraction_39 = Subtraction(A=complex_17.Imaginary, B=complex_15.Imaginary)  # disabled
division_10 = Division(A=subtraction_37, B=subtraction_36)  # disabled
division_11 = Division(A=subtraction_39, B=subtraction_38)  # disabled
k2_2 = Number(division_11)  # disabled
multiplication_5 = Multiplication(A=k2_2, B=complex_15.Real)  # disabled
k1_3 = Number(division_10)  # disabled
multiplication_6 = Multiplication(A=k1_3, B=complex_16.Real)  # disabled
subtraction_40 = Subtraction(A=complex_16.Imaginary, B=multiplication_6)  # disabled
subtraction_41 = Subtraction(A=complex_15.Imaginary, B=multiplication_5)  # disabled
subtraction_42 = Subtraction(A=k1_3, B=k2_2)  # disabled
b1_3 = Number(subtraction_40)  # disabled
b2_2 = Number(subtraction_41)  # disabled
subtraction_43 = Subtraction(A=b2_2, B=b1_3)  # disabled
division_12 = Division(A=subtraction_43, B=subtraction_42)  # disabled
multiplication_7 = Multiplication(A=division_12, B=k2_2)  # disabled
addition_24 = Addition(A=multiplication_7, B=b2_2)  # disabled
xy_4 = XYPlane(Origin=Point(0, 0, 0))  # disabled
intersection_x_2 = Number(division_12)  # disabled
intersection_y_2 = Number(addition_24)  # disabled
xy_5 = XYPlane(Origin=Point(0, 0, 0))  # disabled
pt_12 = PointOriented(BasePlane=xy_5, UComponent=intersection_x_2, VComponent=intersection_y_2, WComponent=0)  # disabled

# ----
# 0 --> extend one line to intersect two lines
# 1 --> extend two lines
# 2 --> extend three lines
dom_3 = ConstructDomain(DomainStart=complex_17.Real, DomainEnd=complex_15.Real)  # disabled
dom_4 = ConstructDomain(DomainStart=complex_18.Real, DomainEnd=complex_16.Real)  # disabled
inc_3 = Includes(Value=division_12, Domain=dom_4)  # -> Includes, Deviation; disabled
inc_4 = Includes(Value=division_12, Domain=dom_3)  # -> Includes, Deviation; disabled
int_18 = Integer(inc_3.Includes)  # disabled
int_19 = Integer(inc_4.Includes)  # disabled
addition_25 = Addition(A=int_18, B=int_19)  # disabled
panel_127 = Panel("2")  # disabled
subtraction_44 = Subtraction(A=panel_127, B=addition_25)  # disabled
extendlinecount_2 = Integer(subtraction_44)  # disabled

sift_26 = SiftPattern(List=addition_24, SiftPattern=extendlinecount_2)  # -> Output0, Output1, Output2; disabled
sift_27 = SiftPattern(List=division_12, SiftPattern=extendlinecount_2)  # -> Output0, Output1, Output2; disabled
pt_13 = PointOriented(BasePlane=xy_4, UComponent=sift_27.Output0, VComponent=sift_26.Output0, WComponent=0)  # disabled
flatten_29 = FlattenTree(Tree=pt_13, Path="{0}")  # disabled
clean_41 = CleanTree(RemoveNulls=True, RemoveInvalid=True, RemoveEmpty=False, Tree=flatten_29)  # disabled
panel_128 = Panel(extendlinecount_2)  # disabled
sift_28 = SiftPattern(List=pt_12, SiftPattern=extendlinecount_2)  # -> Output0, Output1, Output2; disabled
intersectionontwolines_2 = Point(sift_28.Output0)  # disabled
intersectionononeline_2 = Point(sift_28.Output1)  # disabled
intersectiononextend_2 = Point(sift_28.Output2)  # disabled

# ---- group: vector match method 1 simplify
entwine_3 = Entwine(Branch00=panel_96, Branch01=panel_97, Branch02=panel_98, Branch03=panel_99, FlattenInputs=True)  # -> simplify(Result)
flatten_30 = FlattenTree(Tree=concat_8, Path="{0}")
mindex_15 = MemberIndex(Set=entwine_3, Member=flatten_30)  # -> Index, Count
clean_42 = CleanTree(RemoveNulls=True, RemoveInvalid=True, RemoveEmpty=True, Tree=mindex_15.Index)
pshift_6 = ShiftPaths(Data=clean_42, Offset=-1)
viewer_13 = ParamViewer(clean_42)

tstat_20 = TreeStatistics(Tree=pshift_6)  # -> Paths, Length, Count
dpath_12 = DeconstructPath(Branch=tstat_20.Paths)  # -> simplify(Indices)

graft_35 = GraftTree(Tree=tstat_20.Length, IncludeEmptyLists=True, IncludeNullItems=True)
series_25 = Series(Start=0, Step=1, Count=graft_35)
int_20 = Integer(simplify(series_25))
replace_17 = ReplaceItems(List=pshift_6, Item=dpath_12, Indices=int_20, Wrap=False)
graft_36 = GraftTree(Tree=flatten(replace_17), IncludeEmptyLists=True, IncludeNullItems=True)
viewer_14 = ParamViewer(graft_36)
replace_18 = ReplacePaths(Data=graft_36, Search=viewer_14, Replace=viewer_13)
pshift_7 = ShiftPaths(Data=replace_18, Offset="1")
item_50 = ListItem(List=vec_5, Index=pshift_7, Wrap=True)
amp_8 = Amplitude(Vector=item_50, Amplitude=combine_2.Result)
vdis_4 = VectorDisplay(Anchor=pt_7, Vector=amp_8)

# ----
points_3 = PointList(Points=flatten(firstpt_line0_2), Size=Slider(6, range=0..100))

complex_19 = ComplexComponents(Complex=firstpt_line0_2)  # -> Real, Imaginary
complex_20 = ComplexComponents(Complex=endpt_line0_2)  # -> Real, Imaginary
complex_21 = ComplexComponents(Complex=firstpt_line1_2)  # -> Real, Imaginary
complex_22 = ComplexComponents(Complex=endpt1_line1)  # -> Real, Imaginary
subtraction_45 = Subtraction(A=complex_21.Imaginary, B=complex_22.Imaginary)
subtraction_46 = Subtraction(A=complex_21.Real, B=complex_22.Real)
subtraction_47 = Subtraction(A=complex_19.Real, B=complex_20.Real)
subtraction_48 = Subtraction(A=complex_19.Imaginary, B=complex_20.Imaginary)
division_13 = Division(A=subtraction_45, B=subtraction_46)
division_14 = Division(A=subtraction_48, B=subtraction_47)
k1_4 = Number(division_14)
k2_3 = Number(division_13)
multiplication_8 = Multiplication(A=k2_3, B=complex_21.Real)
subtraction_49 = Subtraction(A=complex_21.Imaginary, B=multiplication_8)
b2_3 = Number(subtraction_49)
subtraction_50 = Subtraction(A=k1_4, B=k2_3)

multiplication_9 = Multiplication(A=k1_4, B=complex_19.Real)
subtraction_51 = Subtraction(A=complex_19.Imaginary, B=multiplication_9)

equals_17 = Equality(FirstNumber=subtraction_46, SecondNumber="0")  # -> Equality, Inequality
equals_18 = Equality(FirstNumber=subtraction_47, SecondNumber="0")  # -> Equality, Inequality
sift_29 = SiftPattern(List=complex_22.Real, SiftPattern=equals_17.Equality)  # -> Output0, Output1
sift_30 = SiftPattern(List=complex_19.Real, SiftPattern=equals_18.Equality)  # -> Output0, Output1
or_4 = GateOr(A=equals_18.Equality, B=equals_17.Equality)
combine_5 = CombineData(Input0=sift_30.Output1, Input1=sift_29.Output1)  # -> Result, Index
sift_31 = SiftPattern(List=k2_3, SiftPattern=equals_17.Equality)  # -> Output0, Output1
sift_32 = SiftPattern(List=b2_3, SiftPattern=equals_17.Equality)  # -> Output0, Output1
sift_33 = SiftPattern(List=k1_4, SiftPattern=equals_18.Equality)  # -> Output0, Output1
combine_6 = CombineData(Input0=sift_33.Output0, Input1=sift_31.Output0)  # -> Result, Index
a_2 = Number(combine_5.Result)
k = Number(combine_6.Result)
multiplication_10 = Multiplication(A=a_2, B=k)
intersection_x_3 = Number(a_2)

b1_4 = Number(subtraction_51)
subtraction_52 = Subtraction(A=b2_3, B=b1_4)
division_15 = Division(A=subtraction_52, B=subtraction_50)
multiplication_11 = Multiplication(A=division_15, B=k2_3)
addition_26 = Addition(A=multiplication_11, B=b2_3)
sift_34 = SiftPattern(List=addition_26, SiftPattern=or_4)  # -> Output0, Output1

sift_35 = SiftPattern(List=b1_4, SiftPattern=equals_18.Equality)  # -> Output0, Output1
combine_7 = CombineData(Input0=sift_35.Output0, Input1=sift_32.Output0)  # -> Result, Index
b_2 = Number(combine_7.Result)
sift_36 = SiftPattern(List=b_2, SiftPattern=or_4)  # -> Output0, Output1
addition_27 = Addition(A=multiplication_10, B=sift_36.Output1)
intersection_y_3 = Number(addition_27)

combine_8 = CombineData(Input0=sift_34.Output0, Input1=intersection_y_3)  # -> Result, Index
combine_9 = CombineData(Input0=division_15, Input1=intersection_x_3)  # -> Result, Index

panel_129 = Panel(equals_18.Equality)
intersection_x_4 = Number(combine_9.Result)
intersection_y_4 = Number(combine_8.Result)
pt_14 = PointOriented(BasePlane=xy, UComponent=intersection_x_4, VComponent=intersection_y_4, WComponent=0)

# ----
# true --> real insection
# false --> extend
# 10,11 --> real insection
# 01       --> extend one line
# 00       --> extend two lines
# true   -- > extend one line
# false -->  extend two lines
dom_5 = ConstructDomain(DomainStart=complex_19.Imaginary, DomainEnd=complex_20.Imaginary)
dom_6 = ConstructDomain(DomainStart=complex_19.Real, DomainEnd=complex_20.Real)
dom_7 = ConstructDomain(DomainStart=complex_21.Real, DomainEnd=complex_22.Real)
dom_8 = ConstructDomain(DomainStart=complex_21.Imaginary, DomainEnd=complex_22.Imaginary)
firstpty_domain = Domain(dom_5)
firstptx_domain = Domain(dom_6)
endpty_domain = Domain(dom_8)
endptx_domain = Domain(dom_7)
inc_5 = Includes(Value=intersection_y_4, Domain=firstpty_domain)  # -> Includes, Deviation
inc_6 = Includes(Value=intersection_x_4, Domain=endptx_domain)  # -> Includes, Deviation
inc_7 = Includes(Value=intersection_y_4, Domain=endpty_domain)  # -> Includes, Deviation
inc_8 = Includes(Value=intersection_x_4, Domain=firstptx_domain)  # -> Includes, Deviation
or_5 = GateOr(A=inc_8.Includes, B=inc_5.Includes, C=inc_6.Includes, D=inc_7.Includes)
and_10 = GateAnd(A=inc_8.Includes, B=inc_5.Includes, C=inc_6.Includes, D=inc_7.Includes)
int_21 = Integer(and_10)
int_22 = Integer(or_5)
concat_9 = Concatenate(FragmentA=int_21, FragmentB=int_22)
panel_130 = Panel("""10
11
01
00""")
panel_131 = Panel("""0
0
1
2""")
keysearch_5 = KeyValueSearch(Keys=panel_130, Values=panel_131, Search=concat_9)
extendlinecount_3 = Integer(keysearch_5)

# ----
# k1=k2,b1=b2 --> common line -->point or line
equals_19 = Equality(FirstNumber=k1_4, SecondNumber=k2_3)  # -> Equality, Inequality; disabled
equals_20 = Equality(FirstNumber=b1_4, SecondNumber=b2_3)  # -> Equality, Inequality; disabled
and_11 = GateAnd(A=equals_19.Equality, B=equals_20.Equality)  # disabled
dedomain_5 = DeconstructDomain(Domain=firstptx_domain)  # -> Start, End; disabled
dedomain_6 = DeconstructDomain(Domain=firstpty_domain)  # -> Start, End; disabled
dedomain_7 = DeconstructDomain(Domain=endptx_domain)  # -> Start, End; disabled
dedomain_8 = DeconstructDomain(Domain=endpty_domain)  # -> Start, End; disabled
merge_9 = Merge(Data1=dedomain_5.Start, Data2=dedomain_5.End, Data3=dedomain_7.Start, Data4=dedomain_7.End)  # disabled
merge_10 = Merge(Data1=dedomain_6.Start, Data2=dedomain_6.End, Data3=dedomain_8.Start, Data4=dedomain_8.End)  # disabled
sort_5 = SortList(Keys=merge_9)  # -> Keys, ValuesA; disabled
sort_6 = SortList(Keys=merge_10)  # -> Keys, ValuesA; disabled
panel_132 = Panel("1")  # disabled
panel_133 = Panel("1")  # disabled
item_51 = ListItem(List=sort_5.Keys, Index=panel_132, Wrap=False)  # -> Item, Item1; disabled
item_52 = ListItem(List=sort_6.Keys, Index=panel_133, Wrap=False)  # -> Item, Item1; disabled
panel_134 = Panel("2")  # disabled
panel_135 = Panel("2")  # disabled
addition_28 = Addition(A=item_52.Item, B=item_52.Item1)  # disabled
addition_29 = Addition(A=item_51.Item, B=item_51.Item1)  # disabled
division_16 = Division(A=addition_28, B=panel_135)  # disabled
division_17 = Division(A=addition_29, B=panel_134)  # disabled

sift_37 = SiftPattern(List=pt_14, SiftPattern=extendlinecount_3)  # -> Output0, Output1, Output2
intersectionontwolines_3 = Point(sift_37.Output0)
intersectionononeline_3 = Point(sift_37.Output1)
intersectiononextend_3 = Point(sift_37.Output2)
panel_136 = Panel(intersectionontwolines_3)

firstpt0_4 = Point(firstpt_line0)
firstpt1_3 = Point(firstpt_line1)
endpt0_4 = Point(endpt_line0)
endpt1_3 = Point(endpt_line1)
points_4 = PointList(Points=flatten(firstpt0_4), Size=Slider(0.109, range=0..3))
complex_23 = ComplexComponents(Complex=firstpt0_4)  # -> Real, Imaginary
complex_24 = ComplexComponents(Complex=firstpt1_3)  # -> Real, Imaginary
complex_25 = ComplexComponents(Complex=endpt1_3)  # -> Real, Imaginary
complex_26 = ComplexComponents(Complex=endpt0_4)  # -> Real, Imaginary
subtraction_53 = Subtraction(A=complex_24.Imaginary, B=complex_25.Imaginary)
subtraction_54 = Subtraction(A=complex_24.Real, B=complex_25.Real)
equals_21 = Equality(FirstNumber=subtraction_54, SecondNumber="0")  # -> Equality, Inequality
sift_38 = SiftPattern(List=complex_25.Real, SiftPattern=equals_21.Equality)  # -> Output0, Output1
subtraction_55 = Subtraction(A=complex_23.Imaginary, B=complex_26.Imaginary)
subtraction_56 = Subtraction(A=complex_23.Real, B=complex_26.Real)
equals_22 = Equality(FirstNumber=subtraction_56, SecondNumber="0")  # -> Equality, Inequality
sift_39 = SiftPattern(List=complex_23.Real, SiftPattern=equals_22.Equality)  # -> Output0, Output1
or_6 = GateOr(A=equals_22.Equality, B=equals_21.Equality)
combine_10 = CombineData(Input0=sift_39.Output1, Input1=sift_38.Output1)  # -> Result, Index
division_18 = Division(A=subtraction_53, B=subtraction_54)
division_19 = Division(A=subtraction_55, B=subtraction_56)
panel_137 = Panel("""处理k不存在的情况

写成函数
把坐标在相减后就分开来算""")
k2_4 = Number(division_18)
multiplication_12 = Multiplication(A=k2_4, B=complex_24.Real)
sift_40 = SiftPattern(List=k2_4, SiftPattern=equals_21.Equality)  # -> Output0, Output1
subtraction_57 = Subtraction(A=complex_24.Imaginary, B=multiplication_12)
k1_5 = Number(division_19)
multiplication_13 = Multiplication(A=k1_5, B=complex_23.Real)
sift_41 = SiftPattern(List=k1_5, SiftPattern=equals_22.Equality)  # -> Output0, Output1
subtraction_58 = Subtraction(A=complex_23.Imaginary, B=multiplication_13)
combine_11 = CombineData(Input0=sift_41.Output0, Input1=sift_40.Output0)  # -> Result, Index
b1_5 = Number(subtraction_58)
sift_42 = SiftPattern(List=b1_5, SiftPattern=equals_22.Equality)  # -> Output0, Output1
b2_4 = Number(subtraction_57)
sift_43 = SiftPattern(List=b2_4, SiftPattern=equals_21.Equality)  # -> Output0, Output1
combine_12 = CombineData(Input0=sift_42.Output0, Input1=sift_43.Output0)  # -> Result, Index
subtraction_59 = Subtraction(A=b2_4, B=b1_5)
b_3 = Number(combine_12.Result)
a_3 = Number(combine_10.Result)
k_2 = Number(combine_11.Result)
subtraction_60 = Subtraction(A=k1_5, B=k2_4)
sift_44 = SiftPattern(List=b_3, SiftPattern=or_6)  # -> Output0, Output1
multiplication_14 = Multiplication(A=a_3, B=k_2)
division_20 = Division(A=subtraction_59, B=subtraction_60)
multiplication_15 = Multiplication(A=division_20, B=k2_4)
addition_30 = Addition(A=multiplication_15, B=b2_4)
sift_45 = SiftPattern(List=addition_30, SiftPattern=or_6)  # -> Output0, Output1
addition_31 = Addition(A=multiplication_14, B=sift_44.Output1)
intersection_x_5 = Number(a_3)
intersection_y_5 = Number(addition_31)
combine_13 = CombineData(Input0=sift_45.Output0, Input1=intersection_y_5)  # -> Result, Index
combine_14 = CombineData(Input0=division_20, Input1=intersection_x_5)  # -> Result, Index
intersection_x_6 = Number(combine_14.Result)
intersection_y_6 = Number(combine_13.Result)
xy_6 = XYPlane(Origin=Point(0, 0, 0))
pt_15 = PointOriented(BasePlane=xy_6, UComponent=intersection_x_6, VComponent=intersection_y_6, WComponent=0)

# ----
# true --> real insection
# false --> extend
# 10,11 --> real insection
# 01       --> extend one line
# 00       --> extend two lines
# true   -- > extend one line
# false -->  extend two lines
dom_9 = ConstructDomain(DomainStart=complex_23.Imaginary, DomainEnd=complex_26.Imaginary)
dom_10 = ConstructDomain(DomainStart=complex_23.Real, DomainEnd=complex_26.Real)
dom_11 = ConstructDomain(DomainStart=complex_24.Real, DomainEnd=complex_25.Real)
dom_12 = ConstructDomain(DomainStart=complex_24.Imaginary, DomainEnd=complex_25.Imaginary)
firstpty_domain_2 = Domain(dom_9)
firstptx_domain_2 = Domain(dom_10)
endpty_domain_2 = Domain(dom_12)
endptx_domain_2 = Domain(dom_11)
inc_9 = Includes(Value=intersection_y_6, Domain=firstpty_domain_2)  # -> Includes, Deviation
inc_10 = Includes(Value=intersection_x_6, Domain=endptx_domain_2)  # -> Includes, Deviation
inc_11 = Includes(Value=intersection_y_6, Domain=endpty_domain_2)  # -> Includes, Deviation
inc_12 = Includes(Value=intersection_x_6, Domain=firstptx_domain_2)  # -> Includes, Deviation
or_7 = GateOr(A=inc_12.Includes, B=inc_9.Includes, C=inc_10.Includes, D=inc_11.Includes)
and_12 = GateAnd(A=inc_12.Includes, B=inc_9.Includes, C=inc_10.Includes, D=inc_11.Includes)
int_23 = Integer(and_12)
int_24 = Integer(or_7)
concat_10 = Concatenate(FragmentA=int_23, FragmentB=int_24)
panel_138 = Panel("""10
11
01
00""")
panel_139 = Panel("""0
0
1
2""")
keysearch_6 = KeyValueSearch(Keys=panel_138, Values=panel_139, Search=concat_10)
extendlinecount_4 = Integer(keysearch_6)

sift_46 = SiftPattern(List=pt_15, SiftPattern=extendlinecount_4)  # -> Output0, Output1, Output2
intersectiononextend_4 = Point(sift_46.Output2)
intersectionontwolines_4 = Point(sift_46.Output0)
intersectionononeline_4 = Point(sift_46.Output1)
