# Grasshopper definition 20161020_胡廷威_points_intersection_012_lineDatabase_commit.gh (Grasshopper 0.9.76)

# Point:indicate a position in space
# Line:length,direction,position
# Point
# two ends of the line
# the intersection of two lines
# the meeting of lines at the corner of a space or volumn
# the center of field
panel = Panel("""0;0;0_3.2/1_1.0/3_2.2/5_4.0
1;0;2_2.5/3_4.0/4_8.2/5_1.2/7_2,3.2
2;0;1_2.2/7_2,1.9/11_3.222
3;0;4_8.2/6_4,2.2/14_2.442,3.442""")
panel_2 = Panel("""0;0;0_3.2/1_1.0/3_2.2/5_4.0
1;0;2_2.5/3_4.0/4_8.2/5_1.2/7_2,3.2
2;0;1_2.2/7_2,1.9/11_3.222
3;0;4_8.2/6_4,2.2/14_2.442,3.442
4;0;4_8.2/6_1.2,4.2/14_3.56,4.23
5;0;3_3.2/6_1.2,4.2
6;0;0_2/2_2.3/1_3.2
7;0;6_3.2,1.2/7_1.2,3.2
8;0;8_3.2,2.2,1.2/9_3.4,1.3,1.2/10_2
9;0;6_2.2,3.1/11_4,3,2.2
10;0;12_3.221/13_4
11;0;6_3.21,2.22/15_4.23,5.43""")

# ----
# feed data and store data
panel_3 = Panel("/")
# log:
# 20161017
# 给定相应的数据，去匹配相应的算法
# 考虑是否要反馈数据
# path在后面匹配时，相同path的被放在一起，真tm尴尬...
# 完成一个基本的模板，明天按照这样继续做下去
# 20161018
# 算法和对应的参数进行匹配
# 对数据结构的处理进行简化，避免重复计算
# 数据的过滤和储存方式
txt = Text(panel_2)
split = TextSplit(Text=txt, Separators=";")
item = ListItem(List=split, Index=0, Wrap=True)  # -> Item, Item1, Item2
split_2 = TextSplit(Text=item.Item2, Separators=panel_3)
split_3 = TextSplit(Text=split_2, Separators="_")
item_2 = ListItem(List=split_3, Index=0, Wrap=True)  # -> simplify(Item), Item1
pshift = ShiftPaths(Data=item_2.Item, Offset=-1)
split_4 = TextSplit(Text=item_2.Item1, Separators=",")  # -> simplify(Result)
tstat = TreeStatistics(Tree=pshift)  # -> Paths, Length, Count
initialparasdepathlist = Integer(pshift)
initiallinecount = Integer(tstat.Count)
graft = GraftTree(Tree=tstat.Length, IncludeEmptyLists=True, IncludeNullItems=True)  # -> simplify(Tree)
initialparascounts = Integer(graft)
stack = StackData(Data=item.Item, Stack=initialparascounts)
stack_2 = StackData(Data=item.Item1, Stack=initialparascounts)
graft_2 = GraftTree(Tree=stack_2, IncludeEmptyLists=True, IncludeNullItems=True)
graft_3 = GraftTree(Tree=stack, IncludeEmptyLists=True, IncludeNullItems=True)
int = Integer(simplify(graft_3))
int_2 = Integer(simplify(item_2.Item))
int_3 = Integer(simplify(graft_2))
merge = Merge(Data1=int, Data2=int_3, Data3=int_2)
path = ConstructPath(Indices=merge)
flatten = FlattenTree(Tree=path, Path="{0}")
initialparaspaths = DataPath(path)
viewer = ParamViewer(split_4)
replace = ReplacePaths(Data=split_4, Search=viewer, Replace=flatten)
data = Data(replace)

panel_4 = Panel(data)
databasemapping = Panel("""0,1,2
3,6
4,5
3,5
6,7
8,9,10
6,11
12,13
6,14
6,15""")
databasemapping_2 = Panel("""0,1,2;(0!=zero)and(1!=zero)
3,6;
4,5;(4!=zero)and(5!=zero)
3,5;
6,7;(6[0]!=6[1])and(7[0]!=7[1])
8,9,10;
6,11;
12,13;12=!k*pi,k=1,2,3..
6,14;(14[0]!=zero)and(14[1]!=zero)
6,15;(15[0]!=zero)and(15[1]!=zero)""")
split_5 = TextSplit(Text=databasemapping, Separators=",")  # -> simplify(Result)

functionparasdepathlist = Integer(split_5)
initialparasdepathlist_2 = Integer(initialparasdepathlist)

dataparameterspath = Panel(initialparasdepathlist_2)
functionpath = Panel(functionparasdepathlist)
tstat_2 = TreeStatistics(Tree=functionparasdepathlist)  # -> Paths, Length, Count
initialparascounts_2 = Integer(initialparascounts)
flatten_2 = FlattenTree(Tree=functionparasdepathlist, Path="{0}")
functionsmatchparascounts = Integer(tstat_2.Length)
initiallinecount_2 = Integer(initiallinecount)
functionscount = Integer(tstat_2.Count)
lng = ListLength(List=flatten_2)
multiplication = Multiplication(A=initialparascounts_2, B=functionscount)
multiplication_2 = Multiplication(A=initiallinecount_2, B=lng)
repeat = RepeatData(Data=initialparasdepathlist_2, Length=multiplication)  # -> simplify(Data)
repeat_2 = RepeatData(Data=flatten_2, Length=multiplication_2)
partition = PartitionList(List=repeat, Size=initialparascounts_2)  # -> simplify(Chunks)
partition_2 = PartitionList(List=repeat_2, Size=lng)
partition_3 = PartitionList(List=partition_2, Size=functionsmatchparascounts)  # -> simplify(Chunks)
int_4 = Integer(partition_3)
int_5 = Integer(partition)
mindex = MemberIndex(Set=int_4, Member=int_5)  # -> Index, Count
lng_2 = ListLength(List=int_4)
ma = MassAddition(Input=mindex.Count)  # -> Result, PartialResults
equals = Equality(FirstNumber=lng_2, SecondNumber=ma.Result)  # -> Equality, Inequality
sift = SiftPattern(List=int_4, SiftPattern=equals.Equality)  # -> Output0, Output1
panel_5 = Panel("""2
2""")
panel_6 = Panel("""1
3
5""")
panel_7 = Panel("""7
2
2""")
panel_8 = Panel("""2,3,1
4,2,3
1,3,2""")
panel_9 = Panel("""3
2
1""")
panel_10 = Panel("""3,2,2
1,3,4
4,1,3""")
panel_11 = Panel("""3.22133
1.3229
pi""")
panel_12 = Panel("""2
3""")
panel_13 = Panel("""1
0
4""")
panel_14 = Panel("""3,2,2
2,3,2
4,1,3""")
panel_15 = Panel("""3.42
5.33
1.44""")
clean = CleanTree(RemoveNulls=True, RemoveInvalid=True, RemoveEmpty=True, Tree=sift.Output1)
panel_16 = Panel("""3,2
1,3
0,1""")
panel_17 = Panel("""2,3
4,0
1,3""")
tstat_3 = TreeStatistics(Tree=clean)  # -> Paths, Length, Count
# log:
# 20161010
# 设计向量方向与数据结构之间的映射关系
# 数据结构用集合运算然后替换
# 替换树形结构的时候需要拍平
# 无论什么情况都留出0123正交的位置为Null
# 如果0123存在，没关系，不存在，插入一个空值
# 20161011
# 角度和path之间的映射关系，以及角度的识别:
# 分解basic line的path得到位置位置关系
# 先正交的位置关系，后自由的位置关系
# 考虑先组合line还是先分解path在配对
# 如何识别path知道非正交的相反的向量
# 增强path的排序的算法前馈，可通过path运算直接得到向量关系
# 运用path提取相应的两条交线
# 20161012
# debug时候replacePath爆红
# 精度问题导致set不能去掉原本偏差相同的角度
# 20161017
# 找到了两根交线的关系，先把他放在这，具体怎么用不继续做下去，先考虑其他的大的情况
# 先罗列出方程对应的算法
# 建立数据库，对数据结构进行设计，让每一个数据都有对应的位置
# 给定相应的数据，去匹配相应的算法
# 考虑是否要反馈数据
databaseparameters = Panel("""A
B
C
k
a
b
pt0(x0,y0)
pt1(x1,y1)
intersection_line0(A0,B0,C0)
intersection_line1(A1,B1,C1)
intersection_m
parallel_line(A2,B2,C2)
angle
distance(p)
vector(u,v)
normal_vector(nu,nv)""")
panel_18 = Panel("""1
3""")
dpath = DeconstructPath(Branch=tstat_3.Paths)
item_3 = ListItem(List=dpath, Index=0, Wrap=True)

# ----
# path{x;y}
# x         --> line index
# y         --> function index
# value  -->  parameters index
# each line choose first function
flatten_3 = FlattenTree(Tree=item_3, Path="{0}")
path_2 = DataPath(tstat_3.Paths)
cset = CreateSet(List=flatten_3)  # -> Set, Map
item_4 = ListItem(List=path_2, Index=cset.Set, Wrap=False)
branch = TreeBranch(Tree=clean, Path=item_4, MaintainPaths=True)
int_6 = Integer(branch)

A = Number(panel_12)
B = Number(panel_5)
k = Number(panel_6)
a = Number(panel_13)
b = Number(panel_7)
pt0 = Point([Point(-8, -7, 0), Point(-5, 0, 0), Point(-16, -3, 0)])
pt1 = Point([Point(-8, -10, 0), Point(3, -7, 0), Point(-4, -2, 0)])
intersection_line0_a0_b0_c0 = Vector(panel_8)
intersection_m = Number(panel_9)
parallel_line_a2_b2_c2 = Vector(panel_10)
normal_vector_nu_nv = Vector(panel_17)
C = Number(panel_18)
intersection_line0_a1_b1_c1 = Vector(panel_14)
angle = Number(panel_11)
distance_p = Number(panel_15)
vector_u_v = Vector(panel_16)
pi = Pi(Factor=1)
complex = ComplexComponents(Complex=pt0)  # -> Real, Imaginary
complex_2 = ComplexComponents(Complex=pt1)  # -> Real, Imaginary
division = Division(A=angle, B=pi)
int_7 = Integer(division)
databasefunctions = Panel("""Ax+By+C=0,A!=0 and B!=0
y-y0=k(x-x0),k!=empty
x/a+y/b=1,a!=0andb!=0
y=kx+b,k!=empty
(y-y1)(y2-y1)=(x-x1)(x2-x1),x1!=x2andy1!=y2
f1(x,y)*m+f2(x,y)=0
f(x,y)-f(x0,y0)=0
x*cos(angle)+y*sin(angle)-p=0,angle=!k*pi
(x-x0)/u=(y-y0)/v,u!=0andv!=0
nu*(x-x0)+nv(y-y0)=0,nv!=0andnu!=0""")
complex_3 = ComplexComponents(Complex=vector_u_v)  # -> Real, Imaginary
x0 = Number(complex.Real)
y0 = Number(complex.Imaginary)
x1 = Number(complex_2.Real)
y1 = Number(complex_2.Imaginary)
subtraction = Subtraction(A=division, B=int_7)
equals_2 = Equality(FirstNumber=A, SecondNumber="0")  # -> Equality, Inequality
equals_3 = Equality(FirstNumber=B, SecondNumber="0")  # -> Equality, Inequality
abs = Absolute(Value=subtraction)
merge_2 = Merge(Data1=graft(A), Data2=graft(B), Data3=graft(C))
# path{x;y}表示，索引为x的线可以匹配索引为y算法。
# 如果是相同x下有多个，说明算法上有多个选择
panel_19 = Panel(int_6)
equals_4 = Equality(FirstNumber=a, SecondNumber="0")  # -> Equality, Inequality
equals_5 = Equality(FirstNumber=b, SecondNumber="0")  # -> Equality, Inequality
pdecon = Deconstruct(Point=intersection_line0_a0_b0_c0)  # -> XComponent, YComponent, ZComponent
pdecon_2 = Deconstruct(Point=intersection_line0_a1_b1_c1)  # -> XComponent, YComponent, ZComponent
complex_4 = ComplexComponents(Complex=normal_vector_nu_nv)  # -> Real, Imaginary
and = GateAnd(A=graft(equals_2.Inequality), B=graft(equals_3.Inequality))
equals_6 = Equality(FirstNumber=complex_3.Real, SecondNumber="0")  # -> Equality, Inequality
equals_7 = Equality(FirstNumber=complex_3.Imaginary, SecondNumber="0")  # -> Equality, Inequality
larger = LargerThan(FirstNumber=abs, SecondNumber="0.000001")  # -> LargerThan, OrEqualTo
and_2 = GateAnd(A=equals_4.Inequality, B=equals_5.Inequality)
equals_8 = Equality(FirstNumber=complex_4.Real, SecondNumber="0")  # -> Equality, Inequality
equals_9 = Equality(FirstNumber=complex_4.Imaginary, SecondNumber="0")  # -> Equality, Inequality

tstat_4 = TreeStatistics(Tree=int_6)  # -> Paths, Length, Count
dpath_2 = DeconstructPath(Branch=tstat_4.Paths)
data_2 = Data(data)
functionsmatchparascounts_2 = Integer(functionsmatchparascounts)
viewer_2 = ParamViewer(dpath_2)
tstat_5 = TreeStatistics(Tree=int_6)  # -> Paths, Length, Count
dpath_3 = DeconstructPath(Branch=tstat_5.Paths)
viewer_3 = ParamViewer(dpath_3)
replace_2 = ReplacePaths(Data=dpath_2, Search=viewer_2, Replace=tstat_4.Paths)
replace_3 = ReplacePaths(Data=dpath_3, Search=viewer_3, Replace=tstat_5.Paths)
item_5 = ListItem(List=replace_2, Index=0, Wrap=True)  # -> Item, Item1
item_6 = ListItem(List=functionsmatchparascounts_2, Index=item_5.Item1, Wrap=False)
item_7 = ListItem(List=replace_3, Index=0, Wrap=True)  # -> Item, Item1
stack_3 = StackData(Data=item_5.Item, Stack=item_6)
stack_4 = StackData(Data=item_7.Item1, Stack=item_6)
graft_4 = GraftTree(Tree=int_6, IncludeEmptyLists=True, IncludeNullItems=True)
graft_5 = GraftTree(Tree=stack_3, IncludeEmptyLists=True, IncludeNullItems=True)
graft_6 = GraftTree(Tree=stack_4, IncludeEmptyLists=True, IncludeNullItems=True)
merge_3 = Merge(Data1=graft_5, Data3=graft_4)
ins = InsertItems(List=merge_3, Item="0", Indices="1", Wrap=True)  # -> simplify(List)
path_3 = ConstructPath(Indices=ins)
branch_2 = TreeBranch(Tree=data_2, Path=path_3, MaintainPaths=True)

and_3 = GateAnd(A=equals_6.Inequality, B=equals_7.Inequality)
pdecon_3 = Deconstruct(Point=parallel_line_a2_b2_c2)  # -> XComponent, YComponent, ZComponent
sift_2 = SiftPattern(List=merge_2, SiftPattern=and)  # -> Output0, Output1
sift_3 = SiftPattern(List=angle, SiftPattern=larger.LargerThan)  # -> Output0, Output1
sift_4 = SiftPattern(List=distance_p, SiftPattern=larger.LargerThan)  # -> Output0, Output1
and_4 = GateAnd(A=equals_8.Inequality, B=equals_9.Inequality)
sift_5 = SiftPattern(List=complex_4.Imaginary, SiftPattern=and_4)  # -> Output0, Output1
sift_6 = SiftPattern(List=complex_4.Real, SiftPattern=and_4)  # -> Output0, Output1
sift_7 = SiftPattern(List=complex_3.Imaginary, SiftPattern=and_3)  # -> Output0, Output1
sift_8 = SiftPattern(List=complex_3.Real, SiftPattern=and_3)  # -> Output0, Output1
sift_9 = SiftPattern(List=a, SiftPattern=and_2)  # -> Output0, Output1
sift_10 = SiftPattern(List=b, SiftPattern=and_2)  # -> Output0, Output1
item_8 = ListItem(List=sift_2.Output1, Index=0, Wrap=True)  # -> Item, Item1, Item2
eval = Evaluate(F="{cos(angle),sin(angle),-p}", angle=sift_3.Output1, p=sift_4.Output1)
eval_2 = Evaluate(
    F="{m*A0+A1,m*B0+B1,m*C0+C1}",
    A0=pdecon.XComponent,
    B0=pdecon.YComponent,
    C0=pdecon.ZComponent,
    A1=pdecon_2.XComponent,
    B1=pdecon_2.YComponent,
    C1=pdecon_2.ZComponent,
    m=intersection_m)
eval_3 = Evaluate(F="{A2,B2,-A2*x0-B2*y0}", A2=pdecon_3.XComponent, B2=pdecon_3.YComponent, C2=pdecon_3.ZComponent, x0=x0, y0=y0)
eval_4 = Evaluate(F="{nu,nv,-nu*x0-nv*y0}", x0=x0, y0=y0, nu=sift_6.Output1, nv=sift_5.Output1)
eval_5 = Evaluate(F="{k,-1,y0-k*x0}", k=k, x0=x0, y0=y0)
eval_6 = Evaluate(F="{x0-x1,y1-y0,x0*x1-y0*y1-x0*x0+y0*y0}", x0=x0, y0=y0, x1=x1, y1=y1)
eval_7 = Evaluate(F="{v,-u,-v*x0+u*y0}", x0=x0, y0=y0, u=sift_8.Output1, v=sift_7.Output1)
eval_8 = Evaluate(F="{A,B,C}", A=item_8.Item, B=item_8.Item1, C=item_8.Item2)
eval_9 = Evaluate(F="{b,a,-a*b}", a=sift_9.Output1, b=sift_10.Output1)
eval_10 = Evaluate(F="{k,-1,b}", k=k, b=b)
panel_20 = Panel(eval_8)
panel_21 = Panel(eval_5)
panel_22 = Panel(eval_7)
panel_23 = Panel(eval_9)
panel_24 = Panel(eval_10)
panel_25 = Panel(eval_6)
panel_26 = Panel(eval_2)
panel_27 = Panel(eval_3)
panel_28 = Panel(eval)
panel_29 = Panel(eval_4)
sift_11 = SiftPattern(List=branch_2, SiftPattern=graft_6)  # -> Output0, Output1, Output2, Output3, Output4, Output5, Output6, Output7, Output8, Output9
clean_2 = CleanTree(RemoveNulls=True, RemoveInvalid=True, RemoveEmpty=True, Tree=sift_11.Output0)
clean_3 = CleanTree(RemoveNulls=True, RemoveInvalid=True, RemoveEmpty=True, Tree=sift_11.Output1)
clean_4 = CleanTree(RemoveNulls=True, RemoveInvalid=True, RemoveEmpty=True, Tree=sift_11.Output2)
clean_5 = CleanTree(RemoveNulls=True, RemoveInvalid=True, RemoveEmpty=True, Tree=sift_11.Output3)
clean_6 = CleanTree(RemoveNulls=True, RemoveInvalid=True, RemoveEmpty=True, Tree=sift_11.Output4)
clean_7 = CleanTree(RemoveNulls=True, RemoveInvalid=True, RemoveEmpty=True, Tree=sift_11.Output5)
clean_8 = CleanTree(RemoveNulls=True, RemoveInvalid=True, RemoveEmpty=True, Tree=sift_11.Output6)
clean_9 = CleanTree(RemoveNulls=True, RemoveInvalid=True, RemoveEmpty=True, Tree=sift_11.Output7)
clean_10 = CleanTree(RemoveNulls=True, RemoveInvalid=True, RemoveEmpty=True, Tree=sift_11.Output8)
clean_11 = CleanTree(RemoveNulls=True, RemoveInvalid=True, RemoveEmpty=True, Tree=sift_11.Output9)
tstat_6 = TreeStatistics(Tree=clean_10)  # -> Paths, Length, Count
# foolish!
# foolish!
# foolish!
tstat_7 = TreeStatistics(Tree=int_6)  # -> Paths, Length, Count
pshift_2 = ShiftPaths(Data=tstat_7.Paths, Offset=-1)
dpath_4 = DeconstructPath(Branch=pshift_2)
viewer_4 = ParamViewer(dpath_4)
replace_4 = ReplacePaths(Data=dpath_4, Search=viewer_4, Replace=item_4)
item_9 = ListItem(List=replace_4, Index=0, Wrap=True)  # -> Item, Item1
panel_30 = Panel(replace_4)
int_8 = Integer(item_9.Item)
int_9 = Integer(item_9.Item1)

# ----
# {a;b;c;d;e}
# a --> line index
# b --> line type
# c --> line parameter index
# d --> line function mapping
lng_3 = ListLength(List=int_6)
flatten_4 = FlattenTree(Tree=item.Item1, Path="{0}")
stack_5 = StackData(Data=int_8, Stack=lng_3)
item_10 = ListItem(List=flatten_4, Index=stack_5, Wrap=True)
stack_6 = StackData(Data=int_9, Stack=lng_3)
graft_7 = GraftTree(Tree=int_6, IncludeEmptyLists=True, IncludeNullItems=True)
graft_8 = GraftTree(Tree=stack_5, IncludeEmptyLists=True, IncludeNullItems=True)
graft_9 = GraftTree(Tree=item_10, IncludeEmptyLists=True, IncludeNullItems=True)
graft_10 = GraftTree(Tree=stack_6, IncludeEmptyLists=True, IncludeNullItems=True)
merge_4 = Merge(Data1=graft_8, Data2=graft_9, Data3=graft_7)
merge_5 = Merge(Data1=graft_8, Data2=graft_9, Data3=graft_7, Data4=graft_10)
path_4 = ConstructPath(Indices=merge_4)
path_5 = ConstructPath(Indices=merge_5)
data_3 = Data(data)
flatten_5 = FlattenTree(Tree=path_4, Path="{0}")
flatten_6 = FlattenTree(Tree=path_5, Path="{0}")
branch_3 = TreeBranch(Tree=data_3, Path=flatten_5, MaintainPaths=True)
viewer_5 = ParamViewer(branch_3)
replace_5 = ReplacePaths(Data=branch_3, Search=viewer_5, Replace=flatten_6)

int_10 = Integer(tstat_2.Length)
panel_31 = Panel("""0;0;0_3.2/1_1.0/3_2.2/5_4.0
1;0;2_2.5/3_4.0/4_8.2/5_1.2/7_2,3.2
2;0;1_2.2/7_2,1.9/11_3.222
3;0;4_8.2/6_4,2.2/14_2.442,3.442
4;0;4_8.2/6_1.2,4.2/14_3.56,4.23
5;0;3_3.2/6_1.2,4.2
6;0;0_2/2_2.3/1_3.2
7;0;6_3.2,1.2/7_1.2,3.2
8;0;8_3.2,2.2,1.2/9_3.4,1.3,1.2/10_2
9;0;6_2.2,3.1/11_4,3,2.2
10;0;12_3.221/13_4
11;0;6_3.21,2.22/15_4.23,5.43""")
int_11 = Integer(graft_10)
data_4 = Data(replace_5)
panel_32 = Panel(data_4)
panel_33 = Panel(replace_5)
item_11 = ListItem(List=int_10, Index=0, Wrap=False)  # -> Item, Item1, Item2, Item3, Item4, Item5, Item6, Item7, Item8, Item9
num = Number(item_11.Item8)
series = Series(Start=0, Step=1, Count=num)
sift_12 = SiftPattern(List=tstat_6.Paths, SiftPattern=series)  # -> Output0, Output1
branch_4 = TreeBranch(Tree=clean_10, Path=sift_12.Output1, MaintainPaths=True)
branch_5 = TreeBranch(Tree=clean_10, Path=sift_12.Output0, MaintainPaths=True)
item_12 = ListItem(List=branch_5, Index=0, Wrap=False)  # -> Item, Item1
item_13 = ListItem(List=branch_4, Index=0, Wrap=False)  # -> Item, Item1

u = Number(item_13.Item)
v = Number(item_13.Item1)
y0_2 = Number(item_12.Item1)
x0_2 = Number(item_12.Item)
equals_10 = Equality(FirstNumber=u, SecondNumber="0")  # -> Equality, Inequality
equals_11 = Equality(FirstNumber=v, SecondNumber="0")  # -> Equality, Inequality
and_5 = GateAnd(A=equals_10.Inequality, B=equals_11.Inequality)
sift_13 = SiftPattern(List=v, SiftPattern=and_5)  # -> Output0, Output1
sift_14 = SiftPattern(List=u, SiftPattern=and_5)  # -> Output0, Output1
eval_11 = Evaluate(F="{v,-u,-v*x0+u*y0}", x0=x0_2, y0=y0_2, u=sift_14.Output1, v=sift_13.Output1)
panel_34 = Panel(eval_11)

sift_15 = SiftPattern(List=data_4, SiftPattern=int_11)  # -> Output0, Output1, Output2, Output3, Output4, Output5, Output6, Output7, Output8, Output9
clean_12 = CleanTree(RemoveNulls=True, RemoveInvalid=True, RemoveEmpty=True, Tree=sift_15.Output0)
clean_13 = CleanTree(RemoveNulls=True, RemoveInvalid=True, RemoveEmpty=True, Tree=sift_15.Output1)
clean_14 = CleanTree(RemoveNulls=True, RemoveInvalid=True, RemoveEmpty=True, Tree=sift_15.Output2)
clean_15 = CleanTree(RemoveNulls=True, RemoveInvalid=True, RemoveEmpty=True, Tree=sift_15.Output3)
clean_16 = CleanTree(RemoveNulls=True, RemoveInvalid=True, RemoveEmpty=True, Tree=sift_15.Output4)
clean_17 = CleanTree(RemoveNulls=True, RemoveInvalid=True, RemoveEmpty=True, Tree=sift_15.Output5)
clean_18 = CleanTree(RemoveNulls=True, RemoveInvalid=True, RemoveEmpty=True, Tree=sift_15.Output6)
clean_19 = CleanTree(RemoveNulls=True, RemoveInvalid=True, RemoveEmpty=True, Tree=sift_15.Output7)
clean_20 = CleanTree(RemoveNulls=True, RemoveInvalid=True, RemoveEmpty=True, Tree=sift_15.Output8)
clean_21 = CleanTree(RemoveNulls=True, RemoveInvalid=True, RemoveEmpty=True, Tree=sift_15.Output9)
tstat_8 = TreeStatistics(Tree=clean_19)  # -> Paths, Length, Count
tstat_9 = TreeStatistics(Tree=clean_17)  # -> Paths, Length, Count
tstat_10 = TreeStatistics(Tree=clean_18)  # -> Paths, Length, Count
tstat_11 = TreeStatistics(Tree=clean_16)  # -> Paths, Length, Count
tstat_12 = TreeStatistics(Tree=clean_21)  # -> Paths, Length, Count
tstat_13 = TreeStatistics(Tree=clean_15)  # -> Paths, Length, Count
tstat_14 = TreeStatistics(Tree=clean_12)  # -> Paths, Length, Count
num_2 = Number(item_11.Item7)
num_3 = Number(item_11.Item5)
num_4 = Number(item_11.Item6)
num_5 = Number(item_11.Item4)
num_6 = Number(item_11.Item)
tstat_15 = TreeStatistics(Tree=clean_14)  # -> Paths, Length, Count
num_7 = Number(item_11.Item3)
num_8 = Number(item_11.Item9)
tstat_16 = TreeStatistics(Tree=clean_13)  # -> Paths, Length, Count
panel_35 = Panel(clean_12)
series_2 = Series(Start=0, Step=1, Count=num_2)
num_9 = Number(item_11.Item1)
num_10 = Number(item_11.Item2)
series_3 = Series(Start=0, Step=1, Count=num_3)
series_4 = Series(Start=0, Step=1, Count=num_4)
series_5 = Series(Start=0, Step=1, Count=num_6)
series_6 = Series(Start=0, Step=1, Count=num_5)
num_11 = Number(item_11.Item8)
tstat_17 = TreeStatistics(Tree=clean_20)  # -> Paths, Length, Count
series_7 = Series(Start=0, Step=1, Count=num_8)
series_8 = Series(Start=0, Step=1, Count=num_7)
series_9 = Series(Start=0, Step=1, Count=num_9)
series_10 = Series(Start=0, Step=1, Count=num_10)
sift_16 = SiftPattern(List=tstat_8.Paths, SiftPattern=series_2)  # -> Output0, Output1
sift_17 = SiftPattern(List=tstat_9.Paths, SiftPattern=series_3)  # -> Output0, Output1, Output2
sift_18 = SiftPattern(List=tstat_10.Paths, SiftPattern=series_4)  # -> Output0, Output1
series_11 = Series(Start=0, Step=1, Count=num_11)
sift_19 = SiftPattern(List=tstat_14.Paths, SiftPattern=series_5)  # -> Output0, Output1, Output2
sift_20 = SiftPattern(List=tstat_11.Paths, SiftPattern=series_6)  # -> Output0, Output1
sift_21 = SiftPattern(List=tstat_12.Paths, SiftPattern=series_7)  # -> Output0, Output1
sift_22 = SiftPattern(List=tstat_13.Paths, SiftPattern=series_8)  # -> Output0, Output1
sift_23 = SiftPattern(List=tstat_16.Paths, SiftPattern=series_9)  # -> Output0, Output1
sift_24 = SiftPattern(List=tstat_15.Paths, SiftPattern=series_10)  # -> Output0, Output1
sift_25 = SiftPattern(List=tstat_17.Paths, SiftPattern=series_11)  # -> Output0, Output1
branch_6 = TreeBranch(Tree=clean_17, Path=sift_17.Output1, MaintainPaths=True)
branch_7 = TreeBranch(Tree=clean_17, Path=sift_17.Output0, MaintainPaths=True)
branch_8 = TreeBranch(Tree=clean_17, Path=sift_17.Output2, MaintainPaths=True)
branch_9 = TreeBranch(Tree=clean_18, Path=sift_18.Output0, MaintainPaths=True)
branch_10 = TreeBranch(Tree=clean_16, Path=sift_20.Output0, MaintainPaths=True)
branch_11 = TreeBranch(Tree=clean_18, Path=sift_18.Output1, MaintainPaths=True)
branch_12 = TreeBranch(Tree=clean_16, Path=sift_20.Output1, MaintainPaths=True)
branch_13 = TreeBranch(Tree=clean_19, Path=sift_16.Output0, MaintainPaths=True)
branch_14 = TreeBranch(Tree=clean_19, Path=sift_16.Output1, MaintainPaths=True)
branch_15 = TreeBranch(Tree=clean_21, Path=sift_21.Output0, MaintainPaths=True)
branch_16 = TreeBranch(Tree=clean_15, Path=sift_22.Output0, MaintainPaths=True)
branch_17 = TreeBranch(Tree=clean_21, Path=sift_21.Output1, MaintainPaths=True)
branch_18 = TreeBranch(Tree=clean_15, Path=sift_22.Output1, MaintainPaths=True)
branch_19 = TreeBranch(Tree=clean_12, Path=sift_19.Output0, MaintainPaths=True)
branch_20 = TreeBranch(Tree=clean_12, Path=sift_19.Output1, MaintainPaths=True)
branch_21 = TreeBranch(Tree=clean_12, Path=sift_19.Output1, MaintainPaths=True)
branch_22 = TreeBranch(Tree=clean_14, Path=sift_24.Output1, MaintainPaths=True)
branch_23 = TreeBranch(Tree=clean_14, Path=sift_24.Output0, MaintainPaths=True)
branch_24 = TreeBranch(Tree=clean_13, Path=sift_23.Output1, MaintainPaths=True)
branch_25 = TreeBranch(Tree=clean_13, Path=sift_23.Output0, MaintainPaths=True)
branch_26 = TreeBranch(Tree=clean_20, Path=sift_25.Output1, MaintainPaths=True)
branch_27 = TreeBranch(Tree=clean_20, Path=sift_25.Output0, MaintainPaths=True)
item_14 = ListItem(List=branch_7, Index=0, Wrap=True)  # -> Item, Item1, Item2
item_15 = ListItem(List=branch_6, Index=0, Wrap=True)  # -> Item, Item1, Item2
item_16 = ListItem(List=branch_10, Index=0, Wrap=True)  # -> Item, Item1
item_17 = ListItem(List=branch_12, Index=0, Wrap=True)  # -> Item, Item1
item_18 = ListItem(List=branch_9, Index=0, Wrap=True)  # -> Item, Item1
item_19 = ListItem(List=branch_11, Index=0, Wrap=False)  # -> Item, Item1, Item2
item_20 = ListItem(List=branch_17, Index=0, Wrap=False)  # -> Item, Item1
item_21 = ListItem(List=branch_15, Index=0, Wrap=False)  # -> Item, Item1

A_2 = Number(branch_19)
B_2 = Number(branch_21)
C_2 = Number(branch_20)
equals_12 = Equality(FirstNumber=A_2, SecondNumber="0")  # -> Equality, Inequality
equals_13 = Equality(FirstNumber=B_2, SecondNumber="0")  # -> Equality, Inequality
and_6 = GateAnd(A=equals_12.Inequality, B=equals_13.Inequality)
sift_26 = SiftPattern(List=A_2, SiftPattern=and_6)  # -> Output0, Output1
sift_27 = SiftPattern(List=B_2, SiftPattern=and_6)  # -> Output0, Output1
sift_28 = SiftPattern(List=C_2, SiftPattern=and_6)  # -> Output0, Output1
eval_12 = Evaluate(F="{A,B,C}", A=sift_26.Output1, B=sift_27.Output1, C=sift_28.Output1)
panel_36 = Panel(eval_12)

item_22 = ListItem(List=branch_27, Index=0, Wrap=False)  # -> Item, Item1

k_2 = Number(branch_16)
b_2 = Number(branch_18)
eval_13 = Evaluate(F="{k,-1,b}", k=k_2, b=b_2)
panel_37 = Panel(eval_13)

item_23 = ListItem(List=branch_26, Index=0, Wrap=False)  # -> Item, Item1
panel_38 = Panel(item_14.Item2)

eval_14 = Evaluate(
    F="{m*A0+A1,m*B0+B1,m*C0+C1}",
    A0=item_14.Item,
    B0=item_14.Item1,
    C0=item_14.Item2,
    A1=item_15.Item,
    B1=item_15.Item1,
    C1=item_15.Item2,
    m=branch_8)
panel_39 = Panel(eval_14)

item_24 = ListItem(List=branch_24, Index=0, Wrap=True)  # -> Item, Item1
k_3 = Number(branch_25)
x0_3 = Number(item_24.Item)
y0_3 = Number(item_24.Item1)
eval_15 = Evaluate(F="{k,-1,y0-k*x0}", k=k_3, x0=x0_3, y0=y0_3)
panel_40 = Panel(eval_15)

x0_4 = Number(item_16.Item)
y0_4 = Number(item_16.Item1)
x1_2 = Number(item_17.Item)
y1_2 = Number(item_17.Item1)
eval_16 = Evaluate(F="{x0-x1,y1-y0,x0*x1-y0*y1-x0*x0+y0*y0}", x0=x0_4, y0=y0_4, x1=x1_2, y1=y1_2)
panel_41 = Panel(eval_16)

y0_5 = Number(item_18.Item1)
a2 = Number(item_19.Item)
x0_5 = Number(item_18.Item)
b2 = Number(item_19.Item1)
c2 = Number(item_19.Item2)
eval_17 = Evaluate(F="{A2,B2,-A2*x0-B2*y0}", A2=a2, B2=b2, C2=c2, x0=x0_5, y0=y0_5)
panel_42 = Panel(eval_17)

angle_2 = Number(branch_13)
distance_p_2 = Number(branch_14)
pi_2 = Pi(Factor=1)
division_2 = Division(A=angle_2, B=pi_2)
int_12 = Integer(division_2)
subtraction_2 = Subtraction(A=division_2, B=int_12)
abs_2 = Absolute(Value=subtraction_2)
larger_2 = LargerThan(FirstNumber=abs_2, SecondNumber="0.000001")  # -> LargerThan, OrEqualTo
sift_29 = SiftPattern(List=angle_2, SiftPattern=larger_2.LargerThan)  # -> Output0, Output1
sift_30 = SiftPattern(List=distance_p_2, SiftPattern=larger_2.LargerThan)  # -> Output0, Output1
eval_18 = Evaluate(F="{cos(angle),sin(angle),-p}", angle=sift_29.Output1, p=sift_30.Output1)
panel_43 = Panel(eval_18)

a_2 = Number(branch_23)
b_3 = Number(branch_22)
equals_14 = Equality(FirstNumber=b_3, SecondNumber="0")  # -> Equality, Inequality
equals_15 = Equality(FirstNumber=a_2, SecondNumber="0")  # -> Equality, Inequality
and_7 = GateAnd(A=equals_15.Inequality, B=equals_14.Inequality)
sift_31 = SiftPattern(List=a_2, SiftPattern=and_7)  # -> Output0, Output1
sift_32 = SiftPattern(List=b_3, SiftPattern=and_7)  # -> Output0, Output1
eval_19 = Evaluate(F="{b,a,-a*b}", a=sift_31.Output1, b=sift_32.Output1)
panel_44 = Panel(eval_19)

x0_6 = Number(item_22.Item)
y0_6 = Number(item_22.Item1)
u_2 = Number(item_23.Item)
v_2 = Number(item_23.Item1)
equals_16 = Equality(FirstNumber=u_2, SecondNumber="0")  # -> Equality, Inequality
equals_17 = Equality(FirstNumber=v_2, SecondNumber="0")  # -> Equality, Inequality
and_8 = GateAnd(A=equals_16.Inequality, B=equals_17.Inequality)
sift_33 = SiftPattern(List=v_2, SiftPattern=and_8)  # -> Output0, Output1
sift_34 = SiftPattern(List=u_2, SiftPattern=and_8)  # -> Output0, Output1
eval_20 = Evaluate(F="{v,-u,-v*x0+u*y0}", x0=x0_6, y0=y0_6, u=sift_34.Output1, v=sift_33.Output1)
panel_45 = Panel(eval_20)

x0_7 = Number(item_21.Item)
y0_7 = Number(item_21.Item1)
nu1 = Number(item_20.Item)
nu2 = Number(item_20.Item1)
equals_18 = Equality(FirstNumber=nu2, SecondNumber="0")  # -> Equality, Inequality
equals_19 = Equality(FirstNumber=nu1, SecondNumber="0")  # -> Equality, Inequality
and_9 = GateAnd(A=equals_19.Inequality, B=equals_18.Inequality)
sift_35 = SiftPattern(List=nu2, SiftPattern=and_9)  # -> Output0, Output1
sift_36 = SiftPattern(List=nu1, SiftPattern=and_9)  # -> Output0, Output1
eval_21 = Evaluate(F="{nu,nv,-nu*x0-nv*y0}", x0=x0_7, y0=y0_7, nu=sift_36.Output1, nv=sift_35.Output1)

path_mapper = PathMapper(eval_14, source="{A;B;C;D}", target="{A;B;0}")
path_mapper_2 = PathMapper(eval_19, source="{A;B;C;D}", target="{A;B;0}")
path_mapper_3 = PathMapper(eval_13, source="{A;B;C;D}", target="{A;B;0}")
path_mapper_4 = PathMapper(eval_16, source="{A;B;C;D}", target="{A;B;0}")
path_mapper_5 = PathMapper(eval_15, source="{A;B;C;D}", target="{A;B;0}")
pshift_3 = ShiftPaths(Data=eval_12, Offset=-1)
path_mapper_6 = PathMapper(eval_17, source="{A;B;C;D}", target="{A;B;0}")
panel_46 = Panel(eval_21)
path_mapper_7 = PathMapper(eval_20, source="{A;B;C;D}", target="{A;B;0}")
panel_47 = Panel(pshift_3)
pdecon_4 = Deconstruct(Point=pshift_3)  # -> XComponent, YComponent, ZComponent
graft_11 = GraftTree(Tree=pshift_3, IncludeEmptyLists=True, IncludeNullItems=True)
panel_48 = Panel(path_mapper_5)
path_mapper_8 = PathMapper(eval_18, source="{A;B;C;D}", target="{A;B;0}")
path_mapper_9 = PathMapper(pdecon_4.XComponent, source="{A;B;C}", target="{A;B;0}")
path_mapper_10 = PathMapper(pdecon_4.YComponent, source="{A;B;C}", target="{A;B;1}")
path_mapper_11 = PathMapper(pdecon_4.ZComponent, source="{A;B;C}", target="{A;B;2}")
path_mapper_12 = PathMapper(eval_12, source="{A;B;C;D}", target="{A;B;0;0;0}")
panel_49 = Panel(path_mapper_7)
# describe space by (point;index) of vector
panel_50 = Panel(path_mapper_11)
panel_51 = Panel(path_mapper_12)
