# Grasshopper definition 20161023_PE_points_intersection_013_lineDatabase_fxRevise.gh (Grasshopper 0.9.76)

panel = Panel("""0;0;0_3.2/1_1.0/3_2.2/5_4.0
1;0;2_2.5/3_4.0/4_8.2/5_1.2/7_2,3.2
2;0;1_2.2/7_2,1.9/11_3.222
3;0;4_8.2/6_4,2.2/14_2.442,3.442
4;0;4_8.2/6_1.2,4.2/14_3.56,4.23
5;0;3_3.2/6_1.2,4.2
6;0;0_2/2_2.3/1_3.2
7;0;6_3.2,1.2/7_1.2,3.2
8;0;8_3.2,2.2,1.2/9_3.4,1.3,1.2/10_2
9;0;6_2.2,3.1/11_4,3,2.2
10;0;12_3.221/13_4
11;0;6_3.21,2.22/15_4.23,5.43""")
panel_2 = Panel("""0;0;0_3.2/1_1.0/3_2.2/5_4.0
1;0;2_2.5/3_4.0/4_8.2/5_1.2/7_2,3.2
2;0;1_2.2/7_2,1.9/11_3.222
3;0;4_8.2/6_4,2.2/14_2.442,3.442""")
crv = Curve(<curve referenced from the Rhino model>)

# ----
# feed data and store data
panel_3 = Panel("/")
txt = Text(panel)
# log:
# 20161017
# 给定相应的数据，去匹配相应的算法
# 考虑是否要反馈数据
# path在后面匹配时，相同path的被放在一起，真tm尴尬...
# 完成一个基本的模板，明天按照这样继续做下去
# 20161018
# 算法和对应的参数进行匹配
# 对数据结构的处理进行简化，避免重复计算
# 数据的过滤和储存方式
split = TextSplit(Text=txt, Separators=";")
item = ListItem(List=split, Index=0, Wrap=True)  # -> Item, Item1, Item2
split_2 = TextSplit(Text=item.Item2, Separators=panel_3)
split_3 = TextSplit(Text=split_2, Separators="_")
item_2 = ListItem(List=split_3, Index=0, Wrap=True)  # -> simplify(Item), Item1
pshift = ShiftPaths(Data=item_2.Item, Offset=-1)
split_4 = TextSplit(Text=item_2.Item1, Separators=",")  # -> simplify(Result)
tstat = TreeStatistics(Tree=pshift)  # -> Paths, Length, Count
initialparasdepathlist = Integer(pshift)
initiallinecount = Integer(tstat.Count)
graft = GraftTree(Tree=tstat.Length, IncludeEmptyLists=True, IncludeNullItems=True)  # -> simplify(Tree)
initialparascounts = Integer(graft)
# log:
# 20161010
# 设计向量方向与数据结构之间的映射关系
# 数据结构用集合运算然后替换
# 替换树形结构的时候需要拍平
# 无论什么情况都留出0123正交的位置为Null
# 如果0123存在，没关系，不存在，插入一个空值
# 20161011
# 角度和path之间的映射关系，以及角度的识别:
# 分解basic line的path得到位置位置关系
# 先正交的位置关系，后自由的位置关系
# 考虑先组合line还是先分解path在配对
# 如何识别path知道非正交的相反的向量
# 增强path的排序的算法前馈，可通过path运算直接得到向量关系
# 运用path提取相应的两条交线
# 20161012
# debug时候replacePath爆红
# 精度问题导致set不能去掉原本偏差相同的角度
# 20161017
# 找到了两根交线的关系，先把他放在这，具体怎么用不继续做下去，先考虑其他的大的情况
# 20161018
# 算法和对应的参数进行匹配
# 对数据结构的处理进行简化，避免重复计算
# 数据的过滤和储存方式
# 20161023
# 对线的识别方法以及数据的缺省情况
# 数据分流计算的方法是否合适
stack = StackData(Data=item.Item, Stack=initialparascounts)
stack_2 = StackData(Data=item.Item1, Stack=initialparascounts)
graft_2 = GraftTree(Tree=stack_2, IncludeEmptyLists=True, IncludeNullItems=True)
graft_3 = GraftTree(Tree=stack, IncludeEmptyLists=True, IncludeNullItems=True)
int = Integer(simplify(graft_3))
int_2 = Integer(simplify(item_2.Item))
int_3 = Integer(simplify(graft_2))
merge = Merge(Data1=int, Data2=int_3, Data3=int_2)
path = ConstructPath(Indices=merge)
flatten = FlattenTree(Tree=path, Path="{0}")
initialparaspaths = DataPath(path)
viewer = ParamViewer(split_4)
replace = ReplacePaths(Data=split_4, Search=viewer, Replace=flatten)
data = Data(replace)

# ----
# log:
# 20161010
# 设计向量方向与数据结构之间的映射关系
# 数据结构用集合运算然后替换
# 替换树形结构的时候需要拍平
# 无论什么情况都留出0123正交的位置为Null
# 如果0123存在，没关系，不存在，插入一个空值
# 20161011
# 角度和path之间的映射关系，以及角度的识别
# 线交的算法与path之间多对多的关系
pi = Pi(Factor="2")
# {0,0}-->0/2*pi
# 0/2*pi <= a< 1/2*pi
# {1,0}-->1/2*pi
# 1/2*pi <= a < 2/2*pi
# {2,0}-->2/2*pi
# 2/2*pi <= a < 3/2*pi
# {3,0}-->3/2*pi
# 3/2*pi <= a < 4/2*pi
# log:
# 20161010
# 如果0123存在，没关系，不存在，插入一个空值
# 光是插入一个空值也是不行，修改标签运算的算法使其更合理:原因是set的时候把null去掉了
# 应该是插入不是替换
# 不是插入一个Null就能解决问题的，问题处在了member的寻找上，寻找时候把null数据给删除了，结果找不到对应的path
random = Random(Range=pi, Number="20", Seed=Slider(33.222, range=0..100))

pi_2 = Pi(Factor=1)
ins = InsertItems(List=random, Item=pi_2, Indices="0", Wrap=True)

# ----
# kernel intersection algorithm 002_siftPoint
panel_4 = Panel("""0
0.4
1
1.5
1.5
1.92

2.05
2.1
2.4
2.3
2.3
2.1
3
3.12
3.11
3.12""")
# Point:indicate a position in space
# Line:length,direction,position
# Point
# two ends of the line
# the intersection of two lines
# the meeting of lines at the corner of a space or volumn
# the center of field
panel_5 = Panel("""0
0.4
1
1.5
1.5
1.92

2.05
2.1
2.4
2.3
2.3
2.1
3
3.12
3.11
3.12""")

# ----
# mapping between angle and path
# {0;0} --> 0
# {1;0} --> 1/2*pi
# {2;0} --> pi
# {3;0} --> 3/2*pi
# 当向量中不存在某正交方向时候为Null
# vectorPath00_can't identify reverse vectors
panel_6 = Panel("2")
pi_3 = Pi(Factor=panel_6)
num = Number(panel_4)
remap = RemapNumbers(Value=num, Source="4", Target=pi_3)  # -> Mapped, Clipped
pi_4 = Pi(Factor=1)
sort = SortList(Keys=remap.Mapped)  # -> Keys, ValuesA
division = Division(A=pi_4, B="2")
series = Series(Start=0, Step=division, Count="5")
consec = ConsecutiveDomains(Numbers=series, Additive=False)  # -> simplify(Domains)
domain = Domain(graft(consec))
angle = Number(sort.Keys)
dedomain = DeconstructDomain(Domain=domain)  # -> Start, End
larger = LargerThan(FirstNumber=angle, SecondNumber=dedomain.Start)  # -> LargerThan, OrEqualTo
smaller = SmallerThan(FirstNumber=angle, SecondNumber=dedomain.End)  # -> SmallerThan, OrEqualTo
and = GateAnd(A=larger.OrEqualTo, B=smaller.SmallerThan)
sift = SiftPattern(List=angle, SiftPattern=and)  # -> Output0, Output1
clean = CleanTree(RemoveNulls=True, RemoveInvalid=True, RemoveEmpty=False, Tree=sift.Output1)  # -> simplify(Tree)
item_3 = ListItem(List=clean, Index="0", Wrap=True)
equals = Equality(FirstNumber=item_3, SecondNumber=simplify(dedomain.Start))  # -> Equality, Inequality
int_4 = Integer(equals.Inequality)
ins_2 = InsertItems(List=clean, Indices="0", Wrap=True)
neg = Negative(Value=int_4)
cull_i = CullIndex(List=ins_2, Indices=neg, Wrap=False)  # -> simplify(List)
num_2 = Number(cull_i)
cset = CreateSet(List=num_2)  # -> Set, Map
addition = Addition(A=cset.Map, B=int_4)
tstat_2 = TreeStatistics(Tree=addition)  # -> Paths, Length, Count
dpath = DeconstructPath(Branch=tstat_2.Paths)
graft_4 = GraftTree(Tree=addition, IncludeEmptyLists=True, IncludeNullItems=True)
stack_3 = StackData(Data=dpath, Stack=graft(tstat_2.Length))
graft_5 = GraftTree(Tree=cull_i, IncludeEmptyLists=True, IncludeNullItems=True)
graft_6 = GraftTree(Tree=stack_3, IncludeEmptyLists=True, IncludeNullItems=True)  # -> simplify(Tree)
ins_3 = InsertItems(List=graft_6, Item=graft_4, Indices="-1", Wrap=True)
path_2 = ConstructPath(Indices=ins_3)  # -> simplify(Branch)
viewer_2 = ParamViewer(graft_5)
flatten_2 = FlattenTree(Tree=path_2, Path="{0}")
flatten_3 = FlattenTree(Tree=cull_i, Path="{0}")
replace_2 = ReplacePaths(Data=graft_5, Search=viewer_2, Replace=flatten_2)
graft_7 = GraftTree(Tree=sort.Keys, IncludeEmptyLists=True, IncludeNullItems=True)  # -> simplify(Tree)
keysearch = KeyValueSearch(Keys=flatten_3, Values=flatten_2, Search=graft_7)

panel_7 = Panel("""0
1
2
3
2
2
3
1
2
1
0
0
2
0
1
3""")

# ----
# log:
# 20161011
# 增强path的排序的算法前馈，可通过path运算直接得到向量关系:
# 排序前后问题：
# 先精确控制还是先离散问题
# 应该是把排序前的原始数据进行path替换，而不是排序之后的数据：结果竟然是一样的。。。！
# 20161017
# 修改好排序过后path下为空值产生的错误
# vectorPath01
# mapping between angle and path
# {0;0} --> 0
# {1;0} --> 1/2*pi
# {2;0} --> pi
# {3;0} --> 3/2*pi
# 无所谓正交向量存不存在
panel_8 = Panel("""0
1
0
1.3
3
1
2.3
2""")
jitter = Jitter(List=panel_7, Jitter=1, Seed=2)  # -> Values, Indices
pi_5 = Pi(Factor=1)
pi_6 = Pi(Factor="2")
num_3 = Number(jitter.Values)
division_2 = Division(A=pi_5, B="2")
# log:
# 20161010
# 不是插入一个Null就能解决问题的，问题处在了member的寻找上，寻找时候把null数据给删除了，结果找不到对应的path:
# 找到替换的member的运算器
# 发现前馈需要一大堆的运算器，先做成后馈
panel_9 = Panel("5")
remap_2 = RemapNumbers(Value=num_3, Source="4", Target=pi_6)  # -> Mapped, Clipped
series_2 = Series(Start=0, Step=division_2, Count=panel_9)
consec_2 = ConsecutiveDomains(Numbers=series_2, Additive=False)  # -> simplify(Domains)
angle_2 = Number(remap_2.Mapped)
domain_2 = Domain(graft(consec_2))
dedomain_2 = DeconstructDomain(Domain=domain_2)  # -> simplify(Start), simplify(End)
larger_2 = LargerThan(FirstNumber=angle_2, SecondNumber=dedomain_2.Start)  # -> LargerThan, OrEqualTo
smaller_2 = SmallerThan(FirstNumber=angle_2, SecondNumber=dedomain_2.End)  # -> SmallerThan, OrEqualTo
and_2 = GateAnd(A=larger_2.OrEqualTo, B=smaller_2.SmallerThan)
sift_2 = SiftPattern(List=angle_2, SiftPattern=and_2)  # -> Output0, Output1
clean_2 = CleanTree(RemoveNulls=True, RemoveInvalid=False, RemoveEmpty=True, Tree=sift_2.Output1)  # -> simplify(Tree)
tstat_3 = TreeStatistics(Tree=clean_2)  # -> Paths, Length, Count
branch = TreeBranch(Tree=dedomain_2.Start, Path=tstat_3.Paths, MaintainPaths=True)
subtraction = Subtraction(A=clean_2, B=branch)
num_4 = Number(clean_2)
eval = Evaluate(F="round(x,4)", x=subtraction)
flatten_4 = FlattenTree(Tree=eval, Path="{0}")
cset_2 = CreateSet(List=flatten_4)  # -> Set, Map
sort_2 = SortList(Keys=cset_2.Set)  # -> Keys, ValuesA
mindex = MemberIndex(Set=sort_2.Keys, Member=eval)  # -> Index, Count
pshift_2 = ShiftPaths(Data=mindex.Index, Offset=-1)
flatten_5 = FlattenTree(Tree=mindex.Index, Path="{0}")
tstat_4 = TreeStatistics(Tree=pshift_2)  # -> Paths, Length, Count
dpath_2 = DeconstructPath(Branch=tstat_4.Paths)
graft_8 = GraftTree(Tree=flatten_5, IncludeEmptyLists=True, IncludeNullItems=True)  # -> simplify(Tree)
stack_4 = StackData(Data=dpath_2, Stack=graft(tstat_4.Length))
graft_9 = GraftTree(Tree=angle_2, IncludeEmptyLists=True, IncludeNullItems=True)
flatten_6 = FlattenTree(Tree=stack_4, Path="{0}")
graft_10 = GraftTree(Tree=flatten_6, IncludeEmptyLists=True, IncludeNullItems=True)  # -> simplify(Tree)
merge_2 = Merge(Data1=graft_10, Data2=graft_8)
path_3 = ConstructPath(Indices=merge_2)
graft_11 = GraftTree(Tree=num_4, IncludeEmptyLists=True, IncludeNullItems=True)
flatten_7 = FlattenTree(Tree=path_3, Path="{0}")
flatten_8 = FlattenTree(Tree=graft_11, Path="{0}")
viewer_3 = ParamViewer(graft_11)
keysearch_2 = KeyValueSearch(Keys=flatten_8, Values=flatten_7, Search=graft_9)  # -> simplify(Result)
replace_3 = ReplacePaths(Data=graft_11, Search=viewer_3, Replace=flatten_7)
panel_10 = Panel(replace_3)
panel_11 = Panel(keysearch_2)

panel_12 = Panel(data)
panel_13 = Panel("""2.5838678
Pi
1.6421
3.212896
1.5*Pi""")

# ----
# log:
# 20161010
# 应该是插入不是替换：
# 连一个新电池，是True就插入，False就不插入
# 简短的并不需要连接电池
# 插入的应该是一个Null值，而不是正交角度
# instance
panel_14 = Panel("0")
item_4 = ListItem(List=clean, Index=panel_14, Wrap=True)
equals_2 = Equality(FirstNumber=item_4, SecondNumber=simplify(dedomain.Start))  # -> Equality, Inequality
num_5 = Number(clean)
neg_2 = Negative(Value=equals_2.Inequality)
ins_4 = InsertItems(List=num_5, Indices=graft("0"), Wrap=True)
cull_i_2 = CullIndex(List=ins_4, Indices=neg_2, Wrap=False)  # -> simplify(List)

# ----
# log:
# 20161010
# 插入的应该是一个Null值，而不是正交角度:
# 先保留空值，后根据boolean删除Null
# 插入一个空值的方法：
# 运用cull index运算器本身的性质，对布尔值进行negetive后删除不需要的空值
toggle = BooleanToggle(False)
series_3 = Series(Start=0, Step=1, Count=3)  # -> simplify(graft(Series))
graft_12 = GraftTree(Tree="0", IncludeEmptyLists=True, IncludeNullItems=True)  # -> graft(Tree)
panel_15 = Panel([Toggle(False), Toggle(True), toggle])
bool = Boolean(panel_15)
ins_5 = InsertItems(List=series_3, Indices=graft_12, Wrap=True)  # -> simplify(List)
# log:
# 20161010
# 设计向量方向与数据结构之间的映射关系
# 数据结构用集合运算然后替换
# 替换树形结构的时候需要拍平
# 无论什么情况都留出0123正交的位置为Null
# 如果0123存在，没关系，不存在，插入一个空值
# 20161011
# 角度和path之间的映射关系，以及角度的识别:
# 分解basic line的path得到位置位置关系
# 先正交的位置关系，后自由的位置关系
# 考虑先组合line还是先分解path在配对
# 如何识别path知道非正交的相反的向量
# 增强path的排序的算法前馈，可通过path运算直接得到向量关系
# 运用path提取相应的两条交线
# 20161012
# debug时候replacePath爆红
# 精度问题导致set不能去掉原本偏差相同的角度
# 20161017
# 找到了两根交线的关系，先把他放在这，具体怎么用不继续做下去，先考虑其他的大的情况
# 先罗列出方程对应的算法
# 建立数据库，对数据结构进行设计，让每一个数据都有对应的位置
# 给定相应的数据，去匹配相应的算法
# 考虑是否要反馈数据
int_5 = Integer(bool)
neg_3 = Negative(Value=int_5)
cull_i_3 = CullIndex(List=ins_5, Indices=graft(neg_3), Wrap=False)
panel_16 = Panel(cull_i_3)

# ----
# log:
# 20161010
# 发现前馈需要一大堆的运算器，先做成后馈
# 如果需要前反馈，可能需要修改标签运算的算法，所以先后馈，至少能做下去
# 重新Partition
# 还是回到前馈
# log:
# 20161010
# 还是回到前馈：
# 用set运算器自带的index记录，与boolean值进行相加，对path运算得到新的path
# log:
# 20161010
# 设计向量方向与数据结构之间的映射关系
# 数据结构用集合运算然后替换
# 替换树形结构的时候需要拍平
# 无论什么情况都留出0123正交的位置为Null
# 如果0123存在，没关系，不存在，插入一个空值
# 20161011
# 角度和path之间的映射关系，以及角度的识别:
# 先正交的位置关系，后自由的位置关系
# 如何识别path知道非正交的相反的向量
# 增强path的排序的算法前馈，可通过path运算直接得到向量关系
panel_17 = Panel(clean)
databasemapping = Panel("""0,1,2
3,6
4,5
3,5
6,7
8,9,10
6,11
12,13
6,14
6,15""")
split_5 = TextSplit(Text=databasemapping, Separators=",")  # -> simplify(Result)

functionparasdepathlist = Integer(split_5)
initialparasdepathlist_2 = Integer(initialparasdepathlist)

dataparameterspath = Panel(initialparasdepathlist_2)
functionpath = Panel(functionparasdepathlist)
tstat_5 = TreeStatistics(Tree=functionparasdepathlist)  # -> Paths, Length, Count
initialparascounts_2 = Integer(initialparascounts)
flatten_9 = FlattenTree(Tree=functionparasdepathlist, Path="{0}")

# ----
# sample_treeStatistics
cset_3 = CreateSet(List=num_2)  # -> Set, Map
tstat_6 = TreeStatistics(Tree=cset_3.Map)  # -> Paths, Length, Count
dpath_3 = DeconstructPath(Branch=tstat_6.Paths)
stack_5 = StackData(Data=dpath_3, Stack=graft(tstat_6.Length))
graft_13 = GraftTree(Tree=cset_3.Map, IncludeEmptyLists=True, IncludeNullItems=True)
graft_14 = GraftTree(Tree=stack_5, IncludeEmptyLists=True, IncludeNullItems=True)  # -> simplify(Tree)
ins_6 = InsertItems(List=graft_14, Item=graft_13, Indices="-1", Wrap=True)
path_4 = ConstructPath(Indices=ins_6)  # -> simplify(Branch)
flatten_10 = FlattenTree(Tree=path_4, Path="{0}")

functionsmatchparascounts = Integer(tstat_5.Length)
initiallinecount_2 = Integer(initiallinecount)
functionscount = Integer(tstat_5.Count)
lng = ListLength(List=flatten_9)
multiplication = Multiplication(A=initialparascounts_2, B=functionscount)
panel_19 = Panel(initialparascounts_2)
multiplication_2 = Multiplication(A=initiallinecount_2, B=lng)
databaseparameters = Panel("""A
B
C
k
a
b
pt0(x0,y0)
pt1(x1,y1)
intersection_line0(A0,B0,C0)
intersection_line1(A1,B1,C1)
intersection_m
parallel_line(A2,B2,C2)
angle
distance(p)
vector(u,v)
normal_vector(nu,nv)""")
repeat = RepeatData(Data=initialparasdepathlist_2, Length=multiplication)  # -> simplify(Data)
repeat_2 = RepeatData(Data=flatten_9, Length=multiplication_2)
partition = PartitionList(List=repeat, Size=initialparascounts_2)  # -> simplify(Chunks)
partition_2 = PartitionList(List=repeat_2, Size=lng)
partition_3 = PartitionList(List=partition_2, Size=functionsmatchparascounts)  # -> simplify(Chunks)
# path{x;y}表示，索引为x的线可以匹配索引为y算法。
# 如果是相同x下有多个，说明算法上有多个选择
int_6 = Integer(partition_3)
int_7 = Integer(partition)
mindex_2 = MemberIndex(Set=int_6, Member=int_7)  # -> Index, Count
lng_2 = ListLength(List=int_6)
ma = MassAddition(Input=mindex_2.Count)  # -> Result, PartialResults
equals_3 = Equality(FirstNumber=lng_2, SecondNumber=ma.Result)  # -> Equality, Inequality
panel_20 = Panel("""2
3""")
panel_21 = Panel("""2
2""")
panel_22 = Panel("""1
3
5""")
panel_23 = Panel("""1
0
4""")
panel_24 = Panel("""7
2
2""")
panel_25 = Panel("""2,3,1
4,2,3
1,3,2""")
panel_26 = Panel("""3,2,2
2,3,2
4,1,3""")
panel_27 = Panel("""3
2
1""")
panel_28 = Panel("""3,2,2
1,3,4
4,1,3""")
panel_29 = Panel("""3.22133
1.3229
pi""")
panel_30 = Panel("""3.42
5.33
1.44""")
panel_31 = Panel("""3,2
1,3
0,1""")
panel_32 = Panel("""2,3
4,0
1,3""")
databaseparameters_2 = Panel("""A
B
C
k
a
b
pt0(x0,y0)
pt1(x1,y1)
intersection_line0(A0,B0,C0)
intersection_line1(A1,B1,C1)
intersection_m
parallel_line(A2,B2,C2)
angle
distance(p)
vector(u,v)
normal_vector(nu,nv)""")
panel_33 = Panel("""1
3""")
sift_3 = SiftPattern(List=int_6, SiftPattern=equals_3.Equality)  # -> Output0, Output1
clean_3 = CleanTree(RemoveNulls=True, RemoveInvalid=True, RemoveEmpty=True, Tree=sift_3.Output1)
tstat_7 = TreeStatistics(Tree=clean_3)  # -> Paths, Length, Count
functionparasdepathlist_2 = Integer(functionparasdepathlist)
A = Number(panel_20)
B = Number(panel_21)
C = Number(panel_33)
k = Number(panel_22)
a = Number(panel_23)
b = Number(panel_24)
pt0 = Point([Point(-8, -7, 0), Point(-5, 0, 0), Point(-16, -3, 0)])
pt1 = Point([Point(-8, -10, 0), Point(3, -7, 0), Point(-4, -2, 0)])
intersection_line0_a0_b0_c0 = Vector(panel_25)
intersection_line0_a1_b1_c1 = Vector(panel_26)
intersection_m = Number(panel_27)
parallel_line_a2_b2_c2 = Vector(panel_28)
angle_3 = Number(panel_29)
distance_p = Number(panel_30)
vector_u_v = Vector(panel_31)
normal_vector_nu_nv = Vector(panel_32)
txt_2 = Text(databaseparameters)
dpath_4 = DeconstructPath(Branch=tstat_7.Paths)
pi_7 = Pi(Factor=1)
complex = ComplexComponents(Complex=pt0)  # -> Real, Imaginary
complex_2 = ComplexComponents(Complex=pt1)  # -> Real, Imaginary
item_5 = ListItem(List=dpath_4, Index=0, Wrap=True)

# ----
# path{x;y}
# x         --> line index
# y         --> function index
# value  -->  parameters index
# each line choose first function
flatten_11 = FlattenTree(Tree=item_5, Path="{0}")
path_5 = DataPath(tstat_7.Paths)
cset_4 = CreateSet(List=flatten_11)  # -> Set, Map
item_6 = ListItem(List=path_5, Index=cset_4.Set, Wrap=False)
branch_2 = TreeBranch(Tree=clean_3, Path=item_6, MaintainPaths=True)
int_8 = Integer(branch_2)

panel_34 = Panel(int_8)
division_3 = Division(A=angle_3, B=pi_7)
bang = ExplodeTree(Data=functionparasdepathlist_2)  # -> Branch0, Branch1, Branch2, Branch3, Branch4, Branch5, Branch6, Branch7, Branch8, Branch9
int_9 = Integer(division_3)
databasefunctions = Panel("""Ax+By+C=0,A!=0 and B!=0
y-y0=k(x-x0),k!=empty
x/a+y/b=1,a!=0andb!=0
y=kx+b,k!=empty
(y-y1)(y2-y1)=(x-x1)(x2-x1),x1!=x2andy1!=y2
f1(x,y)*m+f2(x,y)=0
f(x,y)-f(x0,y0)=0
x*cos(angle)+y*sin(angle)-p=0,angle=!k*pi
(x-x0)/u=(y-y0)/v,u!=0andv!=0
nu*(x-x0)+nv(y-y0)=0,nv!=0andnu!=0""")
complex_3 = ComplexComponents(Complex=vector_u_v)  # -> Real, Imaginary
x0 = Number(complex.Real)
y0 = Number(complex.Imaginary)
x1 = Number(complex_2.Real)
y1 = Number(complex_2.Imaginary)
subtraction_2 = Subtraction(A=division_3, B=int_9)
equals_4 = Equality(FirstNumber=A, SecondNumber="0")  # -> Equality, Inequality
equals_5 = Equality(FirstNumber=B, SecondNumber="0")  # -> Equality, Inequality
abs = Absolute(Value=subtraction_2)
merge_3 = Merge(Data1=graft(A), Data2=graft(B), Data3=graft(C))
equals_6 = Equality(FirstNumber=a, SecondNumber="0")  # -> Equality, Inequality
equals_7 = Equality(FirstNumber=b, SecondNumber="0")  # -> Equality, Inequality
pdecon = Deconstruct(Point=intersection_line0_a0_b0_c0)  # -> XComponent, YComponent, ZComponent
pdecon_2 = Deconstruct(Point=intersection_line0_a1_b1_c1)  # -> XComponent, YComponent, ZComponent
complex_4 = ComplexComponents(Complex=normal_vector_nu_nv)  # -> Real, Imaginary
and_3 = GateAnd(A=graft(equals_4.Inequality), B=graft(equals_5.Inequality))
equals_8 = Equality(FirstNumber=complex_3.Real, SecondNumber="0")  # -> Equality, Inequality
equals_9 = Equality(FirstNumber=complex_3.Imaginary, SecondNumber="0")  # -> Equality, Inequality
larger_3 = LargerThan(FirstNumber=abs, SecondNumber="0.000001")  # -> LargerThan, OrEqualTo

tstat_8 = TreeStatistics(Tree=int_8)  # -> Paths, Length, Count
dpath_5 = DeconstructPath(Branch=tstat_8.Paths)
data_2 = Data(data)
functionsmatchparascounts_2 = Integer(functionsmatchparascounts)
viewer_4 = ParamViewer(dpath_5)
replace_4 = ReplacePaths(Data=dpath_5, Search=viewer_4, Replace=tstat_8.Paths)
item_7 = ListItem(List=replace_4, Index=0, Wrap=True)  # -> Item, Item1
item_8 = ListItem(List=functionsmatchparascounts_2, Index=item_7.Item1, Wrap=False)
stack_6 = StackData(Data=item_7.Item, Stack=item_8)
stack_7 = StackData(Data=item_7.Item1, Stack=item_8)
graft_15 = GraftTree(Tree=int_8, IncludeEmptyLists=True, IncludeNullItems=True)
graft_16 = GraftTree(Tree=stack_6, IncludeEmptyLists=True, IncludeNullItems=True)
graft_17 = GraftTree(Tree=stack_7, IncludeEmptyLists=True, IncludeNullItems=True)
merge_4 = Merge(Data1=graft_16, Data3=graft_15)
ins_7 = InsertItems(List=merge_4, Item="0", Indices="1", Wrap=True)  # -> simplify(List)
path_6 = ConstructPath(Indices=ins_7)
branch_3 = TreeBranch(Tree=data_2, Path=path_6, MaintainPaths=True)

int_10 = Integer(graft_17)
and_4 = GateAnd(A=equals_6.Inequality, B=equals_7.Inequality)
equals_10 = Equality(FirstNumber=complex_4.Real, SecondNumber="0")  # -> Equality, Inequality
equals_11 = Equality(FirstNumber=complex_4.Imaginary, SecondNumber="0")  # -> Equality, Inequality
and_5 = GateAnd(A=equals_8.Inequality, B=equals_9.Inequality)
pdecon_3 = Deconstruct(Point=parallel_line_a2_b2_c2)  # -> XComponent, YComponent, ZComponent
sift_4 = SiftPattern(List=merge_3, SiftPattern=and_3)  # -> Output0, Output1
sift_5 = SiftPattern(List=angle_3, SiftPattern=larger_3.LargerThan)  # -> Output0, Output1
sift_6 = SiftPattern(List=distance_p, SiftPattern=larger_3.LargerThan)  # -> Output0, Output1
and_6 = GateAnd(A=equals_10.Inequality, B=equals_11.Inequality)
sift_7 = SiftPattern(List=complex_4.Imaginary, SiftPattern=and_6)  # -> Output0, Output1
sift_8 = SiftPattern(List=complex_4.Real, SiftPattern=and_6)  # -> Output0, Output1
sift_9 = SiftPattern(List=complex_3.Imaginary, SiftPattern=and_5)  # -> Output0, Output1
sift_10 = SiftPattern(List=complex_3.Real, SiftPattern=and_5)  # -> Output0, Output1
sift_11 = SiftPattern(List=a, SiftPattern=and_4)  # -> Output0, Output1
sift_12 = SiftPattern(List=b, SiftPattern=and_4)  # -> Output0, Output1
item_9 = ListItem(List=sift_4.Output1, Index=0, Wrap=True)  # -> Item, Item1, Item2
databasemapping_2 = Panel("""0,1,2;(0!=zero)and(1!=zero)
3,6;
4,5;(4!=zero)and(5!=zero)
3,5;
6,7;(6[0]!=6[1])and(7[0]!=7[1])
8,9,10;
6,11;
12,13;12=!k*pi,k=1,2,3..
6,14;(14[0]!=zero)and(14[1]!=zero)
6,15;(15[0]!=zero)and(15[1]!=zero)""")

tstat_9 = TreeStatistics(Tree=int_8)  # -> Paths, Length, Count
dpath_6 = DeconstructPath(Branch=tstat_9.Paths)
data_3 = Data(data)
functionsmatchparascounts_3 = Integer(functionsmatchparascounts)
viewer_5 = ParamViewer(dpath_6)
replace_5 = ReplacePaths(Data=dpath_6, Search=viewer_5, Replace=tstat_9.Paths)
item_10 = ListItem(List=replace_5, Index=0, Wrap=True)  # -> Item, Item1
item_11 = ListItem(List=functionsmatchparascounts_3, Index=item_10.Item1, Wrap=False)
stack_8 = StackData(Data=item_10.Item, Stack=item_11)
stack_9 = StackData(Data=item_10.Item1, Stack=item_11)
graft_18 = GraftTree(Tree=int_8, IncludeEmptyLists=True, IncludeNullItems=True)
graft_19 = GraftTree(Tree=stack_8, IncludeEmptyLists=True, IncludeNullItems=True)
graft_20 = GraftTree(Tree=stack_9, IncludeEmptyLists=True, IncludeNullItems=True)
merge_5 = Merge(Data1=graft_19, Data3=graft_18)
ins_8 = InsertItems(List=merge_5, Item="0", Indices="1", Wrap=True)  # -> simplify(List)
path_7 = ConstructPath(Indices=ins_8)
branch_4 = TreeBranch(Tree=data_3, Path=path_7, MaintainPaths=True)

path_mapper = PathMapper(branch_4, source="{A;B;C}", target="{C;B;A}")
path_mapper_2 = PathMapper(path_mapper, source="{A;B;C}", target="{A;C}")
pshift_3 = ShiftPaths(Data=path_mapper_2, Offset=-1)
tstat_10 = TreeStatistics(Tree=pshift_3)  # -> Paths, Length, Count
tstat_11 = TreeStatistics(Tree=path_mapper_2)  # -> Paths, Length, Count
partition_4 = PartitionList(List=tstat_11.Paths, Size=tstat_10.Length)  # -> simplify(Chunks)
panel_35 = Panel(tstat_11.Paths)
flatten_12 = FlattenTree(Tree=partition_4, Path="{0}")
branch_5 = TreeBranch(Tree=path_mapper_2, Path=flatten_12, MaintainPaths=True)

panel_36 = Panel("""{A,B,C}
{k,-1,y0-k*x0}
{b,a,-a*b}
{k,-1,b}
{x0-x1,y1-y0,x0*x1-y0*y1-x0*x0+y0*y0}
{m*A0+A1,m*B0+B1,m*C0+C1}
{A2,B2,-A2*x0-B2*y0}
{cos(angle),sin(angle),-p}
{v,-u,-v*x0+u*y0}
{nu,nv,-nu*x0-nv*y0}""")
item_12 = ListItem(List=panel_36, Index=item_10.Item1, Wrap=True)

panel_37 = Panel(item_12)
eval_2 = Evaluate(F="{cos(angle),sin(angle),-p}", angle=sift_5.Output1, p=sift_6.Output1)
eval_3 = Evaluate(
    F="{m*A0+A1,m*B0+B1,m*C0+C1}",
    A0=pdecon.XComponent,
    B0=pdecon.YComponent,
    C0=pdecon.ZComponent,
    A1=pdecon_2.XComponent,
    B1=pdecon_2.YComponent,
    C1=pdecon_2.ZComponent,
    m=intersection_m)
eval_4 = Evaluate(F="{A2,B2,-A2*x0-B2*y0}", A2=pdecon_3.XComponent, B2=pdecon_3.YComponent, C2=pdecon_3.ZComponent, x0=x0, y0=y0)
eval_5 = Evaluate(F="{nu,nv,-nu*x0-nv*y0}", x0=x0, y0=y0, nu=sift_8.Output1, nv=sift_7.Output1)
eval_6 = Evaluate(F="{k,-1,y0-k*x0}", k=k, x0=x0, y0=y0)
eval_7 = Evaluate(F="{x0-x1,y1-y0,x0*x1-y0*y1-x0*x0+y0*y0}", x0=x0, y0=y0, x1=x1, y1=y1)
eval_8 = Evaluate(F="{v,-u,-v*x0+u*y0}", x0=x0, y0=y0, u=sift_10.Output1, v=sift_9.Output1)
eval_9 = Evaluate(F="{A,B,C}", A=item_9.Item, B=item_9.Item1, C=item_9.Item2)
eval_10 = Evaluate(F="{b,a,-a*b}", a=sift_11.Output1, b=sift_12.Output1)
eval_11 = Evaluate(F="{k,-1,b}", k=k, b=b)
viewer_6 = ParamViewer(graft_20)
panel_39 = Panel(eval_9)
panel_40 = Panel(eval_6)
panel_41 = Panel(eval_10)
panel_42 = Panel(eval_11)
panel_43 = Panel(eval_7)
panel_44 = Panel(eval_3)
panel_45 = Panel(eval_4)
panel_46 = Panel(eval_2)
panel_47 = Panel(eval_8)
panel_48 = Panel(eval_5)
eval_12 = Evaluate(F=item_12)
ins_9 = InsertItems(List=ins_7, Item=graft_17, Indices="3", Wrap=True)  # -> simplify(List)
panel_49 = Panel(graft_17)
path_8 = ConstructPath(Indices=ins_9)
panel_50 = Panel("""0
0.4
1
1.5
1.5
1.92
2
2.05
2.1
2.4
2.3
2.3
2.1
3
3.12
3.11
3.12""")
flatten_13 = FlattenTree(Tree=path_6, Path="{0}")
flatten_14 = FlattenTree(Tree=path_8, Path="{0}")
panel_51 = Panel("""0
1
2
3
2
2
3
1
2
1
0
0
2
0
1
3""")
panel_52 = Panel("""0
1
2
1.3
3
2.3
2""")
line = Line(Line((119.3393443, -60.78584412, 0), (119.6525493, -60.78584412, 0)))
panel_53 = Panel("""0
1
0
1.3
3
1
2.3
2""")
line_2 = Line(Line((119.8096632, -60.78584412, 0), (119.4931182, -60.78584412, 0)))
panel_54 = Panel("运算器存在bug")
panel_55 = Panel(ins_8)
replace_6 = ReplacePaths(Data=branch_3, Search=flatten_13, Replace=flatten_14)
num_6 = Number(replace_6)
sift_13 = SiftPattern(List=num_6, SiftPattern=int_10)  # -> Output0, Output1, Output2, Output3, Output4, Output5, Output6, Output7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
path_mapper_3 = PathMapper(num_6, source="{A;B;C;D}", target="{A;D}")
clean_4 = CleanTree(RemoveNulls=True, RemoveInvalid=True, RemoveEmpty=True, Tree=sift_13.Output0)
clean_5 = CleanTree(RemoveNulls=True, RemoveInvalid=True, RemoveEmpty=True, Tree=sift_13.Output1)
clean_6 = CleanTree(RemoveNulls=True, RemoveInvalid=True, RemoveEmpty=True, Tree=sift_13.Output2)
clean_7 = CleanTree(RemoveNulls=True, RemoveInvalid=True, RemoveEmpty=True, Tree=sift_13.Output3)
clean_8 = CleanTree(RemoveNulls=True, RemoveInvalid=True, RemoveEmpty=True, Tree=sift_13.Output4)
clean_9 = CleanTree(RemoveNulls=True, RemoveInvalid=True, RemoveEmpty=True, Tree=sift_13.Output5)
clean_10 = CleanTree(RemoveNulls=True, RemoveInvalid=True, RemoveEmpty=True, Tree=sift_13.Output6)
clean_11 = CleanTree(RemoveNulls=True, RemoveInvalid=True, RemoveEmpty=True, Tree=sift_13.Output7)
clean_12 = CleanTree(RemoveNulls=True, RemoveInvalid=True, RemoveEmpty=True, Tree=sift_13.Output8)
clean_13 = CleanTree(RemoveNulls=True, RemoveInvalid=True, RemoveEmpty=True, Tree=sift_13.Output9)
clean_14 = CleanTree(RemoveNulls=True, RemoveInvalid=True, RemoveEmpty=True, Tree=sift_13.Output10)
sift_14 = SiftPattern(List=clean_4, SiftPattern=graft(bang.Branch0))  # -> Output0, Output1, Output2
sift_15 = SiftPattern(List=clean_5, SiftPattern=graft(bang.Branch1))  # -> Output0, Output1, Output2, Output3, Output4, Output5, Output6
panel_56 = Panel(num_6)
panel_57 = Panel(path_mapper_3)
panel_58 = Panel(sift_15.Output6)
viewer_7 = ParamViewer(num_6)
replace_7 = ReplacePaths(Data=graft_20, Search=viewer_6, Replace=viewer_7)

pshift_4 = ShiftPaths(Data=num_6, Offset=-1)
viewer_8 = ParamViewer(pshift_4)
viewer_9 = ParamViewer(int_8)
replace_8 = ReplacePaths(Data=pshift_4, Search=viewer_8, Replace=viewer_9)
item_13 = ListItem(List=replace_8, Index=0, Wrap=True)

panel_59 = Panel(replace_7)
panel_60 = Panel(replace_8)
ccx = CurveCurve(CurveA=line, CurveB=line_2)  # -> Points, ParamsA, ParamsB
sift_16 = SiftPattern(List=branch_4, SiftPattern=graft_20)  # -> Output0, Output1, Output2, Output3, Output4, Output5, Output6, Output7, Output8, Output9

# ----
# mapping between angle and path
# {0;0} --> 0
# {1;0} --> 1/2*pi
# {2;0} --> pi
# {3;0} --> 3/2*pi
# 无所谓正交向量存不存在
jitter_2 = Jitter(List=panel_52, Jitter=1, Seed=2)  # -> Values, Indices
pi_8 = Pi(Factor=1)
pi_9 = Pi(Factor="2")
division_4 = Division(A=pi_8, B="2")
num_7 = Number(jitter_2.Values)
# log:
# 20161011
# 增强path的排序的算法前馈，可通过path运算直接得到向量关系:
# 排序前后问题：
# 先精确控制还是先离散问题
remap_3 = RemapNumbers(Value=num_7, Source="4", Target=pi_9)  # -> Mapped, Clipped
series_4 = Series(Start=0, Step=division_4, Count="5")
consec_3 = ConsecutiveDomains(Numbers=series_4, Additive=False)  # -> simplify(Domains)
angle_4 = Number(remap_3.Mapped)
domain_3 = Domain(graft(consec_3))
dedomain_3 = DeconstructDomain(Domain=domain_3)  # -> simplify(Start), simplify(End)
# log:
# 20161012
# debug时候replacePath爆红:
# 删除空的树形数据结构，merge的时候数据结构对应
# 精度问题导致set不能去掉原本偏差相同的角度：
# 用round函数取到小数点后几位，关键是排序，这样做就不会对原来的数据产生什么影响，是标签改对了
larger_4 = LargerThan(FirstNumber=angle_4, SecondNumber=dedomain_3.Start)  # -> LargerThan, OrEqualTo
smaller_3 = SmallerThan(FirstNumber=angle_4, SecondNumber=dedomain_3.End)  # -> SmallerThan, OrEqualTo
and_7 = GateAnd(A=larger_4.OrEqualTo, B=smaller_3.SmallerThan)
sift_17 = SiftPattern(List=angle_4, SiftPattern=and_7)  # -> Output0, Output1
clean_15 = CleanTree(RemoveNulls=True, RemoveInvalid=False, RemoveEmpty=True, Tree=sift_17.Output1)  # -> simplify(Tree)
tstat_12 = TreeStatistics(Tree=clean_15)  # -> Paths, Length, Count
branch_6 = TreeBranch(Tree=dedomain_3.Start, Path=tstat_12.Paths, MaintainPaths=True)
subtraction_3 = Subtraction(A=clean_15, B=branch_6)
num_8 = Number(clean_15)
eval_13 = Evaluate(F="round(x,4)", x=subtraction_3)
flatten_15 = FlattenTree(Tree=eval_13, Path="{0}")
cset_5 = CreateSet(List=flatten_15)  # -> Set, Map
sort_3 = SortList(Keys=cset_5.Set)  # -> Keys, ValuesA
mindex_3 = MemberIndex(Set=sort_3.Keys, Member=eval_13)  # -> Index, Count
pshift_5 = ShiftPaths(Data=mindex_3.Index, Offset=-1)
flatten_16 = FlattenTree(Tree=mindex_3.Index, Path="{0}")
tstat_13 = TreeStatistics(Tree=pshift_5)  # -> Paths, Length, Count
dpath_7 = DeconstructPath(Branch=tstat_13.Paths)
graft_21 = GraftTree(Tree=flatten_16, IncludeEmptyLists=True, IncludeNullItems=True)  # -> simplify(Tree)
stack_10 = StackData(Data=dpath_7, Stack=graft(tstat_13.Length))
graft_22 = GraftTree(Tree=angle_4, IncludeEmptyLists=True, IncludeNullItems=True)
flatten_17 = FlattenTree(Tree=stack_10, Path="{0}")
graft_23 = GraftTree(Tree=flatten_17, IncludeEmptyLists=True, IncludeNullItems=True)  # -> simplify(Tree)
merge_6 = Merge(Data1=graft_23, Data2=graft_21)
path_9 = ConstructPath(Indices=merge_6)
graft_24 = GraftTree(Tree=num_8, IncludeEmptyLists=True, IncludeNullItems=True)
flatten_18 = FlattenTree(Tree=path_9, Path="{0}")
flatten_19 = FlattenTree(Tree=graft_24, Path="{0}")
viewer_10 = ParamViewer(graft_24)
keysearch_3 = KeyValueSearch(Keys=flatten_19, Values=flatten_18, Search=graft_22)  # -> simplify(Result)
replace_9 = ReplacePaths(Data=graft_24, Search=viewer_10, Replace=flatten_18)
path_10 = DataPath(keysearch_3)
# log:
# 20161010
# 设计向量方向与数据结构之间的映射关系
# 数据结构用集合运算然后替换
# 替换树形结构的时候需要拍平
# 无论什么情况都留出0123正交的位置为Null
# 如果0123存在，没关系，不存在，插入一个空值
# 20161011
# 角度和path之间的映射关系，以及角度的识别:
# 分解basic line的path得到位置位置关系
# 先正交的位置关系，后自由的位置关系
# 考虑先组合line还是先分解path在配对
# 如何识别path知道非正交的相反的向量
# 增强path的排序的算法前馈，可通过path运算直接得到向量关系
# 运用path提取相应的两条交线
# 20161012
# debug时候replacePath爆红
# 精度问题导致set不能去掉原本偏差相同的角度
# 20161017
# 找到了两根交线的关系，先把他放在这，具体怎么用不继续做下去，先考虑其他的大的情况
# 20161023
# 对线的识别方法以及数据的缺省情况
# 数据分流的方法是否合适
ultimateangle_afterelection = Number(replace_9)

clean_16 = CleanTree(RemoveNulls=True, RemoveInvalid=True, RemoveEmpty=True, Tree=sift_16.Output0)
clean_17 = CleanTree(RemoveNulls=True, RemoveInvalid=True, RemoveEmpty=True, Tree=sift_16.Output1)
clean_18 = CleanTree(RemoveNulls=True, RemoveInvalid=True, RemoveEmpty=True, Tree=sift_16.Output2)
clean_19 = CleanTree(RemoveNulls=True, RemoveInvalid=True, RemoveEmpty=True, Tree=sift_16.Output3)
clean_20 = CleanTree(RemoveNulls=True, RemoveInvalid=True, RemoveEmpty=True, Tree=sift_16.Output4)
clean_21 = CleanTree(RemoveNulls=True, RemoveInvalid=True, RemoveEmpty=True, Tree=sift_16.Output5)
clean_22 = CleanTree(RemoveNulls=True, RemoveInvalid=True, RemoveEmpty=True, Tree=sift_16.Output6)
clean_23 = CleanTree(RemoveNulls=True, RemoveInvalid=True, RemoveEmpty=True, Tree=sift_16.Output7)
clean_24 = CleanTree(RemoveNulls=True, RemoveInvalid=True, RemoveEmpty=True, Tree=sift_16.Output8)
clean_25 = CleanTree(RemoveNulls=True, RemoveInvalid=True, RemoveEmpty=True, Tree=sift_16.Output9)
line_bug_commonline = Line([Line((119.3540923, -60.56923774, 0), (119.5008735, -60.56923774, 0)), Line((119.5919791, -60.56923774, 0), (119.7404475, -60.56923774, 0))])
# debug:之前判断是实交和虚交的方法是判断交点point的x坐标是否在两线段的值域范围内，但是当上述情况的时候，直线会虚交被误判成实际交点
line_bug_insectiononextend = Line([Line((119.0174668, -60.28107794, 0), (119.4638718, -60.28107794, 0)), Line((119.2255633, -60.35451331, 0), (119.2255633, -61.15203638, 0))])
# log:
# 20161010
# 设计向量方向与数据结构之间的映射关系
# 分离对应的算法，让算法之间有通过也有分离
# 线线重合的问题解决后先放在一旁
# 数据结构的替换，在最后做
line_3 = Line([Line((119.5723897, -60.99532941, 0), (119.5723897, -61.13933165, 0)), Line((119.5723897, -60.99532941, 0), (119.7626783, -60.99532941, 0))])
panel_61 = Panel(replace_6)
tstat_14 = TreeStatistics(Tree=clean_24)  # -> Paths, Length, Count
panel_62 = Panel(clean_18)
panel_63 = Panel("把正交和斜交的情况分离开来，同时组织数据结构")
panel_65 = Panel(clean_25)

# ----
# f(x) revise beta1
panel_66 = Panel("""4
3
7""")
graft_25 = GraftTree(Tree=panel_66, IncludeEmptyLists=True, IncludeNullItems=True)
panel_67 = Panel("""9
6
3""")
panel_68 = Panel("""4
2
7""")
panel_69 = Panel("""x+y
x+2*y
x*y""")
path_11 = ConstructPath(Indices=graft_25)
graft_26 = GraftTree(Tree=panel_67, IncludeEmptyLists=True, IncludeNullItems=True)
graft_27 = GraftTree(Tree=panel_68, IncludeEmptyLists=True, IncludeNullItems=True)
item_14 = ListItem(List=panel_69, Index=graft_25, Wrap=True)
flatten_20 = FlattenTree(Tree=path_11, Path="{0}")
viewer_11 = ParamViewer(graft_26)
viewer_12 = ParamViewer(graft_27)
viewer_13 = ParamViewer(item_14)
replace_10 = ReplacePaths(Data=graft_26, Search=viewer_11, Replace=flatten_20)
replace_11 = ReplacePaths(Data=graft_27, Search=viewer_12, Replace=flatten_20)
replace_12 = ReplacePaths(Data=item_14, Search=viewer_13, Replace=flatten_20)
eval_14 = Evaluate(F=replace_12, x=replace_11, y=replace_10)
panel_70 = Panel(replace_12)
panel_71 = Panel(eval_14)

# ----
# f(x) revise beta 02
panel_72 = Panel("""4
3
7
1
3""")
panel_73 = Panel("""4
3
7""")
int_11 = Integer(panel_73)
int_12 = Integer(panel_72)
graft_28 = GraftTree(Tree=int_11, IncludeEmptyLists=True, IncludeNullItems=True)
graft_29 = GraftTree(Tree=int_12, IncludeEmptyLists=True, IncludeNullItems=True)
panel_74 = Panel("""9
6
3
4
2""")
panel_75 = Panel("""x+y
x+2*y
x*y""")
panel_76 = Panel("""4
2
7
4
3""")
path_12 = ConstructPath(Indices=graft_28)
path_13 = ConstructPath(Indices=graft_29)
graft_30 = GraftTree(Tree=panel_74, IncludeEmptyLists=True, IncludeNullItems=True)
graft_31 = GraftTree(Tree=panel_76, IncludeEmptyLists=True, IncludeNullItems=True)
graft_32 = GraftTree(Tree=panel_75, IncludeEmptyLists=True, IncludeNullItems=True)
flatten_21 = FlattenTree(Tree=path_12, Path="{0}")
flatten_22 = FlattenTree(Tree=path_13, Path="{0}")
viewer_14 = ParamViewer(graft_31)
viewer_15 = ParamViewer(graft_30)
viewer_16 = ParamViewer(graft_32)
replace_13 = ReplacePaths(Data=graft_31, Search=viewer_14, Replace=flatten_22)
replace_14 = ReplacePaths(Data=graft_30, Search=viewer_15, Replace=flatten_22)
replace_15 = ReplacePaths(Data=graft_32, Search=viewer_16, Replace=flatten_21)
branch_7 = TreeBranch(Tree=replace_14, Path=flatten_21, MaintainPaths=True)
branch_8 = TreeBranch(Tree=replace_13, Path=flatten_21, MaintainPaths=True)
panel_77 = Panel(graft_32)
eval_15 = Evaluate(F=replace_15, x=branch_8, y=branch_7)
panel_78 = Panel(replace_15)
panel_79 = Panel(branch_8)
panel_80 = Panel(eval_15)
panel_81 = Panel(branch_7)

panel_82 = Panel("""log:
20161023
对线的识别方法以及数据的缺省情况
数据分流计算的方法是否合适：
进行f(x)的修改""")
panel_83 = Panel(clean_24)
# foolish!
# foolish!
# foolish!
tstat_15 = TreeStatistics(Tree=int_8)  # -> Paths, Length, Count
num_9 = Number()
pshift_6 = ShiftPaths(Data=tstat_15.Paths, Offset=-1)
dpath_8 = DeconstructPath(Branch=pshift_6)
panel_84 = Panel(num_9)
viewer_17 = ParamViewer(dpath_8)
replace_16 = ReplacePaths(Data=dpath_8, Search=viewer_17, Replace=item_6)
item_15 = ListItem(List=replace_16, Index=0, Wrap=True)  # -> Item, Item1
panel_85 = Panel(replace_16)
int_13 = Integer(item_15.Item)
int_14 = Integer(item_15.Item1)

# ----
# {a;b;c;d;e}
# a --> line index
# b --> line type
# c --> line parameter index
# d --> line function mapping
lng_3 = ListLength(List=int_8)
flatten_23 = FlattenTree(Tree=item.Item1, Path="{0}")
stack_11 = StackData(Data=int_13, Stack=lng_3)
item_16 = ListItem(List=flatten_23, Index=stack_11, Wrap=True)
stack_12 = StackData(Data=int_14, Stack=lng_3)
graft_33 = GraftTree(Tree=int_8, IncludeEmptyLists=True, IncludeNullItems=True)
graft_34 = GraftTree(Tree=stack_11, IncludeEmptyLists=True, IncludeNullItems=True)
graft_35 = GraftTree(Tree=item_16, IncludeEmptyLists=True, IncludeNullItems=True)
graft_36 = GraftTree(Tree=stack_12, IncludeEmptyLists=True, IncludeNullItems=True)
merge_7 = Merge(Data1=graft_34, Data2=graft_35, Data3=graft_33)
merge_8 = Merge(Data1=graft_34, Data2=graft_35, Data3=graft_33, Data4=graft_36)
path_14 = ConstructPath(Indices=merge_7)
path_15 = ConstructPath(Indices=merge_8)
data_4 = Data(data)
flatten_24 = FlattenTree(Tree=path_14, Path="{0}")
flatten_25 = FlattenTree(Tree=path_15, Path="{0}")
branch_9 = TreeBranch(Tree=data_4, Path=flatten_24, MaintainPaths=True)
viewer_18 = ParamViewer(branch_9)
replace_17 = ReplacePaths(Data=branch_9, Search=viewer_18, Replace=flatten_25)

eval_16 = Evaluate(
    F="{A,B,C}",
    A=num_9,
    B=num_9,
    C=num_9,
    k=num_9,
    x0=num_9,
    y0=num_9,
    a=num_9,
    b=num_9,
    x1=num_9,
    y1=num_9,
    A0=num_9,
    B0=num_9,
    C0=num_9,
    A1=num_9,
    B1=num_9,
    C1=num_9,
    m=num_9,
    A2=num_9,
    B2=num_9,
    C2=num_9,
    angle=num_9,
    p=num_9,
    y=num_9,
    u=num_9,
    v=num_9,
    nu=num_9,
    nv=num_9)
panel_86 = Panel(eval_16)
int_15 = Integer(tstat_5.Length)
panel_87 = Panel("""0;0;0_3.2/1_1.0/3_2.2/5_4.0
1;0;2_2.5/3_4.0/4_8.2/5_1.2/7_2,3.2
2;0;1_2.2/7_2,1.9/11_3.222
3;0;4_8.2/6_4,2.2/14_2.442,3.442
4;0;4_8.2/6_1.2,4.2/14_3.56,4.23
5;0;3_3.2/6_1.2,4.2
6;0;0_2/2_2.3/1_3.2
7;0;6_3.2,1.2/7_1.2,3.2
8;0;8_3.2,2.2,1.2/9_3.4,1.3,1.2/10_2
9;0;6_2.2,3.1/11_4,3,2.2
10;0;12_3.221/13_4
11;0;6_3.21,2.22/15_4.23,5.43""")
int_16 = Integer(graft_36)
data_5 = Data(replace_17)
panel_88 = Panel(data_5)
panel_89 = Panel(replace_17)
item_17 = ListItem(List=int_15, Index=0, Wrap=False)  # -> Item, Item1, Item2, Item3, Item4, Item5, Item6, Item7, Item8, Item9
num_10 = Number(item_17.Item8)
series_5 = Series(Start=0, Step=1, Count=num_10)
sift_18 = SiftPattern(List=tstat_14.Paths, SiftPattern=series_5)  # -> Output0, Output1
branch_10 = TreeBranch(Tree=clean_24, Path=sift_18.Output1, MaintainPaths=True)
branch_11 = TreeBranch(Tree=clean_24, Path=sift_18.Output0, MaintainPaths=True)
item_18 = ListItem(List=branch_11, Index=0, Wrap=False)  # -> Item, Item1
item_19 = ListItem(List=branch_10, Index=0, Wrap=False)  # -> Item, Item1

u = Number(item_19.Item)
v = Number(item_19.Item1)
y0_2 = Number(item_18.Item1)
x0_2 = Number(item_18.Item)
equals_12 = Equality(FirstNumber=u, SecondNumber="0")  # -> Equality, Inequality
equals_13 = Equality(FirstNumber=v, SecondNumber="0")  # -> Equality, Inequality
and_8 = GateAnd(A=equals_12.Inequality, B=equals_13.Inequality)
sift_19 = SiftPattern(List=v, SiftPattern=and_8)  # -> Output0, Output1
sift_20 = SiftPattern(List=u, SiftPattern=and_8)  # -> Output0, Output1
eval_17 = Evaluate(F="{v,-u,-v*x0+u*y0}", x0=x0_2, y0=y0_2, u=sift_20.Output1, v=sift_19.Output1)
panel_90 = Panel(eval_17)
path_mapper_4 = PathMapper(eval_17, source="{A;B;C;D}", target="{A;B;0}")
panel_91 = Panel(path_mapper_4)

sift_21 = SiftPattern(List=data_5, SiftPattern=int_16)  # -> Output0, Output1, Output2, Output3, Output4, Output5, Output6, Output7, Output8, Output9
clean_26 = CleanTree(RemoveNulls=True, RemoveInvalid=True, RemoveEmpty=True, Tree=sift_21.Output0)
clean_27 = CleanTree(RemoveNulls=True, RemoveInvalid=True, RemoveEmpty=True, Tree=sift_21.Output1)
clean_28 = CleanTree(RemoveNulls=True, RemoveInvalid=True, RemoveEmpty=True, Tree=sift_21.Output2)
clean_29 = CleanTree(RemoveNulls=True, RemoveInvalid=True, RemoveEmpty=True, Tree=sift_21.Output3)
clean_30 = CleanTree(RemoveNulls=True, RemoveInvalid=True, RemoveEmpty=True, Tree=sift_21.Output4)
clean_31 = CleanTree(RemoveNulls=True, RemoveInvalid=True, RemoveEmpty=True, Tree=sift_21.Output5)
clean_32 = CleanTree(RemoveNulls=True, RemoveInvalid=True, RemoveEmpty=True, Tree=sift_21.Output6)
clean_33 = CleanTree(RemoveNulls=True, RemoveInvalid=True, RemoveEmpty=True, Tree=sift_21.Output7)
clean_34 = CleanTree(RemoveNulls=True, RemoveInvalid=True, RemoveEmpty=True, Tree=sift_21.Output8)
clean_35 = CleanTree(RemoveNulls=True, RemoveInvalid=True, RemoveEmpty=True, Tree=sift_21.Output9)
tstat_16 = TreeStatistics(Tree=clean_33)  # -> Paths, Length, Count
tstat_17 = TreeStatistics(Tree=clean_31)  # -> Paths, Length, Count
tstat_18 = TreeStatistics(Tree=clean_32)  # -> Paths, Length, Count
tstat_19 = TreeStatistics(Tree=clean_30)  # -> Paths, Length, Count

# ----
# 00 common parallel
# 10 vectical
# 20 reverse parallel
# 30 vectical
path_16 = DataPath(path_10)
flatten_26 = FlattenTree(Tree=path_16, Path="{0}")
tstat_20 = TreeStatistics(Tree=path_16)  # -> Paths, Length, Count
tstat_21 = TreeStatistics(Tree=path_16)  # -> Paths, Length, Count
ma_2 = MassAddition(Input=tstat_20.Length)  # -> Result, PartialResults
series_6 = Series(Start=0, Step=1, Count=tstat_21.Count)
stack_13 = StackData(Data=ma_2.PartialResults, Stack=tstat_20.Length)
shift = ShiftList(List=series_6, Shift=stack_13, Wrap=False)
item_20 = ListItem(List=flatten_26, Index=shift, Wrap=True)  # -> simplify(Item)
lng_4 = ListLength(List=item_20)
# log:
# 20161011
# 如何识别path知道非正交的相反的向量
# 增强path的排序的算法前馈，可通过path运算直接得到向量关系
# 运用path提取相应的两条交线；
# 索引交线，并保留原有树形结构
stack_14 = StackData(Data=path_16, Stack=lng_4)
secondpath = DataPath(item_20)
firstpath = DataPath(stack_14)
dpath_9 = DeconstructPath(Branch=firstpath)
dpath_10 = DeconstructPath(Branch=secondpath)
subtraction_4 = Subtraction(A=dpath_9, B=dpath_10)
abs_2 = Absolute(Value=subtraction_4)
item_21 = ListItem(List=abs_2, Index=0, Wrap=True)  # -> Item, Item1
panel_92 = Panel("""00
10
20
30""")
ultimateangle_afterelection_2 = Number(ultimateangle_afterelection)
concat = Concatenate(FragmentA=item_21.Item, FragmentB=item_21.Item1)
mindex_4 = MemberIndex(Set=panel_92, Member=concat)  # -> simplify(Index), Count
graft_37 = GraftTree(Tree=secondpath, IncludeEmptyLists=True, IncludeNullItems=True)
graft_38 = GraftTree(Tree=firstpath, IncludeEmptyLists=True, IncludeNullItems=True)

tstat_22 = TreeStatistics(Tree=clean_35)  # -> Paths, Length, Count
tstat_23 = TreeStatistics(Tree=clean_29)  # -> Paths, Length, Count
tstat_24 = TreeStatistics(Tree=clean_26)  # -> Paths, Length, Count
num_11 = Number(item_17.Item7)
num_12 = Number(item_17.Item5)
num_13 = Number(item_17.Item6)
num_14 = Number(item_17.Item4)
num_15 = Number(item_17.Item)
tstat_25 = TreeStatistics(Tree=clean_28)  # -> Paths, Length, Count
num_16 = Number(item_17.Item3)
num_17 = Number(item_17.Item9)
tstat_26 = TreeStatistics(Tree=clean_27)  # -> Paths, Length, Count
series_7 = Series(Start=0, Step=1, Count=num_11)
num_18 = Number(item_17.Item1)
num_19 = Number(item_17.Item2)
series_8 = Series(Start=0, Step=1, Count=num_12)
series_9 = Series(Start=0, Step=1, Count=num_13)
series_10 = Series(Start=0, Step=1, Count=num_15)
series_11 = Series(Start=0, Step=1, Count=num_14)
num_20 = Number(item_17.Item8)
tstat_27 = TreeStatistics(Tree=clean_34)  # -> Paths, Length, Count
series_12 = Series(Start=0, Step=1, Count=num_17)
series_13 = Series(Start=0, Step=1, Count=num_16)
series_14 = Series(Start=0, Step=1, Count=num_18)
series_15 = Series(Start=0, Step=1, Count=num_19)
sift_22 = SiftPattern(List=tstat_16.Paths, SiftPattern=series_7)  # -> Output0, Output1
sift_23 = SiftPattern(List=tstat_17.Paths, SiftPattern=series_8)  # -> Output0, Output1, Output2
sift_24 = SiftPattern(List=tstat_18.Paths, SiftPattern=series_9)  # -> Output0, Output1
series_16 = Series(Start=0, Step=1, Count=num_20)
sift_25 = SiftPattern(List=tstat_24.Paths, SiftPattern=series_10)  # -> Output0, Output1, Output2
sift_26 = SiftPattern(List=tstat_19.Paths, SiftPattern=series_11)  # -> Output0, Output1
sift_27 = SiftPattern(List=tstat_22.Paths, SiftPattern=series_12)  # -> Output0, Output1
sift_28 = SiftPattern(List=tstat_23.Paths, SiftPattern=series_13)  # -> Output0, Output1
sift_29 = SiftPattern(List=tstat_26.Paths, SiftPattern=series_14)  # -> Output0, Output1
sift_30 = SiftPattern(List=tstat_25.Paths, SiftPattern=series_15)  # -> Output0, Output1
sift_31 = SiftPattern(List=tstat_27.Paths, SiftPattern=series_16)  # -> Output0, Output1
branch_12 = TreeBranch(Tree=clean_31, Path=sift_23.Output1, MaintainPaths=True)
branch_13 = TreeBranch(Tree=clean_31, Path=sift_23.Output0, MaintainPaths=True)
branch_14 = TreeBranch(Tree=clean_31, Path=sift_23.Output2, MaintainPaths=True)
branch_15 = TreeBranch(Tree=clean_32, Path=sift_24.Output0, MaintainPaths=True)
branch_16 = TreeBranch(Tree=clean_30, Path=sift_26.Output0, MaintainPaths=True)
branch_17 = TreeBranch(Tree=clean_32, Path=sift_24.Output1, MaintainPaths=True)
branch_18 = TreeBranch(Tree=clean_30, Path=sift_26.Output1, MaintainPaths=True)
branch_19 = TreeBranch(Tree=clean_33, Path=sift_22.Output0, MaintainPaths=True)
branch_20 = TreeBranch(Tree=clean_33, Path=sift_22.Output1, MaintainPaths=True)
branch_21 = TreeBranch(Tree=clean_35, Path=sift_27.Output0, MaintainPaths=True)
branch_22 = TreeBranch(Tree=clean_29, Path=sift_28.Output0, MaintainPaths=True)
branch_23 = TreeBranch(Tree=clean_35, Path=sift_27.Output1, MaintainPaths=True)
branch_24 = TreeBranch(Tree=clean_29, Path=sift_28.Output1, MaintainPaths=True)
branch_25 = TreeBranch(Tree=clean_26, Path=sift_25.Output0, MaintainPaths=True)
branch_26 = TreeBranch(Tree=clean_26, Path=sift_25.Output1, MaintainPaths=True)
branch_27 = TreeBranch(Tree=clean_26, Path=sift_25.Output1, MaintainPaths=True)
branch_28 = TreeBranch(Tree=clean_28, Path=sift_30.Output1, MaintainPaths=True)
branch_29 = TreeBranch(Tree=clean_28, Path=sift_30.Output0, MaintainPaths=True)
branch_30 = TreeBranch(Tree=clean_27, Path=sift_29.Output1, MaintainPaths=True)
branch_31 = TreeBranch(Tree=clean_27, Path=sift_29.Output0, MaintainPaths=True)
branch_32 = TreeBranch(Tree=clean_34, Path=sift_31.Output1, MaintainPaths=True)
branch_33 = TreeBranch(Tree=clean_34, Path=sift_31.Output0, MaintainPaths=True)
item_22 = ListItem(List=branch_13, Index=0, Wrap=True)  # -> Item, Item1, Item2
item_23 = ListItem(List=branch_12, Index=0, Wrap=True)  # -> Item, Item1, Item2
item_24 = ListItem(List=branch_16, Index=0, Wrap=True)  # -> Item, Item1
item_25 = ListItem(List=branch_18, Index=0, Wrap=True)  # -> Item, Item1
item_26 = ListItem(List=branch_15, Index=0, Wrap=True)  # -> Item, Item1
item_27 = ListItem(List=branch_17, Index=0, Wrap=False)  # -> Item, Item1, Item2
item_28 = ListItem(List=branch_23, Index=0, Wrap=False)  # -> Item, Item1
item_29 = ListItem(List=branch_21, Index=0, Wrap=False)  # -> Item, Item1

A_2 = Number(branch_25)
B_2 = Number(branch_27)
C_2 = Number(branch_26)
equals_14 = Equality(FirstNumber=A_2, SecondNumber="0")  # -> Equality, Inequality
equals_15 = Equality(FirstNumber=B_2, SecondNumber="0")  # -> Equality, Inequality
and_9 = GateAnd(A=equals_14.Inequality, B=equals_15.Inequality)
sift_32 = SiftPattern(List=A_2, SiftPattern=and_9)  # -> Output0, Output1
sift_33 = SiftPattern(List=B_2, SiftPattern=and_9)  # -> Output0, Output1
sift_34 = SiftPattern(List=C_2, SiftPattern=and_9)  # -> Output0, Output1
eval_18 = Evaluate(F="{A,B,C}", A=sift_32.Output1, B=sift_33.Output1, C=sift_34.Output1)
panel_93 = Panel(eval_18)

item_30 = ListItem(List=branch_33, Index=0, Wrap=False)  # -> Item, Item1

k_2 = Number(branch_22)
b_2 = Number(branch_24)
eval_19 = Evaluate(F="{k,-1,b}", k=k_2, b=b_2)
panel_94 = Panel(eval_19)

item_31 = ListItem(List=branch_32, Index=0, Wrap=False)  # -> Item, Item1
panel_95 = Panel(item_22.Item2)

eval_20 = Evaluate(
    F="{m*A0+A1,m*B0+B1,m*C0+C1}",
    A0=item_22.Item,
    B0=item_22.Item1,
    C0=item_22.Item2,
    A1=item_23.Item,
    B1=item_23.Item1,
    C1=item_23.Item2,
    m=branch_14)
panel_96 = Panel(eval_20)

item_32 = ListItem(List=branch_30, Index=0, Wrap=True)  # -> Item, Item1
k_3 = Number(branch_31)
x0_3 = Number(item_32.Item)
y0_3 = Number(item_32.Item1)
eval_21 = Evaluate(F="{k,-1,y0-k*x0}", k=k_3, x0=x0_3, y0=y0_3)
panel_97 = Panel(eval_21)

x0_4 = Number(item_24.Item)
y0_4 = Number(item_24.Item1)
x1_2 = Number(item_25.Item)
y1_2 = Number(item_25.Item1)
eval_22 = Evaluate(F="{x0-x1,y1-y0,x0*x1-y0*y1-x0*x0+y0*y0}", x0=x0_4, y0=y0_4, x1=x1_2, y1=y1_2)
panel_98 = Panel(eval_22)

y0_5 = Number(item_26.Item1)
a2 = Number(item_27.Item)
x0_5 = Number(item_26.Item)
b2 = Number(item_27.Item1)
c2 = Number(item_27.Item2)
eval_23 = Evaluate(F="{A2,B2,-A2*x0-B2*y0}", A2=a2, B2=b2, C2=c2, x0=x0_5, y0=y0_5)
panel_99 = Panel(eval_23)

angle_5 = Number(branch_19)
distance_p_2 = Number(branch_20)
pi_10 = Pi(Factor=1)
division_5 = Division(A=angle_5, B=pi_10)
int_17 = Integer(division_5)
subtraction_5 = Subtraction(A=division_5, B=int_17)
abs_3 = Absolute(Value=subtraction_5)
larger_5 = LargerThan(FirstNumber=abs_3, SecondNumber="0.000001")  # -> LargerThan, OrEqualTo
sift_35 = SiftPattern(List=angle_5, SiftPattern=larger_5.LargerThan)  # -> Output0, Output1
sift_36 = SiftPattern(List=distance_p_2, SiftPattern=larger_5.LargerThan)  # -> Output0, Output1
eval_24 = Evaluate(F="{cos(angle),sin(angle),-p}", angle=sift_35.Output1, p=sift_36.Output1)
panel_100 = Panel(eval_24)

a_2 = Number(branch_29)
b_3 = Number(branch_28)
equals_16 = Equality(FirstNumber=b_3, SecondNumber="0")  # -> Equality, Inequality
equals_17 = Equality(FirstNumber=a_2, SecondNumber="0")  # -> Equality, Inequality
and_10 = GateAnd(A=equals_17.Inequality, B=equals_16.Inequality)
sift_37 = SiftPattern(List=a_2, SiftPattern=and_10)  # -> Output0, Output1
sift_38 = SiftPattern(List=b_3, SiftPattern=and_10)  # -> Output0, Output1
eval_25 = Evaluate(F="{b,a,-a*b}", a=sift_37.Output1, b=sift_38.Output1)
panel_101 = Panel(eval_25)

x0_6 = Number(item_30.Item)
y0_6 = Number(item_30.Item1)
u_2 = Number(item_31.Item)
v_2 = Number(item_31.Item1)
equals_18 = Equality(FirstNumber=u_2, SecondNumber="0")  # -> Equality, Inequality
equals_19 = Equality(FirstNumber=v_2, SecondNumber="0")  # -> Equality, Inequality
and_11 = GateAnd(A=equals_18.Inequality, B=equals_19.Inequality)
sift_39 = SiftPattern(List=v_2, SiftPattern=and_11)  # -> Output0, Output1
sift_40 = SiftPattern(List=u_2, SiftPattern=and_11)  # -> Output0, Output1
eval_26 = Evaluate(F="{v,-u,-v*x0+u*y0}", x0=x0_6, y0=y0_6, u=sift_40.Output1, v=sift_39.Output1)
panel_102 = Panel(eval_26)

x0_7 = Number(item_29.Item)
y0_7 = Number(item_29.Item1)
nu2 = Number(item_28.Item1)
nu1 = Number(item_28.Item)
equals_20 = Equality(FirstNumber=nu2, SecondNumber="0")  # -> Equality, Inequality
equals_21 = Equality(FirstNumber=nu1, SecondNumber="0")  # -> Equality, Inequality
and_12 = GateAnd(A=equals_21.Inequality, B=equals_20.Inequality)
sift_41 = SiftPattern(List=nu2, SiftPattern=and_12)  # -> Output0, Output1
sift_42 = SiftPattern(List=nu1, SiftPattern=and_12)  # -> Output0, Output1
eval_27 = Evaluate(F="{nu,nv,-nu*x0-nv*y0}", x0=x0_7, y0=y0_7, nu=sift_42.Output1, nv=sift_41.Output1)

path_mapper_5 = PathMapper(eval_20, source="{A;B;C;D}", target="{A;B;0}")
path_mapper_6 = PathMapper(eval_25, source="{A;B;C;D}", target="{A;B;0}")
path_mapper_7 = PathMapper(eval_19, source="{A;B;C;D}", target="{A;B;0}")
panel_103 = Panel(mindex_4.Index)
path_mapper_8 = PathMapper(eval_22, source="{A;B;C;D}", target="{A;B;0}")
path_mapper_9 = PathMapper(eval_21, source="{A;B;C;D}", target="{A;B;0}")
pshift_7 = ShiftPaths(Data=eval_18, Offset=-1)
path_mapper_10 = PathMapper(eval_23, source="{A;B;C;D}", target="{A;B;0}")
panel_104 = Panel(eval_27)
path_mapper_11 = PathMapper(eval_26, source="{A;B;C;D}", target="{A;B;0}")
panel_105 = Panel(pshift_7)
pdecon_4 = Deconstruct(Point=pshift_7)  # -> XComponent, YComponent, ZComponent
graft_39 = GraftTree(Tree=pshift_7, IncludeEmptyLists=True, IncludeNullItems=True)
panel_106 = Panel(path_mapper_9)
path_mapper_12 = PathMapper(eval_24, source="{A;B;C;D}", target="{A;B;0}")
path_mapper_13 = PathMapper(pdecon_4.XComponent, source="{A;B;C}", target="{A;B;0}")
path_mapper_14 = PathMapper(pdecon_4.YComponent, source="{A;B;C}", target="{A;B;1}")
path_mapper_15 = PathMapper(pdecon_4.ZComponent, source="{A;B;C}", target="{A;B;2}")
path_mapper_16 = PathMapper(eval_18, source="{A;B;C;D}", target="{A;B;0;0;0}")
panel_107 = Panel(path_mapper_11)
panel_108 = Panel(path_mapper_15)
panel_109 = Panel(path_mapper_16)
panel_110 = Panel("描述方法只是数据结构的不同，先用几何代表抽象的数据结构")
panel_111 = Panel("""x0,y0;0,1,2,3
x1,y0;0,3,2""")
panel_112 = Panel("""多条线且含有多折线连线组织数据结构问题
得到交点
交点的path替换""")
crv_2 = Curve([<curve referenced from the Rhino model> x3])
crv_3 = Curve([<curve referenced from the Rhino model> x3])
explode = Explode(Curve=crv_3, Recursive=True)  # -> Segments, Vertices
end = EndPoints(Curve=crv_3)  # -> Start, End
neg_4 = Negative(Value="1")
shift_2 = ShiftList(List=explode.Vertices, Shift="1", Wrap=False)
shift_3 = ShiftList(List=explode.Vertices, Shift=neg_4, Wrap=False)

panel_113 = Panel("""1,0
0,1
-1,0
0,-1""")
vec = Vector(panel_113)

# ----
# describe space by (point;index) of vector
md_slider = MDSlider(
    slider_value=Point(0.5591201782, 0.4691162109, 0.5),
    SliderMode=0,
    x_domain=Domain(-1000, 1000),
    y_domain=Domain(-1000, 1000),
    z_domain=Domain(0, 1))
panel_114 = Panel("""0
1
2
3""")
line_length = Panel("""3.2
5.1
3.2
5.1""")
line_length_2 = Number(line_length)
int_18 = Integer(panel_114)
lng_5 = ListLength(List=int_18)
series_17 = Series(Start=0, Step=1, Count=lng_5)
item_33 = ListItem(List=vec, Index=int_18, Wrap=True)
item_34 = ListItem(List=line_length_2, Index=series_17, Wrap=True)
basicvectorunit = Vector(item_33)
amp = Amplitude(Vector=basicvectorunit, Amplitude=item_34)
ma_3 = MassAddition(Input=amp)  # -> Result, PartialResults
addition_2 = Addition(A=md_slider, B=ma_3.PartialResults)
pt = Point(addition_2)
shift_4 = ShiftList(List=ma_3.PartialResults, Shift=-1, Wrap=True)
complex_5 = ComplexComponents(Complex=shift_4)  # -> Real, Imaginary
concat_2 = Concatenate(FragmentA=complex_5.Real, FragmentB=complex_5.Imaginary, JoinSeparator=",")
pline = PolyLine(Vertices=pt, Closed=True)
concat_3 = Concatenate(FragmentA=concat_2, FragmentB=int_18, JoinSeparator=";")

subtraction_6 = Subtraction(A=shift_2, B=shift_3)

graft_40 = GraftTree(Tree=end.Start, IncludeEmptyLists=True, IncludeNullItems=True)  # -> simplify(Tree)
subtraction_7 = Subtraction(A=graft_40, B="{0,0,0}")  # -> flatten(Result)
item_35 = ListItem(List=subtraction_7, Index="0", Wrap=True)
subtraction_8 = Subtraction(A=graft_40, B=item_35)

unit = UnitVector(Vector=subtraction_6)
vec_2 = Vector(subtraction_6)
len = Length(Curve=explode.Segments)  # -> simplify(Length)
pshift_8 = ShiftPaths(Data=unit, Offset=-1)
mindex_5 = MemberIndex(Set=vec, Member=pshift_8)  # -> Index, Count
vdis = VectorDisplay(Anchor=shift_3, Vector=vec_2)
pshift_9 = ShiftPaths(Data=mindex_5.Index, Offset=-1)  # -> simplify(Data)

vecdirection = Integer(pshift_9)
veclength = Number(len)
pt_2 = Point(graft_40)

panel_115 = Panel(vec)
item_36 = ListItem(List=vec, Index=vecdirection, Wrap=True)
amp_2 = Amplitude(Vector=item_36, Amplitude=veclength)
ma_4 = MassAddition(Input=amp_2)  # -> Result, PartialResults
addition_3 = Addition(A=pt_2, B=ma_4.PartialResults)
pt_3 = Point(addition_3)
ins_10 = InsertItems(List=addition_3, Item=pt_2, Indices="0", Wrap=True)
neg_5 = Negative(Value="1")
panel_116 = Panel(pt_2)
panel_117 = Panel(concat_3)
panel_118 = Panel(amp)
shift_5 = ShiftList(List=ins_10, Shift=neg_5, Wrap=False)  # -> simplify(List)

# ----
# tree data trial
# first point 和 end point 的数据结构组织的方式是同一种的
# 
# 先手工傻做，再寻找规律
# 
# 先不管结构如何，把他们放在一起，结构在外部运算，在替换成对的树形数据
# 上升数据结构后手工或者数列
# 上升后全部拍平处理
# 用stack+listItem对拍平的数据处理
# 
# 留下来的问题是数据结构的替换
# 手工
pt_4 = Point(shift_5)
graft_41 = GraftTree(Tree=pt_4, IncludeEmptyLists=True, IncludeNullItems=True)

flatten_27 = FlattenTree(Tree=graft_41, Path="{0}")
tstat_28 = TreeStatistics(Tree=pt_4)  # -> Paths, Length, Count
tstat_29 = TreeStatistics(Tree=graft_41)  # -> Paths, Length, Count
ma_5 = MassAddition(Input=tstat_28.Length)  # -> Result, PartialResults
series_18 = Series(Start=0, Step=1, Count=tstat_29.Count)
stack_15 = StackData(Data=ma_5.PartialResults, Stack=tstat_28.Length)
shift_6 = ShiftList(List=series_18, Shift=stack_15, Wrap=False)
item_37 = ListItem(List=flatten_27, Index=shift_6, Wrap=True)  # -> simplify(Item)

lng_6 = ListLength(List=item_37)

bang_2 = ExplodeTree(Data=graft_41)  # -> Branch0, Branch1, Branch2, Branch3, Branch4, Branch5
merge_9 = Merge(Data1=bang_2.Branch1, Data2=bang_2.Branch2, Data3=bang_2.Branch3, Data4=bang_2.Branch4, Data5=bang_2.Branch5)
entwine = Entwine(
    Branch00=merge_9,
    Branch01=bang_2.Branch5,
    Branch02=bang_2.Branch5,
    Branch03=bang_2.Branch5,
    Branch04=bang_2.Branch5,
    FlattenInputs=True)

stack_16 = StackData(Data=graft_41, Stack=lng_6)
shift_7 = ShiftList(List=ins_10, Shift="1", Wrap=False)  # -> simplify(List)
graft_42 = GraftTree(Tree=stack_16, IncludeEmptyLists=True, IncludeNullItems=True)
graft_43 = GraftTree(Tree=shift_5, IncludeEmptyLists=True, IncludeNullItems=True)

flatten_28 = FlattenTree(Tree=graft_43, Path="{0}")
tstat_30 = TreeStatistics(Tree=shift_5)  # -> Paths, Length, Count
tstat_31 = TreeStatistics(Tree=graft_43)  # -> Paths, Length, Count
ma_6 = MassAddition(Input=tstat_30.Length)  # -> Result, PartialResults
series_19 = Series(Start=0, Step=1, Count=tstat_31.Count)
stack_17 = StackData(Data=ma_6.PartialResults, Stack=tstat_30.Length)
shift_8 = ShiftList(List=series_19, Shift=stack_17, Wrap=False)
viewer_19 = ParamViewer()
item_38 = ListItem(List=flatten_28, Index=shift_8, Wrap=True)  # -> simplify(Item)
replace_18 = ReplacePaths(Data=item_38, Search=viewer_19)

graft_44 = GraftTree(Tree=shift_7, IncludeEmptyLists=True, IncludeNullItems=True)

# ----
# kernel tree data
flatten_29 = FlattenTree(Tree=graft_44, Path="{0}")
tstat_32 = TreeStatistics(Tree=shift_7)  # -> Paths, Length, Count
tstat_33 = TreeStatistics(Tree=graft_44)  # -> Paths, Length, Count
ma_7 = MassAddition(Input=tstat_32.Length)  # -> Result, PartialResults
series_20 = Series(Start=0, Step=1, Count=tstat_33.Count)
stack_18 = StackData(Data=ma_7.PartialResults, Stack=tstat_32.Length)
shift_9 = ShiftList(List=series_20, Shift=stack_18, Wrap=False)
item_39 = ListItem(List=flatten_29, Index=shift_9, Wrap=True)  # -> simplify(Item)
viewer_20 = ParamViewer()
replace_19 = ReplacePaths(Data=item_39, Search=viewer_20)

addition_4 = Addition(A=pt_2)

viewer_21 = ParamViewer()
replace_20 = ReplacePaths(Data=item_37, Search=viewer_21)

firstpt_line0 = Point(graft_43)
firstpt_line1 = Point(item_38)
endpt_line0 = Point(graft_44)
endpt_line1 = Point(item_39)

graft_45 = GraftTree(Tree=item_37, IncludeEmptyLists=True, IncludeNullItems=True)

# ----
# explore a point position in space
line_4 = Line([Line((120.4046894, -60.83579072, 0), (120.4046894, -60.79145643, 0)), Line((120.3917346, -60.82485109, 0), (120.420811, -60.82485109, 0))])
panel_119 = Panel("""处理k不存在的情况

写成函数
把坐标在相减后就分开来算

对实交和虚交的算法 不够缜密""")
# debug:可以做，但是要改动很多，先放放，出现问题了再来
linelist = Curve(line_4)
end_2 = EndPoints(Curve=linelist)  # -> Start, End
subtraction_9 = Subtraction(A=end_2.End, B=end_2.Start)
xy = XYPlane(Origin=Point(0, 0, 0))

startpoint = Point(end_2.Start)
vec_3 = Vector(subtraction_9)

addition_5 = Addition(A=startpoint, B=vec_3)
endpoint = Point(addition_5)
lng_7 = ListLength(List=addition_5)
lng_8 = ListLength(List=startpoint)
subtraction_10 = Subtraction(A=lng_7, B="1")
subtraction_11 = Subtraction(A=lng_8, B="1")
series_21 = Series(Start=0, Step=1, Count=subtraction_11)
series_22 = Series(Start=0, Step=1, Count=subtraction_10)
addition_6 = Addition(A=series_21, B="1")
addition_7 = Addition(A=series_22, B="1")
item_40 = ListItem(List=startpoint, Index=series_21, Wrap=False)  # -> simplify(graft(Item))
item_41 = ListItem(List=addition_5, Index=series_22, Wrap=False)  # -> simplify(graft(Item))
shift_10 = ShiftList(List=addition_5, Shift=addition_7, Wrap=False)  # -> simplify(List)
shift_11 = ShiftList(List=startpoint, Shift=addition_6, Wrap=False)  # -> simplify(List)

firstpt_line0_2 = Point(item_40)
firstpt_line1_2 = Point(shift_11)
endpt1_line1 = Point(shift_10)
endpt_line0_2 = Point(item_41)

points = PointList(Points=flatten(firstpt_line0_2), Size=Slider(6, range=0..100))

complex_6 = ComplexComponents(Complex=firstpt_line0_2)  # -> Real, Imaginary
complex_7 = ComplexComponents(Complex=endpt_line0_2)  # -> Real, Imaginary
complex_8 = ComplexComponents(Complex=firstpt_line1_2)  # -> Real, Imaginary
complex_9 = ComplexComponents(Complex=endpt1_line1)  # -> Real, Imaginary
subtraction_12 = Subtraction(A=complex_8.Imaginary, B=complex_9.Imaginary)
subtraction_13 = Subtraction(A=complex_8.Real, B=complex_9.Real)
subtraction_14 = Subtraction(A=complex_6.Real, B=complex_7.Real)
subtraction_15 = Subtraction(A=complex_6.Imaginary, B=complex_7.Imaginary)
division_6 = Division(A=subtraction_12, B=subtraction_13)
division_7 = Division(A=subtraction_15, B=subtraction_14)
k1 = Number(division_7)
k2 = Number(division_6)
multiplication_3 = Multiplication(A=k2, B=complex_8.Real)
subtraction_16 = Subtraction(A=complex_8.Imaginary, B=multiplication_3)
b2_2 = Number(subtraction_16)
subtraction_17 = Subtraction(A=k1, B=k2)

multiplication_4 = Multiplication(A=k1, B=complex_6.Real)
subtraction_18 = Subtraction(A=complex_6.Imaginary, B=multiplication_4)

equals_22 = Equality(FirstNumber=subtraction_13, SecondNumber="0")  # -> Equality, Inequality
equals_23 = Equality(FirstNumber=subtraction_14, SecondNumber="0")  # -> Equality, Inequality
sift_43 = SiftPattern(List=complex_9.Real, SiftPattern=equals_22.Equality)  # -> Output0, Output1
sift_44 = SiftPattern(List=complex_6.Real, SiftPattern=equals_23.Equality)  # -> Output0, Output1
or = GateOr(A=equals_23.Equality, B=equals_22.Equality)
combine = CombineData(Input0=sift_44.Output1, Input1=sift_43.Output1)  # -> Result, Index
sift_45 = SiftPattern(List=k2, SiftPattern=equals_22.Equality)  # -> Output0, Output1
sift_46 = SiftPattern(List=b2_2, SiftPattern=equals_22.Equality)  # -> Output0, Output1
sift_47 = SiftPattern(List=k1, SiftPattern=equals_23.Equality)  # -> Output0, Output1
combine_2 = CombineData(Input0=sift_47.Output0, Input1=sift_45.Output0)  # -> Result, Index
a_3 = Number(combine.Result)
k_4 = Number(combine_2.Result)
multiplication_5 = Multiplication(A=a_3, B=k_4)
intersection_x = Number(a_3)

b1 = Number(subtraction_18)
subtraction_19 = Subtraction(A=b2_2, B=b1)
division_8 = Division(A=subtraction_19, B=subtraction_17)
multiplication_6 = Multiplication(A=division_8, B=k2)
addition_8 = Addition(A=multiplication_6, B=b2_2)
sift_48 = SiftPattern(List=addition_8, SiftPattern=or)  # -> Output0, Output1

sift_49 = SiftPattern(List=b1, SiftPattern=equals_23.Equality)  # -> Output0, Output1
combine_3 = CombineData(Input0=sift_49.Output0, Input1=sift_46.Output0)  # -> Result, Index
b_4 = Number(combine_3.Result)
sift_50 = SiftPattern(List=b_4, SiftPattern=or)  # -> Output0, Output1
addition_9 = Addition(A=multiplication_5, B=sift_50.Output1)
intersection_y = Number(addition_9)

combine_4 = CombineData(Input0=sift_48.Output0, Input1=intersection_y)  # -> Result, Index
combine_5 = CombineData(Input0=division_8, Input1=intersection_x)  # -> Result, Index

panel_120 = Panel(equals_23.Equality)
intersection_x_2 = Number(combine_5.Result)
intersection_y_2 = Number(combine_4.Result)
pt_5 = PointOriented(BasePlane=xy, UComponent=intersection_x_2, VComponent=intersection_y_2, WComponent=0)

# ----
# true --> real insection
# false --> extend
# 10,11 --> real insection
# 01       --> extend one line
# 00       --> extend two lines
# true   -- > extend one line
# false -->  extend two lines
dom = ConstructDomain(DomainStart=complex_6.Imaginary, DomainEnd=complex_7.Imaginary)
dom_2 = ConstructDomain(DomainStart=complex_6.Real, DomainEnd=complex_7.Real)
dom_3 = ConstructDomain(DomainStart=complex_8.Real, DomainEnd=complex_9.Real)
dom_4 = ConstructDomain(DomainStart=complex_8.Imaginary, DomainEnd=complex_9.Imaginary)
firstpty_domain = Domain(dom)
firstptx_domain = Domain(dom_2)
endpty_domain = Domain(dom_4)
endptx_domain = Domain(dom_3)
inc = Includes(Value=intersection_y_2, Domain=firstpty_domain)  # -> Includes, Deviation
inc_2 = Includes(Value=intersection_x_2, Domain=endptx_domain)  # -> Includes, Deviation
inc_3 = Includes(Value=intersection_y_2, Domain=endpty_domain)  # -> Includes, Deviation
inc_4 = Includes(Value=intersection_x_2, Domain=firstptx_domain)  # -> Includes, Deviation
or_2 = GateOr(A=inc_4.Includes, B=inc.Includes, C=inc_2.Includes, D=inc_3.Includes)
and_13 = GateAnd(A=inc_4.Includes, B=inc.Includes, C=inc_2.Includes, D=inc_3.Includes)
int_19 = Integer(or_2)
int_20 = Integer(and_13)
concat_4 = Concatenate(FragmentA=int_20, FragmentB=int_19)
panel_121 = Panel("""10
11
01
00""")
panel_122 = Panel("""0
0
1
2""")
keysearch_4 = KeyValueSearch(Keys=panel_121, Values=panel_122, Search=concat_4)
extendlinecount = Integer(keysearch_4)

sift_51 = SiftPattern(List=pt_5, SiftPattern=extendlinecount)  # -> Output0, Output1, Output2
intersectionontwolines = Point(sift_51.Output0)
intersectionononeline = Point(sift_51.Output1)
intersectiononextend = Point(sift_51.Output2)
panel_123 = Panel(intersectionontwolines)

firstpt0 = Point(firstpt_line0)
firstpt1 = Point(firstpt_line1)
endpt0 = Point(endpt_line0)
endpt1 = Point(endpt_line1)
points_2 = PointList(Points=flatten(firstpt0), Size=Slider(0.109, range=0..3))
complex_10 = ComplexComponents(Complex=firstpt0)  # -> Real, Imaginary
complex_11 = ComplexComponents(Complex=firstpt1)  # -> Real, Imaginary
complex_12 = ComplexComponents(Complex=endpt1)  # -> Real, Imaginary
complex_13 = ComplexComponents(Complex=endpt0)  # -> Real, Imaginary
subtraction_20 = Subtraction(A=complex_11.Imaginary, B=complex_12.Imaginary)
subtraction_21 = Subtraction(A=complex_11.Real, B=complex_12.Real)
equals_24 = Equality(FirstNumber=subtraction_21, SecondNumber="0")  # -> Equality, Inequality
sift_52 = SiftPattern(List=complex_12.Real, SiftPattern=equals_24.Equality)  # -> Output0, Output1
subtraction_22 = Subtraction(A=complex_10.Imaginary, B=complex_13.Imaginary)
subtraction_23 = Subtraction(A=complex_10.Real, B=complex_13.Real)
equals_25 = Equality(FirstNumber=subtraction_23, SecondNumber="0")  # -> Equality, Inequality
sift_53 = SiftPattern(List=complex_10.Real, SiftPattern=equals_25.Equality)  # -> Output0, Output1
or_3 = GateOr(A=equals_25.Equality, B=equals_24.Equality)
combine_6 = CombineData(Input0=sift_53.Output1, Input1=sift_52.Output1)  # -> Result, Index
division_9 = Division(A=subtraction_20, B=subtraction_21)
division_10 = Division(A=subtraction_22, B=subtraction_23)
panel_124 = Panel("""处理k不存在的情况

写成函数
把坐标在相减后就分开来算""")
k1_2 = Number(division_10)
multiplication_7 = Multiplication(A=k1_2, B=complex_10.Real)
sift_54 = SiftPattern(List=k1_2, SiftPattern=equals_25.Equality)  # -> Output0, Output1
subtraction_24 = Subtraction(A=complex_10.Imaginary, B=multiplication_7)
b1_2 = Number(subtraction_24)
sift_55 = SiftPattern(List=b1_2, SiftPattern=equals_25.Equality)  # -> Output0, Output1
k2_2 = Number(division_9)
multiplication_8 = Multiplication(A=k2_2, B=complex_11.Real)
sift_56 = SiftPattern(List=k2_2, SiftPattern=equals_24.Equality)  # -> Output0, Output1
subtraction_25 = Subtraction(A=complex_11.Imaginary, B=multiplication_8)
combine_7 = CombineData(Input0=sift_54.Output0, Input1=sift_56.Output0)  # -> Result, Index
b2_3 = Number(subtraction_25)
sift_57 = SiftPattern(List=b2_3, SiftPattern=equals_24.Equality)  # -> Output0, Output1
combine_8 = CombineData(Input0=sift_55.Output0, Input1=sift_57.Output0)  # -> Result, Index
subtraction_26 = Subtraction(A=b2_3, B=b1_2)
b_5 = Number(combine_8.Result)
a_4 = Number(combine_6.Result)
k_5 = Number(combine_7.Result)
subtraction_27 = Subtraction(A=k1_2, B=k2_2)
sift_58 = SiftPattern(List=b_5, SiftPattern=or_3)  # -> Output0, Output1
multiplication_9 = Multiplication(A=a_4, B=k_5)
division_11 = Division(A=subtraction_26, B=subtraction_27)
multiplication_10 = Multiplication(A=division_11, B=k2_2)
addition_10 = Addition(A=multiplication_10, B=b2_3)
sift_59 = SiftPattern(List=addition_10, SiftPattern=or_3)  # -> Output0, Output1
addition_11 = Addition(A=multiplication_9, B=sift_58.Output1)
intersection_x_3 = Number(a_4)
intersection_y_3 = Number(addition_11)
combine_9 = CombineData(Input0=sift_59.Output0, Input1=intersection_y_3)  # -> Result, Index
combine_10 = CombineData(Input0=division_11, Input1=intersection_x_3)  # -> Result, Index
intersection_x_4 = Number(combine_10.Result)
intersection_y_4 = Number(combine_9.Result)
xy_2 = XYPlane(Origin=Point(0, 0, 0))
pt_6 = PointOriented(BasePlane=xy_2, UComponent=intersection_x_4, VComponent=intersection_y_4, WComponent=0)

# ----
# true --> real insection
# false --> extend
# 10,11 --> real insection
# 01       --> extend one line
# 00       --> extend two lines
# true   -- > extend one line
# false -->  extend two lines
dom_5 = ConstructDomain(DomainStart=complex_10.Imaginary, DomainEnd=complex_13.Imaginary)
dom_6 = ConstructDomain(DomainStart=complex_10.Real, DomainEnd=complex_13.Real)
dom_7 = ConstructDomain(DomainStart=complex_11.Real, DomainEnd=complex_12.Real)
dom_8 = ConstructDomain(DomainStart=complex_11.Imaginary, DomainEnd=complex_12.Imaginary)
firstpty_domain_2 = Domain(dom_5)
firstptx_domain_2 = Domain(dom_6)
endpty_domain_2 = Domain(dom_8)
endptx_domain_2 = Domain(dom_7)
inc_5 = Includes(Value=intersection_y_4, Domain=firstpty_domain_2)  # -> Includes, Deviation
inc_6 = Includes(Value=intersection_x_4, Domain=endptx_domain_2)  # -> Includes, Deviation
inc_7 = Includes(Value=intersection_y_4, Domain=endpty_domain_2)  # -> Includes, Deviation
inc_8 = Includes(Value=intersection_x_4, Domain=firstptx_domain_2)  # -> Includes, Deviation
or_4 = GateOr(A=inc_8.Includes, B=inc_5.Includes, C=inc_6.Includes, D=inc_7.Includes)
and_14 = GateAnd(A=inc_8.Includes, B=inc_5.Includes, C=inc_6.Includes, D=inc_7.Includes)
int_21 = Integer(or_4)
int_22 = Integer(and_14)
concat_5 = Concatenate(FragmentA=int_22, FragmentB=int_21)
panel_125 = Panel("""10
11
01
00""")
panel_126 = Panel("""0
0
1
2""")
keysearch_5 = KeyValueSearch(Keys=panel_125, Values=panel_126, Search=concat_5)
extendlinecount_2 = Integer(keysearch_5)

sift_60 = SiftPattern(List=pt_6, SiftPattern=extendlinecount_2)  # -> Output0, Output1, Output2
intersectionontwolines_2 = Point(sift_60.Output0)
intersectionononeline_2 = Point(sift_60.Output1)
intersectiononextend_2 = Point(sift_60.Output2)

# ----
# 计算点到边界的垂直向量
# describe space by (point;index) of vector
# 问题在于，当某一path缺少时，替换的内容仍然会配对，造成数据多余错误
# 要探测出缺少的路径
# statistics-->DePath
# 最后拍平后替换路径
line_length_3 = Panel("""3.2
5.1
3.2
5.1
6.4
10.2""")
panel_127 = Panel("""0
1
0
1
2
3""")
md_slider_2 = MDSlider(
    slider_value=Point(0.4899997711, 0.4549980164, 0.5),
    SliderMode=0,
    x_domain=Domain(0, 1),
    y_domain=Domain(0, 1),
    z_domain=Domain(0, 1))
panel_128 = Panel("""0
1
2
3""")
line_length_4 = Panel("""3.2
5.1
3.2
5.1""")
panel_129 = Panel("""用字符串的方法表示还差最后一步，那么先拆开来用判断的方法做
拆开的方法很繁琐，索性还是用字符串替换的方法
检查目前的替换方法是否可以简化
并且找出到各个边的距离最近点""")
line_length_5 = Number(line_length_4)
panel_130 = Panel("""1,0
0,1
-1,0
0,-1""")
vec_4 = Vector(panel_130)
int_23 = Integer(panel_128)
lng_9 = ListLength(List=int_23)
series_23 = Series(Start=0, Step=1, Count=lng_9)
item_42 = ListItem(List=vec_4, Index=int_23, Wrap=True)
panel_131 = Panel(item_42)
item_43 = ListItem(List=line_length_5, Index=series_23, Wrap=True)
basicvectorunit_2 = Vector(item_42)
amp_3 = Amplitude(Vector=basicvectorunit_2, Amplitude=item_43)
ma_8 = MassAddition(Input=amp_3)  # -> Result, PartialResults
addition_12 = Addition(A=md_slider_2, B=ma_8.PartialResults)
shift_12 = ShiftList(List=ma_8.PartialResults, Shift=-1, Wrap=True)
complex_14 = ComplexComponents(Complex=shift_12)  # -> Real, Imaginary
concat_6 = Concatenate(FragmentA=complex_14.Real, FragmentB=complex_14.Imaginary, JoinSeparator=",")
item_44 = ListItem(List=amp_3, Index=graft(series_23), Wrap=True)
panel_132 = Panel(ma_8.PartialResults)
concat_7 = Concatenate(FragmentA=concat_6, FragmentB=int_23, JoinSeparator=";")
item_45 = ListItem(List=concat_7, Index=series_23, Wrap=True)
split_6 = TextSplit(Text=item_45, Separators=";")  # -> simplify(Result)
item_46 = ListItem(List=split_6, Index=0, Wrap=True)  # -> Item, Item1
pt_7 = Point(item_46.Item)
addition_13 = Addition(A=pt_7, B=item_44)
firstpt0_2 = Point(item_46.Item)
endpt0_2 = Point(addition_13)
panel_133 = Panel(concat_7)
complex_15 = ComplexComponents(Complex=endpt0_2)  # -> Real, Imaginary
complex_16 = ComplexComponents(Complex=firstpt0_2)  # -> Real, Imaginary
pt_8 = Point(Point(1.488717773, 12.13872048, 0))
subtraction_28 = Subtraction(A=complex_16.Imaginary, B=complex_15.Imaginary)
subtraction_29 = Subtraction(A=complex_16.Real, B=complex_15.Real)
complex_17 = ComplexComponents(Complex=pt_8)  # -> Real, Imaginary
division_12 = Division(A=subtraction_28, B=subtraction_29)
k1_3 = Number(division_12)
multiplication_11 = Multiplication(A=k1_3, B=complex_15.Real)
subtraction_30 = Subtraction(A=complex_15.Imaginary, B=multiplication_11)
b1_3 = Number(subtraction_30)
panel_134 = Panel("abs(k*x0-y0+b)/sqrt(k*k+1)")
panel_135 = Panel("(k*x0-y0+b)/sqrt(k*k+1)")
panel_136 = Panel("-(k*x0-y0+b)/sqrt(k*k+1)")

y = Number(complex_17.Imaginary)
x = Number(complex_17.Real)
larger_6 = LargerThan(FirstNumber=complex_16.Real, SecondNumber=x)  # -> LargerThan, OrEqualTo
larger_7 = LargerThan(FirstNumber=complex_16.Imaginary, SecondNumber=y)  # -> LargerThan, OrEqualTo
int_24 = Integer(larger_6.LargerThan)
int_25 = Integer(larger_7.LargerThan)
concat_8 = Concatenate(FragmentA=int_24, FragmentB=int_25)

# ---- group: vector match concept Error
panel_137 = Panel("""010
012
110
112""")
panel_138 = Panel("""101
103
111
113""")
panel_139 = Panel("""001
003
011
013""")
panel_140 = Panel("""000
002
100
102""")
merge_10 = Merge(Data1=panel_138, Data2=panel_137, Data3=panel_139, Data4=panel_140)
entwine_2 = Entwine(Branch00=panel_138, Branch01=panel_137, Branch02=panel_139, Branch03=panel_140, FlattenInputs=True)  # -> simplify(Result)
concat_9 = Concatenate(FragmentA=concat_8, FragmentB=item_46.Item1)
flatten_30 = FlattenTree(Tree=concat_9, Path="{0}")
mindex_6 = MemberIndex(Set=merge_10, Member=flatten_30)  # -> Index, Count
division_13 = Division(A=mindex_6.Index, B="4")
int_26 = Integer(division_13)
item_47 = ListItem(List=vec_4, Index=int_26, Wrap=True)

# ----
pt_9 = Point(ma_8.PartialResults)
pline_2 = PolyLine(Vertices=pt_9, Closed=True)

# ---- group: vector match concept Error
mindex_7 = MemberIndex(Set=entwine_2, Member=flatten_30)  # -> Index, Count
clean_36 = CleanTree(RemoveNulls=True, RemoveInvalid=True, RemoveEmpty=True, Tree=mindex_7.Index)
tstat_34 = TreeStatistics(Tree=clean_36)  # -> Paths, Length, Count
split_7 = TextSplit(Text=tstat_34.Paths, Separators=";")
item_48 = ListItem(List=split_7, Index="0", Wrap=True)
split_8 = TextSplit(Text=item_48, Separators="{")
item_49 = ListItem(List=split_8, Index="1", Wrap=True)  # -> simplify(Item)

equals_26 = Equality(FirstNumber=graft(flatten_30), SecondNumber=merge_10)  # -> Equality, Inequality
mindex_8 = MemberIndex(Set=equals_26.Equality, Member=Toggle(True))  # -> Index, Count

# ----
# distances between points and space boundary
null = NullItem(Item=k1_3)  # -> NullFlags, InvalidFlags, Description
sift_61 = SiftPattern(List=pt_7, SiftPattern=null.NullFlags)  # -> Output0, Output1
complex_18 = ComplexComponents(Complex=sift_61.Output1)  # -> Real, Imaginary
eval_28 = Evaluate(F="abs(k*x0-y0+b)/sqrt(k*k+1)", k=k1_3, b=b1_3, x0=complex_17.Real, y0=complex_17.Imaginary)
subtraction_31 = Subtraction(A=complex_17.Real, B=complex_18.Real)  # -> simplify(Result)
distance = Number(eval_28)
abs_4 = Absolute(Value=subtraction_31)  # -> simplify(Result)
combine_11 = CombineData(Input0=distance, Input1=abs_4)  # -> Result, Index

# ---- group: vector match method 1
concat_10 = Concatenate(FragmentA=concat_8, FragmentB=item_46.Item1)
flatten_31 = FlattenTree(Tree=concat_10, Path="{0}")
panel_141 = Panel("""000
002
100
102""")
panel_142 = Panel("""010
012
110
112""")
panel_143 = Panel("""101
103
111
113""")
panel_144 = Panel("""001
003
011
013""")
mindex_9 = MemberIndex(Set=panel_144, Member=flatten_31)  # -> Index, Count
mindex_10 = MemberIndex(Set=panel_141, Member=flatten_31)  # -> Index, Count
mindex_11 = MemberIndex(Set=panel_143, Member=flatten_31)  # -> Index, Count
mindex_12 = MemberIndex(Set=panel_142, Member=flatten_31)  # -> Index, Count
clean_37 = CleanTree(RemoveNulls=True, RemoveInvalid=True, RemoveEmpty=True, Tree=mindex_12.Index)
clean_38 = CleanTree(RemoveNulls=True, RemoveInvalid=True, RemoveEmpty=True, Tree=mindex_10.Index)
clean_39 = CleanTree(RemoveNulls=True, RemoveInvalid=True, RemoveEmpty=True, Tree=mindex_11.Index)
clean_40 = CleanTree(RemoveNulls=True, RemoveInvalid=True, RemoveEmpty=True, Tree=mindex_9.Index)
replace_21 = ReplaceItems(List=clean_39, Item="0", Indices="0", Wrap=False)
replace_22 = ReplaceItems(List=clean_37, Item="1", Indices="0", Wrap=False)
replace_23 = ReplaceItems(List=clean_40, Item="2", Indices="0", Wrap=False)
replace_24 = ReplaceItems(List=clean_38, Item="3", Indices="0", Wrap=False)
merge_11 = Merge(Data1=replace_21, Data2=replace_22, Data3=replace_23, Data4=replace_24)
item_50 = ListItem(List=vec_4, Index=merge_11, Wrap=True)
amp_4 = Amplitude(Vector=item_50, Amplitude=combine_11.Result)
vdis_2 = VectorDisplay(Anchor=pt_8, Vector=amp_4)

# ---- group: vector match method 0 Error
# left-down;x-axis
# left-up;y-axis
a_5 = Number(complex_16.Real)
b_6 = Number(complex_16.Imaginary)
y_2 = Number(complex_17.Imaginary)
x_2 = Number(complex_17.Real)
item_51 = ListItem(List=vec_4, Index=item_46.Item1, Wrap=True)
smaller_4 = SmallerThan(FirstNumber=b_6, SecondNumber=y_2)  # -> SmallerThan, OrEqualTo
not = GateNot(A=smaller_4.SmallerThan)
smaller_5 = SmallerThan(FirstNumber=a_5, SecondNumber=x_2)  # -> SmallerThan, OrEqualTo
and_15 = GateAnd(A=smaller_5.SmallerThan, B=not)
equals_27 = Equality(FirstNumber="0", SecondNumber=graft(int_23))  # -> Equality, Inequality
equals_28 = Equality(FirstNumber="2", SecondNumber=graft(int_23))  # -> Equality, Inequality
and_16 = GateAnd(A=smaller_5.SmallerThan, B=smaller_4.SmallerThan)
equals_29 = Equality(FirstNumber="1", SecondNumber=graft(int_23))  # -> Equality, Inequality
equals_30 = Equality(FirstNumber="3", SecondNumber=graft(int_23))  # -> Equality, Inequality
or_5 = GateOr(A=equals_27.Equality, B=equals_28.Equality)
or_6 = GateOr(A=equals_29.Equality, B=equals_30.Equality)
and_17 = GateAnd(A=or_6, B=and_16)
and_18 = GateAnd(A=or_5, B=and_15)
or_7 = GateOr(A=and_17, B=and_18)
sift_62 = SiftPattern(List=item_51, SiftPattern=or_7)  # -> Output0, Output1
pi_11 = Pi(Factor="0.5")
Z = UnitZ(Factor=1)
neg_6 = Negative(Value=pi_11)
vrot = Rotate(Vector=sift_62.Output0, Axis=Z, Angle=neg_6)
vrot_2 = Rotate(Vector=sift_62.Output1, Axis=Z, Angle=pi_11)
combine_12 = CombineData(Input0=vrot, Input1=vrot_2)  # -> Result, Index
amp_5 = Amplitude(Vector=combine_12.Result, Amplitude=combine_11.Result)
vdis_3 = VectorDisplay(Anchor=pt_8, Vector=amp_5)

# ----
# vectors between points and space boundary
panel_145 = Panel("0.5")  # disabled
item_52 = ListItem(List=vec_4, Index=item_46.Item1, Wrap=True)  # disabled
pi_12 = Pi(Factor=panel_145)  # disabled
neg_7 = Negative(Value=pi_12)  # disabled
Z_2 = UnitZ(Factor=1)  # disabled
vrot_3 = Rotate(Vector=item_52, Axis=Z_2, Angle=neg_7)  # disabled
amp_6 = Amplitude(Vector=vrot_3, Amplitude=combine_11.Result)  # disabled

panel_146 = Panel(eval_28)
panel_147 = Panel(combine_11.Result)

# ---- group: vector match method 1 simplify
entwine_3 = Entwine(Branch00=panel_138, Branch01=panel_137, Branch02=panel_139, Branch03=panel_140, FlattenInputs=True)  # -> simplify(Result)
flatten_32 = FlattenTree(Tree=concat_10, Path="{0}")
mindex_13 = MemberIndex(Set=entwine_3, Member=flatten_32)  # -> Index, Count
clean_41 = CleanTree(RemoveNulls=True, RemoveInvalid=True, RemoveEmpty=True, Tree=mindex_13.Index)
pshift_10 = ShiftPaths(Data=clean_41, Offset=-1)
viewer_22 = ParamViewer(clean_41)

tstat_35 = TreeStatistics(Tree=pshift_10)  # -> Paths, Length, Count
dpath_11 = DeconstructPath(Branch=tstat_35.Paths)  # -> simplify(Indices)

graft_46 = GraftTree(Tree=tstat_35.Length, IncludeEmptyLists=True, IncludeNullItems=True)
series_24 = Series(Start=0, Step=1, Count=graft_46)
int_27 = Integer(simplify(series_24))
replace_25 = ReplaceItems(List=pshift_10, Item=dpath_11, Indices=int_27, Wrap=False)
graft_47 = GraftTree(Tree=flatten(replace_25), IncludeEmptyLists=True, IncludeNullItems=True)
viewer_23 = ParamViewer(graft_47)
replace_26 = ReplacePaths(Data=graft_47, Search=viewer_23, Replace=viewer_22)
pshift_11 = ShiftPaths(Data=replace_26, Offset="1")
item_53 = ListItem(List=vec_4, Index=pshift_11, Wrap=True)
amp_7 = Amplitude(Vector=item_53, Amplitude=combine_11.Result)
vdis_4 = VectorDisplay(Anchor=pt_8, Vector=amp_7)
