# Grasshopper definition 20161027_tim_points_intersection_017_lineDatabase_debugLine.gh (Grasshopper 0.9.76)

databaseparameters = Panel("""A
B
C
k
a
b
x0_pt0
y0_pt0
x1_pt1
y1_pt1
A0_intersectionLine0
B0_intersectionLine0
C0_intersectionLine0
A1_intersectionLine1
B1_intersectionLine1
C1_intersectionLine1
m_intersection
A2_parallelLine
B2_parallelLine
C2_parallelLine
angle
distance(p)
u_vector
v_vector
nu_normalVector
nv_normalVector""")
databaseparameters_2 = Panel("""A
B
C
k
a
b
pt0(x0,y0)
pt1(x1,y1)
intersection_line0(A0,B0,C0)
intersection_line1(A1,B1,C1)
intersection_m
parallel_line(A2,B2,C2)
angle
distance(p)
vector(u,v)
normal_vector(nu,nv)""")
panel = Panel("""0;0;0_3.2/1_1.0/3_2.2/5_4.0
1;0;2_2.5/3_4.0/4_8.2/5_1.2/7_2,3.2
2;0;1_2.2/7_2,1.9/11_3.222
3;0;4_8.2/6_4,2.2/14_2.442,3.442
4;0;4_8.2/6_1.2,4.2/14_3.56,4.23
5;0;3_3.2/6_1.2,4.2
6;0;0_2/2_2.3/1_3.2
7;0;6_3.2,1.2/7_1.2,3.2
8;0;8_3.2,2.2,1.2/9_3.4,1.3,1.2/10_2
9;0;6_2.2,3.1/11_4,3,2.2
10;0;12_3.221/13_4
11;0;6_3.21,2.22/15_4.23,5.43""")
debug01_constraintsituation_a_0 = Panel("""0;0;0_3.2/1_1.0/3_2.2/5_4.0
1;0;2_2.5/3_4.0/4_8.2/5_1.2/8_2/9_3.2
2;0;1_2.2/8_2/9_1.9/11_3.222
3;0;4_8.2/6_4/7_2.2/22_2.442/23_3.442
4;0;4_8.2/6_1.2/7_4.2/22_3.56/23_4.23
5;0;3_3.2/6_1.2/7_4.2
6;0;0_2/2_2.3/1_3.2
7;0;6_3.2/7_1.2/8_1.2/9_3.2
8;0;10_3.2/11_2.2/12_1.2/13_3.4/14_1.3/15_1.2/16_2
9;0;6_2.2/7_3.1/17_4/18_3/19_2.2
10;0;20_3.221/21_4
11;0;6_3.21/7_2.22/24_4.23/25_5.43
12;0;0_0/1_1.2/2_3.1""")
panel_2 = Panel("""0;0;0_3.2/1_1.0/3_2.2/5_4.0
1;0;2_2.5/3_4.0/4_8.2/5_1.2/8_2/9_3.2
2;0;1_2.2/8_2/9_1.9/11_3.222
3;0;4_8.2/6_4/7_2.2/22_2.442/23_3.442
4;0;4_8.2/6_1.2/7_4.2/22_3.56/23_4.23
5;0;3_3.2/6_1.2/7_4.2
6;0;0_2/2_2.3/1_3.2
7;0;6_3.2/7_1.2/8_1.2/9_3.2
8;0;10_3.2/11_2.2/12_1.2/13_3.4/14_1.3/15_1.2/16_2
9;0;6_2.2/7_3.1/17_4/18_3/19_2.2
10;0;20_3.221/21_4
11;0;6_3.21/7_2.22/24_4.23/25_5.43""")
databaseparameters_3 = Panel("""A
B
C
k
a
b
x0_pt0
y0_pt0
x1_pt1
y1_pt1
A0_intersectionLine0
B0_intersectionLine0
C0_intersectionLine0
A1_intersectionLine1
B1_intersectionLine1
C1_intersectionLine1
m_intersection
A2_parallelLine
B2_parallelLine
C2_parallelLine
angle
distance(p)
u_vector
n_vector
nu_normalVector
nv_normalVector""")
panel_4 = Panel("""0;0;0_3.2/1_1.0/3_2.2/5_4.0
1;0;2_2.5/3_4.0/5_1.2/8_2/9_3.2
2;0;1_2.2/8_2/9_1.9/11_3.222
3;0;4_8.2/6_4/7_2.2/23_3.442
4;0;6_1.2/7_4.2/22_3.56/23_4.23
5;0;3_3.2/6_1.2/7_4.2
6;0;0_2/2_2.3/1_3.2
7;0;6_3.2/8_1.2/9_3.2
8;0;10_3.2/11_2.2/12_1.2/13_3.4/14_1.3/15_1.2/16_2
9;0;6_2.2/7_3.1/17_4/18_3/19_2.2
10;0;20_3.221/21_4
11;0;6_3.21/7_2.22/24_4.23/25_5.43""")
panel_5 = Panel("""0;0;0_3.2/1_1.0/3_2.2/5_4.0
1;0;2_2.5/3_4.0/4_8.2/5_1.2/7_2,3.2
2;0;1_2.2/7_2,1.9/11_3.222
3;0;4_8.2/6_4,2.2/14_2.442,3.442""")

unflatten = UnflattenTree()
group = Group()

databasefunctions = Panel("""Ax+By+C=0,A!=0 and B!=0
y-y0=k(x-x0),k!=empty
x/a+y/b=1,a!=0andb!=0
y=kx+b,k!=empty
(y-y1)(y2-y1)=(x-x1)(x2-x1),x1!=x2andy1!=y2
x*cos(angle)+y*sin(angle)-p=0,angle=!k*pi
(x-x0)/u=(y-y0)/v,u!=0andv!=0
nu*(x-x0)+nv(y-y0)=0,nv!=0andnu!=0""")
panel_6 = Panel("""{0;0;0;0}
{0;0;0;1}
{0;0;0;2}
{0;1;1;0}
{1;0;1;0}
{1;0;1;2}
{1;1;0;0}
{1;1;0;1}
{1;1;0;14}
{1;2;0;3}
{1;2;0;2}
{2;0;0;0}
{2;0;0;1}
{2;0;0;2}
{2;1;0;24}
{2;1;0;2}""")

# ----
# feed data and store data
panel_7 = Panel("/")
txt = Text(panel_4)
# log:
# 20161017
# 给定相应的数据，去匹配相应的算法
# 考虑是否要反馈数据
# path在后面匹配时，相同path的被放在一起，真tm尴尬...
# 完成一个基本的模板，明天按照这样继续做下去
# 20161018
# 算法和对应的参数进行匹配
# 对数据结构的处理进行简化，避免重复计算
# 数据的过滤和储存方式
split = TextSplit(Text=txt, Separators=";")
item = ListItem(List=split, Index=0, Wrap=True)  # -> Item, Item1, Item2
split_2 = TextSplit(Text=item.Item2, Separators=panel_7)
split_3 = TextSplit(Text=split_2, Separators="_")
item_2 = ListItem(List=split_3, Index=0, Wrap=True)  # -> simplify(Item), Item1
pshift = ShiftPaths(Data=item_2.Item, Offset=-1)
split_4 = TextSplit(Text=item_2.Item1, Separators=",")  # -> simplify(Result)
tstat = TreeStatistics(Tree=pshift)  # -> Paths, Length, Count
initialparasdepathlist = Integer(pshift)
initiallinecount = Integer(tstat.Count)
graft = GraftTree(Tree=tstat.Length, IncludeEmptyLists=True, IncludeNullItems=True)  # -> simplify(Tree)
initialparascounts = Integer(graft)
# log:
# 20161010
# 设计向量方向与数据结构之间的映射关系
# 数据结构用集合运算然后替换
# 替换树形结构的时候需要拍平
# 无论什么情况都留出0123正交的位置为Null
# 如果0123存在，没关系，不存在，插入一个空值
# 20161011
# 角度和path之间的映射关系，以及角度的识别:
# 分解basic line的path得到位置位置关系
# 先正交的位置关系，后自由的位置关系
# 考虑先组合line还是先分解path在配对
# 如何识别path知道非正交的相反的向量
# 增强path的排序的算法前馈，可通过path运算直接得到向量关系
# 运用path提取相应的两条交线
# 20161012
# debug时候replacePath爆红
# 精度问题导致set不能去掉原本偏差相同的角度
# 20161017
# 找到了两根交线的关系，先把他放在这，具体怎么用不继续做下去，先考虑其他的大的情况
# 20161018
# 算法和对应的参数进行匹配
# 对数据结构的处理进行简化，避免重复计算
# 数据的过滤和储存方式
# 20161023
# 对线的识别方法以及数据的缺省情况
# 数据分流计算的方法是否合适
# 重建数据结构，把他铺平
# 20161024
# 仍旧用了傻逼的分流数据的方法
# 设计能够包容其他线以及多线的数据结构
# debug程序
# 20161026
# 重建数据结构，修改之前Path运算中的bug
stack = StackData(Data=item.Item, Stack=initialparascounts)
stack_2 = StackData(Data=item.Item1, Stack=initialparascounts)
graft_2 = GraftTree(Tree=stack_2, IncludeEmptyLists=True, IncludeNullItems=True)
graft_3 = GraftTree(Tree=stack, IncludeEmptyLists=True, IncludeNullItems=True)
int = Integer(simplify(graft_3))
int_2 = Integer(simplify(item_2.Item))
int_3 = Integer(simplify(graft_2))
merge = Merge(Data1=int, Data2=int_3, Data3=int_2)
path = ConstructPath(Indices=merge)
flatten = FlattenTree(Tree=path, Path="{0}")
initialparaspaths = DataPath(path)
viewer = ParamViewer(split_4)
replace = ReplacePaths(Data=split_4, Search=viewer, Replace=flatten)
data = Data(replace)

# ----
# log:
# 20161023
# 对线的识别方法以及数据的缺省情况
# 数据分流计算的方法是否合适：
# 进行f(x)的修改
# 重建数据结构，把他铺平
# 对bug进行检测加入合适的限制条件
# 补充缺省值的接口
txt_2 = Text(debug01_constraintsituation_a_0)
databasefunctions_2 = Panel("""Ax+By+C=0,A!=0 and B!=0
y-y0=k(x-x0),k!=empty
x/a+y/b=1,a!=0andb!=0
y=kx+b,k!=empty
(y-y1)(y2-y1)=(x-x1)(x2-x1),x1!=x2andy1!=y2
f1(x,y)*m+f2(x,y)=0
f(x,y)-f(x0,y0)=0
x*cos(angle)+y*sin(angle)-p=0,angle=!k*pi
(x-x0)/u=(y-y0)/v,u!=0andv!=0
nu*(x-x0)+nv(y-y0)=0,nv!=0andnu!=0""")
# construct the method of feeding data
split_5 = TextSplit(Text=txt_2, Separators=";")
pathmanual = Panel("""{a;b;c;d;e;f}
a:lineIndex
b:segmentIndex
c:segmentLineType
d:parametersIndex
e:feedback_seg
f:feedback_line""")

# ----
# log:
# 20161010
# 设计向量方向与数据结构之间的映射关系
# 数据结构用集合运算然后替换
# 替换树形结构的时候需要拍平
# 无论什么情况都留出0123正交的位置为Null
# 如果0123存在，没关系，不存在，插入一个空值
# 20161011
# 角度和path之间的映射关系，以及角度的识别
# 线交的算法与path之间多对多的关系
pi = Pi(Factor="2")
# {0,0}-->0/2*pi
# 0/2*pi <= a< 1/2*pi
# {1,0}-->1/2*pi
# 1/2*pi <= a < 2/2*pi
# {2,0}-->2/2*pi
# 2/2*pi <= a < 3/2*pi
# {3,0}-->3/2*pi
# 3/2*pi <= a < 4/2*pi
# log:
# 20161010
# 如果0123存在，没关系，不存在，插入一个空值
# 光是插入一个空值也是不行，修改标签运算的算法使其更合理:原因是set的时候把null去掉了
# 应该是插入不是替换
# 不是插入一个Null就能解决问题的，问题处在了member的寻找上，寻找时候把null数据给删除了，结果找不到对应的path
random = Random(Range=pi, Number="20", Seed=Slider(33.222, range=0..100))

item_3 = ListItem(List=split_5, Index=0, Wrap=True)  # -> Item, Item1, Item2
split_6 = TextSplit(Text=item_3.Item2, Separators="/")
split_7 = TextSplit(Text=split_6, Separators="_")
item_4 = ListItem(List=split_7, Index=0, Wrap=True)  # -> simplify(Item), Item1

pi_2 = Pi(Factor=1)
ins = InsertItems(List=random, Item=pi_2, Indices="0", Wrap=True)

databasemappingline = Panel("""0,1,2
3,6,7
4,5
3,5
6,7,8,9
20,21
6,7,22,23
6,7,24,25""")
# kernel intersection algorithm 002_siftPoint
panel_8 = Panel("""0
0.4
1
1.5
1.5
1.92

2.05
2.1
2.4
2.3
2.3
2.1
3
3.12
3.11
3.12""")
databasemapping = Panel("""0,1,2;(0!=zero)and(1!=zero) A=0-->y-axis B=0-->x-x-axis
3,6,7;
4,5;(4!=zero)and(5!=zero)
3,5;
6,7,8,9;(6!=8)and(7!=9)
20,21;20=!k*pi,k=1,2,3..
6;7;22,23;(22!=zero)and(23!=zero)
6;7;24,25;(24!=zero)and(25!=zero)""")
panel_9 = Panel("""0;0%0:0_2.2/1_3.1/2_1.3*1%1:0_2
1;0%1:0_4.3/2_3.1*1%0:0_3.2/1_3.2/14_2.1*2%0:3_1.1/2_9.2
2;0%0:0_2/1_1.2/2_3.2*1%1:24_5/2_4.3""")
debug_3_a_0_4_b_0_5_c_0_6_a_b_0 = Panel("""0;0%0:0_2.2/1_3.1/2_1.3/3_1.2/5_2.2*1%1:0_2
1;0%1:0_4.3/2_3.1*1%0:0_3.2/1_3.2/14_2.1*2%0:3_1.1/2_9.2
2;0%0:0_2/1_1.2/2_3.2*1%1:24_5/2_4.3
3;0%0:0_0/1_1.8/2_2.3
4;0%0:0_0.2/1_0/2_1.2
5;0%0:0_0.3/1_1.3/2_0
6;0%0:0_0/1_0/2_2.3""")
debug_set = Panel("""0;0%0:0_2.2/1_3.1/2_1.3/3_1.2/5_2.2*1%1:0_2
1;0%1:0_4.3/2_3.1*1%0:0_3.2/1_3.2/14_2.1*2%0:3_1.1/2_9.2
2;0%0:0_2/1_1.2/2_3.2*1%1:24_5/2_4.3""")
pshift_2 = ShiftPaths(Data=item_4.Item, Offset=-1)
panel_10 = Panel(pshift_2)
debug_feedformaterror = Panel("""0;0%0:0_0/1_1.8/2_2.3
1;0%0:0_0.2/1_0/2_3.2
2;0%0:0_0.3/1_1.3/2_0""")
split_8 = TextSplit(Text=item_4.Item1, Separators=",")  # -> simplify(Result)
# Point:indicate a position in space
# Line:length,direction,position
# Point
# two ends of the line
# the intersection of two lines
# the meeting of lines at the corner of a space or volumn
# the center of field
panel_11 = Panel("""0
0.4
1
1.5
1.5
1.92

2.05
2.1
2.4
2.3
2.3
2.1
3
3.12
3.11
3.12""")
databasemapping_2 = Panel("""0,1,2;(0!=zero)and(1!=zero)
3,6;
4,5;(4!=zero)and(5!=zero)
3,5;
6,7;(6[0]!=6[1])and(7[0]!=7[1])
8,9,10;
6,11;
12,13;12=!k*pi,k=1,2,3..
6,14;(14[0]!=zero)and(14[1]!=zero)
6,15;(15[0]!=zero)and(15[1]!=zero)""")
tstat_2 = TreeStatistics(Tree=pshift_2)  # -> Paths, Length, Count
panel_12 = Panel(tstat_2.Length)

# ----
# mapping between angle and path
# {0;0} --> 0
# {1;0} --> 1/2*pi
# {2;0} --> pi
# {3;0} --> 3/2*pi
# 当向量中不存在某正交方向时候为Null
# vectorPath00_can't identify reverse vectors
panel_13 = Panel("2")
pi_3 = Pi(Factor=panel_13)
num = Number(panel_8)
remap = RemapNumbers(Value=num, Source="4", Target=pi_3)  # -> Mapped, Clipped
pi_4 = Pi(Factor=1)
sort = SortList(Keys=remap.Mapped)  # -> Keys, ValuesA
division = Division(A=pi_4, B="2")
series = Series(Start=0, Step=division, Count="5")
consec = ConsecutiveDomains(Numbers=series, Additive=False)  # -> simplify(Domains)
domain = Domain(graft(consec))
angle = Number(sort.Keys)
dedomain = DeconstructDomain(Domain=domain)  # -> Start, End
larger = LargerThan(FirstNumber=angle, SecondNumber=dedomain.Start)  # -> LargerThan, OrEqualTo
smaller = SmallerThan(FirstNumber=angle, SecondNumber=dedomain.End)  # -> SmallerThan, OrEqualTo
and = GateAnd(A=larger.OrEqualTo, B=smaller.SmallerThan)
sift = SiftPattern(List=angle, SiftPattern=and)  # -> Output0, Output1
clean = CleanTree(RemoveNulls=True, RemoveInvalid=True, RemoveEmpty=False, Tree=sift.Output1)  # -> simplify(Tree)
item_5 = ListItem(List=clean, Index="0", Wrap=True)
equals = Equality(FirstNumber=item_5, SecondNumber=simplify(dedomain.Start))  # -> Equality, Inequality
int_4 = Integer(equals.Inequality)
ins_2 = InsertItems(List=clean, Indices="0", Wrap=True)
neg = Negative(Value=int_4)
cull_i = CullIndex(List=ins_2, Indices=neg, Wrap=False)  # -> simplify(List)
num_2 = Number(cull_i)
cset = CreateSet(List=num_2)  # -> Set, Map
addition = Addition(A=cset.Map, B=int_4)
tstat_3 = TreeStatistics(Tree=addition)  # -> Paths, Length, Count
dpath = DeconstructPath(Branch=tstat_3.Paths)
graft_4 = GraftTree(Tree=addition, IncludeEmptyLists=True, IncludeNullItems=True)
stack_3 = StackData(Data=dpath, Stack=graft(tstat_3.Length))
graft_5 = GraftTree(Tree=cull_i, IncludeEmptyLists=True, IncludeNullItems=True)
graft_6 = GraftTree(Tree=stack_3, IncludeEmptyLists=True, IncludeNullItems=True)  # -> simplify(Tree)
ins_3 = InsertItems(List=graft_6, Item=graft_4, Indices="-1", Wrap=True)
path_2 = ConstructPath(Indices=ins_3)  # -> simplify(Branch)
viewer_2 = ParamViewer(graft_5)
flatten_2 = FlattenTree(Tree=path_2, Path="{0}")
flatten_3 = FlattenTree(Tree=cull_i, Path="{0}")
replace_2 = ReplacePaths(Data=graft_5, Search=viewer_2, Replace=flatten_2)
graft_7 = GraftTree(Tree=sort.Keys, IncludeEmptyLists=True, IncludeNullItems=True)  # -> simplify(Tree)
keysearch = KeyValueSearch(Keys=flatten_3, Values=flatten_2, Search=graft_7)

panel_14 = Panel("""0
1
2
3
2
2
3
1
2
1
0
0
2
0
1
3""")
# feed data and store data
initialparasdepathlist_2 = Integer(pshift_2)
initiallinecount_2 = Integer(tstat_2.Count)
graft_8 = GraftTree(Tree=tstat_2.Length, IncludeEmptyLists=True, IncludeNullItems=True)  # -> simplify(Tree)
initialparascounts_2 = Integer(graft_8)

# ----
# log:
# 20161011
# 增强path的排序的算法前馈，可通过path运算直接得到向量关系:
# 排序前后问题：
# 先精确控制还是先离散问题
# 应该是把排序前的原始数据进行path替换，而不是排序之后的数据：结果竟然是一样的。。。！
# 20161017
# 修改好排序过后path下为空值产生的错误
# vectorPath01
# mapping between angle and path
# {0;0} --> 0
# {1;0} --> 1/2*pi
# {2;0} --> pi
# {3;0} --> 3/2*pi
# 无所谓正交向量存不存在
panel_15 = Panel("""0
1
0
1.3
3
1
2.3
2""")
jitter = Jitter(List=panel_14, Jitter=1, Seed=2)  # -> Values, Indices
pi_5 = Pi(Factor=1)
pi_6 = Pi(Factor="2")
num_3 = Number(jitter.Values)
division_2 = Division(A=pi_5, B="2")
# log:
# 20161010
# 不是插入一个Null就能解决问题的，问题处在了member的寻找上，寻找时候把null数据给删除了，结果找不到对应的path:
# 找到替换的member的运算器
# 发现前馈需要一大堆的运算器，先做成后馈
panel_16 = Panel("5")
remap_2 = RemapNumbers(Value=num_3, Source="4", Target=pi_6)  # -> Mapped, Clipped
series_2 = Series(Start=0, Step=division_2, Count=panel_16)
consec_2 = ConsecutiveDomains(Numbers=series_2, Additive=False)  # -> simplify(Domains)
angle_2 = Number(remap_2.Mapped)
domain_2 = Domain(graft(consec_2))
dedomain_2 = DeconstructDomain(Domain=domain_2)  # -> simplify(Start), simplify(End)
larger_2 = LargerThan(FirstNumber=angle_2, SecondNumber=dedomain_2.Start)  # -> LargerThan, OrEqualTo
smaller_2 = SmallerThan(FirstNumber=angle_2, SecondNumber=dedomain_2.End)  # -> SmallerThan, OrEqualTo
and_2 = GateAnd(A=larger_2.OrEqualTo, B=smaller_2.SmallerThan)
sift_2 = SiftPattern(List=angle_2, SiftPattern=and_2)  # -> Output0, Output1
clean_2 = CleanTree(RemoveNulls=True, RemoveInvalid=False, RemoveEmpty=True, Tree=sift_2.Output1)  # -> simplify(Tree)
tstat_4 = TreeStatistics(Tree=clean_2)  # -> Paths, Length, Count
branch = TreeBranch(Tree=dedomain_2.Start, Path=tstat_4.Paths, MaintainPaths=True)
subtraction = Subtraction(A=clean_2, B=branch)
num_4 = Number(clean_2)
eval = Evaluate(F="round(x,4)", x=subtraction)
flatten_4 = FlattenTree(Tree=eval, Path="{0}")
cset_2 = CreateSet(List=flatten_4)  # -> Set, Map
sort_2 = SortList(Keys=cset_2.Set)  # -> Keys, ValuesA
mindex = MemberIndex(Set=sort_2.Keys, Member=eval)  # -> Index, Count
pshift_3 = ShiftPaths(Data=mindex.Index, Offset=-1)
flatten_5 = FlattenTree(Tree=mindex.Index, Path="{0}")
tstat_5 = TreeStatistics(Tree=pshift_3)  # -> Paths, Length, Count
dpath_2 = DeconstructPath(Branch=tstat_5.Paths)
graft_9 = GraftTree(Tree=flatten_5, IncludeEmptyLists=True, IncludeNullItems=True)  # -> simplify(Tree)
stack_4 = StackData(Data=dpath_2, Stack=graft(tstat_5.Length))
graft_10 = GraftTree(Tree=angle_2, IncludeEmptyLists=True, IncludeNullItems=True)
flatten_6 = FlattenTree(Tree=stack_4, Path="{0}")
graft_11 = GraftTree(Tree=flatten_6, IncludeEmptyLists=True, IncludeNullItems=True)  # -> simplify(Tree)
merge_2 = Merge(Data1=graft_11, Data2=graft_9)
path_3 = ConstructPath(Indices=merge_2)
graft_12 = GraftTree(Tree=num_4, IncludeEmptyLists=True, IncludeNullItems=True)
flatten_7 = FlattenTree(Tree=path_3, Path="{0}")
flatten_8 = FlattenTree(Tree=graft_12, Path="{0}")
viewer_3 = ParamViewer(graft_12)
keysearch_2 = KeyValueSearch(Keys=flatten_8, Values=flatten_7, Search=graft_10)  # -> simplify(Result)
replace_3 = ReplacePaths(Data=graft_12, Search=viewer_3, Replace=flatten_7)
panel_17 = Panel(replace_3)
panel_18 = Panel(keysearch_2)

stack_5 = StackData(Data=item_3.Item, Stack=initialparascounts_2)
stack_6 = StackData(Data=item_3.Item1, Stack=initialparascounts_2)
# log:
# 20161010
# 设计向量方向与数据结构之间的映射关系
# 数据结构用集合运算然后替换
# 替换树形结构的时候需要拍平
# 无论什么情况都留出0123正交的位置为Null
# 如果0123存在，没关系，不存在，插入一个空值
# 20161011
# 角度和path之间的映射关系，以及角度的识别:
# 分解basic line的path得到位置位置关系
# 先正交的位置关系，后自由的位置关系
# 考虑先组合line还是先分解path在配对
# 如何识别path知道非正交的相反的向量
# 增强path的排序的算法前馈，可通过path运算直接得到向量关系
# 运用path提取相应的两条交线
# 20161012
# debug时候replacePath爆红
# 精度问题导致set不能去掉原本偏差相同的角度
# 20161017
# 找到了两根交线的关系，先把他放在这，具体怎么用不继续做下去，先考虑其他的大的情况
# 20161018
# 算法和对应的参数进行匹配
# 对数据结构的处理进行简化，避免重复计算
# 数据的过滤和储存方式
# 20161023
# 对线的识别方法以及数据的缺省情况
# 数据分流计算的方法是否合适
# 重建数据结构，把他铺平
# 20161024
# 仍旧用了傻逼的分流数据的方法
# 设计能够包容其他线以及多线的数据结构
# debug程序
# 20161026
# 重建数据结构，修改之前Path运算中的bug
# path中要加入segmentIndex的部分
# 根据老师的建议：删除符合的两个函数，对函数的调用方式进行修改,mapping修改
# 考虑线的域的问题
# 20161027
# 整理重构后的程序，把线的ABC算法仍然保留
# 对path,d位进行缺省研究，确定一条线的值域
# default要同时考虑线的正交情况，导致的A,B=0
txt_3 = Text(debug_3_a_0_4_b_0_5_c_0_6_a_b_0)
panel_19 = Panel(data)
split_9 = TextSplit(Text=txt_3, Separators=";")
graft_13 = GraftTree(Tree=stack_6, IncludeEmptyLists=True, IncludeNullItems=True)
graft_14 = GraftTree(Tree=stack_5, IncludeEmptyLists=True, IncludeNullItems=True)
item_6 = ListItem(List=split_9, Index=0, Wrap=True)  # -> Item, Item1
int_5 = Integer(simplify(graft_14))
int_6 = Integer(simplify(item_4.Item))
int_7 = Integer(simplify(graft_13))
split_10 = TextSplit(Text=item_6.Item1, Separators="*")
merge_3 = Merge(Data1=int_5, Data2=int_7, Data3=int_6)
path_4 = ConstructPath(Indices=merge_3)
flatten_9 = FlattenTree(Tree=path_4, Path="{0}")
panel_20 = Panel("""2.5838678
Pi
1.6421
3.212896
1.5*Pi""")
split_11 = TextSplit(Text=split_10, Separators="%")
viewer_4 = ParamViewer(split_8)
initialparaspaths_2 = DataPath(path_4)
item_7 = ListItem(List=split_11, Index=0, Wrap=True)  # -> Item, Item1
split_12 = TextSplit(Text=item_7.Item1, Separators=":")

# ----
# log:
# 20161010
# 应该是插入不是替换：
# 连一个新电池，是True就插入，False就不插入
# 简短的并不需要连接电池
# 插入的应该是一个Null值，而不是正交角度
# instance
panel_21 = Panel("0")
item_8 = ListItem(List=clean, Index=panel_21, Wrap=True)
equals_2 = Equality(FirstNumber=item_8, SecondNumber=simplify(dedomain.Start))  # -> Equality, Inequality
num_5 = Number(clean)
neg_2 = Negative(Value=equals_2.Inequality)
ins_4 = InsertItems(List=num_5, Indices=graft("0"), Wrap=True)
cull_i_2 = CullIndex(List=ins_4, Indices=neg_2, Wrap=False)  # -> simplify(List)

replace_4 = ReplacePaths(Data=split_8, Search=viewer_4, Replace=flatten_9)
item_9 = ListItem(List=split_12, Index=0, Wrap=True)  # -> Item, Item1
split_13 = TextSplit(Text=item_9.Item1, Separators="/")
simplify = SimplifyTree(Tree=split_13, Front=False)
pshift_4 = ShiftPaths(Data=simplify, Offset=-1)
panel_22 = Panel(pshift_4)
data_2 = Data(replace_4)
lng = ListLength(List=pshift_4)
stack_7 = StackData(Data=item_6.Item, Stack=lng)
split_14 = TextSplit(Text=split_13, Separators="_")  # -> simplify(Result)
lng_2 = ListLength(List=split_13)
stack_8 = StackData(Data=item_7.Item, Stack=lng_2)

# ----
# log:
# 20161010
# 插入的应该是一个Null值，而不是正交角度:
# 先保留空值，后根据boolean删除Null
# 插入一个空值的方法：
# 运用cull index运算器本身的性质，对布尔值进行negetive后删除不需要的空值
toggle = BooleanToggle(False)
series_3 = Series(Start=0, Step=1, Count=3)  # -> simplify(graft(Series))
graft_15 = GraftTree(Tree="0", IncludeEmptyLists=True, IncludeNullItems=True)  # -> graft(Tree)
panel_23 = Panel([Toggle(False), Toggle(True), toggle])
bool = Boolean(panel_23)
ins_5 = InsertItems(List=series_3, Indices=graft_15, Wrap=True)  # -> simplify(List)
# log:
# 20161010
# 设计向量方向与数据结构之间的映射关系
# 数据结构用集合运算然后替换
# 替换树形结构的时候需要拍平
# 无论什么情况都留出0123正交的位置为Null
# 如果0123存在，没关系，不存在，插入一个空值
# 20161011
# 角度和path之间的映射关系，以及角度的识别:
# 分解basic line的path得到位置位置关系
# 先正交的位置关系，后自由的位置关系
# 考虑先组合line还是先分解path在配对
# 如何识别path知道非正交的相反的向量
# 增强path的排序的算法前馈，可通过path运算直接得到向量关系
# 运用path提取相应的两条交线
# 20161012
# debug时候replacePath爆红
# 精度问题导致set不能去掉原本偏差相同的角度
# 20161017
# 找到了两根交线的关系，先把他放在这，具体怎么用不继续做下去，先考虑其他的大的情况
# 先罗列出方程对应的算法
# 建立数据库，对数据结构进行设计，让每一个数据都有对应的位置
# 给定相应的数据，去匹配相应的算法
# 考虑是否要反馈数据
int_8 = Integer(bool)
neg_3 = Negative(Value=int_8)
cull_i_3 = CullIndex(List=ins_5, Indices=graft(neg_3), Wrap=False)
panel_24 = Panel(cull_i_3)

# ----
# path{x;y}表示，索引为x的线可以匹配索引为y算法。
# 如果是相同x下有多个，说明算法上有多个选择
# path{x;y}
# x         --> line index
# y         --> function index
# value  -->  parameters index
# each line choose first function
databasemapping_3 = Panel("""0,1,2
3,6,7
4,5
3,5
6,7,8,9
20,21
6,7,22,23
6,7,24,25""")
initialparasdepathlist_3 = Integer(initialparasdepathlist_2)
split_15 = TextSplit(Text=databasemapping_3, Separators=",")  # -> simplify(Result)
functionparasdepathlist = Integer(split_15)
tstat_6 = TreeStatistics(Tree=functionparasdepathlist)  # -> Paths, Length, Count
initialparascounts_3 = Integer(initialparascounts_2)
flatten_10 = FlattenTree(Tree=functionparasdepathlist, Path="{0}")
initiallinecount_3 = Integer(initiallinecount_2)
functionsmatchparascounts = Integer(tstat_6.Length)
functionscount = Integer(tstat_6.Count)
lng_3 = ListLength(List=flatten_10)
multiplication = Multiplication(A=initialparascounts_3, B=functionscount)
multiplication_2 = Multiplication(A=initiallinecount_3, B=lng_3)
repeat = RepeatData(Data=initialparasdepathlist_3, Length=multiplication)  # -> simplify(Data)
repeat_2 = RepeatData(Data=flatten_10, Length=multiplication_2)
partition = PartitionList(List=repeat, Size=initialparascounts_3)  # -> simplify(Chunks)
partition_2 = PartitionList(List=repeat_2, Size=lng_3)
partition_3 = PartitionList(List=partition_2, Size=functionsmatchparascounts)  # -> simplify(Chunks)
int_9 = Integer(partition_3)
int_10 = Integer(partition)
mindex_2 = MemberIndex(Set=int_9, Member=int_10)  # -> Index, Count
lng_4 = ListLength(List=int_9)
ma = MassAddition(Input=mindex_2.Count)  # -> Result, PartialResults
equals_3 = Equality(FirstNumber=lng_4, SecondNumber=ma.Result)  # -> Equality, Inequality
sift_3 = SiftPattern(List=int_9, SiftPattern=equals_3.Equality)  # -> Output0, Output1
clean_3 = CleanTree(RemoveNulls=True, RemoveInvalid=True, RemoveEmpty=True, Tree=sift_3.Output1)
tstat_7 = TreeStatistics(Tree=clean_3)  # -> Paths, Length, Count
path_5 = DataPath(tstat_7.Paths)
dpath_3 = DeconstructPath(Branch=tstat_7.Paths)
item_10 = ListItem(List=dpath_3, Index=0, Wrap=True)
flatten_11 = FlattenTree(Tree=item_10, Path="{0}")
cset_3 = CreateSet(List=flatten_11)  # -> Set, Map
item_11 = ListItem(List=path_5, Index=cset_3.Set, Wrap=False)
branch_2 = TreeBranch(Tree=clean_3, Path=item_11, MaintainPaths=True)
int_11 = Integer(branch_2)

stack_9 = StackData(Data=item_9.Item, Stack=lng_2)
flatten_12 = FlattenTree(Tree=stack_7, Path="{0}")
flatten_13 = FlattenTree(Tree=stack_8, Path="{0}")
# log:
# 20161010
# 发现前馈需要一大堆的运算器，先做成后馈
# 如果需要前反馈，可能需要修改标签运算的算法，所以先后馈，至少能做下去
# 重新Partition
# 还是回到前馈
# log:
# 20161010
# 还是回到前馈：
# 用set运算器自带的index记录，与boolean值进行相加，对path运算得到新的path
# log:
# 20161010
# 设计向量方向与数据结构之间的映射关系
# 数据结构用集合运算然后替换
# 替换树形结构的时候需要拍平
# 无论什么情况都留出0123正交的位置为Null
# 如果0123存在，没关系，不存在，插入一个空值
# 20161011
# 角度和path之间的映射关系，以及角度的识别:
# 先正交的位置关系，后自由的位置关系
# 如何识别path知道非正交的相反的向量
# 增强path的排序的算法前馈，可通过path运算直接得到向量关系
panel_25 = Panel(clean)
item_12 = ListItem(List=split_14, Index=0, Wrap=True)  # -> Item, Item1
pshift_5 = ShiftPaths(Data=item_12.Item, Offset=-1)
databasemapping_4 = Panel("""0,1,2
3,6
4,5
3,5
6,7
8,9,10
6,11
12,13
6,14
6,15""")
flatten_14 = FlattenTree(Tree=stack_9, Path="{0}")
graft_16 = GraftTree(Tree=flatten_12, IncludeEmptyLists=True, IncludeNullItems=True)
graft_17 = GraftTree(Tree=flatten_13, IncludeEmptyLists=True, IncludeNullItems=True)
tstat_8 = TreeStatistics(Tree=pshift_5)  # -> Paths, Length, Count
initialparasdepathlist_4 = Integer(pshift_5)
flatten_15 = FlattenTree(Tree=item_12.Item, Path="{0}")
graft_18 = GraftTree(Tree=flatten_14, IncludeEmptyLists=True, IncludeNullItems=True)
graft_19 = GraftTree(Tree=flatten_15, IncludeEmptyLists=True, IncludeNullItems=True)
initialparascounts_4 = Integer(tstat_8.Length)
initiallinecount_4 = Integer(tstat_8.Count)
merge_4 = Merge(Data1=graft_16, Data2=graft_17, Data3=graft_18, Data4=graft_19)
path_6 = ConstructPath(Indices=merge_4)
split_16 = TextSplit(Text=databasemapping_4, Separators=",")  # -> simplify(Result)

functionparasdepathlist_2 = Integer(split_16)
initialparasdepathlist_5 = Integer(initialparasdepathlist)

dataparameterspath = Panel(initialparasdepathlist_5)
functionpath = Panel(functionparasdepathlist_2)
viewer_5 = ParamViewer(item_12.Item1)
flatten_16 = FlattenTree(Tree=path_6, Path="{0}")
tstat_9 = TreeStatistics(Tree=functionparasdepathlist_2)  # -> Paths, Length, Count
databasemappingline_2 = Panel("""0,1,2
3,6,7
4,5
3,5
6,7,8,9
20,21
6,7,22,23
6,7,24,25""")
initialparascounts_5 = Integer(initialparascounts)
flatten_17 = FlattenTree(Tree=functionparasdepathlist_2, Path="{0}")

# ----
# sample_treeStatistics
cset_4 = CreateSet(List=num_2)  # -> Set, Map
tstat_10 = TreeStatistics(Tree=cset_4.Map)  # -> Paths, Length, Count
dpath_4 = DeconstructPath(Branch=tstat_10.Paths)
stack_10 = StackData(Data=dpath_4, Stack=graft(tstat_10.Length))
graft_20 = GraftTree(Tree=cset_4.Map, IncludeEmptyLists=True, IncludeNullItems=True)
graft_21 = GraftTree(Tree=stack_10, IncludeEmptyLists=True, IncludeNullItems=True)  # -> simplify(Tree)
ins_6 = InsertItems(List=graft_21, Item=graft_20, Indices="-1", Wrap=True)
path_7 = ConstructPath(Indices=ins_6)  # -> simplify(Branch)
flatten_18 = FlattenTree(Tree=path_7, Path="{0}")

functionsmatchparascounts_2 = Integer(tstat_9.Length)
panel_26 = Panel("""A
P
a
K
t
k
u
v""")
replace_5 = ReplacePaths(Data=item_12.Item1, Search=viewer_5, Replace=flatten_16)
initiallinecount_5 = Integer(initiallinecount)
functionscount_2 = Integer(tstat_9.Count)
databasemappingcurve = Panel("2,24")
databasemappingcurve_2 = Panel("C")
lng_5 = ListLength(List=flatten_17)
data_3 = Data(replace_5)
panel_28 = Panel(data_3)
multiplication_3 = Multiplication(A=initialparascounts_5, B=functionscount_2)
panel_29 = Panel(initialparascounts_5)
multiplication_4 = Multiplication(A=initiallinecount_5, B=lng_5)
merge_5 = Merge(Data1=databasemappingline_2, Data2=databasemappingcurve)
merge_6 = Merge(Data1=panel_26, Data2=databasemappingcurve_2)
repeat_3 = RepeatData(Data=initialparasdepathlist_5, Length=multiplication_3)  # -> simplify(Data)
repeat_4 = RepeatData(Data=flatten_17, Length=multiplication_4)
initialparasdepathlist_6 = Integer(initialparasdepathlist_4)
txt_4 = Text(merge_5)
txt_5 = Text(merge_6)
split_17 = TextSplit(Text=txt_4, Separators=",")  # -> simplify(Result)
functionparasdepathlist_3 = Integer(split_17)
partition_4 = PartitionList(List=repeat_3, Size=initialparascounts_5)  # -> simplify(Chunks)

entwine = Entwine(Branch00=databasemappingline_2, Branch01=databasemappingcurve, FlattenInputs=True)
panel_30 = Panel(entwine)

partition_5 = PartitionList(List=repeat_4, Size=lng_5)
partition_6 = PartitionList(List=partition_5, Size=functionsmatchparascounts_2)  # -> simplify(Chunks)
tstat_11 = TreeStatistics(Tree=functionparasdepathlist_3)  # -> Paths, Length, Count
# path{x;y}表示，索引为x的线可以匹配索引为y算法。
# 如果是相同x下有多个，说明算法上有多个选择
int_12 = Integer(partition_6)
int_13 = Integer(partition_4)
mindex_3 = MemberIndex(Set=int_12, Member=int_13)  # -> Index, Count
panel_31 = Panel("""path{x;y;z}
x --> lineIndex
y -->segmentIndex
z  -->functionIndex
value -->parameters Index""")
lng_6 = ListLength(List=int_12)
initialparascounts_6 = Integer(initialparascounts_4)

item_13 = ListItem(List=initialparasdepathlist_6, Index=0, Wrap=True)
unflatten_2 = UnflattenTree(Tree=initialparascounts_6, Guide=item_13)

ma_2 = MassAddition(Input=mindex_3.Count)  # -> Result, PartialResults
equals_4 = Equality(FirstNumber=lng_6, SecondNumber=ma_2.Result)  # -> Equality, Inequality

initiallinecount_6 = Integer(initiallinecount_4)
flatten_19 = FlattenTree(Tree=functionparasdepathlist_3, Path="{0}")
functionscount_3 = Integer(tstat_11.Count)
functionsmatchparascounts_3 = Integer(tstat_11.Length)
lng_7 = ListLength(List=flatten_19)
multiplication_5 = Multiplication(A=initiallinecount_6, B=lng_7)
repeat_5 = RepeatData(Data=flatten_19, Length=multiplication_5)
partition_7 = PartitionList(List=repeat_5, Size=lng_7)  # -> simplify(Chunks)
partition_8 = PartitionList(List=partition_7, Size=functionsmatchparascounts_3)  # -> simplify(Chunks)

initialparascounts_7 = Integer(initialparascounts_4)
multiplication_6 = Multiplication(A=initialparascounts_7, B=functionscount_3)
graft_22 = GraftTree(Tree=initialparascounts_7, IncludeEmptyLists=True, IncludeNullItems=True)
repeat_6 = RepeatData(Data=initialparasdepathlist_6, Length=graft(multiplication_6))  # -> simplify(Data)
stack_11 = StackData(Data=graft_22, Stack=functionscount_3)
partition_9 = PartitionList(List=repeat_6, Size=stack_11)  # -> simplify(Chunks)

# ----
# A'
# B'
# goal
# B
# A
# 问题：以上是我的做法是把原本多对多的关系，
# 通过stack,repeat,partition转换成一对一。
# 但是这样做不仅算量大，
# 而且当初始设计的数据结构path扩展的时候，
# 就需要重新做这一块。
# 有什么方法更好的处理表之间的多对多？
# 我的直觉是觉得自己没有利用好DataTree本身的特性。
# 目标：想在A树中找到和B树中某表相同的所有表
viewer_6 = ParamViewer(initialparasdepathlist_6)
panel_32 = Panel(initialparasdepathlist_6)
panel_33 = Panel(functionparasdepathlist_3)
viewer_7 = ParamViewer(functionparasdepathlist_3)
int_14 = Integer(partition_9)
int_15 = Integer(partition_8)
mindex_4 = MemberIndex(Set=int_15, Member=int_14)  # -> Index, Count
panel_34 = Panel(int_14)
viewer_8 = ParamViewer(int_14)
panel_35 = Panel(int_15)
viewer_9 = ParamViewer(int_15)
panel_36 = Panel(";")

panel_37 = Panel("""A
P
a
K
t
k
u
v""")
panel_38 = Panel("""2
3""")
panel_39 = Panel("""2
2""")
panel_40 = Panel("""1
3
5""")
panel_41 = Panel("""1
0
4""")
panel_42 = Panel("""7
2
2""")
panel_43 = Panel("""2,3,1
4,2,3
1,3,2""")
panel_44 = Panel("""3,2,2
2,3,2
4,1,3""")
panel_45 = Panel("""3
2
1""")
panel_46 = Panel("""3,2,2
1,3,4
4,1,3""")
panel_47 = Panel("""3.22133
1.3229
pi""")
panel_48 = Panel("""3.42
5.33
1.44""")
panel_49 = Panel("""3,2
1,3
0,1""")
panel_50 = Panel("""2,3
4,0
1,3""")
panel_51 = Panel("""1
3""")
panel_52 = Panel("""-1*(a*x+c)/b
c*(x-a)+b
(1-x/a)*b
a*x+b
(x-a)/(c-a)*(d-b)+b
(b-x*cos(a))/sin(a)
d*(x-a)/c+b
a*(c-x)/b+d""")
sift_4 = SiftPattern(List=int_12, SiftPattern=equals_4.Equality)  # -> Output0, Output1
multiplication_7 = Multiplication(A=unflatten_2, B=functionscount_3)
clean_4 = CleanTree(RemoveNulls=True, RemoveInvalid=True, RemoveEmpty=True, Tree=sift_4.Output1)
tstat_12 = TreeStatistics(Tree=clean_4)  # -> Paths, Length, Count
A = Number(panel_38)
B = Number(panel_39)
C = Number(panel_51)
k = Number(panel_40)
a = Number(panel_41)
b = Number(panel_42)
pt0 = Point([Point(-8, -7, 0), Point(-5, 0, 0), Point(-16, -3, 0)])
pt1 = Point([Point(-8, -10, 0), Point(3, -7, 0), Point(-4, -2, 0)])
intersection_line0_a0_b0_c0 = Vector(panel_43)
intersection_line0_a1_b1_c1 = Vector(panel_44)
intersection_m = Number(panel_45)
parallel_line_a2_b2_c2 = Vector(panel_46)
angle_3 = Number(panel_47)
distance_p = Number(panel_48)
vector_u_v = Vector(panel_49)
normal_vector_nu_nv = Vector(panel_50)
int_16 = Integer("8")
repeat_7 = RepeatData(Data=initialparasdepathlist_6, Length=graft(multiplication_7))  # -> simplify(Data)
dpath_5 = DeconstructPath(Branch=tstat_12.Paths)
pi_7 = Pi(Factor=1)
stack_12 = StackData(Data=unflatten_2, Stack=functionscount_3)
panel_53 = Panel("""{A,B,C}
{k,-1,y0-k*x0}
{b,a,-a*b}
{k,-1,b}
{x0-x1,y1-y0,x0*x1-y0*y1-x0*x0+y0*y0}
{cos(angle),sin(angle),-p}
{v,-u,-v*x0+u*y0}
{nu,nv,-nu*x0-nv*y0}""")
complex = ComplexComponents(Complex=pt0)  # -> Real, Imaginary
complex_2 = ComplexComponents(Complex=pt1)  # -> Real, Imaginary
item_14 = ListItem(List=dpath_5, Index=0, Wrap=True)

# ----
# path{x;y}
# x         --> line index
# y         --> function index
# value  -->  parameters index
# each line choose first function
flatten_20 = FlattenTree(Tree=item_14, Path="{0}")
path_8 = DataPath(tstat_12.Paths)
dcon = DeleteConsecutive(Set=flatten_20, Wrap=False)  # -> Set, Count
mindex_5 = MemberIndex(Set=flatten_20, Member=dcon.Set)  # -> Index, Count
item_15 = ListItem(List=mindex_5.Index, Index=0, Wrap=True)
item_16 = ListItem(List=path_8, Index=item_15, Wrap=True)
flatten_21 = FlattenTree(Tree=item_16, Path="{0}")
branch_3 = TreeBranch(Tree=clean_4, Path=flatten_21, MaintainPaths=True)
int_17 = Integer(branch_3)

division_3 = Division(A=angle_3, B=pi_7)
int_18 = Integer(division_3)
partition_10 = PartitionList(List=repeat_7, Size=stack_12)  # -> simplify(Chunks)
complex_3 = ComplexComponents(Complex=vector_u_v)  # -> Real, Imaginary
x0 = Number(complex.Real)
y0 = Number(complex.Imaginary)
x1 = Number(complex_2.Real)
y1 = Number(complex_2.Imaginary)
subtraction_2 = Subtraction(A=division_3, B=int_18)
equals_5 = Equality(FirstNumber=A, SecondNumber="0")  # -> Equality, Inequality
equals_6 = Equality(FirstNumber=B, SecondNumber="0")  # -> Equality, Inequality
abs = Absolute(Value=subtraction_2)
viewer_10 = ParamViewer(partition_8)
viewer_11 = ParamViewer(partition_10)
merge_7 = Merge(Data1=graft(A), Data2=graft(B), Data3=graft(C))
panel_54 = Panel(int_11)
equals_7 = Equality(FirstNumber=a, SecondNumber="0")  # -> Equality, Inequality
equals_8 = Equality(FirstNumber=b, SecondNumber="0")  # -> Equality, Inequality
pdecon = Deconstruct(Point=intersection_line0_a0_b0_c0)  # -> XComponent, YComponent, ZComponent
pdecon_2 = Deconstruct(Point=intersection_line0_a1_b1_c1)  # -> XComponent, YComponent, ZComponent
complex_4 = ComplexComponents(Complex=normal_vector_nu_nv)  # -> Real, Imaginary
and_3 = GateAnd(A=graft(equals_5.Inequality), B=graft(equals_6.Inequality))
equals_9 = Equality(FirstNumber=complex_3.Real, SecondNumber="0")  # -> Equality, Inequality
equals_10 = Equality(FirstNumber=complex_3.Imaginary, SecondNumber="0")  # -> Equality, Inequality
larger_3 = LargerThan(FirstNumber=abs, SecondNumber="0.000001")  # -> LargerThan, OrEqualTo
replace_6 = ReplacePaths(Data=partition_8, Search=viewer_10, Replace=viewer_11)
int_19 = Integer(partition_10)
and_4 = GateAnd(A=equals_7.Inequality, B=equals_8.Inequality)
equals_11 = Equality(FirstNumber=complex_4.Real, SecondNumber="0")  # -> Equality, Inequality
equals_12 = Equality(FirstNumber=complex_4.Imaginary, SecondNumber="0")  # -> Equality, Inequality
and_5 = GateAnd(A=equals_9.Inequality, B=equals_10.Inequality)
pdecon_3 = Deconstruct(Point=parallel_line_a2_b2_c2)  # -> XComponent, YComponent, ZComponent
sift_5 = SiftPattern(List=merge_7, SiftPattern=and_3)  # -> Output0, Output1

# ----
# path{x;y}表示，索引为x的线可以匹配索引为y算法。
# 如果是相同x下有多个，说明算法上有多个选择
# 求和或者求积
int_20 = Integer(replace_6)
mindex_6 = MemberIndex(Set=int_20, Member=int_19)  # -> Index, Count
lng_8 = ListLength(List=int_20)
ma_3 = MassAddition(Input=mindex_6.Count)  # -> Result, PartialResults
equals_13 = Equality(FirstNumber=lng_8, SecondNumber=ma_3.Result)  # -> Equality, Inequality
sift_6 = SiftPattern(List=int_20, SiftPattern=equals_13.Equality)  # -> Output0, Output1
clean_5 = CleanTree(RemoveNulls=True, RemoveInvalid=True, RemoveEmpty=True, Tree=sift_6.Output1)

sift_7 = SiftPattern(List=angle_3, SiftPattern=larger_3.LargerThan)  # -> Output0, Output1
sift_8 = SiftPattern(List=distance_p, SiftPattern=larger_3.LargerThan)  # -> Output0, Output1
and_6 = GateAnd(A=equals_11.Inequality, B=equals_12.Inequality)
sift_9 = SiftPattern(List=complex_4.Imaginary, SiftPattern=and_6)  # -> Output0, Output1
sift_10 = SiftPattern(List=complex_4.Real, SiftPattern=and_6)  # -> Output0, Output1
sift_11 = SiftPattern(List=complex_3.Imaginary, SiftPattern=and_5)  # -> Output0, Output1
sift_12 = SiftPattern(List=complex_3.Real, SiftPattern=and_5)  # -> Output0, Output1
tstat_13 = TreeStatistics(Tree=int_11)  # -> Paths, Length, Count
dpath_6 = DeconstructPath(Branch=tstat_13.Paths)
sift_13 = SiftPattern(List=a, SiftPattern=and_4)  # -> Output0, Output1
sift_14 = SiftPattern(List=b, SiftPattern=and_4)  # -> Output0, Output1
functionsmatchparascounts_4 = Integer(functionsmatchparascounts)
item_17 = ListItem(List=sift_5.Output1, Index=0, Wrap=True)  # -> Item, Item1, Item2
data_4 = Data(data_2)

tstat_14 = TreeStatistics(Tree=int_17)  # -> Paths, Length, Count
dpath_7 = DeconstructPath(Branch=tstat_14.Paths)
data_5 = Data(data)
functionsmatchparascounts_5 = Integer(functionsmatchparascounts_2)
viewer_12 = ParamViewer(dpath_7)
replace_7 = ReplacePaths(Data=dpath_7, Search=viewer_12, Replace=tstat_14.Paths)
item_18 = ListItem(List=replace_7, Index=0, Wrap=True)  # -> Item, Item1
item_19 = ListItem(List=functionsmatchparascounts_5, Index=item_18.Item1, Wrap=False)
stack_13 = StackData(Data=item_18.Item, Stack=item_19)
stack_14 = StackData(Data=item_18.Item1, Stack=item_19)
graft_23 = GraftTree(Tree=int_17, IncludeEmptyLists=True, IncludeNullItems=True)
graft_24 = GraftTree(Tree=stack_13, IncludeEmptyLists=True, IncludeNullItems=True)
graft_25 = GraftTree(Tree=stack_14, IncludeEmptyLists=True, IncludeNullItems=True)
merge_8 = Merge(Data1=graft_24, Data3=graft_23)
ins_7 = InsertItems(List=merge_8, Item="0", Indices="1", Wrap=True)  # -> simplify(List)
path_9 = ConstructPath(Indices=ins_7)
branch_4 = TreeBranch(Tree=data_5, Path=path_9, MaintainPaths=True)

panel_55 = Panel("""A
P
a
K
t
k
u
v""")
functionindex = Integer(item_18.Item1)
txt_6 = Text(panel_55)
item_20 = ListItem(List=txt_6, Index=functionindex, Wrap=True)
pshift_6 = ShiftPaths(Data=branch_4, Offset="-2")
pshift_7 = ShiftPaths(Data=item_20, Offset="-1")
join = TextJoin(Text=pshift_6, Join=pshift_7)
graft_26 = GraftTree(Tree=txt_6, IncludeEmptyLists=True, IncludeNullItems=True)
flatten_22 = FlattenTree(Tree=join, Path="{0}")
split_18 = TextSplit(Text=flatten_22, Separators=graft_26)
pshift_8 = ShiftPaths(Data=split_18, Offset="1")
lng_9 = ListLength(List=pshift_8)
int_21 = Integer("1")
flatten_23 = FlattenTree(Tree=lng_9, Path="{0}")
replace_8 = ReplaceMembers(Set=lng_9, Find=int_21)
sort_3 = SortList(Keys=flatten_23)  # -> Keys, ValuesA
clean_6 = CleanTree(RemoveNulls=True, RemoveInvalid=True, RemoveEmpty=True, Tree=replace_8)
item_21 = ListItem(List=sort_3.Keys, Index="-1", Wrap=True)
viewer_13 = ParamViewer(clean_6)
series_4 = Series(Start=0, Step=1, Count=item_21)
branch_5 = TreeBranch(Tree=pshift_8, Path=viewer_13, MaintainPaths=True)
int_22 = Integer(series_4)
dpath_8 = DeconstructPath(Branch=viewer_13)
item_22 = ListItem(List=branch_5, Index=int_22, Wrap=False)
pshift_9 = ShiftPaths(Data=dpath_8, Offset="1")
panel_56 = Panel("""{A,B,C}
{k,-1,y0-k*x0}
{b,a,-a*b}
{k,-1,b}
{x0-x1,y1-y0,x0*x1-y0*y1-x0*x0+y0*y0}
{cos(angle),sin(angle),-p}
{v,-u,-v*x0+u*y0}
{nu,nv,-nu*x0-nv*y0}""")
flip = FlipMatrix(Data=item_22)
item_23 = ListItem(List=pshift_9, Index=0, Wrap=True)  # -> Item, Item1
pshift_10 = ShiftPaths(Data=flip, Offset="1")
num_6 = Number("1000")
bang = ExplodeTree(Data=pshift_10)  # -> graft(Branch0), graft(Branch1), graft(Branch2)
txt_7 = Text(panel_56)
item_24 = ListItem(List=txt_7, Index=item_23.Item1, Wrap=True)
eval_2 = Evaluate(F=item_24, x=num_6, a=bang.Branch0, b=bang.Branch1, c=bang.Branch2)

viewer_14 = ParamViewer(dpath_6)
eval_3 = Evaluate(F="{cos(angle),sin(angle),-p}", angle=sift_7.Output1, p=sift_8.Output1)
eval_4 = Evaluate(
    F="{m*A0+A1,m*B0+B1,m*C0+C1}",
    A0=pdecon.XComponent,
    B0=pdecon.YComponent,
    C0=pdecon.ZComponent,
    A1=pdecon_2.XComponent,
    B1=pdecon_2.YComponent,
    C1=pdecon_2.ZComponent,
    m=intersection_m)
eval_5 = Evaluate(F="{A2,B2,-A2*x0-B2*y0}", A2=pdecon_3.XComponent, B2=pdecon_3.YComponent, C2=pdecon_3.ZComponent, x0=x0, y0=y0)
eval_6 = Evaluate(F="{nu,nv,-nu*x0-nv*y0}", x0=x0, y0=y0, nu=sift_10.Output1, nv=sift_9.Output1)
eval_7 = Evaluate(F="{k,-1,y0-k*x0}", k=k, x0=x0, y0=y0)
eval_8 = Evaluate(F="{x0-x1,y1-y0,x0*x1-y0*y1-x0*x0+y0*y0}", x0=x0, y0=y0, x1=x1, y1=y1)
eval_9 = Evaluate(F="{v,-u,-v*x0+u*y0}", x0=x0, y0=y0, u=sift_12.Output1, v=sift_11.Output1)
eval_10 = Evaluate(F="{A,B,C}", A=item_17.Item, B=item_17.Item1, C=item_17.Item2)
eval_11 = Evaluate(F="{b,a,-a*b}", a=sift_13.Output1, b=sift_14.Output1)
eval_12 = Evaluate(F="{k,-1,b}", k=k, b=b)
replace_9 = ReplacePaths(Data=dpath_6, Search=viewer_14, Replace=tstat_13.Paths)
item_25 = ListItem(List=replace_9, Index=0, Wrap=True)  # -> Item, Item1
panel_57 = Panel(eval_10)
panel_58 = Panel(eval_7)
panel_59 = Panel(eval_11)
panel_60 = Panel(eval_12)
panel_61 = Panel(eval_8)
panel_62 = Panel(eval_4)
panel_63 = Panel(eval_5)
panel_64 = Panel(eval_3)
panel_65 = Panel(eval_9)
panel_66 = Panel(eval_6)
item_26 = ListItem(List=functionsmatchparascounts_4, Index=item_25.Item1, Wrap=False)
functionindex_2 = Integer(item_25.Item1)
lineindex = Integer(item_25.Item)
graft_27 = GraftTree(Tree=int_11, IncludeEmptyLists=True, IncludeNullItems=True)
stack_15 = StackData(Data=lineindex, Stack=item_26)
stack_16 = StackData(Data=functionindex_2, Stack=item_26)
parametersindex_tree = Integer(graft_27)
graft_28 = GraftTree(Tree=stack_15, IncludeEmptyLists=True, IncludeNullItems=True)
graft_29 = GraftTree(Tree=stack_16, IncludeEmptyLists=True, IncludeNullItems=True)
functionindex_tree = Integer(graft_29)
merge_9 = Merge(Data1=graft_28, Data3=parametersindex_tree)
ins_8 = InsertItems(List=merge_9, Item="0", Indices="1", Wrap=True)  # -> simplify(List)
merge_10 = Merge(Data1=ins_8, Data2=graft_29)
path_10 = ConstructPath(Indices=merge_10)
path_11 = ConstructPath(Indices=ins_8)
branch_6 = TreeBranch(Tree=data_4, Path=path_11, MaintainPaths=True)
panel_67 = Panel("""0
0.4
1
1.5
1.5
1.92
2
2.05
2.1
2.4
2.3
2.3
2.1
3
3.12
3.11
3.12""")
flatten_24 = FlattenTree(Tree=path_10, Path="{0}")
flatten_25 = FlattenTree(Tree=path_11, Path="{0}")
num_7 = Number(branch_6)

panel_68 = Panel("""A
P
a
K
t
k
u
v""")
functionindex_3 = Integer(functionindex_2)
txt_8 = Text(panel_68)
num_8 = Number(num_7)
item_27 = ListItem(List=txt_8, Index=functionindex_3, Wrap=True)
pshift_11 = ShiftPaths(Data=num_8, Offset="-2")
pshift_12 = ShiftPaths(Data=item_27, Offset="-1")
join_2 = TextJoin(Text=pshift_11, Join=pshift_12)
split_19 = TextSplit(Text=join_2, Separators=txt_8)
lng_10 = ListLength(List=split_19)
int_23 = Integer("1")
replace_10 = ReplaceMembers(Set=lng_10, Find=int_23)
clean_7 = CleanTree(RemoveNulls=True, RemoveInvalid=True, RemoveEmpty=True, Tree=replace_10)
viewer_15 = ParamViewer(clean_7)
branch_7 = TreeBranch(Tree=split_19, Path=viewer_15, MaintainPaths=True)
dpath_9 = DeconstructPath(Branch=viewer_15)
panel_69 = Panel("""-1*(a*x+c)/b
a*(x-b)+c
(1-x/a)*b
a*x+b
(x-a)/(c-a)*(d-b)+b
(b-x*cos(a))/sin(a)
d*(x-a)/c+b
-c*(x-a)/d+b""")
panel_70 = Panel("""0
1
2
3""")
pshift_13 = ShiftPaths(Data=branch_7, Offset=-1)
pshift_14 = ShiftPaths(Data=dpath_9, Offset="1")
int_24 = Integer(panel_70)
item_28 = ListItem(List=pshift_14, Index=0, Wrap=True)  # -> Item, Item1
item_29 = ListItem(List=pshift_13, Index=int_24, Wrap=False)
txt_9 = Text(panel_69)
flip_2 = FlipMatrix(Data=item_29)
path_12 = ConstructPath(Indices=item_28.Item)
item_30 = ListItem(List=txt_9, Index=item_28.Item1, Wrap=True)
flatten_26 = FlattenTree(Tree=path_12, Path="{0}")
num_9 = Number("1000")
bang_2 = ExplodeTree(Data=flip_2)  # -> graft(Branch0), graft(Branch1), graft(Branch2), graft(Branch3)
viewer_16 = ParamViewer(item_30)
replace_11 = ReplacePaths(Data=item_30, Search=viewer_16, Replace=flatten_26)
eval_13 = Evaluate(F=replace_11, x=num_9, a=bang_2.Branch0, b=bang_2.Branch1, c=bang_2.Branch2, d=bang_2.Branch3)
unflatten_3 = UnflattenTree(Tree=eval_13, Guide=replace_11)

panel_71 = Panel("""0
1
2
3
2
2
3
1
2
1
0
0
2
0
1
3""")
panel_72 = Panel("""0
1
2
1.3
3
2.3
2""")
line = Line(Line((119.3393443, -60.78584412, 0), (119.6525493, -60.78584412, 0)))
panel_73 = Panel("""0
1
0
1.3
3
1
2.3
2""")
line_2 = Line(Line((119.8096632, -60.78584412, 0), (119.4931182, -60.78584412, 0)))
panel_74 = Panel("运算器存在bug")
replace_12 = ReplacePaths(Data=num_7, Search=flatten_25, Replace=flatten_24)
functionsmatchparascounts_6 = Integer(functionsmatchparascounts_3)
ccx = CurveCurve(CurveA=line, CurveB=line_2)  # -> Points, ParamsA, ParamsB
sift_15 = SiftPattern(List=branch_4, SiftPattern=graft_25)  # -> Output0, Output1, Output2, Output3, Output4, Output5, Output6, Output7, Output8, Output9

# ----
# mapping between angle and path
# {0;0} --> 0
# {1;0} --> 1/2*pi
# {2;0} --> pi
# {3;0} --> 3/2*pi
# 无所谓正交向量存不存在
jitter_2 = Jitter(List=panel_72, Jitter=1, Seed=2)  # -> Values, Indices
pi_8 = Pi(Factor=1)
pi_9 = Pi(Factor="2")
division_4 = Division(A=pi_8, B="2")
num_10 = Number(jitter_2.Values)
# log:
# 20161011
# 增强path的排序的算法前馈，可通过path运算直接得到向量关系:
# 排序前后问题：
# 先精确控制还是先离散问题
remap_3 = RemapNumbers(Value=num_10, Source="4", Target=pi_9)  # -> Mapped, Clipped
series_5 = Series(Start=0, Step=division_4, Count="5")
consec_3 = ConsecutiveDomains(Numbers=series_5, Additive=False)  # -> simplify(Domains)
angle_4 = Number(remap_3.Mapped)
domain_3 = Domain(graft(consec_3))
dedomain_3 = DeconstructDomain(Domain=domain_3)  # -> simplify(Start), simplify(End)
# log:
# 20161012
# debug时候replacePath爆红:
# 删除空的树形数据结构，merge的时候数据结构对应
# 精度问题导致set不能去掉原本偏差相同的角度：
# 用round函数取到小数点后几位，关键是排序，这样做就不会对原来的数据产生什么影响，是标签改对了
larger_4 = LargerThan(FirstNumber=angle_4, SecondNumber=dedomain_3.Start)  # -> LargerThan, OrEqualTo
smaller_3 = SmallerThan(FirstNumber=angle_4, SecondNumber=dedomain_3.End)  # -> SmallerThan, OrEqualTo
and_7 = GateAnd(A=larger_4.OrEqualTo, B=smaller_3.SmallerThan)
sift_16 = SiftPattern(List=angle_4, SiftPattern=and_7)  # -> Output0, Output1
clean_8 = CleanTree(RemoveNulls=True, RemoveInvalid=False, RemoveEmpty=True, Tree=sift_16.Output1)  # -> simplify(Tree)
tstat_15 = TreeStatistics(Tree=clean_8)  # -> Paths, Length, Count
branch_8 = TreeBranch(Tree=dedomain_3.Start, Path=tstat_15.Paths, MaintainPaths=True)
subtraction_3 = Subtraction(A=clean_8, B=branch_8)
num_11 = Number(clean_8)
eval_14 = Evaluate(F="round(x,4)", x=subtraction_3)
flatten_27 = FlattenTree(Tree=eval_14, Path="{0}")
cset_5 = CreateSet(List=flatten_27)  # -> Set, Map
sort_4 = SortList(Keys=cset_5.Set)  # -> Keys, ValuesA
mindex_7 = MemberIndex(Set=sort_4.Keys, Member=eval_14)  # -> Index, Count
pshift_15 = ShiftPaths(Data=mindex_7.Index, Offset=-1)
flatten_28 = FlattenTree(Tree=mindex_7.Index, Path="{0}")
tstat_16 = TreeStatistics(Tree=pshift_15)  # -> Paths, Length, Count
dpath_10 = DeconstructPath(Branch=tstat_16.Paths)
graft_30 = GraftTree(Tree=flatten_28, IncludeEmptyLists=True, IncludeNullItems=True)  # -> simplify(Tree)
stack_17 = StackData(Data=dpath_10, Stack=graft(tstat_16.Length))
graft_31 = GraftTree(Tree=angle_4, IncludeEmptyLists=True, IncludeNullItems=True)
flatten_29 = FlattenTree(Tree=stack_17, Path="{0}")
graft_32 = GraftTree(Tree=flatten_29, IncludeEmptyLists=True, IncludeNullItems=True)  # -> simplify(Tree)
merge_11 = Merge(Data1=graft_32, Data2=graft_30)
path_13 = ConstructPath(Indices=merge_11)
graft_33 = GraftTree(Tree=num_11, IncludeEmptyLists=True, IncludeNullItems=True)
flatten_30 = FlattenTree(Tree=path_13, Path="{0}")
flatten_31 = FlattenTree(Tree=graft_33, Path="{0}")
viewer_17 = ParamViewer(graft_33)
keysearch_3 = KeyValueSearch(Keys=flatten_31, Values=flatten_30, Search=graft_31)  # -> simplify(Result)
replace_13 = ReplacePaths(Data=graft_33, Search=viewer_17, Replace=flatten_30)
path_14 = DataPath(keysearch_3)
# log:
# 20161010
# 设计向量方向与数据结构之间的映射关系
# 数据结构用集合运算然后替换
# 替换树形结构的时候需要拍平
# 无论什么情况都留出0123正交的位置为Null
# 如果0123存在，没关系，不存在，插入一个空值
# 20161011
# 角度和path之间的映射关系，以及角度的识别:
# 分解basic line的path得到位置位置关系
# 先正交的位置关系，后自由的位置关系
# 考虑先组合line还是先分解path在配对
# 如何识别path知道非正交的相反的向量
# 增强path的排序的算法前馈，可通过path运算直接得到向量关系
# 运用path提取相应的两条交线
# 20161012
# debug时候replacePath爆红
# 精度问题导致set不能去掉原本偏差相同的角度
# 20161017
# 找到了两根交线的关系，先把他放在这，具体怎么用不继续做下去，先考虑其他的大的情况
# 20161023
# 对线的识别方法以及数据的缺省情况
# 数据分流的方法是否合适
ultimateangle_afterelection = Number(replace_13)

data_6 = Data(data_3)
clean_9 = CleanTree(RemoveNulls=True, RemoveInvalid=True, RemoveEmpty=True, Tree=sift_15.Output0)
clean_10 = CleanTree(RemoveNulls=True, RemoveInvalid=True, RemoveEmpty=True, Tree=sift_15.Output1)
clean_11 = CleanTree(RemoveNulls=True, RemoveInvalid=True, RemoveEmpty=True, Tree=sift_15.Output2)
clean_12 = CleanTree(RemoveNulls=True, RemoveInvalid=True, RemoveEmpty=True, Tree=sift_15.Output3)
clean_13 = CleanTree(RemoveNulls=True, RemoveInvalid=True, RemoveEmpty=True, Tree=sift_15.Output4)
clean_14 = CleanTree(RemoveNulls=True, RemoveInvalid=True, RemoveEmpty=True, Tree=sift_15.Output5)
clean_15 = CleanTree(RemoveNulls=True, RemoveInvalid=True, RemoveEmpty=True, Tree=sift_15.Output6)
clean_16 = CleanTree(RemoveNulls=True, RemoveInvalid=True, RemoveEmpty=True, Tree=sift_15.Output7)
clean_17 = CleanTree(RemoveNulls=True, RemoveInvalid=True, RemoveEmpty=True, Tree=sift_15.Output8)
clean_18 = CleanTree(RemoveNulls=True, RemoveInvalid=True, RemoveEmpty=True, Tree=sift_15.Output9)
line_bug_commonline = Line([Line((119.3540923, -60.56923774, 0), (119.5008735, -60.56923774, 0)), Line((119.5919791, -60.56923774, 0), (119.7404475, -60.56923774, 0))])
# debug:之前判断是实交和虚交的方法是判断交点point的x坐标是否在两线段的值域范围内，但是当上述情况的时候，直线会虚交被误判成实际交点
line_bug_insectiononextend = Line([Line((119.0174668, -60.28107794, 0), (119.4638718, -60.28107794, 0)), Line((119.2255633, -60.35451331, 0), (119.2255633, -61.15203638, 0))])
# log:
# 20161010
# 设计向量方向与数据结构之间的映射关系
# 分离对应的算法，让算法之间有通过也有分离
# 线线重合的问题解决后先放在一旁
# 数据结构的替换，在最后做
line_3 = Line([Line((119.5723897, -60.99532941, 0), (119.5723897, -61.13933165, 0)), Line((119.5723897, -60.99532941, 0), (119.7626783, -60.99532941, 0))])
panel_75 = Panel(replace_12)
data_7 = Data(data_6)
functionsmatchparascounts_7 = Integer(functionsmatchparascounts_6)
tstat_17 = TreeStatistics(Tree=clean_17)  # -> Paths, Length, Count
num_12 = Number()
panel_76 = Panel(clean_11)
panel_77 = Panel("把正交和斜交的情况分离开来，同时组织数据结构")
panel_78 = Panel("""{a,b,c}
{a,-1,c-a*b}
{b,a,-a*b}
{a,-1,b}
{a-c,d-b,a*c-b*c-a*a+b*b}
{cos(a),sin(a),-b}
{d,-c,-d*a+c*b}
{c,d,-c*a-d*b}""")
series_6 = Series(Start=0, Step=1, Count=num_12)
sift_17 = SiftPattern(List=tstat_17.Paths, SiftPattern=series_6)  # -> Output0, Output1
branch_9 = TreeBranch(Tree=clean_17, Path=sift_17.Output1, MaintainPaths=True)
branch_10 = TreeBranch(Tree=clean_17, Path=sift_17.Output0, MaintainPaths=True)
merge_12 = Merge(Data1=panel_78, Data2="{a*a,b}")
item_31 = ListItem(List=branch_10, Index=0, Wrap=False)  # -> Item, Item1
item_32 = ListItem(List=branch_9, Index=0, Wrap=False)  # -> Item, Item1
panel_79 = Panel(merge_12)
databasemapping_6 = Panel("""0,1,2;(0!=zero)and(1!=zero)
3,6,7;
4,5;(4!=zero)and(5!=zero)
3,5;
6,7,8,9;(6!=8)and(7!=9)
10,11,12,13,14,15;
6,7,17,18,19;
20,21;20=!k*pi,k=1,2,3..
22,23;(22!=zero)and(23!=zero)
24,25;(24!=zero)and(25!=zero)""")
# foolish!
# foolish!
# foolish!
tstat_18 = TreeStatistics(Tree=int_17)  # -> Paths, Length, Count

u = Number(item_32.Item)
v = Number(item_32.Item1)
y0_2 = Number(item_31.Item1)
x0_2 = Number(item_31.Item)
equals_14 = Equality(FirstNumber=u, SecondNumber="0")  # -> Equality, Inequality
equals_15 = Equality(FirstNumber=v, SecondNumber="0")  # -> Equality, Inequality
and_8 = GateAnd(A=equals_14.Inequality, B=equals_15.Inequality)
sift_18 = SiftPattern(List=v, SiftPattern=and_8)  # -> Output0, Output1
sift_19 = SiftPattern(List=u, SiftPattern=and_8)  # -> Output0, Output1
eval_15 = Evaluate(F="{v,-u,-v*x0+u*y0}", x0=x0_2, y0=y0_2, u=sift_19.Output1, v=sift_18.Output1)
panel_80 = Panel(eval_15)
path_mapper = PathMapper(eval_15, source="{A;B;C;D}", target="{A;B;0}")
panel_81 = Panel(path_mapper)

pshift_16 = ShiftPaths(Data=tstat_18.Paths, Offset=-1)
panel_82 = Panel(item_24)
dpath_11 = DeconstructPath(Branch=pshift_16)
path_15 = DataPath(flatten_21)
viewer_18 = ParamViewer(dpath_11)
replace_14 = ReplacePaths(Data=dpath_11, Search=viewer_18, Replace=path_15)
item_33 = ListItem(List=replace_14, Index=0, Wrap=True)  # -> Item, Item1
panel_83 = Panel(item_28.Item1)
merge_13 = Merge(Data1=Slider(9.8, range=0..10), Data2=Slider(5.62, range=0..10), Data3=Slider(5.73, range=0..10))  # -> graft(Result)
merge_14 = Merge(Data1=Slider(0, range=0..10), Data2=Slider(0, range=0..10), Data3=Slider(1.44, range=0..10))  # -> graft(Result)
panel_84 = Panel(replace_14)
complex_5 = CreateComplex(Real=num_9, Imaginary=unflatten_3)
txt_10 = Text(txt_5)
# function called times
pt = Point(complex_5)
int_25 = Integer(item_33.Item)
int_26 = Integer(item_33.Item1)

# ----
# {a;b;c;d;e}
# a --> line index
# b --> line type
# c --> line parameter index
# d --> line function mapping
lng_11 = ListLength(List=int_17)
flatten_32 = FlattenTree(Tree=item.Item1, Path="{0}")
stack_18 = StackData(Data=int_25, Stack=lng_11)
item_34 = ListItem(List=flatten_32, Index=stack_18, Wrap=True)
stack_19 = StackData(Data=int_26, Stack=lng_11)
graft_34 = GraftTree(Tree=int_17, IncludeEmptyLists=True, IncludeNullItems=True)
graft_35 = GraftTree(Tree=stack_18, IncludeEmptyLists=True, IncludeNullItems=True)
graft_36 = GraftTree(Tree=item_34, IncludeEmptyLists=True, IncludeNullItems=True)
graft_37 = GraftTree(Tree=stack_19, IncludeEmptyLists=True, IncludeNullItems=True)
merge_15 = Merge(Data1=graft_35, Data2=graft_36, Data3=graft_34)
merge_16 = Merge(Data1=graft_35, Data2=graft_36, Data3=graft_34, Data4=graft_37)
path_16 = ConstructPath(Indices=merge_15)
path_17 = ConstructPath(Indices=merge_16)
data_8 = Data(data)
flatten_33 = FlattenTree(Tree=path_16, Path="{0}")
flatten_34 = FlattenTree(Tree=path_17, Path="{0}")
branch_11 = TreeBranch(Tree=data_8, Path=flatten_33, MaintainPaths=True)
viewer_19 = ParamViewer(branch_11)
replace_15 = ReplacePaths(Data=branch_11, Search=viewer_19, Replace=flatten_34)

# ----
# default x0,x1
panel_85 = Panel("8")
# default x0,x1
panel_86 = Panel("3")
# default y0,y1
panel_87 = Panel("3")
dom = ConstructDomain(DomainStart="3", DomainEnd="-1")
panel_88 = Panel(dom)

# ---- group: 得到ABC系数的函数
panel_89 = Panel("""{a,b,c}
{a,-1,c-a*b}
{b,a,-a*b}
{a,-1,b}
{a-c,d-b,a*c-b*c-a*a+b*b}
{cos(a),sin(a),-b}
{d,-c,-d*a+c*b}
{c,d,-c*a-d*b}""")
merge_17 = Merge(Data1=panel_89, Data2="{a*a,b}")

# ----
int_27 = Integer(tstat_9.Length)
int_28 = Integer("0")
num_13 = Number("-3")
int_29 = Integer("0")
num_14 = Number("3")
panel_90 = Panel(merge_17)
int_30 = Integer("0")
int_31 = Integer("0")
num_15 = Number("-3")
num_16 = Number("-3")
int_32 = Integer("0")
int_33 = Integer("0")
num_17 = Number("3")
num_18 = Number("3")
panel_91 = Panel("""(-A*x-C)/B
-C/A
-C/B""")
panel_92 = Panel(replace_15)
txt_11 = Text(panel_91)
item_35 = ListItem(List=txt_11, Index=0, Wrap=True)  # -> Item, Item1, Item2

# ----
# 00 common parallel
# 10 vectical
# 20 reverse parallel
# 30 vectical
path_18 = DataPath(path_14)
flatten_35 = FlattenTree(Tree=path_18, Path="{0}")
tstat_19 = TreeStatistics(Tree=path_18)  # -> Paths, Length, Count
tstat_20 = TreeStatistics(Tree=path_18)  # -> Paths, Length, Count
ma_4 = MassAddition(Input=tstat_19.Length)  # -> Result, PartialResults
series_7 = Series(Start=0, Step=1, Count=tstat_20.Count)
stack_20 = StackData(Data=ma_4.PartialResults, Stack=tstat_19.Length)
shift = ShiftList(List=series_7, Shift=stack_20, Wrap=False)
item_36 = ListItem(List=flatten_35, Index=shift, Wrap=True)  # -> simplify(Item)
lng_12 = ListLength(List=item_36)
# log:
# 20161011
# 如何识别path知道非正交的相反的向量
# 增强path的排序的算法前馈，可通过path运算直接得到向量关系
# 运用path提取相应的两条交线；
# 索引交线，并保留原有树形结构
stack_21 = StackData(Data=path_18, Stack=lng_12)
secondpath = DataPath(item_36)
firstpath = DataPath(stack_21)
dpath_12 = DeconstructPath(Branch=firstpath)
dpath_13 = DeconstructPath(Branch=secondpath)
subtraction_4 = Subtraction(A=dpath_12, B=dpath_13)
abs_2 = Absolute(Value=subtraction_4)
item_37 = ListItem(List=abs_2, Index=0, Wrap=True)  # -> Item, Item1
panel_93 = Panel("""00
10
20
30""")
ultimateangle_afterelection_2 = Number(ultimateangle_afterelection)
concat = Concatenate(FragmentA=item_37.Item, FragmentB=item_37.Item1)
mindex_8 = MemberIndex(Set=panel_93, Member=concat)  # -> simplify(Index), Count
graft_38 = GraftTree(Tree=secondpath, IncludeEmptyLists=True, IncludeNullItems=True)
graft_39 = GraftTree(Tree=firstpath, IncludeEmptyLists=True, IncludeNullItems=True)

eval_16 = Evaluate(F="(a,b,c,d)", a="5", b="5", c="5", d="5")
panel_94 = Panel(mindex_8.Index)
panel_95 = Panel("描述方法只是数据结构的不同，先用几何代表抽象的数据结构")
panel_96 = Panel("""x0,y0;0,1,2,3
x1,y0;0,3,2""")
panel_97 = Panel("""多条线且含有多折线连线组织数据结构问题
得到交点
交点的path替换""")
crv = Curve([<curve referenced from the Rhino model> x3])
crv_2 = Curve([<curve referenced from the Rhino model> x3])
explode = Explode(Curve=crv_2, Recursive=True)  # -> Segments, Vertices
end = EndPoints(Curve=crv_2)  # -> Start, End
neg_4 = Negative(Value="1")
shift_2 = ShiftList(List=explode.Vertices, Shift="1", Wrap=False)
shift_3 = ShiftList(List=explode.Vertices, Shift=neg_4, Wrap=False)

panel_98 = Panel("""1,0
0,1
-1,0
0,-1""")
vec = Vector(panel_98)

# ----
# describe space by (point;index) of vector
md_slider = MDSlider(
    slider_value=Point(0.3873214722, 0.4691162109, 0.5),
    SliderMode=0,
    x_domain=Domain(-1000, 1000),
    y_domain=Domain(-1000, 1000),
    z_domain=Domain(0, 1))
panel_99 = Panel("""0
1
2
3""")
line_length = Panel("""3.2
5.1
3.2
5.1""")
line_length_2 = Number(line_length)
int_34 = Integer(panel_99)
lng_13 = ListLength(List=int_34)
series_8 = Series(Start=0, Step=1, Count=lng_13)
item_38 = ListItem(List=vec, Index=int_34, Wrap=True)
item_39 = ListItem(List=line_length_2, Index=series_8, Wrap=True)
basicvectorunit = Vector(item_38)
amp = Amplitude(Vector=basicvectorunit, Amplitude=item_39)
ma_5 = MassAddition(Input=amp)  # -> Result, PartialResults
addition_2 = Addition(A=md_slider, B=ma_5.PartialResults)
pt_2 = Point(addition_2)
shift_4 = ShiftList(List=ma_5.PartialResults, Shift=-1, Wrap=True)
complex_6 = ComplexComponents(Complex=shift_4)  # -> Real, Imaginary
concat_2 = Concatenate(FragmentA=complex_6.Real, FragmentB=complex_6.Imaginary, JoinSeparator=",")
pline = PolyLine(Vertices=pt_2, Closed=True)
concat_3 = Concatenate(FragmentA=concat_2, FragmentB=int_34, JoinSeparator=";")

subtraction_5 = Subtraction(A=shift_2, B=shift_3)

graft_40 = GraftTree(Tree=end.Start, IncludeEmptyLists=True, IncludeNullItems=True)  # -> simplify(Tree)
subtraction_6 = Subtraction(A=graft_40, B="{0,0,0}")  # -> flatten(Result)
item_40 = ListItem(List=subtraction_6, Index="0", Wrap=True)
subtraction_7 = Subtraction(A=graft_40, B=item_40)

unit = UnitVector(Vector=subtraction_5)
vec_2 = Vector(subtraction_5)
len = Length(Curve=explode.Segments)  # -> simplify(Length)
pshift_17 = ShiftPaths(Data=unit, Offset=-1)
mindex_9 = MemberIndex(Set=vec, Member=pshift_17)  # -> Index, Count
vdis = VectorDisplay(Anchor=shift_3, Vector=vec_2)
pshift_18 = ShiftPaths(Data=mindex_9.Index, Offset=-1)  # -> simplify(Data)

vecdirection = Integer(pshift_18)
veclength = Number(len)
pt_3 = Point(graft_40)

panel_100 = Panel(vec)
item_41 = ListItem(List=vec, Index=vecdirection, Wrap=True)
amp_2 = Amplitude(Vector=item_41, Amplitude=veclength)
ma_6 = MassAddition(Input=amp_2)  # -> Result, PartialResults
addition_3 = Addition(A=pt_3, B=ma_6.PartialResults)
pt_4 = Point(addition_3)
ins_9 = InsertItems(List=addition_3, Item=pt_3, Indices="0", Wrap=True)
neg_5 = Negative(Value="1")
panel_101 = Panel(pt_3)
panel_102 = Panel(concat_3)
panel_103 = Panel(amp)
shift_5 = ShiftList(List=ins_9, Shift=neg_5, Wrap=False)  # -> simplify(List)

# ----
# tree data trial
# first point 和 end point 的数据结构组织的方式是同一种的
# 
# 先手工傻做，再寻找规律
# 
# 先不管结构如何，把他们放在一起，结构在外部运算，在替换成对的树形数据
# 上升数据结构后手工或者数列
# 上升后全部拍平处理
# 用stack+listItem对拍平的数据处理
# 
# 留下来的问题是数据结构的替换
# 手工
pt_5 = Point(shift_5)
graft_41 = GraftTree(Tree=pt_5, IncludeEmptyLists=True, IncludeNullItems=True)

flatten_36 = FlattenTree(Tree=graft_41, Path="{0}")
tstat_21 = TreeStatistics(Tree=pt_5)  # -> Paths, Length, Count
tstat_22 = TreeStatistics(Tree=graft_41)  # -> Paths, Length, Count
ma_7 = MassAddition(Input=tstat_21.Length)  # -> Result, PartialResults
series_9 = Series(Start=0, Step=1, Count=tstat_22.Count)
stack_22 = StackData(Data=ma_7.PartialResults, Stack=tstat_21.Length)
shift_6 = ShiftList(List=series_9, Shift=stack_22, Wrap=False)
item_42 = ListItem(List=flatten_36, Index=shift_6, Wrap=True)  # -> simplify(Item)

lng_14 = ListLength(List=item_42)

bang_3 = ExplodeTree(Data=graft_41)  # -> Branch0, Branch1, Branch2, Branch3, Branch4, Branch5
merge_18 = Merge(Data1=bang_3.Branch1, Data2=bang_3.Branch2, Data3=bang_3.Branch3, Data4=bang_3.Branch4, Data5=bang_3.Branch5)
entwine_2 = Entwine(
    Branch00=merge_18,
    Branch01=bang_3.Branch5,
    Branch02=bang_3.Branch5,
    Branch03=bang_3.Branch5,
    Branch04=bang_3.Branch5,
    FlattenInputs=True)

stack_23 = StackData(Data=graft_41, Stack=lng_14)
shift_7 = ShiftList(List=ins_9, Shift="1", Wrap=False)  # -> simplify(List)
graft_42 = GraftTree(Tree=stack_23, IncludeEmptyLists=True, IncludeNullItems=True)
graft_43 = GraftTree(Tree=shift_5, IncludeEmptyLists=True, IncludeNullItems=True)

flatten_37 = FlattenTree(Tree=graft_43, Path="{0}")
tstat_23 = TreeStatistics(Tree=shift_5)  # -> Paths, Length, Count
tstat_24 = TreeStatistics(Tree=graft_43)  # -> Paths, Length, Count
ma_8 = MassAddition(Input=tstat_23.Length)  # -> Result, PartialResults
series_10 = Series(Start=0, Step=1, Count=tstat_24.Count)
stack_24 = StackData(Data=ma_8.PartialResults, Stack=tstat_23.Length)
shift_8 = ShiftList(List=series_10, Shift=stack_24, Wrap=False)
viewer_20 = ParamViewer()
item_43 = ListItem(List=flatten_37, Index=shift_8, Wrap=True)  # -> simplify(Item)
replace_16 = ReplacePaths(Data=item_43, Search=viewer_20)

graft_44 = GraftTree(Tree=shift_7, IncludeEmptyLists=True, IncludeNullItems=True)

# ----
# kernel tree data
flatten_38 = FlattenTree(Tree=graft_44, Path="{0}")
tstat_25 = TreeStatistics(Tree=shift_7)  # -> Paths, Length, Count
tstat_26 = TreeStatistics(Tree=graft_44)  # -> Paths, Length, Count
ma_9 = MassAddition(Input=tstat_25.Length)  # -> Result, PartialResults
series_11 = Series(Start=0, Step=1, Count=tstat_26.Count)
stack_25 = StackData(Data=ma_9.PartialResults, Stack=tstat_25.Length)
shift_9 = ShiftList(List=series_11, Shift=stack_25, Wrap=False)
item_44 = ListItem(List=flatten_38, Index=shift_9, Wrap=True)  # -> simplify(Item)
viewer_21 = ParamViewer()
replace_17 = ReplacePaths(Data=item_44, Search=viewer_21)

addition_4 = Addition(A=pt_3)

viewer_22 = ParamViewer()
replace_18 = ReplacePaths(Data=item_42, Search=viewer_22)

firstpt_line0 = Point(graft_43)
firstpt_line1 = Point(item_43)
endpt_line0 = Point(graft_44)
endpt_line1 = Point(item_44)

graft_45 = GraftTree(Tree=item_42, IncludeEmptyLists=True, IncludeNullItems=True)

tstat_27 = TreeStatistics(Tree=clean_5)  # -> Paths, Length, Count
item_45 = ListItem(List=clean_5, Index=0, Wrap=True)
unflatten_4 = UnflattenTree(Tree=tstat_27.Paths, Guide=item_45)
dpath_14 = DeconstructPath(Branch=unflatten_4)  # -> simplify(Indices)
item_46 = ListItem(List=dpath_14, Index="0", Wrap=True)  # -> Item, Item1, Item2
pshift_19 = ShiftPaths(Data=item_46.Item, Offset=-1)
pshift_20 = ShiftPaths(Data=item_46.Item2, Offset=-1)
pshift_21 = ShiftPaths(Data=item_46.Item1, Offset=-1)

# ----
# 可能会出现跳级的情况
pshift_22 = ShiftPaths(Data=unflatten_4, Offset=-1)
path_19 = DataPath(pshift_22)
dcon_2 = DeleteConsecutive(Set=pshift_21, Wrap=False)  # -> Set, Count
item_47 = ListItem(List=path_19, Index=dcon_2.Set, Wrap=True)

panel_104 = Panel(item_46.Item)

flatten_39 = FlattenTree(Tree=item_47, Path="{0}")
item_48 = ListItem(List=pshift_21, Index=dcon_2.Set, Wrap=True)
item_49 = ListItem(List=pshift_19, Index=dcon_2.Set, Wrap=True)
item_50 = ListItem(List=pshift_20, Index=dcon_2.Set, Wrap=True)
branch_12 = TreeBranch(Tree=clean_5, Path=flatten_39, MaintainPaths=True)

segmentindex = Integer(item_48)
lineindex_2 = Integer(item_49)
functionindex_4 = Integer(item_50)

# ----
# each line choose first function
parameterindex = Integer(branch_12)

panel_105 = Panel(parameterindex)

int_35 = Integer(int_16)
larger_5 = LargerThan(FirstNumber=functionindex_4, SecondNumber=int_35)  # -> LargerThan, OrEqualTo
curvetype = Integer(larger_5.OrEqualTo)

lineindex_3 = Integer(lineindex_2)
item_51 = ListItem(List=functionsmatchparascounts_7, Index=functionindex_4, Wrap=False)
parameterindex_2 = Integer(parameterindex)
stack_26 = StackData(Data=curvetype, Stack=item_51)
stack_27 = StackData(Data=lineindex_3, Stack=item_51)
stack_28 = StackData(Data=segmentindex, Stack=item_51)
graft_46 = GraftTree(Tree=stack_26, IncludeEmptyLists=True, IncludeNullItems=True)
graft_47 = GraftTree(Tree=stack_27, IncludeEmptyLists=True, IncludeNullItems=True)
graft_48 = GraftTree(Tree=stack_28, IncludeEmptyLists=True, IncludeNullItems=True)

unflatten_5 = UnflattenTree(Tree=parameterindex_2, Guide=graft_48)
parametersindex_tree_2 = Integer(unflatten_5)

merge_19 = Merge(Data1=graft_47, Data2=graft_48, Data3=graft_46, Data4=parametersindex_tree_2)
path_20 = ConstructPath(Indices=merge_19)

# ----
# path{a;b;c;d}
# a         --> line index
# b         -->segmentIndex
# c         -->curveTpye
# d         --> functionIndex
# value  -->  parameters index
branch_13 = TreeBranch(Tree=data_7, Path=path_20, MaintainPaths=True)

functionindex_5 = Integer(functionindex_4)
num_19 = Number(branch_13)
panel_107 = Panel(num_19)

functionindex_6 = Integer(functionindex_5)
txt_12 = Text(txt_10)
num_20 = Number(num_19)
item_52 = ListItem(List=txt_12, Index=functionindex_6, Wrap=True)
pshift_23 = ShiftPaths(Data=num_20, Offset="-2")
pshift_24 = ShiftPaths(Data=item_52, Offset="-1")
join_3 = TextJoin(Text=pshift_23, Join=pshift_24)
split_20 = TextSplit(Text=join_3, Separators=txt_12)
lng_15 = ListLength(List=split_20)
int_36 = Integer("1")
replace_19 = ReplaceMembers(Set=lng_15, Find=int_36)
clean_19 = CleanTree(RemoveNulls=True, RemoveInvalid=True, RemoveEmpty=True, Tree=replace_19)
flatten_40 = FlattenTree(Tree=clean_19, Path="{0}")  # -> graft(Tree)
viewer_23 = ParamViewer(clean_19)
branch_14 = TreeBranch(Tree=split_20, Path=viewer_23, MaintainPaths=True)
dpath_15 = DeconstructPath(Branch=viewer_23)
series_12 = Series(Start=0, Step=1, Count=flatten_40)  # -> simplify(Series)
panel_109 = Panel("""0
1
2
3""")
unflatten_6 = UnflattenTree(Tree=branch_14, Guide=series_12)
int_37 = Integer(panel_109)
item_53 = ListItem(List=dpath_15, Index=0, Wrap=True)  # -> Item, Item1, Item2
item_54 = ListItem(List=unflatten_6, Index=int_37, Wrap=False)
txt_13 = Text(merge_17)
flip_3 = FlipMatrix(Data=item_54)
merge_20 = Merge(Data1=item_53.Item, Data2=item_53.Item1)
item_55 = ListItem(List=txt_13, Index=item_53.Item2, Wrap=True)
num_21 = Number(flip_3)
path_21 = ConstructPath(Indices=merge_20)
bang_4 = ExplodeTree(Data=num_21)  # -> graft(Branch0), graft(Branch1), graft(Branch2), graft(Branch3)
viewer_24 = ParamViewer(item_55)
flatten_41 = FlattenTree(Tree=path_21, Path="{0}")
replace_20 = ReplacePaths(Data=item_55, Search=viewer_24, Replace=flatten_41)
eval_17 = Evaluate(F=replace_20, a=bang_4.Branch0, b=bang_4.Branch1, c=bang_4.Branch2, d=bang_4.Branch3)
unflatten_7 = UnflattenTree(Tree=eval_17, Guide=replace_20)

panel_110 = Panel(eval_17)
merge_21 = Merge(Data1=lineindex_3, Data2=segmentindex, Data3=curvetype)
merge_22 = Merge(Data1=lineindex_3, Data2=segmentindex, Data3=curvetype)
ins_10 = InsertItems(List=merge_21, Item=panel_85, Indices="3", Wrap=True)
ins_11 = InsertItems(List=merge_21, Item="6", Indices="3", Wrap=True)
ins_12 = InsertItems(List=merge_21, Item="9", Indices="3", Wrap=True)
ins_13 = InsertItems(List=merge_22, Item="8", Indices=panel_86, Wrap=True)
ins_14 = InsertItems(List=merge_21, Item="7", Indices=panel_87, Wrap=True)
ins_15 = InsertItems(List=merge_22, Item="6", Indices="3", Wrap=True)
pshift_25 = ShiftPaths(Data=ins_10, Offset="-2")
pshift_26 = ShiftPaths(Data=ins_11, Offset="-2")
pshift_27 = ShiftPaths(Data=ins_12, Offset="-2")
pshift_28 = ShiftPaths(Data=ins_13, Offset="-2")
pshift_29 = ShiftPaths(Data=ins_14, Offset="-2")
pshift_30 = ShiftPaths(Data=ins_15, Offset="-2")
path_22 = ConstructPath(Indices=pshift_25)
path_23 = ConstructPath(Indices=pshift_26)
path_24 = ConstructPath(Indices=pshift_27)
path_25 = ConstructPath(Indices=pshift_28)
path_26 = ConstructPath(Indices=pshift_29)
path_27 = ConstructPath(Indices=pshift_30)
flatten_42 = FlattenTree(Tree=path_23, Path="{0}")
flatten_43 = FlattenTree(Tree=path_22, Path="{0}")
flatten_44 = FlattenTree(Tree=path_26, Path="{0}")
flatten_45 = FlattenTree(Tree=path_27, Path="{0}")
flatten_46 = FlattenTree(Tree=path_24, Path="{0}")
flatten_47 = FlattenTree(Tree=path_25, Path="{0}")
branch_15 = TreeBranch(Tree=data_7, Path=flatten_42, MaintainPaths=True)
branch_16 = TreeBranch(Tree=data_7, Path=flatten_43, MaintainPaths=True)
branch_17 = TreeBranch(Tree=data_7, Path=flatten_44, MaintainPaths=True)
branch_18 = TreeBranch(Tree=data_7, Path=flatten_45, MaintainPaths=True)
branch_19 = TreeBranch(Tree=data_7, Path=flatten_46, MaintainPaths=True)
branch_20 = TreeBranch(Tree=data_7, Path=flatten_47, MaintainPaths=True)
lng_16 = ListLength(List=branch_15)
lng_17 = ListLength(List=branch_16)
panel_111 = Panel(branch_16)
lng_18 = ListLength(List=branch_17)
lng_19 = ListLength(List=branch_18)
lng_20 = ListLength(List=branch_19)
lng_21 = ListLength(List=branch_20)
replace_21 = ReplaceMembers(Set=lng_16, Find=int_28, Replace=num_13)
replace_22 = ReplaceMembers(Set=lng_17, Find=int_29, Replace=num_14)

# ---- group: 得到交点的函数
panel_112 = Panel("""-1*(a*x+c)/b
a*(x-b)+c
(1-x/a)*b
a*x+b
(x-a)/(c-a)*(d-b)+b
(b-x*cos(a))/sin(a)
d*(x-a)/c+b
-c*(x-a)/d+b""")
txt_14 = Text(panel_112)
txt_15 = Text("a*x*x+b")
merge_23 = Merge(Data1=txt_14, Data2=txt_15)
num_22 = Number("1000")
item_56 = ListItem(List=merge_23, Index=item_53.Item2, Wrap=True)
viewer_25 = ParamViewer(item_56)
replace_23 = ReplacePaths(Data=item_56, Search=viewer_25, Replace=flatten_41)
eval_18 = Evaluate(F=replace_23, x=num_22, a=bang_4.Branch0, b=bang_4.Branch1, c=bang_4.Branch2, d=bang_4.Branch3)

# ----
replace_24 = ReplaceMembers(Set=lng_18, Find=int_30, Replace=num_15)
replace_25 = ReplaceMembers(Set=lng_19, Find=int_31, Replace=num_16)
replace_26 = ReplaceMembers(Set=lng_20, Find=int_32, Replace=num_17)
replace_27 = ReplaceMembers(Set=lng_21, Find=int_33, Replace=num_18)
pt_6 = Point(eval_17)
pshift_31 = ShiftPaths(Data=replace_22, Offset="-2")
pshift_32 = ShiftPaths(Data=replace_21, Offset="-2")
pshift_33 = ShiftPaths(Data=replace_26, Offset="-2")
pshift_34 = ShiftPaths(Data=replace_27, Offset="-2")
pshift_35 = ShiftPaths(Data=replace_24, Offset="-2")
pshift_36 = ShiftPaths(Data=replace_25, Offset="-2")
merge_24 = Merge(Data1=pshift_32, Data2=pshift_31)
merge_25 = Merge(Data1=pshift_35, Data2=pshift_33)
merge_26 = Merge(Data1=pshift_36, Data2=pshift_34)
pt_7 = Point(eval_17)

# ----
# 00 --> nonorthogonal          -->0  -->default x0,x1 or x0,y1 or y0,x1 or y0,y1
# 01 --> orthogonal Ax+C=0  -->1 -->default y0,y1
# 10 --> orthogonal By+C=0  -->2 -->default x0,x1
# 11 --> non-exist C=0            -->3
pdecon_4 = Deconstruct(Point=pt_7)  # -> XComponent, YComponent, ZComponent
equals_16 = Equality(FirstNumber=pdecon_4.XComponent, SecondNumber="0")  # -> Equality, Inequality
equals_17 = Equality(FirstNumber=pdecon_4.YComponent, SecondNumber="0")  # -> Equality, Inequality
int_38 = Integer(equals_16.Equality)
int_39 = Integer(equals_17.Equality)
concat_4 = Concatenate(FragmentA=int_38, FragmentB=int_39)
panel_113 = Panel("""00
01
10
11""")
txt_16 = Text(panel_113)
mindex_10 = MemberIndex(Set=txt_16, Member=concat_4)  # -> Index, Count
pshift_37 = ShiftPaths(Data=mindex_10.Index, Offset=-1)
sift_20 = SiftPattern(List=pt_7, SiftPattern=pshift_37)  # -> Output0, Output1, Output2

pdecon_5 = Deconstruct(Point=sift_20.Output1)  # -> XComponent, YComponent, ZComponent
pdecon_6 = Deconstruct(Point=sift_20.Output0)  # -> XComponent, YComponent, ZComponent
pdecon_7 = Deconstruct(Point=sift_20.Output2)  # -> XComponent, YComponent, ZComponent
eval_19 = Evaluate(F=item_35.Item1, A=pdecon_5.XComponent, B=pdecon_5.YComponent, C=pdecon_5.ZComponent, x=merge_24)
eval_20 = Evaluate(F=item_35.Item, A=pdecon_6.XComponent, B=pdecon_6.YComponent, C=pdecon_6.ZComponent, x=merge_24)
complex_7 = CreateComplex(Real=merge_24, Imaginary=eval_20)
panel_114 = Panel(merge_26)
eval_21 = Evaluate(F=item_35.Item2, A=pdecon_7.XComponent, B=pdecon_7.YComponent, C=pdecon_7.ZComponent, x=merge_26)
x = Number(eval_19)
complex_8 = CreateComplex(Real=x, Imaginary=merge_25)
pt_8 = Point(complex_7)
y = Number(eval_21)
pt_9 = Point(complex_8)
item_57 = ListItem(List=pt_8, Index=0, Wrap=True)  # -> Item, Item1
complex_9 = CreateComplex(Real=merge_26, Imaginary=y)
item_58 = ListItem(List=pt_9, Index=0, Wrap=True)  # -> Item, Item1
pt_10 = Point(complex_9)
item_59 = ListItem(List=pt_10, Index=0, Wrap=True)  # -> Item, Item1
ln = Line(StartPoint=item_57.Item, EndPoint=item_57.Item1)
panel_115 = Panel(ln)
ln_2 = Line(StartPoint=item_58.Item, EndPoint=item_58.Item1)
panel_116 = Panel(eval_18)

flatten_48 = FlattenTree(Tree=pt_7, Path="{0}")
lng_22 = ListLength(List=flatten_48)
series_13 = Series(Start=0, Step=1, Count=lng_22)
shift_10 = ShiftList(List=series_13, Shift=series_13, Wrap=False)  # -> simplify(List)
int_40 = Integer(shift_10)
item_60 = ListItem(List=flatten_48, Index=int_40, Wrap=False)
pdecon_8 = Deconstruct(Point=item_60)  # -> XComponent, YComponent, ZComponent
item_61 = ListItem(List=pdecon_8.XComponent, Index=0, Wrap=True)
unflatten_8 = UnflattenTree(Tree=pt_7, Guide=item_61)
pdecon_9 = Deconstruct(Point=unflatten_8)  # -> XComponent, YComponent, ZComponent
eval_22 = Evaluate(
    F="(a*f-c*d)/(b*d-a*e)",
    a=pdecon_9.XComponent,
    b=pdecon_9.YComponent,
    c=pdecon_9.ZComponent,
    d=pdecon_8.XComponent,
    e=pdecon_8.YComponent,
    f=pdecon_8.ZComponent)
eval_23 = Evaluate(F="(-b*y-c)/a", a=pdecon_9.XComponent, b=pdecon_9.YComponent, c=pdecon_9.ZComponent, y=eval_22)
complex_10 = CreateComplex(Real=eval_23, Imaginary=eval_22)
pt_11 = Point(complex_10)

flatten_49 = FlattenTree(Tree=item_57.Item1, Path="{0}")
line_4 = Line(ln_2)
ln_3 = Line(StartPoint=item_59.Item, EndPoint=item_59.Item1)
points = PointList(Points=flatten_49, Size=Slider(0.624, range=0..10))
line_5 = Line(ln)
line_6 = Line(ln_3)
panel_117 = Panel(line_4)
panel_118 = Panel(sift_20.Output0)
panel_119 = Panel(sift_20.Output1)
panel_120 = Panel(sift_20.Output2)
# failure try
panel_122 = Panel(pt_11)
panel_123 = Panel(shift_10)
panel_124 = Panel(unflatten_8)
panel_125 = Panel(eval_23)

# ----
# explore a point position in space
line_7 = Line([Line((120.4046894, -60.83579072, 0), (120.4046894, -60.79145643, 0)), Line((120.3917346, -60.82485109, 0), (120.420811, -60.82485109, 0))])
panel_126 = Panel("""处理k不存在的情况

写成函数
把坐标在相减后就分开来算

对实交和虚交的算法 不够缜密""")
# debug:可以做，但是要改动很多，先放放，出现问题了再来
linelist = Curve(line_7)
end_2 = EndPoints(Curve=linelist)  # -> Start, End
subtraction_8 = Subtraction(A=end_2.End, B=end_2.Start)
xy = XYPlane(Origin=Point(0, 0, 0))

startpoint = Point(end_2.Start)
vec_3 = Vector(subtraction_8)

addition_5 = Addition(A=startpoint, B=vec_3)
endpoint = Point(addition_5)
lng_23 = ListLength(List=addition_5)
lng_24 = ListLength(List=startpoint)
subtraction_9 = Subtraction(A=lng_23, B="1")
subtraction_10 = Subtraction(A=lng_24, B="1")
series_14 = Series(Start=0, Step=1, Count=subtraction_10)
series_15 = Series(Start=0, Step=1, Count=subtraction_9)
addition_6 = Addition(A=series_14, B="1")
addition_7 = Addition(A=series_15, B="1")
item_62 = ListItem(List=startpoint, Index=series_14, Wrap=False)  # -> simplify(graft(Item))
item_63 = ListItem(List=addition_5, Index=series_15, Wrap=False)  # -> simplify(graft(Item))
shift_11 = ShiftList(List=addition_5, Shift=addition_7, Wrap=False)  # -> simplify(List)
shift_12 = ShiftList(List=startpoint, Shift=addition_6, Wrap=False)  # -> simplify(List)

firstpt_line0_2 = Point(item_62)
firstpt_line1_2 = Point(shift_12)
endpt1_line1 = Point(shift_11)
endpt_line0_2 = Point(item_63)

points_2 = PointList(Points=flatten(firstpt_line0_2), Size=Slider(6, range=0..100))

complex_11 = ComplexComponents(Complex=firstpt_line0_2)  # -> Real, Imaginary
complex_12 = ComplexComponents(Complex=endpt_line0_2)  # -> Real, Imaginary
complex_13 = ComplexComponents(Complex=firstpt_line1_2)  # -> Real, Imaginary
complex_14 = ComplexComponents(Complex=endpt1_line1)  # -> Real, Imaginary
subtraction_11 = Subtraction(A=complex_13.Imaginary, B=complex_14.Imaginary)
subtraction_12 = Subtraction(A=complex_13.Real, B=complex_14.Real)
subtraction_13 = Subtraction(A=complex_11.Real, B=complex_12.Real)
subtraction_14 = Subtraction(A=complex_11.Imaginary, B=complex_12.Imaginary)
division_5 = Division(A=subtraction_11, B=subtraction_12)
division_6 = Division(A=subtraction_14, B=subtraction_13)
k1 = Number(division_6)
k2 = Number(division_5)
multiplication_8 = Multiplication(A=k2, B=complex_13.Real)
subtraction_15 = Subtraction(A=complex_13.Imaginary, B=multiplication_8)
b2 = Number(subtraction_15)
subtraction_16 = Subtraction(A=k1, B=k2)

multiplication_9 = Multiplication(A=k1, B=complex_11.Real)
subtraction_17 = Subtraction(A=complex_11.Imaginary, B=multiplication_9)

equals_18 = Equality(FirstNumber=subtraction_12, SecondNumber="0")  # -> Equality, Inequality
equals_19 = Equality(FirstNumber=subtraction_13, SecondNumber="0")  # -> Equality, Inequality
sift_21 = SiftPattern(List=complex_14.Real, SiftPattern=equals_18.Equality)  # -> Output0, Output1
sift_22 = SiftPattern(List=complex_11.Real, SiftPattern=equals_19.Equality)  # -> Output0, Output1
or = GateOr(A=equals_19.Equality, B=equals_18.Equality)
combine = CombineData(Input0=sift_22.Output1, Input1=sift_21.Output1)  # -> Result, Index
sift_23 = SiftPattern(List=k2, SiftPattern=equals_18.Equality)  # -> Output0, Output1
sift_24 = SiftPattern(List=b2, SiftPattern=equals_18.Equality)  # -> Output0, Output1
sift_25 = SiftPattern(List=k1, SiftPattern=equals_19.Equality)  # -> Output0, Output1
combine_2 = CombineData(Input0=sift_25.Output0, Input1=sift_23.Output0)  # -> Result, Index
a_2 = Number(combine.Result)
k_2 = Number(combine_2.Result)
multiplication_10 = Multiplication(A=a_2, B=k_2)
intersection_x = Number(a_2)

b1 = Number(subtraction_17)
subtraction_18 = Subtraction(A=b2, B=b1)
division_7 = Division(A=subtraction_18, B=subtraction_16)
multiplication_11 = Multiplication(A=division_7, B=k2)
addition_8 = Addition(A=multiplication_11, B=b2)
sift_26 = SiftPattern(List=addition_8, SiftPattern=or)  # -> Output0, Output1

sift_27 = SiftPattern(List=b1, SiftPattern=equals_19.Equality)  # -> Output0, Output1
combine_3 = CombineData(Input0=sift_27.Output0, Input1=sift_24.Output0)  # -> Result, Index
b_2 = Number(combine_3.Result)
sift_28 = SiftPattern(List=b_2, SiftPattern=or)  # -> Output0, Output1
addition_9 = Addition(A=multiplication_10, B=sift_28.Output1)
intersection_y = Number(addition_9)

combine_4 = CombineData(Input0=sift_26.Output0, Input1=intersection_y)  # -> Result, Index
combine_5 = CombineData(Input0=division_7, Input1=intersection_x)  # -> Result, Index

panel_127 = Panel(equals_19.Equality)
intersection_x_2 = Number(combine_5.Result)
intersection_y_2 = Number(combine_4.Result)
pt_12 = PointOriented(BasePlane=xy, UComponent=intersection_x_2, VComponent=intersection_y_2, WComponent=0)

# ----
# true --> real insection
# false --> extend
# 10,11 --> real insection
# 01       --> extend one line
# 00       --> extend two lines
# true   -- > extend one line
# false -->  extend two lines
dom_2 = ConstructDomain(DomainStart=complex_11.Imaginary, DomainEnd=complex_12.Imaginary)
dom_3 = ConstructDomain(DomainStart=complex_11.Real, DomainEnd=complex_12.Real)
dom_4 = ConstructDomain(DomainStart=complex_13.Real, DomainEnd=complex_14.Real)
dom_5 = ConstructDomain(DomainStart=complex_13.Imaginary, DomainEnd=complex_14.Imaginary)
firstpty_domain = Domain(dom_2)
firstptx_domain = Domain(dom_3)
endpty_domain = Domain(dom_5)
endptx_domain = Domain(dom_4)
inc = Includes(Value=intersection_y_2, Domain=firstpty_domain)  # -> Includes, Deviation
inc_2 = Includes(Value=intersection_x_2, Domain=endptx_domain)  # -> Includes, Deviation
inc_3 = Includes(Value=intersection_y_2, Domain=endpty_domain)  # -> Includes, Deviation
inc_4 = Includes(Value=intersection_x_2, Domain=firstptx_domain)  # -> Includes, Deviation
or_2 = GateOr(A=inc_4.Includes, B=inc.Includes, C=inc_2.Includes, D=inc_3.Includes)
and_9 = GateAnd(A=inc_4.Includes, B=inc.Includes, C=inc_2.Includes, D=inc_3.Includes)
int_41 = Integer(or_2)
int_42 = Integer(and_9)
concat_5 = Concatenate(FragmentA=int_42, FragmentB=int_41)
panel_128 = Panel("""10
11
01
00""")
panel_129 = Panel("""0
0
1
2""")
keysearch_4 = KeyValueSearch(Keys=panel_128, Values=panel_129, Search=concat_5)
extendlinecount = Integer(keysearch_4)

sift_29 = SiftPattern(List=pt_12, SiftPattern=extendlinecount)  # -> Output0, Output1, Output2
intersectionontwolines = Point(sift_29.Output0)
intersectionononeline = Point(sift_29.Output1)
intersectiononextend = Point(sift_29.Output2)
panel_130 = Panel(intersectionontwolines)

firstpt0 = Point(firstpt_line0)
firstpt1 = Point(firstpt_line1)
endpt0 = Point(endpt_line0)
endpt1 = Point(endpt_line1)
points_3 = PointList(Points=flatten(firstpt0), Size=Slider(0.109, range=0..3))
complex_15 = ComplexComponents(Complex=firstpt0)  # -> Real, Imaginary
complex_16 = ComplexComponents(Complex=firstpt1)  # -> Real, Imaginary
complex_17 = ComplexComponents(Complex=endpt1)  # -> Real, Imaginary
complex_18 = ComplexComponents(Complex=endpt0)  # -> Real, Imaginary
subtraction_19 = Subtraction(A=complex_16.Imaginary, B=complex_17.Imaginary)
subtraction_20 = Subtraction(A=complex_16.Real, B=complex_17.Real)
equals_20 = Equality(FirstNumber=subtraction_20, SecondNumber="0")  # -> Equality, Inequality
sift_30 = SiftPattern(List=complex_17.Real, SiftPattern=equals_20.Equality)  # -> Output0, Output1
subtraction_21 = Subtraction(A=complex_15.Imaginary, B=complex_18.Imaginary)
subtraction_22 = Subtraction(A=complex_15.Real, B=complex_18.Real)
equals_21 = Equality(FirstNumber=subtraction_22, SecondNumber="0")  # -> Equality, Inequality
sift_31 = SiftPattern(List=complex_15.Real, SiftPattern=equals_21.Equality)  # -> Output0, Output1
or_3 = GateOr(A=equals_21.Equality, B=equals_20.Equality)
combine_6 = CombineData(Input0=sift_31.Output1, Input1=sift_30.Output1)  # -> Result, Index
division_8 = Division(A=subtraction_19, B=subtraction_20)
division_9 = Division(A=subtraction_21, B=subtraction_22)
panel_131 = Panel("""处理k不存在的情况

写成函数
把坐标在相减后就分开来算""")
k1_2 = Number(division_9)
multiplication_12 = Multiplication(A=k1_2, B=complex_15.Real)
sift_32 = SiftPattern(List=k1_2, SiftPattern=equals_21.Equality)  # -> Output0, Output1
subtraction_23 = Subtraction(A=complex_15.Imaginary, B=multiplication_12)
b1_2 = Number(subtraction_23)
sift_33 = SiftPattern(List=b1_2, SiftPattern=equals_21.Equality)  # -> Output0, Output1
k2_2 = Number(division_8)
multiplication_13 = Multiplication(A=k2_2, B=complex_16.Real)
sift_34 = SiftPattern(List=k2_2, SiftPattern=equals_20.Equality)  # -> Output0, Output1
subtraction_24 = Subtraction(A=complex_16.Imaginary, B=multiplication_13)
combine_7 = CombineData(Input0=sift_32.Output0, Input1=sift_34.Output0)  # -> Result, Index
b2_2 = Number(subtraction_24)
sift_35 = SiftPattern(List=b2_2, SiftPattern=equals_20.Equality)  # -> Output0, Output1
combine_8 = CombineData(Input0=sift_33.Output0, Input1=sift_35.Output0)  # -> Result, Index
subtraction_25 = Subtraction(A=b2_2, B=b1_2)
b_3 = Number(combine_8.Result)
a_3 = Number(combine_6.Result)
k_3 = Number(combine_7.Result)
subtraction_26 = Subtraction(A=k1_2, B=k2_2)
sift_36 = SiftPattern(List=b_3, SiftPattern=or_3)  # -> Output0, Output1
multiplication_14 = Multiplication(A=a_3, B=k_3)
division_10 = Division(A=subtraction_25, B=subtraction_26)
multiplication_15 = Multiplication(A=division_10, B=k2_2)
addition_10 = Addition(A=multiplication_15, B=b2_2)
sift_37 = SiftPattern(List=addition_10, SiftPattern=or_3)  # -> Output0, Output1
addition_11 = Addition(A=multiplication_14, B=sift_36.Output1)
intersection_x_3 = Number(a_3)
intersection_y_3 = Number(addition_11)
combine_9 = CombineData(Input0=sift_37.Output0, Input1=intersection_y_3)  # -> Result, Index
combine_10 = CombineData(Input0=division_10, Input1=intersection_x_3)  # -> Result, Index
intersection_x_4 = Number(combine_10.Result)
intersection_y_4 = Number(combine_9.Result)
xy_2 = XYPlane(Origin=Point(0, 0, 0))
pt_13 = PointOriented(BasePlane=xy_2, UComponent=intersection_x_4, VComponent=intersection_y_4, WComponent=0)

# ----
# true --> real insection
# false --> extend
# 10,11 --> real insection
# 01       --> extend one line
# 00       --> extend two lines
# true   -- > extend one line
# false -->  extend two lines
dom_6 = ConstructDomain(DomainStart=complex_15.Imaginary, DomainEnd=complex_18.Imaginary)
dom_7 = ConstructDomain(DomainStart=complex_15.Real, DomainEnd=complex_18.Real)
dom_8 = ConstructDomain(DomainStart=complex_16.Real, DomainEnd=complex_17.Real)
dom_9 = ConstructDomain(DomainStart=complex_16.Imaginary, DomainEnd=complex_17.Imaginary)
firstpty_domain_2 = Domain(dom_6)
firstptx_domain_2 = Domain(dom_7)
endpty_domain_2 = Domain(dom_9)
endptx_domain_2 = Domain(dom_8)
inc_5 = Includes(Value=intersection_y_4, Domain=firstpty_domain_2)  # -> Includes, Deviation
inc_6 = Includes(Value=intersection_x_4, Domain=endptx_domain_2)  # -> Includes, Deviation
inc_7 = Includes(Value=intersection_y_4, Domain=endpty_domain_2)  # -> Includes, Deviation
inc_8 = Includes(Value=intersection_x_4, Domain=firstptx_domain_2)  # -> Includes, Deviation
or_4 = GateOr(A=inc_8.Includes, B=inc_5.Includes, C=inc_6.Includes, D=inc_7.Includes)
and_10 = GateAnd(A=inc_8.Includes, B=inc_5.Includes, C=inc_6.Includes, D=inc_7.Includes)
int_43 = Integer(or_4)
int_44 = Integer(and_10)
concat_6 = Concatenate(FragmentA=int_44, FragmentB=int_43)
panel_132 = Panel("""10
11
01
00""")
panel_133 = Panel("""0
0
1
2""")
keysearch_5 = KeyValueSearch(Keys=panel_132, Values=panel_133, Search=concat_6)
extendlinecount_2 = Integer(keysearch_5)

sift_38 = SiftPattern(List=pt_13, SiftPattern=extendlinecount_2)  # -> Output0, Output1, Output2
intersectionontwolines_2 = Point(sift_38.Output0)
intersectionononeline_2 = Point(sift_38.Output1)
intersectiononextend_2 = Point(sift_38.Output2)

# ----
# 计算点到边界的垂直向量
# describe space by (point;index) of vector
# 问题在于，当某一path缺少时，替换的内容仍然会配对，造成数据多余错误
# 要探测出缺少的路径
# statistics-->DePath
# 最后拍平后替换路径
line_length_3 = Panel("""3.2
5.1
3.2
5.1
6.4
10.2""")
panel_134 = Panel("""0
1
0
1
2
3""")
md_slider_2 = MDSlider(
    slider_value=Point(0.4041080475, 0.4034585953, 0.5),
    SliderMode=0,
    x_domain=Domain(0, 1),
    y_domain=Domain(0, 1),
    z_domain=Domain(0, 1))
panel_135 = Panel("""0
1
2
3""")
line_length_4 = Panel("""3.2
5.1
3.2
5.1""")
panel_136 = Panel("""用字符串的方法表示还差最后一步，那么先拆开来用判断的方法做
拆开的方法很繁琐，索性还是用字符串替换的方法
检查目前的替换方法是否可以简化
并且找出到各个边的距离最近点""")
line_length_5 = Number(line_length_4)
panel_137 = Panel("""1,0
0,1
-1,0
0,-1""")
vec_4 = Vector(panel_137)
int_45 = Integer(panel_135)
lng_25 = ListLength(List=int_45)
series_16 = Series(Start=0, Step=1, Count=lng_25)
item_64 = ListItem(List=vec_4, Index=int_45, Wrap=True)
panel_138 = Panel(item_64)
item_65 = ListItem(List=line_length_5, Index=series_16, Wrap=True)
basicvectorunit_2 = Vector(item_64)
amp_3 = Amplitude(Vector=basicvectorunit_2, Amplitude=item_65)
ma_10 = MassAddition(Input=amp_3)  # -> Result, PartialResults
addition_12 = Addition(A=md_slider_2, B=ma_10.PartialResults)
shift_13 = ShiftList(List=ma_10.PartialResults, Shift=-1, Wrap=True)
complex_19 = ComplexComponents(Complex=shift_13)  # -> Real, Imaginary
concat_7 = Concatenate(FragmentA=complex_19.Real, FragmentB=complex_19.Imaginary, JoinSeparator=",")
item_66 = ListItem(List=amp_3, Index=graft(series_16), Wrap=True)
panel_139 = Panel(ma_10.PartialResults)
concat_8 = Concatenate(FragmentA=concat_7, FragmentB=int_45, JoinSeparator=";")
item_67 = ListItem(List=concat_8, Index=series_16, Wrap=True)
split_21 = TextSplit(Text=item_67, Separators=";")  # -> simplify(Result)
item_68 = ListItem(List=split_21, Index=0, Wrap=True)  # -> Item, Item1
pt_14 = Point(item_68.Item)
addition_13 = Addition(A=pt_14, B=item_66)
firstpt0_2 = Point(item_68.Item)
endpt0_2 = Point(addition_13)
panel_140 = Panel(concat_8)
complex_20 = ComplexComponents(Complex=endpt0_2)  # -> Real, Imaginary
complex_21 = ComplexComponents(Complex=firstpt0_2)  # -> Real, Imaginary
pt_15 = Point(Point(1.488717773, 12.13872048, 0))
subtraction_27 = Subtraction(A=complex_21.Imaginary, B=complex_20.Imaginary)
subtraction_28 = Subtraction(A=complex_21.Real, B=complex_20.Real)
complex_22 = ComplexComponents(Complex=pt_15)  # -> Real, Imaginary
division_11 = Division(A=subtraction_27, B=subtraction_28)
k1_3 = Number(division_11)
multiplication_16 = Multiplication(A=k1_3, B=complex_20.Real)
subtraction_29 = Subtraction(A=complex_20.Imaginary, B=multiplication_16)
b1_3 = Number(subtraction_29)
panel_141 = Panel("abs(k*x0-y0+b)/sqrt(k*k+1)")
panel_142 = Panel("(k*x0-y0+b)/sqrt(k*k+1)")
panel_143 = Panel("-(k*x0-y0+b)/sqrt(k*k+1)")

y_2 = Number(complex_22.Imaginary)
x_2 = Number(complex_22.Real)
larger_6 = LargerThan(FirstNumber=complex_21.Real, SecondNumber=x_2)  # -> LargerThan, OrEqualTo
larger_7 = LargerThan(FirstNumber=complex_21.Imaginary, SecondNumber=y_2)  # -> LargerThan, OrEqualTo
int_46 = Integer(larger_6.LargerThan)
int_47 = Integer(larger_7.LargerThan)
concat_9 = Concatenate(FragmentA=int_46, FragmentB=int_47)

# ---- group: vector match concept Error
panel_144 = Panel("""010
012
110
112""")
panel_145 = Panel("""101
103
111
113""")
panel_146 = Panel("""001
003
011
013""")
panel_147 = Panel("""000
002
100
102""")
merge_27 = Merge(Data1=panel_145, Data2=panel_144, Data3=panel_146, Data4=panel_147)
entwine_3 = Entwine(Branch00=panel_145, Branch01=panel_144, Branch02=panel_146, Branch03=panel_147, FlattenInputs=True)  # -> simplify(Result)
concat_10 = Concatenate(FragmentA=concat_9, FragmentB=item_68.Item1)
flatten_50 = FlattenTree(Tree=concat_10, Path="{0}")
mindex_11 = MemberIndex(Set=merge_27, Member=flatten_50)  # -> Index, Count
division_12 = Division(A=mindex_11.Index, B="4")
int_48 = Integer(division_12)
item_69 = ListItem(List=vec_4, Index=int_48, Wrap=True)

# ----
pt_16 = Point(ma_10.PartialResults)
pline_2 = PolyLine(Vertices=pt_16, Closed=True)

# ---- group: vector match concept Error
mindex_12 = MemberIndex(Set=entwine_3, Member=flatten_50)  # -> Index, Count
clean_20 = CleanTree(RemoveNulls=True, RemoveInvalid=True, RemoveEmpty=True, Tree=mindex_12.Index)
tstat_28 = TreeStatistics(Tree=clean_20)  # -> Paths, Length, Count
split_22 = TextSplit(Text=tstat_28.Paths, Separators=";")
item_70 = ListItem(List=split_22, Index="0", Wrap=True)
split_23 = TextSplit(Text=item_70, Separators="{")
item_71 = ListItem(List=split_23, Index="1", Wrap=True)  # -> simplify(Item)

equals_22 = Equality(FirstNumber=graft(flatten_50), SecondNumber=merge_27)  # -> Equality, Inequality
mindex_13 = MemberIndex(Set=equals_22.Equality, Member=Toggle(True))  # -> Index, Count

# ----
# distances between points and space boundary
null = NullItem(Item=k1_3)  # -> NullFlags, InvalidFlags, Description
sift_39 = SiftPattern(List=pt_14, SiftPattern=null.NullFlags)  # -> Output0, Output1
complex_23 = ComplexComponents(Complex=sift_39.Output1)  # -> Real, Imaginary
eval_24 = Evaluate(F="abs(k*x0-y0+b)/sqrt(k*k+1)", k=k1_3, b=b1_3, x0=complex_22.Real, y0=complex_22.Imaginary)
subtraction_30 = Subtraction(A=complex_22.Real, B=complex_23.Real)  # -> simplify(Result)
distance = Number(eval_24)
abs_3 = Absolute(Value=subtraction_30)  # -> simplify(Result)
combine_11 = CombineData(Input0=distance, Input1=abs_3)  # -> Result, Index

# ---- group: vector match method 1
concat_11 = Concatenate(FragmentA=concat_9, FragmentB=item_68.Item1)
flatten_51 = FlattenTree(Tree=concat_11, Path="{0}")
panel_148 = Panel("""000
002
100
102""")
panel_149 = Panel("""010
012
110
112""")
panel_150 = Panel("""101
103
111
113""")
panel_151 = Panel("""001
003
011
013""")
mindex_14 = MemberIndex(Set=panel_151, Member=flatten_51)  # -> Index, Count
mindex_15 = MemberIndex(Set=panel_148, Member=flatten_51)  # -> Index, Count
mindex_16 = MemberIndex(Set=panel_150, Member=flatten_51)  # -> Index, Count
mindex_17 = MemberIndex(Set=panel_149, Member=flatten_51)  # -> Index, Count
clean_21 = CleanTree(RemoveNulls=True, RemoveInvalid=True, RemoveEmpty=True, Tree=mindex_17.Index)
clean_22 = CleanTree(RemoveNulls=True, RemoveInvalid=True, RemoveEmpty=True, Tree=mindex_15.Index)
clean_23 = CleanTree(RemoveNulls=True, RemoveInvalid=True, RemoveEmpty=True, Tree=mindex_16.Index)
clean_24 = CleanTree(RemoveNulls=True, RemoveInvalid=True, RemoveEmpty=True, Tree=mindex_14.Index)
replace_28 = ReplaceItems(List=clean_23, Item="0", Indices="0", Wrap=False)
replace_29 = ReplaceItems(List=clean_21, Item="1", Indices="0", Wrap=False)
replace_30 = ReplaceItems(List=clean_24, Item="2", Indices="0", Wrap=False)
replace_31 = ReplaceItems(List=clean_22, Item="3", Indices="0", Wrap=False)
merge_28 = Merge(Data1=replace_28, Data2=replace_29, Data3=replace_30, Data4=replace_31)
item_72 = ListItem(List=vec_4, Index=merge_28, Wrap=True)
amp_4 = Amplitude(Vector=item_72, Amplitude=combine_11.Result)
vdis_2 = VectorDisplay(Anchor=pt_15, Vector=amp_4)

# ---- group: vector match method 0 Error
# left-down;x-axis
# left-up;y-axis
a_4 = Number(complex_21.Real)
b_4 = Number(complex_21.Imaginary)
y_3 = Number(complex_22.Imaginary)
x_3 = Number(complex_22.Real)
item_73 = ListItem(List=vec_4, Index=item_68.Item1, Wrap=True)
smaller_4 = SmallerThan(FirstNumber=b_4, SecondNumber=y_3)  # -> SmallerThan, OrEqualTo
not = GateNot(A=smaller_4.SmallerThan)
smaller_5 = SmallerThan(FirstNumber=a_4, SecondNumber=x_3)  # -> SmallerThan, OrEqualTo
and_11 = GateAnd(A=smaller_5.SmallerThan, B=not)
equals_23 = Equality(FirstNumber="0", SecondNumber=graft(int_45))  # -> Equality, Inequality
equals_24 = Equality(FirstNumber="2", SecondNumber=graft(int_45))  # -> Equality, Inequality
and_12 = GateAnd(A=smaller_5.SmallerThan, B=smaller_4.SmallerThan)
equals_25 = Equality(FirstNumber="1", SecondNumber=graft(int_45))  # -> Equality, Inequality
equals_26 = Equality(FirstNumber="3", SecondNumber=graft(int_45))  # -> Equality, Inequality
or_5 = GateOr(A=equals_23.Equality, B=equals_24.Equality)
or_6 = GateOr(A=equals_25.Equality, B=equals_26.Equality)
and_13 = GateAnd(A=or_6, B=and_12)
and_14 = GateAnd(A=or_5, B=and_11)
or_7 = GateOr(A=and_13, B=and_14)
sift_40 = SiftPattern(List=item_73, SiftPattern=or_7)  # -> Output0, Output1
pi_10 = Pi(Factor="0.5")
Z = UnitZ(Factor=1)
neg_6 = Negative(Value=pi_10)
vrot = Rotate(Vector=sift_40.Output0, Axis=Z, Angle=neg_6)
vrot_2 = Rotate(Vector=sift_40.Output1, Axis=Z, Angle=pi_10)
combine_12 = CombineData(Input0=vrot, Input1=vrot_2)  # -> Result, Index
amp_5 = Amplitude(Vector=combine_12.Result, Amplitude=combine_11.Result)
vdis_3 = VectorDisplay(Anchor=pt_15, Vector=amp_5)

# ----
# vectors between points and space boundary
panel_152 = Panel("0.5")  # disabled
item_74 = ListItem(List=vec_4, Index=item_68.Item1, Wrap=True)  # disabled
pi_11 = Pi(Factor=panel_152)  # disabled
neg_7 = Negative(Value=pi_11)  # disabled
Z_2 = UnitZ(Factor=1)  # disabled
vrot_3 = Rotate(Vector=item_74, Axis=Z_2, Angle=neg_7)  # disabled
amp_6 = Amplitude(Vector=vrot_3, Amplitude=combine_11.Result)  # disabled

panel_153 = Panel(eval_24)
panel_154 = Panel(combine_11.Result)

# ---- group: vector match method 1 simplify
entwine_4 = Entwine(Branch00=panel_145, Branch01=panel_144, Branch02=panel_146, Branch03=panel_147, FlattenInputs=True)  # -> simplify(Result)
flatten_52 = FlattenTree(Tree=concat_11, Path="{0}")
mindex_18 = MemberIndex(Set=entwine_4, Member=flatten_52)  # -> Index, Count
clean_25 = CleanTree(RemoveNulls=True, RemoveInvalid=True, RemoveEmpty=True, Tree=mindex_18.Index)
pshift_38 = ShiftPaths(Data=clean_25, Offset=-1)
viewer_26 = ParamViewer(clean_25)

tstat_29 = TreeStatistics(Tree=pshift_38)  # -> Paths, Length, Count
dpath_16 = DeconstructPath(Branch=tstat_29.Paths)  # -> simplify(Indices)

graft_49 = GraftTree(Tree=tstat_29.Length, IncludeEmptyLists=True, IncludeNullItems=True)
series_17 = Series(Start=0, Step=1, Count=graft_49)
int_49 = Integer(simplify(series_17))
replace_32 = ReplaceItems(List=pshift_38, Item=dpath_16, Indices=int_49, Wrap=False)
graft_50 = GraftTree(Tree=flatten(replace_32), IncludeEmptyLists=True, IncludeNullItems=True)
viewer_27 = ParamViewer(graft_50)
replace_33 = ReplacePaths(Data=graft_50, Search=viewer_27, Replace=viewer_26)
pshift_39 = ShiftPaths(Data=replace_33, Offset="1")
item_75 = ListItem(List=vec_4, Index=pshift_39, Wrap=True)
amp_7 = Amplitude(Vector=item_75, Amplitude=combine_11.Result)
vdis_4 = VectorDisplay(Anchor=pt_15, Vector=amp_7)
