# Grasshopper definition 20161110_tim_graphics_fillArea_scanLine_002.gh (Grasshopper 0.9.76)
# plug-ins: Python Interpreter

# ----
# 向量运算部分
genes = GenePool(Decimals=6, Maximum=50, Minimum=0, Value=[8.5769, 12.084605])
genes_2 = GenePool(Decimals=6, Maximum=50, Minimum=0, Value=[9.729951, 4.591837])
panel = Panel("""3
0
0
4""")
num = Number([genes, genes_2])
panel_2 = Panel("""0
1""")
panel_3 = Panel("""0
2""")
item = ListItem(List=num, Index=panel_3, Wrap=False)  # -> Item, Item1
item_2 = ListItem(List=num, Index=panel_3, Wrap=False)  # -> Item, Item1
complex = CreateComplex(Real=item.Item, Imaginary=item.Item1)
pt = PointOriented(BasePlane=PlaneXY(0, 0, 0), UComponent=0, VComponent=0, WComponent=0)
cmod = ComplexModulus(Complex=complex)
panel_4 = Panel("2.angleCos cos = u*v/|u|*|v|")
panel_5 = Panel("1.length:|u|2 = u*u")
cmod_2 = ComplexModulus(Complex=complex)
multiplication = Multiplication(A=item.Item, B=item.Item1)
panel_6 = Panel("3.")
vdis = VectorDisplay(Anchor=pt, Vector=complex)
sqr = Square(Value=cmod)
ma = MassAddition(Input=multiplication)  # -> Result, PartialResults
equals = Equality(FirstNumber=ma.Result, SecondNumber="0")  # -> Equality, Inequality
mm = MassMultiplication(Input=cmod_2)  # -> Result, PartialResults
item_3 = ListItem(List=["非正交", "正交"], Index=equals.Equality, Wrap=True)
division = Division(A=ma.Result, B=mm.Result)
sqr_2 = Square(Value=item.Item)
sqr_3 = Square(Value=item.Item1)
panel_7 = Panel(item_3)
addition = Addition(A=sqr_2, B=sqr_3)

# ----
# log:区域填充算法
# 20161110:
# 向量几何公式的gh实现
# 向量乘积：点积，差积，行列式
# 向量需要用时候再学习
# 
# 扫描线填色算法gh实现:
# n,x_array,y_array的形式给出多边形
# 扫描线给定有限元finite_distance从上而下求交点
# 左右顶点处理（考虑是否有限元法不会有此问题）
# 左:y1<y2<y3 y2-y1>0,y2-y3<0
# 右:y1>y2>y3 y2-y1<0,y2-y3>0
panel_8 = Panel("""{7.656903, 14.500688, 0.0}
{6.429437, -1.86552, 0.0}
{2.065114, -5.411532, 0.0}
{-5.367872, 0.521218, 0.0}
{1.724152, 5.294696, 0.0}
{-2.435593, 5.840236, 0.0}
{-1.753668, 10.136366, 0.0}""")
panel_9 = Panel("""{7.637584, 15.346381, 0.0}
{9.723192, 10.523412, 0.0}
{7.767934, -3.684795, 0.0}
{-0.8352, 0.095371, 0.0}
{-3.963612, -6.291805, 0.0}
{-5.397468, 7.395, 0.0}
{-0.313798, 15.346381, 0.0}
{2.423563, 12.869721, 0.0}
{2.293213, 3.745185, 0.0}""")
panel_10 = Panel("""{32.045762, 15.39429, 0.0}
{30.049266, -1.959868, 0.0}
{23.752625, -5.0314, 0.0}
{17.763138, -0.116948, 0.0}
{25.902698, 2.801007, 0.0}
{22.984742, 5.718963, 0.0}
{20.988246, 2.954584, 0.0}
{19.45248, 4.643927, 0.0}
{22.831166, 8.944072, 0.0}
{19.606057, 10.172685, 0.0}
{20.681093, 14.779983, 0.0}
{25.902698, 10.326261, 0.0}
{29.43496, 11.708451, 0.0}
{26.209851, 13.858523, 0.0}""")

# ----
# include wheater In domain
x1 = Number(Slider(3.22, range=0..10))
y1 = Number(Slider(3.99, range=0..10))
y2 = Number(Slider(2.51, range=0..10))
x2 = Number(Slider(1.32, range=0..10))
y0 = Number(Slider(2.568001, range=0..5))
merge = Merge(Data1=y1, Data2=y2)
subtraction = Subtraction(A=x1, B=x2)
subtraction_2 = Subtraction(A=y1, B=y2)
division_2 = Division(A=subtraction_2, B=subtraction)
eval = Evaluate(F="(y1-y2)/(x1-x2)", x1=x1, y1=y1, x2=x2, y2=y2)
subtraction_3 = Subtraction(A=merge, B=y0)
multiplication_2 = Multiplication(A=x1, B=division_2)
smaller = SmallerThan(FirstNumber=subtraction_3, SecondNumber="0")  # -> SmallerThan, OrEqualTo
eval_2 = Evaluate(F="y-k*x", x=x1, y=y1, k=eval)
subtraction_4 = Subtraction(A=y1, B=multiplication_2)
int = Integer(smaller.SmallerThan)
eval_3 = Evaluate(F="(y0-b)/k", y0=y0, k=eval, b=eval_2)
subtraction_5 = Subtraction(A=y0, B=subtraction_4)
division_3 = Division(A=subtraction_5, B=division_2)
join = TextJoin(Text=int)
equals_2 = Equality(FirstNumber=join, SecondNumber="01")  # -> Equality, Inequality

txt = Text(panel_9)
complex_2 = ComplexComponents(Complex=txt)  # -> Real, Imaginary
lng = ListLength(List=txt)
finite_distance = Number(Slider(0.27758, range=0..1))
n = Integer(lng)
x_array = Number(complex_2.Real)
y_array = Number(complex_2.Imaginary)
sort = SortList(Keys=y_array)  # -> Keys, ValuesA
shift = ShiftList(List=y_array, Shift=[-1, 1], Wrap=True)
x2_original = Number(x_array)
y2_original = Number(y_array)
# 左右顶点处理
# left:   y2-y1>0,y2-y3<0 -->10-->0
# right: y2-y1<0,y2-y3>0 -->01-->1
# down y2-y1<0,y2-y3<0-->00--> 2
# up    y2-y1>0,y2-y3>0-->11--> 3
# 研究凹凸性的一个方向
number = Number(shift)  # "y1,y3"
item_4 = ListItem(List=sort.Keys, Index="-1", Wrap=True)  # -> Item, Item1
dom = ConstructDomain(DomainStart=y1, DomainEnd=y2)
subtraction_6 = Subtraction(A=y2_original, B=number)
inc = Includes(Value=y0, Domain=dom)  # -> Includes, Deviation
subtraction_7 = Subtraction(A=item_4.Item, B=item_4.Item1)
division_4 = Division(A=subtraction_7, B=finite_distance)
int_2 = Integer(division_4)
larger = LargerThan(FirstNumber=subtraction_6, SecondNumber="0")  # -> LargerThan, OrEqualTo
neg = Negative(Value=finite_distance)
addition_2 = Addition(A=int_2, B=2)
int_3 = Integer(larger.LargerThan)
panel_11 = Panel(equals_2.Equality)
panel_12 = Panel("""-1
1
0
0""")
series = Series(Start=item_4.Item, Step=neg, Count=addition_2)
flip = FlipMatrix(Data=int_3)
panel_13 = Panel("""10
01
00
11""")
ins = InsertItems(List=series, Item=y_array, Indices="0", Wrap=True)
y0_2 = Number(series)
join_2 = TextJoin(Text=flip)
replace = ReplaceMembers(Set=join_2, Find=panel_13, Replace=panel_12)  # -> flatten(Result)
graft = GraftTree(Tree=y0_2, IncludeEmptyLists=True, IncludeNullItems=True)
addition_3 = Addition(A=y2_original, B=replace)
y2_after_revise = Number(addition_3)
panel_14 = Panel(graft)

pt_2 = Point(txt)
pline = PolyLine(Vertices=pt_2, Closed=True)
points = PointList(Points=txt, Size=Slider(2, range=0..10))

shift_2 = ShiftList(List=x_array, Shift=1, Wrap=True)
shift_3 = ShiftList(List=y_array, Shift=1, Wrap=True)
pshift = ShiftPaths(Data=shift_2, Offset=-1)
pshift_2 = ShiftPaths(Data=shift_3, Offset=-1)
subtraction_8 = Subtraction(A=y_array, B=pshift_2)
subtraction_9 = Subtraction(A=x_array, B=pshift)
division_5 = Division(A=subtraction_8, B=subtraction_9)
k = Number(division_5)

dom_2 = ConstructDomain(DomainStart=y_array, DomainEnd=pshift_2)

inc_2 = Includes(Value=graft, Domain=dom_2)  # -> Includes, Deviation
sift = SiftPattern(List=k, SiftPattern=inc_2.Includes)  # -> Output0, Output1
multiplication_3 = Multiplication(A=x_array, B=sift.Output1)
subtraction_10 = Subtraction(A=y_array, B=multiplication_3)
subtraction_11 = Subtraction(A=graft, B=subtraction_10)
division_6 = Division(A=subtraction_11, B=sift.Output1)

k_2 = Number(k)

complex_3 = CreateComplex(Real=division_6, Imaginary=graft)
pt_3 = Point(complex_3)

division_7 = Division(A="1", B=k_2)
multiplication_4 = Multiplication(A=division_7, B=replace)
clean = CleanTree(RemoveNulls=True, RemoveInvalid=True, RemoveEmpty=False, Tree=pt_3)
addition_4 = Addition(A=x2_original, B=multiplication_4)
item_5 = ListItem(List=clean, Index=0, Wrap=True)  # -> Item, Item1
x2_after_revise = Number(addition_4)
ln = Line(StartPoint=item_5.Item, EndPoint=item_5.Item1)

# ----
# Active_List_of_Side
shift_4 = ShiftList(List=y2_after_revise, Shift=1, Wrap=True)
pshift_3 = ShiftPaths(Data=shift_4, Offset=-1)  # -> graft(Data)
graft_2 = GraftTree(Tree=y2_original, IncludeEmptyLists=True, IncludeNullItems=True)
merge_2 = Merge(Data1=graft_2, Data2=pshift_3)  # -> simplify(Result)
sort_2 = SortList(Keys=merge_2)  # -> Keys, ValuesA
item_6 = ListItem(List=sort_2.Keys, Index="-1", Wrap=True)
y_top = Number(item_6)
flatten = FlattenTree(Tree=y_top, Path="{0}")
lng_2 = ListLength(List=flatten)
series_2 = Series(Start=0, Step=1, Count=lng_2)
int_4 = Integer(series_2)
sort_3 = SortList(Keys=flatten, ValuesA=int_4)  # -> reverse(Keys), reverse(ValuesA)
path = ConstructPath(Indices=graft(sort_3.ValuesA))  # -> flatten(Branch)
cset = CreateSet(List=sort_3.Keys)  # -> Set, Map
consec = ConsecutiveDomains(Numbers=cset.Set, Additive=False)
y0_3 = Number(y0_2)
k_3 = Number(k)
inc_3 = Includes(Value=graft(y0_3), Domain=consec)  # -> Includes, Deviation
python = PythonScript(y_top=flatten, y0_scanLine=y0_3, y1=y_array, y2=pshift_2, k=k_3)  # -> a; inputs y_top: list, y0_scanLine: list, y1: list, y2: list, k: list
# ---------- python: Python ----------
y1y2_dict = {}
k_dict = {}
for i in range(len(y1)):
    y1y2_dict[i]=y1[i]-y2[i]
    k_dict[i]=k[i]
    
print (k_dict)
    
#Active_list_of_side
def putInSidesList():
    """put the y of each in side list for reducing the compute intersection times 
    """
    pass
# ---------- end python ----------

panel_15 = Panel(item_5.Item)
panel_16 = Panel(ln)
panel_17 = Panel(y0_3)
panel_18 = Panel(inc_3.Includes)
