# Grasshopper definition 20161115_tim_graphics_fillArea_scanLine_005.gh (Grasshopper 0.9.76)

# log:区域填充算法
# 20161110:
# 向量几何公式的gh实现
# 向量乘积：点积，差积，行列式
# 向量需要用时候再学习
# 
# 扫描线填色算法gh实现:
# n,x_array,y_array的形式给出多边形
# 扫描线给定有限元finite_distance从上而下求交点
# 左右顶点处理（考虑是否有限元法不会有此问题）
# 左:y1<y2<y3 y2-y1>0,y2-y3<0
# 右:y1>y2>y3 y2-y1<0,y2-y3>0
# 20161113:
# 写活性表的伪代码，想清楚了连电池:
# 0;m0_y与相交值域的比较
# 1;值域和对应线段的映射关系
# 2;左右顶点处理坐标bug修正,书中给出的左右顶点有谬误
# 3;整理应映射标签运算程序段
# 求交点的问题:
# 1;计算数列起始坐标的标签运算:
# 1;0初始坐标调用现有的数据，用top_y以及对应的top_x
# 1;1减少数据结构间的无意义映射
# 2;每段line上scanLine的数量，不要重复计算，并行计算
# 3；对y进行top排序的时候，对应的x的值
# 4；修复因为修正顶点而产生的交点错误
# 5；整理交点部分程序
# 对偶数个数的点序进行连线:
# 1;组织对应的树形数据
# 扫描线有限元范围问题
# 20161114:
# 扫描线求交点问题：
# 1;抓住映射关系，多求一次最最大y0的交点
panel = Panel("""{7.656903, 14.500688, 0.0}
{6.429437, -1.86552, 0.0}
{2.065114, -5.411532, 0.0}
{-5.367872, 0.521218, 0.0}
{1.724152, 5.294696, 0.0}
{-2.435593, 5.840236, 0.0}
{-1.753668, 10.136366, 0.0}""")
panel_2 = Panel("""{32.045762, 15.39429, 0.0}
{30.049266, -1.959868, 0.0}
{23.752625, -5.0314, 0.0}
{17.763138, -0.116948, 0.0}
{25.902698, 2.801007, 0.0}
{22.984742, 5.718963, 0.0}
{20.988246, 2.954584, 0.0}
{19.45248, 4.643927, 0.0}
{22.831166, 8.944072, 0.0}
{19.606057, 10.172685, 0.0}
{20.681093, 14.779983, 0.0}
{25.902698, 10.326261, 0.0}
{29.43496, 11.708451, 0.0}
{26.209851, 13.858523, 0.0}""")
panel_3 = Panel("""{7.637584, 15.346381, 0.0}
{9.723192, 10.523412, 0.0}
{7.767934, -3.684795, 0.0}
{-0.8352, 0.095371, 0.0}
{-3.963612, -6.291805, 0.0}
{-5.397468, 7.395, 0.0}
{-0.313798, 15.346381, 0.0}
{2.423563, 12.869721, 0.0}
{2.293213, 3.745185, 0.0}""")
txt = Text(panel_3)
complex = ComplexComponents(Complex=txt)  # -> Real, Imaginary
lng = ListLength(List=txt)
finite_distance = Number(Slider(1, range=0..1))
n = Integer(lng)
x_array = Number(complex.Real)
y_array = Number(complex.Imaginary)
sort = SortList(Keys=y_array)  # -> Keys, ValuesA
shift = ShiftList(List=y_array, Shift=[-1, 1], Wrap=True)
x2_original = Number(x_array)
y2_original = Number(y_array)
number = Number(shift)  # "y1,y3"
item = ListItem(List=sort.Keys, Index="-1", Wrap=True)  # -> Item, Item1
subtraction = Subtraction(A=y2_original, B=number)
subtraction_2 = Subtraction(A=item.Item, B=item.Item1)
division = Division(A=subtraction_2, B=finite_distance)
int = Integer(division)
larger = LargerThan(FirstNumber=subtraction, SecondNumber="0")  # -> LargerThan, OrEqualTo
neg = Negative(Value=finite_distance)
addition = Addition(A=int, B=2)
int_2 = Integer(larger.LargerThan)

# ----
# 左右顶点处理
# left:   y2-y1>0,y2-y3<0 -->10-->-1
# right: y2-y1<0,y2-y3>0 -->01-->1
# down y2-y1<0,y2-y3<0-->00--> 0
# up    y2-y1>0,y2-y3>0-->11--> 0
panel_4 = Panel("""-1
1
0
0""")

# ----
# 左右顶点处理
# left:   y2-y1>0,y2-y3<0 -->10-->1
# right: y2-y1<0,y2-y3>0 -->01-->-1
# down y2-y1<0,y2-y3<0-->00--> 0
# up    y2-y1>0,y2-y3>0-->11--> 0
panel_5 = Panel("""1
-1
0
0""")

series = Series(Start=item.Item, Step=neg, Count=addition)
flip = FlipMatrix(Data=int_2)
panel_6 = Panel("""10
01
00
11""")
ins = InsertItems(List=series, Item=y_array, Indices="0", Wrap=True)
y0 = Number(series)
join = TextJoin(Text=flip)
replace = ReplaceMembers(Set=join, Find=panel_6, Replace=panel_5)  # -> flatten(Result)
graft = GraftTree(Tree=y0, IncludeEmptyLists=True, IncludeNullItems=True)
addition_2 = Addition(A=y2_original, B=replace)
y2_after_revise = Number(addition_2)

# ----
# sort首尾点的y值
shift_2 = ShiftList(List=y2_after_revise, Shift=1, Wrap=True)
pshift = ShiftPaths(Data=shift_2, Offset=-1)  # -> graft(Data)
graft_2 = GraftTree(Tree=y2_after_revise, IncludeEmptyLists=True, IncludeNullItems=True)
merge = Merge(Data1=graft_2, Data2=pshift)  # -> simplify(Result)
lng_2 = ListLength(List=merge)
series_2 = Series(Start=0, Step=1, Count=lng_2)
int_3 = Integer(series_2)
sort_2 = SortList(Keys=merge, ValuesA=int_3)  # -> Keys, ValuesA
num = Number(sort_2.Keys)

panel_7 = Panel(sort_2.ValuesA)

# ----
# Active_List_of_Side
graft_3 = GraftTree(Tree=reverse(num), IncludeEmptyLists=True, IncludeNullItems=True)
graft_4 = GraftTree(Tree=num, IncludeEmptyLists=True, IncludeNullItems=True)

# ----
# 在端点上的扫描线的y值
# 扫描线的实例与类的映射关系
cset = CreateSet(List=y2_after_revise)  # -> Set, Map
sort_3 = SortList(Keys=cset.Set)  # -> reverse(Keys), ValuesA
shift_3 = ShiftList(List=sort_3.Keys, Shift=[-1, 1], Wrap=False)
y0_2 = Number(y0)
bang = ExplodeTree(Data=shift_3)  # -> Branch0, Branch1
lng_3 = ListLength(List=bang.Branch0)
scanline_class_count = Integer(lng_3)
graft_5 = GraftTree(Tree=y0_2, IncludeEmptyLists=True, IncludeNullItems=True)
smaller = SmallerThan(FirstNumber=graft_5, SecondNumber=bang.Branch0)  # -> SmallerThan, OrEqualTo
larger_2 = LargerThan(FirstNumber=graft_5, SecondNumber=bang.Branch1)  # -> LargerThan, OrEqualTo
and = GateAnd(A=smaller.OrEqualTo, B=larger_2.LargerThan)
mindex = MemberIndex(Set=and, Member=Toggle(True))  # -> simplify(Index), Count

# ----
# {n;m}
# 每条line端点处对应的scanLine的index
num_2 = Number(graft_3)
equals = Equality(FirstNumber=num_2, SecondNumber=sort_3.Keys)  # -> Equality, Inequality
mindex_2 = MemberIndex(Set=equals.Equality, Member=Toggle(True))  # -> simplify(Index), Count
pshift_2 = ShiftPaths(Data=mindex_2.Index, Offset=-1)
item_2 = ListItem(List=pshift_2, Index=0, Wrap=True)  # -> Item, Item1
subtraction_3 = Subtraction(A=item_2.Item1, B=item_2.Item)
series_3 = Series(Start=item_2.Item, Step=1, Count=subtraction_3)
int_4 = Integer(series_3)

scanline_class_count_2 = Integer(scanline_class_count)
series_4 = Series(Start=0, Step=1, Count=scanline_class_count_2)
graft_6 = GraftTree(Tree=int_4, IncludeEmptyLists=True, IncludeNullItems=True)
int_5 = Integer(series_4)
path = ConstructPath(Indices=graft_6)  # -> simplify(Branch)
tstat = TreeStatistics(Tree=path)  # -> Paths, Length, Count
dpath = DeconstructPath(Branch=tstat.Paths)
mindex_3 = MemberIndex(Set=int_4, Member=int_5)  # -> simplify(Index), Count
tstat_2 = TreeStatistics(Tree=mindex_3.Index)  # -> Paths, Length, Count
equals_2 = Equality(FirstNumber=tstat_2.Length, SecondNumber="1")  # -> Equality, Inequality
sift = SiftPattern(List=tstat_2.Paths, SiftPattern=equals_2.Equality)  # -> Output0, Output1
item_3 = ListItem(List=dpath, Index=0, Wrap=True)
partition = PartitionList(List=sift.Output1, Size=scanline_class_count_2)
panel_8 = Panel("组织树形结构时候，减少这种后馈，在前面就设计好算法")
viewer = ParamViewer(item_3)
panel_9 = Panel(int_4)

# ----
# scanLineCount_on_line for process_x_intersections
# 每个值域内的scanLineCount
cset_2 = CreateSet(List=flatten(mindex.Index))  # -> Set, Map; disabled
mindex_4 = MemberIndex(Set=cset_2.Map, Member=cset_2.Set)  # -> Index, Count; disabled
lng_4 = ListLength(List=mindex_4.Index)  # disabled
flatten = FlattenTree(Tree=lng_4, Path="{0}")  # disabled
item_4 = ListItem(List=flatten, Index=int_4, Wrap=False)  # disabled
ma = MassAddition(Input=item_4)  # -> Result, PartialResults; disabled
scanlinecount_on_line = Integer(ma.Result)  # disabled

# ----
# 扫描线的实例与类的映射关系
int_6 = Integer(mindex.Index)

number_slider = Slider(2, range=0..10)
pt = Point(txt)
pline = PolyLine(Vertices=pt, Closed=True)
points = PointList(Points=txt, Size=number_slider)

shift_4 = ShiftList(List=x_array, Shift=1, Wrap=True)
shift_5 = ShiftList(List=y_array, Shift=1, Wrap=True)
pshift_3 = ShiftPaths(Data=shift_4, Offset=-1)
pshift_4 = ShiftPaths(Data=shift_5, Offset=-1)
subtraction_4 = Subtraction(A=y_array, B=pshift_4)
subtraction_5 = Subtraction(A=x_array, B=pshift_3)
division_2 = Division(A=subtraction_4, B=subtraction_5)
k = Number(division_2)

dom = ConstructDomain(DomainStart=y_array, DomainEnd=pshift_4)

inc = Includes(Value=graft, Domain=dom)  # -> Includes, Deviation
sift_2 = SiftPattern(List=k, SiftPattern=inc.Includes)  # -> Output0, Output1
multiplication = Multiplication(A=x_array, B=sift_2.Output1)
subtraction_6 = Subtraction(A=y_array, B=multiplication)
subtraction_7 = Subtraction(A=graft, B=subtraction_6)
division_3 = Division(A=subtraction_7, B=sift_2.Output1)

k_2 = Number(k)

complex_2 = CreateComplex(Real=division_3, Imaginary=graft)
pt_2 = Point(complex_2)

division_4 = Division(A="1", B=k_2)
multiplication_2 = Multiplication(A=division_4, B=replace)
clean = CleanTree(RemoveNulls=True, RemoveInvalid=True, RemoveEmpty=False, Tree=pt_2)

multiplication_3 = Multiplication(A=x_array, B=k)
subtraction_8 = Subtraction(A=y_array, B=multiplication_3)
b = Number(subtraction_8)

addition_3 = Addition(A=x2_original, B=multiplication_2)
item_5 = ListItem(List=clean, Index=0, Wrap=True)  # -> Item, Item1
x2_after_revise = Number(addition_3)
ln = Line(StartPoint=item_5.Item, EndPoint=item_5.Item1)
shift_6 = ShiftList(List=x2_after_revise, Shift=1, Wrap=True)
pt_3 = ConstructPoint(XCoordinate=x2_after_revise, YCoordinate=y2_after_revise, ZCoordinate=0)
graft_7 = GraftTree(Tree=x2_after_revise, IncludeEmptyLists=True, IncludeNullItems=True)
pshift_5 = ShiftPaths(Data=shift_6, Offset=-1)  # -> graft(Data)
points_2 = PointList(Points=flatten(pt_3), Size=number_slider)
merge_2 = Merge(Data1=graft_7, Data2=pshift_5)  # -> simplify(Result)
b_2 = Number(b)
k_3 = Number(k)

item_6 = ListItem(List=num, Index=0, Wrap=True)  # -> Item, Item1
lng_5 = ListLength(List=flatten(item_6.Item1))
series_5 = Series(Start=0, Step=1, Count=lng_5)
sortmethod = Integer(series_5)

# ----
# sort较大的y,得到top_y
sort_4 = SortList(Keys=flatten(item_6.Item1), ValuesA=sortmethod)  # -> reverse(Keys), reverse(ValuesA)

# ----
# 重新寻找top_y对应的top_x
panel_10 = Panel("1")
int_7 = Integer(panel_10)
graft_8 = GraftTree(Tree=sort_4.ValuesA, IncludeEmptyLists=True, IncludeNullItems=True)
mindex_5 = MemberIndex(Set=sort_2.ValuesA, Member=int_7)  # -> Index, Count
path_2 = ConstructPath(Indices=graft_8)
item_7 = ListItem(List=flatten(mindex_5.Index), Index=graft_8, Wrap=False)
item_8 = TreeItem(Tree=merge_2, Path=path_2, Index=item_7, Wrap=True)
flatten_2 = FlattenTree(Tree=item_8, Path="{0}")

top_y_lineindex = Integer(sort_4.ValuesA)
top_y = Number(sort_4.Keys)

panel_11 = Panel(item_7)

# ----
# 恢复path
path_3 = ConstructPath(Indices=graft(top_y_lineindex))  # disabled

# ----
# process_x_intersections
# {n;m}
# 每条line上对应与scanLine交点坐标
number_2 = Number(division_4)  # disabled
item_9 = ListItem(List=x2_after_revise, Index=top_y_lineindex, Wrap=False)  # disabled
item_10 = ListItem(List=number_2, Index=top_y_lineindex, Wrap=False)  # disabled
match_top_1_k = Number(item_10)  # disabled
match_top_x = Number(flatten_2)  # disabled
flatten_3 = FlattenTree(Tree=scanlinecount_on_line, Path="{0}")  # disabled
item_11 = ListItem(List=flatten_3, Index=top_y_lineindex, Wrap=True)  # disabled
neg_2 = Negative(Value=match_top_1_k)  # disabled
panel_12 = Panel("-1")  # disabled
series_6 = Series(Start=match_top_x, Step=neg_2, Count=item_11)  # disabled
series_7 = Series(Start=top_y, Step=panel_12, Count=item_11)  # disabled
viewer_2 = ParamViewer(series_6)  # disabled
replace_2 = ReplacePaths(Data=series_7, Search=viewer_2, Replace=flatten(path_3))  # disabled
replace_3 = ReplacePaths(Data=series_6, Search=viewer_2, Replace=flatten(path_3))  # disabled
flip_2 = FlipMatrix(Data=replace_3)  # disabled
flip_3 = FlipMatrix(Data=replace_2)  # disabled
pt_4 = ConstructPoint(XCoordinate=replace_3, YCoordinate=replace_2, ZCoordinate=0)  # disabled

# ----
# scanLine-->m , line --> n
# {m;n}
# 每条scanLine相交的line
flip_4 = FlipMatrix(Data=partition)
replace_4 = ReplacePaths(Data=item_3, Search=viewer, Replace=flatten(path))

flatten_4 = FlattenTree(Tree=replace_4, Path="{0}")
graft_9 = GraftTree(Tree=replace_4, IncludeEmptyLists=True, IncludeNullItems=True)
tstat_3 = TreeStatistics(Tree=graft_9)  # -> Paths, Length, Count
dpath_2 = DeconstructPath(Branch=tstat_3.Paths)
item_12 = ListItem(List=dpath_2, Index=0, Wrap=True)
flatten_5 = FlattenTree(Tree=item_12, Path="{0}")
weave = Weave(Pattern=[0, 1], Stream0=flatten_5, Stream1=flatten_4, NullGaps=False)
partition_2 = PartitionList(List=weave, Size="2")
path_4 = ConstructPath(Indices=partition_2)
viewer_3 = ParamViewer(graft_9)
flatten_6 = FlattenTree(Tree=path_4, Path="{0}")

replace_5 = ReplacePaths(Data=graft_9, Search=viewer_3, Replace=flatten_6)

panel_13 = Panel(flip_4)
panel_14 = Panel(replace_4)
# scanLine-->m , line --> n
# {m;n}
# 每条scanLine相交的line
int_8 = Integer(replace_4)
tstat_4 = TreeStatistics(Tree=int_8)  # -> Paths, Length, Count
panel_15 = Panel(int_8)
dpath_3 = DeconstructPath(Branch=tstat_4.Paths)

# ----
# member时count需要equal,所以都转成字符串
tstat_5 = TreeStatistics(Tree=int_8)  # -> Paths, Length, Count
dpath_4 = DeconstructPath(Branch=tstat_5.Paths)
join_2 = TextJoin(Text=int_8, Join="t")  # -> flatten(Result)
replace_6 = ReplaceMembers(Set=int_6, Find=flatten(dpath_4), Replace=join_2)
split = TextSplit(Text=replace_6, Separators="t")  # -> simplify(Result)

# ----
# 对y0进行分组
mindex_6 = MemberIndex(Set=flatten(int_6), Member=flatten(dpath_3))  # -> Index, Count
scanlineindexcount_afterpartition = Integer(graft(mindex_6.Count))
# 得到不同扫描线区间的最大实际y0
item_13 = ListItem(List=y0_2, Index=mindex_6.Index, Wrap=True)
item_14 = ListItem(List=item_13, Index=0, Wrap=True)
item_15 = ListItem(List=b_2, Index=int_8, Wrap=True)
item_16 = ListItem(List=k_3, Index=int_8, Wrap=True)
lng_6 = ListLength(List=int_8)
subtraction_9 = Subtraction(A=item_14, B=item_15)
division_5 = Division(A="1", B=item_16)
panel_16 = Panel(split)
series_8 = Series(Start=item_14, Step="-1", Count=scanlineindexcount_afterpartition)  # -> simplify(Series)
multiplication_4 = Multiplication(A=scanlineindexcount_afterpartition, B=lng_6)
# 计算最大实际y0的交点
# x=(y-b)/k
division_6 = Division(A=subtraction_9, B=item_16)
neg_3 = Negative(Value=division_5)
repeat = RepeatData(Data=series_8, Length=multiplication_4)
series_9 = Series(Start=division_6, Step=neg_3, Count=scanlineindexcount_afterpartition)  # -> simplify(Series)
partition_3 = PartitionList(List=repeat, Size=scanlineindexcount_afterpartition)  # -> simplify(Chunks)
panel_17 = Panel(series_9)
num_3 = Number(series_9)
num_4 = Number(partition_3)
panel_18 = Panel(num_4)
path_mapper = PathMapper(num_3, source="{A;B}(i)", target="{A;i}")
path_mapper_2 = PathMapper(num_4, source="{A;B}(i)", target="{A;i}")
panel_19 = Panel(path_mapper_2)
pt_5 = ConstructPoint(XCoordinate=series_9, YCoordinate=partition_3, ZCoordinate=0)

lng_7 = ListLength(List=path_mapper)
# 每一scanLine上的点根据x从左到右排序
series_10 = Series(Start=0, Step=1, Count=lng_7)
sort_5 = SortList(Keys=path_mapper, ValuesA=simplify(series_10))  # -> Keys, ValuesA
item_17 = ListItem(List=path_mapper_2, Index=sort_5.ValuesA, Wrap=True)
partition_4 = PartitionList(List=sort_5.Keys, Size="2")
partition_5 = PartitionList(List=item_17, Size="2")
item_18 = ListItem(List=partition_4, Index=0, Wrap=True)  # -> Item, Item1
complex_3 = CreateComplex(Real=item_18.Item, Imaginary=partition_5)
complex_4 = CreateComplex(Real=item_18.Item1, Imaginary=partition_5)
ln_2 = Line(StartPoint=complex_3, EndPoint=complex_4)

viewer_4 = ParamViewer(partition_5)
panel_21 = Panel(partition_5)
panel_22 = Panel(partition_4)
