# Grasshopper definition 20161128_tim_graphics_fillArea_scanLine_007_debug_knoexist.gh (Grasshopper 0.9.76)

crv = Curve(<curve referenced from the Rhino model>)  # disabled
explode = Explode(Curve=crv, Recursive=True)  # -> Segments, Vertices; disabled
panel = Panel(explode.Vertices)  # disabled

# ----
# log:区域填充算法
# 20161110:
# 向量几何公式的gh实现
# 向量乘积：点积，差积，行列式
# 向量需要用时候再学习
# 
# 扫描线填色算法gh实现:
# n,x_array,y_array的形式给出多边形
# 扫描线给定有限元finite_distance从上而下求交点
# 左右顶点处理（考虑是否有限元法不会有此问题）
# 左:y1<y2<y3 y2-y1>0,y2-y3<0
# 右:y1>y2>y3 y2-y1<0,y2-y3>0
# 20161113:
# 写活性表的伪代码，想清楚了连电池:
# 0;m0_y与相交值域的比较
# 1;值域和对应线段的映射关系
# 2;左右顶点处理坐标bug修正,书中给出的左右顶点有谬误
# 3;整理应映射标签运算程序段
# 求交点的问题:
# 1;计算数列起始坐标的标签运算:
# 1;0初始坐标调用现有的数据，用top_y以及对应的top_x
# 1;1减少数据结构间的无意义映射
# 2;每段line上scanLine的数量，不要重复计算，并行计算
# 3；对y进行top排序的时候，对应的x的值
# 4；修复因为修正顶点而产生的交点错误
# 5；整理交点部分程序
# 对偶数个数的点序进行连线:
# 1;组织对应的树形数据
# 扫描线有限元范围问题
# 20161114:
# 扫描线求交点问题：
# 1;抓住映射关系，多求一次最最大y0的交点
# 20161115:
# 整理求交点部分的程序:
# 0;精简连线前对x排序的算法
# 顶点修正以及去掉水平线
# 0;debug k=0的情况
# 20161228:
# debug:
# 0；k=0
# 1;k not exist
# 1;0:series的三个参数重新运算，使得start=x0,step=0
# 1;1:line连线算法的数据结构不够坚固,排除最特殊的情况
# 2；basicScanLine组null的情况
debug_not_exist_k = Panel("""{-9.248463, -10.752036, 0.0}
{-9.248463, -24.10027, 0.0}
{1.077529, -30.900314, 0.0}
{5.885538, -18.134415, 0.0}
{-1.880792, -11.855255, 0.0}""")
debug_not_exist_k_1 = Panel("""{13.481212, -29.584274, 0.0}
{13.481212, -16.099326, 0.0}
{20.538755, -23.030841, 0.0}
{20.538755, -18.367822, 0.0}
{25.453829, -20.51029, 0.0}
{25.453829, -26.937695, 0.0}
{19.467521, -32.230248, 0.0}""")
debug_not_exist_k_2_supersituation = Panel("""{5.677194, 7.951573, 0.0}
{11.102267, 7.951573, 0.0}
{11.102267, 1.253952, 0.0}
{5.677194, 1.253952, 0.0}""")
debug_not_exist_k_3 = Panel("""{-19.89661, -1.927181, 0.0}
{-10.405646, -1.927181, 0.0}
{-10.405646, -13.907578, 0.0}
{-23.45567, -13.907578, 0.0}
{-23.45567, -8.688233, 0.0}
{-15.372312, -8.688233, 0.0}
{-15.372312, -5.216186, 0.0}
{-19.89661, -5.216186, 0.0}""")
panel_2 = Panel("""{16.049443, -28.416922, 0.0}
{16.049443, -15.058002, 0.0}
{20.704538, -16.905213, 0.0}
{26.076356, -23.935041, 0.0}
{21.161281, -32.504914, 0.0}""")

# ----
# 左右顶点处理
# left:   y2-y1>0,y2-y3<0 -->10-->-1
# right: y2-y1<0,y2-y3>0 -->01-->1
# down y2-y1<0,y2-y3<0-->00--> 0
# up    y2-y1>0,y2-y3>0-->11--> 0
panel_3 = Panel("""-1
1
0
0""")  # disabled

# ----
# 左右顶点处理
# left:   y2-y1>0,y2-y3<0 -->10-->1
# right: y2-y1<0,y2-y3>0 -->01-->-1
# down y2-y1<0,y2-y3<0-->00--> 0
# up    y2-y1>0,y2-y3>0-->11--> 0
panel_4 = Panel("""1
-1
0
0""")  # disabled

debug_nulllist = Panel("""{32.045762, 15.39429, 0.0}
{30.049266, -1.959868, 0.0}
{23.752625, -5.0314, 0.0}
{17.763138, -0.116948, 0.0}
{25.902698, 2.801007, 0.0}
{22.984742, 5.718963, 0.0}
{20.988246, 2.954584, 0.0}
{19.45248, 4.643927, 0.0}
{22.831166, 8.944072, 0.0}
{19.606057, 10.172685, 0.0}
{20.681093, 14.779983, 0.0}
{25.902698, 10.326261, 0.0}
{29.43496, 11.708451, 0.0}
{26.209851, 13.858523, 0.0}""")
panel_5 = Panel("""{7.656903, 14.500688, 0.0}
{6.429437, -1.86552, 0.0}
{2.065114, -5.411532, 0.0}
{-5.367872, 0.521218, 0.0}
{1.724152, 5.294696, 0.0}
{-2.435593, 5.840236, 0.0}
{-1.753668, 10.136366, 0.0}""")
panel_6 = Panel("""{7.637584, 15.346381, 0.0}
{9.723192, 10.523412, 0.0}
{7.767934, -3.684795, 0.0}
{-0.8352, 0.095371, 0.0}
{-3.963612, -6.291805, 0.0}
{-5.397468, 7.395, 0.0}
{-0.313798, 15.346381, 0.0}
{2.423563, 12.869721, 0.0}
{2.293213, 3.745185, 0.0}""")
panel_7 = Panel("""{13.520889, -8.730148, 0.0}
{18.347637, 6.082975, 0.0}
{29.847165, 2.335938, 0.0}
{35.515554, 4.31966, 0.0}
{43.489775, -5.183901, 0.0}
{27.158453, -18.887142, 0.0}""")
debug_not_exist_k_4 = Panel("""{-17.271367, -24.586418, 0.0}
{-17.271367, -19.29447, 0.0}
{-9.829566, -19.29447, 0.0}
{-9.829566, -25.744031, 0.0}
{-12.806287, -25.744031, 0.0}
{-12.806287, -27.811198, 0.0}
{-8.423893, -27.811198, 0.0}
{-8.423893, -23.428804, 0.0}
{-5.943292, -23.428804, 0.0}
{-5.943292, -28.638065, 0.0}
{-16.031067, -28.638065, 0.0}
{-16.031067, -25.082538, 0.0}
{-18.941205, -25.082538, 0.0}
{-18.941205, -24.586418, 0.0}""")

debug_k_0 = Panel("""{-9.755299, 10.398894, 0.0}
{4.699989, 10.398894, 0.0}
{-0.287086, 0.580006, 0.0}
{-6.177616, 4.15769, 0.0}""")
debug_k_0_2 = Panel("""{2.750272, -3.270736, 0.0}
{9.77864, -3.270736, 0.0}
{7.959533, -8.89343, 0.0}
{-2.955109, -8.89343, 0.0}
{-0.226449, -6.495516, 0.0}
{4.982812, -6.495516, 0.0}
{6.266878, -4.704845, 0.0}
{3.500091, -4.704845, 0.0}""")

panel_9 = Panel("""{0.933233, -21.042224, 0.0}
{-5.159734, -3.352964, 0.0}
{4.07799, 7.653686, 0.0}
{20.457204, -6.093154, 0.0}
{15.87083, -24.186981, 0.0}
{15.87083, -30.476495, 0.0}
{30.808426, -26.545549, 0.0}
{37.88413, -14.163067, 0.0}
{37.88413, 1.560719, 0.0}
{29.629142, 15.319032, 0.0}
{8.205484, 22.001641, 0.0}
{-4.76664, 29.666987, 0.0}
{-1.213738, 35.679589, 0.0}
{18.622492, 39.6909, 0.0}
{32.7739, 36.546143, 0.0}
{31.414255, 30.42774, 0.0}
{37.491036, 25.539493, 0.0}
{45.260695, 19.28947, 0.0}
{50.856254, -2.370228, 0.0}
{50.856254, -17.307824, 0.0}
{46.72876, -28.117927, 0.0}
{32.970447, -43.448619, 0.0}
{22.443785, -55.178328, 0.0}
{3.684895, -47.969207, 0.0}
{-13.414722, -35.586726, 0.0}
{-13.414722, -27.528285, 0.0}
{-5.497697, -25.151026, 0.0}""")
txt = Text(debug_nulllist)
complex = ComplexComponents(Complex=txt)  # -> Real, Imaginary
lng = ListLength(List=txt)
n = Integer(lng)
x_array = Number(complex.Real)
y_array = Number(complex.Imaginary)
panel_10 = Panel(n)

shift = ShiftList(List=x_array, Shift=1, Wrap=True)
shift_2 = ShiftList(List=y_array, Shift=1, Wrap=True)
pshift = ShiftPaths(Data=shift, Offset=-1)
pshift_2 = ShiftPaths(Data=shift_2, Offset=-1)
subtraction = Subtraction(A=x_array, B=pshift)
subtraction_2 = Subtraction(A=y_array, B=pshift_2)
division = Division(A=subtraction_2, B=subtraction)
k = Number(division)
multiplication = Multiplication(A=x_array, B=k)
subtraction_3 = Subtraction(A=y_array, B=multiplication)
b = Number(subtraction_3)

num = Number("1")
sort = SortList(Keys=y_array)  # -> Keys, ValuesA
finite_distance = Number(num)

y_array_2 = Number(y_array)
x_array_2 = Number(x_array)
y2_after_revise = Number(y_array_2)
x2_after_revise = Number(x_array_2)

shift_3 = ShiftList(List=x2_after_revise, Shift=1, Wrap=True)  # disabled
pshift_3 = ShiftPaths(Data=shift_3, Offset=-1)  # -> graft(Data); disabled
graft = GraftTree(Tree=x2_after_revise, IncludeEmptyLists=True, IncludeNullItems=True)  # disabled
item = ListItem(List=sort.Keys, Index="-1", Wrap=True)  # -> Item, Item1
merge = Merge(Data1=graft, Data2=pshift_3)  # -> simplify(Result); disabled

number_slider = Slider(2, range=0..10)
pt = Point(txt)
pline = PolyLine(Vertices=pt, Closed=True)
points = PointList(Points=txt, Size=number_slider)

subtraction_4 = Subtraction(A=item.Item, B=item.Item1)
division_2 = Division(A=subtraction_4, B=finite_distance)
int = Integer(division_2)
neg = Negative(Value=finite_distance)
addition = Addition(A=int, B=2)
series = Series(Start=item.Item, Step=neg, Count=addition)

# ----
# sort首尾点的y值
shift_4 = ShiftList(List=y2_after_revise, Shift=1, Wrap=True)
pshift_4 = ShiftPaths(Data=shift_4, Offset=-1)  # -> graft(Data)
graft_2 = GraftTree(Tree=y2_after_revise, IncludeEmptyLists=True, IncludeNullItems=True)
merge_2 = Merge(Data1=graft_2, Data2=pshift_4)  # -> simplify(Result)
lng_2 = ListLength(List=merge_2)
series_2 = Series(Start=0, Step=1, Count=lng_2)
int_2 = Integer(series_2)
sort_2 = SortList(Keys=merge_2, ValuesA=int_2)  # -> Keys, ValuesA
num_2 = Number(sort_2.Keys)

y0 = Number(series)

# ----
# debug_k=0
panel_11 = Panel("0")
entwine = Entwine(Branch00=k, Branch01=b, FlattenInputs=True)
equals = Equality(FirstNumber=k, SecondNumber=panel_11)  # -> Equality, Inequality
sift = SiftPattern(List=entwine, SiftPattern=equals.Equality)  # -> Output0, Output1
clean = CleanTree(RemoveNulls=False, RemoveInvalid=True, RemoveEmpty=False, Tree=sift.Output0)
bang = ExplodeTree(Data=clean)  # -> Branch0, Branch1
revise_k = Number(bang.Branch0)
revise_b = Number(bang.Branch1)

cset = CreateSet(List=y2_after_revise)  # -> Set, Map
sort_3 = SortList(Keys=cset.Set)  # -> reverse(Keys), ValuesA

# ----
# {n;m}
# 每条line端点处对应的scanLine的index
# Active_List_of_Side
graft_3 = GraftTree(Tree=reverse(num_2), IncludeEmptyLists=True, IncludeNullItems=True)
num_3 = Number(graft_3)
equals_2 = Equality(FirstNumber=num_3, SecondNumber=sort_3.Keys)  # -> Equality, Inequality
mindex = MemberIndex(Set=equals_2.Equality, Member=Toggle(True))  # -> simplify(Index), Count
pshift_5 = ShiftPaths(Data=mindex.Index, Offset=-1)
item_2 = ListItem(List=pshift_5, Index=0, Wrap=True)  # -> Item, Item1
subtraction_5 = Subtraction(A=item_2.Item1, B=item_2.Item)
series_3 = Series(Start=item_2.Item, Step=1, Count=subtraction_5)
int_3 = Integer(series_3)

panel_12 = Panel(clean)

# ----
# scanLine-->m , line --> n
# {m;n}
# 每条basicScanLine相交的line
graft_4 = GraftTree(Tree=int_3, IncludeEmptyLists=True, IncludeNullItems=True)
path = ConstructPath(Indices=graft_4)  # -> simplify(Branch)
clean_2 = CleanTree(RemoveNulls=True, RemoveInvalid=True, RemoveEmpty=True, Tree=path)
tstat = TreeStatistics(Tree=clean_2)  # -> Paths, Length, Count
dpath = DeconstructPath(Branch=tstat.Paths)
item_3 = ListItem(List=dpath, Index=0, Wrap=True)
viewer = ParamViewer(item_3)
replace = ReplacePaths(Data=item_3, Search=viewer, Replace=flatten(clean_2))

# ----
# 在端点上的扫描线的y值
# scanLine的实例与类的映射关系
shift_5 = ShiftList(List=sort_3.Keys, Shift=[-1, 1], Wrap=False)
y0_2 = Number(y0)
bang_2 = ExplodeTree(Data=shift_5)  # -> Branch0, Branch1
graft_5 = GraftTree(Tree=y0_2, IncludeEmptyLists=True, IncludeNullItems=True)
lng_3 = ListLength(List=bang_2.Branch0)
smaller = SmallerThan(FirstNumber=graft_5, SecondNumber=bang_2.Branch0)  # -> SmallerThan, OrEqualTo
larger = LargerThan(FirstNumber=graft_5, SecondNumber=bang_2.Branch1)  # -> LargerThan, OrEqualTo
scanline_class_count = Integer(lng_3)
and = GateAnd(A=smaller.OrEqualTo, B=larger.LargerThan)
mindex_2 = MemberIndex(Set=and, Member=Toggle(True))  # -> simplify(Index), Count

pt_2 = ConstructPoint(XCoordinate=x2_after_revise, YCoordinate=y2_after_revise, ZCoordinate=0)
points_2 = PointList(Points=flatten(pt_2), Size=number_slider)
panel_13 = Panel(y0_2)
panel_14 = Panel(sort_3.Keys)
panel_15 = Panel(replace)
# scanLine-->m , line --> n
# {m;n}
# 每条scanLine相交的line
int_4 = Integer(replace)
panel_16 = Panel(int_4)

# ----
# 得到不同扫描线区间的最大实际y0
# 对y0进行分组
int_5 = Integer(mindex_2.Index)
tstat_2 = TreeStatistics(Tree=int_4)  # -> Paths, Length, Count
dpath_2 = DeconstructPath(Branch=tstat_2.Paths)
mindex_3 = MemberIndex(Set=flatten(int_5), Member=flatten(dpath_2))  # -> Index, Count
item_4 = ListItem(List=y0_2, Index=mindex_3.Index, Wrap=True)
item_5 = ListItem(List=item_4, Index=0, Wrap=True)

# ----
# member时count需要equal,所以都转成字符串
tstat_3 = TreeStatistics(Tree=int_4)  # -> Paths, Length, Count
dpath_3 = DeconstructPath(Branch=tstat_3.Paths)
join = TextJoin(Text=int_4, Join="t")  # -> flatten(Result)
replace_2 = ReplaceMembers(Set=int_5, Find=flatten(dpath_3), Replace=join)
split = TextSplit(Text=replace_2, Separators="t")  # -> simplify(Result)

b_2 = Number(revise_b)
k_2 = Number(revise_k)
lng_4 = ListLength(List=int_4)
null = NullItem(Item=k_2)  # -> NullFlags, InvalidFlags, Description
x_array_3 = Number(x_array)
item_6 = ListItem(List=b_2, Index=int_4, Wrap=True)
instancescanliney0_count_afterpartition = Integer(graft(mindex_3.Count))
line_count_witheachscanline = Integer(lng_4)
sift_2 = SiftPattern(List=x_array_3, SiftPattern=null.NullFlags)  # -> Output0, Output1
item_7 = ListItem(List=k_2, Index=int_4, Wrap=True)
item_8 = ListItem(List=k_2, Index=int_4, Wrap=True)
subtraction_6 = Subtraction(A=item_5, B=item_6)
int_6 = Integer(int_4)
item_9 = ListItem(List=sift_2.Output1, Index=graft(int_6), Wrap=True)
division_3 = Division(A=subtraction_6, B=item_8)
division_4 = Division(A="1", B=item_7)
combine = CombineData(Input0=item_9, Input1=graft(division_3))  # -> simplify(Result), Index
neg_2 = Negative(Value=division_4)
num_4 = Number(0)
nullrep = ReplaceNulls(Items=neg_2, Replacements=num_4)  # -> Items, Count
unflatten = UnflattenTree(Tree=combine.Result, Guide=division_3)
panel_18 = Panel(item_5)
panel_19 = Panel(combine.Result)

# ----
# debug k not exsit修改series,
# 信手拈来的感觉。。
# 计算最大实际y0的交点
# x=(y-b)/k
# if k = null x = x0
num_5 = Number(unflatten)
num_6 = Number(nullrep.Items)
series_4 = Series(Start=num_5, Step=num_6, Count=instancescanliney0_count_afterpartition)  # -> simplify(Series)

panel_20 = Panel(num_5)
num_7 = Number(series_4)

series_5 = Series(Start=item_5, Step="-1", Count=instancescanliney0_count_afterpartition)  # -> simplify(Series)
multiplication_2 = Multiplication(A=instancescanliney0_count_afterpartition, B=line_count_witheachscanline)
# simplify
repeat = RepeatData(Data=series_5, Length=multiplication_2)
unflatten_2 = UnflattenTree(Tree=repeat, Guide=num_7)

panel_21 = Panel(series_5)
line_count_witheachscanline_2 = Integer(line_count_witheachscanline)
instancescanliney0_count_afterpartition_2 = Integer(instancescanliney0_count_afterpartition)
num_8 = Number(unflatten_2)
panel_22 = Panel("""            {0}
0. 11.102267
1. 11.102267
2. 11.102267
3. 11.102267
4. 11.102267
5. 11.102267
6. 11.102267
            {1}
0. 5.677194
1. 5.677194
2. 5.677194
3. 5.677194
4. 5.677194
5. 5.677194
6. 5.677194""")

instancescanliney0_count_afterpartition_3 = Integer(instancescanliney0_count_afterpartition_2)
line_count_witheachscanline_3 = Integer(line_count_witheachscanline_2)
num_9 = Number(num_8)
num_10 = Number(num_7)

panel_23 = Panel("5")

# ----
# 在gh中无需对左右顶点进行修正
shift_6 = ShiftList(List=y_array, Shift=[-1, 1], Wrap=True)  # disabled
x2_original = Number(x_array)  # disabled
y2_original = Number(y_array)  # disabled
number = Number(shift_6)  # "y1,y3"; disabled
subtraction_7 = Subtraction(A=y2_original, B=number)  # disabled
panel_24 = Panel("0")  # disabled
larger_2 = LargerThan(FirstNumber=subtraction_7, SecondNumber=panel_24)  # -> LargerThan, OrEqualTo; disabled
int_7 = Integer(larger_2.LargerThan)  # disabled
flip = FlipMatrix(Data=int_7)  # disabled
revise_k_2 = Number(revise_k)  # disabled
panel_25 = Panel("1")  # disabled
join_2 = TextJoin(Text=flip)  # disabled
division_5 = Division(A=panel_25, B=revise_k_2)  # disabled

panel_26 = Panel("""10
01
00
11""")  # disabled
replace_3 = ReplaceMembers(Set=join_2, Find=panel_26, Replace=panel_3)  # -> flatten(Result); disabled

multiplication_3 = Multiplication(A=division_5, B=replace_3)  # disabled
addition_2 = Addition(A=y2_original, B=replace_3)  # disabled
addition_3 = Addition(A=x2_original, B=multiplication_3)  # disabled

# ----
# 重新寻找top_y对应的top_x
panel_27 = Panel("1")  # disabled
int_8 = Integer(panel_27)  # disabled
mindex_4 = MemberIndex(Set=sort_2.ValuesA, Member=int_8)  # -> Index, Count; disabled

item_10 = ListItem(List=num_2, Index=0, Wrap=True)  # -> Item, Item1; disabled
lng_5 = ListLength(List=flatten(item_10.Item1))  # disabled
series_6 = Series(Start=0, Step=1, Count=lng_5)  # disabled
sortmethod = Integer(series_6)  # disabled

# ----
# sort较大的y,得到top_y
sort_4 = SortList(Keys=flatten(item_10.Item1), ValuesA=sortmethod)  # -> reverse(Keys), reverse(ValuesA); disabled

graft_6 = GraftTree(Tree=sort_4.ValuesA, IncludeEmptyLists=True, IncludeNullItems=True)  # disabled
path_2 = ConstructPath(Indices=graft_6)  # disabled
item_11 = ListItem(List=flatten(mindex_4.Index), Index=graft_6, Wrap=False)  # disabled
item_12 = TreeItem(Tree=merge, Path=path_2, Index=item_11, Wrap=True)  # disabled
flatten = FlattenTree(Tree=item_12, Path="{0}")  # disabled

top_y_lineindex = Integer(sort_4.ValuesA)  # disabled
top_y = Number(sort_4.Keys)  # disabled

panel_28 = Panel(flatten)  # disabled

# ----
# debug1;1:line连线算法的数据结构不够坚固,排除最特殊的情况
# 每scanLine上的点根据x从左到右排序
tstat_4 = TreeStatistics(Tree=num_10)  # -> Paths, Length, Count
num_11 = Number(num_10)
num_12 = Number(num_9)
item_13 = ListItem(List=tstat_4.Paths, Index=0, Wrap=True)
dpath_4 = DeconstructPath(Branch=item_13)
lng_6 = ListLength(List=dpath_4)
gate = StreamGate(Stream=num_10, Gate=lng_6)  # -> Target0, Target1, Target2
gate_2 = StreamGate(Stream=num_9, Gate=lng_6)  # -> Target0, Target1, Target2
stack = StackData(Data=line_count_witheachscanline_3, Stack=instancescanliney0_count_afterpartition_3)  # -> simplify(graft(Data))
flip_2 = FlipMatrix(Data=gate.Target1)
flip_3 = FlipMatrix(Data=gate_2.Target1)
series_7 = Series(Start=0, Step=1, Count=stack)
item_14 = ListItem(List=flip_2, Index=0, Wrap=True)  # -> Item, Item1
complex_2 = CreateComplex(Real=item_14.Item, Imaginary=flip_3)
complex_3 = CreateComplex(Real=item_14.Item1, Imaginary=flip_3)
ln = Line(StartPoint=complex_2, EndPoint=complex_3)

panel_29 = Panel(num_11)

# ----
# 手工pathMapper
graft_7 = GraftTree(Tree=num_12, IncludeEmptyLists=True, IncludeNullItems=True)
graft_8 = GraftTree(Tree=num_11, IncludeEmptyLists=True, IncludeNullItems=True)
tstat_5 = TreeStatistics(Tree=graft_8)  # -> Paths, Length, Count
dpath_5 = DeconstructPath(Branch=tstat_5.Paths)
item_15 = ListItem(List=dpath_5, Index=0, Wrap=True)  # -> Item, Item1, Item2
viewer_2 = ParamViewer(graft_8)
merge_3 = Merge(Data1=item_15.Item, Data2=item_15.Item2)
path_3 = ConstructPath(Indices=merge_3)
replace_4 = ReplacePaths(Data=graft_8, Search=viewer_2, Replace=flatten(path_3))
replace_5 = ReplacePaths(Data=graft_7, Search=viewer_2, Replace=flatten(path_3))

path_mapper = PathMapper(gate_2.Target2, source="{A;B}(i)", target="{A;i}")
path_mapper_2 = PathMapper(gate.Target2, source="{A;B}(i)", target="{A;i}")

pt_3 = ConstructPoint(XCoordinate=num_10, YCoordinate=num_12, ZCoordinate=0)

sort_5 = SortList(Keys=path_mapper_2, ValuesA=simplify(series_7))  # -> Keys, ValuesA
item_16 = ListItem(List=path_mapper, Index=sort_5.ValuesA, Wrap=True)
partition = PartitionList(List=sort_5.Keys, Size="2")
partition_2 = PartitionList(List=item_16, Size="2")
item_17 = ListItem(List=partition, Index=0, Wrap=True)  # -> Item, Item1
complex_4 = CreateComplex(Real=item_17.Item1, Imaginary=partition_2)
complex_5 = CreateComplex(Real=item_17.Item, Imaginary=partition_2)
ln_2 = Line(StartPoint=complex_5, EndPoint=complex_4)

panel_30 = Panel(ln_2)
