# Grasshopper definition 20161204_tim_graphics_fillArea_flood_fill_001.gh (Grasshopper 0.9.76)

crv = Curve(<curve referenced from the Rhino model>)
explode = Explode(Curve=crv, Recursive=True)  # -> Segments, Vertices
shift = ShiftList(List=explode.Vertices, Shift=-1, Wrap=False)
panel = Panel(shift)
pt = Point([<point referenced from the Rhino model> x38])
pt_2 = PointOriented(BasePlane=PlaneXY(0, 0, 0), UComponent=0, VComponent=0, WComponent=0)
panel_2 = Panel("""{-6.0, 2.0, 0.0}
{2.0, 6.0, 0.0}
{5.0, 4.0, 0.0}
{3.0, 3.0, 0.0}
{2.0, 1.0, 0.0}
{4.0, 0.0, 0.0}
{7.0, 2.0, 0.0}
{8.0, -2.0, 0.0}
{-1.0, -1.0, 0.0}""")
rectangle = Rectangle(Plane=pt, XSize=Domain(0, 1), YSize=Domain(0, 1), Radius=0)  # -> Rectangle, Length
area = Area(Geometry=rectangle.Rectangle)  # -> Area, Centroid
txt = Text(panel_2)
pt_3 = Point(txt)
pline = PolyLine(Vertices=pt_3, Closed=True)
