# Grasshopper definition 20161110_tim_points_区域填充算法_001.gh (Grasshopper 0.9.76)

# ----
# 向量运算部分
genes = GenePool(Decimals=6, Maximum=50, Minimum=0, Value=[8.5769, 12.084605])
genes_2 = GenePool(Decimals=6, Maximum=50, Minimum=0, Value=[9.729951, 4.591837])
panel = Panel("""3
0
0
4""")
num = Number([genes, genes_2])
panel_2 = Panel("""0
1""")
panel_3 = Panel("""0
2""")
item = ListItem(List=num, Index=panel_3, Wrap=False)  # -> Item, Item1
item_2 = ListItem(List=num, Index=panel_3, Wrap=False)  # -> Item, Item1
complex = CreateComplex(Real=item.Item, Imaginary=item.Item1)
pt = PointOriented(BasePlane=PlaneXY(0, 0, 0), UComponent=0, VComponent=0, WComponent=0)
cmod = ComplexModulus(Complex=complex)
panel_4 = Panel("2.angleCos cos = u*v/|u|*|v|")
panel_5 = Panel("1.length:|u|2 = u*u")
cmod_2 = ComplexModulus(Complex=complex)
multiplication = Multiplication(A=item.Item, B=item.Item1)
panel_6 = Panel("3.")
vdis = VectorDisplay(Anchor=pt, Vector=complex)
sqr = Square(Value=cmod)
ma = MassAddition(Input=multiplication)  # -> Result, PartialResults
equals = Equality(FirstNumber=ma.Result, SecondNumber="0")  # -> Equality, Inequality
mm = MassMultiplication(Input=cmod_2)  # -> Result, PartialResults
item_3 = ListItem(List=["非正交", "正交"], Index=equals.Equality, Wrap=True)
division = Division(A=ma.Result, B=mm.Result)
sqr_2 = Square(Value=item.Item)
sqr_3 = Square(Value=item.Item1)
panel_7 = Panel(item_3)
addition = Addition(A=sqr_2, B=sqr_3)

# ----
# log:区域填充算法
# 20161110:
# 向量几何公式的gh实现
# 向量乘积：点积，差积，行列式
# 向量需要用时候再学习
# 
# 扫描线填色算法gh实现:
# n,x_array,y_array的形式给出多边形
# 扫描线给定有限元finite_distance从上而下求交点
panel_8 = Panel("""{7.656903, 14.500688, 0.0}
{6.429437, -1.86552, 0.0}
{2.065114, -5.411532, 0.0}
{-5.367872, 0.521218, 0.0}
{1.724152, 5.294696, 0.0}
{-2.435593, 5.840236, 0.0}
{-1.753668, 10.136366, 0.0}""")
complex_2 = ComplexComponents(Complex=panel_8)  # -> Real, Imaginary
lng = ListLength(List=panel_8)
finite_distance = Number(Slider(0.54423, range=0..1))
x_array = Number(complex_2.Real)
n = Integer(lng)
y_array = Number(complex_2.Imaginary)
pt_2 = Point(panel_8)
panel_9 = Panel(n)
sort = SortList(Keys=y_array)  # -> Keys, ValuesA
pline = PolyLine(Vertices=pt_2, Closed=True)
points = PointList(Points=panel_8, Size=Slider(3, range=0..10))
item_4 = ListItem(List=sort.Keys, Index="-1", Wrap=True)  # -> Item, Item1
subtraction = Subtraction(A=item_4.Item, B=item_4.Item1)
neg = Negative(Value=finite_distance)
division_2 = Division(A=subtraction, B=finite_distance)
series = Series(Start=item_4.Item, Step=neg, Count=division_2)
panel_10 = Panel(series)
