# Grasshopper definition for_if_1.gh (Grasshopper 0.9.76)
# plug-ins: Python Interpreter

series = Series(Start=0, Step=1, Count=10)
data = Data([3.2, 4.3, 4.6, 6.5, 3.5, 8.1, 9.4, 2.6, 7.3, 2.3, 2.9, 8.6, 4.9, 1, 0.7, 0.1, 0.9, 9.4, 7.4, 7.6, 3.6, 8.5, 10, 4.6, 3.7, 0])
python = PythonScript()  # -> out, a
# ---------- python: Python ----------
for i in range(10):
    print (i)
    if i == 7:
        print ("quit")
        break

i = 0        
while True:
    print (i)
    i += 1
    if i == 8:
        print ("quit")
        break
# ---------- end python ----------
bnd = Bounds(Numbers=series)
python_2 = PythonScript(x=data)  # -> out, a, b, c, d; inputs x: list
# ---------- python_2: Python ----------
a = []
b = []
c = []
d = []

for i in x:
    if 0<=i<2.5:
        a.append(i)
    elif 2.5<=i<5.0:
        b.append(i)
    elif 5.0<=i<7.5:
        c.append(i)
    else:
        d.append(i)
# ---------- end python_2 ----------
bnd_2 = Bounds(Numbers=data)
python_3 = PythonScript()  # -> out, a
# ---------- python_3: Python ----------
for i in range(0,10):
    if i==3:
        print ("i=3")
        continue #跳过这次循环
    print (i)
# ---------- end python_3 ----------
panel = Panel(bnd)
panel_2 = Panel(python_2.b)
panel_3 = Panel(python_2.d)
panel_4 = Panel(python_2.a)
panel_5 = Panel(python_2.c)
python_4 = PythonScript()  # -> out, a
# ---------- python_4: Python ----------
import rhinoscriptsyntax as rs

a = []
for i in rs.frange(0,1000,1.2):
    a.append(i)
# ---------- end python_4 ----------
panel_6 = Panel(bnd_2)
python_5 = PythonScript()  # -> out, a
# ---------- python_5: Python ----------
a = []
for i in xrange(0,5000,2):
    a.append(i)
# ---------- end python_5 ----------
bnd_3 = Bounds(Numbers=panel_3)
bnd_4 = Bounds(Numbers=panel_2)
bnd_5 = Bounds(Numbers=panel_4)
bnd_6 = Bounds(Numbers=panel_5)
panel_7 = Panel(bnd_4)
panel_8 = Panel(bnd_3)
panel_9 = Panel(bnd_5)
panel_10 = Panel(bnd_6)
python_6 = PythonScript(j=Slider(1, range=0..1))  # -> out, a, b; inputs j: Int32
# ---------- python_6: Python ----------
import rhinoscriptsyntax as rs
import math


#定义一个空列表来收集生成的点
pts = []
#进行循环
for i in xrange(500):
    if j == 0:
        y = math.cos(i*0.1)*i*0.1
        x = math.sin(i*0.1)*i*0.08
    else:
        x = math.cos(i*0.1)*i*0.1
        y = math.sin(i*0.1)*i*0.08
    #对z值进行了判断生成。当i小于200的时候z = z - i*0.05否则z = 20-i*0.05
    if i<200:
        z = i*0.05
    else :
        z = 20-i*0.05
    #最后用x，y，z坐标生成点
    pt = rs.AddPoint(x,y,z)
    #收集每次循环生成的p点
    pts.append(pt)
    
a = pts
b = rs.AddCurve(a)
# ---------- end python_6 ----------
panel_11 = Panel(python_6.a)
