# Grasshopper definition fractal_Koch.gh (Grasshopper 0.9.76)
# plug-ins: Python Interpreter

line = Line(Line((-12.48206816, -4.1214376, 0), (11.65778064, -4.1214376, 0)))
# Doubleclick Me!
python = PythonScript()  # -> out, a; inputs iteration: Int32
# ---------- python: Python ----------
#fact.py

#递归函数 没有出现for...in循环 只是迭代自身
def GetFact(n):
    if n==1:
        return 1
    else:
        return n * GetFact(n-1)

a = GetFact(5)
print (a)
# ---------- end python ----------
python_2 = PythonScript(line=line, iteration=Slider(4, range=0..10), ratio=Slider(0.25, range=0..1))  # -> out, a; inputs iteration: Int32
# ---------- python_2: Python ----------
#fractal_tree.py

import rhinoscriptsyntax as rs
outputlines = []
outputlines.append(line)
#上面两句是初始化参数
def Koch(Lins_List,t,gen):
    #进行判断一下，迭代为一次的时候直接返回
    if gen == 1:
        return Lins_List
    else:
        arrlines = []
        #定义一个列表来装生成的参数
        for i in Lins_List:
            #遍历每一条曲线
            #分析point和vector都没有被add
            Pt_start =rs.CurveStartPoint(i)
            Pt_mid = rs.CurveMidPoint(i)
            Pt_end = rs.CurveEndPoint(i)
            new_t1 = rs.CurveDomain(i)[1] * t #return list
            #print (rs.CurveDomain(i)) [0.0, 24.139848797838802]
            Pt2 = rs.EvaluateCurve(i,new_t1) #return 3-D point
            new_t2 = rs.CurveDomain(i)[1] -new_t1
            Pt3 = rs.EvaluateCurve(i,new_t2)
            #得到起点，终点，中，1/4 3/4的点
            
            vec_tan = rs.VectorCreate(Pt2,Pt_mid)
            #创建旋转向量
            Rovec = rs.VectorCreate((0,0,0),(0,0,1))
            #print (Rovec) #0,0,-1
            #创建旋转轴
            new_vec = rs.VectorRotate(vec_tan,90,Rovec)
            #print (new_vec) #0,6.0349621994597,0
            #旋转得到向量
            new_mid = rs.PointAdd(Pt_mid,new_vec)
            #PointAdd是什么意思 两个3d-vector or 3d-point 之和
            #AddPoint是按坐标添加点
            #print (new_mid) #-0.4121437599631,1.91352459982869,0
            arrlines.append(rs.AddLine(Pt_start,Pt2))# 只是add需要的curve
            arrlines.append(rs.AddLine(Pt2,new_mid))
            arrlines.append(rs.AddLine(new_mid,Pt3))
            arrlines.append(rs.AddLine(Pt3,Pt_end))
        return Koch(arrlines,t,gen -1)
        #递归
        
a = Koch(outputlines,ratio,iteration)
# ---------- end python_2 ----------
