# Grasshopper definition fractal_Koch_0002.gh (Grasshopper 0.9.76)
# plug-ins: Python Interpreter

line = Line(Line((-324.5749381, 3.626459244, 0), (-114.5809403, 3.626459244, 0)))
python = PythonScript(line=line, iteration=Slider(5, range=0..10), ratio=Slider(0.24, range=0..1))  # -> out, a; inputs iteration: Int32
# ---------- python: Python ----------
import rhinoscriptsyntax as rs
#from Rhino.Geometry import Line as rgl
import Rhino.Geometry as rg
outputlines = []
outputlines.append(line)
#初始化参数


def Fractal(Lins_list,t,gen):
    if gen == 1:
        return Lins_list
    else:
        
        arrlines = []
        #定义一个列表来装生成的参数
        for line in Lins_list:
            #print (type(line))
            start_pt = rs.CurveStartPoint(line)
            end_pt   = rs.CurveEndPoint(line)
            mid_pt   = rs.CurveMidPoint(line)
            """
            new_t1  = rs.CurveDomain(line)[1]*t
            print (rs.CurveDomain(line,t))
            new_t2  = rs.CurveDomain(line)[1]-new_t1
            pt2      = rs.EvaluateCurve(line,new_t1)
            pt3      = rs.EvaluateCurve(line,new_t2)
            当用了Rhino.Germetry.Line 中的method PointAt之后，省了很多代码
            """
            line = rs.coerceline(line,False)
            pt2 = rg.Line.PointAt(line,t)
            pt3 = rg.Line.PointAt(line,1-t)
            #得到端点和等分点
            #接下来旋转得到分形点
            vect = rs.VectorCreate(mid_pt,pt2)
            axis = rs.VectorCreate((0,0,0),(0,0,1))
            vect_pt = rs.VectorRotate(vect,-90,axis)
            newPt = rs.PointAdd(mid_pt,vect_pt)
            
            #连线
            arrlines.append(rs.AddLine(start_pt,pt2))
            arrlines.append(rs.AddLine(pt2,newPt))
            arrlines.append(rs.AddLine(newPt,pt3))
            arrlines.append(rs.AddLine(pt3,end_pt))
            
            #rg.Line()
        return Fractal(arrlines,t,gen-1)
        
a = Fractal(outputlines,ratio,iteration)
# ---------- end python ----------
