# Grasshopper definition guid_Geometry.gh (Grasshopper 0.9.76)
# plug-ins: Python Interpreter

pt = Point(Point(154, 50, 0))
pt_2 = Point(Point(136, 4, 0))
python = PythonScript(pt1=pt, pt2=pt_2)  # -> out, guid_line2, c
# ---------- python: Python ----------
import rhinoscriptsyntax as rs
import Rhino.Geometry as rg
import scriptcontext as sc

pt3 = rs.AddPoint((10,10,0))
print (type(pt3)) 
#<type 'Guid'>

pt4 = rg.Point3d(20,20,0)
print (type(pt4))
#<type 'Point3d'>

line1 = rs.AddLine(pt1,pt2)
print (type(line1))
#<type 'Guid'>

new_pt3 = rs.coerce3dpoint(pt3)
print (type(new_pt3))
#<type 'Point3d'> 通过coerce3dpoint把guid转换成Point3d

line2 = rg.Line(pt4,new_pt3)
print (type(line2))
#<type 'Line'>

guid_line2 = sc.doc.Objects.AddLine(line2) #实例化
print (type(guid_line2))
#<type 'Guid'> 通过sc.doc.Objects.AddPoint转换成guid
# ---------- end python ----------
