# Grasshopper definition list_DataTree.gh (Grasshopper 0.9.76)
# plug-ins: Python Interpreter

python = PythonScript()  # -> out, d, d1
# ---------- python: Python ----------
a = [i+2 for i in range(10)]
print (a)

b = []
for i in range(10):
    b.append(i+2)
print (b)

c = [i for i in range(10) if i%2 == 0]
print (c)

c1 = []
for i in range(10):
    if i%2 == 0:
        c1.append(i)
        
print (c1)

d = [(x,y) for x in range(10) if x%2==0 for y in range(10) if y%2 != 0]
print (d)

d1 = []
for x in range(10):
    for y in range(10):
        if x%2==0 and y%2 !=0:
            d1.append((x,y))
            
print (d1)
# ---------- end python ----------
panel = Panel(python.d)
panel_2 = Panel(python.d1)
panel_3 = Panel("""A
B
C
D
E""")
panel_4 = Panel("""1
2
3
4
5""")
python_2 = PythonScript(x=panel_4, y=panel_3)  # -> out, A, B, a; inputs x: list, y: list
# ---------- python_2: Python ----------
from Grasshopper.Kernel.Data import GH_Path
from Grasshopper import DataTree 

pts = DataTree[str]()
A = [ i+j for i in x for j in y]#后面的是内层循环
B = [[ i+j for i in x ]for j in y]#前面的是内层循环，颠倒
for i in xrange(len(B)):
    path = GH_Path(i)
    pts.AddRange(B[i],path)


a = pts
print (B)

#A  =[i+j for i in x for j in y]
A1 = []
for i in x:
    inter_A1 = []
    for j in y:
        inter_A1.append((i+j))
    A1.append(inter_A1)
    
print (A1)

#B = [[i + j for i in x ]for j in y] 并不是内循环
B1 = []
for i in y:
    inter_B1 = []
    for j in x:
        inter_B1.append(i+j)
    B1.append(inter_B1)
print (B1)
# ---------- end python_2 ----------
python_3 = PythonScript()  # -> out, a, tree
# ---------- python_3: Python ----------
a = [[(x,y) for y in range(10) if y%2 != 0]for x in range(10) if x%2 ==0]
print (a)


a1 = []
for x in range(10):
    if x%2 == 0:
        inter_list = []
        for y in range(10):
            if y%2 != 0:
                inter_list.append((x,y))
        a1.append(inter_list)
                
print (a1)

#树形结构就是list中嵌套list
from Grasshopper.Kernel.Data import GH_Path
from Grasshopper import DataTree

tree = DataTree[object]()
a = [[(x,y) for y in range(10) if y%2 != 0]for x in range(10) if x%2 == 0]

for i in xrange(len(a)):
    path = GH_Path(i) #数据结构标签
    tree.AddRange(a[i],path) #内容
# ---------- end python_3 ----------
panel_5 = Panel(python_2.a)
panel_6 = Panel(python_2.A)
panel_7 = Panel(python_3.tree)
panel_8 = Panel(python_3.a)
