# Grasshopper definition meshFromPoints.gh (Grasshopper 0.9.76)
# plug-ins: Python Interpreter

number_slider = Slider(49, range=0..100)
pt = Point([Point(11.25368554, 11.36419098, 0), Point(9.521123637, 31.1811859, 0), Point(22.58375817, 37.2444573, 0), Point(37.83069376, 6.837197612, 0)])
python = PythonScript(x=number_slider, y=Slider(50, range=0..100), pointList=pt, z=Slider(18, range=0..100))  # -> out, a, b; inputs x: Int32, y: Int32, pointList: list
# ---------- python: Python ----------
import rhinoscriptsyntax as rs
import math
import System.Drawing as sd

a = []
b = [] 
area = 9
for i in xrange(x):
    for j in xrange(y):
        #建立网格中的点 
        pt = rs.AddPoint(i,j,0)
        
        pt_z = 0
        rgb = (255,255,255)
        for point in pointList:
            dist = rs.Distance(point,pt)
            if dist <= area:
                
                pt_z = z*(math.exp(-0.05*2*dist**2))
                rgb = (abs(255-dist*5),abs(255-dist*3),200) 
        
        new_pt = rs.AddPoint(i,j,pt_z)
        a.append(new_pt)
        b.append(sd.Color.FromArgb(rgb[0],rgb[1],rgb[2]))
# ---------- end python ----------
srfgrid = SurfaceFromPoints(Points=python.a, UCount=number_slider, Interpolate=False)
