# Grasshopper definition offset1.gh (Grasshopper 0.9.76)

pline = PolyLine(
    Vertices=[Point(27, -4, 0), Point(27, 15, 0), Point(32, 15, 0), Point(32, 5, 0), Point(38, 5, 0), Point(38, 1, 0), Point(30, 1, 0), Point(30, -4, 0), Point(27, -4, 0)],
    Closed=False)
pline_2 = PolyLine(
    Vertices=[Point(6, 27, 0), Point(6, 33, 0), Point(12, 33, 0), Point(12, 40, 0), Point(25, 40, 0), Point(25, 54, 0), Point(33, 54, 0), Point(33, 50, 0), Point(69, 50, 0), Point(69, 46, 0)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],
    Closed=False)
pline_3 = PolyLine(
    Vertices=[Point(27, 15, 0), Point(32, 15, 0), Point(32, 5, 0), Point(38, 5, 0), Point(38, 1, 0), Point(30, 1, 0), Point(30, -4, 0), Point(27, -4, 0), Point(27, 15, 0)],
    Closed=False)
pline_4 = PolyLine(
    Vertices=[Point(31, -11, 0), Point(31, -7, 0), Point(39, -7, 0), Point(39, 2, 0), Point(47, 2, 0), Point(47, -11, 0), Point(41, -11, 0), Point(41, -15, 0), Point(53, -15, 0), Point(53, -20, 0), Point(25, -20, 0), Point(25, -11, 0), Point(31, -11, 0)],
    Closed=False)
explode = Explode(Curve=pline_3, Recursive=True)  # -> Segments, Vertices
panel = Panel("""点序问题
偏移梯度问题
偏移量最大后的点堆栈问题""")
pt = Point(explode.Vertices)
shift = ShiftList(List=pt, Shift=-1, Wrap=False)
pt3 = Point([Point(31, -11, 0), Point(31, -7, 0), Point(39, -7, 0), Point(39, 2, 0), Point(47, 2, 0), Point(47, -11, 0), Point(41, -11, 0), Point(41, -15, 0), Point(53, -15, 0), Point(53, -20, 0), Point(25, -20, 0), Point(25, -11, 0)])
pt1 = Point([Point(5, 5, 0), Point(13, 5, 0), Point(13, 15, 0), Point(18, 15, 0), Point(18, -4, 0), Point(15, -4, 0), Point(15, 1, 0), Point(5, 1, 0)])
pt2 = Point([Point(6, 27, 0), Point(6, 33, 0), Point(12, 33, 0), Point(12, 40, 0), Point(25, 40, 0), Point(25, 54, 0), Point(33, 54, 0), Point(33, 50, 0), Point(69, 50, 0), Point(69, 46, 0)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])
pt5 = Point([Point(27, -4, 0), Point(27, 15, 0), Point(32, 15, 0), Point(32, 5, 0), Point(38, 5, 0), Point(38, 1, 0), Point(30, 1, 0), Point(30, -4, 0)])
pt4 = Point([Point(27, -4, 0), Point(30, -4, 0), Point(30, 1, 0), Point(38, 1, 0), Point(38, 5, 0), Point(32, 5, 0), Point(32, 15, 0), Point(27, 15, 0)])
pt5_2 = Point([Point(27, 15, 0), Point(32, 15, 0), Point(32, 5, 0), Point(38, 5, 0), Point(38, 1, 0), Point(30, 1, 0), Point(30, -4, 0), Point(27, -4, 0)])
pt1_2 = Point([Point(5, 1, 0), Point(5, 5, 0), Point(13, 5, 0), Point(13, 15.77581432, 0), Point(18.15627629, 15.77581432, 0), Point(18.15627629, -4.990313619, 0), Point(14.93047001, -4.990313619, 0), Point(14.93047001, 1.009686381, 0), Point(5, 1, 0)])
testpts = Point(pt1)
shift_2 = ShiftList(List=testpts, Shift=1, Wrap=True)
pline_5 = PolyLine(Vertices=pt1_2, Closed=False)
explode_2 = Explode(Curve=pline_5, Recursive=True)  # -> Segments, Vertices
pline_6 = PolyLine(Vertices=testpts, Closed=True)
points = PointList(Points=testpts, Size=Slider(1.22, range=0..10))
len = Length(Curve=explode_2.Segments)
item = ListItem(List=testpts, Index=0, Wrap=True)
subtraction = Subtraction(A=shift_2, B=testpts)
num = Number(len)
panel_2 = Panel("输入一组向量vectors,初始点firstPt")
panel_3 = Panel("梯度数据结构算法")
panel_4 = Panel("""10,0
0-1,1
-10,2
01,3 """)
panel_5 = Panel("标准正交向量序转换")
# + key/value 一个key值对应一个value值
# + 按照value值从小到大排序
# + 每次输入两个key,比较value大小, 删除比较小value对应key序小的key,比较大value对应key序大的key.
# + 输入的key值必须是存在的, 没有被删除
number_slider = Slider(8, range=0..10)
pt_2 = Point(item)
vec = Vector(subtraction)
veclst = Vector(vec)
unit = UnitVector(Vector=veclst)
convertrule = Text(panel_4)
panel_6 = Panel("""4,6
1,7
2,4
3,7
0,4
1,5
3,5""")
complex = ComplexComponents(Complex=unit)  # -> Real, Imaginary
series = Series(Start=0, Step=1, Count=number_slider)
num_2 = Number(flatten([4, 8, 10.77581432, 5.156276294, 20.76612794, 3.225806282, 6, 9.930474736]))
split = TextSplit(Text=convertrule, Separators=",")
int = Integer(complex.Real)
int_2 = Integer(complex.Imaginary)
panel_7 = Panel("顺逆时针判断")
item_2 = ListItem(List=split, Index=0, Wrap=False)  # -> Item, Item1
txt = Text(panel_6)
ma = MassAddition(Input=vec)  # -> Result, PartialResults
concat = Concatenate(FragmentA=int, FragmentB=int_2)
num_3 = Number(num_2)
split_2 = TextSplit(Text=txt, Separators=",")
addition = Addition(A=pt_2, B=ma.PartialResults)
replace = ReplaceMembers(Set=concat, Find=flatten(item_2.Item), Replace=flatten(item_2.Item1))
panel_8 = Panel(split_2)
sort = SortList(Keys=num_3, ValuesA=series)  # -> Keys, ValuesA
item_3 = ListItem(List=num_3, Index=split_2, Wrap=True)
panel_9 = Panel(series)
item_4 = ListItem(List=split_2, Index=0, Wrap=True)  # -> Item, Item1
unit_veclst = Integer(replace)
unit_veclst_2 = Integer(unit_veclst)
shift_3 = ShiftList(List=unit_veclst_2, Shift=1, Wrap=True)
vec1_num = Integer(unit_veclst_2)
vec2_num = Integer(shift_3)
merge = Merge(Data1=flatten(pt_2), Data2=flatten(addition))
item_5 = ListItem(List=item_3, Index=0, Wrap=False)  # -> Item, Item1
panel_10 = Panel(unit_veclst)
subtraction_2 = Subtraction(A=vec1_num, B=vec2_num)
panel_11 = Panel(sort.Keys)
panel_12 = Panel("-3,1-> 逆时针 --> true")
subtraction_3 = Subtraction(A=item_4.Item1, B=item_4.Item)
ptlst = Point(merge)
panel_13 = Panel("""-3
1""")
# 小值key向前, 大值key向后
# False -> 中间
# True -> 两边
smaller = SmallerThan(FirstNumber=item_5.Item, SecondNumber=item_5.Item1)  # -> SmallerThan, OrEqualTo
equals = Equality(FirstNumber=subtraction_2, SecondNumber=graft(panel_13))  # -> simplify(Equality), Inequality
panel_14 = Panel("""01,0
00,1
10,0
11,-1""")
bang = ExplodeTree(Data=equals.Equality)  # -> Branch0, Branch1
offset_convertrule = Text(panel_14)
addition_2 = Addition(A=subtraction_3, B="-1")
or = GateOr(A=bang.Branch0, B=bang.Branch1)
int_3 = Integer(or)
shift_4 = ShiftList(List=int_3, Shift=1, Wrap=True)
addition_3 = Addition(A=item_4.Item1, B="-1")
vec1_num_2 = Integer(int_3)
vec2_num_2 = Integer(shift_4)
series_2 = Series(Start=addition_3, Step="-1", Count=addition_2)
split_3 = TextSplit(Text=offset_convertrule, Separators=",")
panel_15 = Panel(addition_2)
panel_16 = Panel(or)
concat_2 = Concatenate(FragmentA=vec1_num_2, FragmentB=vec2_num_2)
item_6 = ListItem(List=split_3, Index=0, Wrap=False)  # -> Item, Item1
panel_17 = Panel(smaller.SmallerThan)
replace_2 = ReplaceMembers(Set=concat_2, Find=flatten(item_6.Item), Replace=flatten(item_6.Item1))
shift_5 = ShiftList(List=replace_2, Shift=-1, Wrap=True)
fst_offsetindex = Integer("0")
ma_2 = MassAddition(Input=shift_5)  # -> Result, PartialResults
addition_4 = Addition(A=fst_offsetindex, B=ma_2.PartialResults)
int_4 = Integer("4")
int_5 = Integer("0")
panel_18 = Panel("""0,2
1,3
2,0
3,1""")
panel_19 = Panel("""1,-1
-1,-1
-1,1
1,1""")
replace_3 = ReplaceMembers(Set=addition_4, Find=int_4, Replace=int_5)  # -> flatten(Result)
panel_20 = Panel("""偏移向量机制
+ 编号
+ 内外""")
offsetdirectioninverserule = Text(panel_18)
merge_2 = Merge(Data1=fst_offsetindex, Data2=replace_3)
offsetinstance_num = Number(Slider(3.506, range=0..10))
offset_veclst = Vector(panel_19)
offsetdirection = Boolean(Toggle(False))
offset_indexlst = Integer(merge_2)
offset_indexlst_2 = Integer(offset_indexlst)
split_4 = TextSplit(Text=offsetdirectioninverserule, Separators=",")
int_6 = Integer(split_4)
gate = StreamGate(Stream=offset_indexlst_2, Gate=offsetdirection)  # -> Target0, Target1
item_7 = ListItem(List=int_6, Index=0, Wrap=True)  # -> flatten(Item), flatten(Item1)
ptlst_2 = Point(ptlst)
replace_4 = ReplaceMembers(Set=gate.Target1, Find=item_7.Item, Replace=item_7.Item1)
filter = StreamFilter(Gate=offsetdirection, Stream0=offset_indexlst_2, Stream1=replace_4)
item_8 = ListItem(List=offset_veclst, Index=filter, Wrap=False)
amp = Amplitude(Vector=item_8, Amplitude=offsetinstance_num)
addition_5 = Addition(A=ptlst_2, B=amp)
pline_7 = PolyLine(Vertices=addition_5, Closed=False)
