# Grasshopper definition offset2.gh (Grasshopper 0.9.76)
# plug-ins: Python Interpreter

pline = PolyLine(
    Vertices=[Point(27, -4, 0), Point(27, 15, 0), Point(32, 15, 0), Point(32, 5, 0), Point(38, 5, 0), Point(38, 1, 0), Point(30, 1, 0), Point(30, -4, 0), Point(27, -4, 0)],
    Closed=False)
pline_2 = PolyLine(
    Vertices=[Point(6, 27, 0), Point(6, 33, 0), Point(12, 33, 0), Point(12, 40, 0), Point(25, 40, 0), Point(25, 54, 0), Point(33, 54, 0), Point(33, 50, 0), Point(69, 50, 0), Point(69, 46, 0)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],
    Closed=False)
pline_3 = PolyLine(
    Vertices=[Point(27, 15, 0), Point(32, 15, 0), Point(32, 5, 0), Point(38, 5, 0), Point(38, 1, 0), Point(30, 1, 0), Point(30, -4, 0), Point(27, -4, 0), Point(27, 15, 0)],
    Closed=False)
pline_4 = PolyLine(
    Vertices=[Point(31, -11, 0), Point(31, -7, 0), Point(39, -7, 0), Point(39, 2, 0), Point(47, 2, 0), Point(47, -11, 0), Point(41, -11, 0), Point(41, -15, 0), Point(53, -15, 0), Point(53, -20, 0), Point(25, -20, 0), Point(25, -11, 0), Point(31, -11, 0)],
    Closed=False)
explode = Explode(Curve=pline_3, Recursive=True)  # -> Segments, Vertices
panel = Panel("""点序问题
偏移梯度问题
偏移量最大后的点堆栈问题""")
pt = Point(explode.Vertices)
shift = ShiftList(List=pt, Shift=-1, Wrap=False)
pt3 = Point([Point(31, -11, 0), Point(31, -7, 0), Point(39, -7, 0), Point(39, 2, 0), Point(47, 2, 0), Point(47, -11, 0), Point(41, -11, 0), Point(41, -15, 0), Point(53, -15, 0), Point(53, -20, 0), Point(25, -20, 0), Point(25, -11, 0)])
pt1 = Point([Point(5, 5, 0), Point(13, 5, 0), Point(13, 15, 0), Point(18, 15, 0), Point(18, -4, 0), Point(15, -4, 0), Point(15, 1, 0), Point(5, 1, 0)])
pt2 = Point([Point(6, 27, 0), Point(6, 33, 0), Point(12, 33, 0), Point(12, 40, 0), Point(25, 40, 0), Point(25, 54, 0), Point(33, 54, 0), Point(33, 50, 0), Point(69, 50, 0), Point(69, 46, 0)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])
pt5 = Point([Point(27, -4, 0), Point(27, 15, 0), Point(32, 15, 0), Point(32, 5, 0), Point(38, 5, 0), Point(38, 1, 0), Point(30, 1, 0), Point(30, -4, 0)])
pt4 = Point([Point(27, -4, 0), Point(30, -4, 0), Point(30, 1, 0), Point(38, 1, 0), Point(38, 5, 0), Point(32, 5, 0), Point(32, 15, 0), Point(27, 15, 0)])
pt5_2 = Point([Point(27, 15, 0), Point(32, 15, 0), Point(32, 5, 0), Point(38, 5, 0), Point(38, 1, 0), Point(30, 1, 0), Point(30, -4, 0), Point(27, -4, 0)])
testpts = Point(pt1)
shift_2 = ShiftList(List=testpts, Shift=1, Wrap=True)
pline_5 = PolyLine(Vertices=testpts, Closed=True)
item = ListItem(List=testpts, Index=0, Wrap=True)
subtraction = Subtraction(A=shift_2, B=testpts)
panel_2 = Panel("输入一组向量vectors,初始点firstPt")
panel_3 = Panel("""10,0
0-1,1
-10,2
01,3 """)
panel_4 = Panel("标准正交向量序转换")
panel_5 = Panel("反矢间距排序")
# + key/value 一个key值对应一个value值
# + 按照value值从小到大排序
# + 每次输入两个key,比较value大小, 删除比较小value对应key序小的key,比较大value对应key序大的key.
# + 输入的key值必须是存在的, 没有被删除
panel_6 = Panel("梯度数据结构算法")
pt_2 = Point(item)
vec = Vector(subtraction)
veclst = Vector(vec)
unit = UnitVector(Vector=veclst)
convertrule = Text(panel_3)
complex = ComplexComponents(Complex=unit)  # -> Real, Imaginary
pt1_2 = Point([Point(5, 1, 0), Point(5, 5, 0), Point(13, 5, 0), Point(13, 15, 0), Point(18, 15, 0), Point(18, -4, 0), Point(15, -4, 0), Point(15, 1, 0)])
points = PointList(Points=pt1_2, Size=Slider(2.41, range=0..10))
pointlst = Point(pt1_2)
split = TextSplit(Text=convertrule, Separators=",")
complex_2 = ComplexComponents(Complex=graft(pointlst))  # -> Real, Imaginary
int = Integer(complex.Real)
int_2 = Integer(complex.Imaginary)
panel_7 = Panel("顺逆时针判断")
item_2 = ListItem(List=split, Index=0, Wrap=False)  # -> Item, Item1
ma = MassAddition(Input=vec)  # -> Result, PartialResults
concat = Concatenate(FragmentA=int, FragmentB=int_2)
merge = Merge(Data1=complex_2.Real, Data2=complex_2.Imaginary)  # -> simplify(Result)
addition = Addition(A=pt_2, B=ma.PartialResults)

pointlst_2 = Point(pt1_2)
shift_3 = ShiftList(List=pointlst_2, Shift=[1, 0], Wrap=True)
flip = FlipMatrix(Data=shift_3)
item_3 = ListItem(List=flip, Index=0, Wrap=True)  # -> Item, Item1
subtraction_2 = Subtraction(A=item_3.Item, B=item_3.Item1)
pshift = ShiftPaths(Data=subtraction_2, Offset=-1)
panel_8 = Panel("标准向量转换")
vec_2 = Vector(unitize(pshift))
panel_9 = Panel("""10,0
0-1,1
-10,2
01,3""")
complex_3 = ComplexComponents(Complex=vec_2)  # -> Real, Imaginary
txt = Text(panel_9)
int_3 = Integer(complex_3.Real)
int_4 = Integer(complex_3.Imaginary)
split_2 = TextSplit(Text=txt, Separators=",")
concat_2 = Concatenate(FragmentA=int_3, FragmentB=int_4)
item_4 = ListItem(List=split_2, Index=0, Wrap=True)  # -> Item, Item1
replace = ReplaceMembers(Set=concat_2, Find=flatten(item_4.Item), Replace=flatten(item_4.Item1))
veclst_2 = Vector(pshift)
endpt = Point(item_3.Item)
startpt = Point(item_3.Item1)
int_5 = Integer(replace)

veclst_3 = Vector(veclst_2)
endpt_2 = Point(endpt)
int_6 = Integer(int_5)
startpt_2 = Point(startpt)
vlen = VectorLength(Vector=veclst_3)
mod = Modulus(A=int_6, B=2)
not = GateNot(A=mod)  # -> graft(Result)
lng = ListLength(List=int_6)
replace_2 = ReplaceMembers(Set=concat, Find=flatten(item_2.Item), Replace=flatten(item_2.Item1))
panel_10 = Panel(merge)
series = Series(Start=0, Step=1, Count=lng)
item_5 = ListItem(List=merge, Index=not, Wrap=True)  # -> flatten(Item)
panel_11 = Panel("""1,3->1->x
2,4->0->y""")
unit_veclst = Integer(replace_2)
unit_veclst_2 = Integer(unit_veclst)
shift_4 = ShiftList(List=unit_veclst_2, Shift=1, Wrap=True)
vec1_num = Integer(unit_veclst_2)
vec2_num = Integer(shift_4)
merge_2 = Merge(Data1=flatten(pt_2), Data2=flatten(addition))
int_7 = Integer(int_6)
int_8 = Integer(series)
panel_12 = Panel(unit_veclst)
vec_xory = Number(item_5)
subtraction_3 = Subtraction(A=vec1_num, B=vec2_num)
panel_13 = Panel("-3,1-> 逆时针 --> true")
ptlst = Point(merge_2)
concat_3 = Concatenate(FragmentA=int_8, FragmentB=int_7, JoinSeparator=",")
panel_14 = Panel(item_5)
panel_15 = Panel("""-3
1""")
panel_16 = Panel(subtraction_2)
panel_17 = Panel(concat_3)
equals = Equality(FirstNumber=subtraction_3, SecondNumber=graft(panel_15))  # -> simplify(Equality), Inequality
panel_18 = Panel("""01,0
00,1
10,0
11,-1""")
bang = ExplodeTree(Data=equals.Equality)  # -> Branch0, Branch1
dispatch = Dispatch(List=vec_xory, DispatchPattern=mod)  # -> ListA, ListB
dispatch_2 = Dispatch(List=concat_3, DispatchPattern=mod)  # -> ListA, ListB
offset_convertrule = Text(panel_18)
or = GateOr(A=bang.Branch0, B=bang.Branch1)
int_9 = Integer(or)
shift_5 = ShiftList(List=int_9, Shift=1, Wrap=True)
vec1_num_2 = Integer(int_9)
split_3 = TextSplit(Text=dispatch_2.ListA, Separators=",")  # -> simplify(Result)
split_4 = TextSplit(Text=dispatch_2.ListB, Separators=",")  # -> simplify(Result)
flip_2 = FlipMatrix(Data=split_3)
vec2_num_2 = Integer(shift_5)
flip_3 = FlipMatrix(Data=split_4)
panel_19 = Panel(dispatch.ListA)
split_5 = TextSplit(Text=offset_convertrule, Separators=",")
panel_20 = Panel(dispatch_2.ListA)
panel_21 = Panel(dispatch_2.ListB)
panel_22 = Panel(or)
concat_4 = Concatenate(FragmentA=vec1_num_2, FragmentB=vec2_num_2)
sort = SortList(Keys=dispatch.ListA, ValuesA=flip_2)  # -> Keys, ValuesA
sort_2 = SortList(Keys=dispatch.ListB, ValuesA=flip_3)  # -> Keys, ValuesA
item_6 = ListItem(List=split_5, Index=0, Wrap=False)  # -> Item, Item1
panel_23 = Panel("""in 
+ 0上2下
+ 3左1右
out(unfinished)
+ 2上1下
+ 1左3右""")
int_10 = Integer(sort.ValuesA)
int_11 = Integer(sort_2.ValuesA)
replace_3 = ReplaceMembers(Set=concat_4, Find=flatten(item_6.Item), Replace=flatten(item_6.Item1))
bang_2 = ExplodeTree(Data=int_10)  # -> Branch0, Branch1
int_12 = Integer("3")
int_13 = Integer("0")
bang_3 = ExplodeTree(Data=int_11)  # -> Branch0, Branch1
shift_6 = ShiftList(List=replace_3, Shift=-1, Wrap=True)
panel_24 = Panel(dispatch.ListB)
equals_2 = Equality(FirstNumber=bang_2.Branch1, SecondNumber=int_12)  # -> Equality, Inequality
equals_3 = Equality(FirstNumber=bang_3.Branch1, SecondNumber=int_13)  # -> Equality, Inequality
fst_offsetindex = Integer("0")
ma_2 = MassAddition(Input=shift_6)  # -> Result, PartialResults
dispatch_3 = Dispatch(List=bang_2.Branch0, DispatchPattern=equals_2.Equality)  # -> ListA, ListB
dispatch_4 = Dispatch(List=bang_3.Branch0, DispatchPattern=equals_3.Equality)  # -> ListA, ListB
addition_2 = Addition(A=fst_offsetindex, B=ma_2.PartialResults)
panel_25 = Panel(int_5)
graft = GraftTree(Tree=dispatch_3.ListA, IncludeEmptyLists=True, IncludeNullItems=True)
graft_2 = GraftTree(Tree=dispatch_4.ListA, IncludeEmptyLists=True, IncludeNullItems=True)
int_14 = Integer("4")
int_15 = Integer("0")
panel_26 = Panel(graft)
panel_27 = Panel("""0,2
1,3
2,0
3,1""")
concat_5 = Concatenate(FragmentA=graft, FragmentB=dispatch_3.ListB, JoinSeparator=",")
concat_6 = Concatenate(FragmentA=graft_2, FragmentB=dispatch_4.ListB, JoinSeparator=",")
panel_28 = Panel("""1,-1
-1,-1
-1,1
1,1""")
replace_4 = ReplaceMembers(Set=addition_2, Find=int_14, Replace=int_15)  # -> flatten(Result)
panel_29 = Panel("""偏移向量机制
+ 编号
+ 内外""")
offsetdirectioninverserule = Text(panel_27)
merge_3 = Merge(Data1=fst_offsetindex, Data2=replace_4)
merge_4 = Merge(Data1=concat_5, Data2=concat_6)  # -> flatten(Result)
offsetinstance_num = Number(Slider(1.81, range=0..10))
offset_veclst = Vector(panel_28)
offsetdirection = Boolean(Toggle(False))
split_6 = TextSplit(Text=merge_4, Separators=",")
offset_indexlst = Integer(merge_3)
offset_indexlst_2 = Integer(offset_indexlst)
split_7 = TextSplit(Text=offsetdirectioninverserule, Separators=",")
int_16 = Integer(split_7)
item_7 = ListItem(List=vec_xory, Index=split_6, Wrap=True)
item_8 = ListItem(List=item_7, Index=0, Wrap=True)  # -> Item, Item1
gate = StreamGate(Stream=offset_indexlst_2, Gate=offsetdirection)  # -> Target0, Target1
item_9 = ListItem(List=int_16, Index=0, Wrap=True)  # -> flatten(Item), flatten(Item1)
subtraction_4 = Subtraction(A=item_8.Item, B=item_8.Item1)
ptlst_2 = Point(ptlst)
replace_5 = ReplaceMembers(Set=gate.Target1, Find=item_9.Item, Replace=item_9.Item1)
abs = Absolute(Value=subtraction_4)
panel_30 = Panel(abs)
filter = StreamFilter(Gate=offsetdirection, Stream0=offset_indexlst_2, Stream1=replace_5)
sort_3 = SortList(Keys=flatten(abs), ValuesA=merge_4)  # -> Keys, ValuesA
item_10 = ListItem(List=offset_veclst, Index=filter, Wrap=False)
split_8 = TextSplit(Text=sort_3.ValuesA, Separators=",")
int_17 = Integer(split_8)
int_18 = Integer(series)
amp = Amplitude(Vector=item_10, Amplitude=offsetinstance_num)
sort_4 = SortList(Keys=int_17)  # -> Keys, ValuesA
panel_31 = Panel(int_18)
veclength = Number(vlen)
addition_3 = Addition(A=ptlst_2, B=amp)
pline_6 = PolyLine(Vertices=addition_3, Closed=False)
pt_3 = Point(pt1_2)
flatten = FlattenTree(Tree=int_17, Path="{0}")
sort_5 = SortList(Keys=split_8)  # -> Keys, ValuesA
int_19 = Integer(sort_4.Keys)
panel_32 = Panel(int_19)
python = PythonScript(vec_pair_lst=flatten, vecLength_lst=veclength, pts_lst=pt_3)  # -> out, a_lst, b; inputs vec_pair_lst: list of Int32, vecLength_lst: list, pts_lst: list of Point3d
# ---------- python: Python ----------
#a = 5
#b = a+4
#print (b)

#a_lst = []
#a1_lst = [1,2,3,4]
#a_lst.append(a1_lst)

##b = a_lst[0]
#print (3%2)


#firstly, deal with data formats 

vec_pair_lst_tmp = []
for vec_i in range(len(vec_pair_lst)):
    if (vec_i%2 == 0):
        vec_pair = []
        vec_pair.append(vec_pair_lst[vec_i])
        vec_pair.append(vec_pair_lst[vec_i + 1])
        vec_pair_lst_tmp.append(vec_pair)
vec_pair_lst = vec_pair_lst_tmp;del vec_pair_lst_tmp
print vec_pair_lst

print ("--------")
print (vecLength_lst)
print ("--------")

pts_lst_tmp_total = []
for i in range(len(pts_lst)):
    pts_lst_tmp_in = []
    pts_lst_tmp_in.append(pts_lst[i][0])
    pts_lst_tmp_in.append(pts_lst[i][1])           #just record x and y coodinates
    pts_lst_tmp_total.append(pts_lst_tmp_in)
pts_lst = pts_lst_tmp_total;del pts_lst_tmp_total  #redefine pts_lst,convert point3d to normal list
print (pts_lst)
print ("--------")
for i in range(len(vec_pair_lst)):
    #print i
    #print (vec_pair_lst[i])
    subt_i = abs(vec_pair_lst[i][0]-vec_pair_lst[i][1])
    #print (subt_i)
    if (subt_i == 2):
        print "0"
        #if ()
    else:
        print "1"
# ---------- end python ----------
item_11 = ListItem(List=sort_5.Keys, Index=0, Wrap=True)  # -> Item, Item1
item_12 = ListItem(List=int_19, Index=0, Wrap=True)  # -> Item, Item1
subtraction_5 = Subtraction(A=item_12.Item1, B=item_12.Item)
subtraction_6 = Subtraction(A=item_11.Item1, B=item_11.Item)
equals_4 = Equality(FirstNumber=subtraction_5, SecondNumber="2")  # -> flatten(Equality), Inequality
series_2 = Series(Start=item_11.Item, Step=1, Count=expr("x+1", subtraction_6))  # -> simplify(Series)
cull_i = CullIndex(List=int_18, Indices=series_2, Wrap=True)
panel_33 = Panel("""subt_i =? 2
分离和消失的分类讨论""")
bang_4 = ExplodeTree(Data=int_19)  # -> Branch0, Branch1
item_13 = ListItem(List=equals_4.Equality, Index=0, Wrap=True)  # -> Item, Item1
panel_34 = Panel(cull_i)
gate_2 = StreamGate(Stream=bang_4.Branch0, Gate=item_13.Item)  # -> Target0, Target1
gate_3 = StreamGate(Stream=bang_4.Branch1, Gate=item_13.Item1)  # -> Target0, Target1
veclength_2 = Number(veclength)
item_14 = ListItem(List=gate_2.Target1, Index=0, Wrap=True)  # -> Item, Item1
panel_35 = Panel("""1
2
3
4""")
item_15 = ListItem(List=veclength_2, Index=gate_2.Target1, Wrap=True)
panel_36 = Panel("""8
3
6
1""")
vec_distance = Number(panel_36)
vec_number = Integer(panel_35)
item_16 = ListItem(List=item_15, Index=0, Wrap=True)  # -> Item, Item1
# if vec1=vec2:
# del all (vec1_i,i+1;vec2_i,i+1)
# if vec1<vec2:
# del vec1_startPt(vec1_i)
# del vec1_endPt(vec1_i+1)
# del vec2_endPt(vec2_i+1)
# else:
vec1_i = Integer(item_14.Item)
vec2_i = Integer(item_14.Item1)
addition_4 = Addition(A=vec1_i, B=1)
addition_5 = Addition(A=vec2_i, B=1)
sort_6 = SortList(Keys=vec_distance, ValuesA=vec_number)  # -> Keys, ValuesA
subtraction_7 = Subtraction(A=item_16.Item, B=item_16.Item1)
vec1_start_i = Integer(vec1_i)
vec1_end_i = Integer(addition_4)
vec2_start_i = Integer(vec2_i)
vec_length = Number()
vec2_end_i = Integer(addition_5)
panel_37 = Panel("""1,3
+ x = vec2_end_x
+ y = vec1_end_y
0,2
+ x = vec1_end_x
+ y = vec2_end_y""")
equals_5 = Equality(FirstNumber=subtraction_7, SecondNumber="0")  # -> Equality, Inequality
merge_5 = Merge(Data1=vec1_start_i, Data2=vec1_end_i, Data3=vec2_start_i, Data4=vec2_end_i)
panel_38 = Panel("""0
1""")
panel_39 = Panel("""0
1""")
filter_2 = StreamFilter(Gate=equals_5.Equality, Stream1=merge_5)
addition_6 = Addition(A=vec1_i, B=panel_38)
addition_7 = Addition(A=vec2_i, B=panel_39)
smaller = SmallerThan(FirstNumber=subtraction_7, SecondNumber="0")  # -> SmallerThan, OrEqualTo
smaller_2 = SmallerThan(SecondNumber=0)  # -> SmallerThan, OrEqualTo
panel_40 = Panel(sort_6.ValuesA)
equals_6 = Equality(FirstNumber=subtraction_7, SecondNumber="0")  # -> Equality, Inequality
gate_4 = StreamGate(Gate=0)  # -> Target0, Target1
not_2 = GateNot(A=smaller.SmallerThan)
bool = Boolean()
item_17 = ListItem(List=addition_7, Index=0, Wrap=True)  # -> Item, Item1
item_18 = ListItem(List=addition_6, Index=0, Wrap=True)  # -> Item, Item1
merge_6 = Merge(Data1=addition_6, Data2=addition_7)
merge_7 = Merge(Data1=vec2_end_i, Data2=vec1_end_i)
merge_8 = Merge(Data1=vec1_end_i, Data2=vec2_end_i)
lastpoint_i = Integer(int_18)
filter_3 = StreamFilter(Gate=smaller.SmallerThan, Stream0=addition_7, Stream1=addition_6)
filter_4 = StreamFilter(Gate=smaller.SmallerThan, Stream0=item_18.Item1, Stream1=item_17.Item1)
filter_5 = StreamFilter(Gate=equals_6.Equality, Stream1=merge_6)
filter_6 = StreamFilter(Gate=not_2, Stream0=addition_7, Stream1=addition_6)
filter_7 = StreamFilter(Gate=not_2, Stream0=item_18.Item1, Stream1=item_17.Item1)
item_19 = ListItem(List=pt_3, Index=merge_8, Wrap=True)
item_20 = ListItem(List=pt_3, Index=merge_7, Wrap=True)
merge_9 = Merge(Data1=filter_4, Data2=filter_3)
complex_4 = ComplexComponents(Complex=item_19)  # -> Real, Imaginary
complex_5 = ComplexComponents(Complex=item_20)  # -> Real, Imaginary
merge_10 = Merge(Data1=filter_7, Data2=filter_6)
lastptslst = Point(pt_3)
cull_i_2 = CullIndex(List=lastpoint_i, Indices=filter_5, Wrap=True)
cull_i_3 = CullIndex(List=lastpoint_i, Indices=merge_9, Wrap=True)
panel_41 = Panel(complex_4.Imaginary)
panel_42 = Panel(complex_4.Real)
panel_43 = Panel(complex_5.Real)
panel_44 = Panel(complex_5.Imaginary)
lastpoint_i_2 = Integer(cull_i_2)
path = ConstructPath(Indices=graft(lastpoint_i_2))  # -> simplify(Branch)
path_2 = ConstructPath(Indices=graft(cull_i_3))  # -> simplify(Branch)
lastpoint_i_3 = Integer(cull_i_3)
cull_i_4 = CullIndex(List=lastpoint_i_3, Indices=merge_10, Wrap=True)
path_3 = ConstructPath(Indices=graft(cull_i_4))  # -> simplify(Branch)
item_21 = ListItem(List=complex_4.Real, Index=0, Wrap=True)  # -> Item, Item1
item_22 = ListItem(List=complex_4.Imaginary, Index=0, Wrap=True)  # -> Item, Item1
item_23 = ListItem(List=complex_5.Real, Index=0, Wrap=True)  # -> Item, Item1
item_24 = ListItem(List=complex_5.Imaginary, Index=0, Wrap=True)  # -> Item, Item1
lastpoint_i_4 = Integer(cull_i_4)
branch = TreeBranch(Tree=simplify(graft(lastptslst)), Path=path, MaintainPaths=True)
branch_2 = TreeBranch(Tree=simplify(graft(lastptslst)), Path=path_2, MaintainPaths=True)
complex_6 = CreateComplex(Real=item_23.Item, Imaginary=item_24.Item1)
complex_7 = CreateComplex(Real=item_21.Item, Imaginary=item_22.Item1)
panel_45 = Panel("ADD")
branch_3 = TreeBranch(Tree=simplify(graft(lastptslst)), Path=path_3, MaintainPaths=True)
pt_4 = Point(complex_6)
pt_5 = Point(complex_7)
panel_46 = Panel(branch_3)
panel_47 = Panel(branch_2)
filter_8 = StreamFilter(Gate=smaller.SmallerThan, Stream0=branch_3, Stream1=branch_2)
filter_9 = StreamFilter(Gate=smaller.SmallerThan, Stream0=lastpoint_i_4, Stream1=lastpoint_i_3)
lastpointlst = Point(filter_8)
lastpoint_i_5 = Integer(filter_9)
