# Grasshopper definition 20161017_sortList_gh_python.gh (Grasshopper 0.9.76)
# plug-ins: Python Interpreter

series = Series(Start=Slider(7, range=0..10), Step=Slider(3, range=0..10), Count=Slider(6, range=0..10))
pt = Point([Point(7, -9, 0), Point(-12, -6, 0), Point(-2, -2, 0), Point(18, -4, 0), Point(12, 4, 0), Point(-8, 4, 0), Point(1, 9, 0), Point(16, 9, 0)])
panel = Panel(pt)
lng = ListLength(List=pt)
jitter = Jitter(List=series, Jitter=1, Seed=Slider(33.22, range=0..100))  # -> Values, Indices
pt_2 = Point([Point(7, -9, 0), Point(-12, -6, 0), Point(-2, -2, 0), Point(18, -4, 0), Point(12, 4, 0), Point(-8, 4, 0), Point(1, 9, 0), Point(16, 9, 0)])
series_2 = Series(Start=0, Step=1, Count=lng)
complex = ComplexComponents(Complex=pt)  # -> Real, Imaginary
rev = ReverseList(List=jitter.Values)
panel_2 = Panel("""0
5
-1
3
4
2
1""")
panel_3 = Panel(pt_2)
num = Number(flatten(rev))
lng_2 = ListLength(List=num)
series_3 = Series(Start=0, Step=1, Count=lng_2)
jitter_2 = Jitter(List=series_3, Jitter=1, Seed=Slider(18.61, range=0..100))  # -> Values, Indices
rev_2 = ReverseList(List=series_3)
num_2 = Number(flatten(jitter_2.Values))
python = PythonScript(x=panel_2, pts=pt_2)  # -> out, a, b; inputs x: list, y: list, pts: list
# ---------- python: Python ----------
from rhinoscriptsyntax import coerce3dpointlist
help(sorted)
#sort float
a = sorted(x)

#sort strings
def myKey(s):
    return s[0]
    
s0 = ['amy','cname','dis','btim']
s1 = sorted(s0,key = myKey)
print (s1)

#sort points
pts_3d = coerce3dpointlist(pts)
#print (pts_3d[1])
def getPtKey(pt):
    return pt[1]

#for i in range(len(pts_3d)):
    #print (pts_3d[i][0])
ptSorted_list = sorted(pts_3d,key = getPtKey)
print (ptSorted_list)
b = ptSorted_list
# ---------- end python ----------
sort = SortList(Keys=series_2, ValuesA=pt)  # -> Keys, ValuesA
panel_4 = Panel(series_2)
panel_5 = Panel(num)
panel_6 = Panel(num_2)
sort_2 = SortList(Keys=num, ValuesA=num)  # -> Keys, ValuesA
panel_7 = Panel(python.a)
panel_8 = Panel(sort.Keys)
panel_9 = Panel(sort.ValuesA)
panel_10 = Panel(python.b)
panel_11 = Panel(sort_2.Keys)
panel_12 = Panel(sort_2.ValuesA)
pt_3 = Point(pt)
panel_13 = Panel(pt_3)
num_3 = Number(complex.Real)
panel_14 = Panel(num_3)
python_2 = PythonScript(keys0=num_3, values0=pt_3)  # -> keys1, values1; inputs keys0: list, values0: list
# ---------- python_2: Python ----------
print (type(keys0))
keys1 = sorted(keys0)
keys = {}
for i in range(len(keys0)):
    keys[i] =  keys0[i]
print (keys)
# ---------- end python_2 ----------
panel_15 = Panel(python_2.keys1)
