# Grasshopper definition randomSrf.gh (Grasshopper 0.9.76)
# plug-ins: Python Interpreter

cir = Circle(Plane=PlaneXY(0, 0, 0), Radius=Slider(10, range=0..10))
python = PythonScript(cir=cir, div_n=Slider(44, range=0..100))  # -> out, move_z, random_z, a; inputs div_n: Int32
# ---------- python: Python ----------
import rhinoscriptsyntax as rs
import random

move_z = []
random_z = []
loftList = []
for i in xrange(0,50,10):
    move_z.append(i)
    newCir = rs.MoveObject(cir,(0,0,i))
    center = rs.CurveAreaCentroid(newCir)[0]
    div = rs.DivideCurve(newCir,div_n)
    #print (type(div))
    curveList = []
    for pt in div:
        rand = random.uniform(-0.5,0.5)
        random_z.append(rand)
        vec = rs.VectorCreate(center,pt)
        vec = rs.VectorScale(vec,rand)
        pt = rs.AddPoint(pt)
        guid_pt = rs.MoveObject(pt,vec)
        curveList.append(guid_pt)
    
    curveList.append(curveList[0])
    print (type(curveList))
    curve = rs.AddCurve(curveList,3)
    loftList.append(curve)

a = rs.AddLoftSrf(loftList)
# ---------- end python ----------
