# Grasshopper definition rhinocommon_dll.gh (Grasshopper 0.9.76)
# plug-ins: Python Interpreter

python = PythonScript()  # -> out, a, tree
# ---------- python: Python ----------
from Grasshopper.Kernel.Data import GH_Path
from Grasshopper import DataTree

tree = DataTree[object]()

path = 0
for i in xrange(8):
    a = []
    for j in xrange(8):
        if (i%2 != 0) and (j%2 == 0):
            a.append((i,j))
    tree.AddRange(a,GH_Path(path))
    path+=1
print (a)
# ---------- end python ----------
python_2 = PythonScript()  # -> out, list, tree
# ---------- python_2: Python ----------
from Grasshopper.Kernel.Data  import GH_Path
from Grasshopper import DataTree

tree = DataTree[object]()

list = []

for i in xrange(8):
    if i%2 != 0:
        a = []
        for j in xrange(8):
            if (j%2 == 0):
                a.append((i,j))
        list.append(a)
        
for i,k in enumerate(list):
    tree.AddRange(k,GH_Path(i))
# ---------- end python_2 ----------
panel = Panel(python.tree)
panel_2 = Panel(python_2.tree)
srf4pt = _4PointSurface()
crv = Curve(<curve referenced from the Rhino model>)
crv_2 = Curve(<curve referenced from the Rhino model>)
crv_3 = Curve(<curve referenced from the Rhino model>)
c_script = CSharpScript(x=crv_2, y=crv_3)  # -> out, A; inputs x: Curve, y: Curve
# ---------- c_script: C# ----------
    A = Curve.CreateTweenCurves(x, y, 3);
# ---------- end c_script ----------
eval = EvaluateCurve(Curve=crv, Parameter=Slider(20, range=0..100))  # -> Point, Tangent, Angle
python_3 = PythonScript(x=crv)  # -> out, a; inputs x: Curve, y: Curve
# ---------- python_3: Python ----------
a = x.PointAt(20)
# ---------- end python_3 ----------
python_4 = PythonScript(x=crv_2, y=crv_3)  # -> out, a; inputs x: Curve, y: Curve
# ---------- python_4: Python ----------
a = x.CreateTweenCurves(x,y,2)
# ---------- end python_4 ----------
python_5 = PythonScript(x=crv_2, y=crv_3)  # -> out, a; inputs x: Curve, y: Curve
# ---------- python_5: Python ----------
from Rhino.Geometry import Curve

a = Curve.CreateTweenCurves(x,y,4)
# ---------- end python_5 ----------
pt = Point(Point(36.6045059, 5.069496161, 0))
crv_4 = Curve(<curve referenced from the Rhino model>)
python_6 = PythonScript(x=crv_4, y=pt)  # -> out, a; inputs x: Curve, y: Point3d
# ---------- python_6: Python ----------
a = x.ClosestPoint(y)
# ---------- end python_6 ----------
panel_3 = Panel(python_6.a)
