# Grasshopper definition 160913_haystack_001_input.gh (Grasshopper 0.9.76)

file = ReadFile(File="E:/tim/prac/py/class/haystack/data.txt", PerLineParse=True)
panel = Panel(file)
chars = Characters()  # -> Result, Unicode
split = TextSplit(Text=file, Separators="*")
item = ListItem(List=split, Index=-1, Wrap=True)
shift = ShiftList(List=split, Shift=-1, Wrap=False)
split_2 = TextSplit(Text=item, Separators="/")
split_3 = TextSplit(Text=shift, Separators=":")  # -> simplify(Result)
shift_2 = ShiftList(List=split_2, Shift=-1, Wrap=False)  # -> simplify(List)
item_2 = ListItem(List=split_3, Index="0", Wrap=True)
item_3 = ListItem(List=split_3, Index="1", Wrap=True)
split_4 = TextSplit(Text=shift_2, Separators=",")  # -> simplify(Result)
split_5 = TextSplit(Text=item_3, Separators=";")  # -> simplify(Result)
item_4 = ListItem(List=split_4, Index=0, Wrap=True)  # -> Item, Item1, Item2
item_5 = ListItem(List=split_5, Index="0", Wrap=True)
item_6 = ListItem(List=split_5, Index="1", Wrap=True)
pt = ConstructPoint(XCoordinate=item_4.Item, YCoordinate=item_4.Item1, ZCoordinate=item_4.Item2)  # -> flatten(Point)
split_6 = TextSplit(Text=item_5, Separators=",")  # -> simplify(Result)
pline = PolyLine(Vertices=pt, Closed=False)
item_7 = ListItem(List=split_6, Index=0, Wrap=True)  # -> Item, Item1, Item2
pt_2 = ConstructPoint(XCoordinate=item_7.Item, YCoordinate=item_7.Item1, ZCoordinate=item_7.Item2)
cir = Circle(Plane=pt_2, Radius=item_6)
panel_2 = Panel(split_6)
panel_3 = Panel(cir)
