# Grasshopper definition 20170302_tim_weight_list_no-loop.gh (Grasshopper 0.9.76)

panel = Panel("31,29,12,17,8;29,19,5,10,3")  # disabled
txt = Text("31,29,12,17,8;29,19,5,10,3")
split = TextSplit(Text="3,0,1,2,4", Separators=",")  # -> simplify(Result)
lng = ListLength(List=split)
series = Series(Start=0, Step=1, Count=lng)
split_2 = TextSplit(Text=txt, Separators=";")
txt_2 = Text(panel)  # disabled
panel_2 = Panel(";")  # disabled
int = Integer(series)
int_2 = Integer(split)
split_3 = TextSplit(Text=split_2, Separators=",")  # -> simplify(Result)
split_4 = TextSplit(Text=txt_2, Separators=panel_2)  # disabled
mindex = MemberIndex(Set=int_2, Member=int)  # -> Index, Count
number_slider = Slider(0, range=0..50)  # disabled
number_slider_2 = Slider(0, range=0..100)  # disabled
dt = Number(Slider(45, range=0..50))
panel_3 = Panel(",")  # disabled
index_sort = Integer(mindex.Index)
flip = FlipMatrix(Data=split_3)
panel_4 = Panel(flip)
split_5 = TextSplit(Text=split_4, Separators=panel_3)  # -> simplify(Result); disabled
viewer = ParamViewer(flip)
path = ConstructPath(Indices=index_sort)
bang = ExplodeTree(Data=split_5)  # -> Branch0, Branch1; disabled
lng_2 = ListLength(List=bang.Branch0)  # disabled
n = Integer(lng_2)  # disabled
a_change = Number(number_slider)  # disabled
a_index = Integer(number_slider_2)  # disabled
replace = ReplacePaths(Data=flip, Search=viewer, Replace=flatten(path))
flip_2 = FlipMatrix(Data=split_5)  # disabled
series_2 = Series(Start=0, Step=1, Count=n)  # disabled
flip_3 = FlipMatrix(Data=replace)
viewer_2 = ParamViewer(flip_2)  # disabled
panel_5 = Panel(flip_2)  # disabled
int_3 = Integer(series_2)  # disabled
sort = SortList(Keys=bang.Branch0, ValuesA=int_3)  # -> Keys, ValuesA; disabled
bang_2 = ExplodeTree(Data=flip_3)  # -> Branch0, Branch1
subtraction = Subtraction(A=bang.Branch0, B=bang.Branch1)  # disabled
path_2 = ConstructPath(Indices=graft(sort.ValuesA))  # disabled
num = Number(subtraction)  # disabled
value_sorted = Number(bang_2.Branch0)
lng_3 = ListLength(List=value_sorted)
min_list = Number(bang_2.Branch1)

# ----
# changeList
panel_6 = Panel("0")
value_sorted_2 = Number(value_sorted)
a_change_2 = Number(dt)
int_4 = Integer(panel_6)
min_list_2 = Number(min_list)
item = ListItem(List=value_sorted_2, Index=int_4, Wrap=True)
addition = Addition(A=item, B=a_change_2)
replace_2 = ReplaceItems(List=value_sorted_2, Item=addition, Indices=int_4, Wrap=False)
value_changed = Number(replace_2)

replace_3 = ReplacePaths(Data=flip_2, Search=viewer_2, Replace=flatten(path_2))  # disabled
# 1,0,2,-1,-1
# 
# -1 --> min
# 2  --> 趋向min
# 1  --> change
graft = GraftTree(Tree=replace_3, IncludeEmptyLists=True, IncludeNullItems=True)  # disabled
viewer_3 = ParamViewer(graft)  # disabled
sort_2 = SortList(Keys=flatten(graft), ValuesA=flatten(viewer_3))  # -> Keys, ValuesA; disabled
panel_7 = Panel(sort_2.Keys)  # disabled
path_3 = DataPath(path_2)  # disabled
panel_8 = Panel(num)  # disabled
dpath = DeconstructPath(Branch=path_3)  # disabled
subtraction_2 = Subtraction(A=value_sorted, B=min_list)

# ----
# 从排序后的末尾数n个值到达最小
# 余量的情况处理
rev = ReverseList(List=subtraction_2)
ma = MassAddition(Input=rev)  # -> Result, PartialResults
larger = LargerThan(FirstNumber=dt, SecondNumber=ma.PartialResults)  # -> LargerThan, OrEqualTo
n_2 = Integer(lng_3)
mindex_2 = MemberIndex(Set=larger.LargerThan, Member=Toggle(False))  # -> Index, Count
equals = Equality(FirstNumber=mindex_2.Count, SecondNumber="0")  # -> Equality, Inequality
subtraction_3 = Subtraction(A=n_2, B=1)
item_2 = ListItem(List=mindex_2.Index, Index=0, Wrap=True)
filter = StreamFilter(Gate=equals.Equality, Stream0=item_2, Stream1=subtraction_3)

item_3 = ListItem(List=replace_3, Index=0, Wrap=True)  # -> flatten(Item); disabled
flip_4 = FlipMatrix(Data=replace_3)  # disabled
item_4 = ListItem(List=num, Index=dpath, Wrap=True)  # -> flatten(Item); disabled
bang_3 = ExplodeTree(Data=flip_4)  # -> Branch0, Branch1; disabled
branch = TreeBranch(Tree=graft, Path=sort_2.ValuesA, MaintainPaths=True)  # disabled
int_5 = Integer(filter)
ma_2 = MassAddition(Input=reverse(item_4))  # -> Result, PartialResults; disabled

# ----
# changeList
min_list_3 = Number(bang_3.Branch1)  # disabled
value_sorted_3 = Number(bang_3.Branch0)  # disabled
a_change_3 = Number(a_change)  # disabled
a_index_2 = Integer(a_index)  # disabled
item_5 = ListItem(List=value_sorted_3, Index=a_index_2, Wrap=True)  # disabled
addition_2 = Addition(A=item_5, B=a_change_3)  # disabled
replace_4 = ReplaceItems(List=value_sorted_3, Item=addition_2, Indices=a_index_2, Wrap=False)  # disabled
value_changed_2 = Number(replace_4)  # disabled

larger_2 = LargerThan(FirstNumber=a_change, SecondNumber=ma_2.PartialResults)  # -> LargerThan, OrEqualTo; disabled
panel_10 = Panel(sort_2.ValuesA)  # disabled

series_3 = Series(Start=-1, Step=-1, Count=int_5)
item_6 = ListItem(List=subtraction_2, Index=series_3, Wrap=True)
shift = ShiftList(List=value_changed, Shift=expr("- x", int_5), Wrap=False)
ma_3 = MassAddition(Input=item_6)  # -> Result, PartialResults
item_7 = ListItem(List=shift, Index=-1, Wrap=True)
subtraction_4 = Subtraction(A=dt, B=ma_3.Result)
subtraction_5 = Subtraction(A=item_7, B=subtraction_4)
replace_5 = ReplaceItems(List=shift, Item=subtraction_5, Indices=-1, Wrap=True)
result_value = Number(subtraction_4)

series_4 = Series(Start=-1, Step=-1, Count=int_5)
item_8 = ListItem(List=min_list, Index=series_4, Wrap=True)
minvalue_list = Number(reverse(item_8))

toggle = BooleanToggle(False)  # disabled
panel_11 = Panel(ma_2.PartialResults)  # disabled
rev_2 = ReverseList(List=larger_2.LargerThan)  # disabled
panel_12 = Panel(branch)  # disabled
mindex_3 = MemberIndex(Set=rev_2, Member=toggle)  # -> Index, Count; disabled
panel_13 = Panel("0")  # disabled
panel_14 = Panel(bang_3.Branch0)  # disabled
stack = StackData(Data=panel_13, Stack=expr("x -  1", n))  # disabled
item_9 = ListItem(List=mindex_3.Index, Index=-1, Wrap=True)  # disabled
panel_15 = Panel("1")  # disabled
ins = InsertItems(List=stack, Item=panel_15, Indices=item_9, Wrap=True)  # disabled
panel_16 = Panel(value_changed_2)  # disabled
item_10 = ListItem(List=flip, Index=0, Wrap=True)
weight_list = Integer(ins)  # disabled

# ----
# contributeWeight
ma_4 = MassAddition(Input=value_changed_2)  # -> Result, PartialResults; disabled
ma_5 = MassAddition(Input=bang.Branch0)  # -> Result, PartialResults; disabled
item_11 = ListItem(List=ma_4.PartialResults, Index=-1, Wrap=True)  # disabled
item_12 = ListItem(List=ma_5.PartialResults, Index=-1, Wrap=True)  # disabled
sum_original = Number(item_12)  # disabled
sum_list = Number(item_11)  # disabled
subtraction_6 = Subtraction(A=sum_original, B=sum_list)  # disabled
dt_2 = Number(subtraction_6)  # disabled
multiplication = Multiplication(A=dt_2, B=weight_list)  # disabled
addition_3 = Addition(A=value_changed_2, B=multiplication)  # disabled

merge = Merge(Data1=flatten(replace_5), Data2=flatten(minvalue_list))
merge_2 = Merge(Data1="0", Data2=flatten(item_10))
item_13 = ListItem(List=merge, Index=flatten(index_sort), Wrap=True)
merge_3 = Merge(Data1=flatten("0"), Data2=flatten(item_13))
ma_6 = MassAddition(Input=merge_2)  # -> Result, PartialResults
panel_17 = Panel(weight_list)  # disabled
ma_7 = MassAddition(Input=merge_3)  # -> Result, PartialResults
panel_18 = Panel(item_13)
pt = PointOriented(BasePlane=PlaneXY(0, 0, 0), UComponent=ma_6.PartialResults, VComponent=0, WComponent=0)
pt_2 = PointOriented(BasePlane=PlaneXY(0, 0, 0), UComponent=ma_7.PartialResults, VComponent=Slider(2, range=0..10), WComponent=0)
pline = PolyLine(Vertices=pt, Closed=False)
pline_2 = PolyLine(Vertices=pt_2, Closed=False)
# testMinmum
# changeWeightList
panel_19 = Panel(addition_3)  # disabled
