# Grasshopper definition 20170302_胡廷威_weightList_no-loop.gh (Grasshopper 0.9.76)

# 输入：
# 各段长度集合，各段最小值，权重序号
# 输出：
# 排列后的列表
panel = Panel("31,29,12,17,8;29,19,5,10,3")
originalvalue_min_list = Text(panel)
weightindex = Text("3,0,1,2,4")
split = TextSplit(Text=originalvalue_min_list, Separators=";")
split_2 = TextSplit(Text=weightindex, Separators=",")  # -> simplify(Result)
lng = ListLength(List=split_2)
series = Series(Start=0, Step=1, Count=lng)
int = Integer(series)
int_2 = Integer(split_2)
split_3 = TextSplit(Text=split, Separators=",")  # -> simplify(Result)
dt = Number(Slider(12, range=0..50))
mindex = MemberIndex(Set=int_2, Member=int)  # -> Index, Count
index_sort = Integer(mindex.Index)
flip = FlipMatrix(Data=split_3)
viewer = ParamViewer(flip)
path = ConstructPath(Indices=index_sort)
replace = ReplacePaths(Data=flip, Search=viewer, Replace=flatten(path))
flip_2 = FlipMatrix(Data=replace)
bang = ExplodeTree(Data=flip_2)  # -> Branch0, Branch1
value_sorted = Number(bang.Branch0)

# ----
# 按照权序改变列表
panel_2 = Panel("0")
value_sorted_2 = Number(value_sorted)
a_change = Number(dt)
int_3 = Integer(panel_2)
item = ListItem(List=value_sorted_2, Index=int_3, Wrap=True)
addition = Addition(A=item, B=a_change)
replace_2 = ReplaceItems(List=value_sorted_2, Item=addition, Indices=int_3, Wrap=False)
value_changed = Number(replace_2)

min_list = Number(bang.Branch1)
subtraction = Subtraction(A=value_sorted, B=min_list)

# ----
# 排序后从尾数的m个值已到达最小
rev = ReverseList(List=subtraction)
lng_2 = ListLength(List=value_sorted)
ma = MassAddition(Input=rev)  # -> Result, PartialResults
n = Integer(lng_2)
larger = LargerThan(FirstNumber=dt, SecondNumber=ma.PartialResults)  # -> LargerThan, OrEqualTo
subtraction_2 = Subtraction(A=n, B=1)
mindex_2 = MemberIndex(Set=larger.LargerThan, Member=Toggle(False))  # -> Index, Count
equals = Equality(FirstNumber=mindex_2.Count, SecondNumber=0)  # -> Equality, Inequality
item_2 = ListItem(List=mindex_2.Index, Index=0, Wrap=True)
filter = StreamFilter(Gate=equals.Equality, Stream0=item_2, Stream1=subtraction_2)
m_int = Integer(filter)

# ----
# 只对倒序m+1个值进行计算
series_2 = Series(Start=-1, Step=-1, Count=m_int)
item_3 = ListItem(List=subtraction, Index=series_2, Wrap=True)
shift = ShiftList(List=value_changed, Shift=expr("- x", m_int), Wrap=False)
ma_2 = MassAddition(Input=item_3)  # -> Result, PartialResults
item_4 = ListItem(List=shift, Index=-1, Wrap=True)
subtraction_3 = Subtraction(A=dt, B=ma_2.Result)
subtraction_4 = Subtraction(A=item_4, B=subtraction_3)
result_value = Number(subtraction_3)
replace_3 = ReplaceItems(List=shift, Item=subtraction_4, Indices=-1, Wrap=True)

series_3 = Series(Start=-1, Step=-1, Count=m_int)
item_5 = ListItem(List=min_list, Index=series_3, Wrap=True)
minvalue_list = Number(reverse(item_5))

panel_3 = Panel(replace)
item_6 = ListItem(List=flip, Index=0, Wrap=True)
merge = Merge(Data1=flatten(replace_3), Data2=flatten(minvalue_list))
merge_2 = Merge(Data1="0", Data2=flatten(item_6))
item_7 = ListItem(List=merge, Index=flatten(index_sort), Wrap=True)
merge_3 = Merge(Data1=flatten("0"), Data2=flatten(item_7))
ma_3 = MassAddition(Input=merge_2)  # -> Result, PartialResults
ma_4 = MassAddition(Input=merge_3)  # -> Result, PartialResults
finally_list = Number(item_7)
pt = PointOriented(BasePlane=PlaneXY(0, 0, 0), UComponent=ma_3.PartialResults, VComponent=0, WComponent=0)
pt_2 = PointOriented(BasePlane=PlaneXY(0, 0, 0), UComponent=ma_4.PartialResults, VComponent=Slider(4, range=0..10), WComponent=0)
panel_4 = Panel(finally_list)
pline = PolyLine(Vertices=pt, Closed=False)
pline_2 = PolyLine(Vertices=pt_2, Closed=False)
